# Grasshopper definition curve_near_pt.ghx (Grasshopper 0.9.14)
# plug-ins: Decodes Python Interpreter

line = Line(Line((5.664457761, 0.0845090736, 0), (0, 0, 0)))
line_2 = Line(Line((5.940343864, -2.058875642, 0), (-0.04674038574, -1.892951829, 0)))
pt = Point([<point referenced from the Rhino model> x102])
curvepoint = PointOnCurve([line, line_2], parameter=0)
line_3 = Line(Line((0, 0, 0), (10, 10, 0)))  # disabled
decodes = DecodesPythonScript(pt=pt)  # -> console, a; disabled
# ---------- decodes: Python ----------
def func(t):
    return Point(t,t)
crv = Curve(func,Interval(0,10))

near_pt, near_t = crv.near(pt) 

a.put(near_pt)
# ---------- end decodes ----------
crv_cp = CurveCP(Point=pt, Curve=line_3)  # -> Point, Parameter, Distance; disabled
decodes_2 = DecodesPythonScript(pt=curvepoint)  # -> console, a, b
# ---------- decodes_2: Python ----------
def func(t):
    return Point(t,math.sin(t))
crv = Curve(func,Interval(0,math.pi*2))


near_pt, near_t = crv.near(pt)

a.put(near_pt)
b.put(crv)
# ---------- end decodes_2 ----------
dist = Distance(PointA=curvepoint, PointB=decodes_2.a)
panel = Panel(decodes.a)  # disabled
panel_2 = Panel(crv_cp.Point)  # disabled
dist_2 = Distance(PointA=crv_cp.Point, PointB=decodes.a)  # disabled
cir = Circle(Plane=curvepoint, Radius=dist)
graph = QuickGraph(dist_2)  # disabled
sort = SortList(Keys=dist_2)  # -> Keys, ValuesA; disabled
panel_3 = Panel(sort.Keys)  # disabled
