# Grasshopper definition near_unit_test.gh (Grasshopper 0.9.14)
# plug-ins: Decodes Python Interpreter

series = Series(Start=0, Step=1, Count=10)
sin = Sine(Value=series)

# ---- group: testing near_pt on segment
slider = Slider(7.29, range=0..10)  # disabled
slider_2 = Slider(8.03, range=0..10)  # disabled
slider_3 = Slider(4.37, range=0..10)  # disabled
slider_4 = Slider(-2.88, range=-10..10)  # disabled
slider_5 = Slider(1.04, range=0..10)  # disabled
slider_6 = Slider(1.25, range=0..10)  # disabled
slider_7 = Slider(5, range=0..10)  # disabled
pt = PointXYZ(XComponent=0, YComponent=0, ZComponent=0, System=PlaneXY(0, 0, 0))  # disabled
vec = VectorXYZ(XComponent=slider, YComponent=slider_3, ZComponent=slider_2)  # -> Vector, Length; disabled
pt_2 = PointXYZ(XComponent=slider_4, YComponent=slider_6, ZComponent=slider_5, System=PlaneXY(0, 0, 0))  # disabled
line = LineSDL(Start=pt, Direction=vec.Vector, Length=slider_7)  # disabled
decodes = DecodesPythonScript(x=line, u=pt_2)  # -> console, a; disabled
# ---------- decodes: Python ----------
near = x.near(u)
a.put(near[0])
# ---------- end decodes ----------

# ---- group: testing near_pt on ray
slider_8 = Slider(7.29, range=0..10)  # disabled
slider_9 = Slider(4.37, range=0..10)  # disabled
slider_10 = Slider(2.11, range=0..10)  # disabled
slider_11 = Slider(10, range=-10..10)  # disabled
slider_12 = Slider(10, range=0..10)  # disabled
slider_13 = Slider(1.04, range=0..10)  # disabled
pt_3 = PointXYZ(XComponent=0, YComponent=0, ZComponent=0, System=PlaneXY(0, 0, 0))  # disabled
vec_2 = VectorXYZ(XComponent=slider_8, YComponent=slider_9, ZComponent=slider_10)  # -> Vector, Length; disabled
pt_4 = PointXYZ(XComponent=slider_11, YComponent=slider_12, ZComponent=slider_13, System=PlaneXY(0, 0, 0))  # disabled
decodes_2 = DecodesPythonScript(x=pt_3, y=vec_2.Vector, u=pt_4)  # -> console, a, b; disabled
# ---------- decodes_2: Python ----------
ray = Ray(x,y)
near = ray.near(u)
a.put(near[0])
b.put(ray)
# ---------- end decodes_2 ----------

# ---- group: testing near_pt on line
slider_14 = Slider(0.63, range=0..10)  # disabled
slider_15 = Slider(7.29, range=0..10)  # disabled
slider_16 = Slider(4.37, range=0..10)  # disabled
slider_17 = Slider(1.28, range=0..10)  # disabled
slider_18 = Slider(5.01, range=0..10)  # disabled
slider_19 = Slider(1.09, range=0..10)  # disabled
slider_20 = Slider(10, range=-10..10)  # disabled
slider_21 = Slider(10, range=0..10)  # disabled
slider_22 = Slider(0.66, range=0..10)  # disabled
vec_3 = VectorXYZ(XComponent=slider_14, YComponent=slider_18, ZComponent=slider_19)  # -> Vector, Length; disabled
vec_4 = VectorXYZ(XComponent=slider_15, YComponent=slider_16, ZComponent=slider_17)  # -> Vector, Length; disabled
pt_5 = PointXYZ(XComponent=slider_20, YComponent=slider_21, ZComponent=slider_22, System=PlaneXY(0, 0, 0))  # disabled
decodes_3 = DecodesPythonScript(x=vec_3.Vector, y=vec_4.Vector, u=pt_5)  # -> console, a, b; disabled
# ---------- decodes_3: Python ----------
line = Line(x,y)
near = line.near(u)
a.put(near[0])
b.put(line)
# ---------- end decodes_3 ----------

# ---- group: testing near_pt on plane
slider_23 = Slider(7.88, range=0..10)  # disabled
slider_24 = Slider(0.63, range=0..10)  # disabled
slider_25 = Slider(10, range=0..10)  # disabled
slider_26 = Slider(5.31, range=0..10)  # disabled
slider_27 = Slider(0.27, range=-10..10)  # disabled
slider_28 = Slider(2.2, range=0..10)  # disabled
vec_5 = VectorXYZ(XComponent=slider_24, YComponent=slider_25, ZComponent=slider_26)  # -> Vector, Length; disabled
pt_6 = PointXYZ(XComponent=slider_27, YComponent=slider_23, ZComponent=slider_28, System=PlaneXY(0, 0, 0))  # disabled
decodes_4 = DecodesPythonScript(x=vec_5.Vector, u=pt_6)  # -> console, a, b; disabled
# ---------- decodes_4: Python ----------
plane = Plane(normal=x)
near = plane.near(u)
a.put(near)
b.put(plane)
# ---------- end decodes_4 ----------

# ---- group: testing near_pt on segment
pt_7 = PointXYZ(XComponent=series, YComponent=sin, ZComponent=0, System=PlaneXY(0, 0, 0))
vec_6 = VectorXYZ(XComponent=Slider(7.29, range=0..10), YComponent=Slider(4.37, range=0..10), ZComponent=Slider(8.03, range=0..10))  # -> Vector, Length
pt_8 = PointXYZ(
    XComponent=Slider(-2.88, range=-10..10),
    YComponent=Slider(1.25, range=0..10),
    ZComponent=Slider(1.04, range=0..10),
    System=PlaneXY(0, 0, 0))
line_2 = LineSDL(Start=pt_7, Direction=vec_6.Vector, Length=Slider(5, range=0..10))

# ----
pline = PolyLine(Vertices=pt_7, Closed=False)

# ---- group: testing near_pt on segment (continued)
decodes_5 = DecodesPythonScript(y=pline, x=line_2, u=pt_8)  # -> console, a
# ---------- decodes_5: Python ----------
pline = PLine(y)
edges = pline.edges
a.put(edges)
# ---------- end decodes_5 ----------

# ----
panel = Panel(decodes_5.a)
