# Grasshopper definition Arc.gh (Grasshopper 0.9.61)
# plug-ins: Decodes Python Interpreter

pt = ConstructPoint(XCoordinate=Slider(0, range=0..10), YCoordinate=Slider(0, range=0..10), ZCoordinate=Slider(0, range=0..10))
decodes = DecodesPythonScript(pt=pt, rad=Slider(6.243, range=0..10), ang=Slider(1.341, range=0..6.283))  # -> console, a
# ---------- decodes: Python ----------
arc_1=Arc(CS(pt),rad,ang)

a.put(arc_1)
# ---------- end decodes ----------
panel = Panel("CONSTRUCT AN ARC")

pt_2 = ConstructPoint(XCoordinate=Slider(0, range=0..10), YCoordinate=Slider(0, range=0..10), ZCoordinate=Slider(0, range=0..10))
decodes_2 = DecodesPythonScript(pt=pt_2, rad=Slider(6.243, range=0..10), ang=Slider(1.341, range=0..6.283))  # -> console, a, b, c, d, e
# ---------- decodes_2: Python ----------
arc=Arc(CS(pt),rad,ang)
a.put(arc)

#length
len=arc.length
print len
a.put(len)

#spt
spt=arc.spt
print spt
b.put(spt)

#ept
ept=arc.ept
print ept
c.put(ept)

#epts
epts=arc.epts
print epts
d.put(epts)

#origin
orig=arc.origin
print orig
e.put(orig)
# ---------- end decodes_2 ----------
panel_2 = Panel("""PROPERTIES
length
spt
ept
epts
origin""")

pt_3 = ConstructPoint(XCoordinate=Slider(0, range=0..10), YCoordinate=Slider(0, range=0..10), ZCoordinate=Slider(0, range=0..10))
decodes_3 = DecodesPythonScript(pt=pt_3, rad=Slider(6.243, range=0..10), ang=Slider(1.341, range=0..6.283), t=Slider(0.408, range=0..1))  # -> console, a, b, c
# ---------- decodes_3: Python ----------
arc=Arc(CS(pt),rad,ang)
a.put(arc)

p_eval=arc.eval(t)
b.put(p_eval)

pln_eval=arc.eval_pln(t)
c.put(pln_eval)
# ---------- end decodes_3 ----------
panel_3 = Panel("""METHODS
eval(t)
eval_pln(t)""")

pt_4 = ConstructPoint(XCoordinate=Slider(2.875, range=0..10), YCoordinate=Slider(3.837, range=0..10), ZCoordinate=Slider(4.25, range=0..10))
pt_5 = ConstructPoint(XCoordinate=Slider(2.75, range=0..10), YCoordinate=Slider(1.98, range=0..10), ZCoordinate=Slider(2.25, range=0..10))
pt_6 = ConstructPoint(XCoordinate=Slider(3.875, range=0..10), YCoordinate=Slider(2.599, range=0..10), ZCoordinate=Slider(2.375, range=0..10))
vec = VectorXYZ(XComponent=Slider(1.875, range=0..10), YComponent=Slider(4.75, range=0..10), ZComponent=Slider(4.125, range=0..10))  # -> Vector, Length
pt_7 = ConstructPoint(XCoordinate=Slider(0, range=0..10), YCoordinate=Slider(0, range=0..10), ZCoordinate=Slider(0, range=0..10))
pop2d = Populate2D(Region={Plane=PlaneXY(0, 0, 0), Size=Domain2(u=0..20, v=0..10)}, Count=10, Seed=1)
panel_4 = Panel("""STATIC METHODS
from_tan
from_pts
thru_pts""")
decodes_4 = DecodesPythonScript(
    pt=pt_7,
    rad=Slider(6.243, range=0..10),
    ang=Slider(1.341, range=0..6.283),
    start=pt_4,
    sweep=pt_5,
    center=pt_6,
    tan=vec.Vector,
    pts=pop2d)  # -> console, a, b, c, d; inputs pts: list
# ---------- decodes_4: Python ----------
arc=Arc(CS(pt),rad,ang)
a.put(arc)

#from_tan
tanarc=Arc.from_tan(start, sweep, tan)
a.put(tanarc)

#from_pts
ptarc=Arc.from_pts(center, start, sweep)
b.put(ptarc)

#thru_pts
ptsarc=Arc.thru_pts(pts)
c.put(ptsarc)
# ---------- end decodes_4 ----------
