# Grasshopper definition CS.gh (Grasshopper 0.9.61)
# plug-ins: Decodes Python Interpreter

pt = ConstructPoint(XCoordinate=Slider(6.656, range=0..10), YCoordinate=Slider(6.656, range=0..10), ZCoordinate=Slider(6.592, range=0..10))
pt_2 = ConstructPoint(XCoordinate=Slider(1.6, range=0..10), YCoordinate=Slider(1.6, range=0..10), ZCoordinate=Slider(1.536, range=0..10))
decodes = DecodesPythonScript(pt_1=pt, pt_2=pt_2, x=Slider(0, range=0..10), y=Slider(0, range=0..10), z=Slider(0, range=0..10))  # -> console, a, b, c, d
# ---------- decodes: Python ----------
cs=CS(pt_1)
d.put(cs)

#eval a Point
p_eval=cs.eval(pt_2)
a.put(p_eval)

#eval coordinates
p2_eval=cs.eval(x,y,z)
b.put(p2_eval)

#deval
deval=cs.deval(pt_2)
c.put(deval)
# ---------- end decodes ----------
panel = Panel("""METHODS
eval(a,b,c)
deval(a,b,c)""")
vdis = VectorDisplay(Anchor=pt, Vector=decodes.c)

pt_3 = ConstructPoint(XCoordinate=Slider(6.656, range=0..10), YCoordinate=Slider(6.656, range=0..10), ZCoordinate=Slider(6.592, range=0..10))
decodes_2 = DecodesPythonScript(pt_1=pt_3)  # -> console, a, b, c, d
# ---------- decodes_2: Python ----------
cs=CS(pt_1)
a.put(cs)


#XFORM
cs.xform

print cs.xform

#IXFORM
cs.ixform

print cs.ixform

#XY_PLANE
xy=cs.xy_plane

b.put(xy)

#XZ_PLANE
xz=cs.xz_plane

c.put(xz)

#YZ_PLANE
yz=cs.yz_plane

d.put(yz)
# ---------- end decodes_2 ----------
panel_2 = Panel("""PROPERTIES
xy_plane
xz_plane
yz_plane
xform
ixform""")

pt_4 = ConstructPoint(XCoordinate=Slider(6.656, range=0..10), YCoordinate=Slider(6.656, range=0..10), ZCoordinate=Slider(6.592, range=0..10))
vec = VectorXYZ(XComponent=Slider(1.781, range=0..10), YComponent=Slider(7.906, range=0..10), ZComponent=Slider(1.592, range=0..10))  # -> Vector, Length
vec_2 = VectorXYZ(XComponent=Slider(9.531, range=0..10), YComponent=Slider(2.531, range=0..10), ZComponent=Slider(7.592, range=0..10))  # -> Vector, Length
vec_3 = VectorXYZ(XComponent=Slider(8.406, range=0..10), YComponent=Slider(0.531, range=0..10), ZComponent=Slider(7.342, range=0..10))  # -> Vector, Length
panel_3 = Panel("CONSTRUCT A CS")
decodes_3 = DecodesPythonScript(
    x=Slider(0, range=0..10),
    y=Slider(0, range=0..10),
    z=Slider(0, range=0..10),
    pt=pt_4,
    u=vec_3.Vector,
    v=vec.Vector,
    w=vec_2.Vector)  # -> console, a, b, c
# ---------- decodes_3: Python ----------
cs_1=CS(x,y,z)
a.put(cs_1)


cs_2=CS(pt)
b.put(cs_2)

cs_3=CS(u,v,w)
c.put(cs_3)
# ---------- end decodes_3 ----------

# ----
# STATIC METHODS
# on_xy
# on_xz
# on_yz
# 
# ON_YZ HAS PROBLEM.
number_slider = Slider(3.25, range=0..10)
vec_4 = VectorXYZ(XComponent=number_slider, YComponent=Slider(0, range=0..10), ZComponent=Slider(0, range=0..10))  # -> Vector, Length
decodes_4 = DecodesPythonScript(
    x=Slider(6.656, range=0..10),
    y=Slider(6.656, range=0..10),
    z=Slider(6.592, range=0..10),
    vec=vec_4.Vector,
    rotation=Slider(3.958, range=0..6.283))  # -> console, a, b, c, d, e, f
# ---------- decodes_4: Python ----------
#on_xy
xy_1=CS.on_xy(x,y,vec)
a.put(xy_1)

xy_2=CS.on_xy(x,y,rot=rotation)
b.put(xy_2)

#on_xz
xz_1=CS.on_xz(x,z,vec)
c.put(xz_1)

xz_2=CS.on_xz(x,z,rot=rotation)
d.put(xz_2)
"""
#on_yz
yz_1=CS.on_yz(y,z,vec)
e.put(yz_1)
"""
yz_2=CS.on_yz(y,z,rot=rotation)
f.put(yz_2)
# ---------- end decodes_4 ----------
