# Grasshopper definition Circle.gh (Grasshopper 0.9.61)
# plug-ins: Decodes Python Interpreter

pt = ConstructPoint(XCoordinate=Slider(0, range=0..10), YCoordinate=Slider(0, range=0..10), ZCoordinate=Slider(0, range=0..10))
vec = VectorXYZ(XComponent=Slider(10, range=0..10), YComponent=Slider(0, range=0..10), ZComponent=Slider(0, range=0..10))  # -> Vector, Length
panel = Panel("CONSTRUCT A CIRCLE")
decodes = DecodesPythonScript(pt_1=pt, vec=vec.Vector, rad=Slider(8.16, range=0..10))  # -> console, a
# ---------- decodes: Python ----------
plane=Plane(pt_1, vec)

my_circ=Circle(plane, rad)

a.put(my_circ)
# ---------- end decodes ----------

pt_2 = ConstructPoint(XCoordinate=Slider(0, range=0..10), YCoordinate=Slider(0, range=0..10), ZCoordinate=Slider(0, range=0..10))
vec_2 = VectorXYZ(XComponent=Slider(10, range=0..10), YComponent=Slider(0, range=0..10), ZComponent=Slider(0, range=0..10))  # -> Vector, Length
panel_2 = Panel("""PROPERTIES
plane""")
decodes_2 = DecodesPythonScript(pt_1=pt_2, vec=vec_2.Vector, rad=Slider(8.16, range=0..10))  # -> console, a
# ---------- decodes_2: Python ----------
plane=Plane(pt_1, vec)

my_circ=Circle(plane, rad)

#Plane
circ_pl=my_circ.plane
a.put(circ_pl)
# ---------- end decodes_2 ----------

pt_3 = ConstructPoint(XCoordinate=Slider(0, range=0..10), YCoordinate=Slider(0, range=0..10), ZCoordinate=Slider(0, range=0..10))
vec_3 = VectorXYZ(XComponent=Slider(10, range=0..10), YComponent=Slider(0, range=0..10), ZComponent=Slider(0, range=0..10))  # -> Vector, Length

pt_4 = ConstructPoint(XCoordinate=Slider(0, range=0..10), YCoordinate=Slider(0, range=0..10), ZCoordinate=Slider(0, range=0..10))
vec_4 = VectorXYZ(XComponent=Slider(0, range=0..10), YComponent=Slider(10, range=0..10), ZComponent=Slider(0, range=0..10))  # -> Vector, Length

pt_5 = ConstructPoint(XCoordinate=Slider(0, range=0..10), YCoordinate=Slider(0, range=0..10), ZCoordinate=Slider(0, range=0..10))
vec_5 = VectorXYZ(XComponent=Slider(10, range=0..10), YComponent=Slider(0, range=0..10), ZComponent=Slider(0, range=0..10))  # -> Vector, Length

pt_6 = ConstructPoint(XCoordinate=Slider(0, range=0..10), YCoordinate=Slider(7.741, range=0..10), ZCoordinate=Slider(0, range=0..10))
vec_6 = VectorXYZ(XComponent=Slider(10, range=0..10), YComponent=Slider(0, range=0..10), ZComponent=Slider(0, range=0..10))  # -> Vector, Length

panel_3 = Panel("""STATIC METHODS
mutually_tangent""")
decodes_3 = DecodesPythonScript(
    pt_1=pt_5,
    vec_1=vec_5.Vector,
    rad_1=Slider(8.16, range=0..10),
    pt_2=pt_6,
    vec_2=vec_6.Vector,
    rad_2=Slider(8.16, range=0..10))  # -> console, a, b, c
# ---------- decodes_3: Python ----------
pln_1=Plane(pt_1, vec_1)
pln_2=Plane(pt_2, vec_2)

circ_1=Circle(pln_1, rad_1)
a.put(circ_1)

circ_2=Circle(pln_2, rad_2)
b.put(circ_2)

#mutually_tangent
m_tan=Circle.mutually_tangent(circ_1, circ_2)
c.put(m_tan)
# ---------- end decodes_3 ----------

panel_4 = Panel("""METHODS
intersections""")
decodes_4 = DecodesPythonScript(
    pt_1=pt_3,
    vec_1=vec_3.Vector,
    rad_1=Slider(8.16, range=0..10),
    pt_2=pt_4,
    vec_2=vec_4.Vector,
    rad_2=Slider(8.16, range=0..10))  # -> console, a, b
# ---------- decodes_4: Python ----------
pln_1=Plane(pt_1, vec_1)
pln_2=Plane(pt_2, vec_2)

circ_1=Circle(pln_1, rad_1)
a.put(circ_1)

circ_2=Circle(pln_2, rad_2)
b.put(circ_2)

#Intersect Circles (METHOD 1)
isect = Intersector()
i=isect.intersect(circ_1,circ_2)
print i

#Intersect Circles (METHOD 1)
isect_2 = Intersector()
i_2=isect_2.of(circ_1,circ_2)
print i_2
# ---------- end decodes_4 ----------
