# Grasshopper definition Curve.gh (Grasshopper 0.9.61)
# plug-ins: Decodes Python Interpreter

dom = ConstructDomain(DomainStart=Slider(0, range=0..25), DomainEnd=Slider(18.849, range=0..18.849))
decodes = DecodesPythonScript(Inv=dom)  # -> console, a
# ---------- decodes: Python ----------
#function for points
def func(u):
    return Point(math.sin(u),u)

curv = Curve(func,Inv)

a.put(curv.surrogate)
# ---------- end decodes ----------
panel = Panel("CONSTRUCT A CURVE")

dom_2 = ConstructDomain(DomainStart=Slider(0, range=0..25), DomainEnd=Slider(18.849, range=0..18.849))
decodes_2 = DecodesPythonScript(Inv=dom_2)  # -> console, a
# ---------- decodes_2: Python ----------
#function for points
def func(u):
    return Point(math.sin(u),u)
curv = Curve(func,Inv)


#surrogate
a.put(curv.surrogate)

#appx_length
a_len=curv.appx_length
print a_len
# ---------- end decodes_2 ----------
panel_2 = Panel("""PROPERTIES
surrogate
appx_length""")

md_slider = MDSlider(
    slider_value=Point(0.4750001431, 0.3000001907, 0.5),
    SliderMode=0,
    x_domain=Domain(0, 10),
    y_domain=Domain(0, 10),
    z_domain=Domain(0, 1))
dom_3 = ConstructDomain(DomainStart=Slider(4.736, range=0..25), DomainEnd=Slider(14.539, range=0..18.849))
dom_4 = ConstructDomain(DomainStart=Slider(0, range=0..25), DomainEnd=Slider(18.849, range=0..18.849))
decodes_3 = DecodesPythonScript(Inv=dom_4, pt=md_slider, t=Slider(0.25, range=0..1), div=Slider(11, range=0..20), sub_dom=dom_3)  # -> console, a, b, c, d, e, f; inputs div: Int32
# ---------- decodes_3: Python ----------
#function for points
def func(u):
    return Point(math.sin(u),u)
curv = Curve(func,Inv)
a.put(curv)

#near
n_pt=curv.near(pt)
b.put(n_pt)
print n_pt

#far
f_pt=curv.far(pt)
c.put(f_pt)
print f_pt

#deval
d_pt=curv.deval(t)
d.put(d_pt)
print d_pt

#divide
div=curv.divide(divs=div)
e.put(div)


#subcurve
s_crv=curv.subcurve(sub_dom)
f.put(s_crv.surrogate)
# ---------- end decodes_3 ----------
panel_3 = Panel("""METHODS
near
far
deval
divide
subcurve""")

md_slider_2 = MDSlider(slider_value=Point(0.5, 0.5, 0.5), SliderMode=0, x_domain=Domain(0, 15), y_domain=Domain(0, 15), z_domain=Domain(0, 1))
pop2d = Populate2D(Region={Plane=PlaneXY(0, 0, 0), Size=Domain2(u=0..20, v=0..10)}, Count=Slider(3, range=0..18), Seed=1)
dom_5 = ConstructDomain(DomainStart=Slider(0, range=0..25), DomainEnd=Slider(18.849, range=0..18.849))
panel_4 = Panel("""STATIC METHODS
circle
helix
bezier
hermite""")
decodes_4 = DecodesPythonScript(
    ctr=md_slider_2,
    rad=Slider(14.539, range=0..18.849),
    rise=Slider(3.694, range=0..18.849),
    turns=Slider(14, range=0..18),
    inv=dom_5,
    pts=pop2d)  # -> console, a, b, c, d; inputs turns: Int32, pts: list
# ---------- decodes_4: Python ----------
#Circle
my_circ=Curve.circle(ctr, rad)
a.put(my_circ.surrogate)

#Helix
my_helix=Curve.helix(ctr, rad, rise, turns)
b.put(my_helix.surrogate)



#Bezier
my_bezier=Curve.bezier(pts)
c.put(my_bezier.surrogate)

#Hermite
my_hermite=Curve.hermite(pts)
d.put(my_hermite.surrogate)
# ---------- end decodes_4 ----------
