# Grasshopper definition LinearEntity.gh (Grasshopper 0.9.61)
# plug-ins: Decodes Python Interpreter

panel = Panel("LINE")

pt = ConstructPoint(XCoordinate=Slider(0.25, range=0..10), YCoordinate=Slider(0.25, range=0..10), ZCoordinate=Slider(0.25, range=0..10))
pt_2 = ConstructPoint(XCoordinate=Slider(5.75, range=0..10), YCoordinate=Slider(4.85, range=0..10), ZCoordinate=Slider(4.95, range=0..10))
pt_3 = ConstructPoint(XCoordinate=Slider(0.25, range=0..10), YCoordinate=Slider(0.25, range=0..10), ZCoordinate=Slider(0.25, range=0..10))
panel_2 = Panel("""METHODS
eval
parellel_line
near
near_pt""")
decodes = DecodesPythonScript(pt_1=pt_2, pt_2=pt_3, pt_3=pt, num=Slider(0.25, range=0..1))  # -> console, a, b, c
# ---------- decodes: Python ----------
#Construct line from points
le_1=Line(pt_1,pt_2)

#eval
e_pt=le_1.eval(num)
a.put(e_pt)
print e_pt

#parallel line
new_line=le_1.parallel_line(pt_3)
b.put(new_line)

#near
near=le_1.near(pt_3)
print near

#near_pt
near_pt=le_1.near_pt(pt_3)
c.put(near_pt)
# ---------- end decodes ----------

pt_4 = ConstructPoint(XCoordinate=Slider(5.75, range=0..10), YCoordinate=Slider(4.85, range=0..10), ZCoordinate=Slider(4.95, range=0..10))
pt_5 = ConstructPoint(XCoordinate=Slider(0.25, range=0..10), YCoordinate=Slider(0.25, range=0..10), ZCoordinate=Slider(0.25, range=0..10))
panel_3 = Panel("""PROPERTIES
spt
ept
vec
coefficients (not implemented)""")
decodes_2 = DecodesPythonScript(pt_1=pt_4, pt_2=pt_5)  # -> console, a, b, c
# ---------- decodes_2: Python ----------
#Construct a Linear Entity

#From points
le_1=Line(pt_1,pt_2)

#Starting Point
start=le_1.spt
print start

a.put(start)

#Ending Point
end=le_1.ept
print end

b.put(end)

#Vector
vec=le_1.vec
print vec

c.put(vec)

#Coefficients is not yet implemented
# ---------- end decodes_2 ----------
vdis = VectorDisplay(Anchor=Point(0, 0, 0), Vector=decodes_2.c)

pt_6 = ConstructPoint(XCoordinate=Slider(5.75, range=0..10), YCoordinate=Slider(4.85, range=0..10), ZCoordinate=Slider(4.95, range=0..10))
pt_7 = ConstructPoint(XCoordinate=Slider(0.25, range=0..10), YCoordinate=Slider(0.25, range=0..10), ZCoordinate=Slider(0.25, range=0..10))
vec = VectorXYZ(XComponent=Slider(8.95, range=0..10), YComponent=Slider(8.55, range=0..10), ZComponent=Slider(9.35, range=0..10))  # -> Vector, Length
vec_2 = VectorXYZ(XComponent=Slider(0.25, range=0..10), YComponent=Slider(0.25, range=0..10), ZComponent=Slider(0.25, range=0..10))  # -> Vector, Length
decodes_3 = DecodesPythonScript(pt_1=pt_6, pt_2=pt_7, vec_1=vec.Vector, vec_2=vec_2.Vector)  # -> console, a, b
# ---------- decodes_3: Python ----------
#Construct a Linear Entity

#From points
le_1=Line(pt_1,pt_2)
a.put(le_1)

#From vectors
le_2=Line(vec_1, vec_2)
b.put(le_2)
# ---------- end decodes_3 ----------

panel_4 = Panel("CONSTRUCT A LINE")
panel_5 = Panel("SEGMENT")

decodes_4 = DecodesPythonScript(
    num1=Slider(5.377, range=0..10),
    num2=Slider(10, range=0..10),
    num3=Slider(4.95, range=0..10),
    num4=Slider(0.25, range=0..10),
    num5=Slider(4.95, range=0..10),
    num6=Slider(0.25, range=0..10))  # -> console, a, b
# ---------- decodes_4: Python ----------
#Construct a Segment

#2D
l_1=Segment.by_coords2d(x0=num1, y0=num2, x1=num3, y1=num4)
a.put(l_1)

#3D
l_2=Segment.by_coords3d(x0=num1, y0=num2,z0=num5, x1=num3, y1=num4, z1=num6)
b.put(l_2)
# ---------- end decodes_4 ----------
panel_6 = Panel("""STATIC METHODS
by_coords2d
by_coords3d""")

pt_8 = ConstructPoint(XCoordinate=Slider(9.4, range=0..10), YCoordinate=Slider(9.208, range=0..10), ZCoordinate=Slider(8.6, range=0..10))
pt_9 = ConstructPoint(XCoordinate=Slider(0, range=0..10), YCoordinate=Slider(0, range=0..10), ZCoordinate=Slider(0, range=0..10))
pt_10 = ConstructPoint(XCoordinate=Slider(9.4, range=0..10), YCoordinate=Slider(9.208, range=0..10), ZCoordinate=Slider(8.6, range=0..10))
decodes_5 = DecodesPythonScript(pt1=pt_9, pt2=pt_10, pt3=pt_8, num=Slider(0.25, range=0..1))  # -> console, a, b, c, d
# ---------- decodes_5: Python ----------
#Construct Segment with Points
seg_1=Segment(pt1, pt2)

#near
n_pt=seg_1.near(pt3)
print n_pt

#near
n_pt2=seg_1.near_pt(pt3)
b.put(n_pt2)

#inverted
inv_seg=seg_1.inverted
c.put(inv_seg)

#eval
ev=seg_1.eval(num)
d.put(ev)
# ---------- end decodes_5 ----------
panel_7 = Panel("""METHODS
near
near_pt
inverted
eval""")

pt_11 = ConstructPoint(XCoordinate=Slider(0, range=0..10), YCoordinate=Slider(0, range=0..10), ZCoordinate=Slider(0, range=0..10))
pt_12 = ConstructPoint(XCoordinate=Slider(9.4, range=0..10), YCoordinate=Slider(9.208, range=0..10), ZCoordinate=Slider(8.6, range=0..10))
decodes_6 = DecodesPythonScript(pt1=pt_11, pt2=pt_12)  # -> console, a, b
# ---------- decodes_6: Python ----------
#Construct Segment with Points
seg_1=Segment(pt1, pt2)

#length
length=seg_1.length
print length

#midpoint
m_pt=seg_1.midpoint
print m_pt
a.put(m_pt)
# ---------- end decodes_6 ----------
panel_8 = Panel("""PROPERTIES
length
midpoint""")

pt_13 = ConstructPoint(XCoordinate=Slider(0, range=0..10), YCoordinate=Slider(0, range=0..10), ZCoordinate=Slider(0, range=0..10))
pt_14 = ConstructPoint(XCoordinate=Slider(9.4, range=0..10), YCoordinate=Slider(9.208, range=0..10), ZCoordinate=Slider(8.6, range=0..10))
vec_3 = VectorXYZ(XComponent=Slider(0, range=0..10), YComponent=Slider(0, range=0..10), ZComponent=Slider(0, range=0..10))  # -> Vector, Length
vec_4 = VectorXYZ(XComponent=Slider(3.648, range=0..10), YComponent=Slider(4.8, range=0..10), ZComponent=Slider(7.8, range=0..10))  # -> Vector, Length
decodes_7 = DecodesPythonScript(pt1=pt_13, pt2=pt_14, vec1=vec_3.Vector, vec2=vec_4.Vector)  # -> console, a, b
# ---------- decodes_7: Python ----------
#Construct Segment with Points
seg_1=Segment(pt1, pt2)
a.put(seg_1)


#Construct Segment with Vecs
seg_2=Segment(vec1, vec2)
b.put(seg_2)
# ---------- end decodes_7 ----------
panel_9 = Panel("CONSTRUCT A SEGMENT")

panel_10 = Panel("RAY")

pt_15 = ConstructPoint(XCoordinate=Slider(9.4, range=0..10), YCoordinate=Slider(9.208, range=0..10), ZCoordinate=Slider(8.6, range=0..10))
pt_16 = ConstructPoint(XCoordinate=Slider(0, range=0..10), YCoordinate=Slider(0, range=0..10), ZCoordinate=Slider(0, range=0..10))
pt_17 = ConstructPoint(XCoordinate=Slider(9.4, range=0..10), YCoordinate=Slider(9.208, range=0..10), ZCoordinate=Slider(8.6, range=0..10))
decodes_8 = DecodesPythonScript(pt1=pt_16, pt2=pt_17, pt3=pt_15)  # -> console, a, b
# ---------- decodes_8: Python ----------
#Construct Segment with Points
ray_1=Ray(pt1, pt2)

#near
n_pt=ray_1.near(pt3)
a.put(n_pt)

#near_pt
n_pt2=ray_1.near_pt(pt3)
b.put(n_pt2)
# ---------- end decodes_8 ----------
panel_11 = Panel("""METHODS
near
near_pt""")

pt_18 = ConstructPoint(XCoordinate=Slider(0, range=0..10), YCoordinate=Slider(0, range=0..10), ZCoordinate=Slider(0, range=0..10))
pt_19 = ConstructPoint(XCoordinate=Slider(9.4, range=0..10), YCoordinate=Slider(9.208, range=0..10), ZCoordinate=Slider(8.6, range=0..10))
vec_5 = VectorXYZ(XComponent=Slider(0, range=0..10), YComponent=Slider(0, range=0..10), ZComponent=Slider(0, range=0..10))  # -> Vector, Length
vec_6 = VectorXYZ(XComponent=Slider(3.648, range=0..10), YComponent=Slider(4.8, range=0..10), ZComponent=Slider(7.8, range=0..10))  # -> Vector, Length
decodes_9 = DecodesPythonScript(pt1=pt_18, pt2=pt_19, vec1=vec_5.Vector, vec2=vec_6.Vector)  # -> console, a, b
# ---------- decodes_9: Python ----------
#Construct Segment with Points
seg_1=Ray(pt1, pt2)
a.put(seg_1)


#Construct Segment with Vecs
seg_2=Ray(vec1, vec2)
b.put(seg_2)
# ---------- end decodes_9 ----------
panel_12 = Panel("CONSTRUCT A RAY")

panel_13 = Panel("VECFIELD")
pt_20 = ConstructPoint(XCoordinate=Slider(0, range=0..10), YCoordinate=Slider(0, range=0..10), ZCoordinate=Slider(0, range=0..10))
vec_7 = VectorXYZ(XComponent=Slider(0, range=0..10), YComponent=Slider(0, range=0..10), ZComponent=Slider(0, range=0..10))  # -> Vector, Length
decodes_10 = DecodesPythonScript(Pt=pt_20, Vec=vec_7.Vector, N1=Slider(4, range=0..10), N2=Slider(4, range=0..10))  # -> Console, A
panel_14 = Panel("???")
