# Grasshopper definition Mesh.gh (Grasshopper 0.9.61)
# plug-ins: Decodes Python Interpreter

panel = Panel("CONSTRUCT A MESH")
decodes = DecodesPythonScript()  # -> console, a, b
# ---------- decodes: Python ----------
#Vertices
pts=[
    Point(0,0,0),
    Point(0,1,0),
    Point(1,1,0),
    Point(1,0,0),
    Point(0,0,1),
    Point(0,1,1),
    Point(1,1,1),
    Point(1,0,1),
    ]
    
#Quad faced mesh.
quad_faces=[[0,1,2,3],[4,5,6,7],[0,4,5,1],[3,7,6,2]]
quadmesh=Mesh(pts,quad_faces)
a.put(quadmesh)

#Triangular Faced Mesh.
tri_faces=[[0,5,7],[2,5,7],[0,2,5],[0,2,7]]
trimesh=Mesh(pts,tri_faces)
b.put(trimesh)

#Empty Mesh
emsh=Mesh()
# ---------- end decodes ----------

decodes_2 = DecodesPythonScript()  # -> console, a, b, c, d, e
# ---------- decodes_2: Python ----------
pts=[
    Point(0,0,0),
    Point(0,1,0),
    Point(1,1,0),
    Point(1,0,0),
    Point(0,0,1),
    Point(0,1,1),
    Point(1,1,1),
    Point(1,0,1),
    ]

quad_faces=[[0,1,2,3]]

quadmesh=Mesh(pts,quad_faces)
a.put(quadmesh)


#add face
quadmesh.add_face(4,5,6,7)
b.put(quadmesh)

#face_pts
pts=quadmesh.face_pts(0)
c.put(pts)

#centroid
cpt=quadmesh.face_centroid(0)
d.put(cpt)

#face normal
norm=quadmesh.face_normal(0)
e.put(norm)
# ---------- end decodes_2 ----------
panel_2 = Panel("""add_face
face_pts
face_centroid
face_normal""")
vdis = VectorDisplay(Anchor=decodes_2.d, Vector=decodes_2.e)

decodes_3 = DecodesPythonScript()  # -> console, a, b
# ---------- decodes_3: Python ----------
pts=[
    Point(0,0,0),
    Point(0,1,0),
    Point(1,1,0),
    Point(1,0,0),
    Point(0,0,1),
    Point(0,1,1),
    Point(1,1,1),
    Point(1,0,1),
    ]

tri_faces=[[0,5,7],[2,5,7],[0,2,5],[0,2,7]]

trimesh=Mesh(pts,tri_faces)
a.put(trimesh)

#EXPLODE!
extri=Mesh.explode(trimesh)
b.put(extri)
# ---------- end decodes_3 ----------
panel_3 = Panel("explode")
