# Grasshopper definition PGon.gh (Grasshopper 0.9.61)
# plug-ins: Decodes Python Interpreter

md_slider = MDSlider(slider_value=Point(1, 0, 0.5), SliderMode=0, x_domain=Domain(0, 10), y_domain=Domain(0, 10), z_domain=Domain(0, 1))
md_slider_2 = MDSlider(
    slider_value=Point(1, 0.4687504768, 0.5),
    SliderMode=0,
    x_domain=Domain(0, 10),
    y_domain=Domain(0, 10),
    z_domain=Domain(0, 1))
md_slider_3 = MDSlider(
    slider_value=Point(0.6060606061, 0, 0.5),
    SliderMode=0,
    x_domain=Domain(0, 10),
    y_domain=Domain(0, 10),
    z_domain=Domain(0, 1))
md_slider_4 = MDSlider(slider_value=Point(0, 0, 0.5), SliderMode=0, x_domain=Domain(0, 10), y_domain=Domain(0, 10), z_domain=Domain(0, 1))
md_slider_5 = MDSlider(
    slider_value=Point(0.5810605829, 0.8390626907, 0.5),
    SliderMode=0,
    x_domain=Domain(0, 10),
    y_domain=Domain(0, 10),
    z_domain=Domain(0, 1))
pop2d = Populate2D(Region={Plane=PlaneXY(0, 0, 0), Size=Domain2(u=0..20, v=0..10)}, Count=3, Seed=1)
panel = Panel("CONSTRUCT A PGON")
decodes = DecodesPythonScript(pts=pop2d, p1=md_slider_4, p2=md_slider_5, p3=md_slider_2, p4=md_slider, p5=md_slider_3)  # -> console, a, b; inputs pts: list
# ---------- decodes: Python ----------
my_pgon=PGon(pts)
a.put(my_pgon)


pts_2=[p1,p2,p3,p4,p5]
my_pgon2=PGon(pts_2)
b.put(my_pgon2)
# ---------- end decodes ----------

pop2d_2 = Populate2D(Region={Plane=PlaneXY(0, 0, 0), Size=Domain2(u=0..20, v=0..10)}, Count=3, Seed=1)
panel_2 = Panel("""PROPERTIES
edges
area
bounds""")
decodes_2 = DecodesPythonScript(pts=pop2d_2)  # -> console, a, b; inputs pts: list
# ---------- decodes_2: Python ----------
my_pgon=PGon(pts)
a.put(my_pgon)

#edges
edg=my_pgon.edges
b.put(edg)

#area
area=my_pgon.area
print area

#bounds
bnds=my_pgon.bounds
# ---------- end decodes_2 ----------

md_slider_6 = MDSlider(
    slider_value=Point(0, 0.4699997902, 0.5),
    SliderMode=0,
    x_domain=Domain(0, 10),
    y_domain=Domain(0, 10),
    z_domain=Domain(0, 1))
pop2d_3 = Populate2D(Region={Plane=PlaneXY(0, 0, 0), Size=Domain2(u=0..20, v=0..10)}, Count=3, Seed=1)
pop2d_4 = Populate2D(Region={Plane=PlaneXY(0, 0, 0), Size=Domain2(u=0..20, v=0..10)}, Count=3, Seed=3)
decodes_3 = DecodesPythonScript(pts=pop2d_3, t=Slider(0.453, range=0..1), pt=md_slider_6, pts_2=pop2d_4)  # -> console, a, b, c, d, e; inputs pts: list, pts_2: list
# ---------- decodes_3: Python ----------
my_pgon=PGon(pts)
a.put(my_pgon)

#seg
seg=my_pgon.seg(1)
b.put(seg)

#eval
p_eval=my_pgon.eval(t)
c.put(p_eval)

#contains_pt
cntn=my_pgon.contains_pt(pt)
print cntn

#overlaps
my_pgon2=PGon(pts_2)
ovlp=my_pgon.overlaps(my_pgon2)
print ovlp


#inflate
inf=my_pgon.inflate(t)
d.put(inf)

#near
near=my_pgon.near(pt)
print near

#near_pt
n_pt=my_pgon.near_pt(pt)
e.put(n_pt)
# ---------- end decodes_3 ----------
panel_3 = Panel("""METHODS
seg
eval
contains_p
overlaps
inflate
near
near_pt""")

md_slider_7 = MDSlider(
    slider_value=Point(0.91796875, 0.8856248856, 0.5),
    SliderMode=0,
    x_domain=Domain(0, 10),
    y_domain=Domain(0, 10),
    z_domain=Domain(0, 1))
md_slider_8 = MDSlider(
    slider_value=Point(0.68359375, 0.09890604019, 0.5),
    SliderMode=0,
    x_domain=Domain(0, 10),
    y_domain=Domain(0, 10),
    z_domain=Domain(0, 1))
md_slider_9 = MDSlider(
    slider_value=Point(0, 0.4699997902, 0.5),
    SliderMode=0,
    x_domain=Domain(0, 10),
    y_domain=Domain(0, 10),
    z_domain=Domain(0, 1))
panel_4 = Panel("""STATIC METHODS
triangle
rectangle
doughnut""")
decodes_4 = DecodesPythonScript(
    p1=md_slider_9,
    p2=md_slider_7,
    p3=md_slider_8,
    width=Slider(8.5, range=0..10),
    height=Slider(6.125, range=0..10),
    n1=Slider(0.25, range=0..10),
    n2=Slider(6.101, range=0..10))  # -> console, a, b, c
# ---------- decodes_4: Python ----------
#triangle
trng=PGon.triangle(p1,p2,p3)
a.put(trng)

#rectangle
rtang=PGon.rectangle(p1,width, height)
b.put(rtang)

#doughnut
dough=PGon.doughnut(p1,radius_interval=Interval(n1, n2))
c.put(dough)
# ---------- end decodes_4 ----------
