# Grasshopper definition PLine.gh (Grasshopper 0.9.61)
# plug-ins: Decodes Python Interpreter

pop3d = Populate3D(Region={Plane=PlaneXY(0, 0, 0), X=Domain(0, 10), Y=Domain(0, 10), Z=Domain(0, 2)}, Count=Slider(4, range=0..10), Seed=1)
panel = Panel("CONSTRUCT A PLINE")
decodes = DecodesPythonScript(pts=pop3d)  # -> console, a; inputs pts: list
# ---------- decodes: Python ----------
pline=PLine(pts)
a.put(pline)
# ---------- end decodes ----------

pop3d_2 = Populate3D(Region={Plane=PlaneXY(0, 0, 0), X=Domain(0, 10), Y=Domain(0, 10), Z=Domain(0, 2)}, Count=Slider(4, range=0..10), Seed=1)
panel_2 = Panel("""PROPERTIES
edges
length""")
decodes_2 = DecodesPythonScript(pts=pop3d_2)  # -> console, a, b; inputs pts: list
# ---------- decodes_2: Python ----------
pline=PLine(pts)
a.put(pline)

#edges
edg=pline.edges
b.put(edg)

#length
len=pline.length
print len
# ---------- end decodes_2 ----------

pop2d = Populate2D(Region={Plane=PlaneXY(0, 0, 0), Size=Domain2(u=0..20, v=0..10)}, Count=Slider(2, range=0..10), Seed=1)
pop2d_2 = Populate2D(Region={Plane=PlaneXY(0, 0, 0), Size=Domain2(u=0..20, v=0..10)}, Count=Slider(3, range=0..10), Seed=3)
pt = ConstructPoint(XCoordinate=Slider(7.354, range=0..10), YCoordinate=Slider(0.25, range=0..10), ZCoordinate=Slider(0.25, range=0..10))
panel_3 = Panel("""METHODS
seg(index)
eval(t)
join(other)
near(pt)
near_pt(pt)""")
decodes_3 = DecodesPythonScript(pts=pop2d, pts_2=pop2d_2, pt=pt, t=Slider(0.25, range=0..1))  # -> console, a, b, c, d, e, f; inputs pts: list, pts_2: list
# ---------- decodes_3: Python ----------
pline=PLine(pts)
a.put(pline)

pline_2=PLine(pts_2)
b.put(pline_2)

#seg
seg_1=pline.seg(0)
c.put(seg_1)

#eval
p_eval=pline.eval(t)
d.put(p_eval)

#join
new_pline=pline.join(pline_2)
e.put(new_pline)

#near
near=pline.near(pt)
print near

#near_pt
point=pline.near_pt(pt)
f.put(point)
# ---------- end decodes_3 ----------
