# Grasshopper definition Plane.gh (Grasshopper 0.9.61)
# plug-ins: Decodes Python Interpreter

pt = ConstructPoint(XCoordinate=Slider(0, range=0..10), YCoordinate=Slider(0, range=0..10), ZCoordinate=Slider(0, range=0..10))
vec = VectorXYZ(XComponent=Slider(0, range=0..10), YComponent=Slider(0, range=0..10), ZComponent=Slider(2.1, range=0..10))  # -> Vector, Length
pt_2 = ConstructPoint(XCoordinate=Slider(2.9, range=0..10), YCoordinate=Slider(2.8, range=0..10), ZCoordinate=Slider(3, range=0..10))
vec_2 = VectorXYZ(XComponent=Slider(0, range=0..10), YComponent=Slider(0, range=0..10), ZComponent=Slider(2.1, range=0..10))  # -> Vector, Length
decodes = DecodesPythonScript(pt1=pt, vec1=vec.Vector, pt2=pt_2, vec2=vec_2.Vector)  # -> console
# ---------- decodes: Python ----------
pln=Plane(pt1, vec1)

o_pln=Plane(pt2, vec2)

#is_identical
if pln.is_identical(o_pln):
    print "pln is identical to o_pln"
else:
    print "pln is NOT identical to o_pln"

#is_coplanar
if pln.is_coplanar:
    print "pln is coplanar with o_pln"
else:
    print "pln is NOT coplanar with o_pln"

#near
near=pln.near(pt2)
print near
# ---------- end decodes ----------
panel = Panel("""METHODS
is_identical
is_coplanar
near""")

pt_3 = ConstructPoint(XCoordinate=Slider(0, range=0..10), YCoordinate=Slider(0, range=0..10), ZCoordinate=Slider(0, range=0..10))
vec_3 = VectorXYZ(XComponent=Slider(0, range=0..10), YComponent=Slider(0, range=0..10), ZComponent=Slider(2.1, range=0..10))  # -> Vector, Length
pt_4 = ConstructPoint(XCoordinate=Slider(3.125, range=0..10), YCoordinate=Slider(2.625, range=0..10), ZCoordinate=Slider(3.125, range=0..10))
pt_5 = ConstructPoint(XCoordinate=Slider(2.625, range=0..10), YCoordinate=Slider(2, range=0..10), ZCoordinate=Slider(0, range=0..10))
panel_2 = Panel("CONSTRUCT A PLANE")
decodes_2 = DecodesPythonScript(pt1=pt_3, pt2=pt_4, pt3=pt_5, vec=vec_3.Vector)  # -> console, a, b
# ---------- decodes_2: Python ----------
#From a Point and normal vector
pln_1=Plane(pt1, vec)
a.put(pln_1)

#From 3 Points (STATIC METHOD)
pln_2=Plane.from_pts(pt1, pt2, pt3)
b.put(pln_2)
# ---------- end decodes_2 ----------

pt_6 = ConstructPoint(XCoordinate=Slider(0, range=0..10), YCoordinate=Slider(0, range=0..10), ZCoordinate=Slider(0, range=0..10))
vec_4 = VectorXYZ(XComponent=Slider(0, range=0..10), YComponent=Slider(0, range=0..10), ZComponent=Slider(2.1, range=0..10))  # -> Vector, Length
decodes_3 = DecodesPythonScript(pt=pt_6, vec=vec_4.Vector)  # -> console, a, b
# ---------- decodes_3: Python ----------
pln=Plane(pt, vec)
a.put(pln)

#distance
d=pln.d
print d

#normal
norm=pln.normal
a.put(norm)

#origin
origin=pln.origin
b.put(origin)
# ---------- end decodes_3 ----------
panel_3 = Panel("""PROPERTIES
distance from origin
normal
origin""")
vdis = VectorDisplay(Anchor=decodes_3.b, Vector=decodes_3.a)
