# Grasshopper definition Point.gh (Grasshopper 0.9.61)
# plug-ins: Decodes Python Interpreter

# ----
# !TODO! Multiply with xform vec
# Multiply
# Add
# Subtract
# Divide
number_slider = Slider(2.65, range=0..10)
pt = ConstructPoint(XCoordinate=number_slider, YCoordinate=Slider(4.75, range=0..10), ZCoordinate=Slider(4.85, range=0..10))
pt_2 = ConstructPoint(XCoordinate=Slider(4.85, range=0..10), YCoordinate=Slider(2.55, range=0..10), ZCoordinate=Slider(3.55, range=0..10))
decodes = DecodesPythonScript(pt_a=pt, pt_b=pt_2, num=Slider(1.85, range=0..10))  # -> console, c, d, e, f
# ---------- decodes: Python ----------
#multiply by scalar
pt_c= pt_a * num

c.put(pt_c)

#multiply by Xform vector

#add
pt_d=pt_a + pt_b

d.put(pt_d)

#subtract
pt_e= pt_a-pt_b

e.put(pt_c)

#divide
pt_f= pt_a / num

f.put(pt_f)
# ---------- end decodes ----------

md_slider = MDSlider(
    slider_value=Point(0.686953187, 0.5786328316, 0.5),
    SliderMode=0,
    x_domain=Domain(0, 1),
    y_domain=Domain(0, 1),
    z_domain=Domain(0, 1))
decodes_2 = DecodesPythonScript(
    x=Slider(4.909, range=0..10),
    y=Slider(0.25, range=0..10),
    z=Slider(0.25, range=0..10),
    xy=md_slider,
    r=Slider(5, range=0..10))  # -> console, a, b, c, d, e, f
# ---------- decodes_2: Python ----------
#Construct a Point
pt_a=Point()

a.put(pt_a)

pt_b=Point(xy)

b.put(pt_b)

pt_c=Point(x,y)

c.put(pt_c)

pt_d=Point(x,y,z)

d.put(pt_d)

#Construct a random point
#random
rand=Point.random(Interval(0,1))

e.put(rand)

#Construct a list of points
pts=[Point(i,i,i) for i in range(int(r))]

f.put(pts)
# ---------- end decodes_2 ----------
panel = Panel("Construct a Point")

# ----
# LT   GT   EQ   LE   GE   NE
number_slider_2 = Slider(0, range=0..10)
pt_3 = ConstructPoint(XCoordinate=Slider(0, range=0..10), YCoordinate=number_slider_2, ZCoordinate=Slider(10, range=0..10))
pt_4 = ConstructPoint(XCoordinate=Slider(0, range=0..10), YCoordinate=Slider(10, range=0..10), ZCoordinate=Slider(0, range=0..10))
decodes_3 = DecodesPythonScript(pt_1=pt_3, pt_2=pt_4)  # -> console
# ---------- decodes_3: Python ----------
#Less Than
if pt_1 < pt_2:
    print "pt_1 is less than pt_2"
else:
    print "pt_1 is NOT less than pt_2"

#Greater Than
if pt_1 > pt_2:
    print "pt_1 is greater than pt_2"
else:
    print "pt_1 is NOT greater than pt_2"

#Equal To
if pt_1 == pt_2:
    print "pt_1 is equal to pt_2"
else:
    print "pt_1 is NOT equal to pt_2"

#Less Than/Equal To
if pt_1 <= pt_2:
    print "pt_1 is less than or equal to pt_2"
else:
    print "pt_1 is NOT less than or equal to pt_2"

#Greater Than/Equal To
if pt_1 >= pt_2:
    print "pt_1 is greater than or equal to pt_2"
else:
    print "pt_1 is NOT grater than or equal to pt_2"

#Not Equal to
if pt_1 != pt_2:
    print "pt_1 is NOT equal to pt_2"
else:
    print "pt_1 is equal to pt_2"
# ---------- end decodes_3 ----------

pop3d = Populate3D(Region={Plane=PlaneXY(0, 0, 0), X=Domain(0, 10), Y=Domain(0, 10), Z=Domain(0, 2)}, Count=100, Seed=1)
pt_5 = ConstructPoint(XCoordinate=Slider(4.85, range=0..10), YCoordinate=Slider(2.55, range=0..10), ZCoordinate=Slider(3.55, range=0..10))
pt_6 = ConstructPoint(XCoordinate=Slider(2.65, range=0..10), YCoordinate=Slider(4.75, range=0..10), ZCoordinate=Slider(4.85, range=0..10))
panel_2 = Panel("""Interpolate
Centroid""")
decodes_4 = DecodesPythonScript(pt_1=pt_6, pt_2=pt_5, num=Slider(0.25, range=0..1), pts=pop3d)  # -> console, a, b, c, d; inputs pts: list
# ---------- decodes_4: Python ----------
#interpolate
interp=Point.interpolate(pt_1, pt_2, num)

a.put(interp)

#centroid
centr=Point.centroid(pts)

b.put(centr)
# ---------- end decodes_4 ----------

pt_7 = ConstructPoint(XCoordinate=Slider(2.65, range=0..10), YCoordinate=Slider(4.75, range=0..10), ZCoordinate=Slider(4.85, range=0..10))
vec = VectorXYZ(XComponent=Slider(0, range=0..10), YComponent=Slider(1, range=0..10), ZComponent=Slider(0, range=0..10))  # -> Vector, Length
pt_8 = ConstructPoint(XCoordinate=Slider(4.85, range=0..10), YCoordinate=Slider(2.55, range=0..10), ZCoordinate=Slider(3.55, range=0..10))
decodes_5 = DecodesPythonScript(pt_1=pt_7, pt_2=pt_8, vec=vec.Vector)  # -> console, a
# ---------- decodes_5: Python ----------
#distance2
dist2=pt_1.distance2(pt_2)

print dist2

#distance
dist=pt_1.distance(pt_2)

print dist

#projected
pt_proj=pt_1.projected(vec)

a.put(pt_proj)
# ---------- end decodes_5 ----------
panel_3 = Panel("""distance2
distance
projected""")

# ----
# May also create a list of points through decodes. See "Construct a Point."
number_slider_3 = Slider(4.85, range=0..10)
pt_9 = ConstructPoint(XCoordinate=number_slider_3, YCoordinate=Slider(2.55, range=0..10), ZCoordinate=Slider(3.55, range=0..10))
pop2d = Populate2D(Region={Plane=PlaneXY(0, 0, 0), Size=Domain2(u=0..20, v=0..10)}, Count=100, Seed=1)
decodes_6 = DecodesPythonScript(pt=pt_9, pts=pop2d)  # -> console, a, b; inputs pt: Point3d, pts: list of Point3d
# ---------- decodes_6: Python ----------
#near
pt_a=Point.near(pt, pts)

a.put(pt_a)

#near_index
ind_a=Point.near_index(pt, pts)

print ind_a

#far
pt_b=Point.far(pt, pts)

a.put(pt_b)

#far_index
ind_b=Point.far_index(pt, pts)

print ind_b
# ---------- end decodes_6 ----------
panel_4 = Panel("""near
near_index
far
far_index""")
