# Grasshopper definition RGon.gh (Grasshopper 0.9.61)
# plug-ins: Decodes Python Interpreter

decodes = DecodesPythonScript(sides=Slider(4, range=0..10), rad=Slider(1.225, range=0..10), edge=Slider(3, range=0..10), apoth=Slider(3, range=0..10))  # -> console, a, b; inputs sides: Int32
# ---------- decodes: Python ----------
my_rgon=RGon(num_of_sides=sides, radius=rad, edge_length=edge)
a.put(my_rgon)


my_rgon2=RGon(num_of_sides=sides, radius=rad, apothem=apoth)
b.put(my_rgon2)
# ---------- end decodes ----------
panel = Panel("Construct RGon")

vec = VectorXYZ(XComponent=Slider(1, range=0..1), YComponent=Slider(1, range=0..1), ZComponent=Slider(1, range=0..1))  # -> Vector, Length
panel_2 = Panel("""STATIC METHODS
from_edge""")
decodes_2 = DecodesPythonScript(
    sides=Slider(6, range=0..10),
    n_vec=vec.Vector,
    n1=Slider(0, range=0..10),
    n2=Slider(0, range=0..10),
    n3=Slider(2, range=0..10),
    n4=Slider(2, range=0..10))  # -> console, a; inputs sides: Int32
# ---------- decodes_2: Python ----------
my_rgon = RGon.from_edge(Segment.by_coords2d(n1,n2,n3,n4),sides, n_vec)
a.put(my_rgon)
# ---------- end decodes_2 ----------

decodes_3 = DecodesPythonScript(sides=Slider(4, range=0..10), rad=Slider(1.225, range=0..10), edge=Slider(3, range=0..10))  # -> console, a, b; inputs sides: Int32
# ---------- decodes_3: Python ----------
my_rgon=RGon(num_of_sides=sides, radius=rad, edge_length=edge)
a.put(my_rgon)

#area
area=my_rgon.area
print area

#apothem
apothe=my_rgon.apothem
print apothe

#edge_length
e_len=my_rgon.edge_length
print e_len

#circle_inscr
circ_insc=my_rgon.circle_inscr
print circ_insc
b.put(circ_insc)

#interior_angle
i_ang=my_rgon.interior_angle
print i_ang
# ---------- end decodes_3 ----------
panel_3 = Panel("""PROPERTIES
area
apothem
edge_length
circle_inscr
interior_angle""")

decodes_4 = DecodesPythonScript(sides=Slider(4, range=0..10), rad=Slider(1.225, range=0..10), edge=Slider(3, range=0..10))  # -> console, a, b, c, d; inputs sides: Int32
# ---------- decodes_4: Python ----------
my_rgon=RGon(num_of_sides=sides, radius=rad, edge_length=edge)
a.put(my_rgon)

#to_pgon
new_pgon=my_rgon.to_pgon()
b.put(new_pgon)


#inflate
infl=my_rgon.inflate()
c.put(infl)


#deflate
defl=my_rgon.deflate()
d.put(defl)
# ---------- end decodes_4 ----------
panel_4 = Panel("""METHODS
to_pgon
inflate
deflate""")
