# Grasshopper definition Surface.gh (Grasshopper 0.9.61)
# plug-ins: Decodes Python Interpreter

decodes = DecodesPythonScript(res=Slider(17, range=0..20), num1=Slider(4.398, range=0..6.283), num2=Slider(0.817, range=0..6.283))  # -> console, a, b, c, d; inputs res: Int32
# ---------- decodes: Python ----------
#Surface
def func(u,v):
    return Point(u,v,math.sin(u+v))
twopi = Interval.twopi()
surf = Surface(func,twopi,twopi)


#to mesh
meshsurf=surf.to_mesh()
a.put(meshsurf)

#isocurve
isoc=surf.isocurve(num1)
b.put(isoc.surrogate)

#isopolyline
isopl=surf.isopolyline(None, num2)
c.put(isopl)
# ---------- end decodes ----------
panel = Panel("""to_mesh
isocurve
isopolyline""")

panel_2 = Panel("Other surface examples")
decodes_2 = DecodesPythonScript(res=Slider(15, range=0..20))  # -> console, a, b; inputs res: Int32
# ---------- decodes_2: Python ----------
#function for points
def func(u,v):
    return Point(u,v,math.sin(u)+math.cos(v))
twopi = Interval.twopi()
surf = Surface(func,twopi,twopi)


for u in twopi/res: 
    for v in twopi/res:
        a.put(surf.deval(u,v))

b.put(surf.to_mesh())
# ---------- end decodes_2 ----------
decodes_3 = DecodesPythonScript(res=Slider(15, range=0..20))  # -> console, a, b; inputs res: Int32
# ---------- decodes_3: Python ----------
#function for points
def func(u,v):
    return Point(u,v,math.sin(u+v))
twopi = Interval.twopi()
surf = Surface(func,twopi,twopi)


for u in twopi/res: 
    for v in twopi/res:
        a.put(surf.deval(u,v))

b.put(surf.to_mesh())
# ---------- end decodes_3 ----------

decodes_4 = DecodesPythonScript(res=Slider(17, range=0..20), num1=Slider(4.398, range=0..6.283), num2=Slider(0.817, range=0..6.283))  # -> console, a, b, c, d; inputs res: Int32
# ---------- decodes_4: Python ----------
#Surface
def func(u,v):
    return Point(u,v,math.sin(u+v))
twopi = Interval.twopi()
surf = Surface(func,twopi,twopi)


#surrogate
surro=surf.surrogate
a.put(surro)

#deval
d_pt=surf.deval(num1,num2)
b.put(d_pt)


#deval_pln
d_pl=surf.deval_pln(num1,num2)
c.put(d_pl)

#deval_cuviso
d_iso=surf.deval_curviso(num1,num2)
d.put(d_iso)

#deval_curv
# ---------- end decodes_4 ----------
panel_3 = Panel("""surrogate
deval
deval_pln
deval_curviso
deval_curv""")

panel_4 = Panel("Create a Surface")
decodes_5 = DecodesPythonScript(res=Slider(8, range=0..20))  # -> console, a, b; inputs res: Int32
# ---------- decodes_5: Python ----------
#function for points
def func(u,v):
    return Point(u,v)
Int=Interval(1,20)
surf = Surface(func,Int,Int)


for u in Int/res: 
    for v in Int/res:
        a.put(surf.deval(u,v))

b.put(surf.to_mesh())
# ---------- end decodes_5 ----------
