# Grasshopper definition Vec.gh (Grasshopper 0.9.61)
# plug-ins: Decodes Python Interpreter

panel = Panel("""Included all EXCEPT
to_tuple""")

vec = VectorXYZ(XComponent=Slider(0, range=0..10), YComponent=Slider(2.65, range=0..10), ZComponent=Slider(10, range=0..10))  # -> Vector, Length
decodes = DecodesPythonScript(vec_1=vec.Vector, num=Slider(10, range=0..10))  # -> console, a
# ---------- decodes: Python ----------
#Length
print vec_1.length

#Length2
print vec_1.length2

#Set Length
vec_1.length = num
print vec_1.length
# ---------- end decodes ----------
panel_2 = Panel("""Length
Length2
Set Length""")

# ----
# Less Than
# Greater Than
# Equal To
# Less Than/Equal To
# Greater Than/Equal To
# Not Equal To
number_slider = Slider(0, range=0..10)
vec_2 = VectorXYZ(XComponent=number_slider, YComponent=Slider(8.25, range=0..10), ZComponent=Slider(4.6, range=0..10))  # -> Vector, Length
vec_3 = VectorXYZ(XComponent=Slider(0, range=0..10), YComponent=Slider(2.65, range=0..10), ZComponent=Slider(10, range=0..10))  # -> Vector, Length
decodes_2 = DecodesPythonScript(vec_1=vec_3.Vector, vec_2=vec_2.Vector)  # -> console, a
# ---------- decodes_2: Python ----------
#LT
if vec_1 < vec_2:
    print "vec_1 is less than vec_2"
else:
    print "vec_1 is NOT less than vec_2"

#GT
if vec_1 > vec_2:
    print "vec_1 is greater than vec_2"
else:
    print "vec_1 is NOT greater than vec_2"

#EQ
if vec_1 == vec_2:
    print "vec_1 is equal to vec_2"
else:
    print "vec_1 is NOT equal to vec_2"

#LE
if vec_1 <= vec_2:
    print "vec_1 is less than or equal to vec_2"
else:
    print "vec_1 is NOT less than or equal to vec_2"

#GE
if vec_1 >= vec_2:
    print "vec_1 is greater than or equal to vec_2"
else:
    print "vec_1 is NOT greater than or equal to vec_2"

#NE
if vec_1 != vec_2:
    print "vec_1 is not equal to vec_2"
else:
    print "vec_1 is equal to vec_2"
# ---------- end decodes_2 ----------

pt = ConstructPoint(XCoordinate=Slider(6.586, range=0..10), YCoordinate=Slider(5.626, range=0..10), ZCoordinate=Slider(4.35, range=0..10))
pt_2 = ConstructPoint(XCoordinate=Slider(0, range=0..10), YCoordinate=Slider(2.65, range=0..10), ZCoordinate=Slider(0, range=0..10))
decodes_3 = DecodesPythonScript(x=Slider(6.65, range=0..10), y=Slider(2.117, range=0..10), z=Slider(10, range=0..10), pt_1=pt, pt_2=pt_2)  # -> console, a, b, c, d, e; inputs pt_1: Point3d
# ---------- decodes_3: Python ----------
vec_a=Vec()
a.put(vec_a)

#From x, y, z coordinates
vec_b=Vec(x,y,z)
b.put(vec_b)

#From 1 point
vec_c=Vec(pt_1)
c.put(vec_c)

#From 2 points
vec_d=Vec(pt_1, pt_2)
d.put(vec_d)

#Random
vec_e=Vec.random(Interval(1,10))
e.put(vec_e)
# ---------- end decodes_3 ----------
panel_3 = Panel("Construct a vector.")
vdis = VectorDisplay(Anchor=Point(0, 0, 0), Vector=[decodes_3.a, decodes_3.b, decodes_3.c, decodes_3.d, decodes_3.e])

vec_4 = VectorXYZ(XComponent=Slider(0, range=0..10), YComponent=Slider(8.25, range=0..10), ZComponent=Slider(4.6, range=0..10))  # -> Vector, Length
vec_5 = VectorXYZ(XComponent=Slider(0, range=0..10), YComponent=Slider(2.65, range=0..10), ZComponent=Slider(10, range=0..10))  # -> Vector, Length
decodes_4 = DecodesPythonScript(vec_1=vec_5.Vector, vec_2=vec_4.Vector)  # -> console, a
# ---------- decodes_4: Python ----------
#is_identical
print vec_1.is_identical(vec_2)

#is_coincident
print vec_1.is_coincident(vec_2)

#is_parallel
print vec_1.is_parallel(vec_2)

#is_2D
print vec_1.is_2d
# ---------- end decodes_4 ----------
panel_4 = Panel("""is_identical
is_coincident
is_parallel
is_2D""")

vec_6 = VectorXYZ(XComponent=Slider(0, range=0..10), YComponent=Slider(8.25, range=0..10), ZComponent=Slider(4.6, range=0..10))  # -> Vector, Length
vec_7 = VectorXYZ(XComponent=Slider(0, range=0..10), YComponent=Slider(2.65, range=0..10), ZComponent=Slider(10, range=0..10))  # -> Vector, Length
decodes_5 = DecodesPythonScript(vec_1=vec_7.Vector, vec_2=vec_6.Vector, num=Slider(1.583, range=0..10))  # -> console, a, b, c, e, f
# ---------- decodes_5: Python ----------
#Add
vec_a=vec_1 + vec_2

a.put(vec_a)

#Subtract
vec_b=vec_1 - vec_2

b.put(vec_b)

#Divide
vec_c=vec_1 / num

c.put(vec_c)

#Multiply Scalar
vec_e=vec_1 * num

e.put(vec_e)

#Multiply Vector (Cross Product)
vec_f=vec_1 * vec_2

f.put(vec_f)
# ---------- end decodes_5 ----------
panel_5 = Panel("""Add
Subtract
Divide
Multiply""")
vdis_2 = VectorDisplay(Anchor=Point(0, 0, 0), Vector=[decodes_5.b, decodes_5.c, decodes_5.a, decodes_5.e, decodes_5.f])

vec_8 = VectorXYZ(XComponent=Slider(0, range=0..10), YComponent=Slider(2.65, range=0..10), ZComponent=Slider(10, range=0..10))  # -> Vector, Length
vec_9 = VectorXYZ(XComponent=Slider(3.4, range=0..10), YComponent=Slider(2.65, range=0..10), ZComponent=Slider(10, range=0..10))  # -> Vector, Length
decodes_6 = DecodesPythonScript(vec_1=vec_8.Vector, vec_2=vec_9.Vector)  # -> console, a
# ---------- decodes_6: Python ----------
#angle
ang_1=vec_1.angle(vec_2)
print ang_1

#angle deg
ang_2=vec_1.angle_deg(vec_2)
print ang_2
# ---------- end decodes_6 ----------
panel_6 = Panel("""angle
angle_deg""")

decodes_7 = DecodesPythonScript()  # -> console, a, b, c
# ---------- decodes_7: Python ----------
#ux
ux=Vec.ux()
a.put(ux)

#uy
uy=Vec.uy()
b.put(uy)

#uz
uz=Vec.uz()
c.put(uz)
# ---------- end decodes_7 ----------
vdis_3 = VectorDisplay(Anchor=Point(0, 0, 0), Vector=[decodes_7.c, decodes_7.b, decodes_7.a])
panel_7 = Panel("""ux
uy
uz""")

vec_10 = VectorXYZ(XComponent=Slider(0, range=0..10), YComponent=Slider(2.65, range=0..10), ZComponent=Slider(10, range=0..10))  # -> Vector, Length
decodes_8 = DecodesPythonScript(vec_1=vec_10.Vector, digits=Slider(0, range=0..10), num=Slider(0.25, range=0..10))  # -> console, a, b, c, d; inputs digits: Int32
# ---------- decodes_8: Python ----------
#Invert
vec_a=vec_1.__invert__()
a.put(vec_a)

#Inverted
vec_b=vec_1.inverted()
b.put(vec_b)

#Rounded
vec_c=vec_1.rounded(digits)
c.put(vec_c)

#Limited
vec_d=vec_1.limited(num)
d.put(vec_d)
# ---------- end decodes_8 ----------
vdis_4 = VectorDisplay(Anchor=Point(0, 0, 0), Vector=[decodes_8.d, decodes_8.c, decodes_8.b, decodes_8.a])
panel_8 = Panel("""invert
inverted
rounded
limited""")

pop2d = Populate2D(Region={Plane=PlaneXY(0, 0, 0), Size=Domain2(u=0..20, v=0..10)}, Count=100, Seed=1)
pt_3 = ConstructPoint(XCoordinate=0, YCoordinate=0, ZCoordinate=0)
vec2pt = Vector2Pt(PointA=pt_3, PointB=pop2d, Unitize=False)  # -> Vector, Length
vec_11 = VectorXYZ(XComponent=Slider(0, range=0..10), YComponent=Slider(2.65, range=0..10), ZComponent=Slider(10, range=0..10))  # -> Vector, Length
vec_12 = VectorXYZ(XComponent=Slider(0, range=0..10), YComponent=Slider(8.75, range=0..10), ZComponent=Slider(10, range=0..10))  # -> Vector, Length
decodes_9 = DecodesPythonScript(vec_1=vec_11.Vector, vec_2=vec_12.Vector, num=Slider(0.653, range=0..1), vecs=vec2pt.Vector)  # -> console, a, b1, b2, c, d; inputs vecs: list
# ---------- decodes_9: Python ----------
#Interpolate
vec_a=Vec.interpolate(vec_1, vec_2, num)
a.put(vec_a)

#Average
vec_b1=Vec.average([vec_1, vec_2])
b1.put(vec_b1)

vec_b2=Vec.average(vecs)
b2.put(vec_b2)

#Bisector
vec_c=Vec.bisector(vec_1,vec_2)
c.put(vec_c)

#Normalized
vec_d=vec_1.normalized()
d.put(vec_d)
# ---------- end decodes_9 ----------
panel_9 = Panel("""Interpolate
Average
Bisector
Normalized""")
vdis_5 = VectorDisplay(Anchor=Point(0, 0, 0), Vector=[decodes_9.a, decodes_9.b1, decodes_9.b2, decodes_9.c, decodes_9.d])

vec_13 = VectorXYZ(XComponent=Slider(3.4, range=0..10), YComponent=Slider(2.65, range=0..10), ZComponent=Slider(10, range=0..10))  # -> Vector, Length
vec_14 = VectorXYZ(XComponent=Slider(0, range=0..10), YComponent=Slider(2.65, range=0..10), ZComponent=Slider(10, range=0..10))  # -> Vector, Length
decodes_10 = DecodesPythonScript(vec_1=vec_14.Vector, vec_2=vec_13.Vector)  # -> console, a, b
# ---------- decodes_10: Python ----------
#dot
dot=vec_1.dot(vec_2)
print dot

#cross
vec_b=vec_1.cross(vec_2)
b.put(vec_b)
# ---------- end decodes_10 ----------
vdis_6 = VectorDisplay(Anchor=Point(0, 0, 0), Vector=decodes_10.b)
panel_10 = Panel("""dot
cross""")

# ----
# projected length
# projected
# to ray
# to line
number_slider_2 = Slider(3.4, range=0..10)
vec_15 = VectorXYZ(XComponent=Slider(0, range=0..10), YComponent=Slider(2.65, range=0..10), ZComponent=Slider(10, range=0..10))  # -> Vector, Length
vec_16 = VectorXYZ(XComponent=Slider(3.4, range=0..10), YComponent=Slider(2.65, range=0..10), ZComponent=Slider(10, range=0..10))  # -> Vector, Length
pt_4 = ConstructPoint(XCoordinate=number_slider_2, YCoordinate=Slider(2.65, range=0..10), ZCoordinate=Slider(10, range=0..10))
decodes_11 = DecodesPythonScript(vec_1=vec_15.Vector, vec_2=vec_16.Vector, pt=pt_4)  # -> console, a, b, c
# ---------- decodes_11: Python ----------
#projected length
proj_len=vec_1.projected_length(vec_2)
print proj_len

#projected
vec_a=vec_1.projected(vec_2)
a.put(vec_a)

#to ray
ray=vec_1.to_ray(pt)
b.put(ray)


#to line
line=vec_1.to_line(pt)
c.put(line)
# ---------- end decodes_11 ----------
vdis_7 = VectorDisplay(Anchor=Point(0, 0, 0), Vector=[decodes_11.b, decodes_11.c, decodes_11.a])
