# Grasshopper definition solarIncidence.ghx (Grasshopper 0.9.14)
# plug-ins: Decodes Python Interpreter

panel = Panel("G:\git\decodes\sandbox\_codesnips\p4\solarIncidence\USA_CA_San.Francisco.Intl.AP.724940_TMY3.epw")
epw_data = DecodesPythonScript(epw_path=panel)  # -> out, latlong, timezone, DirNormIrad
# ---------- epw_data: Python ----------
import decodes.extensions.parseEPW as epw

def epwData(filepath):
  """given a path to an EPW file, 
  extracts the direct normal irradiance, lat, long, tmz
  out: a dictionary with the above information
  """
  radValues = epw.parse_epw_file(filepath, "DirNormIrad")
  metadata = epw.epw_metadata(filepath)
  dict = {}
  dict['lat'] = metadata['lat']
  dict['long'] = metadata['long']
  dict['timezone'] = metadata['timezone']
  dict['name'] = metadata['name']
  dict['DirNormIrad'] = radValues
  return dict


epwdata = epwData(epw_path)
latlong.put(Vec(epwdata['lat'],epwdata['long']))
timezone = epwdata['timezone']
DirNormIrad = epwdata['DirNormIrad']
# ---------- end epw_data ----------
panel_2 = Panel(epw_data.out)
mesh = Mesh(<mesh referenced from the Rhino model>)
calc_avg_yearly_radiation = DecodesPythonScript(mesh_in=mesh, latlong=epw_data.latlong, timezone=epw_data.timezone, DirNormIrad=epw_data.DirNormIrad)  # -> out, radiation; inputs mesh_in: Mesh, DirNormIrad: list
# ---------- calc_avg_yearly_radiation: Python ----------
import math
import decodes.extensions.solarGeom as sg


"""a simple example of calculating solar incident radiation.  
given a user-defined plane to evaluate, a hard-coded position, 
and a EPW file that associates date/time with radiation level, 
calculates the amount of radition striking the plane
and produces a simple visualization.
"""

def srfIrradiance(plane,hourOfYr,epwdata):
  """calculates irradiance striking a given plane at a given hour for a given location
  plane (fp.Ray) the plane in question
  hour (int) the hour of the year to test, 0-8760
  epwdata (dict) a dictionary of epw data
  out: the amount of radition striking the plane
  """
  #calculate the solar vector
  day = int(hourOfYr/24)
  hour = hourOfYr%24
  sunvec = sg.calc_sunVector(epwdata['lat'], epwdata['long'], epwdata['timezone'], day, hour)
  
  #find the angle between our plane and the sun direction
  incidenceAngle = abs(sunvec.angle(plane.vec))
  if incidenceAngle > math.pi/2 : srfIrr = 0.0 #if the sun is behind our plane, return zero
  else : srfIrr = epwdata['DirNormIrad'][hourOfYr] * math.cos(incidenceAngle) # otherwise, calculate the amout of radition striking our surface
  return srfIrr



# gathering user input #
mymesh = mesh_in
epwdata = {}
epwdata['lat'] = latlong.x
epwdata['long'] = latlong.y
epwdata['timezone'] = timezone
epwdata['DirNormIrad'] = DirNormIrad

# find the normals for each mesh face
normals = [Ray(mymesh.face_centroid(i),mymesh.face_normal(i)) for i in range(len(mymesh.faces))]
normals = normals[:2]
# calculate the yearly average incident radiation value for each mesh face
radVals = []
for normal in normals: 
    radVals.append(sum([srfIrradiance(normal,h,epwdata) for h in range(8760)])/8760)

radiation = radVals
# ---------- end calc_avg_yearly_radiation ----------
visualize = DecodesPythonScript(
    mesh_in=mesh,
    radiation=calc_avg_yearly_radiation.radiation,
    hair_length="0.5 to 10.0",
    low_color=ColourSwatch(SwatchColor=RGB(0, 136, 255)),
    high_color=ColourSwatch(SwatchColor=RGB(255, 0, 0)))  # -> out, hairs_out, colors_out; inputs mesh_in: Mesh, radiation: list
# ---------- visualize: Python ----------
import math
import decodes.extensions.solarGeom as sg


# gathering user input #
mymesh = mesh_in
radVals = radiation
colorA = low_color
colorB = high_color
hair_length_min = hair_length.Min
hair_length_max = hair_length.Max

# find the normals for each mesh face
normals = [Ray(mymesh.face_centroid(i),mymesh.face_normal(i)) for i in range(len(mymesh.faces))]

#visualize results by producing hairs and colors for each mesh face
colors = []
for n, normal in enumerate(normals):
    t = (radVals[n]-min(radVals))/(max(radVals)-min(radVals))
    colors.append(Color.interpolate(colorA,colorB,t))
    normal.vec.length = ((hair_length_max - hair_length_min) * t) + hair_length_min
    
hairs_out.put(normals)
colors_out.put(colors)
# ---------- end visualize ----------
panel_3 = Panel(visualize.hairs_out)
click_to_bake = Button()
panel_4 = Panel(visualize.colors_out)
color_bake = COLORBAKE(geo=visualize.hairs_out, col=visualize.colors_out, bool=click_to_bake)

# ==== cluster COLORBAKE
geo = ClusterInput()
col = ClusterInput()
geo_2 = Geometry(geo)
col_2 = Colour(col)
argb = SplitARGB(Colour=col_2)  # -> Alpha, Red, Green, Blue
frgb = ColourRGBF(Alpha=1, Red=argb.Red, Green=argb.Green, Blue=argb.Blue)
material = CreateMaterial(Diffuse=frgb, Specular=RGB(255, 255, 255), Emission=RGB(0, 0, 0), Transparency=expr("1-T", argb.Alpha), Shine=0)
bool = ClusterInput()
bool_2 = Boolean(bool)
preview = CustomPreview(Geometry=geo_2, Shader=col_2)
c_script = CSharpScript(objs=geo_2, colors=col_2, materials=material, activate=bool_2, groupListTgthr=Toggle(True))  # -> out, A; inputs objs: list, names: list of String, layers: list of String, colors: list of Color, pWidths: list of Double, wiresEach: list of Int32, materials: list, activate: Boolean, groupListTgthr: Boolean
# ---------- c_script: C# ----------
    //Inserts geometry into the Rhino document, with custom attributes
    //Written by Giulio Piacentino
    //Version written 2011 10 18 - for Grasshopper 0.8.52

    if (activate)
    {
      int groupIndex = -1;
      if(groupListTgthr)
        groupIndex = doc.Groups.Add();

      for(int i = 0; i < objs.Count; i++)
      {
        object obj = objs[i];
        if(obj == null)
        {
          Print("No object to bake");
          return;
        }

        //Make new attribute to set name
        Rhino.DocObjects.ObjectAttributes att = new Rhino.DocObjects.ObjectAttributes();

        string name = names.Count > 0 ? names[i % names.Count] : null;
        //Set object name
        if(!string.IsNullOrEmpty(name))
        {
          att.Name = name;
        }

        Color color = colors.Count > 0 ? colors[i % colors.Count] : new Color();
        //Set color
        if(!color.IsEmpty)
        {
          att.ColorSource = Rhino.DocObjects.ObjectColorSource.ColorFromObject; //Make the color type "by object"
          att.ObjectColor = color;

          att.PlotColorSource = Rhino.DocObjects.ObjectPlotColorSource.PlotColorFromObject; //Make the plot color type "by object"
          att.PlotColor = color;
        }

        string layer = layers.Count > 0 ? layers[i % layers.Count] : null;
        //Set layer
        if(!string.IsNullOrEmpty(layer) && Rhino.DocObjects.Layer.IsValidName(layer))
        {
          //Get the current layer index
          Rhino.DocObjects.Tables.LayerTable layerTable = doc.Layers;
          int layerIndex = layerTable.Find(layer, true);

          if(layerIndex < 0) //This layer does not exist, we add it
          {
            Rhino.DocObjects.Layer onlayer = new Rhino.DocObjects.Layer(); //Make a new layer
            onlayer.Name = layer;

            layerIndex = layerTable.Add(onlayer); //Add the layer to the layer table
            if (layerIndex > -1) //We manged to add layer!
            {
              att.LayerIndex = layerIndex;
              Print("Added new layer to the document at position " + layerIndex + " named " + layer + ". ");
            } else
              Print("Layer did not add. Try cleaning up your layers."); //This never happened to me.
          }
          else
            att.LayerIndex = layerIndex; //We simply add to the existing layer
        }


        double pWidth = pWidths.Count > 0 ? pWidths[i % pWidths.Count] : 0;
        //Set plotweight
        if(pWidth > 0)
        {
          att.PlotWeightSource = Rhino.DocObjects.ObjectPlotWeightSource.PlotWeightFromObject;
          att.PlotWeight = pWidth;
        }


        object material = materials.Count > 0 ? materials[i % materials.Count] : null;
        //Set material
        bool materialByName = !string.IsNullOrEmpty(material as string);
        Rhino.Display.DisplayMaterial inMaterial = material as Rhino.Display.DisplayMaterial;
        if(material is Color)
        {
          inMaterial = new Rhino.Display.DisplayMaterial((Color) material);
        }
        if(material != null && inMaterial == null && !materialByName)
        {
          if(!(material is string))
          {
            try //We also resort to try with IConvertible
            {
              inMaterial = (Rhino.Display.DisplayMaterial) Convert.ChangeType(material, typeof(Rhino.Display.DisplayMaterial));
            }
            catch(InvalidCastException)
            {
            }
          }
        }
        if(inMaterial != null || materialByName)
        {
          string matName;

          if(!materialByName)
          {
            matName = string.Format("A:{0}-D:{1}-E:{2}-S:{3},{4}-T:{5}",
              Format(inMaterial.Ambient),
              Format(inMaterial.Diffuse),
              Format(inMaterial.Emission),
              Format(inMaterial.Specular),
              inMaterial.Shine.ToString(),
              inMaterial.Transparency.ToString()
              );
          }
          else
          {
            matName = (string) material;
          }

          int materialIndex = doc.Materials.Find(matName, true);
          if(materialIndex < 0 && !materialByName) //Material does not exist and we have its specs
          {
            materialIndex = doc.Materials.Add(); //Let's add it
            if(materialIndex > -1)
            {
              Print("Added new material at position " + materialIndex + " named \"" + matName + "\". ");
              Rhino.DocObjects.Material m = doc.Materials[materialIndex];
              m.Name = matName;
              m.AmbientColor = inMaterial.Ambient;
              m.DiffuseColor = inMaterial.Diffuse;
              m.EmissionColor = inMaterial.Emission;
              //m.ReflectionColor = no equivalent
              m.SpecularColor = inMaterial.Specular;
              m.Shine = inMaterial.Shine;
              m.Transparency = inMaterial.Transparency;
              //m.TransparentColor = no equivalent
              m.CommitChanges();

              att.MaterialSource = Rhino.DocObjects.ObjectMaterialSource.MaterialFromObject;
              att.MaterialIndex = materialIndex;
            }
            else
              Print("Material did not add. Try cleaning up your materials."); //This never happened to me.
          }
          else if(materialIndex < 0 && materialByName) //Material does not exist and we do not have its specs. We do nothing
          {
            Print("Warning: material name not found. I cannot set the source to this material name. Add a material with name: " + matName);
          }
          else
          {
            //If this material exists, we do not replace it!
            att.MaterialSource = Rhino.DocObjects.ObjectMaterialSource.MaterialFromObject;
            att.MaterialIndex = materialIndex;
          }
        }


        int wires = wiresEach.Count > 0 ? wiresEach[i % wiresEach.Count] : 0;
        //Set wire density
        if(wires == -1 || wires > 0)
        {
          att.WireDensity = wires;
        }

        Bake(obj, att, groupIndex);
      }
    }
    else
    {
      Print("Inactive");
    }
# ---------- c_script: C# additional code ----------
  void Bake(object obj, Rhino.DocObjects.ObjectAttributes att, int groupIndex)
  {
    if(obj == null)
      return;

    Guid id;

    //Bake to the right type of object
    if(obj is GeometryBase)
    {
      GeometryBase geomObj = obj as GeometryBase;

      switch(geomObj.ObjectType)
      {
        case Rhino.DocObjects.ObjectType.Brep:
          id = doc.Objects.AddBrep(obj as Brep, att);
          break;
        case Rhino.DocObjects.ObjectType.Curve:
          id = doc.Objects.AddCurve(obj as Curve, att);
          break;
        case Rhino.DocObjects.ObjectType.Point:
          id = doc.Objects.AddPoint((obj as Rhino.Geometry.Point).Location, att);
          break;
        case Rhino.DocObjects.ObjectType.Surface:
          id = doc.Objects.AddSurface(obj as Surface, att);
          break;
        case Rhino.DocObjects.ObjectType.Mesh:
          id = doc.Objects.AddMesh(obj as Mesh, att);
          break;
        case (Rhino.DocObjects.ObjectType) 1073741824://Rhino.DocObjects.ObjectType.Extrusion:
          id = (Guid) typeof(Rhino.DocObjects.Tables.ObjectTable).InvokeMember("AddExtrusion", BindingFlags.Instance | BindingFlags.InvokeMethod, null, doc.Objects, new object[]{obj, att});
          break;
        case Rhino.DocObjects.ObjectType.PointSet:
          id = doc.Objects.AddPointCloud(obj as Rhino.Geometry.PointCloud, att); //This is a speculative entry
          break;
        default:
          Print("The script does not know how to handle this type of geometry: " + obj.GetType().FullName);
          return;
      }
    }
    else
    {
      Type objectType = obj.GetType();

      if(objectType == typeof(Arc))
      {
        id = doc.Objects.AddArc((Arc) obj, att);
      }
      else if(objectType == typeof(Box))
      {
        id = doc.Objects.AddBrep(((Box) obj).ToBrep(), att);
      }
      else if(objectType == typeof(Circle))
      {
        id = doc.Objects.AddCircle((Circle) obj, att);
      }
      else if(objectType == typeof(Ellipse))
      {
        id = doc.Objects.AddEllipse((Ellipse) obj, att);
      }
      else if(objectType == typeof(Polyline))
      {
        id = doc.Objects.AddPolyline((Polyline) obj, att);
      }
      else if(objectType == typeof(Sphere))
      {
        id = doc.Objects.AddSphere((Sphere) obj, att);
      }
      else if(objectType == typeof(Point3d))
      {
        id = doc.Objects.AddPoint((Point3d) obj, att);
      }
      else if(objectType == typeof(Line))
      {
        id = doc.Objects.AddLine((Line) obj, att);
      }
      else if(objectType == typeof(Vector3d))
      {
        Print("Impossible to bake vectors");
        return;
      }
      else if(obj is IEnumerable)
      {
        int newGroupIndex;
        if(groupIndex == -1)
          newGroupIndex = doc.Groups.Add();
        else
          newGroupIndex = groupIndex;
        foreach(object o in obj as IEnumerable)
        {
          Bake(o, att, newGroupIndex);
        }
        return;
      }
      else
      {
        Print("Unhandled type: " + objectType.FullName);
        return;
      }
    }

    if(groupIndex != -1)
    {
      doc.Groups.AddToGroup(groupIndex, id);
      Print("Added " + obj.GetType().Name + " to group number " + groupIndex);
    }
    else
      Print("Added " + obj.GetType().Name);
  }

  static string Format(Color c)
  {
    return (new System.Text.StringBuilder("A")).Append(c.A.ToString()).Append("R").Append(c.R.ToString()).Append("G")
      .Append(c.G.ToString()).Append("B").Append(c.B.ToString()).ToString();
  }
# ---------- end c_script ----------
