# Grasshopper definition 01-panel optimization.ghx (Grasshopper 0.9.14)
# plug-ins: Decodes Python Interpreter

md_slider = MDSlider(slider_value=Point(1, 1, 0.5), x_domain=Domain(0, 1), y_domain=Domain(0, 1), z_domain=Domain(0, 1), SliderMode=0)
rad_0 = Slider(0.56, range=0.01..1)
rad_1 = Slider(0.22, range=0.01..1)
skew_u = Slider(0.47, range=0..1)
skew_v = Slider(0.78, range=0..1)
res_u = Slider(20, range=3..20)
res_v = Slider(20, range=3..20)

# ---- group: dupin cyclide surface
decodes = DecodesPythonScript(rad_0=rad_0, rad_1=rad_1, ipt=md_slider)  # -> console, a
# ---------- decodes: Python ----------
print ipt
import math

tvec = Vec(0,-3,0) # to move the thing away from origin

def func(u,v):
    x = (rad_0+rad_1*math.cos(v))*math.cos(u)
    y = (rad_0+rad_1*math.cos(v))*math.sin(u)
    z = rad_1 * math.sin(v)
    
    vec = Vec(ipt,Point(x,y,z))
    vec.length = 1/vec.length
    return ipt + vec + tvec
    
a.put(func)
# ---------- end decodes ----------

# ---- group: sqrt distribution
decodes_2 = DecodesPythonScript(ival="0 to PI", count=res_u, skew=skew_u)  # -> console, a; inputs count: Int32
# ---------- decodes_2: Python ----------
import math
s = Interval(0.00001,4.0).eval(skew) # 0 < s < 4.0

def f(x):
    x = x - 0.5
    y = 0.0
    if x < 0 :
        y = -math.sqrt(-x) ** s
    if x > 0:
        y = math.sqrt(x) ** s
    return y

ival_y = Interval(f(0),f(1))

for x in Interval().divide(count,include_last = True):
    y = f(x)
    a.put(ival.eval(ival_y.deval(y)))
    
    
    print ival.eval(ival_y.deval(y))
# ---------- end decodes_2 ----------
u_vals = Number(decodes_2.a)

# ---- group: sq distribution
decodes_3 = DecodesPythonScript(ival="0 to PI", count=res_v, skew=skew_v)  # -> console, a; inputs count: Int32
# ---------- decodes_3: Python ----------
for x in Interval().divide(count,include_last = True):
    s = Interval(0.5,1.5).eval(skew) # 0.5 < s < 1.5
    y = x**(s**10)# 0 < y < 1
    a.put(ival.eval(y))
# ---------- end decodes_3 ----------
v_vals = Number(decodes_3.a)

# ----
surface_function = Data(decodes.a)

# ---- group: create mesh from surface
decodes_4 = DecodesPythonScript(func=surface_function, u_vals=u_vals, v_vals=v_vals)  # -> console, a; inputs u_vals: list, v_vals: list
# ---------- decodes_4: Python ----------
msh = Mesh()
for v in v_vals:
    for u in u_vals:
        msh.append(func(u,v))

res_u = len(u_vals)
# simple triangulation style
for v in range(len(v_vals)):
    row = v*res_u
    for u in range(len(u_vals)-1):
        pi_0 = row+u
        pi_1 = row+u+1
        pi_2 = row+u+res_u+1
        pi_3 = row+u+res_u
        msh.add_face(pi_0,pi_1,pi_2,pi_3)

a.put(msh)
# ---------- end decodes_4 ----------
panel_mesh = Mesh(decodes_4.a)
