# Grasshopper definition attractor.ghx (Grasshopper 0.9.14)
# plug-ins: Decodes Python Interpreter

sqgrid = Square(Plane=PlaneXY(0, 0, 0), Size=1, ExtentX=5, ExtentY=5)  # -> Cells, Points
sqgrid_2 = Square(Plane=PlaneXY(0, 0, 0), Size=1, ExtentX=5, ExtentY=5)  # -> Cells, Points
pt = Point(<point referenced from the Rhino model>)
pt_2 = Point([<point referenced from the Rhino model> x4])
decodes = DecodesPythonScript(points=sqgrid_2.Points, attractor=pt_2, strength=Slider(1.59, range=0..10))  # -> console, a, a_props; inputs points: list, attractor: list
# ---------- decodes: Python ----------
lines = [ ]
for pt in points:
    distance = [ ]
    for att in attractor:
        distance.append(pt.distance(att))
    distance.sort()
    dist = distance[0] # Get minimum distance
    #dist = distance[-1] # Set maximum distance
    #dist = sum(distance)/len(distance) # Set average distance
    
    z_disp = dist/strength
    line = Segment(pt,Vec(0,0,z_disp))
    line.set_weight(z_disp+1)
    lines.append(line)

a.put(lines)
# ---------- end decodes ----------
decodes_2 = DecodesPythonScript(points=sqgrid.Points, attractor=pt, strength=Slider(1.59, range=0..10))  # -> console, a, a_props; inputs points: list
# ---------- decodes_2: Python ----------
lines = [ ]
for pt in points:
    dist = pt.distance(attractor)
    z_disp = dist/strength
    line = Segment(pt,Vec(0,0,z_disp))
    line.set_weight(z_disp+1)
    lines.append(line)

a.put(lines)
# ---------- end decodes_2 ----------
hardboil = DecodesHardBoil(Geometry=decodes_2.a, Properties=decodes_2.a_props)
hardboil_2 = DecodesHardBoil(Geometry=decodes.a, Properties=decodes.a_props)
