# Grasshopper definition closest_pt.gh (Grasshopper 0.9.14)
# plug-ins: Decodes Python Interpreter

decodes = DecodesPythonScript()  # -> console, a
# ---------- decodes: Python ----------
seg = Segment(Point(), Point(10,0,0))

print seg.closest_point(Point(0,1,0))

a.put(seg)
# ---------- end decodes ----------
