# Grasshopper definition danzer.ghx (Grasshopper 0.9.14)
# plug-ins: Decodes Python Interpreter

slider = Slider(0.2, range=0..1)
slider_2 = Slider(0.01, range=0..0.1)
slider_3 = Slider(0.1, range=0..0.1)
geo = Geometry([<point referenced from the Rhino model> x4])
decodes = DecodesPythonScript(
    mr=Slider(4, range=0..10),
    points=[Point(0.6151234466, 0.1456374847, 0), Point(0.141526428, 0.2161892917, 0), Point(0.2504258661, 0.40549528, 0), Point(0.1526587283, 0.07960404295, 0)],
    x=Slider(0.13, range=0..1))  # -> console, b, danzer; inputs points: list
# ---------- decodes: Python ----------
import decodes.extensions.danzerTile as dt

maxRecursion = int(mr)
if maxRecursion > 5: maxRecursion = 5
meshes = [ ]

def main():
    mesh = recurse([dt.DzTileK()])
    centroid = [mesh.centroid for mesh in meshes]
    indexes = []
    distances = []
    for c in centroid:
        dist = []
        for p in points: 
            dist.append(c.distance(p))
        dist.sort()
        distances.append(dist[0])
    for d in distances:
        if d > x:
            indexes.append(distances.index(d))
    #print [meshes[i].pts for i in indexes]
    b.put([meshes[i].pts for i in indexes])
    danzer.put([meshes[i] for i in indexes])

def recurse(tiles,rlvl=0):
  
  if rlvl < maxRecursion : 
    for tile in tiles: recurse(tile.inflate(),rlvl+1)
  else : 
    for tile in tiles:
      meshes.append(tile.draw())
    return

if __name__=="__main__": main()
# ---------- end decodes ----------
voronoi³ = Voronoi3D(Points=decodes.b)  # -> Cells, Boundary
panel = Panel(decodes.b)
mint = MeshIntersection(MeshesA=voronoi³.Cells, MeshesB=graft(decodes.danzer))
mdif = MeshDifference(MeshesA=graft(decodes.danzer), MeshesB=voronoi³.Cells)
