# Grasshopper definition magnetic field.ghx (Grasshopper 0.9.14)
# plug-ins: Decodes Python Interpreter

slider = Slider(13.4, range=0..20)  # disabled
geo = Geometry(<curve referenced from the Rhino model>)  # disabled
geo_2 = Geometry(<curve referenced from the Rhino model>)  # disabled
trigrid = Triangular(Plane=PlaneXY(-42.27924175, -50.81144793, 0), Size=slider, ExtentX=5, ExtentY=5)  # -> Cells, flatten(Points); disabled
slider_2 = Slider(0.4, range=0..10)  # disabled
line = Line(geo)  # disabled
slider_3 = Slider(2.8, range=0..10)  # disabled
line_2 = Line(geo_2)  # disabled
slider_4 = Slider(0.2, range=0..1)  # disabled
pt = Point(<point referenced from the Rhino model>)  # disabled
flip = Flip(Curve=line)  # -> Curve, Flag; disabled
vec2pt = Vector2Pt(PointA=trigrid.Points, PointB=pt, Unitize=False)  # -> Vector, Length; disabled
pt_2 = Point(<point referenced from the Rhino model>)  # disabled
flip_2 = Flip(Curve=line_2)  # -> Curve, Flag; disabled
panel = Panel(""".7
.5""")  # disabled
slider_5 = Slider(0.8, range=0..5)  # disabled
pt_3 = Point([<point referenced from the Rhino model> x6])  # disabled
decodes = DecodesPythonScript(starting_line=flip.Curve, charged_points=pt_2, charges=slider_2)  # -> console, a, b; inputs starting_line: Line; disabled
# ---------- decodes: Python ----------
sl = starting_line
cp = charged_points
iterations = 200
step_size = 1.0
ppos = [sl.spt]
pvec = sl.vec.normalized(step_size)
threshold = step_size/2
keep_going = True

while keep_going:
    # first calculate all the vecs that will influence the pvec
    cvec = Vec(ppos[-1],cp) # Get the vector for origin point and charge
    cvec.length = charges / cvec.length  # resize according to distance from particle
    
    # alter the pvec
    pvec = (pvec + cvec).normalized() # alter the pvec
    # move the partilce
    ppos.append(ppos[-1]+pvec) # Move pt with current vector
    
    # test to see if we should stop
    if cp.distance(ppos[-1]) < threshold: keep_going = False # 1. too close to the charge
    if len(ppos) > iterations : keep_going = False # 2. too many steps
    
for n in range(len(ppos)-1): a.put(Segment(ppos[n], ppos[n+1]))
# ---------- end decodes ----------
decodes_2 = DecodesPythonScript(starting_line=flip_2.Curve, charged_points=pt_3, charges=slider_4)  # -> console, a, b; inputs starting_line: Line, charged_points: list; disabled
# ---------- decodes_2: Python ----------
sl = starting_line
cp = charged_points
iterations = 200
step_size = 1.0
ppos = [sl.spt]
pvec = sl.vec.normalized(step_size)
threshold = step_size/2
keep_going = True

while keep_going:
    for cp in charged_points:
        # first calculate all the vecs that will influence the pvec
        cvec = Vec(ppos[-1],cp) # Get the vector for origin point and charge
        cvec.length = charges / cvec.length  # resize according to distance from particle
        pvec = (pvec + cvec).normalized() # alter the pvec
    
    # move the partilce
    ppos.append(ppos[-1]+pvec) # Move pt with current vector
    
    # test to see if we should stop
    for cp in charged_points:
        if cp.distance(ppos[-1]) < threshold: keep_going = False # 1. too close to the charge
    if len(ppos) > iterations : keep_going = False # 2. too many steps
    
for n in range(len(ppos)-1): a.put(Segment(ppos[n], ppos[n+1]))
# ---------- end decodes_2 ----------
line_3 = LineSDL(Start=trigrid.Points, Direction=vec2pt.Vector, Length=slider_3)  # disabled
pt_4 = Point([<point referenced from the Rhino model> x5])  # disabled
decodes_3 = DecodesPythonScript(starting_line=line_3, charged_points=pt_4, charges=slider_5)  # -> console, a, b; inputs starting_line: Line, charged_points: list, charges: list; disabled
# ---------- decodes_3: Python ----------
sl = starting_line
iterations = 200
step_size = 1.0
ppos = [sl.spt]
pvec = sl.vec.normalized(step_size)
threshold = step_size/2
keep_going = True
while len(charges) < len(charged_points): charges.append(charges[-1])


while keep_going:
    for i, cp in enumerate(charged_points):
        charge = float(charges[i])
        cvec = Vec(ppos[-1],cp) # get the vector for origin point and charge
        cvec.length = charge / cvec.length  # resize according to distance from particle
        pvec = (pvec + cvec).normalized() # alter the pvec
    
    # move the partilce
    ppos.append(ppos[-1]+pvec) # Move pt with current vector
    
    # test to see if we should stop
    for cp in charged_points:
        if cp.distance(ppos[-1]) < threshold: keep_going = False # 1. too close to the charge
    
    if len(ppos) > iterations : keep_going = False # 2. too many steps
    
for n in range(len(ppos)-1): a.put(Segment(ppos[n], ppos[n+1]))
# ---------- end decodes_3 ----------
