# Grasshopper definition pinwheel.ghx (Grasshopper 0.9.14)
# plug-ins: Decodes Python Interpreter

decodes = DecodesPythonScript()  # -> console, a, b
# ---------- decodes: Python ----------
import decodes.extensions.pinwheelTile as pt


tile = pt.PwTile()
a.put(tile.draw())
tiles = tile.inflate()

for rlvl in range(3):
    new_tiles = []
    for t in tiles:
        sub_tiles = t.inflate()
        for sub_tile in sub_tiles : new_tiles.append(sub_tile)
    tiles = new_tiles

b.put( [t.draw() for t in tiles] )
# ---------- end decodes ----------
xy = XYPlane(Origin=Point(0, 0, 0))
pt = Point(Point(0.3511877437, 0.3693963604, 0))
decodes_2 = DecodesPythonScript()  # -> console, a
# ---------- decodes_2: Python ----------
limit = 5

def func(n):
    print n,"is starting"
    if n<limit: print func(n+1)
    print n,"is finishing"
    return n
    
func(0)
# ---------- end decodes_2 ----------
xy_2 = XYPlane(Origin=Point(0, 0, 0))
pt_2 = Point(<point referenced from the Rhino model>)
decodes_3 = DecodesPythonScript(mr=Slider(4, range=0..10), attractor=pt, threshold=Slider(0.4, range=0..1), base_plane=xy)  # -> console, a
# ---------- decodes_3: Python ----------
import decodes.extensions.pinwheelTile as pt

att = attractor
thresh = threshold
meshes = []
maxRecursion = mr 
if maxRecursion > 4 : maxRecursion = 4

def main():
    cs = CS(Point(1,1),Vec(1,-1))
    recurse([pt.PwTile(xf=base_plane.xform)])
    mesh_inside = [ ]
    # this gets the meshes within a distance of a point
    for mesh in meshes:
        if mesh.centroid.distance(att) < thresh:
            mesh_inside.append(mesh)
    a.put(mesh_inside)

def recurse(tiles,rlvl=0):
    if rlvl >= maxRecursion : 
        for tile in tiles : meshes.append(tile.draw())
        return
    for tile in tiles: recurse(tile.inflate(),rlvl+1)

if __name__=="__main__": main()
# ---------- end decodes_3 ----------
decodes_4 = DecodesPythonScript(
    mr=Slider(3, range=0..10),
    attractor=Point(0.2426315561, 0.3205255881, 0),
    threshold=Slider(0.4, range=0..1),
    base_plane=xy_2)  # -> console, a
# ---------- decodes_4: Python ----------
# according to Radin, the pinwheel tiling contains one prototyle 
# a triangle with the following edge lenghts: 1, 2, sqrt(5)
# (http://www.ma.utexas.edu/users/radin/papers/pinwheel.pdf)
# (http://www.michaelwhittaker.ca/fractalpinwheel.pdf)
# some nice variation (color) here: http://tilings.math.uni-bielefeld.de/substitution_rules/pinwheel_1_2_0

   
xf_scale = Xform.scale(1/math.sqrt(5))    #= 0.447213595
basePts = [
    Point(),
    Point(2.0, 0.0),
    Point(0.0, 1.0),
    Point(0.2, 0.4),
    Point(1.2, 0.4),
    Point(0.4, 0.8),
    Point(1.0, 0.0),
    ]

def pwtile(**kargs):
    xf = kargs["xf"] if "xf" in kargs else Xform()
    return xf
    
def _CSFromBasePts(basePts, oPt,xPt,yPt):
    '''
    Returns a CS oriented to this tile's (world) points
    rlvl: the recursion level to scale the base points to
    oPt: index of origin point
    xPt: index of a point on the desired x-axis
    yPt: index of a point on the desired y-axis
    '''
    return CS(basePts[oPt],basePts[xPt]-basePts[oPt],basePts[yPt]-basePts[oPt])
        
def draw(basePts, xf):
    msh = Mesh()
    msh.append(basePts[0] * xf)
    msh.append(basePts[1] * xf)
    msh.append(basePts[2] * xf)
    msh.add_face(0,1,2)
    return msh

#def centroid(self): return Point.centroid([p*self.xf for p in PwTile.basePts])

def inflate(xf,xf_scale):
    cs = _CSFromBasePts(basePts,3,6,5)
    tile0 = xf * cs.xform * xf_scale
                                                                                                                                                                                 
    cs = _CSFromBasePts(basePts,4,5,6)                                                                                                                
    tile1 = xf * cs.xform * xf_scale
                                                                                                                                                                                 
    cs = _CSFromBasePts(basePts,3,6,0)                                                                                                                
    tile2 = xf * cs.xform * xf_scale
                                                                                                                                                                                 
    cs = _CSFromBasePts(basePts,5,0,2)                                                                                                                
    tile3 = xf * cs.xform * xf_scale
    
    cs = _CSFromBasePts(basePts,4,1,6)
    tile4 = xf * cs.xform * xf_scale
    
    return [tile0,tile1,tile2,tile3,tile4]



tiles = [pwtile()]
rlvls = 3

for rlvl in range(rlvls): 
    new_tiles = []
    for tile in tiles: new_tiles.extend(inflate(pwtile(),xf_scale))
    tiles = new_tiles
print tiles[0]

meshes = []
for tile in tiles:
    #draw(basePts, tile)

print points
#if __name__=="__main__": main()

'''
def main():
    cs = CS(Point(1,1),Vec(1,-1))
    recurse([pt.PwTile(xf=base_plane.xform)])
    mesh_inside = [ ]
    # this gets the meshes within a distance of a point
    for mesh in meshes:
        if mesh.centroid.distance(att) < thresh:
            mesh_inside.append(mesh)
    a.put(mesh_inside)

def recurse(tiles,rlvl=0):
    if rlvl >= maxRecursion : 
        for tile in tiles : meshes.append(tile.draw())
        return
    for tile in tiles: recurse(tile.inflate(),rlvl+1)'''

'''
rlvls = 5
tiles = [dt.DzTileK()]

for rlvl in range(rlvls): 
    new_tiles = []
    for tile in tiles: new_tiles.extend(tile.inflate())
    tiles = new_tiles

points = []
for tile in tiles:
    for pt in tile.draw().pts:
        if not (pt in points) : points.append(pt)
        


att = attractor
thresh = threshold
meshes = []
maxRecursion = mr 
if maxRecursion > 4 : maxRecursion = 4
'''
# ---------- end decodes_4 ----------
