# Grasshopper definition tower.gh (Grasshopper 0.8.66)

geo = Geometry(<20, culture=neutral, publickeytoken=null referenced from the Rhino model>)
series = Series(Start=0, Step=Slider(20.2, range=0..100), Count=10)
Z = UnitZ(Factor=series)
series_2 = Series(Start=0, Step=Slider(0.118, range=0..1), Count=10)
move = Move(Geometry=geo, Motion=Z)  # -> Geometry, Transform
area = Area(Geometry=move.Geometry)  # -> Area, Centroid
rotate = Rotate(Geometry=move.Geometry, Angle=series_2, Plane=area.Centroid)  # -> Geometry, Transform
loft = Loft(Curves=rotate.Geometry, Options={Adjust=False, Closed=False, Rebuild=10, Refit=0.01, LoftType=0, LoftEnds=0, LoftSimp=0})
