# Grasshopper definition colorbar.gh (Grasshopper 0.9.14)
# plug-ins: Python Interpreter

panel = Panel("C:\Documents and Settings\kat.park\My Documents\GitHub\decodes\sandbox\_dm_sandbox\USA_NY_New.York-Central.Park.725033_TMY3.epw")
# idea:
# define new grasshopper param: (date-value) or (hour-value) or (hour-dict) or (daterange-value) wherein each object represents a datetime (or a range of datetimes) and a single value.  this would make searching, averaging, and slicing up yearly data easier.
toggle = BooleanToggle(False)
file = ReadFile(Path=panel, Lines=toggle)
time = Time(634874976000000000)
epw_parser = DecodesPythonScript(epw_file=file)  # -> out, DirNormIrad, DifHorzIrad, OpqSkyCvr, DryBulbTemp, DewPtTemp, RelHumid, Pressure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
# ---------- epw_parser: Python ----------
import decodes.extensions.parseEPW as epw_parser

def parse_epw_string(epw_string):
    """ parses an EPW file and returns structured data
    path (string) filepath to the EPW file
    desired_keys ([string]) keys indicating the values to be returned.  only keys listed in epw_keycols may be used.  
    out: an array of dicts is returned.
    """
    skip = epw_parser.number_of_epw_header_lines
    lineno = 0 # keeps track of how many lines have been parsed
    hours = [] #initalize an empty list where we'll store our dicts
    lines = epw_string.split("\n") # splits the passed string into individual strings at each newline character
    for line in lines:
        #print "this is line: " + line    
        if lineno >= skip and "," in line : # only parse this line if past the header
          hourdict = epw_parser._parse_epw_line(line, epw_parser.epw_keycols.keys()) # parse line
          if hourdict is not None : 
            hours.append(hourdict)
        lineno += 1 # keep track of how many lines have been parsed        
    return hours

hours = parse_epw_string(epw_file)

DirNormIrad = []
DifHorzIrad = []
OpqSkyCvr = []
DryBulbTemp = []
DewPtTemp = []
RelHumid = []
Pressure = []
WindDir = []
WindSpd = []
PreciptWater = []
AeroDepth = []
SnowDepth = []
YearOfSample = []

for hour in hours : 
    DirNormIrad.append(hour["DirNormIrad"])
    DifHorzIrad.append(hour["DifHorzIrad"])
    OpqSkyCvr.append(hour["OpqSkyCvr"])
    DryBulbTemp.append(hour["DryBulbTemp"])
    DewPtTemp.append(hour["DewPtTemp"])
    RelHumid.append(hour["RelHumid"])
    Pressure.append(hour["Pressure"])
    WindDir.append(hour["WindDir"])
    WindSpd.append(hour["WindSpd"])
    PreciptWater.append(hour["PreciptWater"])
    AeroDepth.append(hour["AeroDepth"])
    SnowDepth.append(hour["SnowDepth"])
    YearOfSample.append(hour["YearOfSample"])
# ---------- end epw_parser ----------
panel_2 = Panel(time)
a_high_b_low = ColourSwatch(SwatchColor=RGB(255, 255, 0))
a_low_b_high = ColourSwatch(SwatchColor=RGB(0, 0, 255))
a_high_b_high = ColourSwatch(SwatchColor=RGB(255, 0, 0))
a_low_b_low = ColourSwatch(SwatchColor=RGB(255, 255, 255))
bar_width = DigitScroller(Scroller_Digits=12, Scroller_Radix=9, Scroller_Value=200, Scroller_Prefix="BAR WIDTH")
bar_height = DigitScroller(Scroller_Digits=12, Scroller_Radix=9, Scroller_Value=50, Scroller_Prefix="BAR HEIGHT")
high = ColourSwatch(SwatchColor=RGB(255, 0, 0))
low = ColourSwatch(SwatchColor=RGB(0, 0, 255))
color_interpolator = ColorInterpolator(high_color=high, low_color=low, values=epw_parser.DryBulbTemp, domain="-10 to 40")
double_color_interpolator = DoubleColorInterpolator(
    color_a_low_b_low=a_low_b_low,
    color_a_high_b_low=a_high_b_low,
    color_a_low_b_high=a_low_b_high,
    color_a_high_b_high=a_high_b_high,
    a_values=epw_parser.DryBulbTemp,
    a_domain="-10 to 40",
    b_values=epw_parser.RelHumid,
    b_domain="0 to 100")
bar_height_2 = Number(bar_height)
bar_width_2 = Number(bar_width)

# ----
# Dumb Wind Representation
bar_height_3 = Number(bar_height_2)
bar_width_3 = Number(bar_width_2)
colorbar_points = DecodesPythonScript(width=bar_width_3, height=bar_height_3)  # -> out, points; disabled
# ---------- colorbar_points: Python ----------
m = Mesh()

dx = width/365
dy = height/24
i=0
for x in range(365):
    for y in range(24):
        points.put(Point(dx*x,-dy*y))
# ---------- end colorbar_points ----------
winddir = Number(epw_parser.WindDir)
windspd = Number(epw_parser.WindSpd)
rad = Radians(Degrees=winddir)
pt = PointCylindrical(BasePlane=colorbar_points.points, Angle=rad, Radius=windspd, Elevation=0)
ln = Line(StartPoint=colorbar_points.points, EndPoint=pt)

a_really_long_list_of_colors = Colour(color_interpolator)
bar_height_4 = Number(bar_height_2)
bar_width_4 = Number(bar_width_2)
panel_3 = Panel(a_really_long_list_of_colors)

# ----
# Single Mesh Output
# These components create a 'colorbar' as a single mesh with vertices centered on each hour, and "vertex colors" assigned accordingly.
# 
# Advantages: Fast.  Creates renderable geometry to Rhino.
# Disadvantages: Produces a "blurry" image in which distinctions between individual hours and days are obscured .  Impossible to get the resulting mesh geometry into other software (such as illustrator) in vector format.
bar_height_5 = Number(bar_height_2)
bar_width_5 = Number(bar_width_2)
colorbar_mesh = DecodesPythonScript(width=bar_width_5, height=bar_height_5)  # -> out, mesh
# ---------- colorbar_mesh: Python ----------
m = Mesh()

dx = width/365
dy = height/24
i=0
for x in range(365):
    for y in range(24):
        m.add_vert(Point(dx*x,-dy*y))
        if y>0 : m.add_face(i,i+24,i+23)
        if y<23 : m.add_face(i,i+1,i+24)
        i = i+1

mesh.put(m)
# ---------- end colorbar_mesh ----------
mcol = MeshColours(Mesh=colorbar_mesh.mesh, Colours=a_really_long_list_of_colors)

# ----
# Many Meshes Output
# These components create a 'colorbar' as a collection of many many many individual meshes, and bakes them to rhino in color.
# 
# Advantages: Creates renderable geometry to Rhino including sharp distinctions between "pixels".
# Disadvantages: Slow, and it's difficult to get the resulting mesh geometry into other software (such as illustrator) in vector format.
bar_height_6 = Number(bar_height_2)
bar_width_6 = Number(bar_width_2)
many_colorbar_meshes = DecodesPythonScript(width=bar_width_6, height=bar_height_6)  # -> out, Meshes; disabled
# ---------- many_colorbar_meshes: Python ----------
def rect(cpt, w, h):
    verts = [
      Point(cpt.x-w/2,cpt.y-h/2),
      Point(cpt.x-w/2,cpt.y+h/2),
      Point(cpt.x+w/2,cpt.y+h/2),
      Point(cpt.x+w/2,cpt.y-h/2)
    ]
    faces = [[0,1,2,3]]
    return Mesh(verts,faces)

pt = Point(0,0)

dx = width/365
dy = height/24
for d in range(365):
    for h in range(24):
        Meshes.put(rect(Point(dx*d,-dy*h),dx,dy))
# ---------- end many_colorbar_meshes ----------
click_to_bake = Button()
color_bake = COLORBAKE(geo=many_colorbar_meshes.Meshes, col=a_really_long_list_of_colors, bool=click_to_bake)

# ----
# SVG Output
# These components create a 'colorbar' as a collection of filled rectangles, and exports an SVG file to a specified filepath.  No geometry is baked to Rhino.
# 
# Advantages: Creates vector-format geometry, able to be imported into Illustrator.
# Disadvantages: Very slow.
panel_4 = Panel("G:\git\decodes\sandbox\_dm_sandbox\colorbar.svg")
click_to_save_svg = Button()
colorbar_svg = DecodesPythonScript(filepath=panel_4, colors=a_really_long_list_of_colors, width="365*2", height="24*4", do_it=click_to_save_svg)  # -> out, a; inputs colors: list
# ---------- colorbar_svg: Python ----------
#TODO: remove this translation once GH innie is up and running
colors = [Color(c.R/255,c.G/255,c.B/255) for c in colors]

if do_it:
    svn = makeOut(outies.SVG, "colorabr", path=filepath)
    dx = width/365
    dy = height/24
    
    i=0
    for x in range(365):
      for y in range(24):
        rec = rect(Point(x*dx,y*dy),dx,dy)
        rec.set_color(colors[i])
        svn.put(rec)
        i = i+1
    
    svn.draw()
# ---------- end colorbar_svg ----------

# ==== cluster COLORBAKE
geo = ClusterInput()
col = ClusterInput()
geo_2 = Geometry(geo)
col_2 = Colour(col)
argb = SplitARGB(Colour=col_2)  # -> Alpha, Red, Green, Blue
frgb = ColourRGBF(Alpha=1, Red=argb.Red, Green=argb.Green, Blue=argb.Blue)
material = CreateMaterial(Diffuse=frgb, Specular=RGB(255, 255, 255), Emission=RGB(0, 0, 0), Transparency=expr("1-T", argb.Alpha), Shine=0)
bool = ClusterInput()
bool_2 = Boolean(bool)
preview = CustomPreview(Geometry=geo_2, Shader=col_2)
c_script = CSharpScript(objs=geo_2, colors=col_2, materials=material, activate=bool_2, groupListTgthr=Toggle(True))  # -> out, A; inputs objs: list, names: list of String, layers: list of String, colors: list of Color, pWidths: list of Double, wiresEach: list of Int32, materials: list, activate: Boolean, groupListTgthr: Boolean
# ---------- c_script: C# ----------
    //Inserts geometry into the Rhino document, with custom attributes
    //Written by Giulio Piacentino
    //Version written 2011 10 18 - for Grasshopper 0.8.52

    if (activate)
    {
      int groupIndex = -1;
      if(groupListTgthr)
        groupIndex = doc.Groups.Add();

      for(int i = 0; i < objs.Count; i++)
      {
        object obj = objs[i];
        if(obj == null)
        {
          Print("No object to bake");
          return;
        }

        //Make new attribute to set name
        Rhino.DocObjects.ObjectAttributes att = new Rhino.DocObjects.ObjectAttributes();

        string name = names.Count > 0 ? names[i % names.Count] : null;
        //Set object name
        if(!string.IsNullOrEmpty(name))
        {
          att.Name = name;
        }

        Color color = colors.Count > 0 ? colors[i % colors.Count] : new Color();
        //Set color
        if(!color.IsEmpty)
        {
          att.ColorSource = Rhino.DocObjects.ObjectColorSource.ColorFromObject; //Make the color type "by object"
          att.ObjectColor = color;

          att.PlotColorSource = Rhino.DocObjects.ObjectPlotColorSource.PlotColorFromObject; //Make the plot color type "by object"
          att.PlotColor = color;
        }

        string layer = layers.Count > 0 ? layers[i % layers.Count] : null;
        //Set layer
        if(!string.IsNullOrEmpty(layer) && Rhino.DocObjects.Layer.IsValidName(layer))
        {
          //Get the current layer index
          Rhino.DocObjects.Tables.LayerTable layerTable = doc.Layers;
          int layerIndex = layerTable.Find(layer, true);

          if(layerIndex < 0) //This layer does not exist, we add it
          {
            Rhino.DocObjects.Layer onlayer = new Rhino.DocObjects.Layer(); //Make a new layer
            onlayer.Name = layer;

            layerIndex = layerTable.Add(onlayer); //Add the layer to the layer table
            if (layerIndex > -1) //We manged to add layer!
            {
              att.LayerIndex = layerIndex;
              Print("Added new layer to the document at position " + layerIndex + " named " + layer + ". ");
            } else
              Print("Layer did not add. Try cleaning up your layers."); //This never happened to me.
          }
          else
            att.LayerIndex = layerIndex; //We simply add to the existing layer
        }


        double pWidth = pWidths.Count > 0 ? pWidths[i % pWidths.Count] : 0;
        //Set plotweight
        if(pWidth > 0)
        {
          att.PlotWeightSource = Rhino.DocObjects.ObjectPlotWeightSource.PlotWeightFromObject;
          att.PlotWeight = pWidth;
        }


        object material = materials.Count > 0 ? materials[i % materials.Count] : null;
        //Set material
        bool materialByName = !string.IsNullOrEmpty(material as string);
        Rhino.Display.DisplayMaterial inMaterial = material as Rhino.Display.DisplayMaterial;
        if(material is Color)
        {
          inMaterial = new Rhino.Display.DisplayMaterial((Color) material);
        }
        if(material != null && inMaterial == null && !materialByName)
        {
          if(!(material is string))
          {
            try //We also resort to try with IConvertible
            {
              inMaterial = (Rhino.Display.DisplayMaterial) Convert.ChangeType(material, typeof(Rhino.Display.DisplayMaterial));
            }
            catch(InvalidCastException)
            {
            }
          }
        }
        if(inMaterial != null || materialByName)
        {
          string matName;

          if(!materialByName)
          {
            matName = string.Format("A:{0}-D:{1}-E:{2}-S:{3},{4}-T:{5}",
              Format(inMaterial.Ambient),
              Format(inMaterial.Diffuse),
              Format(inMaterial.Emission),
              Format(inMaterial.Specular),
              inMaterial.Shine.ToString(),
              inMaterial.Transparency.ToString()
              );
          }
          else
          {
            matName = (string) material;
          }

          int materialIndex = doc.Materials.Find(matName, true);
          if(materialIndex < 0 && !materialByName) //Material does not exist and we have its specs
          {
            materialIndex = doc.Materials.Add(); //Let's add it
            if(materialIndex > -1)
            {
              Print("Added new material at position " + materialIndex + " named \"" + matName + "\". ");
              Rhino.DocObjects.Material m = doc.Materials[materialIndex];
              m.Name = matName;
              m.AmbientColor = inMaterial.Ambient;
              m.DiffuseColor = inMaterial.Diffuse;
              m.EmissionColor = inMaterial.Emission;
              //m.ReflectionColor = no equivalent
              m.SpecularColor = inMaterial.Specular;
              m.Shine = inMaterial.Shine;
              m.Transparency = inMaterial.Transparency;
              //m.TransparentColor = no equivalent
              m.CommitChanges();

              att.MaterialSource = Rhino.DocObjects.ObjectMaterialSource.MaterialFromObject;
              att.MaterialIndex = materialIndex;
            }
            else
              Print("Material did not add. Try cleaning up your materials."); //This never happened to me.
          }
          else if(materialIndex < 0 && materialByName) //Material does not exist and we do not have its specs. We do nothing
          {
            Print("Warning: material name not found. I cannot set the source to this material name. Add a material with name: " + matName);
          }
          else
          {
            //If this material exists, we do not replace it!
            att.MaterialSource = Rhino.DocObjects.ObjectMaterialSource.MaterialFromObject;
            att.MaterialIndex = materialIndex;
          }
        }


        int wires = wiresEach.Count > 0 ? wiresEach[i % wiresEach.Count] : 0;
        //Set wire density
        if(wires == -1 || wires > 0)
        {
          att.WireDensity = wires;
        }

        Bake(obj, att, groupIndex);
      }
    }
    else
    {
      Print("Inactive");
    }
# ---------- c_script: C# additional code ----------
  void Bake(object obj, Rhino.DocObjects.ObjectAttributes att, int groupIndex)
  {
    if(obj == null)
      return;

    Guid id;

    //Bake to the right type of object
    if(obj is GeometryBase)
    {
      GeometryBase geomObj = obj as GeometryBase;

      switch(geomObj.ObjectType)
      {
        case Rhino.DocObjects.ObjectType.Brep:
          id = doc.Objects.AddBrep(obj as Brep, att);
          break;
        case Rhino.DocObjects.ObjectType.Curve:
          id = doc.Objects.AddCurve(obj as Curve, att);
          break;
        case Rhino.DocObjects.ObjectType.Point:
          id = doc.Objects.AddPoint((obj as Rhino.Geometry.Point).Location, att);
          break;
        case Rhino.DocObjects.ObjectType.Surface:
          id = doc.Objects.AddSurface(obj as Surface, att);
          break;
        case Rhino.DocObjects.ObjectType.Mesh:
          id = doc.Objects.AddMesh(obj as Mesh, att);
          break;
        case (Rhino.DocObjects.ObjectType) 1073741824://Rhino.DocObjects.ObjectType.Extrusion:
          id = (Guid) typeof(Rhino.DocObjects.Tables.ObjectTable).InvokeMember("AddExtrusion", BindingFlags.Instance | BindingFlags.InvokeMethod, null, doc.Objects, new object[]{obj, att});
          break;
        case Rhino.DocObjects.ObjectType.PointSet:
          id = doc.Objects.AddPointCloud(obj as Rhino.Geometry.PointCloud, att); //This is a speculative entry
          break;
        default:
          Print("The script does not know how to handle this type of geometry: " + obj.GetType().FullName);
          return;
      }
    }
    else
    {
      Type objectType = obj.GetType();

      if(objectType == typeof(Arc))
      {
        id = doc.Objects.AddArc((Arc) obj, att);
      }
      else if(objectType == typeof(Box))
      {
        id = doc.Objects.AddBrep(((Box) obj).ToBrep(), att);
      }
      else if(objectType == typeof(Circle))
      {
        id = doc.Objects.AddCircle((Circle) obj, att);
      }
      else if(objectType == typeof(Ellipse))
      {
        id = doc.Objects.AddEllipse((Ellipse) obj, att);
      }
      else if(objectType == typeof(Polyline))
      {
        id = doc.Objects.AddPolyline((Polyline) obj, att);
      }
      else if(objectType == typeof(Sphere))
      {
        id = doc.Objects.AddSphere((Sphere) obj, att);
      }
      else if(objectType == typeof(Point3d))
      {
        id = doc.Objects.AddPoint((Point3d) obj, att);
      }
      else if(objectType == typeof(Line))
      {
        id = doc.Objects.AddLine((Line) obj, att);
      }
      else if(objectType == typeof(Vector3d))
      {
        Print("Impossible to bake vectors");
        return;
      }
      else if(obj is IEnumerable)
      {
        int newGroupIndex;
        if(groupIndex == -1)
          newGroupIndex = doc.Groups.Add();
        else
          newGroupIndex = groupIndex;
        foreach(object o in obj as IEnumerable)
        {
          Bake(o, att, newGroupIndex);
        }
        return;
      }
      else
      {
        Print("Unhandled type: " + objectType.FullName);
        return;
      }
    }

    if(groupIndex != -1)
    {
      doc.Groups.AddToGroup(groupIndex, id);
      Print("Added " + obj.GetType().Name + " to group number " + groupIndex);
    }
    else
      Print("Added " + obj.GetType().Name);
  }

  static string Format(Color c)
  {
    return (new System.Text.StringBuilder("A")).Append(c.A.ToString()).Append("R").Append(c.R.ToString()).Append("G")
      .Append(c.G.ToString()).Append("B").Append(c.B.ToString()).ToString();
  }
# ---------- end c_script ----------

# ==== cluster DoubleColorInterpolator
a_domain = ClusterInput()
b_domain = ClusterInput()
a_values = ClusterInput()
b_values = ClusterInput()
color_a_high_b_high = ClusterInput()
color_a_high_b_low = ClusterInput()
color_a_low_b_high = ClusterInput()
color_a_low_b_low = ClusterInput()
a_domain_2 = Domain(a_domain)
b_domain_2 = Domain(b_domain)
a_values_2 = Number(a_values)
b_values_2 = Number(b_values)
color_a_high_b_high_2 = Colour(color_a_high_b_high)
color_a_high_b_low_2 = Colour(color_a_high_b_low)
color_a_low_b_high_2 = Colour(color_a_low_b_high)
color_a_low_b_low_2 = Colour(color_a_low_b_low)
remap = RemapNumbers(Value=b_values_2, Source=b_domain_2, Target=Domain(0, 1))
remap_2 = RemapNumbers(Value=a_values_2, Source=a_domain_2, Target=Domain(0, 1))
blendcol = BlendColours(ColourA=color_a_low_b_low_2, ColourB=color_a_high_b_low_2, Factor=remap_2)
blendcol_2 = BlendColours(ColourA=color_a_low_b_high_2, ColourB=color_a_high_b_high_2, Factor=remap_2)
blendcol_3 = BlendColours(ColourA=blendcol, ColourB=blendcol_2, Factor=remap)
C = ClusterOutput(blendcol_3)

# ==== cluster ColorInterpolator
domain = ClusterInput()
values = ClusterInput()
high_color = ClusterInput()
low_color = ClusterInput()
domain_2 = Domain(domain)
values_2 = Number(values)
high_color_2 = Colour(high_color)
low_color_2 = Colour(low_color)
remap = RemapNumbers(Value=values_2, Source=domain_2, Target=Domain(0, 1))
blendcol = BlendColours(ColourA=low_color_2, ColourB=high_color_2, Factor=remap)
C = ClusterOutput(blendcol)
