# Grasshopper definition collections.gh (Grasshopper 0.9.14)
# plug-ins: Decodes Python Interpreter

panel = Panel("i've got 99 problems")  # disabled
slider = Slider(1, range=0..10)  # disabled
# in, remove: The 'in' operator evaluates to true if it finds a variable in the specified sequence and false otherwise.
# 
# The 'remove' method removes the first item whose value is equal to the given item.  Note that Decodes vectors and points test for equality.
slider_2 = Slider(4, range=0..10)  # disabled
collection_indexing_and_slicing = Panel("")  # disabled
recgrid = Rectangular(Plane=PlaneXY(0, 0, 0), SizeX=1, SizeY=2, ExtentX=10, ExtentY=5)  # -> Cells, Points; disabled
# list comprehension with conditional: List comprehension statements may be nested to create more complex structures.
slider_3 = Slider(3, range=1..10)
recgrid_2 = Rectangular(Plane=PlaneXY(0, 0, 0), SizeX=1, SizeY=1, ExtentX=20, ExtentY=10)  # -> Cells, Points
# list comprehension: Python provides a concise syntax to create lists.  This syntax may be used to quickly create new lists made up of the results of operations performed on existing lists.
slider_4 = Slider(5, range=1..10)  # disabled
# nested list comprehension: List comprehension statements may be nested to create more complex structures.
slider_5 = Slider(2, range=1..10)  # disabled
pt = Point(flatten(recgrid.Points))  # disabled
pt_2 = Point(flatten(recgrid_2.Points))
decodes = DecodesPythonScript(count=slider_4)  # -> console, a, b; inputs count: Int32; disabled
# ---------- decodes: Python ----------
# what takes three tedious lines of code here...
pts_hard = []
for x in range(count):
    pts_hard.append(Point(x,0))

# we can do in just one line of code here...
pts_easy = [Point(x,1) for x in range(count)]


a.put(pts_hard)
b.put(pts_easy)
# ---------- end decodes ----------
decodes_2 = DecodesPythonScript(count=slider_5)  # -> console, a, b; inputs count: Int32; disabled
# ---------- decodes_2: Python ----------
# what takes six tedious lines of code here...
pts_hard = []
for x in range(count):
    row = []
    for y in range(count):
        row.append(Point(x,y,0))
    pts_hard.append(row)

# we can do in just one line of code here...
pts_easy = [ [Point(x,y) for x in range(count)] for y in range(count) ]


a.put(pts_hard)
b.put(pts_easy)
# ---------- end decodes_2 ----------
decodes_3 = DecodesPythonScript(pts=pt, x=slider, y=slider_2)  # -> console, a; inputs pts: list; disabled
# ---------- decodes_3: Python ----------
# create a point at the specified x,y coordinates
bad_pt = Point(x,y)

# test if this point may be found in the given collection of points
if bad_pt in pts :
    # if point is found in the collection...
    pts.remove(Point(x,y)) # remove the point from the collection
    pts = [pt + Vec(12,0) for pt in pts] # do something nasty to the rest of the points
    a.put(pts) # add the whole collection of points to the outie
else :
    # if point is not found in the collection...
    print "couldn't find the darn thing!"
# ---------- end decodes_3 ----------
decodes_4 = DecodesPythonScript(pts=pt_2, m=slider_3)  # -> console, a; inputs pts: list
# ---------- decodes_4: Python ----------
some_pts = [pt for pt in pts if (pt.x + pt.y)%m == 0 ]
a.put(some_pts)
# ---------- end decodes_4 ----------
decodes_5 = DecodesPythonScript(msg=panel)  # -> console, a; disabled
# ---------- decodes_5: Python ----------
print "the length is:",len(msg)
print "the first thing is:",msg[0]
print "the last thing is:",msg[len(msg)-1], "aka", msg[-1]

# slicing
# some_collection[start:end]
# This expression results in the creation of a new collection containing the 
# elements of the old collection starting with the index start, and ending with 
# the index end-1
print msg[5:8]

a.put( msg[:8] + ' a ' + msg[12:-1] )
# ---------- end decodes_5 ----------
panel_2 = Panel(decodes_3.console)  # disabled
panel_3 = Panel(decodes.a)  # disabled
panel_4 = Panel(decodes.b)  # disabled
panel_5 = Panel(decodes_4.console)
panel_6 = Panel(decodes_2.a)  # disabled
panel_7 = Panel(decodes_5.console)  # disabled
panel_8 = Panel(decodes_2.b)  # disabled
panel_9 = Panel(decodes_5.a)  # disabled
pt_3 = Point(decodes_3.a)  # disabled
pt_4 = Point(decodes_4.a)
