# Grasshopper definition control_flow.gh (Grasshopper 0.9.14)
# plug-ins: Decodes Python Interpreter

slider = Slider(2.85, range=0..3)
pt_a = Point(Point(3.130184347, 3.663397047, 0))
pt_b = Point(Point(10.50405278, 10.56763336, 0))
int = Integer(Slider(4, range=0..10))
decodes = DecodesPythonScript(pt_a=pt_a, pt_b=pt_b, buffer=slider)  # -> console, a
# ---------- decodes: Python ----------
limit = 500

n=0
fail = False
while pt_a.distance(pt_b) > buffer :
    next_pt = pt_a + Vec.random([-0.75,0.75], False, True)
    a.put(Segment(pt_a,next_pt))
    pt_a = next_pt
    n = n+1
    if n>limit : 
        fail = True
        break
        
if fail :
    print "FAIL"
else :
    print "WIN"
# ---------- end decodes ----------
cir = Circle(Plane=pt_b, Radius=slider)
decodes_2 = DecodesPythonScript(x=int)  # -> console, a
# ---------- decodes_2: Python ----------
if x<1 : x = 1

for n in range(x):
    print "n:",n
    
for m in range(2,x):
    print "m:",m
    
for i in range(5,20,x):
    print "i:",i
# ---------- end decodes_2 ----------
decodes_3 = DecodesPythonScript(x=Slider(0.452, range=0..10))  # -> console, a
# ---------- decodes_3: Python ----------
if x<0.1 : x = 0.1

for n in frange(0,7,x):
    print "n:",n
# ---------- end decodes_3 ----------
panel = Panel(decodes.console)
panel_2 = Panel(decodes_2.console)
panel_3 = Panel(decodes_3.console)
slider_2 = Slider(0.277, range=0..0.5)  # disabled
pt_mover = Point(Point(9.636776726, 12.57573306, 0))  # disabled
pt_a_2 = Point(Point(3.130184347, 3.663397047, 0))  # disabled
pt_b_2 = Point(Point(10.50405278, 10.56763336, 0))  # disabled
pt_c = Point(Point(14.00244172, 2.670880856, 0))  # disabled
decodes_4 = DecodesPythonScript(pt_a=pt_a_2, pt_b=pt_b_2, pt_c=pt_c, pt_mover=pt_mover, d=slider_2)  # -> console, a; disabled
# ---------- decodes_4: Python ----------
n = 0

while abs(pt_mover.distance(pt_a) - pt_mover.distance(pt_b)) > d :
    print n,":",abs(pt_mover.distance(pt_a) - pt_mover.distance(pt_b))
    vec = Vec.average( [ Vec(pt_mover,pt_a) , Vec(pt_mover,pt_b) , Vec(pt_mover,pt_c) ] )
    vec = vec.normalized(d)
    pt_next = pt_mover + vec
    a.put(Segment(pt_mover,pt_next))
    pt_mover = pt_next
    n = n+1
    if n > 200 : break
# ---------- end decodes_4 ----------
