# Grasshopper definition mathematical monsters.gh (Grasshopper 0.9.14)
# plug-ins: Decodes Python Interpreter

slider = Slider(0.6, range=0..10)  # disabled
slider_2 = Slider(2.1, range=0..10)  # disabled
a_torus_made_of_lines = Panel("")  # disabled
decodes = DecodesPythonScript(rad_0=Slider(2.1, range=0..10), rad_1=Slider(0.6, range=0..10))  # -> console, a
# ---------- decodes: Python ----------
from math import *

"""
the equation for a torus
https://www.math.duke.edu//education/ccp/materials/mvcalc/parasurfs/para1.html
x = (a + b cos v) cos u
y = (a + b cos v) sin u
z = b sin v
"""


pts = []
for u in drange(0,math.pi*2,20):
    for v in drange(0,math.pi*2,20):
        x = (rad_0+rad_1*math.cos(v))*cos(u)
        y = (rad_0+rad_1*math.cos(v))*sin(u)
        z = rad_1*math.sin(v)
        pts.append(Point(x,y,z))

a.put(pts)
# ---------- end decodes ----------
decodes_2 = DecodesPythonScript(rad_0=slider_2, rad_1=slider)  # -> console, a; disabled
# ---------- decodes_2: Python ----------
from math import *

"""
the equation for a torus
https://www.math.duke.edu//education/ccp/materials/mvcalc/parasurfs/para1.html
x = (a + b cos v) cos u
y = (a + b cos v) sin u
z = b sin v
"""

pts = []
for u in drange(0,math.pi*2,20):
    for v in drange(0,math.pi*2,20):
        x = (rad_0+rad_1*math.cos(v))*cos(u)
        y = (rad_0+rad_1*math.cos(v))*sin(u)
        z = rad_1*math.sin(v)
        pts.append(Point(x,y,z))

for n in range(len(pts)-1) : 
    a.put(Segment(pts[n],pts[n+1]))
# ---------- end decodes_2 ----------
decodes_3 = DecodesPythonScript(rad_0=Slider(2.3, range=-2..10), rad_1=Slider(0.4, range=-2..10))  # -> console, a
# ---------- decodes_3: Python ----------
from math import *

"""
the equation for a torus
https://www.math.duke.edu//education/ccp/materials/mvcalc/parasurfs/para1.html
x = (a + b cos v) cos u
y = (a + b cos v) sin u
z = b sin v
"""

all_pts = []
for u in drange(0,math.pi*2,20):
    row_pts = []
    for v in drange(0,math.pi*2,20):
        x = (rad_0+rad_1*math.cos(v))*cos(u)
        y = (rad_0+rad_1*math.cos(v))*sin(u)
        z = rad_1*math.sin(v)
        row_pts.append(Point(x,y,z))
    all_pts.append(row_pts)

def draw_rows(pt_grid):
    for n in range(len(pt_grid)-1) : 
        for m in range(len(pt_grid[n])-1) : 
            a.put(Segment(pt_grid[n][m],pt_grid[n][m+1]))
        a.put(Segment(pt_grid[n][-1],pt_grid[n][0]))
    
draw_rows(all_pts)
all_pts = zip(*all_pts)
draw_rows(all_pts)
# ---------- end decodes_3 ----------
