# Grasshopper definition objects and types.gh (Grasshopper 0.9.14)
# plug-ins: Decodes Python Interpreter

slider = Slider(1.6, range=0..10)  # disabled
slider_2 = Slider(8, range=0..10)  # disabled
slider_3 = Slider(1.6, range=0..10)  # disabled
slider_4 = Slider(8, range=0..10)  # disabled
vec = Vector(Vector(0, 10.57694005, 0))
vec_2 = Vector(Vector(11.9667319, 0, 0))
chained_expressions = Panel("")  # disabled
decodes = DecodesPythonScript(vec_a=vec_2, vec_b=vec)  # -> console, a, b
# ---------- decodes: Python ----------
vec_c = Vec.interpolate(vec_a,vec_b).cross(vec_b).inverted().normalized(3.0)
vec_d = Vec.interpolate(vec_a,vec_b).inverted().normalized(3.0).cross(vec_b)

a.put(vec_c)
b.put(vec_d)
# ---------- end decodes ----------
pt = PointXYZ(XComponent=slider_2, YComponent=slider, ZComponent=0, System=PlaneXY(0, 0, 0))  # disabled
decodes_2 = DecodesPythonScript()  # -> console, a; disabled
# ---------- decodes_2: Python ----------
pt_a = Point(0,1)
pt_b = pt_a
num = pt_b.x
#pt_a.x = 1


print "num", num
print "pt_a: ", pt_a
print "pt_b: ", pt_b
a.put([pt_a,pt_b])
# ---------- end decodes_2 ----------
Z = UnitZ(Factor=1)  # disabled
decodes_3 = DecodesPythonScript()  # -> console, a; disabled
# ---------- decodes_3: Python ----------
# first we create two points
pt_a = Point(2,1,0)
pt_b = Point(2,1,1)
# and then we construct a line that refers to that point and vector
ln_a = Segment(pt_a,pt_b)


# senario 1a: what happens if we change a coordinate of the first point we defined?
#pt_a.y = 2 

# senario 1b: what happens if we change a coordinate of the second point we defined?
#pt_b.y = 2

# senario 2a: what if we were to change a coordinate of the start point of our line?
#ln_a.spt.y = 2

# senario 2b: what if we were to change a coordinate of the vector of our line?
ln_a.vec.z = 3

print "ln_a: ", ln_a
print "pt_a: ", pt_a
print "pt_b: ", pt_b
a.put([ln_a,pt_a,pt_b])
# ---------- end decodes_3 ----------
decodes_4 = DecodesPythonScript()  # -> console, a; disabled
# ---------- decodes_4: Python ----------
# first we create a point and a vector
pt_a = Point(0,1)
vec_a = Vec(0,0,1)
# and then we construct a line that refers to that point and vector
ln_a = Segment(pt_a,vec_a)


# senario 1a: what happens if we change a coordinate of the vector we first defined?
#vec_a.z = 3 

# senario 1b: what happens if we change a coordinate of the line's vector?
#ln_a.vec.z = 5 

# senario 2a: what if we were to set a new start point for our line?
#ln_a.spt = Point(1,1) 

# senario 2b: what if we were to change a coordinate of the start point of our line?
#ln_a.spt.x = 1 

# senario 3: what if we alter the coordinate of the endpoint of our line?
#ln_a.ept.x = 3
#print ln_a.ept

print "ln_a: ", ln_a
print "pt_a: ", pt_a
print "vec_a: ", vec_a
a.put([ln_a,pt_a,vec_a])
# ---------- end decodes_4 ----------
pt_2 = PointXYZ(XComponent=slider_4, YComponent=slider_3, ZComponent=0, System=PlaneXY(0, 0, 0))  # disabled
pt_3 = PointXYZ(XComponent=slider_3, YComponent=slider_4, ZComponent=0, System=PlaneXY(0, 0, 0))  # disabled
line = LineSDL(Start=pt, Direction=Z, Length=slider)  # disabled
pt_4 = Point(Point(0, 0, 0))
decodes_5 = DecodesPythonScript(pt_a=pt_2, pt_b=pt_3)  # -> console, a; disabled
# ---------- decodes_5: Python ----------
print Point.interpolate(pt_a,pt_b).y

a.put(Point.interpolate(pt_a,pt_b))
# ---------- end decodes_5 ----------
decodes_6 = DecodesPythonScript(pt=pt, ln=line)  # -> console, a; disabled
# ---------- decodes_6: Python ----------
print "x:",pt.x
print "y:",pt.y
print "z:",pt.z

print "start point: ",ln.spt
print "end point: ",ln.ept
# ---------- end decodes_6 ----------
vdis = VectorDisplay(Anchor=pt_4, Vector=decodes.a)
vdis_2 = VectorDisplay(Anchor=pt_4, Vector=decodes.b)
panel = Panel(decodes_5.console)  # disabled
panel_2 = Panel(decodes_6.console)  # disabled
