# Grasshopper definition pline.gh (Grasshopper 0.9.14)
# plug-ins: Decodes Python Interpreter

series = Series(Start=0, Step=1, Count=10)
pt = PointXYZ(XComponent=series, YComponent=series, ZComponent=0, System=PlaneXY(0, 0, 0))
pline = PolyLine(Vertices=pt, Closed=False)
decodes = DecodesPythonScript(x=pt)  # -> console, a, b; inputs x: list
# ---------- decodes: Python ----------
pl = PLine(x)
pl.append(Point(20,0,10))

b.put(pl.verts)
a.put(pl)
# ---------- end decodes ----------
decodes_2 = DecodesPythonScript(x=pt)  # -> console, a, b; inputs x: list
# ---------- decodes_2: Python ----------
pl = PLine()
pl.append(x)

#b.put(pl.verts)
a.put(pl)
# ---------- end decodes_2 ----------
decodes_3 = DecodesPythonScript()  # -> console, a, b
# ---------- decodes_3: Python ----------
lpt = [Point(0,0,0),Point(0,2,0),Point(1,5,2)]

pl = PLine(lpt)


a.put(pl)

b.put(pl[1])
# ---------- end decodes_3 ----------
decodes_4 = DecodesPythonScript()  # -> console, a
# ---------- decodes_4: Python ----------
lpt = [Point(0,0,0),Point(0,2,0),Point(1,5,2)]

pl = PLine(lpt)

a.put(pl)
# ---------- end decodes_4 ----------
decodes_5 = DecodesPythonScript(x=pline)  # -> console, a, b
# ---------- decodes_5: Python ----------
line = x
a.put(PLine([vert + Vec(0,0,1) for vert in x.verts]))
xf = Xform.mirror()
new_line = line * xf
print new_line
b.put(new_line)
# ---------- end decodes_5 ----------
