# Grasshopper definition svg.gh (Grasshopper 0.9.14)
# plug-ins: Python Interpreter, Decodes Python Interpreter, DYear

filepath = Panel("G:\\ksteinfe\\Desktop\\test.svg")  # disabled
daytime_oakland = DataHour([{hr="8", keys="global_horz_irrad,direct_norm_irrad,diffuse_horz_irrad,global_horz_illum,direct_norm_illum,diffuse_horz_illum,total_sky_cvr,opaque_sky_cvr,dry_bulb_temp,dew_point_temp,relative_humidity,pressure,wind_dir,wind_speed,precipt_water,solar_altitude,solar_azimuth,sun_is_up,absolute_humidity", values="154,362,121,999900,999900,999900,6,6,6.7,1.1,67,101360,353,5.8,0,0.0916961,2.171773,1,509.2748"}, {hr="9", keys="global_horz_irrad,direct_norm_irrad,diffuse_horz_irrad,global_horz_illum,direct_norm_illum,diffuse_horz_illum,total_sky_cvr,opaque_sky_cvr,dry_bulb_temp,dew_point_temp,relative_humidity,pressure,wind_dir,wind_speed,precipt_water,solar_altitude,solar_azimuth,sun_is_up,absolute_humidity", values="291,619,138,999900,999900,999900,0,0,7.2,0.6,63,101440,320,7.2,0,0.2511402,2.355329,1,494.6917"}, {hr="10", keys="global_horz_irrad,direct_norm_irrad,diffuse_horz_irrad,global_horz_illum,direct_norm_illum,diffuse_horz_illum,total_sky_cvr,opaque_sky_cvr,dry_bulb_temp,dew_point_temp,relative_humidity,pressure,wind_dir,wind_speed,precipt_water,solar_altitude,solar_azimuth,sun_is_up,absolute_humidity", values="398,757,118,999900,999900,999900,0,0,8.3,-0.6,53,101440,347,7,0,0.3815003,2.568796,1,446.8079"}, {hr="11", keys="global_horz_irrad,direct_norm_irrad,diffuse_horz_irrad,global_horz_illum,direct_norm_illum,diffuse_horz_illum,total_sky_cvr,opaque_sky_cvr,dry_bulb_temp,dew_point_temp,relative_humidity,pressure,wind_dir,wind_speed,precipt_water,solar_altitude,solar_azimuth,sun_is_up,absolute_humidity", values="456,801,94,999900,999900,999900,0,0,9.5,-1.9,44,101440,13,6.9,0,0.4718678,2.814416,1,400.5294"}, {hr="12", keys="global_horz_irrad,direct_norm_irrad,diffuse_horz_irrad,global_horz_illum,direct_norm_illum,diffuse_horz_illum,total_sky_cvr,opaque_sky_cvr,dry_bulb_temp,dew_point_temp,relative_humidity,pressure,wind_dir,wind_speed,precipt_water,solar_altitude,solar_azimuth,sun_is_up,absolute_humidity", values="458,804,66,999900,999900,999900,0,0,10.6,-3.3,36,101440,40,6.7,0,0.5116541,3.084245,1,351.3618"}, {hr="13", keys="global_horz_irrad,direct_norm_irrad,diffuse_horz_irrad,global_horz_illum,direct_norm_illum,diffuse_horz_illum,total_sky_cvr,opaque_sky_cvr,dry_bulb_temp,dew_point_temp,relative_humidity,pressure,wind_dir,wind_speed,precipt_water,solar_altitude,solar_azimuth,sun_is_up,absolute_humidity", values="401,763,40,999900,999900,999900,0,0,10.2,-3.8,36,101470,37,6.9,0,0.4951154,3.358909,1,342.5933"}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])  # disabled
simple_export_to_svg = Panel("")  # disabled
daytime_oakland_2 = DataHour([{hr="8", keys="global_horz_irrad,direct_norm_irrad,diffuse_horz_irrad,global_horz_illum,direct_norm_illum,diffuse_horz_illum,total_sky_cvr,opaque_sky_cvr,dry_bulb_temp,dew_point_temp,relative_humidity,pressure,wind_dir,wind_speed,precipt_water,solar_altitude,solar_azimuth,sun_is_up,absolute_humidity", values="154,362,121,999900,999900,999900,6,6,6.7,1.1,67,101360,353,5.8,0,0.0916961,2.171773,1,509.2748"}, {hr="9", keys="global_horz_irrad,direct_norm_irrad,diffuse_horz_irrad,global_horz_illum,direct_norm_illum,diffuse_horz_illum,total_sky_cvr,opaque_sky_cvr,dry_bulb_temp,dew_point_temp,relative_humidity,pressure,wind_dir,wind_speed,precipt_water,solar_altitude,solar_azimuth,sun_is_up,absolute_humidity", values="291,619,138,999900,999900,999900,0,0,7.2,0.6,63,101440,320,7.2,0,0.2511402,2.355329,1,494.6917"}, {hr="10", keys="global_horz_irrad,direct_norm_irrad,diffuse_horz_irrad,global_horz_illum,direct_norm_illum,diffuse_horz_illum,total_sky_cvr,opaque_sky_cvr,dry_bulb_temp,dew_point_temp,relative_humidity,pressure,wind_dir,wind_speed,precipt_water,solar_altitude,solar_azimuth,sun_is_up,absolute_humidity", values="398,757,118,999900,999900,999900,0,0,8.3,-0.6,53,101440,347,7,0,0.3815003,2.568796,1,446.8079"}, {hr="11", keys="global_horz_irrad,direct_norm_irrad,diffuse_horz_irrad,global_horz_illum,direct_norm_illum,diffuse_horz_illum,total_sky_cvr,opaque_sky_cvr,dry_bulb_temp,dew_point_temp,relative_humidity,pressure,wind_dir,wind_speed,precipt_water,solar_altitude,solar_azimuth,sun_is_up,absolute_humidity", values="456,801,94,999900,999900,999900,0,0,9.5,-1.9,44,101440,13,6.9,0,0.4718678,2.814416,1,400.5294"}, {hr="12", keys="global_horz_irrad,direct_norm_irrad,diffuse_horz_irrad,global_horz_illum,direct_norm_illum,diffuse_horz_illum,total_sky_cvr,opaque_sky_cvr,dry_bulb_temp,dew_point_temp,relative_humidity,pressure,wind_dir,wind_speed,precipt_water,solar_altitude,solar_azimuth,sun_is_up,absolute_humidity", values="458,804,66,999900,999900,999900,0,0,10.6,-3.3,36,101440,40,6.7,0,0.5116541,3.084245,1,351.3618"}, {hr="13", keys="global_horz_irrad,direct_norm_irrad,diffuse_horz_irrad,global_horz_illum,direct_norm_illum,diffuse_horz_illum,total_sky_cvr,opaque_sky_cvr,dry_bulb_temp,dew_point_temp,relative_humidity,pressure,wind_dir,wind_speed,precipt_water,solar_altitude,solar_azimuth,sun_is_up,absolute_humidity", values="401,763,40,999900,999900,999900,0,0,10.2,-3.8,36,101470,37,6.9,0,0.4951154,3.358909,1,342.5933"}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])
filepath_2 = Panel("G:\\ksteinfe\\Desktop\\test.svg")  # disabled
panel = Panel("wind_speed")  # disabled
filepath_3 = Panel("G:\\ksteinfe\\Desktop\\test.svg")  # disabled
filepath_4 = Panel("G:\\ksteinfe\\Desktop\\test.svg")
button = Button()  # disabled
daytime_oakland_3 = DataHour([{hr="8", keys="global_horz_irrad,direct_norm_irrad,diffuse_horz_irrad,global_horz_illum,direct_norm_illum,diffuse_horz_illum,total_sky_cvr,opaque_sky_cvr,dry_bulb_temp,dew_point_temp,relative_humidity,pressure,wind_dir,wind_speed,precipt_water,solar_altitude,solar_azimuth,sun_is_up,absolute_humidity", values="154,362,121,999900,999900,999900,6,6,6.7,1.1,67,101360,353,5.8,0,0.0916961,2.171773,1,509.2748"}, {hr="9", keys="global_horz_irrad,direct_norm_irrad,diffuse_horz_irrad,global_horz_illum,direct_norm_illum,diffuse_horz_illum,total_sky_cvr,opaque_sky_cvr,dry_bulb_temp,dew_point_temp,relative_humidity,pressure,wind_dir,wind_speed,precipt_water,solar_altitude,solar_azimuth,sun_is_up,absolute_humidity", values="291,619,138,999900,999900,999900,0,0,7.2,0.6,63,101440,320,7.2,0,0.2511402,2.355329,1,494.6917"}, {hr="10", keys="global_horz_irrad,direct_norm_irrad,diffuse_horz_irrad,global_horz_illum,direct_norm_illum,diffuse_horz_illum,total_sky_cvr,opaque_sky_cvr,dry_bulb_temp,dew_point_temp,relative_humidity,pressure,wind_dir,wind_speed,precipt_water,solar_altitude,solar_azimuth,sun_is_up,absolute_humidity", values="398,757,118,999900,999900,999900,0,0,8.3,-0.6,53,101440,347,7,0,0.3815003,2.568796,1,446.8079"}, {hr="11", keys="global_horz_irrad,direct_norm_irrad,diffuse_horz_irrad,global_horz_illum,direct_norm_illum,diffuse_horz_illum,total_sky_cvr,opaque_sky_cvr,dry_bulb_temp,dew_point_temp,relative_humidity,pressure,wind_dir,wind_speed,precipt_water,solar_altitude,solar_azimuth,sun_is_up,absolute_humidity", values="456,801,94,999900,999900,999900,0,0,9.5,-1.9,44,101440,13,6.9,0,0.4718678,2.814416,1,400.5294"}, {hr="12", keys="global_horz_irrad,direct_norm_irrad,diffuse_horz_irrad,global_horz_illum,direct_norm_illum,diffuse_horz_illum,total_sky_cvr,opaque_sky_cvr,dry_bulb_temp,dew_point_temp,relative_humidity,pressure,wind_dir,wind_speed,precipt_water,solar_altitude,solar_azimuth,sun_is_up,absolute_humidity", values="458,804,66,999900,999900,999900,0,0,10.6,-3.3,36,101440,40,6.7,0,0.5116541,3.084245,1,351.3618"}, {hr="13", keys="global_horz_irrad,direct_norm_irrad,diffuse_horz_irrad,global_horz_illum,direct_norm_illum,diffuse_horz_illum,total_sky_cvr,opaque_sky_cvr,dry_bulb_temp,dew_point_temp,relative_humidity,pressure,wind_dir,wind_speed,precipt_water,solar_altitude,solar_azimuth,sun_is_up,absolute_humidity", values="401,763,40,999900,999900,999900,0,0,10.2,-3.8,36,101470,37,6.9,0,0.4951154,3.358909,1,342.5933"}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])  # disabled
panel_2 = Panel("50")  # disabled
panel_3 = Panel("500")  # disabled
# radial to SVG: fancying it up with the Interval class and the Basis property of points!
panel_4 = Panel("500")
# Getting Serious: using functions, and storing the frequency of points within set intervals of wind speed and direction
button_2 = Button()  # disabled
dom = Domain(DomainStart=panel_2, DomainEnd=panel_3)  # disabled
getval = GetValue(ValueKey=panel, DHour=daytime_oakland)  # -> Value, Range; disabled
# heatmap to SVG: warning: this script is quite slow
button_3 = Button()  # disabled
dom_2 = Domain(DomainStart="50", DomainEnd=panel_4)
decodes = DecodesPythonScript(path=filepath, do_it=button)  # -> console, a
# ---------- decodes: Python ----------
from random import random
# here we setup an "outie" for drawing geometry to an SVG file
# we can name this "outie" whatever variable name we want, we'll use "svg" here
# the path variable sets the file location (defaults to your user directory)
# this will behave just like any other decodes output, including the 'put' method
svg = dc.makeOut(dc.Outies.SVG, path=path)

print path

scale = 20
for x in range(10):
    for y in range(10):
        pt = Point(x,y)
        pt *= scale
        pt.set_color(Color(1,0,0))
        #pt.set_weight((random()+0.1)*2) #try this after you understand the rest
        
        # here we put a point into our svg outie
        # svg files don't have points, so by default, a point will be drawn 
        # as a filled circle
        svg.put(pt)
        
        # notice that if we were to only put geometry in the svg out, we would
        # see nothing in grasshopper.  let's put things the regular way too.
        a.put(pt)


# finally, we have to 'draw' our svg outie to save our geometry to the file
# it's a good idea to attach a boolean button here, so that we don't try and 
# save a file everytime the component updates
if do_it: svg.draw()
# ---------- end decodes ----------
getval_2 = GetValue(ValueKey="wind_speed", DHour=daytime_oakland_2)  # -> Value, Range
panel_5 = Panel("10.0")  # disabled
panel_6 = Panel("4.0")  # disabled
decodes_2 = DecodesPythonScript(path=filepath_2, wspd_src=getval.Range, wspd_tar=dom, dhrs=daytime_oakland, do_it=button_2)  # -> console, a, a_props, b, b_props; inputs dhrs: list
# ---------- decodes_2: Python ----------
import math
if do_it: svg = dc.makeOut(dc.Outies.SVG, path=path)

wdir_src = Interval(0,360)
wdir_tar = Interval(0,2*math.pi)

wdir_res = 8
wspd_res = 8
#count = [[0]*wdir_res for n in range(wspd_res)]
pts = []
for n in range(wspd_res):
    pts.append([])
    for m in range(wdir_res):
        pts[n].append([])
        
cpt = Point(wspd_tar.b,wspd_tar.b)
cs = CylCS(cpt)

def hour_address(dhr):
    for n, wspd_sub in enumerate(wspd_src//wspd_res):
        for m, wdir_sub in enumerate(wdir_src//wdir_res):
            if (dhr.val("wind_dir") in wdir_sub) and (dhr.val("wind_speed") in wspd_sub) : 
                #print dhr.val("wind_dir"), " in " , wdir_sub, "\t and \t", dhr.val("wind_speed"), " in ", wspd_sub
                return [n,m]
    print "found hour out of range"

for dhr in dhrs:
    address = hour_address(dhr)
    #if address is not None: count[address[0]][address[1]] += 1
    if address is not None:
        rad = Interval.remap(dhr.val("wind_speed"),wspd_src,wspd_tar)
        ang = Interval.remap(dhr.val("wind_dir"),wdir_src,wdir_tar)
        pt = Point(rad,ang,basis=cs)
        pts[address[0]][address[1]].append(pt)
        #b.put(pt)
    
max_pt_count = max(max([len(col) for col in row]) for row in pts)
print max_pt_count

freq_src = Interval(max_pt_count,0)

for n, wspd_sub in enumerate(wspd_tar//wspd_res):
    for m, wdir_sub in enumerate(wdir_tar//wdir_res):
        pt_count = len(pts[n][m])
        if (pt_count>0):
            color = Color(Interval.remap(pt_count,freq_src))
            pgon = PGon.doughnut(cpt,wspd_sub,wdir_sub)
            pgon.set_color(color)
            a.put(pgon)
            if do_it: svg.put(pgon)
            
            for pt in pts[n][m] :
                pt.set_color(0.0)
                if color.r < 0.5 : pt.set_color(1.0)
                b.put(pt)
                if do_it: svg.put(pt)
            
            
if do_it: svg.draw()
# ---------- end decodes_2 ----------
decodes_3 = DecodesPythonScript(path=filepath_3, dhrs=daytime_oakland_3, width=panel_5, height=panel_6, do_it=button_3)  # -> console, a, a_props; inputs dhrs: list; disabled
# ---------- decodes_3: Python ----------
if do_it: svg = dc.makeOut(dc.Outies.SVG, path=path)

for dhr in dhrs:
    day_of_year = int(dhr.hr/24.0)
    hour_of_day = dhr.hr%24
    pt = Point(day_of_year/365*width, (1-hour_of_day/24)*height )
    rec = PGon.rectangle(pt,width/365,height/24)
    
    t = Interval(-10,50).deval(dhr.val("dry_bulb_temp"))
    c = Color.interpolate(Color(0),Color(1),t)
    rec.set_color(c)
    
    if do_it: svg.put(rec)
    else : a.put(rec)

if do_it: svg.draw()
# ---------- end decodes_3 ----------
decodes_4 = DecodesPythonScript(path=filepath_4, wspd_src=getval_2.Range, wspd_tar=dom_2, dhrs=daytime_oakland_2, do_it=Button())  # -> console, a; inputs dhrs: list
# ---------- decodes_4: Python ----------
import math
if do_it: svg = dc.makeOut(dc.Outies.SVG, path=path)

cs = CylCS(Point(rad_max,rad_max))
#wspd_src = Interval(0, 20) # wind_speed source range
#wspd_tar = Interval(rad_min, rad_max) # wind_speed target range (sets radius)

dnm_src = Interval(0, 1000) # direct_norm source range
dnm_tar = Interval(1.0, 4.0) # direct_norm target range (sets dot size)

for dhr in dhrs:
    theta = math.radians(dhr.val("wind_dir"))
    radius = Interval.remap(dhr.val("wind_speed"),wspd_src,wspd_tar)
    pt = Point(radius,theta,basis=cs)
    pt.set_weight( Interval.remap(dhr.val("direct_norm_irrad"),dnm_src,dnm_tar) )
    
    
    if do_it: svg.put(pt)
    else : a.put(pt)

if do_it: svg.draw()
# ---------- end decodes_4 ----------
hardboil = DecodesHardBoil(Geometry=decodes_2.a, Properties=decodes_2.a_props)
hardboil_2 = DecodesHardBoil(Geometry=decodes_2.b, Properties=decodes_2.b_props)
hardboil_3 = DecodesHardBoil(Geometry=decodes_3.a, Properties=decodes_3.a_props)  # disabled

python_conditioanl_statement_1_line_only = Panel("hour.val(\"sun_is_up\")==1")  # disabled
oakland_epw = DataHour([{hr="0", keys="global_horz_irrad,direct_norm_irrad,diffuse_horz_irrad,global_horz_illum,direct_norm_illum,diffuse_horz_illum,total_sky_cvr,opaque_sky_cvr,dry_bulb_temp,dew_point_temp,relative_humidity,pressure,wind_dir,wind_speed,precipt_water,solar_altitude,solar_azimuth,sun_is_up,absolute_humidity", values="0,0,0,999900,999900,999900,0,0,5.7,4.5,92,101430,40,1.9,0,-1.309197,6.092528,0,655.0204"}, {hr="1", keys="global_horz_irrad,direct_norm_irrad,diffuse_horz_irrad,global_horz_illum,direct_norm_illum,diffuse_horz_illum,total_sky_cvr,opaque_sky_cvr,dry_bulb_temp,dew_point_temp,relative_humidity,pressure,wind_dir,wind_speed,precipt_water,solar_altitude,solar_azimuth,sun_is_up,absolute_humidity", values="0,0,0,999900,999900,999900,0,0,4.9,3.9,93,101230,30,2,0,-1.257168,0.6658595,0,628.1306"}, {hr="2", keys="global_horz_irrad,direct_norm_irrad,diffuse_horz_irrad,global_horz_illum,direct_norm_illum,diffuse_horz_illum,total_sky_cvr,opaque_sky_cvr,dry_bulb_temp,dew_point_temp,relative_humidity,pressure,wind_dir,wind_speed,precipt_water,solar_altitude,solar_azimuth,sun_is_up,absolute_humidity", values="0,0,0,999900,999900,999900,0,0,4.4,3.6,95,101110,20,2.2,0,-1.092806,1.136033,0,620.726"}, {hr="3", keys="global_horz_irrad,direct_norm_irrad,diffuse_horz_irrad,global_horz_illum,direct_norm_illum,diffuse_horz_illum,total_sky_cvr,opaque_sky_cvr,dry_bulb_temp,dew_point_temp,relative_humidity,pressure,wind_dir,wind_speed,precipt_water,solar_altitude,solar_azimuth,sun_is_up,absolute_humidity", values="0,0,0,999900,999900,999900,2,2,4.1,3.5,96,101060,10,2.3,0,-0.8952814,1.392847,0,614.871"}, {hr="4", keys="global_horz_irrad,direct_norm_irrad,diffuse_horz_irrad,global_horz_illum,direct_norm_illum,diffuse_horz_illum,total_sky_cvr,opaque_sky_cvr,dry_bulb_temp,dew_point_temp,relative_humidity,pressure,wind_dir,wind_speed,precipt_water,solar_altitude,solar_azimuth,sun_is_up,absolute_humidity", values="0,0,0,999900,999900,999900,2,2,4.3,2.7,89,101090,27,2.4,0,-0.6892139,1.57199,0,577.6714"}, {hr="5", keys="global_horz_irrad,direct_norm_irrad,diffuse_horz_irrad,global_horz_illum,direct_norm_illum,diffuse_horz_illum,total_sky_cvr,opaque_sky_cvr,dry_bulb_temp,dew_point_temp,relative_humidity,pressure,wind_dir,wind_speed,precipt_water,solar_altitude,solar_azimuth,sun_is_up,absolute_humidity", values="0,0,0,999900,999900,999900,2,2,5.1,2.7,84,101190,43,2.6,0,-0.4829474,1.722077,0,574.8912"}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])  # disabled
python = PythonScript(hrsIn=oakland_epw, testFor=python_conditioanl_statement_1_line_only)  # -> out, Mask; inputs hrsIn: list; disabled
# ---------- python: Python ----------
import clr
clr.AddReference("DYear")
from DYear import HourMask
from System import Array

head = """def is_good_hour(hour): 
    if """
exec head + testFor + ": return True"

bools = []
for hr in hrsIn: bools.append(is_good_hour(hr))
    
Mask = HourMask()
Mask.maskPerHour(Array[bool](bools))
# ---------- end python ----------
maskhours = MaskHours(DHours=oakland_epw, Hourmask=python.Mask)  # disabled
