# Grasshopper definition lsystem2.ghx (Grasshopper 0.9.14)
# plug-ins: Decodes Python Interpreter

slider = Slider(5, range=0..10)
panel = Panel("FX")
panel_2 = Panel("X")
panel_3 = Panel("X+YF+")
panel_4 = Panel("Y")
panel_5 = Panel("-FX-Y")

# ---- group: make replacement rules
decodes = DecodesPythonScript()  # -> console, a
# ---------- decodes: Python ----------
class ReplacementRule():
    def __init__(self, search, replace):
        self.srch = search
        self.repl = replace.split(",")
        
    def matches(self,turtle):
        if turtle.name == self.srch : return True
        return False


a.put(ReplacementRule("a","a,b"))
a.put(ReplacementRule("b","a"))
# ---------- end decodes ----------

# ---- group: make Turtle class
decodes_2 = DecodesPythonScript()  # -> console, a
# ---------- decodes_2: Python ----------
class Turtle():
    def __init__(self,name,parent=None):
        self.name = name
        self.prnt = parent
        
        
    def __repr__(self):
        return self.name
        
        
a.put(Turtle)
# ---------- end decodes_2 ----------

# ----
decodes_3 = DecodesPythonScript(level=slider, initial_state="A", target="A", replace="AB", target2="B", replace2="A")  # -> console, a; inputs level: Int32
# ---------- decodes_3: Python ----------
# generate the fractal drawing string
class Turtle():
    def __init__(self,name,lineage,pos=None):
        self.name = name
        self.lineage = lineage
        self.pos = pos
    
def L_system(level, initial_turtles, rule_dict):
    state = initial_state
    test = []
    for counter in range(level):
        state2 = ''
        for character in state:
            if character == trgt:
                state2 += rplcmnt
            elif character == trgt2:
                state2 += rplcmnt2
            else:
                state2 += character
            #print state2
            for i in state2:
                test.append(Turtle(i, counter,counter+counter))
        #test.append(LSys(counter, counter))
        state = state2
    print test[4].name, test
    return state


"""def L_system(level, initial_state, trgt, rplcmnt, trgt2, rplcmnt2):
    states = [initial_state]
    test = []
    for i in states:
        for char in i:
            if char == target:
                test.append(replace)
        print test
        state2 = ''
        for character in states:
            if character == trgt:
                state2 += rplcmnt
            elif character == trgt2:
                state2 += rplcmnt2
            else:
                state2 += character
        state = state2
    return state"""

lstrings = L_system(level, initial_state, target, replace, target2, replace2)
a.put(lstrings)
#print lstrings
"""n=5,δ=22.5
X
X→F-[[X]+X]+F[+FX]-X
F→FF"""
# ---------- end decodes_3 ----------
decodes_4 = DecodesPythonScript(level=slider, initial_state="A", target="A", replace="AB", target2="B", replace2="A")  # -> console, a; inputs level: Int32
# ---------- decodes_4: Python ----------
# generate the fractal drawing string
def L_system(level, initial_state, trgt, rplcmnt, trgt2, rplcmnt2):
    state = [initial_state]
    print state
   
    for counter in range(level):
        state2 = ''
        for character in state:
            if character == trgt:
                state2 += rplcmnt
            elif character == trgt2:
                state2 += rplcmnt2
            else:
                state2 += character
        state = state2
    return state

lstrings = L_system(level, initial_state, target, replace, target2, replace2)
a.put(lstrings)
print lstrings
# ---------- end decodes_4 ----------
decodes_5 = DecodesPythonScript(level=Slider(6, range=0..10))  # -> console, a
# ---------- decodes_5: Python ----------
# generate the fractal drawing string
def L_system(level, initial_state, trgt, rplcmnt, trgt2, rplcmnt2):
    state = initial_state
   
    for counter in range(level):
        state2 = ''
        for character in state:
            if character == trgt:
                state2 += rplcmnt
            elif character == trgt2:
                state2 += rplcmnt2
            else:
                state2 += character
        state = state2
    return state

lstrings = L_system(int(level), 'A', 'A', 'AB', 'B', 'A')
a.put(lstrings)
print lstrings
# ---------- end decodes_5 ----------
decodes_6 = DecodesPythonScript(level=slider, initial_state="A", target="A", replace="AB", target2="B", replace2="A")  # -> console, a; inputs level: Int32
# ---------- decodes_6: Python ----------
# generate the fractal drawing string
class LSys():
    def __init__(self):
        self.name = name
        self.lineage = lineage
    
def L_system(level, initial_state, trgt, rplcmnt, trgt2, rplcmnt2):
    states = [initial_state]
    test = []
    for i in states:
        for char in i:
            if char == target:
                test.append(replace)
        print test
        state2 = ''
        for character in states:
            if character == trgt:
                state2 += rplcmnt
            elif character == trgt2:
                state2 += rplcmnt2
            else:
                state2 += character
        state = state2
    return state

lstrings = L_system(level, initial_state, target, replace, target2, replace2)
a.put(lstrings)
#print lstrings
"""n=5,δ=22.5
X
X→F-[[X]+X]+F[+FX]-X
F→FF"""
# ---------- end decodes_6 ----------
panel_6 = Panel(decodes_3.a)

# ---- group: turtles make love
decodes_7 = DecodesPythonScript(Turtle=decodes_2.a, axiom="a", rules=decodes.a, count=Slider(10, range=0..10))  # -> console, a; inputs rules: list, count: Int32
# ---------- decodes_7: Python ----------
axiom = axiom.split(",")
turtles = [[ Turtle(name) for name in axiom ]]

for n in range(count):
    next_gen = []
    for turtle in turtles[-1]:
        replaced_turtle = False
        for rule in rules:
            if rule.matches(turtle) :
                for name in rule.repl:
                    baby = Turtle(name,turtle)
                    baby.n = n
                    next_gen.append(baby)
                replaced_turtle = True
                break
        if not replaced_turtle : print "oh fuck, a childless turtle!"
    turtles.append(next_gen)
        
print turtles
a.put(turtles)
# ---------- end decodes_7 ----------

# ----
decodes_8 = DecodesPythonScript(x=decodes_5.a)  # -> console, a
# ---------- decodes_8: Python ----------
point = Point()
vecA = Vec(0,1,0)
vecB = Vec(1,1,0)
points = []
for i in x:
    
    if i == 'A':
        point = point + vecA
        points.append(point)
    else:
        point = point + vecB
        points.append(point)
a.put(points)
# ---------- end decodes_8 ----------

# ---- group: make movement rules
decodes_9 = DecodesPythonScript()  # -> console, a
# ---------- decodes_9: Python ----------
class MovementRule():
    def __init__(self, search, vector):
        self.srch = search
        self.vec = vector
        
    def matches(self,turtle):
        if turtle.name == self.srch : return True
        return False


a.put(MovementRule("a",Vec(1,1)))
a.put(MovementRule("b",Vec(-1,1)))
# ---------- end decodes_9 ----------

# ----
decodes_10 = DecodesPythonScript()  # -> console, a
# ---------- decodes_10: Python ----------
class Bird():
    
    def __init__(self, initial_state, pos_start = None, vel_start = None):
        if pos_start is None : pos_start = Point.random(constrain2d=True)
        if vel_start is None : vel_start = Vec.random(constrain2d=True)
        
        # pos represents this bird's position
        self.pos = pos_start 
        # vel represents this bird's velocity and maximum velocity
        self.vel = vel_start 
        self.max_vel = 0.5
        # acl represents this bird's acceleration
        # this vector will be added to velocity at each step, 
        # so a acl of zero length will result in the bird maintaing its current
        # speed and direction
        self.acl = Vec() # initial acceleration is zero
        self.max_frc = 0.25 # the maximum force that any steering behavior can exert on the acceleration.
        
        self.is_alive = True # if false, stop recording steps
        self.clear_history() # initalize history lists 
        self.record_step() # record this initial condition as a "step"
        
        
        
    def step(self):
        """
        completes a simulation step for this bird.
        """
        if self.is_alive:
            self.vel += self.acl # add the acceleration to the velocity
            self.vel = self.vel.limited(self.max_vel) # limit to the maximum velocity
            
            self.record_step() # record the step (note that we record before moving)
            self.pos += self.vel # move bird
            self.acl = Vec() # reset acceleration back to zero for next step
        
    def steer(self, vec):
        """
        steers the bird by adding the given vector to the acceleration vector
        steer each bird before 'stepping' him within each simulation loop step
        """
        vec = vec.limited(self.max_frc) # limit to the maximum acceleration
        self.acl += vec
        
        
    def kill(self): self.is_alive = False
        
    # History Functions
    def reset(self):
        """
        resets this bird back to his initialized condition.
        replaces existing history lists with single inital values
        """
        self.is_alive = True
        if len(self.hist_pos) > 0:
            self.pos = self.hist_pos[0]
            self.vel = self.hist_vel[0]
            self.acl = self.hist_acl[0]
        self.clear_history()
        self.record_step()
        
        
    def clear_history(self):
        """
        initializes history lists
        """
        self.hist_pos = []
        self.hist_vel = []
        self.hist_acl = []
        
    def record_step(self):
        """
        records the current state of this bird to history lists
        """
        if self.is_alive:
            self.hist_pos.append(self.pos)
            self.hist_vel.append(self.vel)
            self.hist_acl.append(self.acl)

a.put(Bird)
# ---------- end decodes_10 ----------
decodes_11 = DecodesPythonScript(turtles=decodes_7.a)  # -> console, a; inputs rules: list, turtles: list
# ---------- decodes_11: Python ----------
for turtle in turtles:
    if turtle.prnt is None: turtle.cs = CS()

for turtle in turtles:
    if turtle.prnt is not None: 
        for rule in rules:
            if rule.matches(turtle):
                babies.append(turtle_points[turtle.prnt.n][0]+ rule.vec)
        
                #pass #print rule.vec
                
                """for name in rule.repl:
                    baby = Turtle(name,turtle)
                    baby.n = n
                    next_gen.append(baby)"""
                replaced_turtle = True
                break
        turtle_points.append( babies)
"""
        print turtle.name,"--", turtle.prnt.n
        if not replaced_turtle : print "oh fuck, a childless turtle!"
        #turtles.append(next_gen)
    else:
        pass
        #print turtle.name"""
print turtle_points
print len(turtle_points)
a.put(turtle_points)
# ---------- end decodes_11 ----------
decodes_12 = DecodesPythonScript(rules=decodes_9.a, turtles=decodes_7.a)  # -> console, a; inputs rules: list, turtles: list
# ---------- decodes_12: Python ----------
for turtle in turtles:
    if turtle.prnt is None: 
        turtle.n = 0
        turtle.pos = Point()
        turtle_points = [[Point()]]
for turtle in turtles:
    babies = []
    if turtle.prnt is not None: 
        replaced_turtle = False
        for rule in rules:
            if rule.matches(turtle):
                babies.append(turtle_points[turtle.prnt.n][0]+ rule.vec)
        
                #pass #print rule.vec
                
                """for name in rule.repl:
                    baby = Turtle(name,turtle)
                    baby.n = n
                    next_gen.append(baby)"""
                replaced_turtle = True
                break
        turtle_points.append( babies)
"""
        print turtle.name,"--", turtle.prnt.n
        if not replaced_turtle : print "oh fuck, a childless turtle!"
        #turtles.append(next_gen)
    else:
        pass
        #print turtle.name"""
print turtle_points
print len(turtle_points)
a.put(turtle_points)
# ---------- end decodes_12 ----------
panel_7 = Panel(decodes_7.a)
