# Grasshopper definition pinwheel.ghx (Grasshopper 0.9.14)
# plug-ins: Decodes Python Interpreter

xy = XYPlane(Origin=Point(0, 0, 0))
xy_2 = XYPlane(Origin=Point(0, 0, 0))
pt = Point(<point referenced from the Rhino model>)
decodes = DecodesPythonScript(mr=Slider(4, range=0..10), base_plane=xy)  # -> console, a; disabled
# ---------- decodes: Python ----------
# according to Radin, the pinwheel tiling contains one prototyle 
# a triangle with the following edge lenghts: 1, 2, sqrt(5)
# (http://www.ma.utexas.edu/users/radin/papers/pinwheel.pdf)
# (http://www.michaelwhittaker.ca/fractalpinwheel.pdf)
# some nice variation (color) here: http://tilings.math.uni-bielefeld.de/substitution_rules/pinwheel_1_2_0

   
xf_scale = Xform.scale(1/math.sqrt(5))    #= 0.447213595
basePts = [
    Point(),
    Point(2.0, 0.0),
    Point(0.0, 1.0),
    Point(0.2, 0.4),
    Point(1.2, 0.4),
    Point(0.4, 0.8),
    Point(1.0, 0.0),
    ]

def pwtile(**kargs):
    xf = kargs["xf"] if "xf" in kargs else Xform()
    return xf
    
def _CSFromBasePts(basePts, oPt,xPt,yPt):
    '''
    Returns a CS oriented to this tile's (world) points
    rlvl: the recursion level to scale the base points to
    oPt: index of origin point
    xPt: index of a point on the desired x-axis
    yPt: index of a point on the desired y-axis
    '''
    return CS(basePts[oPt],basePts[xPt]-basePts[oPt],basePts[yPt]-basePts[oPt])
        
def draw(basePts, xf):
    msh = Mesh()
    msh.append(basePts[0] * xf)
    msh.append(basePts[1] * xf)
    msh.append(basePts[2] * xf)
    msh.add_face(0,1,2)
    return msh

def inflate(xf,xf_scale):
    cs = _CSFromBasePts(basePts,3,6,5)
    tile0 = xf * cs.xform * xf_scale
                                                                                                                                                                                 
    cs = _CSFromBasePts(basePts,4,5,6)                                                                                                                
    tile1 = xf * cs.xform * xf_scale
                                                                                                                                                                                 
    cs = _CSFromBasePts(basePts,3,6,0)                                                                                                                
    tile2 = xf * cs.xform * xf_scale
                                                                                                                                                                                 
    cs = _CSFromBasePts(basePts,5,0,2)                                                                                                                
    tile3 = xf * cs.xform * xf_scale
    
    cs = _CSFromBasePts(basePts,4,1,6)
    tile4 = xf * cs.xform * xf_scale
    
    return [tile0,tile1,tile2,tile3,tile4]


tiles = [pwtile(xf=base_plane.xform)]
rlvls = mr

for rlvl in range(int(rlvls)): 
    new_tiles = []
    for tile in tiles: new_tiles.extend(inflate(pwtile(xf=tile),xf_scale))
    tiles = new_tiles

meshes = [draw(basePts, tile) for tile in tiles]

a.put(meshes)
# ---------- end decodes ----------
decodes_2 = DecodesPythonScript(
    mr=Slider(4, range=0..10),
    attractor=Point(0.2426315561, 0.3205255881, 0),
    threshold=Slider(0.3, range=0..1),
    base_plane=xy_2)  # -> console, a
# ---------- decodes_2: Python ----------
# according to Radin, the pinwheel tiling contains one prototyle 
# a triangle with the following edge lenghts: 1, 2, sqrt(5)
# (http://www.ma.utexas.edu/users/radin/papers/pinwheel.pdf)
# (http://www.michaelwhittaker.ca/fractalpinwheel.pdf)
# some nice variation (color) here: http://tilings.math.uni-bielefeld.de/substitution_rules/pinwheel_1_2_0

   
xf_scale = Xform.scale(1/math.sqrt(5))    #= 0.447213595
basePts = [
    Point(),
    Point(2.0, 0.0),
    Point(0.0, 1.0),
    Point(0.2, 0.4),
    Point(1.2, 0.4),
    Point(0.4, 0.8),
    Point(1.0, 0.0),
    ]

def pwtile(**kargs):
    xf = kargs["xf"] if "xf" in kargs else Xform()
    return xf
    
def _CSFromBasePts(basePts, oPt,xPt,yPt):
    '''
    Returns a CS oriented to this tile's (world) points
    rlvl: the recursion level to scale the base points to
    oPt: index of origin point
    xPt: index of a point on the desired x-axis
    yPt: index of a point on the desired y-axis
    '''
    return CS(basePts[oPt],basePts[xPt]-basePts[oPt],basePts[yPt]-basePts[oPt])
        
def draw(basePts, xf):
    msh = Mesh()
    msh.append(basePts[0] * xf)
    msh.append(basePts[1] * xf)
    msh.append(basePts[2] * xf)
    msh.add_face(0,1,2)
    return msh

def inflate(xf,xf_scale):
    cs = _CSFromBasePts(basePts,3,6,5)
    tile0 = xf * cs.xform * xf_scale
                                                                                                                                                                                 
    cs = _CSFromBasePts(basePts,4,5,6)                                                                                                                
    tile1 = xf * cs.xform * xf_scale
                                                                                                                                                                                 
    cs = _CSFromBasePts(basePts,3,6,0)                                                                                                                
    tile2 = xf * cs.xform * xf_scale
                                                                                                                                                                                 
    cs = _CSFromBasePts(basePts,5,0,2)                                                                                                                
    tile3 = xf * cs.xform * xf_scale
    
    cs = _CSFromBasePts(basePts,4,1,6)
    tile4 = xf * cs.xform * xf_scale
    
    return [tile0,tile1,tile2,tile3,tile4]


tiles = [pwtile()]
rlvls = mr

for rlvl in range(int(rlvls)): 
    new_tiles = []
    for tile in tiles: new_tiles.extend(inflate(pwtile(xf=tile),xf_scale))
    tiles = new_tiles

meshes = [draw(basePts, tile) for tile in tiles]
meshes_inside = []
for mesh in meshes:
    if mesh.centroid.distance(attractor) < threshold:
        meshes_inside.append(mesh)

a.put(meshes_inside)
# ---------- end decodes_2 ----------
