# Grasshopper definition decompose_line.ghx (Grasshopper 0.9.14)
# plug-ins: Decodes Python Interpreter

series = Series(Start=0, Step=Slider(1.3, range=0..10), Count=10)
sin = Sine(Value=series)
pt = PointXYZ(XComponent=series, YComponent=sin, ZComponent=0, System=PlaneXY(0, 0, 0))
decodes = DecodesPythonScript(
    points=pt,
    threshold=Slider(0.1, range=0..1),
    step_size=Slider(0.3, range=0..1),
    tries=Slider(5, range=0..10),
    iter=Slider(15, range=0..100))  # -> console, a, b, c; inputs points: list
# ---------- decodes: Python ----------
curve = Curve.bezier(points)

start = curve.near_pt(points[0]).origin
vec = Vec(step_size,0,0)
step = Point(vec + start)
pts = [start]
for i in range(int(iter)):
    new_pt = curve.near_pt(step).origin
    dist = step.distance(new_pt)
    if dist <= threshold:
        pts.append(new_pt)
        step = Point(new_pt+vec)
    else:
        back_vec = Vec(step_size/tries,0,0)
        step = Point(step+back_vec)
        is_good = False
        for tr in range(int(tries)):
            new_pt = curve.near_pt(step).origin
            if tr != int(tries)-1:
                dist = step.distance(new_pt)
                step = Point(new_pt+back_vec)
                if dist <= threshold: 
                    is_good = True
                    break
            else:
                is_good == True
                break
        if is_good: pts.append(new_pt)
        

b.put(pts)
a.put(curve)
c.put(PLine(pts))
# ---------- end decodes ----------
