# Grasshopper definition decompose_srf.gh (Grasshopper 0.9.14)
# plug-ins: Decodes Python Interpreter

md_slider = MDSlider(
    slider_value=Point(0.1097560976, 0.4634146341, 0.5),
    x_domain=Domain(0, 1),
    y_domain=Domain(0, 1),
    z_domain=Domain(0, 1),
    SliderMode=0)
cluster = Cluster(num=Slider(0.257, range=0..1), V=md_slider, num_2=Slider(0.413, range=0..1))
res_u = Slider(13, range=4..20)
res_v = Slider(20, range=2..20)
dom = Domain(DomainStart=Slider(0, range=0..6.28), DomainEnd=Slider(1.66, range=0..6.28))
pts = Point(cluster)
random = Random(Range=Domain(0, 1), Number=res_u, Seed=2)
random_2 = Random(Range=Domain(0, 1), Number=res_v, Seed=2)
decodes = DecodesPythonScript(pts=pts, rot_ival=dom)  # -> console, a; inputs pts: list
# ---------- decodes: Python ----------
import math

def func(u,v):
    flat_pts = [Point(p.x,0,p.z) for p in pts]# ensure points lie on same plane as rotational axis by setting y=0
    
    angle = rot_ival.eval(u)
    xf = Xform.rotation(axis=Vec(0,0,1),angle=angle)
    rot_pts = [pt*xf for pt in flat_pts]
    
    crv = Curve.bezier(rot_pts)
    
    return crv.eval(v)
    

a.put(func)
# ---------- end decodes ----------
sort = SortList(Keys=random)  # -> Keys, ValuesA
sort_2 = SortList(Keys=random_2)  # -> Keys, ValuesA

# ---- group: quad mesh on surf defined by given func
decodes_2 = DecodesPythonScript(func=decodes.a, u_vals=sort.Keys, v_vals=sort_2.Keys, do_close=Toggle(False))  # -> console, a; inputs u_vals: list, v_vals: list
# ---------- decodes_2: Python ----------
msh = Mesh()
for v in v_vals:
    for u in u_vals:
        msh.append(func(u,v))

res_u = len(u_vals)
print res_u
pt_a = func(u_vals[0],v_vals[0])
pt_b = func(u_vals[-1],v_vals[0])
pt_c = func(u_vals[0],v_vals[-1])
srf_cs = CS(pt_a, pt_b, pt_c)
print pt_c
print Point(pt_a.x,pt_a.y,pt_a.z, srf_cs)
# simple triangulation style
for v in range(len(v_vals)):
    row = v*res_u
    for u in range(len(u_vals)-1):
        pi_0 = row+u
        pi_1 = row+u+1
        pi_2 = row+u+res_u+1
        pi_3 = row+u+res_u
        msh.add_face(pi_0,pi_1,pi_2,pi_3)
    if do_close:
        #last two faces in the row
        pi_0 = row+res_u-1
        pi_1 = row+0
        pi_2 = row+res_u
        pi_3 = row+res_u-1+res_u
        msh.add_face(pi_0,pi_1,pi_2,pi_3)

a.put(msh)
# ---------- end decodes_2 ----------

# ----
mesh = Mesh(decodes_2.a)

# ==== cluster Cluster
V = ClusterInput()
num = ClusterInput()
num_2 = ClusterInput()
vcomp = Decompose(Vector=V)  # -> XComponent, YComponent, ZComponent
num_3 = Number(num)
num_4 = Number(num_2)
pt = PointXYZ(XComponent=vcomp.XComponent, YComponent=vcomp.ZComponent, ZComponent=vcomp.YComponent, System=PlaneXY(0, 0, 0))
pt_2 = PointXYZ(XComponent=num_4, YComponent=0, ZComponent=0, System=PlaneXY(0, 0, 0))
pt_3 = PointXYZ(XComponent=num_3, YComponent=0, ZComponent=1, System=PlaneXY(0, 0, 0))
pt_4 = Point([pt_2, pt, pt_3])
pt_5 = ClusterOutput(pt_4)
