# Grasshopper definition extruded surface.gh (Grasshopper 0.9.14)
# plug-ins: Decodes Python Interpreter

md_slider = MDSlider(
    slider_value=Point(0, 0.4929273652, 0.5),
    x_domain=Domain(0, 1),
    y_domain=Domain(0, 1),
    z_domain=Domain(0, 1),
    SliderMode=0)
md_slider_2 = MDSlider(
    slider_value=Point(0, 0.3124389648, 0.5),
    x_domain=Domain(0, 1),
    y_domain=Domain(0, 1),
    z_domain=Domain(0, 1),
    SliderMode=0)
md_slider_3 = MDSlider(slider_value=Point(0.5, 1, 0.5), x_domain=Domain(-1, 1), y_domain=Domain(-1, 1), z_domain=Domain(0, 1), SliderMode=0)
cluster = Cluster(num=Slider(0.257, range=0..1), V=md_slider_2, V_2=md_slider, num_2=Slider(1, range=0..1))
pts = Point(cluster)
vdis = VectorDisplay(Anchor=pts, Vector=md_slider_3)
decodes = DecodesPythonScript(pts=pts, tvec=md_slider_3)  # -> console, a; inputs pts: list
# ---------- decodes: Python ----------
def func(u,v):
    if u > 0 : 
        vec = Vec(tvec.x * u,tvec.y * u,tvec.z * u)
        trans_pts = [pt+vec for pt in pts]
        crv = Curve.bezier(trans_pts)
    else:
        crv = Curve.bezier(pts)
        
    return crv.eval(v)

a.put(func)
# ---------- end decodes ----------
res_u = Slider(2, range=2..10)
res_v = Slider(15, range=2..20)
random = Random(Range=Domain(0, 1), Number=res_v, Seed=2)
range = Range(Domain=Domain(0, 1), Steps=res_u)
sort = SortList(Keys=random)  # -> Keys, ValuesA

# ---- group: quad mesh on surf defined by given func
decodes_2 = DecodesPythonScript(func=decodes.a, u_vals=range, v_vals=sort.Keys)  # -> console, a; inputs u_vals: list, v_vals: list
# ---------- decodes_2: Python ----------
msh = Mesh()
for v in v_vals:
    for u in u_vals:
        msh.append(func(u,v))

res_u = len(u_vals)
# simple triangulation style
for v in range(len(v_vals)):
    row = v*res_u
    for u in range(len(u_vals)-1):
        pi_0 = row+u
        pi_1 = row+u+1
        pi_2 = row+u+res_u+1
        pi_3 = row+u+res_u
        msh.add_face(pi_0,pi_1,pi_2,pi_3)

a.put(msh)
# ---------- end decodes_2 ----------

# ----
mesh = Mesh(decodes_2.a)

# ==== cluster Cluster
V = ClusterInput()
num = ClusterInput()
num_2 = ClusterInput()
V_2 = ClusterInput()
vcomp = Decompose(Vector=V)  # -> XComponent, YComponent, ZComponent
vcomp_2 = Decompose(Vector=V_2)  # -> XComponent, YComponent, ZComponent
num_3 = Number(num)
num_4 = Number(num_2)
pt = PointXYZ(XComponent=vcomp.XComponent, YComponent=vcomp.ZComponent, ZComponent=vcomp.YComponent, System=PlaneXY(0, 0, 0))
pt_2 = PointXYZ(XComponent=vcomp_2.XComponent, YComponent=vcomp_2.ZComponent, ZComponent=vcomp_2.YComponent, System=PlaneXY(0, 0, 0))
pt_3 = PointXYZ(XComponent=num_4, YComponent=0, ZComponent=0, System=PlaneXY(0, 0, 0))
pt_4 = PointXYZ(XComponent=num_3, YComponent=0, ZComponent=1, System=PlaneXY(0, 0, 0))
pt_5 = Point([pt_4, pt, pt_2, pt_3])
pt_6 = ClusterOutput(pt_5)
