# Grasshopper definition great court roof.gh (Grasshopper 0.9.14)
# plug-ins: Decodes Python Interpreter

rec_w = Slider(6.4, range=1..8)
rec_h = Slider(4.6, range=1..8)
rad = Slider(0.98, range=0.1..3)
height = Slider(0.4, range=-1..1.5)
gcr_mesh_lores_simple_tri = Mesh(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)
gcr_mesh_lores_centroid_tri = Mesh(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)
gcr_mesh_2d_simple_tri = Mesh(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)
gcr_mesh_centroid_tri = Mesh(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)
res_u = Slider(17, range=4..30)
res_v = Slider(4, range=2..10)
decodes = DecodesPythonScript(rec_w=rec_w, rec_h=rec_h, rad=rad, height=height)  # -> console, a
# ---------- decodes: Python ----------
import math


def func(u,v):
    
    theta = (math.pi*2*u) - (math.pi/2) - math.atan(rec_w/rec_h)
    spt = Point(rad*math.cos(theta), rad*math.sin(theta) )
    if (u>=0) and (u<0.25): 
        ln = Line( Point(-rec_w/2,-rec_h/2), Point(rec_w/2,-rec_h/2) )
        ept = ln.eval(u*4.0)
    elif (u>=0.25) and (u<0.5): 
        ln = Line( Point(rec_w/2,-rec_h/2), Point(rec_w/2,rec_h/2) )
        ept = ln.eval((u-0.25)*4.0)
    elif (u>=0.5) and (u<0.75): 
        ln = Line( Point(rec_w/2,rec_h/2), Point(-rec_w/2,rec_h/2) )
        ept = ln.eval((u-0.5)*4.0)
    elif (u>=0.75) and (u<=1.0): 
        ln = Line( Point(-rec_w/2,rec_h/2), Point(-rec_w/2,-rec_h/2) )
        ept = ln.eval((u-0.75)*4.0)
    else: print "wtf?"
        
    ln = Segment(spt,ept)
    pt = ln.eval(v)
    pt.z = math.sin(v*math.pi)*height
    return pt
    

a.put(func)
# ---------- end decodes ----------

# ---- group: just to visualize boundary
cluster = Cluster(rec_w=rec_w, rec_h=rec_h, rad=rad)

# ---- group: simple triangulated mesh
decodes_2 = DecodesPythonScript(func=decodes.a, res_u=res_u, res_v=res_v)  # -> console, a; inputs res_u: Int32, res_v: Int32
# ---------- decodes_2: Python ----------
# convert res_u to nearest multiple of 4.0
if res_u%4 != 0 : 
    res_u = res_u + (4 - res_u%4)
    print "res_u set to ", res_u

msh = Mesh()
for v in range(res_v+1):
    for u in range(res_u):
        msh.append(func(u/res_u,v/res_v))

# simple triangulation style
for v in range(res_v):
    row = v*res_u
    for u in range(res_u-1):
        pi_0 = row+u
        pi_1 = row+u+1
        pi_2 = row+u+res_u
        pi_3 = row+u+res_u+1
        msh.add_face(pi_0,pi_1,pi_2)
        msh.add_face(pi_1,pi_3,pi_2)
    #last two faces in the row
    pi_0 = row+res_u-1
    pi_1 = row+0
    pi_2 = row+res_u-1+res_u
    pi_3 = row+res_u
    msh.add_face(pi_0,pi_1,pi_2)
    msh.add_face(pi_1,pi_3,pi_2)

a.put(msh)
# ---------- end decodes_2 ----------

# ---- group: simple u-v curves
decodes_3 = DecodesPythonScript(func=decodes.a, res_u=res_u, res_v=res_v)  # -> console, a, b; inputs res_u: Int32, res_v: Int32; disabled
# ---------- decodes_3: Python ----------
# convert res_u to nearest multiple of 4.0
if res_u%4 != 0 : res_u = res_u + (4 - res_u%4)
print res_u

# u-curves
for v in range(res_v+1):
    a.put(PLine([func(u/res_u,v/res_v) for u in range(res_u+1)]))
    
# v-curves
for u in range(res_u+1):
    b.put(PLine([func(u/res_u,v/res_v) for v in range(res_v+1)]))
# ---------- end decodes_3 ----------

# ---- group: centroid triangulated mesh
decodes_4 = DecodesPythonScript(func=decodes.a, res_u=res_u, res_v=res_v)  # -> console, a; inputs res_u: Int32, res_v: Int32; disabled
# ---------- decodes_4: Python ----------
# convert res_u to nearest multiple of 4.0
if res_u%4 != 0 : 
    res_u = res_u + (4 - res_u%4)
    print "res_u set to ", res_u

msh = Mesh()
for v in range(res_v+1):
    for u in range(res_u):
        msh.append(func(u/res_u,v/res_v))

# centroid triangulation style
for v in range(res_v):
    row = v*res_u
    for u in range(res_u-1):
        pi = [row+u,row+u+1,row+u+res_u,row+u+res_u+1]
        msh.append(Point.centroid([msh.pts[i] for i in pi])) # add one more vertex at the center
        pi.append(len(msh.pts)-1)
        msh.add_face(pi[0],pi[1],pi[4])
        msh.add_face(pi[1],pi[3],pi[4])
        msh.add_face(pi[3],pi[2],pi[4])
        msh.add_face(pi[2],pi[0],pi[4])
    #last two faces in the row
    pi = [ row+res_u-1, row+0, row+res_u-1+res_u, row+res_u ]
    msh.append(Point.centroid([msh.pts[i] for i in pi])) # add one more vertex at the center
    pi.append(len(msh.pts)-1)
    msh.add_face(pi[0],pi[1],pi[4])
    msh.add_face(pi[1],pi[3],pi[4])
    msh.add_face(pi[3],pi[2],pi[4])
    msh.add_face(pi[2],pi[0],pi[4])

a.put(msh)
# ---------- end decodes_4 ----------

# ----
keep_low = Panel("10")

# ----
# Relaxation
decodes_5 = DecodesPythonScript()  # -> console, a
# ---------- decodes_5: Python ----------
def mesh_neighborhood(m):
    nbrhd = []
    
    for pi in range(len(m.pts)): # for each point index in our mesh
        nbrhd.append([]) #append an empty list of neighbors to hold neighbor information for this point.
        for face in m.faces: # look at each face in the mesh
            if pi in face : # if we find this point index listed in the face
                if len(face)==3: #and the face is a triangle
                    # add the two other points found in this face to our list of neighbors for this point
                    if face[0] != pi and face[0] not in nbrhd[-1]: nbrhd[-1].append(face[0])
                    if face[1] != pi and face[1] not in nbrhd[-1]: nbrhd[-1].append(face[1])
                    if face[2] != pi and face[2] not in nbrhd[-1]: nbrhd[-1].append(face[2])
    return nbrhd

a.put(mesh_neighborhood)
# ---------- end decodes_5 ----------
decodes_6 = DecodesPythonScript(msh=gcr_mesh_lores_simple_tri, func=decodes_5.a, steps=keep_low)  # -> console, a; inputs steps: Int32
# ---------- decodes_6: Python ----------
nbrhd = func(msh)
good_nbrhd = 6

for step in range(steps):
    new_msh = Mesh()
    for pi in range(len(msh.pts)): # for each point index in our mesh
        if len(nbrhd[pi])>=good_nbrhd:  new_msh.append(Point.centroid([msh.pts[n] for n in nbrhd[pi]]))
        else: new_msh.append(msh.pts[pi])
            
    for face in msh.faces:
        new_msh.add_face(face[0],face[1],face[2])
    
    msh = new_msh
    
    
    
a.put(msh)
# ---------- end decodes_6 ----------

# ---- group: just for debugging
slider = Slider(39, range=0..350)  # disabled
decodes_7 = DecodesPythonScript(msh=gcr_mesh_lores_centroid_tri, func=decodes_5.a, sample_pt=slider)  # -> console, a, b, c, d; inputs sample_pt: Int32; disabled
# ---------- decodes_7: Python ----------
nbrhd = func(msh)
npts = [msh.pts[n] for n in nbrhd[sample_pt]]
a.put(npts)
b.put(Point.centroid(npts))
c.put(msh.pts[sample_pt])
d.put(nbrhd)
# ---------- end decodes_7 ----------
panel = Panel(decodes_7.d)  # disabled
lng = ListLength(List=decodes_7.a)  # disabled
sample_pt = Point(decodes_7.c)  # disabled
centroid = Point(decodes_7.b)  # disabled
of_points_in_nbrhd = Panel(lng)  # disabled

# ----
gcr_mesh_simple_tri = Mesh(decodes_2.a)
gcr_mesh_centroid_tri_2 = Mesh(decodes_4.a)
mesh = Mesh(decodes_6.a)

# ---- group: 2.6 min calculation time
gcr_simple_tri_40_step_relax = Mesh(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)

# ---- group: 45s calculation time
gcr_simple_tri_10_step_relax = Mesh(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)

# ---- group: 1.3 min calculation time
gcr_simple_tri_20_step_relax = Mesh(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)

# ---- group: 2 min calculation time
gcr_centroid_tri_10_step_relax = Mesh(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)

# ==== cluster Cluster
rec_w = ClusterInput()
rec_h = ClusterInput()
rad = ClusterInput()
rec_w_2 = Number(expr("rec_w/2", rec_w))
rec_h_2 = Number(expr("rec_h/2", rec_h))
rad_2 = Number(rad)
dom = Domain(DomainStart=rec_w_2, DomainEnd=expr("-B", rec_w_2))
dom_2 = Domain(DomainStart=rec_h_2, DomainEnd=expr("-B", rec_h_2))
cir = Circle(Plane=PlaneXY(0, 0, 0), Radius=rad_2)
rectangle = Rectangle(Plane=PlaneXY(0, 0, 0), XSize=dom, YSize=dom_2, Radius=0)  # -> Rectangle, Length
crv = Curve([cir, rectangle.Rectangle])
crv_2 = ClusterOutput(crv)
