# Grasshopper definition mobius.gh (Grasshopper 0.9.14)
# plug-ins: Python Interpreter, Decodes Python Interpreter

slider = Slider(72, range=0..100)
slider_2 = Slider(42, range=0..100)
dom = Domain(DomainStart="-1", DomainEnd="1")
pi = Pi(Factor=Slider(2, range=0..10))
subtraction = Subtraction(A=pi, B=Slider(0.1, range=0..0.1))
range = Range(Domain=subtraction, Steps=slider_2)
range_2 = Range(Domain=dom, Steps=slider_2)
python = PythonScript(x=range, y=range_2)  # -> out, a
# ---------- python: Python ----------
import math
import Rhino

x = (1+.5*y*math.cos(x/2))*math.cos(x)
y = (1+.5*y*math.cos(x/2))*math.sin(x)
z = 0.5*y*math.sin(x/2)
a = Rhino.Geometry.Point3d(x,y,z)
# ---------- end python ----------
decodes = DecodesPythonScript(rad=Slider(1, range=0..1))  # -> console, a
# ---------- decodes: Python ----------
import math

def func(t):
    x = rad*math.cos(t)
    y = rad*math.sin(t)
    return Point(x,y)+ctr
Curve(func,Interval(0,1))
# ---------- end decodes ----------
