# Grasshopper definition rotational surface.gh (Grasshopper 0.9.14)
# plug-ins: Decodes Python Interpreter

md_slider = MDSlider(
    slider_value=Point(0.8292682927, 0.3475609756, 0.5),
    x_domain=Domain(0, 1),
    y_domain=Domain(0, 1),
    z_domain=Domain(0, 1),
    SliderMode=0)
res_v = Slider(8, range=2..20)
res_u = Slider(4, range=4..20)

# ---- group: creates a circle class
decodes = DecodesPythonScript()  # -> console, a
# ---------- decodes: Python ----------
class Circle():
    
    def __init__(self,plane,radius):
        self.pln = plane
        self.rad = radius
        
    def to_gh(self):
        import Rhino.Geometry as rg
        plane = rg.Plane(rg.Point3d(self.pln.origin.x,self.pln.origin.y,self.pln.origin.z),rg.Vector3d(self.pln.vec.x,self.pln.vec.y,self.pln.vec.z))
        return rg.Circle(plane,self.rad)
        
a.put(Circle)
# ---------- end decodes ----------

# ----
cluster = Cluster_2(N=res_v)
cluster_2 = Cluster_2(N=res_u)
cluster_3 = Cluster(num=Slider(0.353, range=0..1), V=md_slider, num_2=Slider(0.263, range=0..1))
dom = Domain(DomainStart=Slider(0, range=0..6.28), DomainEnd=Slider(1.66, range=0..6.28))
pts = Point(cluster_3)
decodes_2 = DecodesPythonScript(pts=pts, rot_ival=dom)  # -> console, a; inputs pts: list
# ---------- decodes_2: Python ----------
import math

def func(u,v):
    flat_pts = [Point(p.x,0,p.z) for p in pts]# ensure points lie on same plane as rotational axis by setting y=0
    
    angle = rot_ival.eval(u)
    xf = Xform.rotation(axis=Vec(0,0,1),angle=angle)
    rot_pts = [pt*xf for pt in flat_pts]
    
    crv = Curve.bezier(rot_pts)
    
    return crv.eval(v)
    

a.put(func)
# ---------- end decodes_2 ----------
surface_function = Data(decodes_2.a)
surface_function_2 = Data(surface_function)
surface_function_3 = Data(surface_function)
decodes_3 = DecodesPythonScript(func=surface_function_2, Circle=decodes.a, res=Slider(6, range=1..20))  # -> console, a, b, c, d; inputs res: Int32
# ---------- decodes_3: Python ----------
for ival_v in Interval()//res: 
    pa = func(0.5,ival_v.a)
    pb = func(0.5,ival_v.b)
    seg = Segment(pa,pb)
    a.put(seg)
    
    cpt_0 = Point(0,0,seg.spt.z)
    cpt_1 = Point(0,0,seg.ept.z)
    circ_0 = Circle(Plane(cpt_0),cpt_0.distance(seg.spt))
    circ_1 = Circle(Plane(cpt_1),cpt_1.distance(seg.ept))
    b.put([circ_0.to_gh(),circ_1.to_gh()])
    
    apex = None
    slope = 0
    if seg.vec.x != 0: # if false, we have a cyl
        slope = seg.vec.z / seg.vec.x
        dz = slope * seg.spt.x
        apex = Point(0,0,seg.spt.z - dz)
    c.put(apex)
    
    s0,s1 = None,None
    if slope < 0: 
        s0 = Segment(apex,func(0,ival_v.a))
        s1 = Segment(apex,func(1,ival_v.a))
    if slope > 0: 
        s0 = Segment(apex,func(0,ival_v.b))
        s1 = Segment(apex,func(1,ival_v.b))
    d.put([s0,s1])
# ---------- end decodes_3 ----------
circle = Circle(decodes_3.b)
center_line = Line(decodes_3.a)
pt = Point(simplify(graft(decodes_3.c)))
edge_lines = Line(decodes_3.d)

# ---- group: quad mesh on surf defined by given func
decodes_4 = DecodesPythonScript(func=surface_function_3, u_vals=cluster_2, v_vals=cluster, do_close=Toggle(False))  # -> console, a; inputs u_vals: list, v_vals: list
# ---------- decodes_4: Python ----------
msh = Mesh()
for v in v_vals:
    for u in u_vals:
        msh.append(func(u,v))

res_u = len(u_vals)
# simple triangulation style
for v in range(len(v_vals)):
    row = v*res_u
    for u in range(len(u_vals)-1):
        pi_0 = row+u
        pi_1 = row+u+1
        pi_2 = row+u+res_u+1
        pi_3 = row+u+res_u
        msh.add_face(pi_0,pi_1,pi_2,pi_3)
    if do_close:
        #last two faces in the row
        pi_0 = row+res_u-1
        pi_1 = row+0
        pi_2 = row+res_u
        pi_3 = row+res_u-1+res_u
        msh.add_face(pi_0,pi_1,pi_2,pi_3)

a.put(msh)
# ---------- end decodes_4 ----------

# ----
merge = Merge(Data1=circle, Data2=pt, Data3=edge_lines)
top_and_bottom_circles_at_each_div = Panel(circle)
mesh = Mesh(decodes_4.a)
branch = TreeBranch(Tree=merge, Path=Slider(4, range=0..10), MaintainPaths=True)
geo = Geometry(branch)
apex_points_for_each_div = Panel(pt)
edge_lines_for_each_div = Panel(edge_lines)

# ==== cluster Cluster
V = ClusterInput()
num = ClusterInput()
num_2 = ClusterInput()
vcomp = Decompose(Vector=V)  # -> XComponent, YComponent, ZComponent
num_3 = Number(num)
num_4 = Number(num_2)
pt = PointXYZ(XComponent=vcomp.XComponent, YComponent=vcomp.ZComponent, ZComponent=vcomp.YComponent, System=PlaneXY(0, 0, 0))
pt_2 = PointXYZ(XComponent=num_4, YComponent=0, ZComponent=0, System=PlaneXY(0, 0, 0))
pt_3 = PointXYZ(XComponent=num_3, YComponent=0, ZComponent=1, System=PlaneXY(0, 0, 0))
pt_4 = Point([pt_2, pt, pt_3])
pt_5 = ClusterOutput(pt_4)

# ==== cluster Cluster_2
N = ClusterInput()
random = Random(Range=Domain(0, 1), Number=N, Seed=2)
sort = SortList(Keys=random)  # -> Keys, ValuesA
ins = ListInsert(List=sort.Keys, Item=0, Indices=0, Wrap=True)
ins_2 = ListInsert(List=ins, Item=1, Indices=-1, Wrap=True)
L = ClusterOutput(ins_2)
