# Grasshopper definition ruled_srf.gh (Grasshopper 0.9.14)
# plug-ins: Decodes Python Interpreter

radius = Slider(0.4, range=0..1)
divisions = Slider(37, range=0..100)
cir = Circle(Plane=PlaneXY(0, 0, 0), Radius=radius)
cir_2 = Circle(Plane=PlaneXY(0, 0, 0), Radius=radius)
Z = UnitZ(Factor=1)
move = Move(Geometry=cir_2, Motion=Z)  # -> Geometry, Transform
divide = DivideCurve(Curve=cir, Count=divisions, Kinks=False)  # -> Points, Tangents, Parameters
divide_2 = DivideCurve(Curve=move.Geometry, Count=divisions, Kinks=False)  # -> Points, Tangents, Parameters
shift = ShiftList(List=divide_2.Points, Shift=Slider(23, range=0..100), Wrap=Toggle(True))
ln = Line(StartPoint=divide.Points, EndPoint=shift)
res_v = Slider(20, range=2..20)
decodes = DecodesPythonScript(lines=ln)  # -> console, a; inputs lines: list
# ---------- decodes: Python ----------
def func(u,v):
    return lines[u].eval(v)

a.put(func)
# ---------- end decodes ----------
range = Range(Domain=Domain(0, 1), Steps=res_v)
series = Series(Start=0, Step=1, Count=divisions)
decodes_2 = DecodesPythonScript(func=decodes.a, u_vals=series, v_vals=range)  # -> console, a; inputs u_vals: list, v_vals: list
# ---------- decodes_2: Python ----------
msh = Mesh()
for v in v_vals:
    for u in u_vals:
        msh.append(func(int(u),v))

res_u = len(u_vals)


# simple triangulation style
for v in range(len(v_vals)):
    row = v*res_u
    for u in range(len(u_vals)-1):
        pi_0 = row+u
        pi_1 = row+u+1
        pi_2 = row+u+res_u+1
        pi_3 = row+u+res_u
        msh.add_face(pi_0,pi_1,pi_2,pi_3)


a.put(msh)
# ---------- end decodes_2 ----------
mesh = Mesh(decodes_2.a)
