# Grasshopper definition torus circles.gh (Grasshopper 0.9.14)
# plug-ins: Decodes Python Interpreter

decodes = DecodesPythonScript()  # -> console, a, b
# ---------- decodes: Python ----------
"""
Torus 
    x = 0.5*(2+math.cos(v))*math.cos(u)
    y = 0.5*(2+math.cos(v))*math.sin(u)
    z = math.sin(v)
    domain = [0, 2*pi]x[0, 2*pi]
"""

import math

r = 2.0
R = 5.0


def func(u,v):
    u_val = 2*math.pi*u
    v_val = 2*math.pi*v
    rho = R+math.cos(v_val)*r
    pt_out = Point(rho*math.cos(u_val), rho*math.sin(u_val), r*math.sin(v_val))
    return pt_out

#v = 'phi'
#u = 'theta'
def func_2(u,v):
    tilt = r/R
    alpha = math.asin(tilt)
    u_val = 2*math.pi*u
    v_val = 2*math.pi*v
    gamma = v_val
    
    rho = R+math.cos(v_val)*r
    x_ref = rho*math.cos(u_val)
    y_ref = rho*math.sin(u_val)
    z_ref = r*math.cos(v_val)
    
    x_2 = x_ref
    y_2 = y_ref
    z_2 = z_ref
    
    x_1 = r + R*math.cos(gamma)
    y_1 = R*math.sin(gamma)*math.cos(alpha)
    z_1 = r*math.sin(gamma)
    
    psi = math.atan2(x_1*y_2 - x_2*y_1, x_1*x_2 + y_1*y_2)
      
    x_2 = x_1*math.cos(psi) - y_1*math.sin(psi)
    y_2 = x_1*math.sin(psi) + y_1*math.cos(psi)
    z_2 = z_1
    
    pt_out = Point(x_2, y_2, z_2)
    return pt_out
 
 
a.put(func)

b.put(func_2)
# ---------- end decodes ----------
res_v = Slider(18, range=2..20)
res_u = Slider(23, range=4..50)
decodes_2 = DecodesPythonScript(func=decodes.b, res_u=res_v, res_v=res_u)  # -> console, a
# ---------- decodes_2: Python ----------
#IN:   a function f(u,v) describing a parametric surface on the domain [0,1]x[0,1]
#OUT:  Surface expressed as a mesh aligned with isocurves for u, v determined by res_u and res_v 


count_u = int(res_u)
count_v = int(res_v)
tol_u = 1.0/res_u
tol_v = 1.0/res_v
u_vals = [i*tol_u for i in range(count_u+1)]
v_vals = [i*tol_v for i in range(count_v+1)]

#Expressed as a mesh with faces determined by isocurves
msh = Mesh()
for v in v_vals:
    for u in u_vals:
        msh.append(func(u,v))

for j in range(count_v):
    row = j*(count_u+1)
    for i in range(count_u):
        pi_0 = row+i
        pi_1 = row+i+1
        pi_2 = row+i+count_u+2
        pi_3 = row+i+count_u+1
        msh.add_face(pi_0,pi_1,pi_2,pi_3)

a.put(msh)
# ---------- end decodes_2 ----------
