# Grasshopper definition translational_srf.gh (Grasshopper 0.9.14)
# plug-ins: Decodes Python Interpreter

pi = Pi(Factor=Slider(3, range=0..10))
range = Range(Domain=pi, Steps=10)
range_2 = Range(Domain=Domain(0, 1), Steps=10)
sin = Sine(Value=range)
bnd = Bounds(Numbers=sin)
remap = RemapNumbers(Value=sin, Source=bnd, Target=Domain(0, 1))
res_u = Slider(10, range=2..10)
res_v = Slider(15, range=2..20)
pt = PointXYZ(XComponent=0, YComponent=range_2, ZComponent=remap, System=PlaneXY(0, 0, 0))
pt_2 = PointXYZ(XComponent=range_2, YComponent=0, ZComponent=remap, System=PlaneXY(0, 0, 0))
random = Random(Range=Domain(0, 1), Number=res_v, Seed=2)
decodes = DecodesPythonScript(crv_pts=pt_2, rail_pts=pt)  # -> console, a; inputs crv_pts: list, rail_pts: list
# ---------- decodes: Python ----------
def func(u,v):
    rail = Curve.bezier(rail_pts)
    vec = crv_pts[0] - rail.eval(u)
    new_crv = Curve.bezier([pt - vec for pt in crv_pts])
        
    return new_crv.eval(v)

a.put(func)
# ---------- end decodes ----------
sort = SortList(Keys=random)  # -> Keys, ValuesA
range_3 = Range(Domain=Domain(0, 1), Steps=res_u)

# ---- group: quad mesh on surf defined by given func
decodes_2 = DecodesPythonScript(func=decodes.a, u_vals=range_3, v_vals=sort.Keys)  # -> console, a; inputs u_vals: list, v_vals: list
# ---------- decodes_2: Python ----------
msh = Mesh()
for v in v_vals:
    for u in u_vals:
        msh.append(func(u,v))

res_u = len(u_vals)
# simple triangulation style
for v in range(len(v_vals)):
    row = v*res_u
    for u in range(len(u_vals)-1):
        pi_0 = row+u
        pi_1 = row+u+1
        pi_2 = row+u+res_u+1
        pi_3 = row+u+res_u
        msh.add_face(pi_0,pi_1,pi_2,pi_3)

a.put(msh)
# ---------- end decodes_2 ----------

# ----
mesh = Mesh(decodes_2.a)
