# Grasshopper definition birds.ghx (Grasshopper 0.9.14)
# plug-ins: Decodes Python Interpreter

bird_count = Slider(30, range=3..30)
bird_count_2 = Slider(3, range=3..20)
max_frc = Slider(0.13, range=0..1)
max_vel = Slider(1, range=0..1)
rov = Slider(2.25, range=0.5..3)
roc = Slider(1.5, range=0.5..3)
step_count = Slider(100, range=5..100)

# ---- group: create Bird class
decodes = DecodesPythonScript()  # -> console, a
# ---------- decodes: Python ----------
class Bird():
    
    def __init__(self, pos_start = None, vel_start = None):
        if pos_start is None : pos_start = Point.random(constrain2d=True)
        if vel_start is None : vel_start = Vec.random(constrain2d=True)
        
        # pos represents this bird's position
        self.pos = pos_start 
        # vel represents this bird's velocity and maximum velocity
        self.vel = vel_start 
        self.max_vel = 0.5
        # acl represents this bird's acceleration
        # this vector will be added to velocity at each step, 
        # so a acl of zero length will result in the bird maintaing its current
        # speed and direction
        self.acl = Vec() # initial acceleration is zero
        self.max_frc = 0.25 # the maximum force that any steering behavior can exert on the acceleration.
        
        self.rov = 5.0 # range of vision determines the range to which this bird can see other birds
        self.roc = 1.0 # range of comfort determines the range to which this bird if comfortable with other birds being close by
        
        
        self.is_alive = True # if false, stop recording steps
        self.clear_history() # initalize history lists 
        self.record_step() # record this initial condition as a "step"
        
        
        
    def step(self):
        """
        completes a simulation step for this bird.
        """
        if self.is_alive:
            self.vel += self.acl # add the acceleration to the velocity
            self.vel = self.vel.limited(self.max_vel) # limit to the maximum velocity
            
            self.record_step() # record the step (note that we record before moving)
            self.pos += self.vel # move bird
            self.acl = Vec() # reset acceleration back to zero for next step
        
    def steer(self, vec):
        """
        steers the bird by adding the given vector to the acceleration vector
        steer each bird before 'stepping' him within each simulation loop step
        """
        vec = vec.limited(self.max_frc) # limit to the maximum acceleration
        self.acl += vec
        
        
    def kill(self): self.is_alive = False
        
    def in_range(self, others, range):
        r2 = range**2
        near_birds = []
        for bird in others:
            dist2 = self.pos.distance2(bird.pos)
            if dist2 !=0 and dist2 <= r2 : near_birds.append(bird)
        return near_birds
        
        
    # Mid-Level Behavior Functions
        
    def seek(self, goal_pt, close_enough = None):
        """
        steers this bird toward a given goal point.
        if already close enough to the goal, does not influence bird behavior
        """
        if close_enough is None : close_enough = self.max_vel
        vec = Vec(self.pos,goal_pt)
        if vec.length > close_enough : self.steer( vec  - self.vel ) 
        
    def flee(self, flee_pt, far_enough = None):
        """
        steers this bird away from a given goal point.
        if already far enough to the goal, does not influence bird behavior
        """
        if far_enough is None : far_enough = self.max_vel
        vec = Vec(flee_pt, self.pos)
        if vec.length < far_enough : self.steer( vec  - self.vel ) 
        
    def align(self, align_vec):
        """
        steers this bird such that it aligns with a given vector.
        the greater the magnitude of the given vector, the more this bird aligns to it
        """
        self.steer( align_vec  - self.vel ) 
        
        
    # High-Level Behavior Functions
    
    
    
    
        
    # History Functions
    def reset(self):
        """
        resets this bird back to his initialized condition.
        replaces existing history lists with single inital values
        """
        self.is_alive = True
        if len(self.hist_pos) > 0:
            self.pos = self.hist_pos[0]
            self.vel = self.hist_vel[0]
            self.acl = self.hist_acl[0]
        self.clear_history()
        self.record_step()
        
        
    def clear_history(self):
        """
        initializes history lists
        """
        self.hist_pos = []
        self.hist_vel = []
        self.hist_acl = []
        
    def record_step(self):
        """
        records the current state of this bird to history lists
        """
        if self.is_alive:
            self.hist_pos.append(self.pos)
            self.hist_vel.append(self.vel)
            self.hist_acl.append(self.acl)

a.put(Bird)
# ---------- end decodes ----------

# ----
close_enough = Slider(0.1, range=0.1..3)
max_frc_2 = Slider(0.3, range=0..1)
max_vel_2 = Slider(0.69, range=0..1)
step_count_2 = Slider(80, range=5..100)
md_slider = MDSlider(
    slider_value=Point(0.578125, 0.6780004501, 0.5),
    x_domain=Domain(-10, 10),
    y_domain=Domain(-10, 10),
    z_domain=Domain(0, 1),
    SliderMode=0)

# ---- group: create Bird class
decodes_2 = DecodesPythonScript()  # -> console, a
# ---------- decodes_2: Python ----------
class Bird():
    
    def __init__(self, pos_start = None, vel_start = None):
        if pos_start is None : pos_start = Point.random(constrain2d=True)
        if vel_start is None : vel_start = Vec.random(constrain2d=True)
        
        # pos represents this bird's position
        self.pos = pos_start 
        # vel represents this bird's velocity and maximum velocity
        self.vel = vel_start 
        self.max_vel = 0.5
        # acl represents this bird's acceleration
        # this vector will be added to velocity at each step, 
        # so a acl of zero length will result in the bird maintaing its current
        # speed and direction
        self.acl = Vec() # initial acceleration is zero
        self.max_frc = 0.25 # the maximum force that any steering behavior can exert on the acceleration.
        
        self.is_alive = True # if false, stop recording steps
        self.clear_history() # initalize history lists 
        self.record_step() # record this initial condition as a "step"
        
        
        
    def step(self):
        """
        completes a simulation step for this bird.
        """
        if self.is_alive:
            self.vel += self.acl # add the acceleration to the velocity
            self.vel = self.vel.limited(self.max_vel) # limit to the maximum velocity
            
            self.record_step() # record the step (note that we record before moving)
            self.pos += self.vel # move bird
            self.acl = Vec() # reset acceleration back to zero for next step
        
    def steer(self, vec):
        """
        steers the bird by adding the given vector to the acceleration vector
        steer each bird before 'stepping' him within each simulation loop step
        """
        vec = vec.limited(self.max_frc) # limit to the maximum acceleration
        self.acl += vec
        
        
    def kill(self): self.is_alive = False
        
    # History Functions
    def reset(self):
        """
        resets this bird back to his initialized condition.
        replaces existing history lists with single inital values
        """
        self.is_alive = True
        if len(self.hist_pos) > 0:
            self.pos = self.hist_pos[0]
            self.vel = self.hist_vel[0]
            self.acl = self.hist_acl[0]
        self.clear_history()
        self.record_step()
        
        
    def clear_history(self):
        """
        initializes history lists
        """
        self.hist_pos = []
        self.hist_vel = []
        self.hist_acl = []
        
    def record_step(self):
        """
        records the current state of this bird to history lists
        """
        if self.is_alive:
            self.hist_pos.append(self.pos)
            self.hist_vel.append(self.vel)
            self.hist_acl.append(self.acl)

a.put(Bird)
# ---------- end decodes_2 ----------

# ---- group: create population of birds
# Flocking Birds
decodes_3 = DecodesPythonScript(Bird=decodes.a, count=bird_count)  # -> console, a; inputs count: Int32; disabled
# ---------- decodes_3: Python ----------
birds = []
for n in range(count): birds.append(Bird())
a.put(birds)
# ---------- end decodes_3 ----------

# Goal Seeking Birds
decodes_4 = DecodesPythonScript(Bird=decodes_2.a, count=bird_count_2)  # -> console, a; inputs count: Int32; disabled; same code as decodes_3

# ----
goal_pt = Point(md_slider)

# ---- group: simulate bird movement
decodes_5 = DecodesPythonScript(flock=decodes_3.a, max_frc=max_frc, max_vel=max_vel, rov=rov, roc=roc, count=step_count)  # -> console, a, b; inputs flock: list, count: Int32
# ---------- decodes_5: Python ----------
import math


for bird in flock: 
    bird.reset()
    bird.max_frc = max_frc
    bird.max_vel = max_vel
    bird.rov = rov
    bird.roc = roc

for step in range(count):
    for bird in flock:
        nears = bird.in_range(flock, bird.rov)
        if len(nears) > 0 : 
            bird.align(Vec.average([other_bird.vel for other_bird in nears])) # alignment
            fcntr = Point.centroid([other_bird.pos for other_bird in nears])
            bird.seek(fcntr) # cohesion
            too_nears = bird.in_range(nears, bird.roc)
            if len(too_nears) > 0 : 
                bird.flee(Point.centroid([other_bird.pos for other_bird in too_nears])) # separation
        
        bird.step()
        
a.put(flock)
# ---------- end decodes_5 ----------

decodes_6 = DecodesPythonScript(flock=decodes_4.a, max_frc=max_frc_2, max_vel=max_vel_2, count=step_count_2, close_enough=close_enough, goal_pt=goal_pt)  # -> console, a; inputs flock: list, count: Int32
# ---------- decodes_6: Python ----------
import math


for bird in flock: 
    bird.reset()
    bird.max_frc = max_frc
    bird.max_vel = max_vel

for step in range(count):
    for bird in flock:
        vec = Vec(bird.pos,goal_pt)
        if vec.length <= close_enough : bird.kill()
        bird.steer( vec  - bird.vel )
        bird.step()
        
a.put(flock)
# ---------- end decodes_6 ----------

# ----
cluster = Cluster(max_step=step_count, t_step=Slider(1, range=0..1))
cluster_2 = Cluster(max_step=step_count_2, t_step=Slider(0, range=0..1))

# ---- group: draw bird trails
decodes_7 = DecodesPythonScript(flock=decodes_5.a)  # -> console, a; inputs flock: list
# ---------- decodes_7: Python ----------
for bird in flock: a.put(PLine(bird.hist_pos))
# ---------- end decodes_7 ----------

# ---- group: draw birds at given step
decodes_8 = DecodesPythonScript(flock=decodes_5.a, step=cluster)  # -> console, a, b, c, d, e; inputs flock: list
# ---------- decodes_8: Python ----------
class Circle():
    
    def __init__(self,plane,radius):
        self.pln = plane
        self.rad = radius
        
    def to_gh(self):
        import Rhino.Geometry as rg
        plane = rg.Plane(rg.Point3d(self.pln.origin.x,self.pln.origin.y,self.pln.origin.z),rg.Vector3d(self.pln.vec.x,self.pln.vec.y,self.pln.vec.z))
        return rg.Circle(plane,self.rad)
        
        
        

for bird in flock:
    pos = bird.hist_pos[-1]
    vel = bird.hist_vel[-1]
    acl = bird.hist_acl[-1]
    if step < len(bird.hist_pos):
        pos = bird.hist_pos[step]
        vel = bird.hist_vel[step]
        acl = bird.hist_acl[step]
    a.put(pos)
    b.put(vel)
    c.put(acl)
    d.put(Circle(Plane(pos,Vec(0,0,1)),bird.rov).to_gh())
    e.put(Circle(Plane(pos,Vec(0,0,1)),bird.roc).to_gh())
# ---------- end decodes_8 ----------

decodes_9 = DecodesPythonScript(flock=decodes_6.a, step=cluster_2)  # -> console, a, b, c; inputs flock: list
# ---------- decodes_9: Python ----------
for bird in flock:
    pos = bird.hist_pos[-1]
    vel = bird.hist_vel[-1]
    acl = bird.hist_acl[-1]
    if step < len(bird.hist_pos):
        pos = bird.hist_pos[step]
        vel = bird.hist_vel[step]
        acl = bird.hist_acl[step]
    a.put(pos)
    b.put(vel)
    c.put(acl)
# ---------- end decodes_9 ----------

# ---- group: draw bird trails
decodes_10 = DecodesPythonScript(flock=decodes_6.a)  # -> console, a; inputs flock: list; same code as decodes_7

# ----
vdis = VectorDisplay(Anchor=decodes_8.a, Vector=decodes_8.b)
vdis_2 = VectorDisplay(Anchor=decodes_8.a, Vector=decodes_8.c)
runion = RegionUnion(Curves=decodes_8.d)
runion_2 = RegionUnion(Curves=decodes_8.e)
vdis_3 = VectorDisplay(Anchor=decodes_9.a, Vector=decodes_9.b)
vdis_4 = VectorDisplay(Anchor=decodes_9.a, Vector=decodes_9.c)

# ==== cluster Cluster
max_step = ClusterInput()
max_step_2 = Integer(max_step)
t_step = ClusterInput()
dom = Domain(DomainStart=0, DomainEnd=max_step_2)
remap = RemapNumbers(TStep=t_step, Source=Domain(0, 1), Target=dom)
step = Integer(remap)
step_2 = ClusterOutput(step)
