# Grasshopper definition derive.ghx (Grasshopper 0.9.14)
# plug-ins: Decodes Python Interpreter

# ---- group: create a vector field
slider = Slider(1, range=-1..1)  # disabled
slider_2 = Slider(4.3, range=0..20)  # disabled
slider_3 = Slider(0.9, range=0..5)  # disabled
md_slider = MDSlider(
    slider_value=Point(1, 0.8921340268, 0.5),
    x_domain=Domain(-1, 1),
    y_domain=Domain(-1, 1),
    z_domain=Domain(0, 1),
    SliderMode=0)  # disabled
md_slider_2 = MDSlider(
    slider_value=Point(0.3630692201, 0.6300186854, 0.5),
    x_domain=Domain(-1, 1),
    y_domain=Domain(-1, 1),
    z_domain=Domain(0, 1),
    SliderMode=0)  # disabled
pcharge = PointCharge(Point=md_slider, Charge=slider, Decay=slider_3)  # disabled
fspin = SpinForce(Plane=md_slider_2, Strength=slider_2, Radius=0.5, Decay=slider_3)  # disabled
mergef = MergeFields(Fields=[fspin, pcharge])  # disabled

# ----
slider_4 = Slider(100, range=0..100)  # disabled

# ---- group: create guy class
decodes = DecodesPythonScript()  # -> console, a
# ---------- decodes: Python ----------
class Guy():
    
    def __init__(self, pos_start, vel_start):
        # pos represents this guy's position
        self.pos = pos_start 
        # vel represents this guy's velocity
        self.vel = vel_start
        
    def step(self):
        """
        step guy forward
        """        
        self.vel = Vec.random(Interval(-1,1),constrain2d = True)
        self.pos += self.vel # move guy
        
        
a.put(Guy)
# ---------- end decodes ----------

# ----
decodes_2 = DecodesPythonScript(Guy=decodes.a, count=Slider(67, range=0..100))  # -> console, a, b; inputs count: Int32
# ---------- decodes_2: Python ----------
debord = Guy(Point(0,0),Vec(-0.1,0.1))

pts = []
for n in range(count):
    debord.step()
    a.put(debord.pos)
    pts.append(debord.pos)
    
b.put(PLine(pts))
# ---------- end decodes_2 ----------

# ---- group: create guy class
decodes_3 = DecodesPythonScript()  # -> console, a; disabled
# ---------- decodes_3: Python ----------
class Guy():
    
    def __init__(self, pos_start, vel_start):
        # pos represents this guy's position
        self.pos = pos_start 
        # vel represents this guy's velocity
        self.vel = vel_start
        
    def step(self):
        """
        step guy forward
        """        
        self.vel = self.vel.limited(0.1) # limit to a maximum speed that this guy can walk
        self.pos += self.vel # move guy
        
    def steer(self, vec):
        """
        steers this guy by adding the given vector to his current velocity
        """
        vec = vec.limited(0.5) # limit to a maximum force guy will respond to
        self.vel += vec
        
a.put(Guy)
# ---------- end decodes_3 ----------

# ----
pt = Point(decodes_2.a)
vec_field = Field(mergef)  # disabled
rectangle = Rectangle(Plane=PlaneXY(0, 0, 0), XSize=Domain(-1, 1), YSize=Domain(-1, 1), Radius=0)  # -> Rectangle, Length; disabled
vec_field_2 = Field(vec_field)  # disabled

# ---- group: sample vec field
slider_5 = Slider(7, range=0..20)  # disabled
sqgrid = Square(Plane=PlaneXY(-1, -1, 0), Size=expr("2.0/S", slider_5), ExtentX=slider_5, ExtentY=slider_5)  # -> Cells, flatten(Points); disabled
slider_6 = Slider(0.128, range=0..0.5)  # disabled
cluster = Cluster(vec_field=vec_field_2, sample_pt=sqgrid.Points, scale=slider_6)  # -> sample_pt_4, R; disabled
field_vecs = Vector(cluster.R)  # disabled
field_pts = Point(cluster.sample_pt_4)  # disabled

# ----
field_vecs_2 = Vector(field_vecs)  # disabled
field_pts_2 = Point(field_pts)  # disabled
decodes_4 = DecodesPythonScript(Guy=decodes_3.a, fpts=field_pts_2, fvecs=field_vecs_2, count=slider_4)  # -> console, a, b; inputs fpts: list, fvecs: list, count: Int32; disabled
# ---------- decodes_4: Python ----------
def nearest_vec_to(pt):
    i = Point.near_index(pt,fpts)
    return fvecs[i]

debord = Guy(Point(0,0),Vec(-0.1,0.1))

pts = []
for n in range(count):
    fvec = nearest_vec_to(debord.pos)
    debord.steer(fvec)
    debord.step()
    a.put(debord.pos)
    pts.append(debord.pos)
    
b.put(PLine(pts))
# ---------- end decodes_4 ----------
pt_2 = Point(decodes_4.a)  # disabled
rec = Rectangle(rectangle.Rectangle)  # disabled
# including this function reduces computation time from 2 sec to 0.4 sec for 100 walkers
field_pts_3 = Point(field_pts)  # disabled
field_vecs_3 = Vector(field_vecs)  # disabled
pt_3 = Point(sqgrid.Points)  # disabled

# ---- group: efficient field lookup
decodes_5 = DecodesPythonScript(fvecs=field_vecs_3, fpts=field_pts_3)  # -> console, a; inputs fvecs: list, fpts: list; disabled
# ---------- decodes_5: Python ----------
import math

# note: the following lookup table assumes that the given vector field is a square grid
# same number of rows and columns of vecs
# and that the field covers a domain of -1 to 1 in x and y directions

# create a lookup table of all the vecs in the field
vec_lookup = []
dim = int(len(fpts)**0.5) # number of vecs per row or col
for x in range(dim): vec_lookup.append([])
for n in range(len(fvecs)):
    row = int(math.floor(n/dim))
    vec_lookup[row].append(fvecs[n])

# create ivals for each vector in rows and colums
# b/c our field is the same dimesion in both directions, we only need one set of ivals
ivals = Interval(-1 -(1.0/(dim+2)),1+(1.0/(dim+2)))//(dim)
print dim,ivals

def func(sample_pt):
    row = None
    if sample_pt.x <= ivals[0].a : row = 0
    elif sample_pt.x >= ivals[-1].b : row = dim-1
    else :
        for n in range(dim): 
            if sample_pt.x in ivals[n] : row = n
    
    col = None
    if sample_pt.y <= ivals[0].a : col = 0
    elif sample_pt.y >= ivals[-1].b : col = dim-1
    else :
        for n in range(dim): 
            if sample_pt.y in ivals[n] : col = n
    
    return vec_lookup[row][col]




a.put(func)
# ---------- end decodes_5 ----------

# ----
slider_7 = Slider(100, range=0..500)  # disabled
panel = Panel("0.01")  # disabled
fvec_func = Data(decodes_5.a)  # disabled

# ---- group: tests efficient field lookup
md_slider_3 = MDSlider(
    slider_value=Point(0.9449949265, 0.797498703, 0.5),
    x_domain=Domain(-1.5, 1.5),
    y_domain=Domain(-1.5, 1.5),
    z_domain=Domain(0, 1),
    SliderMode=0)  # disabled
fvec_func_2 = Data(fvec_func)  # disabled
pt_4 = Point(md_slider_3)  # disabled
decodes_6 = DecodesPythonScript(fvec_func=fvec_func_2, pt=pt_4)  # -> console, a; disabled
# ---------- decodes_6: Python ----------
fvec = fvec_func(pt)
a.put(Ray(pt,fvec))
# ---------- end decodes_6 ----------

# ----
vdis = VectorDisplay(Anchor=field_pts, Vector=field_vecs)  # disabled
vec_field_3 = Field(vec_field)  # disabled
vec_field_4 = Field(vec_field)  # disabled
ftensor = TensorDisplay(Field=vec_field_3, Section=rec, Samples=1000)  # disabled
fline = FieldLine(Field=vec_field_4, Point=pt_3, Steps=slider_7, Accuracy=panel, Method=3)  # disabled
slider_8 = Slider(100, range=0..100)  # disabled
slider_9 = Slider(20, range=0..100)  # disabled

# ---- group: create guy class
decodes_7 = DecodesPythonScript()  # -> console, a; disabled
# ---------- decodes_7: Python ----------
class Guy():
    
    def __init__(self, pos_start, vel_start):
        # pos represents this guy's position
        self.pos = pos_start
        self.hist_pos = [] # a way of recording our history
        # vel represents this guy's velocity
        self.vel = vel_start
        self.record_step() # record this initial condition as a "step"
        
        self.max_dist2 = 1.5**2 # the maximum distance this guy will walk
        
    def step(self):
        """
        step guy forward
        """        
        self.vel = self.vel.limited(0.1) # limit to a maximum speed this guy can walk
        self.record_step() # record the step (note that we record before moving)
        self.pos += self.vel # move guy
        
    def steer(self, vec):
        """
        steers this guy by adding the given vector to his current velocity
        """
        vec = vec.limited(0.1) # limit to a maximum force this guy will respond to
        self.vel += vec
        
    def is_pooped(self):
        """
        determines when this guy has had it
        """
        dist_traveled = self.hist_pos[0].distance2(self.hist_pos[-1])
        if dist_traveled > self.max_dist2 : return True
        if self.pos.x > 1.5 or self.pos.x < -1.5: return True
        if self.pos.y > 1.5 or self.pos.y < -1.5: return True
        
    def record_step(self):
        """
        records the current state of this bird to history lists
        """
        self.hist_pos.append(self.pos)
        
a.put(Guy)
# ---------- end decodes_7 ----------

# ----
fvec_func_3 = Data(fvec_func)  # disabled
decodes_8 = DecodesPythonScript(Guy=decodes_7.a, fvec_func=fvec_func_3, max_steps=slider_8, max_guys=slider_9)  # -> console, a; inputs max_steps: Int32, max_guys: Int32; disabled
# ---------- decodes_8: Python ----------
for g in range(max_guys):
    debord = Guy(Point.random(Interval(-0.5,0.5),constrain2d=True),Vec.random(constrain2d=True))
    for s in range(max_steps):
        fvec = fvec_func(debord.pos)
        debord.steer(fvec)
        debord.step()
        if debord.is_pooped() : break
    a.put(PLine(debord.hist_pos))
# ---------- end decodes_8 ----------
crv = Curve(decodes_8.a)  # disabled

# ---- group: create guy class
decodes_9 = DecodesPythonScript()  # -> console, a; disabled; same code as decodes_7

# ----
slider_10 = Slider(100, range=0..100)  # disabled
slider_11 = Slider(20, range=0..100)  # disabled

# ---- group: create jorn class
decodes_10 = DecodesPythonScript(Guy=decodes_9.a)  # -> console, a; disabled
# ---------- decodes_10: Python ----------
class Jorn(Guy):
    
    def steer(self, vec):
        """
        steers this guy by adding the given vector to his current velocity
        """
        vec = vec.limited(0.1) # limit to a maximum force this guy will respond to
        self.vel -= vec
        
        
a.put(Jorn)
# ---------- end decodes_10 ----------

# ----
fvec_func_4 = Data(fvec_func)  # disabled
decodes_11 = DecodesPythonScript(Guy=decodes_9.a, Jorn=decodes_10.a, fvec_func=fvec_func_4, max_steps=slider_10, max_guys=slider_11)  # -> console, a; inputs max_steps: Int32, max_guys: Int32; disabled
# ---------- decodes_11: Python ----------
for g in range(max_guys):
    pt = Point.random(Interval(-0.5,0.5),constrain2d=True)
    vec = Vec.random(constrain2d=True)
    if g%2 ==0 : walker = Jorn(pt,vec)
    else : walker = Guy(pt,vec)
    for s in range(max_steps):
        fvec = fvec_func(walker.pos)
        walker.steer(fvec)
        walker.step()
        if walker.is_pooped() : break
    
    pl = PLine(walker.hist_pos)
    a.put(pl)
# ---------- end decodes_11 ----------
crv_2 = Curve(decodes_11.a)  # disabled

# ==== cluster Cluster
sample_pt = ClusterInput()
vec_field = ClusterInput()
scale = ClusterInput()
sample_pt_2 = Point(sample_pt)
vec_field_2 = Field(vec_field)
evf = EvaluateField(Field=vec_field_2, Point=sample_pt_2)  # -> Tensor, Strength
scale_2 = Number(scale)
sample_vec = Vector(evf.Tensor)
sample_pt_3 = Point(sample_pt_2)
multiplication = Multiplication(A=sample_vec, B=scale_2)
sample_pt_4 = ClusterOutput(sample_pt_3)
R = ClusterOutput(multiplication)
