# Grasshopper definition lsystem.ghx (Grasshopper 0.9.14)
# plug-ins: Decodes Python Interpreter

rulestrings = Panel("""r->r,b
b->r""")

# ---- group: make replacement rules
decodes = DecodesPythonScript(rulestrings=rulestrings)  # -> console, a; inputs rulestrings: list
# ---------- decodes: Python ----------
class ReplacementRule():
    def __init__(self, search, replace):
        self.srch = search
        self.repl = replace.split(",")
        
    def matches(self,turtle):
        if turtle.name == self.srch : return True
        return False


for str in rulestrings:
    strarr = str.split("->")
    a.put(ReplacementRule(strarr[0],strarr[1]))
# ---------- end decodes ----------

# ---- group: make Turtle class
decodes_2 = DecodesPythonScript()  # -> console, a
# ---------- decodes_2: Python ----------
class Turtle():
    def __init__(self,name,parent=None):
        self.name = name
        self.prnt = parent
        
        
    def __repr__(self):
        return self.name
        
        
a.put(Turtle)
# ---------- end decodes_2 ----------

# ----
slider = Slider(8, range=0..10)
md_slider = MDSlider(
    slider_value=Point(0.9594145984, 0.3849754799, 0.5),
    x_domain=Domain(-0.5, 0.5),
    y_domain=Domain(-0.5, 0.5),
    z_domain=Domain(0, 1),
    SliderMode=0)
md_slider_2 = MDSlider(
    slider_value=Point(0, 0.8376585798, 0.5),
    x_domain=Domain(-0.5, 0.5),
    y_domain=Domain(-0.5, 0.5),
    z_domain=Domain(0, 1),
    SliderMode=0)
generation_count = Integer(slider)

# ---- group: turtles make love
decodes_3 = DecodesPythonScript(Turtle=decodes_2.a, axiom="r", rules=decodes.a, count=slider)  # -> console, a, b; inputs rules: list, count: Int32
# ---------- decodes_3: Python ----------
axiom = axiom.split(",")
turtles = [[ Turtle(name) for name in axiom ]]
strings = []
for n in range(count):
    next_gen = []
    gen_string = ""
    for turtle in turtles[-1]: # go through the latest list of turtles
        replaced_turtle = False
        for rule in rules:
            if rule.matches(turtle) :
                for name in rule.repl:
                    baby = Turtle(name,turtle)
                    baby.gen = n
                    next_gen.append(baby)
                    gen_string += name+","
                replaced_turtle = True
                break
        if not replaced_turtle : print "glory be! a childless turtle!"
    turtles.append(next_gen)
    strings.append(gen_string[:-1]) #take off the last comma
    
#print strings
#print turtles
a.put(turtles)
b.put(strings)
# ---------- end decodes_3 ----------

# ----
cluster = Cluster(V=md_slider, Z=Slider(-0.154, range=-0.5..0.5))
cluster_2 = Cluster(V=md_slider_2, Z=Slider(0.5, range=-0.5..0.5))
panel = Panel(decodes_3.b)

# ---- group: make movement rules
decodes_4 = DecodesPythonScript(vec_a=cluster, vec_b=cluster_2)  # -> console, a
# ---------- decodes_4: Python ----------
class MovementRule():
    def __init__(self, search, func):
        self.srch = search
        self.transform = func
        
    def matches(self,turtle):
        if turtle.name == self.srch : return True
        return False
        
        

def func(pcs): 
    opt = pcs.eval(vec_a)
    x_axis = Vec(pcs.origin,pcs.eval(vec_a))
    y_axis = pcs.yAxis
    return CS(opt,x_axis,y_axis)
a.put(MovementRule("r",func))

def func(pcs): 
    opt = pcs.eval(vec_b)
    x_axis = Vec(pcs.origin,pcs.eval(vec_b))
    y_axis = pcs.yAxis
    return CS(opt,x_axis,y_axis)
a.put(MovementRule("b",func))
# ---------- end decodes_4 ----------

# ----
decodes_5 = DecodesPythonScript(rules=decodes_4.a, turtles=decodes_3.a, gen_count=generation_count)  # -> console, a, a_props; inputs rules: list, turtles: list
# ---------- decodes_5: Python ----------
for turtle in turtles:
    if turtle.prnt is None: turtle.cs = CS()

for turtle in turtles:
    if turtle.prnt is not None: 
        for rule in rules:
            if rule.matches(turtle):
                turtle.cs = rule.transform(turtle.prnt.cs)
                line = Line(turtle.prnt.cs.origin, turtle.cs.origin)
                
                if hasattr(turtle, 'gen'): 
                    if turtle.name == "r" : cname = Color(1.00,0.25,0.00)
                    if turtle.name == "b" : cname = Color(0.00,0.50,1.00)
                    c = Color.interpolate(cname,Color(0.5),turtle.gen/gen_count)
                    line.set_color(c)
                    line.set_weight(gen_count/(turtle.gen+1)*2)
                    
                a.put(line)
                break
# ---------- end decodes_5 ----------
hardboil = DecodesHardBoil(Geometry=decodes_5.a, Properties=decodes_5.a_props)

# ==== cluster Cluster
V = ClusterInput()
Z = ClusterInput()
vcomp = Decompose(Vector=V)  # -> XComponent, YComponent, ZComponent
vec = VectorXYZ(XComponent=vcomp.XComponent, YComponent=vcomp.YComponent, ZComponent=Z)  # -> Vector, Length
V_2 = ClusterOutput(vec.Vector)
