# Grasshopper definition lsystem3.ghx (Grasshopper 0.9.14)
# plug-ins: Decodes Python Interpreter

# ---- group: make replacement rules
decodes = DecodesPythonScript()  # -> console, a
# ---------- decodes: Python ----------
class ReplacementRule():
    def __init__(self, search, replace):
        self.srch = search
        self.repl = replace.split(",")
        
    def matches(self,turtle):
        if turtle.name == self.srch : return True
        return False


a.put(ReplacementRule("a","a,b"))
a.put(ReplacementRule("b","a"))
# ---------- end decodes ----------

# ---- group: make Turtle class
decodes_2 = DecodesPythonScript()  # -> console, a
# ---------- decodes_2: Python ----------
class Turtle():
    def __init__(self,name,parent=None):
        self.name = name
        self.prnt = parent
        
        
    def __repr__(self):
        return self.name
        
        
a.put(Turtle)
# ---------- end decodes_2 ----------

# ---- group: make replacement rules
decodes_3 = DecodesPythonScript()  # -> console, a; disabled
# ---------- decodes_3: Python ----------
class ReplacementRule():
    def __init__(self, search, replace):
        self.srch = search
        self.repl = replace.split(",")
        
    def matches(self,turtle):
        if turtle.name == self.srch : return True
        return False


a.put(ReplacementRule("a","a,b,a"))
a.put(ReplacementRule("b","a,b,b"))
# ---------- end decodes_3 ----------

# ---- group: make Turtle class
decodes_4 = DecodesPythonScript()  # -> console, a; disabled; same code as decodes_2

# ---- group: make replacement rules
decodes_5 = DecodesPythonScript()  # -> console, a; disabled
# ---------- decodes_5: Python ----------
class ReplacementRule():
    def __init__(self, search, replace):
        self.srch = search
        self.repl = replace.split(",")
        
    def matches(self,turtle):
        if turtle.name == self.srch : return True
        return False


a.put(ReplacementRule("a","b,b,b"))
a.put(ReplacementRule("b","a,b,a"))
# ---------- end decodes_5 ----------

decodes_6 = DecodesPythonScript()  # -> console, a; disabled
# ---------- decodes_6: Python ----------
class ReplacementRule():
    def __init__(self, search, replace):
        self.srch = search
        self.repl = replace.split(",")
        
    def matches(self,turtle):
        if turtle.name == self.srch : return True
        return False


a.put(ReplacementRule("a","b,b,b"))
a.put(ReplacementRule("b","b,a"))
# ---------- end decodes_6 ----------

# ---- group: make Turtle class
decodes_7 = DecodesPythonScript()  # -> console, a; disabled; same code as decodes_2

decodes_8 = DecodesPythonScript()  # -> console, a; disabled; same code as decodes_2

# ----
md_slider = MDSlider(
    slider_value=Point(0.6415012639, 0.5979924551, 0.5),
    x_domain=Domain(-0.5, 0.5),
    y_domain=Domain(-0.5, 0.5),
    z_domain=Domain(0, 1),
    SliderMode=0)
md_slider_2 = MDSlider(
    slider_value=Point(1, 0.8296750697, 0.5),
    x_domain=Domain(-0.5, 0.5),
    y_domain=Domain(-0.5, 0.5),
    z_domain=Domain(0, 1),
    SliderMode=0)
slider = Slider(10, range=0..10)  # disabled
md_slider_3 = MDSlider(
    slider_value=Point(0.6415012639, 0.5979924551, 0.5),
    x_domain=Domain(-0.5, 0.5),
    y_domain=Domain(-0.5, 0.5),
    z_domain=Domain(0, 1),
    SliderMode=0)  # disabled
md_slider_4 = MDSlider(
    slider_value=Point(1, 0.8296750697, 0.5),
    x_domain=Domain(-0.5, 0.5),
    y_domain=Domain(-0.5, 0.5),
    z_domain=Domain(0, 1),
    SliderMode=0)  # disabled
slider_2 = Slider(10, range=0..10)  # disabled
md_slider_5 = MDSlider(
    slider_value=Point(0.6415012639, 0.5979924551, 0.5),
    x_domain=Domain(-0.5, 0.5),
    y_domain=Domain(-0.5, 0.5),
    z_domain=Domain(0, 1),
    SliderMode=0)  # disabled
slider_3 = Slider(10, range=0..10)  # disabled
md_slider_6 = MDSlider(
    slider_value=Point(1, 0.8296750697, 0.5),
    x_domain=Domain(-0.5, 0.5),
    y_domain=Domain(-0.5, 0.5),
    z_domain=Domain(0, 1),
    SliderMode=0)  # disabled
md_slider_7 = MDSlider(
    slider_value=Point(0.6415012639, 0.5979924551, 0.5),
    x_domain=Domain(-0.5, 0.5),
    y_domain=Domain(-0.5, 0.5),
    z_domain=Domain(0, 1),
    SliderMode=0)  # disabled
md_slider_8 = MDSlider(
    slider_value=Point(0.993902439, 0.8296750697, 0.5),
    x_domain=Domain(-0.5, 0.5),
    y_domain=Domain(-0.5, 0.5),
    z_domain=Domain(0, 1),
    SliderMode=0)  # disabled
panel = Panel("a")  # disabled
panel_2 = Panel("a")  # disabled
panel_3 = Panel("a")  # disabled

# ---- group: turtles make love
decodes_9 = DecodesPythonScript(Turtle=decodes_2.a, axiom="a", rules=decodes.a, count=Slider(10, range=0..10))  # -> console, a; inputs rules: list, count: Int32
# ---------- decodes_9: Python ----------
axiom = axiom.split(",")
turtles = [[ Turtle(name) for name in axiom ]]

for n in range(count):
    next_gen = []
    for turtle in turtles[-1]:
        replaced_turtle = False
        for rule in rules:
            if rule.matches(turtle) :
                for name in rule.repl:
                    baby = Turtle(name,turtle)
                    baby.n = n
                    next_gen.append(baby)
                replaced_turtle = True
                break
        if not replaced_turtle : print "oh fuck, a childless turtle!"
    turtles.append(next_gen)
        
print turtles
a.put(turtles)
# ---------- end decodes_9 ----------

# ---- group: make movement rules
decodes_10 = DecodesPythonScript(vec_a=md_slider, vec_b=md_slider_2)  # -> console, a
# ---------- decodes_10: Python ----------
class MovementRule():
    def __init__(self, search, func):
        self.srch = search
        self.transform = func
        
    def matches(self,turtle):
        if turtle.name == self.srch : return True
        return False
        
        

def func(pcs): 
    opt = pcs.eval(vec_a)
    x_axis = Vec(pcs.origin,pcs.eval(vec_a))
    y_axis = pcs.yAxis
    return CS(opt,x_axis,y_axis)
a.put(MovementRule("a",func))

def func(pcs): 
    opt = pcs.eval(vec_b)
    x_axis = Vec(pcs.origin,pcs.eval(vec_b))
    y_axis = pcs.zAxis
    return CS(opt,x_axis,y_axis)
a.put(MovementRule("b",func))
# ---------- end decodes_10 ----------

# ---- group: turtles make love
decodes_11 = DecodesPythonScript(Turtle=decodes_4.a, axiom=panel, rules=decodes_3.a, count=slider)  # -> console, a; inputs rules: list, count: Int32; disabled; same code as decodes_9

decodes_12 = DecodesPythonScript(Turtle=decodes_7.a, axiom=panel_2, rules=decodes_5.a, count=slider_2)  # -> console, a; inputs rules: list, count: Int32; disabled; same code as decodes_9

decodes_13 = DecodesPythonScript(Turtle=decodes_8.a, axiom=panel_3, rules=decodes_6.a, count=slider_3)  # -> console, a; inputs rules: list, count: Int32; disabled; same code as decodes_9

# ---- group: make movement rules
decodes_14 = DecodesPythonScript(vec_a=md_slider_3, vec_b=md_slider_4)  # -> console, a; disabled; same code as decodes_10

decodes_15 = DecodesPythonScript(vec_a=md_slider_5, vec_b=md_slider_6)  # -> console, a; disabled; same code as decodes_10

decodes_16 = DecodesPythonScript(vec_a=md_slider_7, vec_b=md_slider_8)  # -> console, a; disabled; same code as decodes_10

# ----
decodes_17 = DecodesPythonScript(rules=decodes_10.a, turtles=decodes_9.a)  # -> console, a; inputs rules: list, turtles: list
# ---------- decodes_17: Python ----------
for turtle in turtles:
    if turtle.prnt is None: turtle.cs = CS()

for turtle in turtles:
    if turtle.prnt is not None: 
        for rule in rules:
            if rule.matches(turtle):
                turtle.cs = rule.transform(turtle.prnt.cs)
                a.put(Line(turtle.prnt.cs.origin, turtle.cs.origin))
# ---------- end decodes_17 ----------
decodes_18 = DecodesPythonScript(rules=decodes_14.a, turtles=decodes_11.a)  # -> console, a; inputs rules: list, turtles: list; disabled; same code as decodes_17
decodes_19 = DecodesPythonScript(rules=decodes_15.a, turtles=decodes_12.a)  # -> console, a; inputs rules: list, turtles: list; disabled; same code as decodes_17
decodes_20 = DecodesPythonScript(rules=decodes_16.a, turtles=decodes_13.a)  # -> console, a; inputs rules: list, turtles: list; disabled; same code as decodes_17
