# Grasshopper definition lsystem_examples.ghx (Grasshopper 0.9.14)
# plug-ins: Decodes Python Interpreter

# ---- group: make Turtle class
decodes = DecodesPythonScript()  # -> console, a
# ---------- decodes: Python ----------
class Turtle():
    def __init__(self,name,parent=None):
        self.name = name
        self.prnt = parent
        
        
    def __repr__(self):
        return self.name
        
        
a.put(Turtle)
# ---------- end decodes ----------

# ----
turtle_class = Data(decodes.a)
md_slider = MDSlider(
    slider_value=Point(1, 0.6922925158, 0.5),
    x_domain=Domain(-0.5, 0.5),
    y_domain=Domain(-0.5, 0.5),
    z_domain=Domain(0, 1),
    SliderMode=0)
md_slider_2 = MDSlider(slider_value=Point(1, 1, 0.5), x_domain=Domain(0, 1), y_domain=Domain(0, 1), z_domain=Domain(0, 1), SliderMode=0)
md_slider_3 = MDSlider(
    slider_value=Point(1, 0.4971705646, 0.5),
    x_domain=Domain(-0.5, 0.5),
    y_domain=Domain(-0.5, 0.5),
    z_domain=Domain(0, 1),
    SliderMode=0)
md_slider_4 = MDSlider(
    slider_value=Point(0.4975610128, 1, 0.5),
    x_domain=Domain(-0.5, 0.5),
    y_domain=Domain(-0.5, 0.5),
    z_domain=Domain(0, 1),
    SliderMode=0)
rulestrings = Panel("""r->+b,b,-b
b->r,b""")
rulestrings_2 = Panel("""r->+b,-b
b->r
b->r""")
rulestrings_3 = Panel("""r->r,b
b->r""")
md_slider_5 = MDSlider(
    slider_value=Point(1, 0.4971705646, 0.5),
    x_domain=Domain(-0.5, 0.5),
    y_domain=Domain(-0.5, 0.5),
    z_domain=Domain(0, 1),
    SliderMode=0)
md_slider_6 = MDSlider(
    slider_value=Point(0.4975610128, 1, 0.5),
    x_domain=Domain(-0.5, 0.5),
    y_domain=Domain(-0.5, 0.5),
    z_domain=Domain(0, 1),
    SliderMode=0)
cluster = Cluster_2(V=md_slider, Z=Slider(0.5, range=-0.5..0.5))

# ---- group: make replacement rules
decodes_2 = DecodesPythonScript(rulestrings=rulestrings_3)  # -> console, a; inputs rulestrings: list; disabled
# ---------- decodes_2: Python ----------
class ReplacementRule():
    def __init__(self, search, replace):
        self.srch = search
        self.repl = replace.split(",")
        
    def matches(self,turtle):
        if turtle.name == self.srch : return True
        return False


for str in rulestrings:
    strarr = str.split("->")
    a.put(ReplacementRule(strarr[0],strarr[1]))
# ---------- end decodes_2 ----------

# ----
cluster_2 = Cluster_2(V=md_slider_3, Z=Slider(0.5, range=-0.5..0.5))
cluster_3 = Cluster_2(V=md_slider_2, Z=Slider(0.307, range=-0.5..0.5))
cluster_4 = Cluster_2(V=md_slider_4, Z=Slider(-0.073, range=-0.5..0.5))

# ---- group: make movement rules
decodes_3 = DecodesPythonScript(vec_a=cluster, vec_b=cluster_3)  # -> console, a
# ---------- decodes_3: Python ----------
class MovementRule():
    def __init__(self, search, func):
        self.srch = search
        self.transform = func
        
    def matches(self,turtle):
        if turtle.name == self.srch : return True
        return False
        
        

def func(pcs): 
    opt = pcs.eval(vec_a)
    x_axis = Vec(pcs.origin,pcs.eval(vec_a))
    y_axis = pcs.yAxis
    return CS(opt,x_axis,y_axis)
a.put(MovementRule("r",func))

def func(pcs): 
    opt = pcs.eval(vec_b.x,0,0)
    x_axis = pcs.xAxis
    y_axis = pcs.yAxis
    return CS(opt,x_axis,y_axis)
a.put(MovementRule("b",func))

def func(pcs): 
    opt = pcs.eval(vec_b.x,vec_b.y,vec_b.z)
    x_axis = pcs.xAxis
    y_axis = pcs.yAxis
    return CS(opt,x_axis,y_axis)
a.put(MovementRule("-b",func))

def func(pcs): 
    opt = pcs.eval(vec_b.x,-vec_b.y,vec_b.z)
    x_axis = pcs.xAxis
    y_axis = pcs.yAxis
    return CS(opt,x_axis,y_axis)
a.put(MovementRule("+b",func))
# ---------- end decodes_3 ----------

decodes_4 = DecodesPythonScript(vec_a=cluster_2, vec_b=cluster_4)  # -> console, a
# ---------- decodes_4: Python ----------
class MovementRule():
    def __init__(self, search, func):
        self.srch = search
        self.transform = func
        
    def matches(self,turtle):
        if turtle.name == self.srch : return True
        return False
        
        

def func(pcs): 
    opt = pcs.eval(vec_a)
    x_axis = Vec(pcs.origin,pcs.eval(vec_a))
    y_axis = pcs.yAxis
    return CS(opt,x_axis,y_axis)
a.put(MovementRule("r",func))


def func(pcs): 
    opt = pcs.eval(vec_b)
    x_axis = pcs.xAxis
    y_axis = pcs.yAxis
    return CS(opt,x_axis,y_axis)
a.put(MovementRule("+b",func))

def func(pcs): 
    opt = pcs.eval(-vec_b*0.618)
    x_axis = pcs.xAxis
    y_axis = pcs.yAxis
    return CS(opt,x_axis,y_axis)
a.put(MovementRule("-b",func))
# ---------- end decodes_4 ----------

# ----
slider = Slider(10, range=0..10)
axiom = Panel("r")
axiom_2 = Panel("r")
turtle_class_2 = Data(decodes.a)
cluster_5 = Cluster_2(V=md_slider_5, Z=Slider(0, range=-0.5..0.5))
cluster_6 = Cluster_2(V=md_slider_6, Z=Slider(0.5, range=-0.5..0.5))
cluster_7 = Cluster(
    axiom=axiom,
    turtle_class=turtle_class,
    repl_rulestrings=rulestrings_2,
    mvmt_rules=decodes_4.a,
    gen_count=Slider(10, range=0..10))  # -> a, a_props, population_2; disabled
cluster_8 = Cluster(
    axiom=axiom_2,
    turtle_class=turtle_class,
    repl_rulestrings=rulestrings,
    mvmt_rules=decodes_3.a,
    gen_count=Slider(4, range=0..5))  # -> a, a_props, population_2

# ---- group: turtles make love
decodes_5 = DecodesPythonScript(Turtle=turtle_class_2, axiom="r", rules=decodes_2.a, count=slider)  # -> console, a, b; inputs rules: list, count: Int32
# ---------- decodes_5: Python ----------
axiom = axiom.split(",")
turtles = [[ Turtle(name) for name in axiom ]]
strings = []
for n in range(count):
    next_gen = []
    gen_string = ""
    for turtle in turtles[-1]: # go through the latest list of turtles
        replaced_turtle = False
        for rule in rules:
            if rule.matches(turtle) :
                for name in rule.repl:
                    baby = Turtle(name,turtle)
                    baby.gen = n
                    next_gen.append(baby)
                    gen_string += name+","
                replaced_turtle = True
                break
        if not replaced_turtle : print "glory be! a childless turtle!"
    turtles.append(next_gen)
    strings.append(gen_string[:-1]) #take off the last comma
    
#print strings
#print turtles
a.put(turtles)
b.put(strings)
# ---------- end decodes_5 ----------

# ---- group: make movement rules
decodes_6 = DecodesPythonScript(vec_a=cluster_5, vec_b=cluster_6)  # -> console, a
# ---------- decodes_6: Python ----------
class MovementRule():
    def __init__(self, search, func):
        self.srch = search
        self.transform = func
        
    def matches(self,turtle):
        if turtle.name == self.srch : return True
        return False
        
        

def func(pcs): 
    opt = pcs.eval(vec_a)
    x_axis = Vec(pcs.origin,pcs.eval(vec_a))
    y_axis = pcs.yAxis
    return CS(opt,x_axis,y_axis)
a.put(MovementRule("r",func))

def func(pcs): 
    opt = pcs.eval(vec_b)
    x_axis = Vec(pcs.origin,pcs.eval(vec_b))
    y_axis = pcs.yAxis
    return CS(opt,x_axis,y_axis)
a.put(MovementRule("b",func))
# ---------- end decodes_6 ----------

# ----
panel = Panel(decodes_5.b)
hardboil = DecodesHardBoil(Geometry=cluster_7.a, Properties=cluster_7.a_props)
panel_2 = Panel(cluster_7.population_2)
decodes_7 = DecodesPythonScript(rules=decodes_6.a, turtles=decodes_5.a, gen_count=slider)  # -> console, a, a_props; inputs rules: list, turtles: list
# ---------- decodes_7: Python ----------
for turtle in turtles:
    if turtle.prnt is None: turtle.cs = CS()

for turtle in turtles:
    if turtle.prnt is not None: 
        for rule in rules:
            if rule.matches(turtle):
                turtle.cs = rule.transform(turtle.prnt.cs)
                line = Line(turtle.prnt.cs.origin, turtle.cs.origin)
                
                if hasattr(turtle, 'gen'): 
                    if turtle.name == "r" : cname = Color(1.00,0.25,0.00)
                    if turtle.name == "b" : cname = Color(0.00,0.50,1.00)
                    c = Color.interpolate(cname,Color(0.5),turtle.gen/gen_count)
                    line.set_color(c)
                    line.set_weight(gen_count/(turtle.gen+1)*2)
                    
                a.put(line)
                break
# ---------- end decodes_7 ----------
panel_3 = Panel(cluster_8.population_2)
hardboil_2 = DecodesHardBoil(Geometry=cluster_8.a, Properties=cluster_8.a_props)
hardboil_3 = DecodesHardBoil(Geometry=decodes_7.a, Properties=decodes_7.a_props)

# ==== cluster Cluster
repl_rulestrings = ClusterInput()
axiom = ClusterInput()
axiom_2 = String(axiom)
repl_rulestrings_2 = String(repl_rulestrings)

# ---- group: make replacement rules
decodes = DecodesPythonScript(rulestrings=repl_rulestrings_2)  # -> console, a; inputs rulestrings: list
# ---------- decodes: Python ----------
class ReplacementRule():
    bad_chars = '(){}<>+-'
    
    def __init__(self, search, replace):
        self.srch = search.translate(None,self.bad_chars) #strips out any unwanted chars
        self.repl = replace.split(",")
        
    def matches(self,turtle):
        if self.srch in turtle.name : return True
        return False


for str in rulestrings:
    strarr = str.split("->")
    a.put(ReplacementRule(strarr[0],strarr[1]))
# ---------- end decodes ----------

# ----
gen_count = ClusterInput()
turtle_class = ClusterInput()
gen_count_2 = Integer(gen_count)
turtle_class_2 = Data(turtle_class)
repl_rules = Data(decodes.a)
mvmt_rules = ClusterInput()

# ---- group: turtles make love
decodes_2 = DecodesPythonScript(Turtle=turtle_class_2, axiom=axiom_2, rules=repl_rules, count=gen_count_2)  # -> console, a, b; inputs rules: list, count: Int32
# ---------- decodes_2: Python ----------
axiom = axiom.split(",")
turtles = [[ Turtle(name) for name in axiom ]]
strings = []
for n in range(count):
    next_gen = []
    gen_string = ""
    for turtle in turtles[-1]: # go through the latest list of turtles
        replaced_turtle = False
        for rule in rules:
            if rule.matches(turtle) :
                for name in rule.repl:
                    baby = Turtle(name,turtle)
                    baby.gen = n
                    next_gen.append(baby)
                    gen_string += name+","
                replaced_turtle = True
                break
        if not replaced_turtle : print "glory be! a childless turtle:",turtle
    turtles.append(next_gen)
    strings.append(gen_string[:-1]) #take off the last comma
    
#print strings
#print turtles
a.put(turtles)
b.put(strings)
# ---------- end decodes_2 ----------

# ----
mvmt_rules_2 = Data(mvmt_rules)
population = String(decodes_2.b)
decodes_3 = DecodesPythonScript(rules=mvmt_rules_2, turtles=decodes_2.a, gen_count=gen_count_2)  # -> console, a, a_props; inputs rules: list, turtles: list
# ---------- decodes_3: Python ----------
for turtle in turtles:
    if turtle.prnt is None: turtle.cs = CS()

for turtle in turtles:
    if turtle.prnt is not None: 
        for rule in rules:
            if rule.matches(turtle):
                turtle.cs = rule.transform(turtle.prnt.cs)
                line = Line(turtle.prnt.cs.origin, turtle.cs.origin)
                
                if hasattr(turtle, 'gen'): 
                    if "r" in turtle.name : cname = Color(1.00,0.25,0.00)
                    if "b" in turtle.name : cname = Color(0.00,0.50,1.00)
                    c = Color.interpolate(cname,Color(0.5),turtle.gen/gen_count)
                    line.set_color(c)
                    line.set_weight(gen_count/(turtle.gen+1)*2)
                    
                a.put(line)
                break
# ---------- end decodes_3 ----------
panel = Panel(decodes_2.console)
population_2 = ClusterOutput(population)
a = ClusterOutput(decodes_3.a)
a_props = ClusterOutput(decodes_3.a_props)
panel_2 = Panel(decodes_2.b)

# ==== cluster Cluster_2
V = ClusterInput()
Z = ClusterInput()
vcomp = Decompose(Vector=V)  # -> XComponent, YComponent, ZComponent
vec = VectorXYZ(XComponent=vcomp.XComponent, YComponent=vcomp.YComponent, ZComponent=Z)  # -> Vector, Length
V_2 = ClusterOutput(vec.Vector)
