# Grasshopper definition color optimization.gh (Grasshopper 0.9.14)
# plug-ins: Decodes Python Interpreter

goal_color = ColourSwatch(SwatchColor=RGB(110, 121, 186))
slider = Slider(110, range=0..255)
slider_2 = Slider(120, range=0..255)
slider_3 = Slider(186, range=0..255)

# ---- group: define fitness function
decodes = DecodesPythonScript(goal=goal_color)  # -> console, a
# ---------- decodes: Python ----------
hue_weight = 1.0
sat_weight = 1.0
val_weight = 1.0

def fitness(sample):
    dhue = 1-abs(sample.hue - goal.hue)
    dsat = 1-abs(sample.sat - goal.sat)
    dval = 1-abs(sample.val - goal.val)
    sum = (dhue*hue_weight)+(dsat*sat_weight)+(dval*val_weight)
    return sum/(hue_weight+sat_weight+val_weight)

a.put( fitness )
# ---------- end decodes ----------

# ----
goal_color_2 = Colour(goal_color)
rgb = ColourRGB(Alpha=255, Red=slider, Green=slider_2, Blue=slider_3)
cluster = Cluster(C=goal_color_2)
fitness_function = Data(decodes.a)
fitness_function_2 = Data(fitness_function)
decodes_2 = DecodesPythonScript(fitness=fitness_function_2, res=Slider(20, range=4..20), thresh=Slider(0.75, range=0..0.99))  # -> console, a, a_props, b, b_props, c, c_props; inputs res: Int32
# ---------- decodes_2: Python ----------
best_clr = Color(0,0,0)
best_fit = 0.0

for ri in range(res+1):
    for gi in range(res+1):
        for bi in range(res+1):
            pt = Point(ri/res,gi/res,bi/res)
            clr = Color(ri/res,gi/res,bi/res)
            pt.set_color(clr)
            fit = fitness(clr)
            
            if fit > best_fit:
                best_fit = fit
                best_clr = clr
            
            pt.set_weight(Interval.remap(fit,Interval(max([thresh,0.8]),1.0),Interval(0,10)) )
            if fit > thresh : a.put(pt)
            
b.put(best_clr)
c.put(best_fit)
# ---------- end decodes_2 ----------
cluster_2 = Cluster(C=rgb)
hardboil = DecodesHardBoil(Geometry=decodes_2.a, Properties=decodes_2.a_props)
cluster_3 = Cluster(C=decodes_2.b)
best_fit = Panel(decodes_2.c)
fitness_function_3 = Data(fitness_function)
goal_point = Point(cluster)
goal_point_2 = Point(goal_point)
decodes_3 = DecodesPythonScript(fitness=fitness_function_3, sample=rgb)  # -> console, a
# ---------- decodes_3: Python ----------
a.put(fitness(sample))
# ---------- end decodes_3 ----------
ln = Line(StartPoint=cluster_3, EndPoint=goal_point_2)
galapagos = Galapagos(fitness=fitness, gene=[slider, slider_2, slider_3])
fitness = Number(decodes_3.a)
fitness_2 = Panel(fitness)

# ==== cluster Cluster
C = ClusterInput()
argb = SplitARGB(Colour=C)  # -> Alpha, Red, Green, Blue
pt = PointXYZ(XComponent=argb.Red, YComponent=argb.Green, ZComponent=argb.Blue, System=PlaneXY(0, 0, 0))
pt_2 = ClusterOutput(pt)
