# Grasshopper definition color optimization.ghx (Grasshopper 0.9.14)
# plug-ins: Decodes Python Interpreter

color = ColourSwatch(SwatchColor=RGB(110, 121, 186))
color_2 = ColourSwatch(SwatchColor=RGB(255, 72, 0))
color_3 = ColourSwatch(SwatchColor=RGB(0, 255, 0))
colour = ColourPicker(PickedColour=RGB(66, 0, 0))  # disabled
slider = Slider(20, range=4..20)  # disabled
slider_2 = Slider(0.75, range=0..0.99)  # disabled
slider_3 = Slider(0.981, range=0.85..0.99)  # disabled
goal_color = ColourSwatch(SwatchColor=RGB(110, 121, 186))
slider_4 = Slider(0.029, range=0.01..0.25)  # disabled
slider_5 = Slider(126, range=0..255)  # disabled
slider_6 = Slider(138, range=0..255)  # disabled
slider_7 = Slider(187, range=0..255)  # disabled
cluster = Cluster_2(color=color)  # -> S, M
goal_color_2 = Colour(goal_color)
cluster_2 = Cluster_3(color=color_2)  # -> S, M
cluster_3 = Cluster_3(color=color_3)  # -> S, M

# ---- group: define HSB fitness function
decodes = DecodesPythonScript(goal=goal_color)  # -> console, a
# ---------- decodes: Python ----------
hue_weight = 1.0
sat_weight = 1.0
val_weight = 1.0

def fitness(sample):
    dhue = 1-abs(sample.hue - goal.hue)
    dsat = 1-abs(sample.sat - goal.sat)
    dval = 1-abs(sample.val - goal.val)
    sum = (dhue*hue_weight)+(dsat*sat_weight)+(dval*val_weight)
    return sum/(hue_weight+sat_weight+val_weight)

a.put( fitness )
# ---------- end decodes ----------

# ---- group: define RGB fitness
decodes_2 = DecodesPythonScript(goal=goal_color)  # -> console, a
# ---------- decodes_2: Python ----------
def fitness(sample):
    dr = 1-abs(sample.r - goal.r)
    dg = 1-abs(sample.g - goal.g)
    db = 1-abs(sample.b - goal.b)
    return (dr+dg+db)/3.0

a.put( fitness )
# ---------- end decodes_2 ----------

# ----
rgb = ColourRGB(Alpha=255, Red=slider_5, Green=slider_6, Blue=slider_7)  # disabled
cluster_4 = Cluster(C=goal_color_2)
preview = CustomPreview(Geometry=cluster.S, Shader=cluster.M)
preview_2 = CustomPreview(Geometry=cluster_2.S, Shader=cluster_2.M)
preview_3 = CustomPreview(Geometry=cluster_3.S, Shader=cluster_3.M)
fitness_function = Data(decodes.a)
fitness_function_2 = Data(fitness_function)  # disabled
fitness_function_3 = Data(fitness_function)  # disabled

# ---- group: brute force
decodes_3 = DecodesPythonScript(fitness=fitness_function_2, res=slider, thresh=slider_2)  # -> console, a, a_props, b, b_props, c, c_props; inputs res: Int32; disabled
# ---------- decodes_3: Python ----------
best_clr = Color(0,0,0)
best_fit = 0.0

for ri in range(res+1):
    for gi in range(res+1):
        for bi in range(res+1):
            pt = Point(ri/res,gi/res,bi/res)
            clr = Color(ri/res,gi/res,bi/res)
            pt.set_color(clr)
            fit = fitness(clr)
            
            if fit > best_fit:
                best_fit = fit
                best_clr = clr
            
            pt.set_weight(Interval.remap(fit,Interval(max([thresh,0.8]),1.0),Interval(0,10)) )
            if fit > thresh : a.put(pt)
            
b.put(best_clr)
c.put(best_fit)
# ---------- end decodes_3 ----------

# ----
decodes_4 = DecodesPythonScript(fitness=fitness_function_3, step=slider_4, thresh=slider_3, sample=colour)  # -> console, a; disabled
# ---------- decodes_4: Python ----------
# greedy algo

def nearby_clrs(clr, delta):
    nearby = []
    nearby.append(Color(sample.r+delta,sample.g,sample.b) ) #r_plus 
    nearby.append( Color(sample.r-delta,sample.g,sample.b)) #r_minus
    nearby.append(Color(sample.r,sample.g+delta,sample.b) ) #g_plus 
    nearby.append( Color(sample.r,sample.g-delta,sample.b)) #g_minus
    nearby.append(Color(sample.r,sample.g+delta,sample.b) ) #b_plus 
    nearby.append( Color(sample.r,sample.g-delta,sample.b)) #b_minus
    
    nearby.append(Color(sample.r+delta,sample.g+delta,sample.b) ) #r_plus g_plus
    nearby.append(Color(sample.r+delta,sample.g-delta,sample.b) ) #r_plus g_minus
    nearby.append(Color(sample.r+delta,sample.g,sample.b+delta) ) #r_plus b_plus 
    nearby.append(Color(sample.r+delta,sample.g,sample.b-delta) ) #r_plus b_minus 

    nearby.append(Color(sample.r-delta,sample.g+delta,sample.b) ) #r_minus g_plus
    nearby.append(Color(sample.r-delta,sample.g-delta,sample.b) ) #r_minus g_minus
    nearby.append(Color(sample.r-delta,sample.g,sample.b+delta) ) #r_minus b_plus 
    nearby.append(Color(sample.r-delta,sample.g,sample.b-delta) ) #r_minus b_minus 
    
    return nearby

a.put(sample)
n = 0
while fitness(sample) < thresh:
    step_samples = nearby_clrs(sample,step)
    step_samples.sort(key=fitness)
    sample = step_samples[-1]
    print fitness(sample)
    a.put(sample)
    n += 1
    if (n>100) : break
# ---------- end decodes_4 ----------
cluster_5 = Cluster(C=rgb)  # disabled
goal_point = Point(cluster_4)
hardboil = DecodesHardBoil(Geometry=decodes_3.a, Properties=decodes_3.a_props)  # disabled
cluster_6 = Cluster(C=decodes_3.b)  # disabled
cluster_7 = Cluster(C=colour)  # disabled
best_fit = Panel(decodes_3.c)  # disabled
fitness_function_4 = Data(fitness_function)  # disabled
goal_point_2 = Point(goal_point)  # disabled
panel = Panel(decodes_4.console)  # disabled
cluster_8 = Cluster(C=decodes_4.a)  # disabled
decodes_5 = DecodesPythonScript(fitness=fitness_function_4, sample=rgb)  # -> console, a; disabled
# ---------- decodes_5: Python ----------
a.put(fitness(sample))
# ---------- end decodes_5 ----------
ln = Line(StartPoint=cluster_6, EndPoint=goal_point_2)  # disabled
pline = PolyLine(Vertices=cluster_8, Closed=False)  # disabled
galapagos = Galapagos(fitness=fitness, gene=[slider_5, slider_6, slider_7])
fitness = Number(decodes_5.a)  # disabled
fitness_2 = Panel(fitness)  # disabled

# ==== cluster Cluster
C = ClusterInput()
argb = SplitARGB(Colour=C)  # -> Alpha, Red, Green, Blue
pt = PointXYZ(XComponent=argb.Red, YComponent=argb.Green, ZComponent=argb.Blue, System=PlaneXY(0, 0, 0))
pt_2 = ClusterOutput(pt)

# ==== cluster Cluster_2
color = ClusterInput()
color_2 = Colour(color)
cluster = Cluster(C=color_2)
goal_point = Point(cluster)
cluster_2 = Cluster(C=color_2)
sph = Sphere(Base=goal_point, Radius=Slider(0.028, range=0..1))
S = ClusterOutput(sph)
goal_point_2 = Point(cluster_2)
material = CreateMaterial(Diffuse=color_2, Specular=color_2, Emission=RGB(0, 0, 0), Transparency=0, Shine=0)
M = ClusterOutput(material)

# ==== cluster Cluster_3
color = ClusterInput()
color_2 = Colour(color)
cluster = Cluster(C=color_2)
goal_point = Point(cluster)
cluster_2 = Cluster(C=color_2)
sph = Sphere(Base=goal_point, Radius=Slider(0.028, range=0..1))
goal_point_2 = Point(cluster_2)
material = CreateMaterial(Diffuse=color_2, Specular=color_2, Emission=RGB(0, 0, 0), Transparency=0, Shine=0)
S = ClusterOutput(sph)
M = ClusterOutput(material)
