# Grasshopper definition panel optimization.ghx (Grasshopper 0.9.14)
# plug-ins: Decodes Python Interpreter

res_v = Slider(20, range=3..20)
skew_v = Slider(0.61, range=0..1)
res_u = Slider(20, range=3..20)
skew_u = Slider(0.5, range=0..1)
md_slider = MDSlider(
    slider_value=Point(1, 0.9968779959, 0.5),
    x_domain=Domain(0, 1),
    y_domain=Domain(0, 1),
    z_domain=Domain(0, 1),
    SliderMode=0)
slider = Slider(0.05, range=0..0.05)  # disabled
count_u = Integer(res_u)
count_v = Integer(res_v)
ival_v = Domain("0 to PI")
ival_u = Domain("0 to PI")
skew_v_2 = Number(skew_v)
skew_u_2 = Number(skew_u)

# ---- group: QPanel class
decodes = DecodesPythonScript(similarity_tol=slider)  # -> console, a; disabled
# ---------- decodes: Python ----------
class QPanel(PGon):
    """
    a flat quad panel
    """
    
    def __init__(self,pts,indx):
        if len(pts) != 4 : raise Exception("four points please!")
        super(QPanel,self).__init__() #calls the PGon constructor
        
        self.tol2 = similarity_tol**2
        
        # find the cs of this panel
        o = Point.centroid(pts)
        vx = Vec(o,pts[0])
        vy = Vec(o,pts[1])
        self.basis = CS(o,vx,vy) 
        
        # transform each of the given points into the 'space' of the cs
        xf = Xform.change_basis(self.basis,CS())
        pts = [pt*xf for pt in pts]
        if pts[2]._z != 0 : 
            #print "non flat panel!  adjusting corner by ",pts[2].z
            pts[2]._z = 0
            
        if pts[3]._z != 0 : 
            #print "non flat panel!  adjusting corner by ",pts[3].z
            pts[3]._z = 0
        
        self.append(pts)
        self.index = indx
        
        
    def is_similar_to(self,other):
        return all( [self.pts[n].distance2(other.pts[n]) <= self.tol2 for n in range(4) ] )
        
    def to_pgon(self):
        return PGon(self.pts,self.basis)
        
    def to_mesh(self):
        return Mesh(self.pts,[[0,1,2,3]])
        
    def to_rebased_pgon(self, cs):
        #print self.pts[0].basis_stripped(), self.pts[0], self.pts[0].basis, self.basis
        return PGon([pt.basis_stripped() for pt in self.pts],cs)
    
    @property
    def do_translate(self): return False # this tells grasshopper not to translate this class to native GH type
        

a.put(QPanel)
# ---------- end decodes ----------

# ----
qpanel = Data(decodes.a)

# ---- group: dupin cyclide surface
decodes_2 = DecodesPythonScript(rad_0=Slider(0.62, range=0.01..1), rad_1=Slider(0.24, range=0.01..1), ipt=md_slider)  # -> console, a
# ---------- decodes_2: Python ----------
import math

tvec = Vec(0,-3,0) # to move the thing away from origin

def func(u,v):
    x = (rad_0+rad_1*math.cos(v))*math.cos(u)
    y = (rad_0+rad_1*math.cos(v))*math.sin(u)
    z = rad_1 * math.sin(v)
    
    vec = Vec(ipt,Point(x,y,z))
    vec.length = 1/vec.length
    return ipt + vec + tvec
    
a.put(func)
# ---------- end decodes_2 ----------

# ---- group: sq distribution
count_u_2 = Integer(count_u)
ival_u_2 = Domain(ival_u)
skew_u_3 = Number(skew_u_2)
count_v_2 = Integer(res_v)
ival_v_2 = Domain("0 to PI")
skew_v_3 = Number(skew_v)
decodes_3 = DecodesPythonScript(ival=ival_u_2, count=count_u_2, skew=skew_u_3)  # -> console, a; inputs count: Int32
# ---------- decodes_3: Python ----------
for x in Interval().divide(count,include_last = True):
    s = Interval(0.5,1.5).eval(skew) # 0.5 < s < 1.5
    y = x**(s**10)# 0 < y < 1
    a.put(ival.eval(y))
# ---------- end decodes_3 ----------
decodes_4 = DecodesPythonScript(ival=ival_v_2, count=count_v_2, skew=skew_v_3)  # -> console, a; inputs count: Int32; same code as decodes_3
u_vals = Number(decodes_3.a)
v_vals = Number(decodes_4.a)

# ---- group: sqrt distribution
count_u_3 = Integer(count_u)
ival_u_3 = Domain(ival_u)
skew_u_4 = Number(skew_u_2)
count_v_3 = Integer(res_v)
ival_v_3 = Domain("0 to PI")
skew_v_4 = Number(skew_v)
decodes_5 = DecodesPythonScript(ival=ival_u_3, count=count_u_3, skew=skew_u_4)  # -> console, a; inputs count: Int32
# ---------- decodes_5: Python ----------
import math
s = Interval(0.00001,4.0).eval(skew) # 0 < s < 4.0

def f(x):
    x = x - 0.5
    y = 0.0
    if x < 0 :
        y = -math.sqrt(-x) ** s
    if x > 0:
        y = math.sqrt(x) ** s
    return y

ival_y = Interval(f(0),f(1))

for x in Interval().divide(count,include_last = True):
    y = f(x)
    a.put(ival.eval(ival_y.deval(y)))
# ---------- end decodes_5 ----------
decodes_6 = DecodesPythonScript(ival=ival_v_3, count=count_v_3, skew=skew_v_4)  # -> console, a; inputs count: Int32; same code as decodes_5
u_vals_2 = Number(decodes_5.a)
v_vals_2 = Number(decodes_6.a)

# ---- group: bezier distribution
count_u_4 = Integer(count_u)
ival_u_4 = Domain(ival_u)
skew_u_5 = Number(skew_u_2)
count_v_4 = Integer(res_v)
ival_v_4 = Domain("0 to PI")
skew_v_5 = Number(skew_v)
decodes_7 = DecodesPythonScript(ival=ival_u_4, count=count_u_4, skew=skew_u_5)  # -> console, a; inputs count: Int32
# ---------- decodes_7: Python ----------
p0 = Point(0,ival.a)
p1 = Point(1,ival.b)
pm = Segment(Point(0,ival.b),Point(1,ival.a)).eval(skew)
guide_curve = Curve.bezier([p0,pm,p1])

for x in Interval().divide(count,include_last = True):
    a.put(guide_curve.eval(x).y)
# ---------- end decodes_7 ----------
decodes_8 = DecodesPythonScript(ival=ival_v_4, count=count_v_4, skew=skew_v_5)  # -> console, a; inputs count: Int32; same code as decodes_7
u_vals_3 = Number(decodes_7.a)
v_vals_3 = Number(decodes_8.a)

# ----
count_u_5 = Integer(count_u)
pln = Plane(Plane(origin=(-1, -2, 0), x=(0, 1, 0), y=(-1, 0, 0)))
qpanel_2 = Data(decodes.a)  # disabled
surface_function = Data(decodes_2.a)

# ---- group: test tolerence and panel flattening
slider_2 = Slider(0.021, range=0.001..0.05)  # disabled
pt = Point([Point(-0.6609079321, 0.3117478834, 0), Point(-0.3316418827, 0.2276581382, 0), Point(-0.3260694684, 0.2986109273, 0.03075507245), Point(-0.6791915287, 0.5148850447, 0.06127449096)])  # disabled
pline = PolyLine(Vertices=pt, Closed=True)  # disabled
cluster = Cluster(pt=pt, A=slider_2)  # disabled
pt_2 = Point(cluster)  # disabled
pline_2 = PolyLine(Vertices=pt_2, Closed=True)  # disabled
decodes_9 = DecodesPythonScript(QPanel=qpanel_2, test_pts_a=pt, test_pts_b=pt_2)  # -> console, a, a_props; inputs test_pts_a: list, test_pts_b: list; disabled
# ---------- decodes_9: Python ----------
pnl_a = QPanel(test_pts_a,0)
pnl_b = QPanel(test_pts_b,0)

pg_a = pnl_a.to_rebased_pgon(CS())
pg_b = pnl_b.to_rebased_pgon(CS())

if pnl_b.is_similar_to(pnl_a):
    pg_b.set_color(0,1,0)
else:
    pg_b.set_color(1,0,0)

a.put([pg_a,pg_b])
# ---------- end decodes_9 ----------
hardboil = DecodesHardBoil(Geometry=decodes_9.a, Properties=decodes_9.a_props)  # disabled

# ----
graph = QuickGraph(v_vals_3)
graph_2 = QuickGraph(u_vals_3)
graph_3 = QuickGraph(v_vals)
graph_4 = QuickGraph(u_vals)
graph_5 = QuickGraph(v_vals_2)
graph_6 = QuickGraph(u_vals_2)
dist_type_v = Slider(1, range=0..2)
dist_type_u = Slider(2, range=0..2)
filter = StreamFilter(Gate=dist_type_v, Stream0=v_vals_3, Stream1=v_vals, Stream2=v_vals_2)
filter_2 = StreamFilter(Gate=dist_type_u, Stream0=u_vals_3, Stream1=u_vals, Stream2=u_vals_2)
v_distribution = QuickGraph(filter)

# ---- group: u_distribution
graph_7 = QuickGraph(filter_2)

# ----
v_vals_4 = Number(filter)
u_vals_4 = Number(filter_2)

# ---- group: create mesh from surface
surface_function_2 = Data(surface_function)
decodes_10 = DecodesPythonScript(func=surface_function_2, u_vals=u_vals_4, v_vals=v_vals_4)  # -> console, a; inputs u_vals: list, v_vals: list
# ---------- decodes_10: Python ----------
msh = Mesh()
for v in v_vals:
    for u in u_vals:
        msh.append(func(u,v))

res_u = len(u_vals)
# simple triangulation style
for v in range(len(v_vals)):
    row = v*res_u
    for u in range(len(u_vals)-1):
        pi_0 = row+u
        pi_1 = row+u+1
        pi_2 = row+u+res_u+1
        pi_3 = row+u+res_u
        msh.add_face(pi_0,pi_1,pi_2,pi_3)

a.put(msh)
# ---------- end decodes_10 ----------
panel_mesh = Mesh(decodes_10.a)

# ----
panel_mesh_2 = Mesh(panel_mesh)

# ---- group: create panels
decodes_11 = DecodesPythonScript(QPanel=qpanel, msh=panel_mesh_2)  # -> console, a; disabled
# ---------- decodes_11: Python ----------
n = 0
for face in msh.faces:
    pts = [msh.pts[face[0]],msh.pts[face[1]],msh.pts[face[2]],msh.pts[face[3]]]
    panel = QPanel(pts,n)
    a.put(panel)
    print "basis = ",panel.basis
    n += 1
    
print a.geom[0].basis
# ---------- end decodes_11 ----------

# ---- group: lays out unordered panels
decodes_12 = DecodesPythonScript(
    panels=decodes_11.a,
    layout_plane=pln,
    count_u=count_u_5,
    spac_x=Slider(0.68, range=0..1),
    spac_y=Slider(0.32, range=0..1))  # -> console, a, b; inputs panels: list; disabled
# ---------- decodes_12: Python ----------
layout_plane.origin = layout_plane.eval(-count_u*0.5*spac_x,0) # centers content on plane

y = 0
x = 0
for panel in panels:
    cs = CS(layout_plane.eval(x,y),layout_plane.xAxis,layout_plane.yAxis)
    a.put(panel.to_rebased_pgon(cs))
    b.put(Point.centroid(panel.pts))
    x += spac_x
    if x > (count_u-1) * spac_x:
        x = 0
        y += spac_y
# ---------- end decodes_12 ----------

# ---- group: bin panels
decodes_13 = DecodesPythonScript(panels=decodes_11.a, do_it=Button())  # -> console, a, b; inputs panels: list
# ---------- decodes_13: Python ----------
# first sort the panels by area

# start an empty list of lists of panels, call it a list of panel bins
# each panel bin will have a 'king' panel assigned
# an other panel can go into each bin if it is similar to the king

# for each panel, try to put in each bin already existing.
# if the panel fits into a bin, move on
# it the panel does not fit in any existing bin, create a new bin with this panel as its king.

# count the bins


if (do_it):
    bins = []
    
    for panel in panels:
        binned_panel = False
        
        for bin in bins:
            if panel.is_similar_to(bin[0]) :
                bin.append(panel)
                binned_panel = True
                break
        
        if not binned_panel :
            bins.append([panel])
    
    pgons = []
    rb_pgons = []
    for bin in bins:
        pgons.append([panel.to_mesh() for panel in bin])
        rb_pgons.append([panel.to_rebased_pgon(CS()) for panel in bin])

a.put(pgons)
b.put(rb_pgons)
# ---------- end decodes_13 ----------

# ----
points = PointList(Points=decodes_12.b, Tags=True, Lines=False, Size=Slider(0.012, range=0..0.1))
tstat = TreeStatistics(Tree=decodes_13.a)  # -> Paths, Length, Count
_3d_meshes = Mesh(decodes_13.a)
flat_pgons = Curve(decodes_13.b)
bin_count = Integer(tstat.Count)
bin_count_2 = Integer(bin_count)
random = Random(Range=Domain(0.25, 0.75), Number=bin_count_2, Seed=0)
random_2 = Random(Range=Domain(0.5, 1), Number=bin_count_2, Seed=2)
hsl = ColourHSL(Alpha=1, Hue=random, Saturation=random_2, Luminance=0.5)
equals = Equality(FirstNumber=tstat.Length, SecondNumber=1)  # -> Equality, Inequality
is_one_panel_bin = Boolean(equals.Equality)
is_one_panel_bin_2 = Boolean(is_one_panel_bin)
material = CreateMaterial(Diffuse=hsl, Specular=RGB(255, 255, 255), Emission=RGB(0, 0, 0), Transparency=is_one_panel_bin_2, Shine=0)  # -> graft(Material)

# ---- group: layout flat polygons
bbox = BoundingBox(Content=flat_pgons, Plane=PlaneXY(0, 0, 0), UnionBox=True)  # -> Box, Box_2
box = BoxComponents(Box=bbox.Box)  # -> Plane, X, Y, Z
domcomp = DomainComponents(Domain=box.X)  # -> Start, End
subtraction = Subtraction(A=domcomp.End, B=domcomp.Start)
ma = MassAddition(Input=flatten(subtraction))  # -> Result, PartialResults
X = UnitX(Factor=ma.PartialResults)  # -> graft(UnitVector)
move = Move(Geometry=flat_pgons, Motion=X)  # -> Geometry, Transform

# ----
ma_2 = MassAddition(Input=equals.Equality)  # -> Result, PartialResults
preview = CustomPreview(Geometry=_3d_meshes, Shader=material)
panel_types = Panel(bin_count)
unique_panels = Panel(ma_2.Result)

# ==== cluster Cluster
pt = ClusterInput()
pt_2 = Point(pt)
avr = Average(Input=pt_2)
vec2pt = Vector2Pt(PointA=avr, PointB=pt_2, Unitize=False)  # -> Vector, Length
A = ClusterInput()
amp = Amplitude(Vector=vec2pt.Vector, Amplitude=A)
move = Move(Geometry=pt_2, Motion=amp)  # -> Geometry, Transform
G = ClusterOutput(move.Geometry)
