# Grasshopper definition surface_optimization.ghx (Grasshopper 0.9.14)
# plug-ins: Decodes Python Interpreter

md_slider = MDSlider(
    slider_value=Point(1, 0.4634144481, 0.5),
    x_domain=Domain(0, 1),
    y_domain=Domain(0, 1),
    z_domain=Domain(0, 1),
    SliderMode=0)
slider = Slider(0.864, range=0..1)
range = Range(Domain=Domain(0, 1), Steps=10)
range_2 = Range(Domain=Domain(0, 1), Steps=10)
decodes = DecodesPythonScript()  # -> console, a; disabled
# ---------- decodes: Python ----------
import math


def rot_surface(rad_cap, rad_mid, mid_height):
    pts = [Point(rad_cap+rad_cap,rad_mid,mid_height),Point(rad_mid+rad_cap,rad_mid,mid_height+mid_height),Point(rad_cap+rad_cap,rad_mid,mid_height+1)]
    def func(u,v):        
        angle = Interval.twopi().eval(u)
        xf = Xform.rotation(axis=Vec(rad_cap,rad_mid,mid_height+1)- Vec(rad_cap,rad_mid,mid_height),angle=angle)
        rot_pts = [pt*xf for pt in pts]
        
        crv = Curve.bezier(rot_pts)
        
        return crv.eval(v)
        
    return func

a.put(rot_surface)
# ---------- end decodes ----------
decodes_2 = DecodesPythonScript()  # -> console, a; disabled
# ---------- decodes_2: Python ----------
import math


def rot_surface(rad_cap, rad_mid, mid_height):
    pts = [Point(rad_cap,0,0),Point(rad_mid,0,mid_height),Point(rad_cap,0,1)]
    def func(u,v):        
        angle = Interval.twopi().eval(u)
        xf = Xform.rotation(axis=Vec(0,0,1),angle=angle)
        rot_pts = [pt*xf for pt in pts]
        
        crv = Curve.bezier(rot_pts)
        
        return crv.eval(v)
        
    return func

a.put(rot_surface)
# ---------- end decodes_2 ----------
decodes_3 = DecodesPythonScript()  # -> console, a; disabled
# ---------- decodes_3: Python ----------
def make_msh(surf):
    msh = Mesh()
    u_vals = Interval().divide(include_last=True)
    for ui in Interval().divide(include_last=True):
        for vi in u_vals:
            msh.append(surf(ui,vi).origin)
    res_u = len(u_vals)
    # simple triangulation style
    for v in range(len(u_vals)):
        row = v*res_u
        for u in range(len(u_vals)-1):
            pi_0 = row+u
            pi_1 = row+u+1
            pi_2 = row+u+res_u+1
            pi_3 = row+u+res_u
            msh.add_face(pi_0,pi_1,pi_2,pi_3)
    return msh

a.put(make_msh)
# ---------- end decodes_3 ----------
decodes_4 = DecodesPythonScript()  # -> console, a
# ---------- decodes_4: Python ----------
import math

def area_to_volume_ratio(func, res = 10):
    interval = Interval().divide(res, include_last = True)
    volumes = []
    srf_area = []
    seg = Segment(func(1,0).origin, func(1,1).origin)
    for i, v in enumerate(interval):
        pt = (func(1,v).origin)
        cpt = Point(0,0,pt.z)
        radius = cpt.distance(pt)
        if i == 0 or i == len(interval)-1:
            srf_area.append(math.pi*radius**2)
        if i < len(interval)-1:
            volumes.append(math.pi * radius**2 * seg.eval(interval[i+1]).distance(seg.eval(interval[i])))
            srf_area.append(math.pi * 2 * radius * seg.eval(interval[i+1]).distance(seg.eval(interval[i])))
    return sum(srf_area)/sum(volumes)

a.put(area_to_volume_ratio)
# ---------- end decodes_4 ----------
decodes_5 = DecodesPythonScript(u_vals=range_2, v_vals=range, floor_count=Slider(10, range=0..10))  # -> console, a, b; inputs u_vals: list, v_vals: list
# ---------- decodes_5: Python ----------
import math

def facade_and_floor_area(func, res=10):
    circumferences = []
    floor_areas = []
    for ival in Interval()//res:
        pt_a = func(0.5,ival.a).origin
        pt_b = func(0.5,ival.b).origin
        cpt = Point(0,0,pt_a.z)
        radius = cpt.distance(pt_a)
        circ = math.pi * 2 * radius
        circumferences.append(circ * (pt_b.z - pt_a.z) )
        floor_areas.append(math.pi * radius**2)
    fac_area = sum(circumferences)
    flr_area = sum(floor_areas)
    
    # add in roof to facade area
    top_pt = func(0.5,1.0).origin
    top_radius = top_pt.distance(Point(0,0,top_pt.z))
    fac_area += math.pi * top_radius**2
    
    return (fac_area, flr_area)
    
    #TODO: adde floor count


def surf_to_mesh(func):
    msh = Mesh()
    for v in v_vals:
        for u in u_vals:
            msh.append(func(u,v))
    
    res_u = len(u_vals)
    # simple triangulation style
    for v in range(len(v_vals)):
        row = v*res_u
        for u in range(len(u_vals)-1):
            pi_0 = row+u
            pi_1 = row+u+1
            pi_2 = row+u+res_u+1
            pi_3 = row+u+res_u
            msh.add_face(pi_0,pi_1,pi_2,pi_3)
        if do_close:
            #last two faces in the row
            pi_0 = row+res_u-1
            pi_1 = row+0
            pi_2 = row+res_u
            pi_3 = row+res_u-1+res_u
            msh.add_face(pi_0,pi_1,pi_2,pi_3)
    
    return msh

a.put(surf_to_mesh)
b.put(facade_and_floor_area)
# ---------- end decodes_5 ----------
cluster = Cluster(num=slider, V=md_slider, num_2=slider)
make_surf_function = Data(decodes.a)  # disabled
make_surf_function_2 = Data(decodes_2.a)  # disabled
fitness_function = Data(decodes_4.a)  # disabled
make_mesh_function = Data(decodes_3.a)  # disabled
to_mesh_function = Data(decodes_5.a)
facd_flr_area_function = Data(decodes_5.b)
decodes_6 = DecodesPythonScript(pts=cluster)  # -> console, a; inputs pts: list
# ---------- decodes_6: Python ----------
import math

def func(u,v):
    flat_pts = [Point(p.x,0,p.z) for p in pts]# ensure points lie on same plane as rotational axis by setting y=0
    
    angle = Interval.twopi().eval(u)
    xf = Xform.rotation(axis=Vec(0,0,1),angle=angle)
    rot_pts = [pt*xf for pt in flat_pts]
    
    crv = Curve.bezier(rot_pts)
    
    return crv.eval(v)
    

a.put(func)
# ---------- end decodes_6 ----------
slider_2 = Slider(1, range=1..20)  # disabled
slider_3 = Slider(10, range=0..10)  # disabled
surface = Data(decodes_6.a)
surface_2 = Data(surface)
decodes_7 = DecodesPythonScript(surf=surface_2, to_mesh=to_mesh_function, fac_flr_area=facd_flr_area_function)  # -> console, a
# ---------- decodes_7: Python ----------
a.put(to_mesh(surf))

ff_area = fac_flr_area(surf)
print ff_area
print ff_area[0]/ff_area[1]
# ---------- end decodes_7 ----------
panel = Panel(decodes_7.console)
mesh = Mesh(decodes_7.a)
decodes_8 = DecodesPythonScript(make_msh=make_mesh_function, make_surf=make_surf_function_2, fitness=fitness_function, res=slider_2, thresh=slider_3)  # -> console, a, a_props, b, b_props, c, c_props; inputs res: Int32; disabled
# ---------- decodes_8: Python ----------
best_fit = thresh
for ri in Interval().divide(res,include_last=True):
    for gi in Interval().divide(res,include_last=True):
        if gi == 0: gi = 0.001
        for bi in Interval().divide(res,include_last=True):
            surf = make_surf(ri,gi,bi)
            fit = fitness(surf)
            clr = Color(ri,gi,bi)
            msh = make_msh(surf)
            # Now define the move vector for each....
            xf = Xform.translation(Vec()-Vec(ri*2,gi*2,bi*2))
            move_msh = msh *xf 
            move_msh.set_color(clr)
            if fit <= best_fit:
                best_fit = fit
                best_msh = move_msh
            if fit < thresh : 
                a.put(move_msh)
b.put(best_msh)
c.put(best_fit)
# ---------- end decodes_8 ----------
decodes_9 = DecodesPythonScript(make_surf=make_surf_function_2, fitness=fitness_function, res=slider_2, thresh=slider_3)  # -> console, a, a_props, b, b_props, c, c_props; inputs res: Int32; disabled
# ---------- decodes_9: Python ----------
def make_msh(rr,gg,bb):
    surf = make_surf(rr,gg,bb)

    msh = Mesh()
    u_vals = Interval().divide(include_last=True)
    for ui in Interval().divide(include_last=True):
        for vi in u_vals:
            msh.append(surf(ui,vi).origin)
    
    res_u = len(u_vals)
    # simple triangulation style
    for v in range(len(u_vals)):
        row = v*res_u
        for u in range(len(u_vals)-1):
            pi_0 = row+u
            pi_1 = row+u+1
            pi_2 = row+u+res_u+1
            pi_3 = row+u+res_u
            msh.add_face(pi_0,pi_1,pi_2,pi_3)
            msh.set_color(Color(rr,gg,bb))
    fit = fitness(surf)
    return fitness(surf), msh

best_fit = 10
for bi in Interval().divide(res,include_last=True):
    gi = bi
    if bi == 0:
        gi = 0.001
    make_mshs = make_msh(bi/res,gi,bi/res)
    msh = make_mshs[1]
    fit = make_mshs[0]
    if fit < best_fit:
        best_fit = fit
        best_msh = msh
    if fit < thresh : a.put(msh)
b.put(best_msh)
c.put(best_fit)
"""
for ri in range(res+1):
    for gi in range(res+1):
        for bi in range(res+1):"""
# ---------- end decodes_9 ----------
hardboil = DecodesHardBoil(Geometry=decodes_8.a, Properties=decodes_8.a_props)  # disabled
panel_2 = Panel(decodes_9.c)  # disabled
geo = Geometry(decodes_9.b)  # disabled
hardboil_2 = DecodesHardBoil(Geometry=decodes_9.a, Properties=decodes_9.a_props)  # disabled

# ==== cluster Cluster
V = ClusterInput()
num = ClusterInput()
num_2 = ClusterInput()
vcomp = Decompose(Vector=V)  # -> XComponent, YComponent, ZComponent
num_3 = Number(num)
num_4 = Number(num_2)
pt = PointXYZ(XComponent=vcomp.XComponent, YComponent=vcomp.ZComponent, ZComponent=vcomp.YComponent, System=PlaneXY(0, 0, 0))
pt_2 = PointXYZ(XComponent=num_4, YComponent=0, ZComponent=0, System=PlaneXY(0, 0, 0))
pt_3 = PointXYZ(XComponent=num_3, YComponent=0, ZComponent=1, System=PlaneXY(0, 0, 0))
pt_4 = Point([pt_2, pt, pt_3])
pt_5 = ClusterOutput(pt_4)
