# Grasshopper definition circles.gh (Grasshopper 0.9.14)
# plug-ins: Decodes Python Interpreter

md_slider = MDSlider(
    slider_value=Point(0.256097561, 0.2865853659, 0.5),
    x_domain=Domain(0, 1),
    y_domain=Domain(0, 1),
    z_domain=Domain(0, 1),
    SliderMode=0)
vcomp = Decompose(Vector=md_slider)  # -> XComponent, YComponent, ZComponent

# ---- group: creates a circle class
decodes = DecodesPythonScript()  # -> console, a
# ---------- decodes: Python ----------
class Circle():
    
    # TODO: this class currently assumes a circle on the xy axis
    
    def __init__(self,plane,radius):
        self.pln = plane
        self.rad = radius
        
    @property
    def cpt(self):
        return self.pln.origin
        
    def intersections(self,other):
        # TODO: this func currently assumes a circle on the xy axis
        if not self.pln.is_coplanar( other.pln ) : 
            print self.pln.near(other.pln.origin)[0].distance(other.pln.origin)
            print 'circles not coplanar'
            return False
        d = self.cpt.distance(other.cpt)
        if d == 0 : 
            print 'circles share a center point'
            return False
        a = (self.rad**2 - other.rad**2 + d**2)/(2*d)
        h2 = self.rad**2 - a**2
        if h2 < 0 : 
            print 'what, huh?'
            return False
        h = math.sqrt(h2)
        pt = ( other.cpt - self.cpt ) * (a/d) + self.cpt
        if h == 0 : return pt
        vec = Vec(self.cpt,pt).cross(self.pln.vec).normalized(h)
        return [pt - vec, pt + vec]
        
    def to_gh(self):
        import Rhino.Geometry as rg
        plane = rg.Plane(rg.Point3d(self.pln.origin.x,self.pln.origin.y,self.pln.origin.z),rg.Vector3d(self.pln.vec.x,self.pln.vec.y,self.pln.vec.z))
        return rg.Circle(plane,self.rad)
        
a.put(Circle)
# ---------- end decodes ----------

# ----
vec = VectorXYZ(XComponent=0, YComponent=vcomp.XComponent, ZComponent=vcomp.YComponent)  # -> Vector, Length
pt = Point(vec.Vector)
decodes_2 = DecodesPythonScript(Circle=decodes.a, rad=Slider(0.5, range=0..1), p1=pt)  # -> console, a, b
# ---------- decodes_2: Python ----------
vec = p1.cross(Vec(1,0))

c0 = Circle(Plane(Point(),vec),rad/2)
c1 = Circle(Plane(p1,vec),rad)



a.put([c0.to_gh(),c1.to_gh()])
b.put(c0.intersections(c1))
# ---------- end decodes_2 ----------
panel = Panel(decodes_2.b)
panel_2 = Panel(decodes_2.console)
