# Grasshopper definition curve folding.gh (Grasshopper 0.9.14)
# plug-ins: Decodes Python Interpreter

md_slider = MDSlider(
    slider_value=Point(0.5, 0.4963416123, 0.5),
    x_domain=Domain(0, 1),
    y_domain=Domain(0, 1),
    z_domain=Domain(0, 1),
    SliderMode=0)

# ---- group: par baked
crv_a = Curve(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)
crv_b = Curve(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)

# ---- group: meshing and flattening functions
decodes = DecodesPythonScript()  # -> console, a, b
# ---------- decodes: Python ----------
def flatten_ptstrip(pts_a,pts_b):
    fpts_a = [Point()]
    fpts_b = [Point(0,pts_a[0].distance(pts_b[0]))]
    cs_tar = CS(Point(),Vec(0,1),Vec(1,0))
    for n in range(len(pts_a)-1):
        cs_src = CS(pts_b[n],Vec(pts_b[n],pts_a[n]),Vec(pts_b[n],pts_a[n+1]))
        fpts_b.append(pts_a[n+1]*Xform.change_basis(cs_src,cs_tar))
        cs_tar = CS(fpts_b[-1],Vec(fpts_b[-1],fpts_a[-1]),Vec(1,0))
        
        cs_src = CS(pts_a[n+1],Vec(pts_a[n+1],pts_b[n]),Vec(pts_a[n+1],pts_b[n+1]))
        fpts_a.append(pts_b[n+1]*Xform.change_basis(cs_src,cs_tar))
        cs_tar = CS(fpts_a[-1],Vec(fpts_a[-1],fpts_b[-1]),Vec(1,0))
    return fpts_a , fpts_b

def mesh_from_ptstrip(pts_a,pts_b):
    msh = Mesh()
    for pt in pts_a + pts_b : msh.append(pt)
    for n in range(len(pts_b)):
        pi_0 = n
        pi_1 = n+1
        pi_2 = n+len(pts_b)+1
        pi_3 = n+len(pts_b)
        msh.add_face(pi_0,pi_3,pi_2)
        msh.add_face(pi_0,pi_2,pi_1)
    return msh
    
a.put(mesh_from_ptstrip)
b.put(flatten_ptstrip)
# ---------- end decodes ----------

# ---- group: choose any two 3-point splines
crv_b_2 = Curve(<curve referenced from the Rhino model>)
crv_a_2 = Curve(<curve referenced from the Rhino model>)

# ----
mesh_from_ptstrip_function = Data(decodes.a)
flatten_ptstrip_function = Data(decodes.b)
mesh_from_ptstrip_function_2 = Data(mesh_from_ptstrip_function)
res_u = Slider(5, range=4..20)
cluster = Cluster(num=Slider(1, range=0..1), V=md_slider, num_2=Slider(0, range=0..1), I=Slider(2.5, range=1.75..2.5))
flatten_ptstrip_function_2 = Data(flatten_ptstrip_function)
cluster_2 = Cluster_2(C=crv_a_2)
cluster_3 = Cluster_2(C=crv_b_2)
decodes_2 = DecodesPythonScript(pts_a=cluster_2, pts_b=cluster_3)  # -> console, a; inputs pts_a: list, pts_b: list
# ---------- decodes_2: Python ----------
import math

def func(u,v):
    crv_a = Curve.bezier(pts_a)
    crv_b = Curve.bezier(pts_b)
    ln = Line(crv_a.eval(u),crv_b.eval(u))
    
    return ln.eval(v)
    

a.put(func)
# ---------- end decodes_2 ----------
surface_function = Data(decodes_2.a)
surface_function_2 = Data(surface_function)

# ---- group: unfoldable mesh
decodes_3 = DecodesPythonScript(func=surface_function_2, mesh_ptstr=mesh_from_ptstrip_function_2, flat_ptstr=flatten_ptstrip_function_2, res_u=res_u)  # -> console, a, b; inputs res_u: Int32
# ---------- decodes_3: Python ----------
pts_top = []
pts_btm = []
for u in range(0,res_u+1):
    pts_top.append(func(u/res_u,1))
    pts_btm.append(func(u/res_u,0))

msh = mesh_ptstr(pts_top,pts_btm)
a.put(msh)

fpts_top, fpts_btm = flat_ptstr(pts_top,pts_btm)
fmsh = mesh_ptstr(fpts_top,fpts_btm)
b.put(fmsh)

#c.put(fpts_top)
#c.put(fpts_btm)
# ---------- end decodes_3 ----------

# ----
md_slider_2 = MDSlider(
    slider_value=Point(1, 0.6783536585, 0.5),
    x_domain=Domain(0, 1),
    y_domain=Domain(0, 1),
    z_domain=Domain(0, 1),
    SliderMode=0)
mesh = Mesh(decodes_3.a)
mesh_2 = Mesh(decodes_3.b)
cluster_4 = Cluster(num=Slider(0, range=0..1), V=md_slider_2, num_2=Slider(1, range=0..1), I=1.5)
res_u_2 = Slider(18, range=4..20)
surface_function_3 = Data(surface_function)

# ---- group: creates a circle class
decodes_4 = DecodesPythonScript()  # -> console, a
# ---------- decodes_4: Python ----------
class Circle():
    
    # TODO: this class currently assumes a circle on the xy axis
    
    def __init__(self,plane,radius):
        self.pln = plane
        self.rad = radius
        
    @property
    def cpt(self):
        return self.pln.origin
        
    def intersections(self,other):
        # TODO: this func currently assumes a circle on the xy axis
        if not self.pln.is_coplanar( other.pln ) : return False
        d = self.cpt.distance(other.cpt)
        if d == 0 : return False
        a = (self.rad**2 - other.rad**2 + d**2)/(2*d)
        h2 = self.rad**2 - a**2
        if h2 < 0 : return False
        h = math.sqrt(h2)
        p2 = ( other.cpt - self.cpt ) * (a/d) + self.cpt
        x3 = p2.x + h * (other.cpt.y - self.cpt.y) / d
        y3 = p2.y - h * (other.cpt.x - self.cpt.x) / d
        if h == 0 : return Point(x3,y3)
        x4 = p2.x - h * (other.cpt.y - self.cpt.y) / d
        y4 = p2.y + h * (other.cpt.x - self.cpt.x) / d
        return [Point(x3,y3),Point(x4,y4)]
        
    def to_gh(self):
        import Rhino.Geometry as rg
        plane = rg.Plane(rg.Point3d(self.pln.origin.x,self.pln.origin.y,self.pln.origin.z),rg.Vector3d(self.pln.vec.x,self.pln.vec.y,self.pln.vec.z))
        return rg.Circle(plane,self.rad)
        
a.put(Circle)
# ---------- end decodes_4 ----------

# ----
decodes_5 = DecodesPythonScript(Circle=decodes_4.a, func=surface_function_3, res=res_u_2)  # -> console, a, b, c; inputs res: Int32
# ---------- decodes_5: Python ----------
lines = []
for u in range(res+1):
    lines.append(Segment(func(u/res,0),func(u/res,1)))
a.put(lines)

flines = []
flines.append(Segment(Point(0,0),Point(lines[0].length,0))) # first line aligns with x-axis
for n in range(1,len(lines)):
    ln_prev = flines[-1]
    
    dspt = lines[n].spt.distance(lines[n-1].spt)
    dept = lines[n].ept.distance(lines[n-1].ept)
    diag_se = lines[n-1].spt.distance(lines[n].ept)
    diag_es = lines[n-1].ept.distance(lines[n].spt)
    
    ca = Circle(Plane(flines[-1].spt),dspt)
    cb = Circle(Plane(flines[-1].ept),diag_es)
    p0 = ca.intersections(cb)[0]
    cc = Circle(Plane(p0),lines[n].length)
    cd = Circle(Plane(flines[-1].ept),dept)
    p1 = cc.intersections(cd)[0]    
    #c.put([p0,ca.to_gh(),cb.to_gh(),p1,cc.to_gh(),cd.to_gh()])
    
    flines.append(Segment(p0,p1))
    
    
b.put(flines)
# ---------- end decodes_5 ----------
rule_lines = Line(decodes_5.a)
const = Geometry(decodes_5.c)  # disabled
flat_rule_lines = Line(decodes_5.b)  # disabled
rule_lines_2 = Line(rule_lines)
decodes_6 = DecodesPythonScript(rlines=rule_lines_2, fold_u=Slider(0.38, range=0..1), fold_ang=Slider(0.19, range=-1.57..1.57))  # -> console, a, b, c, d; inputs rlines: list
# ---------- decodes_6: Python ----------
import math

mi = len(rlines)//2
rl_mid = rlines[mi]
xf = Xform.rotation(center=rl_mid.eval(fold_u), axis=Vec(rl_mid.spt,rlines[mi-1].spt), angle=fold_ang)

cs = CS(rl_mid.eval(fold_u),rl_mid.vec,Vec(rl_mid.spt,rlines[mi+1].spt).cross(rl_mid.vec))

msh = Mesh()

for rl in rlines:
    fep = rl.ept * xf # folded end point
    dst = rl.ept.distance(fep) / 2 # distance between end point and folded end point
    ang = Vec(rl.ept,fep).angle(~rl.vec) # angle between rule line and folded line (notice vector inversion)
    h = dst / math.cos(ang) # hypotenuse by SOHCAHTOA
    fpt = rl.ept+ ~rl.vec.normalized(h) # fold point (notice vector inversion)
    
    #print fpt.distance(rl.ept) - fpt.distance(fep) # ought to be zero (or very small)
    
    b.put(rl.near(fpt)[1]) # the t-value of the fold point on the rule line
    c.put(Segment(fpt,fep))
    d.put(Segment(rl.spt,fpt))
    msh.append([rl.spt,fpt,fep])

for n in range(len(rlines)-1):
    p0 = n*3
    msh.add_face(p0,p0+1,p0+4,p0+3)
    msh.add_face(p0+1,p0+2,p0+5,p0+4)
    
a.put(msh)
# ---------- end decodes_6 ----------
line = Line(decodes_6.c)
fold_pt_t_vals = Number(decodes_6.b)
mesh_3 = Mesh(decodes_6.a)
line_2 = Line(decodes_6.d)
mesh_from_ptstrip_function_3 = Data(mesh_from_ptstrip_function)
mesh_from_ptstrip_function_4 = Data(mesh_from_ptstrip_function)
flatten_ptstrip_function_3 = Data(flatten_ptstrip_function)
flatten_ptstrip_function_4 = Data(flatten_ptstrip_function)

# ---- group: for laser cutting
fold_pt_t_vals_2 = Number(fold_pt_t_vals)  # disabled
flat_rule_lines_2 = Line(flat_rule_lines)  # disabled
end = EndPoints(Curve=flat_rule_lines_2)  # -> Start, End; disabled
eval = EvaluateCurve(Curve=flat_rule_lines_2, Parameter=fold_pt_t_vals_2)  # -> Point, Tangent, Angle; disabled

# ----
decodes_7 = DecodesPythonScript(lines=line, mesh_ptstr=mesh_from_ptstrip_function_3, flat_ptstr=flatten_ptstrip_function_3)  # -> console, a, b; inputs lines: list
# ---------- decodes_7: Python ----------
pts_top = []
pts_btm = []
for line in lines:
    pts_top.append( line.ept )
    pts_btm.append( line.spt )
    

msh = mesh_ptstr(pts_top,pts_btm)
a.put(msh)

fpts_top, fpts_btm = flat_ptstr(pts_top,pts_btm)
fmsh = mesh_ptstr(fpts_top,fpts_btm)
b.put(fmsh)
# ---------- end decodes_7 ----------
decodes_8 = DecodesPythonScript(lines=line_2, mesh_ptstr=mesh_from_ptstrip_function_4, flat_ptstr=flatten_ptstrip_function_4)  # -> console, a, b; inputs lines: list; same code as decodes_7
pline = PolyLine(Vertices=eval.Point, Closed=False)  # disabled
pline_2 = PolyLine(Vertices=end.Start, Closed=False)  # disabled
pline_3 = PolyLine(Vertices=end.End, Closed=False)  # disabled
mesh_4 = Mesh(decodes_7.a)
mesh_5 = Mesh(decodes_7.b)
mesh_6 = Mesh(decodes_8.a)
mesh_7 = Mesh(decodes_8.b)

# ==== cluster Cluster
I = ClusterInput()
V = ClusterInput()
num = ClusterInput()
num_2 = ClusterInput()
null = NullItem(Item=I)  # -> NullFlags, InvalidFlags, Description
p_n_c = PickNChoose(Pattern=null.NullFlags, Stream0=I, Stream1=0)
vcomp = Decompose(Vector=V)  # -> XComponent, YComponent, ZComponent
num_3 = Number(p_n_c)
num_4 = Number(num)
num_5 = Number(num_2)
pt = PointXYZ(XComponent=vcomp.XComponent, YComponent=num_3, ZComponent=vcomp.YComponent, System=PlaneXY(0, 0, 0))
pt_2 = PointXYZ(XComponent=num_5, YComponent=num_3, ZComponent=0, System=PlaneXY(0, 0, 0))
pt_3 = PointXYZ(XComponent=num_4, YComponent=num_3, ZComponent=1, System=PlaneXY(0, 0, 0))
pt_4 = Point([pt_2, pt, pt_3])
pt_5 = ClusterOutput(pt_4)

# ==== cluster Cluster_2
C = ClusterInput()
cp = ControlPoints(Curve=C)  # -> Points, Weights, Knots
item = ListItem(List=cp.Points, Index=[0, 1, 2], Wrap=False)
E = ClusterOutput(item)
