# Grasshopper definition best fit curves.ghx (Grasshopper 0.9.14)
# plug-ins: Decodes Python Interpreter

# A total least squares circle function
# TODO - implement arc class and return an arc
decodes = DecodesPythonScript()  # -> console, a
# ---------- decodes: Python ----------
class Circle():
    
    # TODO: this class currently assumes a circle on the xy axis
    
    def __init__(self,plane,radius):
        self.pln = plane
        self.rad = radius
        
    @property
    def cpt(self):
        return self.pln.origin
        
    def intersections(self,other):
        # TODO: this func currently assumes a circle on the xy axis
        if not self.pln.is_coplanar( other.pln ) : 
            print self.pln.near(other.pln.origin)[0].distance(other.pln.origin)
            print 'circles not coplanar'
            return False
        d = self.cpt.distance(other.cpt)
        if d == 0 : 
            print 'circles share a center point'
            return False
        a = (self.rad**2 - other.rad**2 + d**2)/(2*d)
        h2 = self.rad**2 - a**2
        if h2 < 0 : 
            print 'what, huh?'
            return False
        h = math.sqrt(h2)
        pt = ( other.cpt - self.cpt ) * (a/d) + self.cpt
        if h == 0 : return pt
        vec = Vec(self.cpt,pt).cross(self.pln.vec).normalized(h)
        return [pt - vec, pt + vec]
        
    def to_gh(self):
        import Rhino.Geometry as rg
        plane = rg.Plane(rg.Point3d(self.pln.origin.x,self.pln.origin.y,self.pln.origin.z),rg.Vector3d(self.pln.vec.x,self.pln.vec.y,self.pln.vec.z))
        return rg.Circle(plane,self.rad)
        
a.put(Circle)
# ---------- end decodes ----------
# An ordinary least squares line function
decodes_2 = DecodesPythonScript()  # -> console, a
# ---------- decodes_2: Python ----------
#Returns a best fit line defined by ordinary least squares
#TODO - implement exception eg. xsq_m == x_m*x*m


def leastSquaresLine(pts_in):
    x_m = 0
    y_m = 0
    xsq_m = 0
    xy_m = 0
    
    for pt in pts_in :
        x_m = x_m + pt.x 
        y_m = y_m + pt.y
        xsq_m = xsq_m + pt.x*pt.x
        xy_m = xy_m + pt.x*pt.y
    
    n = len(pts_in)
    x_m = x_m/n
    y_m = y_m/n
    xsq_m = xsq_m/n
    xy_m = xy_m/n
    
    if (xsq_m != x_m*x_m):
        m = (xy_m - x_m*y_m)/(xsq_m - x_m*x_m)
        y_coeff = y_m - m*x_m
        p_ls = Point(0, y_coeff)
        u_ls = Vec(1, m).normalized()
    else: print "yikes"
        
    d_min = Vec(pts_in[0]-p_ls).dot(u_ls)
    d_max = d_min
    for pt in pts_in:
        d = Vec(pt - p_ls).dot(u_ls)
        if (d > d_max): d_max = d
        elif (d < d_min): d_min = d
        
    p_start = p_ls + u_ls*d_min
    p_end = p_ls + u_ls*d_max
    
    return Segment(p_start, p_end)

a.put(leastSquaresLine)
# ---------- end decodes_2 ----------
decodes_3 = DecodesPythonScript(Circle=decodes.a)  # -> console, a
# ---------- decodes_3: Python ----------
#Returns a best fit circle using the modified least squares method
#TODO - implement exceptions eg. A*C == B*B 
#     - implement Arc as a subclass of Circle

def leastSquaresCircle(pts_in):
    x = 0
    y = 0
    x = 0
    xsq = 0
    ysq = 0
    xy = 0
    xysq = 0
    xsqy = 0
    xcube = 0
    ycube = 0
    
    for pt in pts_in :
        x = x + pt.x 
        y = y + pt.y
        xsq = xsq + pt.x*pt.x
        ysq = ysq + pt.y*pt.y
        xy = xy + pt.x*pt.y
        xysq = xysq + pt.x*pt.y*pt.y
        xsqy = xsqy + pt.x*pt.x*pt.y
        xcube = xcube + pt.x*pt.x*pt.x
        ycube = ycube + pt.y*pt.y*pt.y
       
    n = len(pts_in)

    A = n*xsq - x*x
    B = n*xy - x*y
    C = n*ysq - y*y
    D = 0.5*(n*xysq - x*ysq + n*xcube - x*xsq)
    E = 0.5*(n*xsqy - y*xsq + n*ycube - y*ysq)
    
    denom = A*C - B*B
    if (denom != 0):
        center = Point((D*C - B*E)/denom, (A*E - B*D)/denom)
    else: print "yikes"     
    rad = 0
    for pt in pts_in:
        rad = rad + pt._distance(center)        
    rad = rad/n
    circ_out = Circle(Plane(center, Vec(0,0,1)), rad)
    return circ_out.to_gh()
    
    #TODO - implement Arc as subclass of Circle and return arc
    #angle_start = 2*math.pi
    #angle_end = 0
    #for pt in pts_in:
    #    angle = math.atan2(pt.y-center.y,pt.x-center.x)
    #    if angle < angle_start: angle = angle_start
    #    if angle > angle_end: angle = angle_end
    #arc_out = rg.Arc(circ_out, Interval(angle_start, angle_end))
    #return arc_out
    
#TEST
#import math
#pts_curve = []

#n = 50
#for i in range(n):
#    pts_curve.append(Point(10*math.cos(1.2*math.pi*i/n), 4*math.sin(1.2*math.pi*i/n)))
#a.put(leastSquaresCircle(pts_curve))

a.put(leastSquaresCircle)
# ---------- end decodes_3 ----------
# A total least squares line function
decodes_4 = DecodesPythonScript()  # -> console, a
# ---------- decodes_4: Python ----------
#Returns a best fit line defined by total least squares
#TODO - implement exception eg. xy_m == x_m*y*m


import math

def leastSquaresLineTotal(pts_in):
    x_m = 0
    y_m = 0
    xsq_m = 0
    ysq_m = 0
    xy_m = 0
    
    for pt in pts_in :
        x_m = x_m + pt.x 
        y_m = y_m + pt.y
        xsq_m = xsq_m + pt.x*pt.x
        ysq_m = ysq_m + pt.y*pt.y
        xy_m = xy_m + pt.x*pt.y
    
    n = len(pts_in)
    x_m = x_m/n
    y_m = y_m/n
    xsq_m = xsq_m/n
    ysq_m = ysq_m/n
    xy_m = xy_m/n
    
    if (xy_m != x_m*y_m):
        B = 0.5*((ysq_m - y_m*y_m)-(xsq_m - x_m*x_m))/(x_m*y_m -xy_m)
        m = [-B + math.sqrt(B*B + 1), -B - math.sqrt(B*B + 1)]
        y_coeff = [y_m - m[0]*x_m, y_m - m[1]*x_m]
        p = [Point(0, y_coeff[0]), Point(0, y_coeff[1])]
        n0 = Vec(-m[0], 1).normalized()
        n1 = Vec(-m[1], 1).normalized()
        #test for the line that gives the least (not the most!) distance
        d0 = 0
        d1 = 0
        for pt in pts_in:
            d0 = d0 +  abs(Vec(pt - p[0]).dot(n0))
            d1 = d1 +  abs(Vec(pt - p[1]).dot(n1))
        if d0 < d1: i_min = 0
        else: i_min = 1
        p_ls = p[i_min]
        u_ls = Vec(1, m[i_min]).normalized()
    else: print "yikes"
        
    d_min = Vec(pts_in[0]-p_ls).dot(u_ls)
    d_max = d_min
    for pt in pts_in:
        d = Vec(pt - p_ls).dot(u_ls)
        if (d > d_max): d_max = d
        elif (d < d_min): d_min = d
        
    p_start = p_ls + u_ls*d_min
    p_end = p_ls + u_ls*d_max
    
    return Segment(p_start, p_end)


a.put(leastSquaresLineTotal)
# ---------- end decodes_4 ----------
pt = Point([<point referenced from the Rhino model> x4])
decodes_5 = DecodesPythonScript(pts=pt, bestFit=[decodes_4.a, decodes_3.a, decodes_2.a])  # -> console, a, b; inputs pts: list
# ---------- decodes_5: Python ----------
curve_in = Curve.bezier(pts)
a.put(curve_in)



pts_curve = []

n = 50
for i in range(n):
    pts_curve.append(curve_in.eval(i/n).origin)

b.put(bestFit(pts_curve))
# ---------- end decodes_5 ----------
panel = Panel([decodes_5.b, decodes_5.a])
decodes_6 = DecodesPythonScript()  # -> console, a, b; disabled
# ---------- decodes_6: Python ----------
def leastSquaresLine(pts_in):
    x_m = 0
    y_m = 0
    xsq_m = 0
    xy_m = 0
    
    for pt in pts_in :
        x_m = x_m + pt.x 
        y_m = y_m + pt.y
        xsq_m = xsq_m + pt.x*pt.x
        xy_m = xy_m + pt.x*pt.y
    
    N = len(pts_in)
    x_m = x_m/N
    y_m = y_m/N
    xsq_m = xsq_m/N
    xy_m = xy_m/N
    
    if (xsq_m != x_m*x_m):
        m = (xy_m - x_m*y_m)/(xsq_m - x_m*x_m)
        y_coeff = y_m - m*x_m
        p_ls = Point(0, y_coeff)
        u_ls = Vec(1, m).normalized()
        
    d_min = 0
    d_max = 0
    for pt in pts_in:
        d = Vec(pt - p_ls).dot(u_ls)
        if (d > d_max): d_max = d
        elif (d < d_min): d_min = d
        
    p_start = p_ls + u_ls*d_min
    p_end = p_ls + u_ls*d_max
    
    return Segment(p_start, p_end)
    

import math

pts = []

n = 50
for i in range(n):
    pts.append(Point(10*math.cos(1.4*math.pi*i/n), 4*math.sin(1.4*math.pi*i/n)))

a.put(pts)  
b.put(leastSquaresLine(pts))
# ---------- end decodes_6 ----------
