# Grasshopper definition biot-savart .ghx (Grasshopper 0.9.14)
# plug-ins: Decodes Python Interpreter

rec_w = Slider(1.84, range=1..4)
rec_h = Slider(3.34, range=1..4)
crv = Curve(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)  # disabled

# ---- group: product of lines surface
decodes = DecodesPythonScript(rec_w=rec_w, rec_h=rec_h)  # -> console, a; disabled
# ---------- decodes: Python ----------
#Function resulting from the product of lines
w = 0.5*rec_w
h = 0.5*rec_h

def func(u,v):
    x = u
    y = v
    z = 0.4*(u + 0.5*rec_w)*(u - 0.5*rec_w)*(v + 0.5*rec_h)*(v - 0.5*rec_h)
    return Point(x,y,z)
     
srf = Surface(func, Interval(-w,w), Interval(-h,h), tol_u = 0.08, tol_v = 0.08)
a.put(srf.surrogate)
# ---------- end decodes ----------

# ---- group: biot-savart surface with polygonal boundary (no trimming)
decodes_2 = DecodesPythonScript(rec_w=rec_w, rec_h=rec_h)  # -> console, a
# ---------- decodes_2: Python ----------
"""
Ouputs a nontrimmed biot-savart surface given a polygonal boundary inside the 
rectangular bounding box
"""


zero = 10e-12
w = 0.5*rec_w
h = 0.5*rec_h
rec = PLine([Point(w,h), Point(-w,h), Point(-w,-h), Point(w,-h), Point(w,h)])

#ex of a convex polygon 
#poly = PLine([Point(w,0), Point(0.5*w,h), Point(0,h), Point(-w,0), Point(-0.5*w,-h), Point(0, -h), Point(w, 0)])

#ex of a nonconvex polygon
poly = PLine([Point(0.5*w,0), Point(w, h), Point(-w, 0.5*h), Point(w, -h), Point(0.5*w, 0)])

a.put(poly)


def magnetic_field(pt_in, seg):
    vec_a = Vec(seg.spt - pt_in)
    vec_b = Vec(seg.ept - pt_in)
    mag_a = vec_a.length
    mag_b = vec_b.length
    a_cross_b = vec_a.x*vec_b.y - vec_a.y*vec_b.x
    bottom = mag_a*mag_b*(mag_a*mag_b + vec_a.dot(vec_b))
    if (bottom > zero):
        return a_cross_b*(mag_a + mag_b)/bottom
    else: return zero
   

def func(u,v):
    x = u
    y = v
    if (abs(abs(x) - w) > zero) and (abs(abs(y) - h) > zero):
        this_magnetic_field = 0
        for i in range(len(poly.pts)-1):
            seg = poly.edges[i]
            this_magnetic_field  += magnetic_field(Point(x,y), seg)
        if this_magnetic_field > zero:      
            z = 2.0/this_magnetic_field
        else: z = 0
    else: z = 0
    return Point(x,y,z)
     
     
srf = Surface(func, Interval(-w,w), Interval(-h, h), tol_u = 0.08, tol_v = 0.08)
a.put(srf.surrogate)
# ---------- end decodes_2 ----------

# ---- group: biot-savart surface with rectangular boundary
decodes_3 = DecodesPythonScript(rec_w=rec_w, rec_h=rec_h)  # -> console, a; disabled
# ---------- decodes_3: Python ----------
zero = 10e-12
w = 0.5*rec_w
h = 0.5*rec_h
rec = PLine([Point(w,h), Point(-w,h), Point(-w,-h), Point(w,-h), Point(w,h)])

def magnetic_field(pt_in, seg):
    vec_a = Vec(seg.spt - pt_in)
    vec_b = Vec(seg.ept - pt_in)
    mag_a = vec_a.length
    mag_b = vec_b.length
    a_cross_b = vec_a.x*vec_b.y - vec_a.y*vec_b.x
    bottom = mag_a*mag_b*(mag_a*mag_b + vec_a.dot(vec_b))
    if (bottom > zero):
        return a_cross_b*(mag_a + mag_b)/bottom
    else: return zero
   

def func(u,v):
    x = u
    y = v
    if (abs(abs(x) - w) > zero) and (abs(abs(y) - h) > zero):
        this_magnetic_field = 0
        for i in range(len(rec.pts)-1):
            seg = rec.edges[i]
            this_magnetic_field  += magnetic_field(Point(x,y), seg)
        z = 2.0/this_magnetic_field
    else: z = 0
    return Point(x,y,z)
     
     
srf = Surface(func, Interval(-w,w), Interval(-h, h), tol_u = 0.08, tol_v = 0.08)
a.put(srf.surrogate)
# ---------- end decodes_3 ----------

# ----
decodes_4 = DecodesPythonScript(shape=crv)  # -> console, a; disabled
# ---------- decodes_4: Python ----------
def is_convex(polygon, index):
    # detects convex points for clockwise curves
    # detects concave points for counter-clockwise curves
    ln_a = polygon.edges[n-1]
    ln_b = polygon.edges[n]
    cross = ln_b.vec.cross(ln_a.vec.inverted())
    return cross.z > 0

print shape.pts
for n in range(0,len(shape.pts)):
    if is_convex(shape,n) : a.put(shape.pts[n])
# ---------- end decodes_4 ----------
