# Grasshopper definition blobby curve.ghx (Grasshopper 0.9.14)
# plug-ins: Decodes Python Interpreter

# Blob-shaped curve family.  All curves corresponding to fixed rad  have the same area.
slider = Slider(0.12, range=0..1)
decodes = DecodesPythonScript(rad=slider, alpha=Slider(0, range=0..1))  # -> console, a
# ---------- decodes: Python ----------
import math

def blob(t):
    c = math.cos(2*math.pi*t)
    s = math.sin(2*math.pi*t)
    c_theta = math.cos(2*math.pi*alpha)
    s_theta = math.sin(2*math.pi*alpha)
    factor = 1.0/math.sqrt(2)
    r = 50*(1 + rad*factor*c_theta*math.cos(4*math.pi*t) + rad*factor*s_theta*math.cos(6*math.pi*t))
    pt_out = Point(r*c, r*s)
    return pt_out
     

crv_out = Curve(blob ,Interval(0,1), 0.01)
a.put(crv_out)
# ---------- end decodes ----------
