# Grasshopper definition curve decomposition.ghx (Grasshopper 0.9.14)
# plug-ins: Decodes Python Interpreter

# A total least squares circle function
# TODO - implement arc class and return an arc
decodes = DecodesPythonScript()  # -> console, a; disabled
# ---------- decodes: Python ----------
class Circle():
    
    # TODO: this class currently assumes a circle on the xy axis
    
    def __init__(self,plane,radius):
        self.pln = plane
        self.rad = radius
        
    @property
    def cpt(self):
        return self.pln.origin
        
    def intersections(self,other):
        # TODO: this func currently assumes a circle on the xy axis
        if not self.pln.is_coplanar( other.pln ) : 
            print self.pln.near(other.pln.origin)[0].distance(other.pln.origin)
            print 'circles not coplanar'
            return False
        d = self.cpt.distance(other.cpt)
        if d == 0 : 
            print 'circles share a center point'
            return False
        a = (self.rad**2 - other.rad**2 + d**2)/(2*d)
        h2 = self.rad**2 - a**2
        if h2 < 0 : 
            print 'what, huh?'
            return False
        h = math.sqrt(h2)
        pt = ( other.cpt - self.cpt ) * (a/d) + self.cpt
        if h == 0 : return pt
        vec = Vec(self.cpt,pt).cross(self.pln.vec).normalized(h)
        return [pt - vec, pt + vec]
        
    def to_gh(self):
        import Rhino.Geometry as rg
        plane = rg.Plane(rg.Point3d(self.pln.origin.x,self.pln.origin.y,self.pln.origin.z),rg.Vector3d(self.pln.vec.x,self.pln.vec.y,self.pln.vec.z))
        return rg.Circle(plane,self.rad)
        
a.put(Circle)
# ---------- end decodes ----------
# Decomposition of a Bezier curve into lines
slider = Slider(0.699, range=0.1..1)
# An ordinary least squares line function
decodes_2 = DecodesPythonScript()  # -> console, a; disabled
# ---------- decodes_2: Python ----------
#Returns a best fit line defined by ordinary least squares
#TODO - implement exception eg. xsq_m == x_m*x*m


def leastSquaresLine(pts_in):
    x_m = 0
    y_m = 0
    xsq_m = 0
    xy_m = 0
    
    for pt in pts_in :
        x_m = x_m + pt.x 
        y_m = y_m + pt.y
        xsq_m = xsq_m + pt.x*pt.x
        xy_m = xy_m + pt.x*pt.y
    
    n = len(pts_in)
    x_m = x_m/n
    y_m = y_m/n
    xsq_m = xsq_m/n
    xy_m = xy_m/n
    
    if (xsq_m != x_m*x_m):
        m = (xy_m - x_m*y_m)/(xsq_m - x_m*x_m)
        y_coeff = y_m - m*x_m
        p_ls = Point(0, y_coeff)
        u_ls = Vec(1, m).normalized()
    else: print "yikes"
        
    d_min = Vec(pts_in[0]-p_ls).dot(u_ls)
    d_max = d_min
    for pt in pts_in:
        d = Vec(pt - p_ls).dot(u_ls)
        if (d > d_max): d_max = d
        elif (d < d_min): d_min = d
        
    p_start = p_ls + u_ls*d_min
    p_end = p_ls + u_ls*d_max
    
    return Segment(p_start, p_end)

a.put(leastSquaresLine)
# ---------- end decodes_2 ----------
decodes_3 = DecodesPythonScript(Circle=decodes.a)  # -> console, a; disabled
# ---------- decodes_3: Python ----------
#Returns a best fit circle using the modified least squares method
#TODO - implement exceptions eg. A*C == B*B 
#     - implement Arc as a subclass of Circle

def leastSquaresCircle(pts_in):
    x = 0
    y = 0
    x = 0
    xsq = 0
    ysq = 0
    xy = 0
    xysq = 0
    xsqy = 0
    xcube = 0
    ycube = 0
    
    for pt in pts_in :
        x = x + pt.x 
        y = y + pt.y
        xsq = xsq + pt.x*pt.x
        ysq = ysq + pt.y*pt.y
        xy = xy + pt.x*pt.y
        xysq = xysq + pt.x*pt.y*pt.y
        xsqy = xsqy + pt.x*pt.x*pt.y
        xcube = xcube + pt.x*pt.x*pt.x
        ycube = ycube + pt.y*pt.y*pt.y
       
    n = len(pts_in)

    A = n*xsq - x*x
    B = n*xy - x*y
    C = n*ysq - y*y
    D = 0.5*(n*xysq - x*ysq + n*xcube - x*xsq)
    E = 0.5*(n*xsqy - y*xsq + n*ycube - y*ysq)
    
    denom = A*C - B*B
    if (denom != 0):
        center = Point((D*C - B*E)/denom, (A*E - B*D)/denom)
    else: print "yikes"     
    rad = 0
    for pt in pts_in:
        rad = rad + pt._distance(center)        
    rad = rad/n
    circ_out = Circle(Plane(center, Vec(0,0,1)), rad)
    return circ_out.to_gh()
    
    #TODO - implement Arc as subclass of Circle and return arc
    #angle_start = 2*math.pi
    #angle_end = 0
    #for pt in pts_in:
    #    angle = math.atan2(pt.y-center.y,pt.x-center.x)
    #    if angle < angle_start: angle = angle_start
    #    if angle > angle_end: angle = angle_end
    #arc_out = rg.Arc(circ_out, Interval(angle_start, angle_end))
    #return arc_out
    
#TEST
#import math
#pts_curve = []

#n = 50
#for i in range(n):
#    pts_curve.append(Point(10*math.cos(1.2*math.pi*i/n), 4*math.sin(1.2*math.pi*i/n)))
#a.put(leastSquaresCircle(pts_curve))

a.put(leastSquaresCircle)
# ---------- end decodes_3 ----------
# A total least squares line function
decodes_4 = DecodesPythonScript()  # -> console, a; disabled
# ---------- decodes_4: Python ----------
#Returns a best fit line defined by total least squares
#TODO - implement exception eg. xy_m == x_m*y*m


import math

def leastSquaresLineTotal(pts_in):
    x_m = 0
    y_m = 0
    xsq_m = 0
    ysq_m = 0
    xy_m = 0
    
    for pt in pts_in :
        x_m = x_m + pt.x 
        y_m = y_m + pt.y
        xsq_m = xsq_m + pt.x*pt.x
        ysq_m = ysq_m + pt.y*pt.y
        xy_m = xy_m + pt.x*pt.y
    
    n = len(pts_in)
    x_m = x_m/n
    y_m = y_m/n
    xsq_m = xsq_m/n
    ysq_m = ysq_m/n
    xy_m = xy_m/n
    
    if (xy_m != x_m*y_m):
        B = 0.5*((ysq_m - y_m*y_m)-(xsq_m - x_m*x_m))/(x_m*y_m -xy_m)
        m = [-B + math.sqrt(B*B + 1), -B - math.sqrt(B*B + 1)]
        y_coeff = [y_m - m[0]*x_m, y_m - m[1]*x_m]
        p = [Point(0, y_coeff[0]), Point(0, y_coeff[1])]
        n0 = Vec(-m[0], 1).normalized()
        n1 = Vec(-m[1], 1).normalized()
        #test for the line that gives the least (not the most!) distance
        d0 = 0
        d1 = 0
        for pt in pts_in:
            d0 = d0 +  abs(Vec(pt - p[0]).dot(n0))
            d1 = d1 +  abs(Vec(pt - p[1]).dot(n1))
        if d0 < d1: i_min = 0
        else: i_min = 1
        p_ls = p[i_min]
        u_ls = Vec(1, m[i_min]).normalized()
    else: print "yikes"
        
    d_min = Vec(pts_in[0]-p_ls).dot(u_ls)
    d_max = d_min
    for pt in pts_in:
        d = Vec(pt - p_ls).dot(u_ls)
        if (d > d_max): d_max = d
        elif (d < d_min): d_min = d
        
    p_start = p_ls + u_ls*d_min
    p_end = p_ls + u_ls*d_max
    
    return Segment(p_start, p_end)


a.put(leastSquaresLineTotal)
# ---------- end decodes_4 ----------
pt = Point([<point referenced from the Rhino model> x7])
decodes_5 = DecodesPythonScript(pts=pt, threshold=slider)  # -> console, a, b; inputs pts: list
# ---------- decodes_5: Python ----------
def furthestFromLeastSquaresLine(pts_in):
    x_m = 0
    y_m = 0
    xsq_m = 0
    xy_m = 0
    
    for pt in pts_in :
        x_m = x_m + pt.x 
        y_m = y_m + pt.y
        xsq_m = xsq_m + pt.x*pt.x
        xy_m = xy_m + pt.x*pt.y
    
    n = len(pts_in)
    x_m = x_m/n
    y_m = y_m/n
    xsq_m = xsq_m/n
    xy_m = xy_m/n
    
    if (xsq_m != x_m*x_m):
        m = (xy_m - x_m*y_m)/(xsq_m - x_m*x_m)
        y_coeff = y_m - m*x_m
        p_ls = Point(0, y_coeff)
        n_ls = Vec(-m, 1).normalized()
    else:
        p_ls = Point(x_m, 0)
        n_ls = Vec(1,0)
        
    d_max = 0
    i_max = 0
    for i in range(n):
        d = abs(Vec(pts_in[i] - p_ls).dot(n_ls))
        if (d > d_max):
            d_max = d
            i_max = i
    return [i_max, d_max]


def furthestFromLeastSquaresLineTotal(pts_in):
    x_m = 0
    y_m = 0
    xsq_m = 0
    ysq_m = 0
    xy_m = 0
    
    for pt in pts_in :
        x_m = x_m + pt.x 
        y_m = y_m + pt.y
        xsq_m = xsq_m + pt.x*pt.x
        ysq_m = ysq_m + pt.y*pt.y
        xy_m = xy_m + pt.x*pt.y
    
    n = len(pts_in)
    x_m = x_m/n
    y_m = y_m/n
    xsq_m = xsq_m/n
    ysq_m = ysq_m/n
    xy_m = xy_m/n
    
    if (xy_m != x_m*y_m):
        B = 0.5*((ysq_m - y_m*y_m)-(xsq_m - x_m*x_m))/(x_m*y_m -xy_m)
        m = [-B + math.sqrt(B*B + 1), -B - math.sqrt(B*B + 1)]
        y_coeff = [y_m - m[0]*x_m, y_m - m[1]*x_m]
        p = [Point(0, y_coeff[0]), Point(0, y_coeff[1])]
        n0 = Vec(-m[0], 1).normalized()
        n1 = Vec(-m[1], 1).normalized()
        #test for the line that gives the least (not the most!) distance
        d0 = 0
        d1 = 0
        for pt in pts_in:
            d0 = d0 +  abs(Vec(pt - p[0]).dot(n0))
            d1 = d1 +  abs(Vec(pt - p[1]).dot(n1))
        if d0 < d1:
            p_ls  = p[0]
            n_ls = n0
        else:
            p_ls = p[1]
            n_ls = n1
    else:
        p_ls = Point(x_m, 0)
        n_ls = Vec(1,0)
        
    d_max = 0
    i_max = 0
    for i in range(n):
        d = abs(Vec(pts_in[i] - p_ls).dot(n_ls))
        if (d > d_max):
            d_max = d
            i_max = i
    return [i_max, d_max]

      
def decomposeCurve(pts_in, i_left, indices):
    [i_star, dist] = furthestFromLeastSquaresLineTotal(pts_in)
    indices.append(i_left + i_star)
    if (dist > threshold):
        if (i_star != 0):
            decomposeCurve(pts_in[:i_star], i_left, indices)
        if (i_star != len(pts_in)-1):
            decomposeCurve(pts_in[i_star+1:], i_left+i_star+1, indices)


curve_in = Curve.bezier(pts)
a.put(curve_in)

pts_curve = []
n = 50
pts_curve = [curve_in.eval(i/n).origin for i in range(n+1)]

i_keep = []
decomposeCurve(pts_curve, 0, i_keep)
print len(i_keep)," indices to keep:", sorted(i_keep)
pts_keep = [curve_in.eval(i/n).origin for i in sorted(i_keep)]
b.put(PLine(pts_keep))
# ---------- end decodes_5 ----------
range = Range(Domain=Domain(0, 6.283185307), Steps=3)
sin = Sine(Value=range)
pt_2 = PointXYZ(XComponent=range, YComponent=sin, ZComponent=0, System=PlaneXY(0, 0, 0))
panel = Panel([decodes_5.b, decodes_5.a])
decodes_6 = DecodesPythonScript(points=pt_2, threshold=Slider(0.137, range=0..0.2), step_size=Slider(0.05, range=0.05..0.5))  # -> console, a, b, c; inputs points: list
# ---------- decodes_6: Python ----------
"""
Decomposes a curve into a PLine
IN: List of Points to create a bezier curve
    Step size for the T values
    Distance threshold for the points
OUT: Curve
     [Point]
     PLine
"""
curve = Curve.bezier(points)
divs_t = [0.0]
delta_t = step_size

while divs_t[-1] <= curve.domain.b:
    t0 = divs_t[-1]
    t1 = t0 + delta_t
    if t1 >= curve.domain.b :
        divs_t.append(curve.domain.b)
        break
    subcrv = curve.subcurve(Interval(t0,t1))
    pt = Segment(curve.eval(t0),curve.eval(t1)).midpoint
    dist = pt.distance(subcrv.near_pt(pt).origin)
    if dist >= threshold:
        divs_t.append(t1)
        delta_t = step_size
    else:
        delta_t = delta_t + step_size

div_pts = [curve.eval(t).origin for t in divs_t]

a.put(curve)
b.put(PLine(div_pts))
c.put(div_pts)
# ---------- end decodes_6 ----------
