# Grasshopper definition curves.gh (Grasshopper 0.9.14)
# plug-ins: Decodes Python Interpreter

# Curve morphing from a diamond to an astroid
# Generalization of Releaux for any triangle
panel = Panel("Releaux Triangle")

# ---- group: bezier through many points
pts = Point([Point(-0.9610811336, -2.074298095, 0), Point(-0.2385807026, -1.387942156, 0), Point(0.5472529461, -1.908522516, 0), Point(1.350597514, -1.351687855, 0), Point(2.074259354, -2.122590892, 0)])
decodes = DecodesPythonScript(pts=pts, t=Slider(0.5287, range=0..1))  # -> console, a, b; inputs pts: list
# ---------- decodes: Python ----------
crv = Curve.bezier(pts)
a.put(crv)
b.put(crv.eval(t))
# ---------- end decodes ----------
pt = Point(decodes.b)

# ----
# Moves a point along a diagonal and prints out coordinates
# Moves point along diagonal using Decodes
slider = Slider(10, range=0..10)  # disabled
# Moves point along a function y = f(x)
slider_2 = Slider(6.942, range=0..10)  # disabled
# Moves point along a curve defined by (x(t), y(t), z(t))
slider_3 = Slider(10, range=0..10)  # disabled
slider_4 = Slider(0.745, range=0..1)  # disabled
# Planar curves, some by explicit parameterization and some by geometric construction.  Always defined as a function parametrized with interval [0,1].
# Boundary of a rectangle with height h and width w
slider_5 = Slider(6.647, range=1..10)
# Bezier curve defined by corners of the rectangle above - SLOW
slider_6 = Slider(8.26, range=1..10)
slider_7 = Slider(6.016, range=1..10)
slider_8 = Slider(6.451, range=1..10)
# Diamond curve with lengths from center to vertices len_x, len_y
slider_9 = Slider(5.368, range=1..10)
# Spatial curves, defined as a function parametrized with interval [0,1].
# Helices with radius rad, height h, number of turns n
slider_10 = Slider(8.56, range=1..10)
decodes_2 = DecodesPythonScript(rec_w=slider_5, rec_h=slider_6)  # -> console, a
# ---------- decodes_2: Python ----------
def func(t):
    if (t>=0) and (t<0.25): 
        ln = Line( Point(-rec_w/2,-rec_h/2), Point(rec_w/2,-rec_h/2) )
        pt_out = ln.eval(t*4.0)
    elif (t>=0.25) and (t<0.5): 
        ln = Line( Point(rec_w/2,-rec_h/2), Point(rec_w/2,rec_h/2) )
        pt_out = ln.eval((t-0.25)*4.0)
    elif (t>=0.5) and (t<0.75): 
        ln = Line( Point(rec_w/2,rec_h/2), Point(-rec_w/2,rec_h/2) )
        pt_out = ln.eval((t-0.5)*4.0)
    elif (t>=0.75) and (t<=1.0): 
        ln = Line( Point(-rec_w/2,rec_h/2), Point(-rec_w/2,-rec_h/2) )
        pt_out = ln.eval((t-0.75)*4.0)
    else: print "wtf?"
      
    return pt_out
    

a.put(func)
# ---------- end decodes_2 ----------
decodes_3 = DecodesPythonScript(rec_w=slider_5, rec_h=slider_6)  # -> console, a
# ---------- decodes_3: Python ----------
import math

#pt_1 = Point(-rec_w/2,-rec_h/2)
#pt_2 = Point(rec_w/2,-rec_h/2)
#pt_3 = Point(rec_w/2,rec_h/2)
#pt_4 = Point(-rec_w/2, rec_h/2)

#crv = Curve.bezier([pt_1, pt_2, pt_3, pt_4])
#a.put(crv)


def func(t):
    pt_1 = Point(-rec_w/2,-rec_h/2)
    pt_2 = Point(rec_w/2,-rec_h/2)
    pt_3 = Point(rec_w/2,rec_h/2)
    pt_4 = Point(-rec_w/2, rec_h/2)
   
    crv = Curve.bezier([pt_1, pt_2, pt_3, pt_4, pt_1])
    pt_out = crv.eval(t).origin
    return pt_out
    

a.put(func)
# ---------- end decodes_3 ----------
pt_2 = PointXYZ(XComponent=slider, YComponent=slider, ZComponent=slider, System=PlaneXY(0, 0, 0))  # disabled
decodes_4 = DecodesPythonScript(len_x=slider_9, len_y=slider_8)  # -> console, a
# ---------- decodes_4: Python ----------
import math

def func(t):
    c = math.cos(2*math.pi*t)
    s = math.sin(2*math.pi*t)
    pt_out = Point(len_x*abs(c)*c, len_y*abs(s)*s)
    return pt_out
     

a.put(func)
# ---------- end decodes_4 ----------
decodes_5 = DecodesPythonScript(rad=slider_7)  # -> console, a
# ---------- decodes_5: Python ----------
import math


def func(t):
    onethird = 1/3.0
    if (t >= 0) and (t < onethird):
        pt_out = Point(rad*math.cos(math.pi*t) - 0.5*rad, rad*math.sin(math.pi*t)-0.5*rad/math.sqrt(3))
    elif (t >= onethird) and (t < 2*onethird):
        #pt_base = Point(rad*math.cos(math.pi*(t-onethird)) - 0.5*rad, rad*math.sin(math.pi*(t-onethird))-0.5*rad/math.sqrt(3))
        #mRot = Xform.rotation(angle = math.pi*onethird, axis = Vec(0,0,1))
        #print "rotated point = ", pt_base*mRot
        pt_out = Point(rad*math.cos(math.pi*(t+onethird))+0.5*rad, rad*math.sin(math.pi*(t+onethird))-0.5*rad/math.sqrt(3))
    elif (t >= 2*onethird) and (t <=1):
        #pt_base = Point(rad*math.cos(math.pi*(t-2*onethird)) - 0.5*rad, rad*math.sin(math.pi*(t-2*onethird))-0.5*rad/math.sqrt(3))
        #mRot = Xform.rotation(angle = 2*math.pi*onethird, axis = Vec(0,0,1)) 
        pt_out = Point(rad*math.cos(math.pi*(t+2*onethird)), rad*math.sin(math.pi*(t+2*onethird)) + rad/math.sqrt(3))
    else: print "yikes"
    
    return pt_out


a.put(func)
#Test
#count = 50
#pts = []
#for i in range(count+1):
#    pt = func(i/count)
#    print pt
#    pts.append(pt)    
#poly = PLine(pts)
#a.put(poly)
# ---------- end decodes_5 ----------
decodes_6 = DecodesPythonScript(rad=slider_7)  # -> console, verts
# ---------- decodes_6: Python ----------
import math

factor = 1/math.sqrt(3)
p1 = Point(0, rad*factor)
p2 = Point(-rad/2, -rad*0.5*factor)
p3 = Point(rad/2, -rad*0.5*factor)
verts.put([p1,p2,p3])
# ---------- end decodes_6 ----------
decodes_7 = DecodesPythonScript(x=slider_3)  # -> console, a; disabled
# ---------- decodes_7: Python ----------
import math


pt_out = Point(x,2*math.sin(2*math.pi*x))

a.put(pt_out)
# ---------- end decodes_7 ----------
decodes_8 = DecodesPythonScript(len_x=slider_9, len_y=slider_8, m=Slider(1, range=0..1))  # -> console, a
# ---------- decodes_8: Python ----------
import math

def func(t):
    c = math.cos(2*math.pi*t)
    s = math.sin(2*math.pi*t)
    interp_c = (1-m)*abs(c) + m*c*c
    interp_s = (1-m)*abs(s) + m*s*s
    pt_out = Point(len_x*interp_c*c, len_y*interp_s*s)
    return pt_out
     

a.put(func)
# ---------- end decodes_8 ----------
decodes_9 = DecodesPythonScript(x=slider_2)  # -> console, a; disabled
# ---------- decodes_9: Python ----------
pt_out = Point(x,x,x)

a.put(pt_out)
# ---------- end decodes_9 ----------
decodes_10 = DecodesPythonScript(t=slider_4)  # -> console, a; disabled
# ---------- decodes_10: Python ----------
import math

pt_out = Point(2*math.cos(2*math.pi*t),4*math.sin(2*math.pi*t), 6*t)

a.put(pt_out)
# ---------- end decodes_10 ----------
decodes_11 = DecodesPythonScript(rad=slider_10, h=Slider(20, range=1..20), n=Slider(10, range=1..10))  # -> console, a
# ---------- decodes_11: Python ----------
import math

def func(t):
    #Cylindrical Helix
    #pt_out = Point(rad*math.cos(2*n*math.pi*t), rad*math.sin(2*n*math.pi*t), h*t)  
    
    #Conical Helix
    #pt_out = Point(rad*t*math.cos(2*n*math.pi*t), rad*t*math.sin(2*n*math.pi*t), h*t)  

    #More General Helix
    pt_out = Point(rad*math.log(math.sqrt(t*t+1))*math.cos(2*n*math.pi*t), rad*math.log(math.sqrt(t*t+1))*math.sin(2*n*math.pi*t), h-h*t)
    
    return pt_out
     

a.put(func)
# ---------- end decodes_11 ----------
decodes_12 = DecodesPythonScript(pt_in=pt_2)  # -> console, a; disabled
# ---------- decodes_12: Python ----------
print "Point at (" + str(pt_in.x)+"," + str(pt_in.y) + "," + str(pt_in.y) + ")"
# ---------- end decodes_12 ----------
panel_2 = Panel("t")
panel_3 = Panel(decodes_12.console)  # disabled
decodes_13 = DecodesPythonScript(t=Slider(1, range=0..1), func_in=decodes_5.a)  # -> console, a, b, c, d
# ---------- decodes_13: Python ----------
#moves a point along the curve
pt_out = func_in(t)
a.put(pt_out)

#draws the part of the curve in the interval [0,t] with tolerance determined by fixed N
#! Will have an error with t = 0
#! Quirky behavior when N is too low
N = 50
crv_out = Curve(func_in,Interval(0,t), t/N)
b.put(crv_out)

# draws a line segment determined by point on the curve and a fixed vector
vec_a = Vec(0,0,10)
pt_out = func_in(t)
ln_out = Segment(pt_out,vec_a)
c.put(ln_out)

# approximates the part of the curve in the interval [0,t] by a polyline 
poly_out = crv_out._to_pline()
d.put(poly_out)
# ---------- end decodes_13 ----------
