# Grasshopper definition curves.ghx (Grasshopper 0.9.14)
# plug-ins: Decodes Python Interpreter

# ---- group: bezier through many points
slider = Slider(0.5287, range=0..1)  # disabled
pts = Point([Point(-0.9610811336, -2.074298095, 0), Point(-0.2385807026, -1.387942156, 0), Point(0.5472529461, -1.908522516, 0), Point(1.350597514, -1.351687855, 0), Point(2.074259354, -2.122590892, 0)])  # disabled
decodes = DecodesPythonScript(pts=pts, t=slider)  # -> console, a, b; inputs pts: list; disabled
# ---------- decodes: Python ----------
crv = Curve.bezier(pts)
a.put(crv)
b.put(crv.eval(t))
# ---------- end decodes ----------
pt = Point(decodes.b)  # disabled

# ----
# Curve morphing from a diamond to an astroid
# TODO - Generalization of Releaux for any triangle
panel = Panel("Releaux Triangle")
# Moves a point along a diagonal and prints out coordinates
# Moves point along diagonal using Decodes
slider_2 = Slider(10, range=0..10)  # disabled
# Moves point along a function y = f(x)
slider_3 = Slider(6.942, range=0..10)  # disabled
# Moves point along a curve defined by (x(t), y(t), z(t))
slider_4 = Slider(10, range=0..10)  # disabled
# Planar curves, some by explicit parameterization and some by geometric construction.  Always defined as a function parametrized with interval [0,1].
slider_5 = Slider(0.745, range=0..1)  # disabled
# Boundary of a rectangle with height h and width w
slider_6 = Slider(6.647, range=1..10)
# Bezier curve defined by corners of the rectangle above - SLOW
slider_7 = Slider(8.26, range=1..10)
# Wavy function with k oscillations
slider_8 = Slider(5, range=1..10)
slider_9 = Slider(9.82, range=1..10)
# Spatial curves, defined as a function parametrized with interval [0,1].
# Helices with radius rad, height h, number of turns n
slider_10 = Slider(10, range=1..10)
slider_11 = Slider(6.451, range=1..10)
# Diamond curve with lengths from center to vertices len_x, len_y
slider_12 = Slider(5.368, range=1..10)
pt_2 = PointXYZ(XComponent=slider_2, YComponent=slider_2, ZComponent=slider_2, System=PlaneXY(0, 0, 0))  # disabled
decodes_2 = DecodesPythonScript(rec_w=slider_6, rec_h=slider_7)  # -> console, a
# ---------- decodes_2: Python ----------
def func(t):
    if (t>=0) and (t<0.25): 
        ln = Line( Point(-rec_w/2,-rec_h/2), Point(rec_w/2,-rec_h/2) )
        pt_out = ln.eval(t*4.0)
    elif (t>=0.25) and (t<0.5): 
        ln = Line( Point(rec_w/2,-rec_h/2), Point(rec_w/2,rec_h/2) )
        pt_out = ln.eval((t-0.25)*4.0)
    elif (t>=0.5) and (t<0.75): 
        ln = Line( Point(rec_w/2,rec_h/2), Point(-rec_w/2,rec_h/2) )
        pt_out = ln.eval((t-0.5)*4.0)
    elif (t>=0.75) and (t<=1.0): 
        ln = Line( Point(-rec_w/2,rec_h/2), Point(-rec_w/2,-rec_h/2) )
        pt_out = ln.eval((t-0.75)*4.0)
    else: print "wtf?"
      
    return pt_out
    

a.put(func)
# ---------- end decodes_2 ----------
decodes_3 = DecodesPythonScript(rec_w=slider_6, rec_h=slider_7)  # -> console, a
# ---------- decodes_3: Python ----------
import math

#pt_1 = Point(-rec_w/2,-rec_h/2)
#pt_2 = Point(rec_w/2,-rec_h/2)
#pt_3 = Point(rec_w/2,rec_h/2)
#pt_4 = Point(-rec_w/2, rec_h/2)

#crv = Curve.bezier([pt_1, pt_2, pt_3, pt_4])
#a.put(crv)


def func(t):
    pt_1 = Point(-rec_w/2,-rec_h/2)
    pt_2 = Point(rec_w/2,-rec_h/2)
    pt_3 = Point(rec_w/2,rec_h/2)
    pt_4 = Point(-rec_w/2, rec_h/2)
   
    crv = Curve.bezier([pt_1, pt_2, pt_3, pt_4, pt_1])
    pt_out = crv.eval(t).origin
    return pt_out
    

a.put(func)
# ---------- end decodes_3 ----------
decodes_4 = DecodesPythonScript(x=slider_4)  # -> console, a; disabled
# ---------- decodes_4: Python ----------
import math


pt_out = Point(x,2*math.sin(2*math.pi*x))

a.put(pt_out)
# ---------- end decodes_4 ----------
decodes_5 = DecodesPythonScript(k=slider_8)  # -> console, a
# ---------- decodes_5: Python ----------
import math

def func(t):
    pt_out = Point(2*math.pi*k*t,math.exp(t)*math.sin(2*math.pi*k*t))
    return pt_out
    
    
a.put(func)
# ---------- end decodes_5 ----------
decodes_6 = DecodesPythonScript(x=slider_3)  # -> console, a; disabled
# ---------- decodes_6: Python ----------
pt_out = Point(x,x,x)

a.put(pt_out)
# ---------- end decodes_6 ----------
decodes_7 = DecodesPythonScript(t=slider_5)  # -> console, a; disabled
# ---------- decodes_7: Python ----------
import math

pt_out = Point(2*math.cos(2*math.pi*t),4*math.sin(2*math.pi*t), 6*t)

a.put(pt_out)
# ---------- end decodes_7 ----------
decodes_8 = DecodesPythonScript(len_x=slider_12, len_y=slider_11)  # -> console, a
# ---------- decodes_8: Python ----------
import math

def func(t):
    c = math.cos(2*math.pi*t)
    s = math.sin(2*math.pi*t)
    pt_out = Point(len_x*abs(c)*c, len_y*abs(s)*s)
    return pt_out
     

a.put(func)
# ---------- end decodes_8 ----------
decodes_9 = DecodesPythonScript(rad=slider_9)  # -> console, a
# ---------- decodes_9: Python ----------
import math

#Releaux Triangle 
#vertices at p1, p2, p3 as follows:
#factor = 1/math.sqrt(3)
#p1 = Point(0, rad*factor)
#p2 = Point(-rad/2, -rad*0.5*factor)
#p3 = Point(rad/2, -rad*0.5*factor)
#arc1 - center at p2, t in [0, pi/3]
#arc2 - center at p3, t in [2*pi/3, pi/2] 
#arc3 - center at p1, t in [4*pi/3, 5*pi/3]



def func(t):
    onethird = 1/3.0
    if (t >= 0) and (t < onethird):
        pt_out = Point(rad*math.cos(math.pi*t) - 0.5*rad, rad*math.sin(math.pi*t)-0.5*rad/math.sqrt(3))
    elif (t >= onethird) and (t < 2*onethird):
         pt_out = Point(rad*math.cos(math.pi*(t+onethird))+0.5*rad, rad*math.sin(math.pi*(t+onethird))-0.5*rad/math.sqrt(3))
    elif (t >= 2*onethird) and (t <=1):
         pt_out = Point(rad*math.cos(math.pi*(t+2*onethird)), rad*math.sin(math.pi*(t+2*onethird)) + rad/math.sqrt(3))
    else: print "yikes"
    
    return pt_out


a.put(func)
#Test
#count = 50
#pts = []
#for i in range(count+1):
#    pt = func(i/count)
#    print pt
#    pts.append(pt)    
#poly = PLine(pts)
#a.put(poly)
# ---------- end decodes_9 ----------
decodes_10 = DecodesPythonScript(rad=slider_9)  # -> console, verts; disabled
# ---------- decodes_10: Python ----------
import math

factor = 1/math.sqrt(3)
p1 = Point(0, rad*factor)
p2 = Point(-rad/2, -rad*0.5*factor)
p3 = Point(rad/2, -rad*0.5*factor)
verts.put([p1,p2,p3])
# ---------- end decodes_10 ----------
decodes_11 = DecodesPythonScript(rad=slider_10, h=Slider(20, range=1..20), n=Slider(10, range=1..10))  # -> console, a
# ---------- decodes_11: Python ----------
import math

def func(t):
    #Cylindrical Helix
    #pt_out = Point(rad*math.cos(2*n*math.pi*t), rad*math.sin(2*n*math.pi*t), h*t)  
    
    #Conical Helix
    #pt_out = Point(rad*t*math.cos(2*n*math.pi*t), rad*t*math.sin(2*n*math.pi*t), h*t)  

    #More General Helix
    pt_out = Point(rad*math.log(math.sqrt(t*t+1))*math.cos(2*n*math.pi*t), rad*math.log(math.sqrt(t*t+1))*math.sin(2*n*math.pi*t), h-h*t)
    
    return pt_out
     

a.put(func)
# ---------- end decodes_11 ----------
decodes_12 = DecodesPythonScript(len_x=slider_12, len_y=slider_11, m=Slider(0.898, range=0..1))  # -> console, a
# ---------- decodes_12: Python ----------
import math

def func(t):
    c = math.cos(2*math.pi*t)
    s = math.sin(2*math.pi*t)
    interp_c = (1-m)*abs(c) + m*c*c
    interp_s = (1-m)*abs(s) + m*s*s
    pt_out = Point(len_x*interp_c*c, len_y*interp_s*s)
    return pt_out
     

a.put(func)
# ---------- end decodes_12 ----------
decodes_13 = DecodesPythonScript(pt_in=pt_2)  # -> console, a; disabled
# ---------- decodes_13: Python ----------
print "Point at (" + str(pt_in.x)+"," + str(pt_in.y) + "," + str(pt_in.y) + ")"
# ---------- end decodes_13 ----------
slider_13 = Slider(0.984, range=0..1)
panel_2 = Panel(decodes_13.console)  # disabled
panel_3 = Panel("t")
# Evaluates a curve at a given parameter t, draws the curve and an approximating polyline
decodes_14 = DecodesPythonScript(t=slider_13)  # -> console, a, b, c, d
# ---------- decodes_14: Python ----------
#moves a point along the curve
pt_out = func_in(t)
a.put(pt_out)

#draws the part of the curve in the interval [0,t] with tolerance determined by fixed N
#! Will have an error with t = 0
#! Quirky behavior when N is too low
N = 50
crv_out = Curve(func_in,Interval(0,t), t/N)
b.put(crv_out)

# draws a line segment determined by point on the curve and a fixed vector
vec_a = Vec(0,0,10)
pt_out = func_in(t)
ln_out = Segment(pt_out,vec_a)
c.put(ln_out)

# approximates the part of the curve in the interval [0,t] by a polyline 
poly_out = crv_out._to_pline()
d.put(poly_out)
# ---------- end decodes_14 ----------

# ---- group: creates a circle class
decodes_15 = DecodesPythonScript()  # -> console, a
# ---------- decodes_15: Python ----------
class Circle():
    
    # TODO: this class currently assumes a circle on the xy axis
    
    def __init__(self,plane,radius):
        self.pln = plane
        self.rad = radius
        
    @property
    def cpt(self):
        return self.pln.origin
        
    def intersections(self,other):
        # TODO: this func currently assumes a circle on the xy axis
        if not self.pln.is_coplanar( other.pln ) : 
            print self.pln.near(other.pln.origin)[0].distance(other.pln.origin)
            print 'circles not coplanar'
            return False
        d = self.cpt.distance(other.cpt)
        if d == 0 : 
            print 'circles share a center point'
            return False
        a = (self.rad**2 - other.rad**2 + d**2)/(2*d)
        h2 = self.rad**2 - a**2
        if h2 < 0 : 
            print 'what, huh?'
            return False
        h = math.sqrt(h2)
        pt = ( other.cpt - self.cpt ) * (a/d) + self.cpt
        if h == 0 : return pt
        vec = Vec(self.cpt,pt).cross(self.pln.vec).normalized(h)
        return [pt - vec, pt + vec]
        
    def to_gh(self):
        import Rhino.Geometry as rg
        plane = rg.Plane(rg.Point3d(self.pln.origin.x,self.pln.origin.y,self.pln.origin.z),rg.Vector3d(self.pln.vec.x,self.pln.vec.y,self.pln.vec.z))
        return rg.Circle(plane,self.rad)
        
a.put(Circle)
# ---------- end decodes_15 ----------

# ----
panel_4 = Panel("n")
# Illustrates the key geometric objects of tangent line, osculating circle, curvature and Frenet frame along a curve.  Uses discrete approximations with resolution controlled by n.
decodes_16 = DecodesPythonScript(n=Slider(102, range=1..200), t=slider_13, func_in=decodes_11.a, Circle=decodes_15.a)  # -> console, a, b, c, d, e, f
# ---------- decodes_16: Python ----------
#Illustrates the key geometric objects of tangent vector, osculating circle, curvature and Frenet frame
#Evaluates these at t in [0,1] with a resolution determined by n


res = 1.0/n

#a point along the curve
pt_out = func_in(t)
a.put(pt_out)


# Draws the curve as well as a discrete polyline with resolution res
crv_out = Curve(func_in,Interval(0,1), res)
b.put(crv_out)
poly_out = crv_out._to_pline()
c.put(poly_out)

#nearest neighbors of point in question; used for discrete approximations calculations 
if (t == 0):
    pt_t = func_in(0.1*res)
    pt_plus = func_in(0.2*res)
    pt_minus = func_in(0)    
elif (t > 0) and (t < 0.5*res):
    pt_t = pt_out
    pt_plus = func_in(2*t)
    pt_minus = func_in(0)
elif (t > 1-0.5*res) and (t < 1):
    pt_t = pt_out
    pt_plus = func_in(1)
    pt_minus = func_in(0.5*t)
elif (t == 1):
    pt_t = func_in(1-0.1*res)
    pt_plus = func_in(1)
    pt_minus = func_in(1-0.2*res)
else:
    pt_t = pt_out
    pt_plus = func_in(t + 0.5*res)
    pt_minus = func_in(t - 0.5*res)


# draws a tangent line at t with resolution of discrete approximation given by res
vec_t = Vec(pt_plus - pt_minus)
factor = crv_out.appx_length/(20*vec_t.length)
ln_out = Segment(pt_t + vec_t*factor, pt_t - vec_t*factor)
d.put(ln_out)

#draws the osculating circle and calculates the curvature at t with resolution res
v1 = Vec(pt_plus - pt_t)
v2 = Vec(pt_minus - pt_t)
v3 = Vec(pt_plus - pt_minus)

rad_osc = 0.5*v1.length*v2.length*v3.length/(v1*v3).length
denom = 2*(v1.cross(v3).length)*(v1.cross(v3).length)
a1 = v3.length*v3.length*v1.dot(v2)/denom
a2 = v2.length*v2.length*v1.dot(v3)/denom
a3 = v1.length*v1.length*(-v2.dot(v3))/denom
center_osc = pt_t*a1 + pt_plus*a2 + pt_minus*a3

pln_out = Plane(center_osc, v1.cross(v2))
circ_out = Circle(pln_out,rad_osc)
e.put(circ_out.to_gh())
print "approximate curvature: ", 1/rad_osc

#draws Frenet frame (T, N, B) at t with resolution res
#the direction of the unit normal N gives an easy visualization of inflection points
vec_T = vec_t.normalized()
vec_N = Vec(center_osc-pt_t).normalized()
cs_out = CS(pt_t, vec_T, vec_N)
f.put(cs_out)
# ---------- end decodes_16 ----------
panel_5 = Panel(decodes_16.console)
