# Grasshopper definition developable surfaces.ghx (Grasshopper 0.9.14)
# plug-ins: Decodes Python Interpreter

# ---- group: cylindrical patch
bend = Slider(0, range=0..1)
decodes = DecodesPythonScript(bend=bend)  # -> console, a
# ---------- decodes: Python ----------
"""
A cylindrical patch (inverted trough on the x-y plane) with variable bend
Parametrized on [0,1]x[0,1], with u-isocurves being the rulings (v is the ruling
direction)
"""


import math
pi = math.pi
w = 10

def func(u,v):
    curv = bend/w
    if curv != 0:
        rad = 1.0/curv
        theta = math.acos(w*curv)
        z0 = - math.sqrt(rad*rad - w*w)   
        u_val = (pi - 2*theta)*(1-u) + theta
        v_val = 2*w*v - w
        x = rad*math.cos(u_val)
        y = v_val
        z = rad*math.sin(u_val) + z0
    else:
        x = 2*w*u - w
        y = 2*w*v - w
        z = 0
    return Point( x, y, z )
    

a.put(func)
#a.put(Surface(func).surrogate)
# ---------- end decodes ----------

# ---- group: conical patch
bend_2 = Slider(0.24, range=0..1)
decodes_2 = DecodesPythonScript(bend=bend_2)  # -> console, a
# ---------- decodes_2: Python ----------
"""
A conical patch with variable bend
Parametrized on [0,1]x[0,1], with u-isocurves being the rulings (v is the ruling
direction)
"""


import math
pi = math.pi
w = 10

def func(u,v):
    curv = bend/w
    if curv != 0:
        rad = 1.0/curv
        z0 = -math.sqrt(rad*rad - w*w)  
        w_b = w*(1-bend)
        y_int = w*(1-2*w/(w-w_b))
        circ_center = Vec(0, w, z0)
        base_pt = Vec(0, y_int, 0)
        rot_axis = (circ_center-base_pt).normalized()
        circ_center_adj = circ_center - rot_axis*(Vec(0, 0, -z0).dot(-rot_axis))
        u1 = (Vec( w,w,0)-circ_center_adj).normalized()
        u2 = (Vec(-w,w,0)-circ_center_adj).normalized()
        theta = math.acos(u1.dot(u2))
        angle = theta*(1-u)
        xf = Xform.rotation(axis=rot_axis,angle=-angle,center=base_pt)
        ln = Line(Point(w_b, -w, 0), Point(w, w, 0))
        return ln.eval(v)*xf
    else:
        x = 2*w*u - w
        y = 2*w*v - w
        z = 0
        return Point( x, y, z )
    


a.put(func)
# Create a decodes surface with a given function
#surf = Surface(func)
#b.put(surf.surrogate)
# ---------- end decodes_2 ----------

# ----
panel = Panel("TODO:  a tangent surface")
crv_to_pull = Curve(<curve referenced from the Rhino model>)
cp = ControlPoints(Curve=crv_to_pull)  # -> Points, Weights, Knots
decodes_3 = DecodesPythonScript(surf_func=decodes_2.a, num_rulings=Slider(11, range=2..20), crv_pts=cp.Points)  # -> console, a, b; inputs crv_pts: list
# ---------- decodes_3: Python ----------
# This is for developable surfaces parametrized on [0,1]x[0,1] with rulings in the v-direction
# and where delta_u x delta v is the outward pointing normal 

rule_number = int(num_rulings)
u_val = Interval().divide(rule_number-1,True)

#Create a mesh consisting of a single strip of planar quads
srf_mesh = Mesh()
for v in range(2):
    for u in u_val:
        srf_mesh.append(surf_func(u,v))

for i in range(rule_number):
    srf_mesh.add_face(i, i+1, i + rule_number+1, i + rule_number)
 
a.put(srf_mesh)

#Pulls the curve onto the surface by normal projection
crv = Curve.bezier(crv_pts)
crv_count = rule_number*2
#crv_val = Interval().divide(crv_count-1,True)
crv_val = [0.5]
#for k in range(len(srf_mesh.faces)):
for k in range(3,4):
    verts = srf_mesh.face_pts(k)
    base_pt = verts[0]
    normal = srf_mesh.face_normal(k)
    cs_face = CS(base_pt, Vec(base_pt, verts[1]).normalized(), Vec(base_pt, verts[3]).normalized())
    xf = Xform.change_basis(cs_face, CS())
    verts_xy = [verts[i]*xf for i in range(len(verts))]
    poly_xy = PGon(verts_xy)
    b.put(poly_xy)
    #Pull curve points onto each face
    for t in crv_val:
        pt = crv.eval(t).origin
        b.put(pt)       
        vec_to_proj = Vec(pt - base_pt)       
        pt_proj = pt - normal*(vec_to_proj.dot(normal))
        # check if face contains point (uses contain_pt which works for a poly and a point on xy-plane) 
        pt_proj_xy = pt_proj*xf  
        if pt_proj_xy in poly_xy:
            b.put(pt_proj)
# ---------- end decodes_3 ----------
