# Grasshopper definition postrationalization.ghx (Grasshopper 0.9.14)
# plug-ins: Decodes Python Interpreter

# ---- group: conical patch
bend = Slider(0.78, range=0..1)
decodes = DecodesPythonScript(bend=bend)  # -> console, a
# ---------- decodes: Python ----------
"""
A conical patch with variable bend
Parametrized on [0,1]x[0,1], with u-isocurves being the rulings (v is the ruling
direction)
"""


import math
pi = math.pi
w = 1

def func(u,v):
    curv = bend/w
    if curv != 0:
        rad = 1.0/curv
        z0 = -math.sqrt(rad*rad - w*w)  
        w_b = w*(1-bend)
        y_int = w*(1-2*w/(w-w_b))
        circ_center = Vec(0, w, z0)
        base_pt = Vec(0, y_int, 0)
        rot_axis = (circ_center-base_pt).normalized()
        circ_center_adj = circ_center - rot_axis*(Vec(0, 0, -z0).dot(-rot_axis))
        u1 = (Vec( w,w,0)-circ_center_adj).normalized()
        u2 = (Vec(-w,w,0)-circ_center_adj).normalized()
        theta = math.acos(u1.dot(u2))
        angle = theta*(1-u)
        xf = Xform.rotation(axis=rot_axis,angle=-angle,center=base_pt)
        ln = Line(Point(w_b, -w, 0), Point(w, w, 0))
        return ln.eval(v)*xf
    else:
        x = 2*w*u - w
        y = 2*w*v - w
        z = 0
        return Point( x, y, z )

surf = Surface(func)
a.put(surf)
# ---------- end decodes ----------

# ----
pts_b = Point([Point(-3.018592699, -2.024892261, 0), Point(-1.129377763, -0.7757352849, -1.482849848), Point(-2.990803284, 0.002538433396, 0)])
pts_a = Point([Point(-2.001169597, -2.020473651, 0), Point(-2.007284576, -1.025343648, 1.414240644), Point(-2.040558602, -0.03388352001, 0)])
pts_c = Point([Point(-3.430345193, -2.010302463, 0), Point(-3.445540397, -0.625990868, -0.3879325821), Point(-3.440382422, -0.005936497756, 0)])
decodes_2 = DecodesPythonScript(pts_a=pts_a, pts_b=pts_b, pts_c=pts_c)  # -> console, a; inputs pts_a: list, pts_b: list, pts_c: list
# ---------- decodes_2: Python ----------
crv_a = Curve.bezier(pts_a)
crv_b = Curve.bezier(pts_b)
crv_c = Curve.bezier(pts_c)

def func(u,v):
    pts = [crv.eval(u) for crv in [crv_a,crv_b,crv_c]]
    return Curve.bezier(pts).eval(v)

srf = Surface(func)
a.put(srf)
# ---------- end decodes_2 ----------
decodes_3 = DecodesPythonScript()  # -> console, a, b, c, d, e
# ---------- decodes_3: Python ----------
import math

def func(u,v): return Point(u,v,math.sin(u*v)) # sine surface
surf_a = Surface(func, Interval(0, 1), Interval(-1,1))
a.put(surf_a)

def func(u,v): return Point(u,v,(u**3-3*u*v**2)/4) # monkey saddle
surf_b = Surface(func, Interval(-1, 1), Interval(-1,1))
b.put(surf_b)

def func(u,v): return Point(u,v,((1/3)*u**3+u*v**2+2*(u**2-v**2))/4 ) # handkerchief surface
surf_c = Surface(func, Interval(-1, 1), Interval(-1,1))
c.put(surf_c)

def func(u,v): return Point(u*v,u,v**2) #umbrella surface
surf_d = Surface(func, Interval(0.01, 1), Interval(-1,1))
d.put(surf_d)

#steiner surface
def func(u,v):
    x = 0.5*math.cos(v)*math.cos(v)*math.sin(2*u)
    y = 0.5*math.sin(u)*math.sin(2*v)
    z = 0.5*math.cos(u)*math.sin(2*v)
    return Point(x,y,z)
surf_e = Surface(func, Interval(0.01, math.pi), Interval(0.01, math.pi))
e.put(surf_e)
# ---------- end decodes_3 ----------
md_slider = MDSlider(
    slider_value=Point(0.7500991821, 0.8931233476, 0.5),
    x_domain=Domain(0, 1),
    y_domain=Domain(0, 1),
    z_domain=Domain(0, 1),
    SliderMode=0)
res_u = Slider(12, range=1..30)
res_v = Slider(13, range=1..30)
decodes_4 = DecodesPythonScript(surf=decodes_3.c, res_u=res_u, res_v=res_v, rgn_ctr=md_slider, rgn_width=Slider(0.77, range=0.01..1), test=Toggle(False))  # -> console, a, a_props, test_out, test_out_props; disabled
# ---------- decodes_4: Python ----------
"""
IN:  square region given in domain space by rgn_ctr (center of a normalized domain) 
and rgn_width (normalized width of box) 
OUT: 
"""

import math

def deval_normal(u,v):
    pt_uv = surf.deval(u,v)
    pt, u_pos, u_neg, v_pos, v_neg = surf._nudged(u,v,True)
    ngbr = Mesh()
    ngbr.append(pt_uv)
    ngbr.append(pt_uv +  u_pos )
    ngbr.append(pt_uv +  u_pos  +  v_pos)
    ngbr.append(pt_uv +  v_pos )
    ngbr.append(pt_uv +  u_neg  +  v_pos)
    ngbr.append(pt_uv +  u_neg )
    ngbr.append(pt_uv +  u_neg  +  v_neg)
    ngbr.append(pt_uv +  v_neg )
    ngbr.append(pt_uv +  u_pos  +  v_neg)
    

    #Triangular mesh
    ngbr.add_face(0,1,2)
    ngbr.add_face(0,2,3)
    ngbr.add_face(0,3,5)
    ngbr.add_face(0,5,6)
    ngbr.add_face(0,6,7)
    ngbr.add_face(0,7,1)

    N_vec = Vec.average([ngbr.face_normal(k) for k in range(len(ngbr.faces))])
    if test:
        N_vec_test = Vec(0,0,0)
        for k in range(len(ngbr.faces)):
            verts = ngbr.face_pts(k)
            face_area = 0.5*Vec(verts[0],verts[1]).cross(Vec(verts[0],verts[2])).length
            N_vec_test = N_vec_test + ngbr.face_normal(k)*face_area 
        print "N_vec comparision:", N_vec.normalized(), N_vec_test.normalized()

    return N_vec.normalized()
   
 

def deviation_from_plane(vecs):
    avg_v = Vec.average(vecs)
    dev = []
    for v in vecs:
        dev.append((v - v.projected(avg_v)).length)
    return max(dev)
        
    
count_u = int(res_u)
count_v = int(res_v)
srf_msh = surf.to_mesh(divs_u=count_u,divs_v=count_v)
a.put(srf_msh)

u0 = surf.u0
u1 = surf.u1
v0 = surf.v0
v1 = surf.v1

u0_regn = max(u0, u0 + (u1-u0)*(math.floor((rgn_ctr.x - rgn_width*0.5)*count_u)/count_u))
u1_regn = min(u1, u0 + (u1-u0)*(math.ceil((rgn_ctr.x + rgn_width*0.5)*count_u)/count_u))
v0_regn = max(v0, v0 + (v1-v0)*(math.floor((rgn_ctr.y - rgn_width*0.5)*count_v)/count_v))
v1_regn = min(v1, v0 + (v1-v0)*(math.ceil((rgn_ctr.y + rgn_width*0.5)*count_v)/count_v))
if test: test_out.put([surf.deval(u0_regn, v0_regn), surf.deval(u1_regn, v0_regn), surf.deval(u1_regn, v1_regn), surf.deval(u0_regn, v1_regn)])

div_u = (u1-u0)/count_u
div_v = (v1-v0)/count_v
count_u_regn = int(math.ceil((u1_regn - u0_regn)/div_u))
count_v_regn = int(math.ceil((v1_regn - v0_regn)/div_v))
u_val = Interval(u0_regn, u1_regn).divide(count_u_regn,True)
v_val = Interval(v0_regn, v1_regn).divide(count_v_regn,True)


# Evaluate the normals at each vertex in the given region
normals = []
for v in v_val:
   for u in u_val:
        N_vec = deval_normal(u,v)
        normals.append(N_vec)
        if test: test_out.put(Segment(surf.deval(u,v), N_vec*0.25))


dev_plane = deviation_from_plane(normals)
print "Deviation from plane: ", dev_plane

#Color in the faces in the region according to the region's deviation from planar
color_near = Color.RGB(1, 1, 1)
color_far =  Color.RGB(1, 0, 0)

i0 = int((u0_regn-u0)/div_u)
j0 = int((v0_regn-v0)/div_v)
i1 = int((u1_regn-u0)/div_u)
j1 = int((v1_regn-v0)/div_v)

for j in range(j0, j1):
    for i in range(i0, i1):
        pts = srf_msh.face_pts(j*count_u + i)
        nface = [0,1,2,3]
        face_msh = Mesh(pts,[nface])
        face_msh.set_color(Color.interpolate(color_near,color_far,dev_plane))
        a.put(face_msh)
# ---------- end decodes_4 ----------

# ---- group: Deviation of Surface from Plane
decodes_5 = DecodesPythonScript(surf=decodes_2.a, res_u=res_u, res_v=res_v, test=Toggle(False))  # -> console, a, a_props, test_out, test_out_props
# ---------- decodes_5: Python ----------
"""
IN:   
OUT:
"""
def deval_normal(u,v):
    pt_uv = surf.deval(u,v)
    pt, u_pos, u_neg, v_pos, v_neg = surf._nudged(u,v,True)
    ngbr = Mesh()
    ngbr.append(pt_uv)
    ngbr.append(pt_uv +  u_pos )
    ngbr.append(pt_uv +  u_pos  +  v_pos)
    ngbr.append(pt_uv +  v_pos )
    ngbr.append(pt_uv +  u_neg  +  v_pos)
    ngbr.append(pt_uv +  u_neg )
    ngbr.append(pt_uv +  u_neg  +  v_neg)
    ngbr.append(pt_uv +  v_neg )
    ngbr.append(pt_uv +  u_pos  +  v_neg)
    

    #Triangular mesh
    ngbr.add_face(0,1,2)
    ngbr.add_face(0,2,3)
    ngbr.add_face(0,3,5)
    ngbr.add_face(0,5,6)
    ngbr.add_face(0,6,7)
    ngbr.add_face(0,7,1)

    N_vec = Vec.average([ngbr.face_normal(k) for k in range(len(ngbr.faces))])
    if test:
        N_vec_test = Vec(0,0,0)
        for k in range(len(ngbr.faces)):
            verts = ngbr.face_pts(k)
            face_area = 0.5*Vec(verts[0],verts[1]).cross(Vec(verts[0],verts[2])).length
            N_vec_test = N_vec_test + ngbr.face_normal(k)*face_area 
        print "N_vec comparision:", N_vec.normalized(), N_vec_test.normalized()
    return N_vec.normalized()
   
 

def deviation_from_plane(vecs):
    avg_v = Vec.average(vecs)
    dev = []
    for v in vecs:
        dev.append((v - v.projected(avg_v)).length)
    return max(dev)
        
    
count_u = int(res_u)
count_v = int(res_v)
msh = surf.to_mesh(divs_u=count_u,divs_v=count_v)

u_val = Interval(surf.u0, surf.u1).divide(count_u,True)
v_val = Interval(surf.v0, surf.v1).divide(count_v,True)

# Evaluate the normals at each vertex of the mesh
normals = []
for v in v_val:
   for u in u_val:
        N_vec = deval_normal(u,v)
        normals.append(N_vec)
        if test: test_out.put(Segment(surf.deval(u,v), N_vec*0.25))

dev_plane = []
for k in range(len(msh.faces)):
    vert_normals = [normals[i] for i in msh.faces[k]]
    if test and ((k) % count_u == 0):
        verts = msh.face_pts(k)
        test_out.put(verts[0])
        avg_v = Vec.average(vert_normals)
        print vert_normals[1], vert_normals[2]
        test_out.put(Segment(msh.face_centroid(k), avg_v.normalized()*0.25))
    dev_plane.append(deviation_from_plane(vert_normals))

color_near = Color.RGB(1, 1, 1)
color_far =  Color.RGB(1, 0, 0)
msh_faces = Mesh.explode(msh)

print "Min deviation:", min(dev_plane)
print "Max deviation:", max(dev_plane)
if max(dev_plane) > 1:
    dev_plane =  [Interval.remap(i, Interval(0, max(dev_plane))) for i in dev_plane]

for i in range(len(msh_faces)):
    face = msh_faces[i]
    face.set_color(Color.interpolate(color_near,color_far,dev_plane[i]))
    a.put(face)
# ---------- end decodes_5 ----------

# ----
hardboil = DecodesHardBoil(Geometry=decodes_5.a, Properties=decodes_5.a_props)
hardboil_2 = DecodesHardBoil(Geometry=decodes_4.a, Properties=decodes_4.a_props)  # disabled
panel = Panel(decodes_5.console)
panel_2 = Panel(decodes_4.console)

# ---- group: c
decodes_6 = DecodesPythonScript()  # -> console, a, b; disabled
# ---------- decodes_6: Python ----------
# A wavy translational surface

import math

def func_crv(t):
    return Point(t, 0, math.sin(t))

def func_rail(t):
    return Point(0, 2*t, -t*t)
    
crv = Curve(func_crv,Interval(0,4.5*math.pi))
rail = Curve(func_rail, Interval(-2,2))
origin = Point(0,0,0)

def func(u,v):
    u_value = rail.domain.length*u + rail.domain.a
    v_value = crv.domain.length*v + crv.domain.a
    vec = origin - rail.deval(u_value)
    return crv.deval(v_value) - vec
   
surf = Surface(func)
a.put(surf)
b.put(surf.surrogate)
# ---------- end decodes_6 ----------

# ---- group: b
decodes_7 = DecodesPythonScript()  # -> console, a, b; disabled
# ---------- decodes_7: Python ----------
#A hyperbolic parabolic consructed as a translational surface of the two curves
#(2t, 0, 2*t*t) and (0, 2*t, -2*t*t).  Parametrized on the domain [0,1]x[0,1].  

def func_crv(t):
    return Point(2*t, 0, 2*t*t)

def func_rail(t):
    return Point(0, 2*t, -2*t*t)
   

crv = Curve(func_crv,Interval(-2,2))
rail = Curve(func_rail, Interval(-2,2))
origin = Point(0,0,0)

def func(u,v):
    u_value = rail.domain.length*u + rail.domain.a
    v_value = crv.domain.length*v + crv.domain.a
    vec = origin - rail.deval(u_value)
    return crv.deval(v_value) - vec
   
surf = Surface(func)
a.put(surf)
b.put(surf.surrogate)
# ---------- end decodes_7 ----------

# ---- group: a
# Recursive Subdivision of a Translational Surface
decodes_8 = DecodesPythonScript()  # -> console, a, b; disabled
# ---------- decodes_8: Python ----------
# Parametrized on the domain [0,1]x[0,1].  

def func_crv(t):
    return Point(t, 0, t*t*t/3.0 + t*t)

def func_rail(t):
    return Point(0, t, -1.5*t*t)

crv = Curve(func_crv,Interval(-2,1.5))
rail = Curve(func_rail, Interval(-1,1))
origin = Point(0,0,0)

def func(u,v):
    u_value = rail.domain.length*u + rail.domain.a
    v_value = crv.domain.length*v + crv.domain.a
    vec = origin - rail.deval(u_value)
    return crv.deval(v_value) - vec
   
surf = Surface(func)
a.put(surf)
b.put(surf.surrogate)
# ---------- end decodes_8 ----------

# ----
slider = Slider(2, range=0.1..2)  # disabled
decodes_9 = DecodesPythonScript(surf=decodes_8.a, threshold=slider)  # -> console, a, b, c; disabled
# ---------- decodes_9: Python ----------
#IN:  a function defining a translational surface parametrized on the domain [0,1]x[0,1]

def func_u(t):
    return surf._func(0,t)

def func_v(t):
    return surf._func(t,0)
 
def calc_curvature(func_crv,t):
    #nearest neighbors of point in question; used for discrete approximations
    #calculations;
    res_curvature = grid_res
    pt_out = func_crv(t)
    if (t == 0):
        pt_t = func_crv(0.1*res_curvature)
        pt_plus = func_crv(0.2*res_curvature)
        pt_minus = func_crv(0)    
    elif (t > 0) and (t < 0.5*res_curvature):
        pt_t = pt_out
        pt_plus = func_crv(2*t)
        pt_minus = func_crv(0)
    elif (t > 1-0.5*res_curvature) and (t < 1):
        pt_t = pt_out
        pt_plus = func_crv(1)
        pt_minus = func_crv(0.5*t)
    elif (t == 1):
        pt_t = func_crv(1-0.1*res_curvature)
        pt_plus = func_crv(1)
        pt_minus = func_crv(1-0.2*res_curvature)
    else:
        pt_t = pt_out
        pt_plus = func_crv(t + 0.5*res_curvature)
        pt_minus = func_crv(t - 0.5*res_curvature)

    #calculates the curvature at t for given grid_resolution
    v1 = Vec(pt_plus - pt_t)
    v2 = Vec(pt_minus - pt_t)
    v3 = Vec(pt_plus - pt_minus)
    try:
        rad_osc = 0.5*v1.length*v2.length*v3.length/(v1*v3).length
        return 1.0/rad_osc
    except:
        print "curvature calculation error!"
        print t
        print v1, v2, v3
        return False

def decompose_surface(u0=0,u1=1,v0=0,v1=1):
    i0 = int(grid_count*u0)
    i1 = int(grid_count*u1)
    j0 = int(grid_count*v0)
    j1 = int(grid_count*v1)
    if (i1 > i0+1) and (j1 > j0+1):
        max_curvature = max(max(curvature_u[i0: i1+1]), max(curvature_v[j0:j1+1]))
        #print "max curvature", max_curvature
        if (max_curvature > threshold):
            u_mid = (u0 + u1)/2
            v_mid = (v0 + v1)/2
            decomposeSurface(u0, u_mid, v0, v_mid)
            decomposeSurface(u_mid, u1, v0, v_mid)
            decomposeSurface(u0, u_mid, v_mid, v1)
            decomposeSurface(u_mid, u1, v_mid, v1)
        else:
            index0= j0*(grid_count+1)+i0
            index1= j0*(grid_count+1)+i1
            index2= j1*(grid_count+1)+i1
            index3= j1*(grid_count+1)+i0
            msh.add_face(index0, index1, index2, index3)
    else:
        index0= j0*(grid_count+1)+i0
        index1= j0*(grid_count+1)+i1
        index2= j1*(grid_count+1)+i1
        index3= j1*(grid_count+1)+i0
        msh.add_face(index0, index1, index2, index3)
    
    return msh

            
grid_count = 32
grid_res = 1.0/grid_count

curvature_u = [calc_curvature(func_u, i*grid_res) for i in range(grid_count+1)]
curvature_v = [calc_curvature(func_v, j*grid_res) for j in range(grid_count+1)] 

msh = Mesh()
for i in range(grid_count+1):
    for j in range(grid_count+1):
        msh.append(surf.eval(i*grid_res,j*grid_res))

decompose_surface()
a.put(msh)
b.put(curvature_u)
c.put(curvature_u)
# ---------- end decodes_9 ----------
decodes_10 = DecodesPythonScript(surf=decodes_8.a)  # -> console, a; disabled
# ---------- decodes_10: Python ----------
crv_v = surf.isocurve(u_val=0)
crv_u = surf.isocurve(v_val=0)
a.put([crv_u.surrogate,crv_v.surrogate])
# ---------- end decodes_10 ----------
mesh = Mesh(decodes_9.a)  # disabled
