# Grasshopper definition surface shape.ghx (Grasshopper 0.9.14)
# plug-ins: Decodes Python Interpreter

panel = Panel("Set one surface")  # disabled
srf = Surface(<surface referenced from the Rhino model>)  # disabled

pts_b1 = Point([Point(-3.018592699, -2.024892261, -0.09282004814), Point(-3, -0.7757352849, 1.482849848), Point(-2.990803284, 0.002538433396, 0.07336474846)])
pts_b0 = Point([Point(-3.018592699, -2.024892261, 0.1003747255), Point(-3, -0.7757352849, 1.482849848), Point(-2.990803284, 0.002538433396, 0.07336474846)])

# ----
# Set one point.
srf_cp = SurfaceCP(Surface=srf)  # -> Point, UVPoint, Distance; disabled

curvature = PrincipalCurvature(Surface=srf, Point=srf_cp.UVPoint)  # -> Frame, Min, Max, MinDirection, MaxDirection; disabled
pts_b = Point(pts_b1)
pts_c = Point([Point(-3.430345193, -2.010302463, 0), Point(-3.445540397, -0.4191996433, -0.3879325821), Point(-3.440382422, -0.005936497756, 0)])
pts_a = Point([Point(-2.001169597, -2.020473651, 0), Point(-2.007284576, -1.025343648, -1.414240644), Point(-2.040558602, -0.03388352001, 0)])

# ---- group: torus
r = Slider(2.669, range=2..5)
R = Slider(5, range=5..10)
decodes = DecodesPythonScript(r=r, R=R)  # -> console, a, domain
# ---------- decodes: Python ----------
"""
Ring Torus - standard parametrization as a surface of revolution 
    x = (R + r*math.cos(v))*math.cos(u)
    y = (R + r*math.cos(v))*math.sin(u)
    z = r*math.sin(v)
    R > r > 0
    domain = [0, 2*pi]x[0, 2*pi]
"""

import math

def func(u,v):
    rho = R + r*math.cos(v)
    pt_out = Point(rho*math.cos(u), rho*math.sin(u), r*math.sin(v))
    return pt_out

 
a.put(func)
domain.put([0, 2*math.pi, 0, 2*math.pi])
# ---------- end decodes ----------

# ---- group: wavy translational surface
decodes_2 = DecodesPythonScript()  # -> console, a, domain
# ---------- decodes_2: Python ----------
def func_crv(t):
    return Point(t, 0, t*t*t/3.0 + t*t)

def func_rail(t):
    return Point(0, t, -1.5*t*t*t)

crv = Curve(func_crv,Interval(-2,1.5))
rail = Curve(func_rail, Interval(-1,1))
origin = Point(0,0,0)

def func(u,v):
    u_value = rail.domain.length*u + rail.domain.a
    v_value = crv.domain.length*v + crv.domain.a
    vec = origin - rail.deval(u_value).origin
    return crv.deval(v_value).origin - vec
   

a.put(func)
domain.put([0,1,0,1])
# ---------- end decodes_2 ----------

# ----
decodes_3 = DecodesPythonScript(pts_a=pts_a, pts_b=pts_b, pts_c=pts_c)  # -> console, a; inputs pts_a: list, pts_b: list, pts_c: list
# ---------- decodes_3: Python ----------
crv_a = Curve.bezier(pts_a)
crv_b = Curve.bezier(pts_b)
crv_c = Curve.bezier(pts_c)

def func(u,v):
    pts = [crv.eval(u) for crv in [crv_a,crv_b,crv_c]]
    return Curve.bezier(pts).eval(v)

surf = Surface(func)
a.put(surf)
# ---------- end decodes_3 ----------
decodes_4 = DecodesPythonScript(bz_surf=decodes_3.a)  # -> console, a, domain
# ---------- decodes_4: Python ----------
"""
def func(u,v): return Point(u,v,math.sin(u*v)) # sine surface
a.put(func)
domain.put([0,1,-1,1])
"""
def func(u,v): return Point(u,v,(u**3-3*u*v**2)/4) # monkey saddle
a.put(func)
domain.put([-1,1,-1,1])
"""
def func(u,v): return Point(u,v,((1/3)*u**3+u*v**2+2*(u**2-v**2))/4 ) # handkerchief surface
a.put(func)
domain.put([-1,1,-1,1])

def func(u,v): return Point(u*v,u,v**2) #umbrella surface
a.put(func)
domain.put([0.01,1-1,1])
"""
# ---------- end decodes_4 ----------

eval = EvaluateSurface(Surface=srf, Point=srf_cp.UVPoint)  # -> Point, Normal, Frame; disabled
vdis = VectorDisplay(Anchor=srf_cp.Point, Vector=curvature.MinDirection)  # disabled
vdis_2 = VectorDisplay(Anchor=srf_cp.Point, Vector=eval.Normal)  # disabled
# Min. Principal Curvature
xprod = CrossProduct(VectorA=curvature.MinDirection, VectorB=eval.Normal, Unitize=False)  # -> Vector, Length; disabled
pl = PlaneNormal(Origin=srf_cp.Point, ZAxis=xprod.Vector)  # disabled
plane = PlaneSrf(Plane=pl, XSize=Domain(-10, 10), YSize=Domain(-10, 10))  # disabled
bbx = BrepBrep(A=srf, B=plane)  # -> Curves, Points; disabled

eval_2 = EvaluateSurface(Surface=srf, Point=srf_cp.UVPoint)  # -> Point, Normal, Frame; disabled
vdis_3 = VectorDisplay(Anchor=srf_cp.Point, Vector=curvature.MaxDirection)  # disabled
vdis_4 = VectorDisplay(Anchor=srf_cp.Point, Vector=eval_2.Normal)  # disabled
# Max. Principal Curvature
xprod_2 = CrossProduct(VectorA=curvature.MaxDirection, VectorB=eval_2.Normal, Unitize=False)  # -> Vector, Length; disabled
pl_2 = PlaneNormal(Origin=srf_cp.Point, ZAxis=xprod_2.Vector)  # disabled
plane_2 = PlaneSrf(Plane=pl_2, XSize=Domain(-10, 10), YSize=Domain(-10, 10))  # disabled
bbx_2 = BrepBrep(A=srf, B=plane_2)  # -> Curves, Points; disabled

md_slider = MDSlider(
    slider_value=Point(0.6418471918, 0.8075944854, 0.5),
    x_domain=Domain(0, 1),
    y_domain=Domain(0, 1),
    z_domain=Domain(0, 1),
    SliderMode=0)
res_u = Slider(10, range=4..20)
res_v = Slider(10, range=4..20)
decodes_5 = DecodesPythonScript(func=decodes_4.a, domain=decodes_4.domain, res_u=res_u, res_v=res_v, dom_pt=md_slider)  # -> console, a, b, c, d, e; inputs domain: list
# ---------- decodes_5: Python ----------
"""
IN:   
- a function f(u,v) describing a parametric surface on a rectamgular domain
- resolution of drawn surface controlled by res_u, res_v
- a point dom_pt (given on a normalized domain) referring to a point on the surface 

OUT:
The following geometric entities describing the shape of the surface at a given point:  
- normal vector
- principal directions (expressed as a coordinate system)
- curvatures: principal curvatures (min/max), Gaussian curvature (K), Mean Curvature (H)

Note: All quantities at a given point are computed using nearest neighbors on a mesh.  
For the case of a parametrized surface, we take a mesh of nearest neighbors with vertices
given by the isocurves at a resolution tol_nudge. These calculations are good for any mesh 
on a surface;  all that would need to change for another type of mesh is 
(1) the construction of the mesh of nearest neighbors around the surface point in question 
(2) the calculation of the areas of the faces and the weighted face areas
ref: 
Taubin, Gabriel, Estimating the Tensor of Curvature of a Surface from a Polyhedral
Approximation, http://pdf.aminer.org/000/234/737/curvature_approximation_for_triangulated_surfaces.pdf

Note: we can define projection onto a surface by computing the normal on the surrogate)
"""

import math

# * eliminate when we have a matrix class or can import numpy
def matrix_mult(matrix1,matrix2):
    if len(matrix1[0]) != len(matrix2):
        print "Matrices can't be multiplied!"
    else:
        m = len(matrix1)
        n = len(matrix1[0])
        p = len(matrix2[0])
        new_matrix = [[0 for row in range(p)] for col in range(m)]
        for i in range(m):
            for j in range(p):
                for k in range(n):
                    new_matrix[i][j] += matrix1[i][k]*matrix2[k][j]
        return new_matrix

def transpose(matrix):
    return [list(i) for i in zip(*matrix)]
        

u0 = domain[0]
u1 = domain[1]
v0 = domain[2]
v1 = domain[3]

count_u = int(res_u)
count_v = int(res_v)
tol_u = (u1-u0)/count_u
tol_v = (v1-v0)/count_v

srf = Surface(func, Interval(u0, u1), Interval(v0,v1), tol_u, tol_v)
a.put(srf.surrogate)

u = u0 + (u1-u0)*dom_pt.x
v = v0 + (v1-v0)*dom_pt.y

pt_uv = func(u,v)
b.put(pt_uv)

tol_u_nudge = tol_u/100.0
tol_v_nudge = tol_v/100.0
            

#construct mesh of nearest neighbors, with 0 indexing p_uv and neighbors indexed counterclockwise 
ngbr = Mesh()
u_plus = u + tol_u_nudge
u_minus = u - tol_u_nudge
v_plus = v + tol_v_nudge
v_minus = v - tol_v_nudge
ngbr.append(func(u,v))
if (u_minus > u0) and (u_plus < u1) and (v_minus > v0) and (v_minus < v1):
    ngbr.append(func(u_plus, v))
    ngbr.append(func(u_plus, v_plus))
    ngbr.append(func(u, v_plus))
    ngbr.append(func(u_minus, v_plus))
    ngbr.append(func(u_minus, v))
    ngbr.append(func(u_minus, v_minus))
    ngbr.append(func(u, v_minus))
    ngbr.append(func(u_plus, v_minus))
    
    #Quad mesh
    ngbr.add_face(0,1,2,3)
    ngbr.add_face(0,3,4,5)
    ngbr.add_face(0,5,6,7)
    ngbr.add_face(0,7,8,1)
   
    """
    #Triangular mesh
    ngbr.add_face(0,1,2)
    ngbr.add_face(0,2,3)
    ngbr.add_face(0,3,5)
    ngbr.add_face(0,5,6)
    ngbr.add_face(0,6,7)
    ngbr.add_face(0,7,1)
    """
else:
    print "Deal with later"

#weights stores the sum of the face areas for faces touching at given vertex and p_uv
#used for creating the matrix needed for the calculation of the principals
weights = [0]*len(ngbr) 

#Compute the normal vector and tangent plane at the point pt_uv
N_vec = Vec(0,0,0)
for k in range(len(ngbr.faces)):
    verts = ngbr.face_pts(k)

    #Quad face area
    face_area = Vec(verts[0],verts[1]).cross(Vec(verts[0],verts[2])).length

    #Triangular face area
    #face_area = 0.5*Vec(verts[0],verts[1]).cross(Vec(verts[0],verts[2])).length

    N_vec = N_vec + ngbr.face_normal(k)*face_area
    for i in ngbr.faces[k]:
        weights[i] += face_area
N_vec = N_vec.normalized()
tangent_plane = Plane(pt_uv, N_vec)
c.put(N_vec)

#Compute the principal curvatures and directions at the point pt_uv (*)

#Form the matrix needed for the calculation of the principal curvatures/directions
M_mat = [[0 for row in range(3)] for col in range(3)]
weights_sum = sum(weights)
for k in range(1,len(ngbr)):
    vec_k = Vec(ngbr[k] - pt_uv) 
    #T_k is normalized projecton of vec_k onto the tangent plane
    T_k = (vec_k - N_vec*(vec_k.dot(N_vec))).normalized().to_tuple()
    #kappa_k is the approximate directional curvature at ngbr[k]
    kappa_k = 2*N_vec.dot(vec_k)/vec_k.length2
    w_k =  weights[k]/weights_sum
    factor = kappa_k*w_k  
    for row in range(3):
       for col in range(3):
           M_mat[row][col] += factor * T_k[row] * T_k[col]
 
"""
#Check that N_vec is an eigenvector of M_mat (with eigenvalue 0)
N = [[N_vec.x], [N_vec.y], [N_vec.z]]
print matrix_mult(M_mat, N)
"""

#Form matrix for Householder transformation(reflection matrix Q = I - 2*W*transpose(W))
E_vec = Vec(1,0,0)
if (E_vec - N_vec).length2 > (E_vec + N_vec).length2:
    W_vec = (Vec(1,0,0) - N_vec).normalized().to_tuple()
else:
    W_vec = (Vec(1,0,0) + N_vec).normalized().to_tuple()
    
I_mat = [[1,0,0], [0,1,0], [0,0,1]] 
Q_mat = [[0 for row in range(3)] for col in range(3)]

for row in range(3):
    for col in range(3):
        Q_mat[row][col] = I_mat[row][col] - 2 * W_vec[row] * W_vec[col]

"""
#Check that +- N_vec is the first column of Q
print N_vec, Q_mat
"""

T1_tilde = Vec(Q_mat[0][1], Q_mat[1][1], Q_mat[2][1])
T2_tilde = Vec(Q_mat[0][2], Q_mat[1][2], Q_mat[2][2])
"""
#Check that these vectors are orthonormal
print T1_tilde.length, T2_tilde.length, T1_tilde.dot(T2_tilde)
"""

#Apply Householder transformation by forming matrix : transpose(Q)*M*Q = Q*M*Q
#Note: Q_mat_transpose = transpose(Q_mat)
M_s =  matrix_mult(matrix_mult(Q_mat, M_mat), Q_mat)
m11 = M_s[1][1]
m12 = M_s[1][2]
m21 = M_s[2][1]
m22 = M_s[2][2]
M_s_restricted = [[m11, m12],[m21 , m22]]

"""
#Check that M_s_rectricted (restriction of M_s on tangent space) is symmetric
print "Matrix to be diagonalized", M_s_restricted
"""

#Calculate the Givens rotation angle
theta = 0.5*math.atan2(2*m12, m22-m11)
cos = math.cos(theta)
sin = math.sin(theta)

"""
#Check that transpose(Rot)*M_s_restricted*Rot is diagonal
Rot_mat = [[cos, sin],[-sin, cos]]
print matrix_mult(matrix_mult(transpose(Rot_mat), M_s_restricted), Rot_mat)
"""

#Calculate the eigenvectors and eigenvalues of M_mat
T1_vec = T1_tilde*cos - T2_tilde*sin
T2_vec = T1_tilde*sin + T2_tilde*cos
d1 = cos*cos*m11 - 2*cos*sin*m12 + sin*sin*m22 
d2 = sin*sin*m11 + 2*cos*sin*m12 + cos*cos*m22
if d1 > d2:
    d1,d2 = d2,d1
    T1_vec, T2_vec = T2_vec, T1_vec


"""
#Check that T1, T2 are eigenvectors of M_mat
T1 = [[T1_vec.x], [T1_vec.y], [T1_vec.z]]
T2 = [[T2_vec.x], [T2_vec.y], [T2_vec.z]]
T1_test = matrix_mult(M_mat, T1)
#These should all equal d1
print T1_test[0][0]/T1[0][0], T1_test[1][0]/T1[1][0], T1_test[2][0]/T1[2][0]
T2_test = matrix_mult(M_mat, T2)
#These should all equal d2
print T2_test[0][0]/T2[0][0], T2_test[1][0]/T2[1][0], T2_test[2][0]/T2[2][0]
""" 

#T1 and T2 are the principal directions.  Form a coordinate system aligned with these directions.
cs_principal = CS(pt_uv, T1_vec, T2_vec)
d.put(cs_principal)

#Compute all the curvature quantities: principal curvatures, Gaussian, Mean
k1 = 3*d1 - d2
k2 = 3*d2 - d1
K = k1*k2
H = (k1 + k2)*0.5
e.put([k1, k2, K, H])
print ("Min Principal Curvature = %.3f" % k1)
print ("Max Principal Curvature = %.3f" % k2)
print ("Gaussian Curvature = %.3f" % K)
print ("Mean Curvature = %.3f" % H)
# ---------- end decodes_5 ----------

# ---- group: compare with explicit curvatures for torus
decodes_6 = DecodesPythonScript(r=r, R=R, dom_pt=md_slider)  # -> console
# ---------- decodes_6: Python ----------
"""
This is just a check for the calculation of the curvature quantities
Compare with the values given by explicit equations for these quantities
Ring Torus - standard parametrization as a surface of revolution 
    x = (R + r*math.cos(v))*math.cos(u)
    y = (R + r*math.cos(v))*math.sin(u)
    z = r*math.sin(v)
    R > r > 0
    domain = [0, 2*pi]x[0, 2*pi]

"""

import math


pi = math.pi
u = 2*pi*dom_pt.x
v = 2*pi*dom_pt.y


#Compute all the curvature quantities: principal curvatures, Gaussian, Mean
cosv = math.cos(v)
curv1 = -cosv/(R+r*cosv)
curv2 = -1/r
if (curv1 < curv2):
    k1 = curv1
    k2 = curv2
else:
    k1 = curv2
    k2 = curv1

K = k1*k2
H = (k1 + k2)*0.5
print ("Min Principal Curvature = %.3f" % k1)
print ("Max Principal Curvature = %.3f" % k2)
print ("Gaussian Curvature = %.3f" % K)
print ("Mean Curvature = %.3f" % H)
# ---------- end decodes_6 ----------
panel_2 = Panel(decodes_6)

# ----
panel_3 = Panel(decodes_5.console)
