# Grasshopper definition surfaces.ghx (Grasshopper 0.9.14)
# plug-ins: Decodes Python Interpreter

height = Slider(4.735, range=1..5)
num_rot = Slider(4, range=1..6)
# Surfaces expressed as func(u,v) on a normalized domain [0,1]x[0,1]
panel = Panel("Cone ")
panel_2 = Panel("Torus")
panel_3 = Panel("Catenoid")
panel_4 = Panel("Helicoid")
decodes = DecodesPythonScript(h=height)  # -> console, a
# ---------- decodes: Python ----------
"""
Catenoid
    x = math.cosh(v/3)*math.cos(u)
    y = math.cosh(v/3)*math.sin(u)
    z = v
    domain = [0, 2*pi]x[-h/2,h/2]
"""

import math


def func(u,v):
    u_val = 2*math.pi*u
    v_val = h*v - h/2
    pt_out = Point(math.cosh(v_val/3)*math.cos(u_val), math.cosh(v_val/3)*math.sin(u_val), v_val)
    return pt_out
    
a.put(func)
# ---------- end decodes ----------
decodes_2 = DecodesPythonScript(n=num_rot)  # -> console, a
# ---------- decodes_2: Python ----------
"""
Helicoid;  domain
    #x = (v/5)*math.cos(u)
    #y = (v/5)v*math.sin(u)
    #z = u/20
    domain = [0, 2*n*pi]x[2,5]
"""

import math

def func(u,v):
    u_val = 2*n*math.pi*u
    v_val = 3*v + 2
    pt_out = Point((v_val/5)*math.cos(u_val), (v_val/5)*math.sin(u_val), u_val/20)
    return pt_out
    
a.put(func)
# ---------- end decodes_2 ----------
decodes_3 = DecodesPythonScript()  # -> console, a
# ---------- decodes_3: Python ----------
"""
Cone parametrized in cylindrical coordinates
    x = v*math.cos(u)
    y = v*math.sin(u)
    z = v
    domain = [0, 2*pi]x[0, 2]
"""


import math

def func(u,v):
    u_val = 2*math.pi*u
    v_val = 2*v
    pt_out = Point(v_val*math.cos(u_val), v_val*math.sin(u_val), v_val)
    return pt_out
    
a.put(func)
# ---------- end decodes_3 ----------
decodes_4 = DecodesPythonScript()  # -> console, a
# ---------- decodes_4: Python ----------
"""
Torus 
    x = 0.5*(2+math.cos(v))*math.cos(u)
    y = 0.5*(2+math.cos(v))*math.sin(u)
    z = math.sin(v)
    domain = [0, 2*pi]x[0, 2*pi]
"""

import math

def func(u,v):
    u_val = 2*math.pi*u
    v_val = 2*math.pi*v
    pt_out = Point(0.5*(2+ math.cos(v_val))*math.cos(u_val), 0.5*(2+math.cos(v_val))*math.sin(u_val), math.sin(v_val))
    return pt_out
    
print func(0,0)
a.put(func)
# ---------- end decodes_4 ----------
res_u = Slider(15, range=4..50)
res_v = Slider(17, range=2..20)
# Meshing for surfaces parametrized from [0,1]x[0,1]
# Surface expressed as a mesh aligned with isocurves for u, v determined by res_u and res_v
decodes_5 = DecodesPythonScript(func=decodes_4.a, res_u=res_u, res_v=res_v)  # -> console, a
# ---------- decodes_5: Python ----------
#IN:   a function f(u,v) describing a parametric surface on the domain [0,1]x[0,1]
#OUT:  Surface expressed as a mesh aligned with isocurves for u, v determined by res_u and res_v 


count_u = int(res_u)
count_v = int(res_v)
tol_u = 1.0/res_u
tol_v = 1.0/res_v
u_vals = [i*tol_u for i in range(count_u+1)]
v_vals = [i*tol_v for i in range(count_v+1)]

#Expressed as a mesh with faces determined by isocurves
msh = Mesh()
for v in v_vals:
    for u in u_vals:
        msh.append(func(u,v))

for j in range(count_v):
    row = j*(count_u+1)
    for i in range(count_u):
        pi_0 = row+i
        pi_1 = row+i+1
        pi_2 = row+i+count_u+2
        pi_3 = row+i+count_u+1
        msh.add_face(pi_0,pi_1,pi_2,pi_3)

a.put(msh)
# ---------- end decodes_5 ----------
# Surface expressed as a mesh, simple triangulation style
decodes_6 = DecodesPythonScript(func=decodes_4.a, res_u=res_u, res_v=res_v)  # -> console, a
# ---------- decodes_6: Python ----------
#IN:   a function f(u,v) describing a parametric surface on the domain [0,1]x[0,1]
#OUT:  Surface expressed as a mesh, simple triangulation style

count_u = int(res_u)
count_v = int(res_v)
tol_u = 1.0/res_u
tol_v = 1.0/res_v
u_vals = [i*tol_u for i in range(count_u+1)]
v_vals = [i*tol_v for i in range(count_v+1)]

msh = Mesh()
for v in v_vals:
    for u in u_vals:
        msh.append(func(u,v))

for j in range(count_v):
    row = j*(count_u+1)
    for i in range(count_u):
        pi_0 = row+i
        pi_1 = row+i+1
        pi_2 = row+i+count_u+2
        pi_3 = row+i+count_u+1
        msh.add_face(pi_0,pi_1,pi_2)
        msh.add_face(pi_0, pi_2, pi_3)

a.put(msh)
# ---------- end decodes_6 ----------
