# Grasshopper definition test.gh (Grasshopper 0.9.14)
# plug-ins: Decodes Python Interpreter

decodes = DecodesPythonScript(x=Slider(1.3, range=0..10))  # -> out, a
# ---------- decodes: Python ----------
pt = Point(x,x)
print pt
a.put(pt)
# ---------- end decodes ----------
