# Grasshopper definition test.ghx (Grasshopper 0.9.14)
# plug-ins: Decodes Python Interpreter

decodes = DecodesPythonScript()  # -> console, a
# ---------- decodes: Python ----------
p = Point(2,3,0)
a.put(p)
# ---------- end decodes ----------
