# Grasshopper definition torus circles.ghx (Grasshopper 0.9.14)
# plug-ins: Decodes Python Interpreter

r = Slider(2, range=2..5)
R = Slider(5, range=5..10)
phi = Slider(5.11, range=0..6.283)
md_slider = MDSlider(
    slider_value=Point(1, 0.6552514797, 0.5),
    x_domain=Domain(0, 6.283),
    y_domain=Domain(0, 6.283),
    z_domain=Domain(0, 1),
    SliderMode=0)
decodes = DecodesPythonScript(r=r, R=R)  # -> console, a, domain; disabled
# ---------- decodes: Python ----------
"""
Ring Torus - standard parametrization as a surface of revolution 
    x = (R + r*math.cos(v))*math.cos(u)
    y = (R + r*math.cos(v))*math.sin(u)
    z = r*math.sin(v)
    R > r > 0
    domain = [0, 2*pi]x[0, 2*pi]
"""

import math

def func(u,v):
    rho = R + r*math.cos(v)
    pt_out = Point(rho*math.cos(u), rho*math.sin(u), r*math.sin(v))
    return pt_out

 
a.put(func)
domain.put([0, 2*math.pi, 0, 2*math.pi])
# ---------- end decodes ----------
res_v = Slider(18, range=2..20)
res_u = Slider(23, range=4..50)
decodes_2 = DecodesPythonScript(r=r, R=R, ipt=md_slider)  # -> console, a, circles
# ---------- decodes_2: Python ----------
"""
Draws 
Draws family of 4 circles -- parallel, meridian, Villarceau (2)
given a point defined by parameters phi, theta, R(max plane or major 
radius) and r(tube or minor radius).   
func1-4 are parametrizations for a coordinate system with x-axis through the point in question
ref: 
http://kurtnalty.com/Villarceau.pdf 
Weisstein, Eric W. "Villarceau Circles." From MathWorld--A Wolfram Web Resource. http://mathworld.wolfram.com/VillarceauCircles.html
"""

import math

pi = math.pi
#normal coordinates
theta = ipt.x
phi = ipt.y
rot_theta = Xform.rotation(axis = Vec(0,0,1), angle = theta)

#tilt angle for Villarceau circles
alpha = math.asin(r/R)
cos_alpha = math.cos(alpha)
sin_alpha = math.sin(alpha)
cos_gamma = -r*math.sin(phi)/(R*sin_alpha)
psi_v1 = math.atan2(R*math.sqrt(1-cos_gamma*cos_gamma) + r, R*cos_alpha*cos_gamma)  
print math.degrees(psi_v1)
rot_psi_v1 = Xform.rotation(axis = Vec(0,0,1), angle = -psi_v1)



#Parallel circles (t = "theta")
def func1(t):
    rho = R + r*math.cos(phi)
    x = rho*math.cos(t)
    y = rho*math.sin(t)
    z = r*math.sin(phi)
    pt_out = Point(x,y,z)
    return pt_out
    
#Meridian circles (t = "phi")
def func2(t):
    x1 = R + r*math.cos(t)
    y1 = 0
    z1 = r*math.sin(t)
    pt_out = Point(x1,y1,z1)
    return pt_out

#Villarceau #1  (t = "gamma")
def func3(t):
    #t_v = t + 0.5*pi
    x1 = R*math.cos(alpha)*math.cos(t)
    y1 = R*math.sin(t) + r
    z1 = -R*math.sin(alpha)*math.cos(t)
    pt_out = Point(x1,y1,z1)*rot_psi_v1
    return pt_out
    
#Villarceau #2
def func4(t):
    t_v = t + 0.5*pi
    x = R*math.cos(alpha)*math.cos(t_v)
    y = R*math.sin(t_v) - r
    z = -R*math.sin(alpha)*math.cos(t_v)
    pt_out = Point(x,y,z)*rot_psi_v2
    return pt_out

def circle_3pts(p0, p1, p2):
    v1 = Vec(p1-p0)
    v2 = Vec(p2-p0)
    v3 = Vec(p1-p2)
    rad = 0.5*v1.length*v2.length*v3.length/(v1*v3).length
    denom = 2*(v1.cross(v3).length)*(v1.cross(v3).length)
    a1 = v3.length*v3.length*v1.dot(v2)/denom
    a2 = v2.length*v2.length*v1.dot(v3)/denom
    a3 = v1.length*v1.length*(-v2.dot(v3))/denom
    center = p0*a1 + p1*a2 + p2*a3
    pln = Plane(center, v1.cross(v2))
    return Circle(pln,rad)
    

pt_out = func1(0)*rot_theta
a.put(pt_out)
circ1 = circle_3pts(func1(0), func1(0.5*pi), func1(pi))
circles.put(circ1*rot_theta)
circ2 = circle_3pts(func2(0), func2(0.5*pi), func2(pi))
circles.put(circ2*rot_theta)
circ3 = circle_3pts(func3(0), func3(0.5*pi), func3(pi))
circles.put(circ3*rot_theta)
#circ4 = circle_3pts(func4(0), func4(0.5*pi), func4(pi))
#circles.put(circ4*rot_theta)
# ---------- end decodes_2 ----------
decodes_3 = DecodesPythonScript(r=r, R=R)  # -> console, a, circles
# ---------- decodes_3: Python ----------
#FIX - circles are being generated but circles not going through the given point
"""
Draws family of 4 circles -- parallel, meridian, Villarceau (2)
given a point defined with parameters phi, theta, R(max plane or major 
radius) and r(tube or minor radius).   
func1-4 are parametrizations for a coordinate system with x-axis through the point in question
ref: 
http://kurtnalty.com/Villarceau.pdf 
Weisstein, Eric W. "Villarceau Circles." From MathWorld--A Wolfram Web Resource. http://mathworld.wolfram.com/VillarceauCircles.html
"""

import math

pi = math.pi
theta = ipt.x
phi = ipt.y

gamma = phi

alpha = math.asin(r/R)
rot_theta = Xform.rotation(axis = Vec(0,0,1), angle = theta)
c = r*math.sin(phi)/R*math.sin(alpha)
psi = math.atan2(R*math.sqrt(1-c*c) + r, R*math.cos(alpha)*c)
rot_psi = Xform.rotation(axis = Vec(0,0,1), angle = -psi)



#Parallel
def func1(t):
    rho = R + r*math.cos(phi)
    x = rho*math.cos(t)
    y = rho*math.sin(t)
    z = r*math.sin(phi)
    pt_out = Point(x,y,z)
    return pt_out
    
#Meridian
def func2(t):
    x1 = R + r*math.cos(t)
    y1 = 0
    z1 = r*math.sin(t)
    pt_out = Point(x1,y1,z1)
    return pt_out

#Villarceau #1 
def func3(t):
    x1 = -R*math.cos(alpha)*math.cos(t)
    y1 = R*math.sin(t) + r
    z1 = -r*math.cos(t)
    pt_out = Point(x1,y1,z1)*rot_psi
    #x1 = r + R*math.cos(t)
    #y1 = R*math.cos(alpha)*math.sin(t)
    #z1 = r*math.sin(t)
    #pt_out = Point(x1,y1,z1)*rot_psi
    return pt_out
    
#Villarceau #2
def func4(t):
    x = R*math.cos(t)*math.cos(alpha)
    y = R*math.sin(t) - r
    z = -R*math.sin(alpha)*math.cos(t)
    pt_out = Point(x,y,z)*rot_psi
    return pt_out

def circle_3pts(p0, p1, p2):
    v1 = Vec(p1-p0)
    v2 = Vec(p2-p0)
    v3 = Vec(p1-p2)
    rad = 0.5*v1.length*v2.length*v3.length/(v1*v3).length
    denom = 2*(v1.cross(v3).length)*(v1.cross(v3).length)
    a1 = v3.length*v3.length*v1.dot(v2)/denom
    a2 = v2.length*v2.length*v1.dot(v3)/denom
    a3 = v1.length*v1.length*(-v2.dot(v3))/denom
    center = p0*a1 + p1*a2 + p2*a3
    print center, rad
    pln = Plane(center, v1.cross(v2))
    return Circle(pln,rad)
    

pt_out = func1(theta)
print r, R
a.put(pt_out)
circ1 = circle_3pts(func1(0), func1(0.5*pi), func1(pi))
circles.put(circ1*rot_theta)
circ2 = circle_3pts(func2(0), func2(0.5*pi), func2(pi))
circles.put(circ2*rot_theta)
circ3 = circle_3pts(func3(0), func3(0.5*pi), func3(pi))
circles.put(circ3*rot_theta)
#circ4 = circle_3pts(func4(0), func4(0.5*pi), func4(pi))
#circles.put(circ4)
# ---------- end decodes_3 ----------
panel = Panel(decodes_2.console)
decodes_4 = DecodesPythonScript()  # -> console, a, b; disabled
# ---------- decodes_4: Python ----------
"""
Torus 
    x = (R + r*math.cos(v))*math.cos(u)
    y = (R + r*math.cos(v))*math.sin(u)
    z = r*math.sin(v)
    domain = [0, 2*pi]x[0, 2*pi]
"""

import math



def torus_1(u,v):
    u_val = 2*math.pi*u
    v_val = 2*math.pi*v
    rho = R + r*math.cos(v_val)
    pt_out = Point(rho*math.cos(u_val), rho*math.sin(u_val), r*math.sin(v_val))
    return pt_out


#Alternate parametrization that gives isocurves along the Villarceau circles
#[FIX - need to do change of coords]
#v = 'phi'
#u = 'theta'
def torus_2(u,v):
    tilt = r/R
    alpha = math.asin(tilt)
    u_val = 2*math.pi*u
    v_val = 2*math.pi*v
    gamma = v_val
    
    rho = R+math.cos(v_val)*r
    x_ref = rho*math.cos(u_val)
    y_ref = rho*math.sin(u_val)
    z_ref = r*math.cos(v_val)
    
    x_2 = x_ref
    y_2 = y_ref
    z_2 = z_ref
    
    x_1 = r + R*math.cos(gamma)
    y_1 = R*math.sin(gamma)*math.cos(alpha)
    z_1 = r*math.sin(gamma)
    
    psi = math.atan2(x_1*y_2 - x_2*y_1, x_1*x_2 + y_1*y_2)
      
    x_2 = x_1*math.cos(psi) - y_1*math.sin(psi)
    y_2 = x_1*math.sin(psi) + y_1*math.cos(psi)
    z_2 = z_1
    
    pt_out = Point(x_2, y_2, z_2)
    return pt_out
 
 
a.put(torus_1)

b.put(torus_2)
# ---------- end decodes_4 ----------
decodes_5 = DecodesPythonScript(domain=decodes.domain, res_u=res_u, res_v=res_v)  # -> console, a; inputs domain: list
# ---------- decodes_5: Python ----------
#IN:   a function f(u,v) describing a parametric surface on a rectangular domain
#OUT:  Surface expressed as a mesh, simple triangulation style

u0 = domain[0]
u1 = domain[1]
v0 = domain[2]
v1 = domain[3]

count_u = int(res_u)
count_v = int(res_v)
tol_u = (u1-u0)/res_u
tol_v = (v1-v0)/res_v
u_vals = [u0 + i*tol_u for i in range(count_u+1)]
v_vals = [v0 + i*tol_v for i in range(count_v+1)]


msh = Mesh()
for v in v_vals:
    for u in u_vals:
        msh.append(func(u,v))

for j in range(count_v):
    for i in range(count_u):
        index = j*(count_u + 1) + i
        msh.add_face(index,index + 1, index + count_u + 2)
        msh.add_face(index, index + count_u + 2, index + count_u + 1)

a.put(msh)
# ---------- end decodes_5 ----------
decodes_6 = DecodesPythonScript(func=decodes.a, domain=decodes.domain, res_u=res_u, res_v=res_v)  # -> console, a; inputs domain: list
# ---------- decodes_6: Python ----------
#IN:   a function f(u,v) describing a parametric surface on a rectamgular domain
#OUT:  Surface expressed as a mesh aligned with isocurves for u, v determined by res_u and res_v 

import math

u0 = domain[0]
u1 = domain[1]
v0 = domain[2]
v1 = domain[3]

count_u = int(res_u)
count_v = int(res_v)
tol_u = (u1-u0)/count_u
tol_v = (v1-v0)/count_v
u_vals = [u0 + i*tol_u for i in range(count_u+1)]
v_vals = [v0 + i*tol_v for i in range(count_v+1)]

#Expressed as a mesh with faces determined by isocurves
msh = Mesh()
for v in v_vals:
    for u in u_vals:
        msh.append(func(u,v))

for j in range(count_v):
    for i in range(count_u):
        index = j*(count_u + 1) + i
        msh.add_face(index,index + 1, index + count_u + 2 , index + count_u + 1)

a.put(msh)
# ---------- end decodes_6 ----------
