# Grasshopper definition translational surfaces.ghx (Grasshopper 0.9.14)
# plug-ins: Decodes Python Interpreter

slider = Slider(4, range=0..10)  # disabled
panel = Panel("A hyperbolic paraboloid")  # disabled
# Another wavy surface, a la Savill Gardens gridshell
panel_2 = Panel("A wavy surface")  # disabled
# Translational Surface defined by two curves (each defined by a set of input control points).  VERY SLOW!
pi = Pi(Factor=slider)  # disabled
range = Range(Domain=pi, Steps=10)  # disabled
range_2 = Range(Domain=Domain(0, 1), Steps=10)  # disabled
sin = Sine(Value=range)  # disabled
bnd = Bounds(Numbers=sin)  # disabled
remap = RemapNumbers(Value=sin, Source=bnd, Target=Domain(0, 1))  # disabled
pt = PointXYZ(XComponent=range_2, YComponent=0, ZComponent=remap, System=PlaneXY(0, 0, 0))  # disabled
pt_2 = PointXYZ(XComponent=0, YComponent=range_2, ZComponent=remap, System=PlaneXY(0, 0, 0))  # disabled
decodes = DecodesPythonScript(crv_pts=pt, rail_pts=pt_2)  # -> console, a, b; inputs crv_pts: list, rail_pts: list; disabled
# ---------- decodes: Python ----------
def func(u,v):
    rail = Curve.bezier(rail_pts)
    vec = crv_pts[0] - rail.eval(u)
    new_crv = Curve.bezier([pt - vec for pt in crv_pts])
        
    return new_crv.eval(v).origin

a.put(func)
# ---------- end decodes ----------
decodes_2 = DecodesPythonScript(h=Slider(4, range=1..4), w=Slider(12, range=8..12))  # -> console, a
# ---------- decodes_2: Python ----------
# A translational surface a la Savill Gardens Gridshell 
# crv and rail are the same curve

import math

def func_crv(t):
    return Point(t, 0, (h/2)*math.cos(2*math.pi*t/w))

def func_rail(t):
    return Point(0, t, (h/2)*math.cos(2*math.pi*t/w))


crv = Curve(func_crv,Interval(-w/2, w/2))
rail = Curve(func_rail,Interval(-w/2, w/2))
origin = Point(0,0,h/2)

def func(u,v):
    u_value = rail.domain.length*u + rail.domain.a
    v_value = crv.domain.length*v + crv.domain.a
    vec = origin - rail.deval(u_value).origin
    return crv.deval(v_value).origin - vec
   
a.put(func)
# ---------- end decodes_2 ----------
decodes_3 = DecodesPythonScript()  # -> console, a
# ---------- decodes_3: Python ----------
#A hyperbolic parabolic consructed as a translational surface of the two curves
#(2t, 0, 2*t*t) and (0, 2*t, -2*t*t).  Parametrized on the domain [0,1]x[0,1].  

def func_crv(t):
    return Point(2*t, 0, 2*t*t)

def func_rail(t):
    return Point(0, 2*t, -2*t*t)
   

crv = Curve(func_crv,Interval(-2,2))
rail = Curve(func_rail, Interval(-2,2))
origin = Point(0,0,0)

def func(u,v):
    u_value = rail.domain.length*u + rail.domain.a
    v_value = crv.domain.length*v + crv.domain.a
    vec = origin - rail.deval(u_value).origin
    return crv.deval(v_value).origin - vec
   
a.put(func)
# ---------- end decodes_3 ----------
decodes_4 = DecodesPythonScript()  # -> console, a
# ---------- decodes_4: Python ----------
# A wavy translational surface

import math

def func_crv(t):
    return Point(t, 0, math.sin(t))

def func_rail(t):
    return Point(0, 2*t, -t*t)
    
crv = Curve(func_crv,Interval(0,4.5*math.pi))
rail = Curve(func_rail, Interval(-2,2))
origin = Point(0,0,0)

def func(u,v):
    u_value = rail.domain.length*u + rail.domain.a
    v_value = crv.domain.length*v + crv.domain.a
    vec = origin - rail.deval(u_value).origin
    return crv.deval(v_value).origin - vec
   
a.put(func)
# ---------- end decodes_4 ----------
res_u = Slider(18, range=4..50)
res_v = Slider(18, range=2..20)
# Recursive Subdivision of a Translational Surface
decodes_5 = DecodesPythonScript()  # -> console, a
# ---------- decodes_5: Python ----------
# Parametrized on the domain [0,1]x[0,1].  

def func_crv(t):
    return Point(t, 0, t*t*t/3.0 + t*t)

def func_rail(t):
    return Point(0, t, -1.5*t*t)

crv = Curve(func_crv,Interval(-2,1.5))
rail = Curve(func_rail, Interval(-1,1))
origin = Point(0,0,0)

def func(u,v):
    u_value = rail.domain.length*u + rail.domain.a
    v_value = crv.domain.length*v + crv.domain.a
    vec = origin - rail.deval(u_value).origin
    return crv.deval(v_value).origin - vec
   
a.put(func)
# ---------- end decodes_5 ----------
slider_2 = Slider(0.25, range=0..1)
decodes_6 = DecodesPythonScript(func_in=decodes_5.a, threshold=Slider(1.602, range=0.1..2))  # -> console, a
# ---------- decodes_6: Python ----------
#IN:  a function defining a translational surface parametrized on the domain [0,1]x[0,1]

def func_u(t):
    return func_in(0,t)

def func_v(t):
    return func_in(t,0)
 
def calc_curvature(func_crv,t):
    #nearest neighbors of point in question; used for discrete approximations 
    #calculations;
    res_curvature = grid_res
    pt_out = func_crv(t)
    if (t == 0):
        pt_t = func_crv(0.1*res_curvature)
        pt_plus = func_crv(0.2*res_curvature)
        pt_minus = func_crv(0)    
    elif (t > 0) and (t < 0.5*res_curvature):
        pt_t = pt_out
        pt_plus = func_crv(2*t)
        pt_minus = func_crv(0)
    elif (t > 1-0.5*res_curvature) and (t < 1):
        pt_t = pt_out
        pt_plus = func_crv(1)
        pt_minus = func_crv(0.5*t)
    elif (t == 1):
        pt_t = func_crv(1-0.1*res_curvature)
        pt_plus = func_crv(1)
        pt_minus = func_crv(1-0.2*res_curvature)
    else:
        pt_t = pt_out
        pt_plus = func_crv(t + 0.5*res_curvature)
        pt_minus = func_crv(t - 0.5*res_curvature)

    #calculates the curvature at t with grid_resolution grid_res
    v1 = Vec(pt_plus - pt_t)
    v2 = Vec(pt_minus - pt_t)
    v3 = Vec(pt_plus - pt_minus)
    rad_osc = 0.5*v1.length*v2.length*v3.length/(v1*v3).length
    return 1.0/rad_osc
       

def decomposeSurface(u0, u1, v0, v1):
    i0 = int(grid_count*u0)
    i1 = int(grid_count*u1)
    j0 = int(grid_count*v0)
    j1 = int(grid_count*v1)
    print i0, i1, j0, j1
    if (i1 > i0+1) and (j1 > j0+1):
        max_curvature = max(max(curvature_u[i0: i1+1]), max(curvature_v[j0:j1+1]))
        #print "max curvature", max_curvature
        if (max_curvature > threshold):
            u_mid = (u0 + u1)/2
            v_mid = (v0 + v1)/2
            decomposeSurface(u0, u_mid, v0, v_mid)
            decomposeSurface(u_mid, u1, v0, v_mid)
            decomposeSurface(u0, u_mid, v_mid, v1)
            decomposeSurface(u_mid, u1, v_mid, v1)
        else:
            print "panel outputed"
            index0= j0*(grid_count+1)+i0
            index1= j0*(grid_count+1)+i1
            index2= j1*(grid_count+1)+i1
            index3= j1*(grid_count+1)+i0
            msh.add_face(index0, index1, index2, index3)
    else:
        index0= j0*(grid_count+1)+i0
        index1= j0*(grid_count+1)+i1
        index2= j1*(grid_count+1)+i1
        index3= j1*(grid_count+1)+i0
        msh.add_face(index0, index1, index2, index3)


            
grid_count = 32
grid_res = 1.0/grid_count

curvature_u = [calc_curvature(func_u, i*grid_res) for i in range(grid_count+1)]
curvature_v = [calc_curvature(func_v, j*grid_res) for j in range(grid_count+1)] 

print curvature_u, curvature_v

msh = Mesh()
for i in range(grid_count+1):
    for j in range(grid_count+1):
        msh.append(func_in(i*grid_res,j*grid_res))

decomposeSurface(0,1,0,1)
a.put(msh)
# ---------- end decodes_6 ----------
decodes_7 = DecodesPythonScript(res_u=res_u, res_v=res_v)  # -> console, a
# ---------- decodes_7: Python ----------
#IN:   a function f(u,v) describing a parametric surface on the domain [0,1]x[0,1]
#OUT:  Surface expressed as a set of points func(u,v) for (u,v) determined by res_u, res_v

count_u = int(res_u)
count_v = int(res_v)
tol_u = 1.0/res_u
tol_v = 1.0/res_v
u_vals = [i*tol_u for i in range(count_u+1)]
v_vals = [i*tol_v for i in range(count_v+1)]

#Expressed as a set of points
pts_out = []
for v in v_vals:
    for u in u_vals:
        pts_out.append(func(u,v))
a.put(pts_out)
# ---------- end decodes_7 ----------
# Surface expressed as a quad mesh aligned with isocurves for u, v determined by res_u and res_v
decodes_8 = DecodesPythonScript(res_u=res_v, res_v=res_u)  # -> console, a
# ---------- decodes_8: Python ----------
#IN:   a function f(u,v) describing a parametric surface on the domain [0,1]x[0,1]
#OUT:  Surface expressed as a mesh aligned with isocurves for u, v determined by res_u and res_v 


count_u = int(res_u)
count_v = int(res_v)
tol_u = 1.0/res_u
tol_v = 1.0/res_v
u_vals = [i*tol_u for i in range(count_u+1)]
v_vals = [i*tol_v for i in range(count_v+1)]

#Expressed as a mesh with faces determined by isocurves
msh = Mesh()
for v in v_vals:
    for u in u_vals:
        msh.append(func(u,v))

for j in range(count_v):
    row = j*(count_u+1)
    for i in range(count_u):
        pi_0 = row+i
        pi_1 = row+i+1
        pi_2 = row+i+count_u+2
        pi_3 = row+i+count_u+1
        msh.add_face(pi_0,pi_1,pi_2,pi_3)

a.put(msh)
# ---------- end decodes_8 ----------
# Surface expressed as a mesh, simple triangulation style
decodes_9 = DecodesPythonScript(res_u=res_v, res_v=res_u)  # -> console, a
# ---------- decodes_9: Python ----------
#IN:   a function f(u,v) describing a parametric surface on the domain [0,1]x[0,1]
#OUT:  Surface expressed as a mesh, simple triangulation style

count_u = int(res_u)
count_v = int(res_v)
tol_u = 1.0/res_u
tol_v = 1.0/res_v
u_vals = [i*tol_u for i in range(count_u+1)]
v_vals = [i*tol_v for i in range(count_v+1)]

msh = Mesh()
for v in v_vals:
    for u in u_vals:
        msh.append(func(u,v))

for j in range(count_v):
    row = j*(count_u+1)
    for i in range(count_u):
        pi_0 = row+i
        pi_1 = row+i+1
        pi_2 = row+i+count_u+2
        pi_3 = row+i+count_u+1
        msh.add_face(pi_0,pi_1,pi_2)
        msh.add_face(pi_0, pi_2, pi_3)

a.put(msh)
# ---------- end decodes_9 ----------
decodes_10 = DecodesPythonScript()  # -> console, a; disabled
# ---------- decodes_10: Python ----------
#IN:   a function f(u,v) describing a parametric surface on the domain [0,1]x[0,1]
#OUT:  Surface expressed as a quad mesh, defined by the diagonals

count_u = int(res_u)
count_v = int(res_v)
tol_u = 1.0/res_u
tol_v = 1.0/res_v
u_vals = [i*tol_u for i in range(count_u+1)]
v_vals = [i*tol_v for i in range(count_v+1)]

msh = Mesh()
for v in v_vals:
    for u in u_vals:
        msh.append(func(u,v))

for i in range(count_u):
    pi_0 = i
    pi_1 = i + 1
    pi_2 = i + count_u + 2
    msh.add_face(pi_0,pi_1,pi_2)
    
for j in range(1, count_v - 1):
    row = j*(count_u+1)
    for i in range(count_u):
        pi_0 = row+i
        pi_1 = row+i-count_u-1
        pi_2 = row+i+1
        pi_3 = row+i+count_u+2
        msh.add_face(pi_0,pi_1,pi_2, pi_3)
 
row = j*(count_u + 1)
for i in range(count_u):
    pi_0 = row + i
    pi_1 = row + i + count_u + 2
    pi_2 = row + i + count_u + 1
    msh.add_face(pi_0, pi_1, pi_2)
     
a.put(msh)
# ---------- end decodes_10 ----------
# Surface expressed as a set of points func(u,v) for (u,v) determined by res_u, res_v
crv = Curve(Vertices=decodes_7.a, Degree=3, Periodic=False)  # -> Curve, Length, Domain
panel_3 = Panel(decodes_6.console)
