# Grasshopper definition tweened curve.ghx (Grasshopper 0.9.14)
# plug-ins: Decodes Python Interpreter

slider = Slider(8.608, range=1..10)
slider_2 = Slider(6.386, range=1..10)
panel = Panel("Releaux Triangle")
# Boundary of a rectangle with height h and width w
slider_3 = Slider(8.252, range=1..10)
panel_2 = Panel("Ellipse ")
panel_3 = Panel("Astroid")
panel_4 = Panel("Diamond")
decodes = DecodesPythonScript(len_x=slider, len_y=slider_2)  # -> console, a
# ---------- decodes: Python ----------
import math

def func(t):
    c = math.cos(2*math.pi*t)
    s = math.sin(2*math.pi*t)
    pt_out = Point(len_x*c, len_y*s)
    return pt_out
     

a.put(func)
# ---------- end decodes ----------
decodes_2 = DecodesPythonScript(len_x=slider, len_y=slider_2)  # -> console, a
# ---------- decodes_2: Python ----------
import math

import math

def func(t):
    c = math.cos(2*math.pi*t)
    s = math.sin(2*math.pi*t)
    pt_out = Point(len_x*c*c*c, len_y*s*s*s)
    return pt_out
     

a.put(func)
# ---------- end decodes_2 ----------
decodes_3 = DecodesPythonScript(len_x=slider, len_y=slider_2)  # -> console, a
# ---------- decodes_3: Python ----------
import math

def func(t):
    c = math.cos(2*math.pi*t)
    s = math.sin(2*math.pi*t)
    pt_out = Point(len_x*abs(c)*c, len_y*abs(s)*s)
    return pt_out
     

a.put(func)
# ---------- end decodes_3 ----------
panel_5 = Panel("Teardrop")  # disabled
decodes_4 = DecodesPythonScript(len_x=slider, len_y=slider_2, n=Slider(4, range=1..10))  # -> console, a
# ---------- decodes_4: Python ----------
import math

def func(t):
    c = math.cos(2*math.pi*t)
    s = math.sin(2*math.pi*t)
    pt_out = Point(len_x*c, len_y*(math.sin(math.pi*t)**n)*s)
    return pt_out

print func(0.2)
a.put(func)
# ---------- end decodes_4 ----------
decodes_5 = DecodesPythonScript(rec_w=slider_3, rec_h=Slider(8.26, range=1..10))  # -> console, a
# ---------- decodes_5: Python ----------
def func(t):
    if (t>=0) and (t<0.25): 
        ln = Line( Point(-rec_w/2,-rec_h/2), Point(rec_w/2,-rec_h/2) )
        pt_out = ln.eval(t*4.0)
    elif (t>=0.25) and (t<0.5): 
        ln = Line( Point(rec_w/2,-rec_h/2), Point(rec_w/2,rec_h/2) )
        pt_out = ln.eval((t-0.25)*4.0)
    elif (t>=0.5) and (t<0.75): 
        ln = Line( Point(rec_w/2,rec_h/2), Point(-rec_w/2,rec_h/2) )
        pt_out = ln.eval((t-0.5)*4.0)
    elif (t>=0.75) and (t<=1.0): 
        ln = Line( Point(-rec_w/2,rec_h/2), Point(-rec_w/2,-rec_h/2) )
        pt_out = ln.eval((t-0.75)*4.0)
    else: print "wtf?"
      
    return pt_out
    

a.put(func)
# ---------- end decodes_5 ----------
decodes_6 = DecodesPythonScript(rad=Slider(9.82, range=1..10))  # -> console, a
# ---------- decodes_6: Python ----------
import math

#Releaux Triangle 
#vertices at p1, p2, p3 as follows:
#factor = 1/math.sqrt(3)
#p1 = Point(0, rad*factor)
#p2 = Point(-rad/2, -rad*0.5*factor)
#p3 = Point(rad/2, -rad*0.5*factor)
#arc1 - center at p2, t in [0, pi/3]
#arc2 - center at p3, t in [2*pi/3, pi/2] 
#arc3 - center at p1, t in [4*pi/3, 5*pi/3]



def func(t):
    onethird = 1/3.0
    if (t >= 0) and (t < onethird):
        pt_out = Point(rad*math.cos(math.pi*t) - 0.5*rad, rad*math.sin(math.pi*t)-0.5*rad/math.sqrt(3))
    elif (t >= onethird) and (t < 2*onethird):
         pt_out = Point(rad*math.cos(math.pi*(t+onethird))+0.5*rad, rad*math.sin(math.pi*(t+onethird))-0.5*rad/math.sqrt(3))
    elif (t >= 2*onethird) and (t <=1):
         pt_out = Point(rad*math.cos(math.pi*(t+2*onethird)), rad*math.sin(math.pi*(t+2*onethird)) + rad/math.sqrt(3))
    else: print "yikes"
    
    return pt_out


a.put(func)
#Test
#count = 50
#pts = []
#for i in range(count+1):
#    pt = func(i/count)
#    print pt
#    pts.append(pt)    
#poly = PLine(pts)
#a.put(poly)
# ---------- end decodes_6 ----------
decodes_7 = DecodesPythonScript(m=Slider(0.665, range=0..1), func1=decodes.a, func2=decodes_4.a)  # -> console, a
# ---------- decodes_7: Python ----------
#Interpolates between two curves given by func1 and func2, both defined on [0,1]

def func(t):
    return func1(t)*(1-m) + func2(t)*m
      
crv_out = Curve(func ,Interval(0,1), 0.01)
a.put(crv_out)
# ---------- end decodes_7 ----------
