# Grasshopper definition fieldpacktest.gh (Grasshopper 0.9.14)
# plug-ins: Python Interpreter

pt = Point(Point(3.833260158, -5.129347685, 0))
pt_2 = Point(<point referenced from the Rhino model>)
line = Line(Line((13, -7, 0), (10, 19, 0)))
crv = Curve(<curve referenced from the Rhino model>)
python = PythonScript(mynumber=Slider(1, range=1..4), mypt=pt_2, myline=line, vec=crv, GhMemory=0)  # -> out, a, b; inputs vec: Curve
# ---------- python: Python ----------
import fieldpack as fp
from fieldpack import *
import rhinoscriptsyntax as rs
import math

inputs = ghenv.Component.Params.Input
for input in inputs :
    print input.NickName
    print input.TypeHint
    print input.Description
    print type(eval(input.NickName))
    print "----"

circles = []            # create a list. We will add IDs to it later on
radii = []              # ...and another one

for i in range(int(number)):
    pt = (i, math.cos(i), 0)             # a tuple (here for a point)
    id1 = rs.AddCircle(pt, 0.3)
    circles.append(id1)
    endPt = rs.PointAdd(pt, (0, 0.3, 0)) # move the point by the vector
    id2 = rs.AddLine(pt, endPt)
    radii.append(id2)

pt = fp.Point(2,2,2)


a = circles
b = fp.outies.rhinoUtil.VecToPoint3d(Point(2,2,2))
# ---------- end python ----------
panel = Panel(python.b)
panel_2 = Panel(python.a)
panel_3 = Panel(python.out)
