# Grasshopper definition gh in test.ghx (Grasshopper 0.9.14)
# plug-ins: Decodes Python Interpreter

# INNIE TEST
toggle = BooleanToggle(False)
msphere = MeshSphere(Base=PlaneXY(0, 0, 0), Radius=Slider(1.2, range=0..10), UCount=5, VCount=5)
Z = UnitZ(Factor=1)
ln = Line(StartPoint=Point(1, 1, 0), EndPoint=Point(2, 2, 0))
domain = Domain(Domain(0, 10))
_6 = Integer(69)
number = Number(3.141592654)
str = String("\"hello\"")
col = Colour(RGB(255, 129, 0))
pt = Point(Point(-2, 2, 2))
decodes = DecodesPythonScript(
    bool_in=toggle,
    int_in=_6,
    num_in=number,
    str_in=str,
    col_in=col,
    domain_in=domain,
    pt_in=pt,
    vec_in=Z,
    line_in=ln,
    mesh_in=msphere)  # -> console, bool_out, int_out, num_out, str_out, col_out, domain_out, pt_out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
# ---------- decodes: Python ----------
print bool_in
print int_in
print num_in
print str_in
print col_in
print domain_in
print pt_in
print vec_in
print line_in
print mesh_in

bool_out.put(bool_in)
int_out.put(int_in)
num_out.put(num_in)
str_out.put(str_in)
col_out.put(col_in)
domain_out.put(domain_in)
pt_out.put(pt_in)
vec_out.put(vec_in)
line_out.put(line_in)
mesh_out.put(mesh_in)
# ---------- end decodes ----------
panel = Panel(decodes.console)
