# Grasshopper definition arc test.gh (Grasshopper 0.9.14)
# plug-ins: Decodes Python Interpreter

decodes = DecodesPythonScript(x=Slider(0.48, range=0..1))  # -> console, a
# ---------- decodes: Python ----------
cs = CS(Point(1,1),Vec(1,1),Vec(0,0,1))
arc = Arc(cs,2.0,math.pi)
a.put(arc)

a.put(arc.deval(x))

for n in range(10):
    pln = arc.eval_pln(x)
    cs = CS(pln.origin,pln.normal,arc.basis.z_axis)
    arc = Arc(cs,2.0/(n+1),math.pi)
    a.put(arc)
# ---------- end decodes ----------
