# Grasshopper definition arc_split.gh (Grasshopper 0.9.75)
# plug-ins: Decodes Python Interpreter

decodes = DecodesPythonScript()  # -> console, a, b
# ---------- decodes: Python ----------
arc = Arc(CS(Point(),Vec(1,0),Vec(0,1,1)),10,math.pi*0.5)
#a.put(arc)

print arc.angle


   
arc = arc.reciprocal()
a.put(arc)


pln = Plane(Point(),Vec(1,0,1))
#a.put(pln)


sarcs = arc.split_by(pln)
b.put(sarcs)
# ---------- end decodes ----------
geo = Geometry(decodes.b)
geo_2 = Geometry(decodes.a)
item = ListItem(List=geo, Index=Slider(0, range=0..3), Wrap=True)
offset = Offset(Curve=item, Distance=1, Plane=PlaneXY(0, 0, 0), Corners=1)
