# Grasshopper definition based curve.gh (Grasshopper 0.9.14)
# plug-ins: Decodes Python Interpreter

pln = Plane(Plane(origin=(1.870189982, 3.18155263, 0), x=(0.8607331113, 0.509056491, 0), y=(-0.4466040616, 0.7551360413, 0.4799107952)))
decodes = DecodesPythonScript()  # -> console, a
# ---------- decodes: Python ----------
def func(t):
    return Point(t,math.sin(t))

cs = CS(Point(1,1),Vec(0,1),Vec(1,0))
crv = Curve(func,Interval(0,math.pi*2))

a.put(crv)

for n in range(10):
    a.put(crv.eval(n/10.0))
# ---------- end decodes ----------
decodes_2 = DecodesPythonScript(coordsys=pln)  # -> console, a
# ---------- decodes_2: Python ----------
def func(t):
    return Point(t,math.sin(t))

#cs = CS(Point(1,1),Vec(0,1),Vec(1,0))
crv = Curve(func,Interval(0,math.pi*2),basis=coordsys)

a.put(crv)

for n in range(10):
    a.put(crv.eval(n/10.0))
# ---------- end decodes_2 ----------
