# Grasshopper definition bezier_curves.ghx (Grasshopper 0.9.14)
# plug-ins: Decodes Python Interpreter

md_slider = MDSlider(
    slider_value=Point(0.712000068, 0.2880001068, 0.5),
    x_domain=Domain(-0.5, 1.5),
    y_domain=Domain(-0.5, 1.5),
    z_domain=Domain(0, 1),
    SliderMode=0)
slider = Slider(0.5696, range=0..1)

# ---- group: bezier through many points
pts = Point([Point(-0.9610811336, -2.074298095, 0), Point(-0.2385807026, -1.387942156, 0), Point(0.5472529461, -1.908522516, 0), Point(1.350597514, -1.351687855, 0), Point(2.074259354, -2.122590892, 0)])
decodes = DecodesPythonScript(pts=pts, t=Slider(0.3904, range=0..1))  # -> console, a, b; inputs pts: list
# ---------- decodes: Python ----------
crv = Curve.bezier(pts)
a.put(crv)
b.put(crv.eval(t))
# ---------- end decodes ----------
crv = Curve([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])
pt = Point(decodes.b)

# ----
cluster = Cluster(P=md_slider, Z=Slider(0, range=0..1))
pt_2 = Point(Point(0, 0, 0))
pt_3 = Point(cluster)
pt_4 = Point(Point(1, 1, 0))

# ---- group: hermite interp
decodes_2 = DecodesPythonScript(pa=pt_2, pb=pt_3, pc=pt_4, t=slider)  # -> console, a, b
# ---------- decodes_2: Python ----------
crv = Curve.hermite([pa,pb,pc])
a.put(crv)
b.put(crv.eval(t))
# ---------- end decodes_2 ----------
crv_2 = Curve(decodes_2.a)
pt_5 = Point(decodes_2.b)

# ---- group: bezier interp
decodes_3 = DecodesPythonScript(pa=pt_2, pb=pt_3, pc=pt_4, t=slider)  # -> console, a, b
# ---------- decodes_3: Python ----------
crv = Curve.bezier([pa,pb,pc])
a.put(crv)
b.put(crv.eval(t))
# ---------- end decodes_3 ----------
crv_3 = Curve(decodes_3.a)
pt_6 = Point(decodes_3.b)

# ==== cluster Cluster
Z = ClusterInput()
P = ClusterInput()
pcomp = Decompose(Point=P, System=PlaneXY(0, 0, 0))  # -> XComponent, YComponent, ZComponent
pt = PointXYZ(XComponent=pcomp.XComponent, YComponent=pcomp.YComponent, ZComponent=Z, System=PlaneXY(0, 0, 0))
pt_2 = ClusterOutput(pt)
