# Grasshopper definition bounds_test.gh (Grasshopper 0.9.14)
# plug-ins: Decodes Python Interpreter

pt = Point([Point(1.010692891, 4.928522549, 0), Point(6.774133133, 4.590818018, 0), Point(6.774133133, 4.590818018, 0), Point(5.655214512, 2.032293332, 0), Point(3.258668326, 7.752515304, 0)])
pt_2 = Point([Point(8.807890976, 2.369505626, 0), Point(9.653972004, 3.506793495, 0), Point(11.24863328, 3.105442626, 0)])
pt_3 = Point([Point(6.541468523, -4.808929388, 0), Point(8.125646664, -3.054283273, 2.214647221)])
bnd = Bounds2D(Coordinates=pt)
bnd_2 = Bounds2D(Coordinates=pt_2)
cluster = Cluster(L=pt_3, L_2=pt_3)  # -> X, Y, Z
dom = Domain²Components(Domain=bnd)  # -> UComponent, VComponent
dom_2 = Domain²Components(Domain=bnd_2)  # -> UComponent, VComponent
decodes = DecodesPythonScript(ixa=dom.UComponent, iya=dom.VComponent, ixb=dom_2.UComponent, iyb=dom_2.VComponent)  # -> console, a, b, c
# ---------- decodes: Python ----------
bnds_a = Bounds( ival_x = ixa , ival_y = iya )
bnds_b = Bounds( ival_x = ixb , ival_y = iyb )

print bnds_a.corners
print bnds_b.corners

a.put(PLine(bnds_a.corners))
b.put(PLine(bnds_b.corners))

if bnds_a.overlaps(bnds_b):
    print "overlap!"
# ---------- end decodes ----------
decodes_2 = DecodesPythonScript(divs=Slider(4, range=1..5), ix=cluster.X, iy=cluster.Y, iz=cluster.Z)  # -> console, a; inputs divs: Int32
# ---------- decodes_2: Python ----------
bnds = Bounds( ival_x = ix , ival_y = iy, ival_z = iz )


for sub_bnds in bnds//divs:
    a.put(PLine(sub_bnds.corners))
# ---------- end decodes_2 ----------
geo = Geometry(decodes.a)
geo_2 = Geometry(decodes.b)
decodes_3 = DecodesPythonScript(divs=Slider(5, range=0..10), ixa=dom.UComponent, iya=dom.VComponent)  # -> console, a; inputs divs: Int32
# ---------- decodes_3: Python ----------
bnds = Bounds( ival_x = ixa , ival_y = iya )


for sub_bnds in bnds//divs:
    a.put(PLine(sub_bnds.corners))
# ---------- end decodes_3 ----------
item = ListItem(List=decodes_3.a, Index=Slider(2, range=0..100), Wrap=False)

# ==== cluster Cluster
L = ClusterInput()
L_2 = ClusterInput()
item = ListItem(List=L_2, Index=1, Wrap=False)
item_2 = ListItem(List=L, Index=0, Wrap=False)
box = Box2Pt(PointA=item_2, PointB=item, Plane=PlaneXY(0, 0, 0))
box_2 = BoxComponents(Box=box)  # -> Plane, X, Y, Z
X = ClusterOutput(box_2.X)
Y = ClusterOutput(box_2.Y)
Z = ClusterOutput(box_2.Z)
