# Grasshopper definition change of basis.gh (Grasshopper 0.9.75)
# plug-ins: Decodes Python Interpreter

box = Box({Plane=PlaneXY(0, 0, 0), X=Domain(0, 8.620978522), Y=Domain(0, 3.304696365), Z=Domain(0, 0.4510041061)})
box_corners = BoxCorners(Box=box)  # -> CornerA, CornerB, CornerC, CornerD, CornerE, CornerF, CornerG, CornerH
pt = Point([box_corners.CornerA, box_corners.CornerB, box_corners.CornerC, box_corners.CornerD, box_corners.CornerE, box_corners.CornerF, box_corners.CornerG, box_corners.CornerH])
pln = Plane(Plane(origin=(22.33932473, -23.39137876, 0), x=(0.6790346959, -0.7341061788, 0), y=(0.7341061788, 0.6790346959, 0)))
pt_2 = Point([Point(0.8866834799, 0.5847295619, 0), Point(0.4753256524, 1.027506877, 0), Point(1.252708226, 1.371746164, 0)])
pln_2 = Plane(Plane(origin=(2.574752049, -3.331766027, 0), x=(0.8795624331, -0.4757834868, 0), y=(0.290790167, 0.5375724755, 0.791490311)))
pln_3 = Plane(Plane(origin=(2, 2, -2), x=(0.9520687661, -0.01516581145, 0.3055078769), y=(0.1255734716, 0.930105701, -0.3451589319)))
prot = RotatePlane(Plane=pln_2, Angle=Slider(0, range=0..10))
prot_2 = RotatePlane(Plane=pln_3, Angle=Slider(0.13, range=0..10))
pt_3 = Point([Point(0, 0, 0), Point(1, 0, 0), Point(0, 1, 0)])
md_slider = MDSlider(
    slider_value=Point(0.9750004411, 0.9625000954, 0.5),
    SliderMode=0,
    x_domain=Domain(0, 1),
    y_domain=Domain(0, 1),
    z_domain=Domain(0, 1))
decodes = DecodesPythonScript(src_cs=prot_2, tar_cs=prot, src_pt=pt_2)  # -> console, a, b
# ---------- decodes: Python ----------
pt_a = src_cs.eval(src_pt)
a.put(pt_a)

xf = Xform.change_basis( src_cs, tar_cs )

pt_b = pt_a * xf
b.put(pt_b)
# ---------- end decodes ----------
decodes_2 = DecodesPythonScript()  # -> console, a, b; disabled
# ---------- decodes_2: Python ----------
def change_basis(cs_src,cs_tar):
    """ Changes the plane basis of an object.            
        
        :param cs_src: CS source of the object.
        :type cs_src: CS
        :param cs_tar: CS plane of the object.
        :type cs_tar: CS
        :result: Transformation Matrix.
        :rtype: Xform
        
    """
    xg, yg, zg = Vec(1,0,0), Vec(0,1,0), Vec(0,0,1) # global coordinate basis vectors
    xs, ys, zs = cs_src.x_axis, cs_src.y_axis, cs_src.z_axis
    xt, yt, zt = cs_tar.x_axis, cs_tar.y_axis, cs_tar.z_axis
    xf_gs = Xform(matrix=[xs.dot(xg),xs.dot(yg),xs.dot(zg),0,ys.dot(xg),ys.dot(yg),ys.dot(zg),0,zs.dot(xg),zs.dot(yg),zs.dot(zg),0,0,0,0,1])
    xf_gs *= Xform.translation(-cs_src.origin) 
    xf_st = Xform(matrix=[xg.dot(xt),xg.dot(yt),xg.dot(zt),0,yg.dot(xt),yg.dot(yt),yg.dot(zt),0,zg.dot(xt),zg.dot(yt),zg.dot(zt),0,0,0,0,1])
    return Xform.translation(cs_tar.origin)* (xf_st * xf_gs )


xf = change_basis( src_cs, tar_cs )
print xf.m00, xf.m01, xf.m02, xf.m03
print xf.m10, xf.m11, xf.m12, xf.m13
print xf.m20, xf.m21, xf.m22, xf.m23
print xf.m30, xf.m31, xf.m32, xf.m33
print xf


pt_a = src_cs.eval(src_pt)
a.put(pt_a)

pt_b = pt_a * xf
print pt_b
b.put(pt_b)
# ---------- end decodes_2 ----------
decodes_3 = DecodesPythonScript()  # -> console, a, b; disabled
# ---------- decodes_3: Python ----------
def change_basis(cs_src,cs_tar):
    """ Changes the plane basis of an object.            
        
        :param cs_src: CS source of the object.
        :type cs_src: CS
        :param cs_tar: CS plane of the object.
        :type cs_tar: CS
        :result: Transformation Matrix.
        :rtype: Xform
        
    """
    xg, yg, zg = Vec(1,0,0), Vec(0,1,0), Vec(0,0,1) # global coordinate basis vectors
    xs, ys, zs = cs_src.x_axis, cs_src.y_axis, cs_src.z_axis
    xt, yt, zt = cs_tar.x_axis, cs_tar.y_axis, cs_tar.z_axis
    
    org_src = cs_src.origin
    
    #xf *= Xform.translation(cs_src.origin.inverted())
    #xf *= Xform.translation(Vec(cs_src.origin,cs_tar.origin))
    #xf *= Xform.translation(cs_src.origin)
    
    xf_gs = Xform()
    
    xf_gs.m00 = xs.dot(xg)
    xf_gs.m01 = xs.dot(yg)
    xf_gs.m02 = xs.dot(zg)
    #xf_gs.m03 = -org_src.x

    xf_gs.m10 = ys.dot(xg)
    xf_gs.m11 = ys.dot(yg)
    xf_gs.m12 = ys.dot(zg)
    #xf_gs.m13 = -org_src.y
    
    xf_gs.m20 = zs.dot(xg)
    xf_gs.m21 = zs.dot(yg)
    xf_gs.m22 = zs.dot(zg)
    #xf_gs.m23 = -org_src.z
    
    xf_gs *= Xform.translation(-cs_src.origin) 
    
    
    xf_st = Xform()
    xf_st.m00 = xg.dot(xt)
    xf_st.m01 = xg.dot(yt)
    xf_st.m02 = xg.dot(zt)#

    xf_st.m10 = yg.dot(xt)
    xf_st.m11 = yg.dot(yt)
    xf_st.m12 = yg.dot(zt)#
    
    xf_st.m20 = zg.dot(xt)#
    xf_st.m21 = zg.dot(yt)#
    xf_st.m22 = zg.dot(zt)
    
    return Xform.translation(cs_tar.origin)* (xf_st * xf_gs )
    #
    """
    
    xf.m00 = xs.dot(xt)
    xf.m10 = xs.dot(yt)
    xf.m20 = xs.dot(zt)

    xf.m01 = ys.dot(xt)
    xf.m11 = ys.dot(yt)
    xf.m21 = ys.dot(zt)
    
    xf.m02 = zs.dot(xt)
    xf.m12 = zs.dot(yt)
    xf.m22 = zs.dot(zt)
    """
    
    #print xf.m02, xf.m12, xf.m20, xf.m21
    
    #xf *= Xform.translation(cs_src.origin.inverted())
    
    



xf = change_basis( src_cs, tar_cs )
#xf = Xform.translation(Vec(1,2,3))

print xf.m00, xf.m01, xf.m02, xf.m03
print xf.m10, xf.m11, xf.m12, xf.m13
print xf.m20, xf.m21, xf.m22, xf.m23
print xf.m30, xf.m31, xf.m32, xf.m33
print xf


pt_a = src_cs.eval(src_pt)
a.put(pt_a)

pt_b = pt_a * xf
print pt_b
b.put(pt_b)
# ---------- end decodes_3 ----------
move = Move(Geometry=pt_3, Motion=md_slider)  # -> Geometry, Transform
pt_4 = Point(decodes.a)
pt_5 = Point(decodes.b)
pline = PolyLine(Vertices=pt_4, Closed=True)
pline_2 = PolyLine(Vertices=pt_5, Closed=True)
item = ListItem(List=decodes.b, Index=0, Wrap=True)
item_2 = ListItem(List=decodes.b, Index=1, Wrap=True)
item_3 = ListItem(List=decodes.b, Index=2, Wrap=True)
pl_3pt = Plane3Pt(PointA=item, PointB=item_2, PointC=item_3)
