# Grasshopper definition circle plane xsec test.gh (Grasshopper 0.9.65)
# plug-ins: Decodes Python Interpreter

Y = UnitY(Factor=1)
pln = Plane(Plane(origin=(0, 0, 1), x=(0, 1, 0), y=(-1, 0, 0)))
md_slider = MDSlider(
    slider_value=Point(0.358292696, 0.6585364923, 0.5),
    SliderMode=0,
    x_domain=Domain(0, 1),
    y_domain=Domain(-1, 1),
    z_domain=Domain(0, 1))
pi = Pi(Factor=Slider(0.2, range=0..1))
move = Move(Geometry=pln, Motion=Y)  # -> Geometry, Transform
number_slider = Slider(3.1, range=0..10)
deplane = DeconstructPlane(Plane=move.Geometry)  # -> Origin, XAxis, YAxis, ZAxis
panel = Panel("pi/4 to 4*pi/3")
pi_2 = Pi(Factor=Slider(0, range=0..2))
pi_3 = Pi(Factor=Slider(1.32, range=0..2))
rot3d = Rotate3D(Geometry=move.Geometry, Angle=pi, Center=Point(0, 0, 0), Axis=deplane.XAxis)  # -> Geometry, Transform
pl = PlaneNormal(Origin=Point(1, 0, 0), ZAxis=md_slider)
dom = ConstructDomain(DomainStart=pi_2, DomainEnd=pi_3)
pln_2 = Plane(PlaneYZ(0, 0, 0))
pln_3 = Plane(rot3d.Geometry)
cir = Circle(Plane=pln_3, Radius=number_slider)
arc = Arc(Plane=pln_3, Radius=number_slider, Angle=dom)  # -> Arc, Length
decodes = DecodesPythonScript(circ=cir, plane=pl)  # -> console, a
# ---------- decodes: Python ----------
xsec = Intersector()
xsec.of(plane.xy_plane,circ)

print xsec.log

a.put(xsec.results)
# ---------- end decodes ----------
decodes_2 = DecodesPythonScript(arc=arc.Arc, plane=pl)  # -> console, a, b
# ---------- decodes_2: Python ----------
xsec = Intersector()
if xsec.of(plane.xy_plane,arc):
    print "found intersections!"
    print xsec.log
else:
    print "no intersections!"
    print xsec.log
    
a.put(xsec.results)

b.put(arc.basis)
# ---------- end decodes_2 ----------
geo = Geometry(decodes_2.b)
geo_2 = Geometry(decodes_2.a)
panel_2 = Panel(decodes_2.console)
