# Grasshopper definition circle_by_two_pts_vec.gh (Grasshopper 0.9.14)
# plug-ins: Decodes Python Interpreter

pt = Point(Point(1.955790363, 4.531373447, 0))
pt_2 = Point(Point(-3.057644089, 7.947119996, 0))
pt_3 = Point(pt)
vec = Vector(Vector(-5.037460317, 0, 0))
decodes = DecodesPythonScript(pta=pt_2, ptb=pt_3, tan=vec)  # -> console, a
# ---------- decodes: Python ----------
plane = CS().xy_plane

vec_ab = Vec(pta,ptb)
vec_rad = tan.cross(plane.normal) # make sure plane ppoints in right direction (ang is lower than 180)
ang = vec_ab.angle(vec_rad)
print math.degrees(ang)

rad = vec_ab.length/math.cos(ang)/2.0
a.put(Point(pta+vec_rad.normalized(rad)))
# ---------- end decodes ----------
