# Grasshopper definition containment test.gh (Grasshopper 0.9.14)
# plug-ins: Decodes Python Interpreter

md_slider = MDSlider(
    slider_value=Point(0.5307317594, 0.460975647, 0.5),
    x_domain=Domain(-5, 5),
    y_domain=Domain(-5, 5),
    z_domain=Domain(0, 1),
    SliderMode=0)
md_slider_2 = MDSlider(
    slider_value=Point(0.7063415341, 0.5682925713, 0.5),
    x_domain=Domain(-5, 5),
    y_domain=Domain(-5, 5),
    z_domain=Domain(0, 1),
    SliderMode=0)
crv = Curve(<curve referenced from the Rhino model>)
pt = Point(md_slider)
pt_2 = Point(Point(1, 0, 0))
decodes = DecodesPythonScript(pgon=crv, pt=pt_2)  # -> console, a
# ---------- decodes: Python ----------
print pt in pgon
# ---------- end decodes ----------
move = Move(Geometry=crv, Motion=md_slider_2)  # -> Geometry, Transform
decodes_2 = DecodesPythonScript(pgon_a=crv, pgon_b=move.Geometry)  # -> console, a
# ---------- decodes_2: Python ----------
print pgon_a.overlaps(pgon_b)
# ---------- end decodes_2 ----------
panel = Panel(decodes.console)
panel_2 = Panel(decodes_2.console)
