# Grasshopper definition cs deval_cyl test.gh (Grasshopper 0.9.65)
# plug-ins: Decodes Python Interpreter

md_slider = MDSlider(
    slider_value=Point(0.8075003922, 0.1249995232, 0.5),
    SliderMode=0,
    x_domain=Domain(-1, 1),
    y_domain=Domain(-1, 1),
    z_domain=Domain(0, 1))
md_slider_2 = MDSlider(
    slider_value=Point(0.4950002432, 0.4374995232, 0.5),
    SliderMode=0,
    x_domain=Domain(0, 10),
    y_domain=Domain(0, 10),
    z_domain=Domain(0, 1))
pln = Plane(Plane(origin=(1.834329365, 7.108519714, 0), x=(0.4866992003, 0.8735696243, 0), y=(-0.7256822817, 0.4043054799, 0.5567066597)))
pln_2 = Plane(Plane(origin=(4.660650279, 2.517041759, 0), x=(1, 0, 0), y=(0, -1, 0)))
pln_3 = Plane(PlaneXY(1.532314416, 2.486888196, 0))
pdecon = Deconstruct(Point=md_slider)  # -> XComponent, YComponent, ZComponent
pln_4 = Plane(pln_2)
pt = Point(md_slider_2)
pt_2 = PointOriented(BasePlane=pln_4, UComponent=pdecon.XComponent, VComponent=pdecon.YComponent, WComponent=0)
decodes = DecodesPythonScript(cs=pln_4, pt=pt)  # -> console, a, b; inputs pt: Point3d
# ---------- decodes: Python ----------
tup = cs.deval_cyl(pt)
a.put(tup[1])
print tup[0]
print tup[1]
print tup[2]


b.put(cs)
# ---------- end decodes ----------
cluster = Cluster(pln=pln_4, pt=pt)  # -> radius, radians, z
panel = Panel(decodes.console)
panel_2 = Panel([cluster.radius, cluster.radians, cluster.z])
subtraction = Subtraction(A=decodes.a, B=cluster.radians)
panel_3 = Panel(subtraction)

# ==== cluster Cluster
pln = ClusterInput()
pt = ClusterInput()
pln_2 = Plane(pln)
pt_2 = Point(pt)
cp = PlaneClosestPoint(Point=pt_2, Plane=pln_2)  # -> Point, UVPoint, Distance
vec2pt = Vector2Pt(PointA=pln_2, PointB=cp.Point, Unitize=False)  # -> Vector, Length
ln = Line(StartPoint=pln_2, EndPoint=cp.Point)
deplane = DeconstructPlane(Plane=pln_2)  # -> Origin, XAxis, YAxis, ZAxis
len = Length(Curve=ln)
angle = Angle(VectorA=deplane.XAxis, VectorB=vec2pt.Vector, Plane=pln_2)  # -> Radians, Reflex
radius = ClusterOutput(len)
radians = ClusterOutput(angle.Radians)
z = ClusterOutput(cp.Distance)
