# Grasshopper definition curvature test.ghx (Grasshopper 0.9.14)
# plug-ins: Decodes Python Interpreter

pts_a = Point([Point(-2.001169597, -2.020473651, 0), Point(-2.007284576, -1.025343648, 1.414240644), Point(-2.040558602, -0.03388352001, 0)])
pts_b = Point([Point(-3.018592699, -2.024892261, 0), Point(-1.129377763, -0.7757352849, -1.482849848), Point(-2.990803284, 0.002538433396, 0)])
pts_c = Point([Point(-3.430345193, -2.010302463, 0), Point(-3.445540397, -0.625990868, -0.3879325821), Point(-3.440382422, -0.005936497756, 0)])
dirx_pts = Point([Point(0, -0.02284630349, 0.2117866685), Point(0.1544445374, 1.746816852, -0.3675136662), Point(0, 0, 0)])
genx_pts = Point([Point(0, 0, 0), Point(1.03400497, 1.082456826, 0.5406159429), Point(1.241072145, 0, -0.1328753718), Point(1.700161103, 0, 0.2915466293)])
decodes = DecodesPythonScript(pts_a=pts_a, pts_b=pts_b, pts_c=pts_c)  # -> console, a; inputs pts_a: list, pts_b: list, pts_c: list, pts_d: list
# ---------- decodes: Python ----------
crv_a = Curve.bezier(pts_a)
crv_b = Curve.bezier(pts_b)
crv_c = Curve.bezier(pts_c)

a.put([crv_a,crv_b,crv_c])
# ---------- end decodes ----------
md_slider = MDSlider(
    slider_value=Point(0.102439043, 0.1560975052, 0.5),
    x_domain=Domain(0, 1),
    y_domain=Domain(0, 1),
    z_domain=Domain(0, 1),
    SliderMode=0)
decodes_2 = DecodesPythonScript(dirx_pts=dirx_pts, genx_pts=genx_pts)  # -> console, a, b; inputs dirx_pts: list, genx_pts: list
# ---------- decodes_2: Python ----------
directrix = Curve.bezier(dirx_pts)
generatrix = Curve.bezier(genx_pts)

def func(u,v):
    generatrix.basis = CS(directrix.eval(u).origin)
    return generatrix.eval(v).origin

surf = Surface(func)
a.put(surf)
b.put(surf.surrogate)
# ---------- end decodes_2 ----------
md_slider_2 = MDSlider(
    slider_value=Point(0.09146341463, 0.3512197355, 0.5),
    x_domain=Domain(0, 1),
    y_domain=Domain(0, 1),
    z_domain=Domain(0, 1),
    SliderMode=0)
decodes_3 = DecodesPythonScript(pts_a=pts_a, pts_b=pts_b, pts_c=pts_c)  # -> console, a, b; inputs pts_a: list, pts_b: list, pts_c: list
# ---------- decodes_3: Python ----------
crv_a = Curve.bezier(pts_a)
crv_b = Curve.bezier(pts_b)
crv_c = Curve.bezier(pts_c)

def func(u,v):
    pts = [crv.eval(u) for crv in [crv_a,crv_b,crv_c]]
    return Curve.bezier(pts).eval(v)

surf = Surface(func)
a.put(surf)
b.put(surf.surrogate)
# ---------- end decodes_3 ----------
decodes_4 = DecodesPythonScript(srf=decodes_3.a, pt=md_slider_2)  # -> console, a, b
# ---------- decodes_4: Python ----------
u = pt.x
v = pt.y


gauss_crv, uv_crv, circs= srf.eval_curvature(u,v,True)
print gauss_crv
a.put(circs)


# for figuring out min and max curvature
# at last check, 0->2 is about right
"""
crvs = []
for u in Interval(0.1,0.9)/5:
    for v in Interval(0.1,0.9)/5:
        gauss_crv, uv_crv, circs= srf.eval_curvature(u,v)
        crvs.append(gauss_crv)
        #print gauss_crv
        a.put(circs)

print max(crvs)
print min(crvs)
"""
# ---------- end decodes_4 ----------

# ---- group: by extracting isoparms
decodes_5 = DecodesPythonScript(srf=decodes_2.a, pt=md_slider)  # -> console, a, b; disabled
# ---------- decodes_5: Python ----------
u = pt.x
v = pt.y


iso_u = srf.isocurve(u_val=u)
iso_v = srf.isocurve(v_val=v)

#iso_u.tol *= 0.25
#iso_v.tol *= 0.25

a.put([iso_u.surrogate,iso_v.surrogate])


curv_u = iso_u.eval_curvature(v)
curv_v = iso_v.eval_curvature(u)
b.put([curv_u[1],curv_v[1]])
print curv_u[0]
print curv_v[0]
# ---------- end decodes_5 ----------

# ---- group: by evaluating surface directly
decodes_6 = DecodesPythonScript(srf=decodes_2.a, pt=md_slider)  # -> console, a, b
# ---------- decodes_6: Python ----------
u = pt.x
v = pt.y

gauss_crv, uv_crv, circs= srf.eval_curvature(u,v,True)
print gauss_crv
print uv_crv
a.put(circs)
# ---------- end decodes_6 ----------

# ----
panel = Panel(decodes_5.console)
panel_2 = Panel(decodes_4.console)
panel_3 = Panel(decodes_6.console)
