# Grasshopper definition curve_test.gh (Grasshopper 0.9.65)
# plug-ins: Decodes Python Interpreter

md_slider = MDSlider(
    slider_value=Point(0.6851572481, 0.5429270675, 0.5),
    SliderMode=0,
    x_domain=Domain(0, 1),
    y_domain=Domain(-1, 1),
    z_domain=Domain(0, 1))
slider = Slider(1, range=0..10)  # disabled
slider_2 = Slider(0.684, range=0..5)  # disabled
decodes = DecodesPythonScript(amp=Slider(0.2, range=0.1..5), humps=Slider(8, range=1..8), tolerance=Slider(0.02, range=0.001..0.5), pt=md_slider)  # -> console, a, b
# ---------- decodes: Python ----------
def func(t):
    x = t
    y = abs(math.sin(t*humps/2)*amp)
    return Point(x,y)

crv = Curve(func,Interval(0,math.pi*2),tolerance)
print crv.tol

print crv.domain
print crv.deval(6.2831)

a.put(crv.near_pt(pt,resolution=100))
b.put(crv.surrogate)
# ---------- end decodes ----------
decodes_2 = DecodesPythonScript(amp=slider, freq=slider_2)  # -> console, a; disabled
# ---------- decodes_2: Python ----------
def func(t):
    return Point(t,math.sin(t*freq)*amp)

crv = Curve(func,Interval(0,math.pi*2))
a.put(crv)
# ---------- end decodes_2 ----------
pt = Point(md_slider)
crv = Curve(decodes.b)
pt_2 = Point(decodes.a)
crv_2 = Curve(decodes_2.a)  # disabled
cp = ControlPoints(Curve=crv)  # -> Points, Weights, Knots
cp_2 = ControlPoints(Curve=crv_2)  # -> Points, Weights, Knots; disabled
