# Grasshopper definition curves.gh (Grasshopper 0.9.14)
# plug-ins: Decodes Python Interpreter

# ---- group: properties of Decodes Curves
md_slider = MDSlider(
    slider_value=Point(0.7912666798, 0.7593851823, 0.5),
    x_domain=Domain(-1.5, 1.5),
    y_domain=Domain(-1.5, 1.5),
    z_domain=Domain(0, 1),
    SliderMode=0)
# Exercise: Construct a Bezier Span
pt = Point(md_slider)
decodes = DecodesPythonScript(pt_count=Slider(54, range=10..200), t=Slider(0.43, range=0..1), td=Slider(2.408, range=-10..10), pt=md_slider)  # -> console, a, b, c, d
# ---------- decodes: Python ----------
def func(t):
    x = (1 - t**2)/(1 + t**2)
    y = 2*t/(1+t**2)
    return Point(x,y)
    
ival = Interval(-10,10)
tol = ival.delta/pt_count
crv = Curve(func,ival,tol)
a.put(crv)

# curves can be evaluated within an interval of 0->1
pln = crv.eval(t)
b.put(pln)

# curves can be "devaluated" within the interval defined by their domain
pln = crv.deval(td)
b.put(pln)

# the tolerence of a curve does not effect the position of evaluated points,
# but does effect other things, such as the calculated length of the curve
# this is because some operations are performed on a discretized version of the
# curve (a polyline).  we can access this 'secret' polyline via the surrogate property

# try setting a very low pt_count and see what happens to the output below:
c.put(crv.surrogate)
print "curve length is a bit more than ",crv.appx_length

near_pt, near_t, dist = crv.near(pt)
print "nearest point",near_pt,"found at t=",near_t,",",dist,"units away"
d.put(near_pt)
# ---------- end decodes ----------
crv = Curve(decodes.a)
pln = Plane(decodes.b)
crv_2 = Curve(decodes.c)
pt_2 = Point(decodes.d)
panel = Panel(decodes.console)

# ---- group: constructing Decodes Curves
slider = Slider(200, range=10..200)  # disabled
decodes_2 = DecodesPythonScript(pt_count=slider)  # -> console, a; disabled
# ---------- decodes_2: Python ----------
def eval_normal(t):
    x = math.cos(t)
    y = math.sin(t)
    return Point(x,y)

ival = Interval(0,math.pi*2)
tol = ival.delta/pt_count
cir_normal = Curve(eval_normal,ival,tol)
a.put(cir_normal)


def eval_goofy(t):
    x = (1 - t**2)/(1 + t**2)
    y = 2*t/(1+t**2)
    return Point(x,y,1)
    
ival = Interval(-10,10)
tol = ival.delta/pt_count
cir_goofy = Curve(eval_goofy,ival,tol)
a.put(cir_goofy)
# ---------- end decodes_2 ----------
crv_3 = Curve(decodes_2.a)  # disabled
cp = ControlPoints(Curve=crv_3)  # -> Points, Weights, Knots; disabled

# ---- group: re-working our monsters using functions
slider_2 = Slider(3.652, range=-10..10)  # disabled
slider_3 = Slider(-0.23, range=-10..10)  # disabled
slider_4 = Slider(54, range=0..100)  # disabled
decodes_3 = DecodesPythonScript(aa=slider_2, bb=slider_3, pt_count=slider_4)  # -> console, a, b; inputs pt_count: Int32; disabled
# ---------- decodes_3: Python ----------
from math import *


# In our mathematical monsters exercise, we had written something like this:
#
#for t in Interval(0,math.pi*2)/50:
#    x = (aa-bb)*math.cos(t) + bb*cos(t*((aa/bb)-1))
#    y = (aa-bb)*math.sin(t) + bb*sin(t*((aa/bb)-1))
#    a.put(Point(x,y))

# This could be re-written using a function like so:

def evaluate(t):
    x = (aa-bb)*math.cos(t) + bb*cos(t*((aa/bb)-1))
    y = (aa-bb)*math.sin(t) + bb*sin(t*((aa/bb)-1))
    return Point(x,y)

pts = []
for t in Interval(0,math.pi*2)/pt_count: 
    pts.append(evaluate(t))

a.put(pts)
b.put(PLine(pts))
# ---------- end decodes_3 ----------
crv_4 = Curve(decodes_3.b)  # disabled

# ---- group: parameterization of a circle
slider_5 = Slider(200, range=10..200)  # disabled
decodes_4 = DecodesPythonScript(pt_count=slider_5)  # -> console, a, b; inputs pt_count: Int32; disabled
# ---------- decodes_4: Python ----------
import math

# There's often more than one way to describe how to plot points along a curve.
# This process is called "parameterization", and has ramifications for how we 
# use the curve to create subsequent geometry.
#
# Here's the typical way we would parameterize a circle...
def eval_normal(t):
    x = math.cos(t)
    y = math.sin(t)
    return Point(x,y)

pts = []
for t in Interval(0,math.pi*2)/pt_count: 
    pts.append(eval_normal(t))
a.put(pts)
b.put(PGon(pts))


# And here's an alternative way...
def eval_goofy(t):
    x = (1 - t**2)/(1 + t**2)
    y = 2*t/(1+t**2)
    return Point(x,y)

pts = []
for t in Interval(-10,10)/pt_count: 
    pts.append(eval_goofy(t)+Vec(0,0,1))
a.put(pts)
b.put(PGon(pts))
# ---------- end decodes_4 ----------
crv_5 = Curve(decodes_4.b)  # disabled

# ----
slider_6 = Slider(0, range=0..1)  # disabled
md_slider_2 = MDSlider(
    slider_value=Point(0.8203334014, 0.3649231837, 0.5),
    x_domain=Domain(-0.5, 1.5),
    y_domain=Domain(-0.5, 1.5),
    z_domain=Domain(0, 1),
    SliderMode=0)  # disabled
slider_7 = Slider(0.5696, range=0..1)  # disabled

# ---- group: bezier through many points
slider_8 = Slider(0.3904, range=0..1)  # disabled
pts = Point([Point(-0.9610811336, -2.074298095, 0), Point(-0.2385807026, -1.387942156, 0), Point(0.5472529461, -1.908522516, 0), Point(1.350597514, -1.351687855, 0), Point(2.074259354, -2.122590892, 0)])  # disabled
decodes_5 = DecodesPythonScript(pts=pts, t=slider_8)  # -> console, a, b; inputs pts: list; disabled
# ---------- decodes_5: Python ----------
crv = Curve.bezier(pts)
a.put(crv)
b.put(crv.eval(t))
# ---------- end decodes_5 ----------
crv_6 = Curve([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])  # disabled
pt_3 = Point(decodes_5.b)  # disabled

# ----
cluster = Cluster(P=md_slider_2, Z=slider_6)  # disabled
pt_4 = Point(Point(0, 0, 0))  # disabled
pt_5 = Point(cluster)  # disabled
pt_6 = Point(Point(1, 1, 0))  # disabled

# ---- group: hermite interp
decodes_6 = DecodesPythonScript(pa=pt_4, pb=pt_5, pc=pt_6, t=slider_7)  # -> console, a, b; disabled
# ---------- decodes_6: Python ----------
crv = Curve.hermite([pa,pb,pc])
a.put(crv)
b.put(crv.eval(t))
# ---------- end decodes_6 ----------
crv_7 = Curve(decodes_6.a)  # disabled
pt_7 = Point(decodes_6.b)  # disabled

# ---- group: bezier interp
decodes_7 = DecodesPythonScript(pa=pt_4, pb=pt_5, pc=pt_6, t=slider_7)  # -> console, a, b; disabled
# ---------- decodes_7: Python ----------
crv = Curve.bezier([pa,pb,pc])
a.put(crv)
b.put(crv.eval(t))
# ---------- end decodes_7 ----------
pt_8 = Point(decodes_7.b)  # disabled
crv_8 = Curve(decodes_7.a)  # disabled

# ==== cluster Cluster
P = ClusterInput()
Z = ClusterInput()
pcomp = Decompose(Point=P, System=PlaneXY(0, 0, 0))  # -> XComponent, YComponent, ZComponent
pt = PointXYZ(XComponent=pcomp.XComponent, YComponent=pcomp.YComponent, ZComponent=Z, System=PlaneXY(0, 0, 0))
pt_2 = ClusterOutput(pt)
