# Grasshopper definition gh out test.gh (Grasshopper 0.9.14)
# plug-ins: Decodes Python Interpreter

# INNIE TEST
toggle = BooleanToggle(False)
msphere = MeshSphere(Base=PlaneXY(0, 0, 0), Radius=Slider(0.1, range=0..10), UCount=10, VCount=20)
Z = UnitZ(Factor=1)
ln = Line(StartPoint=Point(1, 1, 0), EndPoint=Point(2, 2, 0))
domain² = Domain²(Domain2(u=0..2, v=0..3))
domain = Domain(Domain(0, 10))
col = Colour(RGB(255, 129, 0))
pt = Point(Point(-2, 2, 2))
_6 = Integer(69)
str = String("\"hello\"")
number = Number(3.141592654)
decodes = DecodesPythonScript(
    bool_in=toggle,
    int_in=_6,
    float_in=number,
    str_in=str,
    color_in=col,
    domain_in=domain,
    domain2_in=domain²,
    pt_in=pt,
    vec_in=Z,
    line_in=ln,
    mesh_in=msphere)  # -> out, geom_out; disabled
# ---------- decodes: Python ----------
#THIS WAS ALL PORTED TO ghIn.py
"""
inputs = ghenv.Component.Params.Input
import Rhino.Geometry as rg
import System.Drawing.Color
primitive_types = ["bool", "int", "float", "str"]
for input in inputs :
    gh_in_str = input.NickName
    gh_in = eval(gh_in_str)
    if gh_in is not None : 
        if type(gh_in) is rg.Vector3d : 
            vars()[gh_in_str] = dc.Vec(gh_in.X,gh_in.Y,gh_in.Z)
        elif type(gh_in)is rg.Point3d : 
            vars()[gh_in_str] = dc.Point(gh_in.X,gh_in.Y,gh_in.Z)
        elif type(gh_in) is rg.Line : 
            vars()[gh_in_str] = dc.Segment(Point(0,1),Vec(0,0,1))
        elif type(gh_in) is System.Drawing.Color : 
            vars()[gh_in_str] = dc.Color(float(gh_in.R)/255,float(gh_in.G)/255,float(gh_in.B)/255)
            
        elif type(gh_in) is rg.Mesh : 
            verts = [dc.Point(rh_pt.X,rh_pt.Y,rh_pt.Z) for rh_pt in gh_in.Vertices]
            faces = []
            for rh_fc in gh_in.Faces :
                faces.append([rh_fc[0],rh_fc[1],rh_fc[2]]) #add the first three points of each face
                if rh_fc[2] != rh_fc[3] : 
                  faces.append([rh_fc[0],rh_fc[2],rh_fc[3]]) #if face is a quad, add the missing triangle
            vars()[gh_in_str] = dc.Mesh(verts,faces)
        elif any(p in str(type(gh_in)) for p in primitive_types) :
            pass
            #print "primitive: "+ str(type(gh_in))
        else :
            print "UNKNOWN TYPE: "+gh_in_str+" is a "+ str(type(gh_in))
            #print inspect.getmro(gh_in.__class__)
            #if issubclass(gh_in.__class__, rg.GeometryBase ) : print "this is geometry"
            #print input.TypeHint
            #print input.Description
"""

geom_out.put([pt_in, vec_in, line_in, color_in, str_in, mesh_in])
# ---------- end decodes ----------
# OUTTIE TEST
decodes_2 = PythonScript(x=Slider(10, range=0.001..10))  # -> out, mixed_tree_out, simple_array_out, singleton_out, color_out
# ---------- decodes_2: Python ----------
pt = Point(1,1,x)
vec = Vec(0,10,x)
seg = Line(Point(1,1,x),Vec(0,0,-2))
cs = CS(Point(-2,-x), Vec(0,2,x))

verts = [
  Point(0.0       , 0.0	      , 0.0),
  Point(0.9510565 , 0.0	      , 0.0),
  Point(0.6881910 , 1.3763819 , 0.0),
  Point(0.5257311 , 0.6881910	, x/2)
]
faces = [[0,1,2],[0,2,3],[2,3,0],[3,0,1]]
mesh = dc.Mesh(verts,faces)

mixed_tree_out.put(mesh)
mixed_tree_out.put([[pt,pt,pt],[pt,pt,pt]])
mixed_tree_out.put(vec)
mixed_tree_out.put(10)

simple_array_out.put(10)
simple_array_out.put(20)

singleton_out.put(cs)

clr = Color.interpolate(Color(1,0,0),Color(0,0,1),1/x)
color_out.put(clr)
# ---------- end decodes_2 ----------
panel = Panel(decodes.out)
panel_2 = Panel(decodes.geom_out)
panel_3 = Panel(decodes_2.mixed_tree_out)
panel_4 = Panel(decodes_2.out)
panel_5 = Panel(decodes_2.simple_array_out)
panel_6 = Panel(decodes_2.singleton_out)
col_2 = Colour(decodes_2.color_out)
click_to_bake = Button()
six_is_too_high = Panel("5")

# ----
# FUN STUFF
panel_7 = Panel("G:\git\decodes\sandbox\_ks_sandbox\svgtest.svg")  # disabled
click_to_save_svg = Button()  # disabled
danzer_tile = PythonScript(
    recurse_level=six_is_too_high,
    color_a=ColourSwatch(SwatchColor=RGB(255, 255, 255)),
    color_b=ColourSwatch(SwatchColor=RGB(255, 128, 128)),
    color_c=ColourSwatch(SwatchColor=RGB(128, 255, 128)),
    color_k=ColourSwatch(SwatchColor=RGB(128, 128, 255)))  # -> out, flatten(mesh_out), color_out; inputs recurse_level: Int32
# ---------- danzer_tile: Python ----------
import decodes.extensions.danzerTile as dt

def color_draw_tile(tile):
    msh = tile.toMesh()
    msh.name = tile.lineage
    
    if isinstance(tile,dt.DzTileA) : msh.set_color(color_a)
    if isinstance(tile,dt.DzTileB) : msh.set_color(color_b)
    if isinstance(tile,dt.DzTileC) : msh.set_color(color_c)
    if isinstance(tile,dt.DzTileK) : msh.set_color(color_k)
    return msh

def flatten(l):
    for el in l:
        if isinstance(el, collections.Iterable) and not isinstance(el, basestring):
            for sub in flatten(el):
                yield sub
        else:
            yield el

def recurse(tiles,rlvl=0):
  if rlvl < recurse_level : return [recurse(tile.inflate(),rlvl+1) for tile in tiles]
  else : return [color_draw_tile(tile) for tile in tiles]


meshes = recurse([dt.DzTileK()])
colors = []
for mesh in flatten(meshes):
    colors.append(mesh.props['color'])

mesh_out.put( meshes ) 
color_out.put( colors )
# ---------- end danzer_tile ----------
svg_out = PythonScript(filepath=panel_7, do_it=click_to_save_svg)  # -> out, a; disabled
# ---------- svg_out: Python ----------
if do_it :
    outie = makeOut(outies.SVG, "svgtest", path=filepath)
    
    scale = x
    for x in range(10):
      for y in range(10):
        r1 = rect(Point(x*scale,y*scale),x,x)
        r1.set_color(Color(1,0,0))
        outie.put(r1)
        
    for x in range(10):
      for y in range(10):
        pt = Point(x*scale,(y+20)*scale)
        outie.put(pt)
    
    outie.draw()
# ---------- end svg_out ----------

sph = Sphere(Base=PlaneXY(0, 0, 0), Radius=1)  # disabled
color_bake = COLORBAKE(geo=sph, col=col_2, bool=click_to_bake)
click_to_bake_2 = Button()
color_bake_2 = COLORBAKE(geo=danzer_tile.mesh_out, col=danzer_tile.color_out, bool=click_to_bake_2)

# ==== cluster COLORBAKE
geo = ClusterInput()
col = ClusterInput()
geo_2 = Geometry(geo)
col_2 = Colour(col)
argb = SplitARGB(Colour=col_2)  # -> Alpha, Red, Green, Blue
frgb = ColourRGBF(Alpha=1, Red=argb.Red, Green=argb.Green, Blue=argb.Blue)
material = CreateMaterial(Diffuse=frgb, Specular=RGB(255, 255, 255), Emission=RGB(0, 0, 0), Transparency=expr("1-T", argb.Alpha), Shine=0)
bool = ClusterInput()
bool_2 = Boolean(bool)
preview = CustomPreview(Geometry=geo_2, Shader=col_2)
c_script = CSharpScript(objs=geo_2, colors=col_2, materials=material, activate=bool_2, groupListTgthr=Toggle(True))  # -> out, A; inputs objs: list, names: list of String, layers: list of String, colors: list of Color, pWidths: list of Double, wiresEach: list of Int32, materials: list, activate: Boolean, groupListTgthr: Boolean
# ---------- c_script: C# ----------
    //Inserts geometry into the Rhino document, with custom attributes
    //Written by Giulio Piacentino
    //Version written 2011 10 18 - for Grasshopper 0.8.52

    if (activate)
    {
      int groupIndex = -1;
      if(groupListTgthr)
        groupIndex = doc.Groups.Add();

      for(int i = 0; i < objs.Count; i++)
      {
        object obj = objs[i];
        if(obj == null)
        {
          Print("No object to bake");
          return;
        }

        //Make new attribute to set name
        Rhino.DocObjects.ObjectAttributes att = new Rhino.DocObjects.ObjectAttributes();

        string name = names.Count > 0 ? names[i % names.Count] : null;
        //Set object name
        if(!string.IsNullOrEmpty(name))
        {
          att.Name = name;
        }

        Color color = colors.Count > 0 ? colors[i % colors.Count] : new Color();
        //Set color
        if(!color.IsEmpty)
        {
          att.ColorSource = Rhino.DocObjects.ObjectColorSource.ColorFromObject; //Make the color type "by object"
          att.ObjectColor = color;

          att.PlotColorSource = Rhino.DocObjects.ObjectPlotColorSource.PlotColorFromObject; //Make the plot color type "by object"
          att.PlotColor = color;
        }

        string layer = layers.Count > 0 ? layers[i % layers.Count] : null;
        //Set layer
        if(!string.IsNullOrEmpty(layer) && Rhino.DocObjects.Layer.IsValidName(layer))
        {
          //Get the current layer index
          Rhino.DocObjects.Tables.LayerTable layerTable = doc.Layers;
          int layerIndex = layerTable.Find(layer, true);

          if(layerIndex < 0) //This layer does not exist, we add it
          {
            Rhino.DocObjects.Layer onlayer = new Rhino.DocObjects.Layer(); //Make a new layer
            onlayer.Name = layer;

            layerIndex = layerTable.Add(onlayer); //Add the layer to the layer table
            if (layerIndex > -1) //We manged to add layer!
            {
              att.LayerIndex = layerIndex;
              Print("Added new layer to the document at position " + layerIndex + " named " + layer + ". ");
            } else
              Print("Layer did not add. Try cleaning up your layers."); //This never happened to me.
          }
          else
            att.LayerIndex = layerIndex; //We simply add to the existing layer
        }


        double pWidth = pWidths.Count > 0 ? pWidths[i % pWidths.Count] : 0;
        //Set plotweight
        if(pWidth > 0)
        {
          att.PlotWeightSource = Rhino.DocObjects.ObjectPlotWeightSource.PlotWeightFromObject;
          att.PlotWeight = pWidth;
        }


        object material = materials.Count > 0 ? materials[i % materials.Count] : null;
        //Set material
        bool materialByName = !string.IsNullOrEmpty(material as string);
        Rhino.Display.DisplayMaterial inMaterial = material as Rhino.Display.DisplayMaterial;
        if(material is Color)
        {
          inMaterial = new Rhino.Display.DisplayMaterial((Color) material);
        }
        if(material != null && inMaterial == null && !materialByName)
        {
          if(!(material is string))
          {
            try //We also resort to try with IConvertible
            {
              inMaterial = (Rhino.Display.DisplayMaterial) Convert.ChangeType(material, typeof(Rhino.Display.DisplayMaterial));
            }
            catch(InvalidCastException)
            {
            }
          }
        }
        if(inMaterial != null || materialByName)
        {
          string matName;

          if(!materialByName)
          {
            matName = string.Format("A:{0}-D:{1}-E:{2}-S:{3},{4}-T:{5}",
              Format(inMaterial.Ambient),
              Format(inMaterial.Diffuse),
              Format(inMaterial.Emission),
              Format(inMaterial.Specular),
              inMaterial.Shine.ToString(),
              inMaterial.Transparency.ToString()
              );
          }
          else
          {
            matName = (string) material;
          }

          int materialIndex = doc.Materials.Find(matName, true);
          if(materialIndex < 0 && !materialByName) //Material does not exist and we have its specs
          {
            materialIndex = doc.Materials.Add(); //Let's add it
            if(materialIndex > -1)
            {
              Print("Added new material at position " + materialIndex + " named \"" + matName + "\". ");
              Rhino.DocObjects.Material m = doc.Materials[materialIndex];
              m.Name = matName;
              m.AmbientColor = inMaterial.Ambient;
              m.DiffuseColor = inMaterial.Diffuse;
              m.EmissionColor = inMaterial.Emission;
              //m.ReflectionColor = no equivalent
              m.SpecularColor = inMaterial.Specular;
              m.Shine = inMaterial.Shine;
              m.Transparency = inMaterial.Transparency;
              //m.TransparentColor = no equivalent
              m.CommitChanges();

              att.MaterialSource = Rhino.DocObjects.ObjectMaterialSource.MaterialFromObject;
              att.MaterialIndex = materialIndex;
            }
            else
              Print("Material did not add. Try cleaning up your materials."); //This never happened to me.
          }
          else if(materialIndex < 0 && materialByName) //Material does not exist and we do not have its specs. We do nothing
          {
            Print("Warning: material name not found. I cannot set the source to this material name. Add a material with name: " + matName);
          }
          else
          {
            //If this material exists, we do not replace it!
            att.MaterialSource = Rhino.DocObjects.ObjectMaterialSource.MaterialFromObject;
            att.MaterialIndex = materialIndex;
          }
        }


        int wires = wiresEach.Count > 0 ? wiresEach[i % wiresEach.Count] : 0;
        //Set wire density
        if(wires == -1 || wires > 0)
        {
          att.WireDensity = wires;
        }

        Bake(obj, att, groupIndex);
      }
    }
    else
    {
      Print("Inactive");
    }
# ---------- c_script: C# additional code ----------
  void Bake(object obj, Rhino.DocObjects.ObjectAttributes att, int groupIndex)
  {
    if(obj == null)
      return;

    Guid id;

    //Bake to the right type of object
    if(obj is GeometryBase)
    {
      GeometryBase geomObj = obj as GeometryBase;

      switch(geomObj.ObjectType)
      {
        case Rhino.DocObjects.ObjectType.Brep:
          id = doc.Objects.AddBrep(obj as Brep, att);
          break;
        case Rhino.DocObjects.ObjectType.Curve:
          id = doc.Objects.AddCurve(obj as Curve, att);
          break;
        case Rhino.DocObjects.ObjectType.Point:
          id = doc.Objects.AddPoint((obj as Rhino.Geometry.Point).Location, att);
          break;
        case Rhino.DocObjects.ObjectType.Surface:
          id = doc.Objects.AddSurface(obj as Surface, att);
          break;
        case Rhino.DocObjects.ObjectType.Mesh:
          id = doc.Objects.AddMesh(obj as Mesh, att);
          break;
        case (Rhino.DocObjects.ObjectType) 1073741824://Rhino.DocObjects.ObjectType.Extrusion:
          id = (Guid) typeof(Rhino.DocObjects.Tables.ObjectTable).InvokeMember("AddExtrusion", BindingFlags.Instance | BindingFlags.InvokeMethod, null, doc.Objects, new object[]{obj, att});
          break;
        case Rhino.DocObjects.ObjectType.PointSet:
          id = doc.Objects.AddPointCloud(obj as Rhino.Geometry.PointCloud, att); //This is a speculative entry
          break;
        default:
          Print("The script does not know how to handle this type of geometry: " + obj.GetType().FullName);
          return;
      }
    }
    else
    {
      Type objectType = obj.GetType();

      if(objectType == typeof(Arc))
      {
        id = doc.Objects.AddArc((Arc) obj, att);
      }
      else if(objectType == typeof(Box))
      {
        id = doc.Objects.AddBrep(((Box) obj).ToBrep(), att);
      }
      else if(objectType == typeof(Circle))
      {
        id = doc.Objects.AddCircle((Circle) obj, att);
      }
      else if(objectType == typeof(Ellipse))
      {
        id = doc.Objects.AddEllipse((Ellipse) obj, att);
      }
      else if(objectType == typeof(Polyline))
      {
        id = doc.Objects.AddPolyline((Polyline) obj, att);
      }
      else if(objectType == typeof(Sphere))
      {
        id = doc.Objects.AddSphere((Sphere) obj, att);
      }
      else if(objectType == typeof(Point3d))
      {
        id = doc.Objects.AddPoint((Point3d) obj, att);
      }
      else if(objectType == typeof(Line))
      {
        id = doc.Objects.AddLine((Line) obj, att);
      }
      else if(objectType == typeof(Vector3d))
      {
        Print("Impossible to bake vectors");
        return;
      }
      else if(obj is IEnumerable)
      {
        int newGroupIndex;
        if(groupIndex == -1)
          newGroupIndex = doc.Groups.Add();
        else
          newGroupIndex = groupIndex;
        foreach(object o in obj as IEnumerable)
        {
          Bake(o, att, newGroupIndex);
        }
        return;
      }
      else
      {
        Print("Unhandled type: " + objectType.FullName);
        return;
      }
    }

    if(groupIndex != -1)
    {
      doc.Groups.AddToGroup(groupIndex, id);
      Print("Added " + obj.GetType().Name + " to group number " + groupIndex);
    }
    else
      Print("Added " + obj.GetType().Name);
  }

  static string Format(Color c)
  {
    return (new System.Text.StringBuilder("A")).Append(c.A.ToString()).Append("R").Append(c.R.ToString()).Append("G")
      .Append(c.G.ToString()).Append("B").Append(c.B.ToString()).ToString();
  }
# ---------- end c_script ----------
