# Grasshopper definition line intersection test.gh (Grasshopper 0.9.75)
# plug-ins: Decodes Python Interpreter

line = Line(Line((75.24067719, 61.28582978, 0), (98.57981187, 61.28582978, 0)))
line_2 = Line(Line((60.64307281, 45.46627982, -9.163715341), (74.61981478, 45.46627982, 9.163715341)))
line_3 = Line(Line((90.68017546, 45.46627982, 0), (67.6314438, 45.46627982, 0)))
line_4 = Line(Line((67.6314438, 17.16359896, 0), (67.6314438, 73.76896069, 0)))
line_5 = Line(Line((88.33831836, 12.45900963, 0), (32.58981299, 64.64045257, 0)))
line_6 = Line(line_4)
line_7 = Line(line)
decodes = DecodesPythonScript(ln_a=line_6, ln_b=line_7)  # -> console, a
# ---------- decodes: Python ----------
def is_perpendicular(l1, l2):
    if l1.vec.dot(l2.vec) == 0:
        la = Line(l1.spt, l1.vec)
        lb = Line(l2.spt, l2.vec)
        xsec = Intersector()
        if xsec.of(la,lb): return True
    return False

print ln_a
print ln_b

print is_perpendicular(ln_a,ln_b)
print LinearEntity.is_perpendicular(ln_a,ln_b)

"""
xsec = Intersector()

if xsec.of(ln_a,ln_b):
    print xsec.log
    a.put( xsec[0] )
else:
    print "no xsec"
    a.put( xsec[0] )
"""
# ---------- end decodes ----------
