# Grasshopper definition mirror arbitrary plane test.gh (Grasshopper 0.9.75)
# plug-ins: Decodes Python Interpreter

md_slider = MDSlider(
    slider_value=Point(0.469999969, 0.2800002098, 0.5),
    SliderMode=0,
    x_domain=Domain(0, 30),
    y_domain=Domain(0, 30),
    z_domain=Domain(0, 1))
md_slider_2 = MDSlider(
    slider_value=Point(0.7900000811, 0.05000019073, 0.5),
    SliderMode=0,
    x_domain=Domain(0, 1),
    y_domain=Domain(0, 1),
    z_domain=Domain(0, 1))
crv = Curve([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])
pln = Plane(PlaneYZ(0, 0, 0))
line = Line(crv)
pl = PlaneNormal(Origin=md_slider, ZAxis=md_slider_2)
decodes = DecodesPythonScript(geom=line, cs=pl)  # -> console, a; inputs geom: list
# ---------- decodes: Python ----------
pln = cs.xy_plane
xf = Xform.mirror(pln)


ret = [g*xf for g in geom]
a.put(ret)
# ---------- end decodes ----------
