# Grasshopper definition pgon near test.gh (Grasshopper 0.9.65)
# plug-ins: Decodes Python Interpreter

Z = Slider(0.5, range=-0.5..0.5)
md_slider = MDSlider(
    slider_value=Point(0.6663527769, 0.6319999695, 0.5),
    SliderMode=0,
    x_domain=Domain(-1, 1),
    y_domain=Domain(0, 2),
    z_domain=Domain(0, 1))
cluster = Cluster(P=md_slider, Z=Z)
decodes = DecodesPythonScript(pt=cluster, n=Slider(10, range=3..10))  # -> console, a, b; inputs n: Int32
# ---------- decodes: Python ----------
pgon = RGon(n,1.0,basis=CS(0,1))
b.put(pgon)
b.put(pt)

# result: Nearest point on the PGon, index of the segment of this PGon on which this Point lies, the t-value along this segment, and the distance from the given Point.
# rtype: (Point, integer, float, float)
result = pgon.near(pt)
print "near point: ", result[0]
print "edge index: ", result[1]
print "t: ", result[2]
print "dist: ", result[3]

npt = pgon.near_pt(pt)
a.put(npt)
# ---------- end decodes ----------
panel = Panel(decodes.console)
pt = Point(decodes.a)

# ==== cluster Cluster
Z = ClusterInput()
P = ClusterInput()
pdecon = Deconstruct(Point=P)  # -> XComponent, YComponent, ZComponent
pt = ConstructPoint(XCoordinate=pdecon.XComponent, YCoordinate=pdecon.YComponent, ZCoordinate=Z)
pt_2 = ClusterOutput(pt)
