# Grasshopper definition pgon offplane test.gh (Grasshopper 0.9.65)
# plug-ins: Decodes Python Interpreter

md_slider = MDSlider(
    slider_value=Point(0.2580487699, 0.203414917, 0.5),
    SliderMode=0,
    x_domain=Domain(0, 4),
    y_domain=Domain(0, 4),
    z_domain=Domain(0, 1))
crv = Curve(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)
crv_2 = Curve(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)
decodes = DecodesPythonScript(geom=crv, pt=md_slider)  # -> console, a, b, c, d; inputs pt: Point3d
# ---------- decodes: Python ----------
print geom

pg = PGon(geom.pts)
a.put(pg)
b.put(pg.basis)

c.put(pg.bounds.corners)
c.put([pg.basis.eval(v) for v in pg.bounds.corners])

test_pt = pg.basis.eval(pt)
#test_pt.z = test_pt.z + 1
if test_pt in pg : print "point inside"
else: print "point outside"
d.put(test_pt)
# ---------- end decodes ----------
panel = Panel(decodes.console)
