# Grasshopper definition pgon-inline intersection test.gh (Grasshopper 0.9.65)
# plug-ins: Decodes Python Interpreter

md_slider = MDSlider(
    slider_value=Point(0.5835294163, 0.8897559606, 0.5),
    SliderMode=0,
    x_domain=Domain(0, 1),
    y_domain=Domain(0, 1),
    z_domain=Domain(0, 1))
md_slider_2 = MDSlider(
    slider_value=Point(0.764705658, 0.7497558855, 0.5),
    SliderMode=0,
    x_domain=Domain(-1, 1),
    y_domain=Domain(-1, 1),
    z_domain=Domain(0, 1))
decodes = DecodesPythonScript()  # -> Console, A
decodes_2 = DecodesPythonScript(pt=md_slider, vec=md_slider_2)  # -> console, a, b; inputs vec: Vector3d
# ---------- decodes_2: Python ----------
lent = Segment(Point(pt.x,pt.y,1),vec)
pgon = RGon(4,1.0,basis=CS(0,1,1))

a.put([pgon,pgon.basis])
a.put(lent)

xsec = Intersector()
#print xsec.log

if xsec.of(lent,pgon):
    print "found {0} intersections".format(len(xsec))
    b.put( xsec.results )
else:
    print "no intersection"
# ---------- end decodes_2 ----------
pt = Point(decodes_2.b)
