# Grasshopper definition plane plane intersection.gh (Grasshopper 0.9.14)
# plug-ins: Decodes Python Interpreter

md_slider = MDSlider(
    slider_value=Point(0.4500487025, 0.6930731797, 0.5),
    x_domain=Domain(-1, 1),
    y_domain=Domain(-1, 1),
    z_domain=Domain(0, 1),
    SliderMode=0)
pln = Plane(Plane(origin=(0.2147391956, -0.1891808498, 0), x=(0.779132905, 0.626858769, 0), y=(0.2508403745, -0.3117735594, 0.9164476822)))
pcomp = PlaneComponents(Plane=pln)  # -> Origin, XAxis, YAxis, ZAxis
yz = YZPlane(Origin=Point(0, 0, 0))
xy = XYPlane(Origin=Point(0, 0, 0))
pln_2 = Plane(Plane(origin=(-0.2436950466, 0.2704433487, 0), x=(0.8543764353, -0.5196546034, 0), y=(0.504127103, 0.8288473043, 0.2426273073)))
pl = Plane(Origin=pcomp.Origin, XAxis=md_slider, YAxis=pcomp.YAxis)
decodes = DecodesPythonScript(pln_a=pln_2, pln_b=pl)  # -> console, a
# ---------- decodes: Python ----------
def _plane_plane(pln_a,pln_b):
    if pln_a.normal.is_parallel(pln_b.normal) :
        print "Planes are parallel, no intersection found."
        return False
    vec = pln_a.normal.cross(pln_b.normal)
    
    ldir = pln_b.normal.cross(vec)
    denom = pln_a.normal.dot(ldir)
    tvec = pln_a.origin - pln_b.origin
    t = pln_a.normal.dot(tvec) / denom
    pt = pln_b.origin + ldir * t
    
    return Line(pt,vec)

pln_a = pln_a.xy_plane
pln_b = pln_b.xy_plane


#xsec = Intersector()
#xsec.of(pln_a,pln_b)
#result = xsec[0]
result = _plane_plane(pln_b,pln_a)
result.vec *= 100
a.put(result.spt)
a.put( result )
# ---------- end decodes ----------
data = Data(decodes.a)
