# Grasshopper definition plane_to_cs_test.gh (Grasshopper 0.9.76)
# plug-ins: Decodes Python Interpreter

pt = Point(Point(2.744417172, 9.039137872, 6.227676869))
pt_2 = Point(Point(5.009361928, 8.231887805, 0))
pt_3 = Point(Point(-10.46978528, -5.543816816, 4.183340534))
decodes = DecodesPythonScript(po=pt_2, pn=pt, pt=pt_3)  # -> console, a, b
# ---------- decodes: Python ----------
pln = Plane(po, Vec(po,pn))

a.put(pln.to_cs(Vec(po,pt)))

b.put(pln.normal)
# ---------- end decodes ----------
