# Grasshopper definition pline-plane intersection test.gh (Grasshopper 0.9.14)
# plug-ins: Decodes Python Interpreter

crv = Curve(<curve referenced from the Rhino model>)
cp = ControlPoints(Curve=crv)  # -> Points, Weights, Knots
pline = PolyLine(Vertices=cp.Points, Closed=False)
decodes = DecodesPythonScript(pl=pline)  # -> console, a, b
# ---------- decodes: Python ----------
print pl
xsec = Intersector()

pln = CS().xz_plane
if xsec.of(pl,pln):
    print "found ",len(xsec)," intersections"
    print xsec.edges
    for n, geom in enumerate(xsec):
        b.put(geom)
        if xsec.edges[n] >= 0 : print "edge intersection"
        if xsec.verts[n] >= 0 : print "vertex intersection"

def split_pline(pline, plane):
    #TODO: handle vertex intersections
    splits = []
    if xsec.of(pline,plane):
        pts = []
        pts.append(pline.pts[0])
        isec = 0
        for n,seg in enumerate(pline.edges):
            if not n in xsec.edges:
                pts.append(seg.ept)
            else:
                pts.append(xsec[isec])
                splits.append(PLine(pts))
                pts = [xsec[isec],seg.ept]
                isec += 1
                
                
        splits.append(PLine(pts))
        return splits
    else:
        return False

a.put(split_pline(pl,pln))
# ---------- end decodes ----------
panel = Panel(decodes.console)
