# Grasshopper definition polyline in test.ghx (Grasshopper 0.9.14)
# plug-ins: Decodes Python Interpreter

simple_polyline = Curve(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)
crazy_polyline = Curve(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)
decodes = DecodesPythonScript(gh_curve=simple_polyline)  # -> console, a, a_props
# ---------- decodes: Python ----------
print gh_curve

gh_curve *= Xform.translation(Vec(0,0,2))
gh_curve.set_weight(2)
gh_curve.set_color(Color(0,1,0))
a+=gh_curve
# ---------- end decodes ----------
hardboil = DecodesHardBoil(Geometry=decodes.a, Properties=decodes.a_props)
panel = Panel(decodes.console)
