# Grasshopper definition qtree_test.gh (Grasshopper 0.9.14)
# plug-ins: Decodes Python Interpreter

box = CenterBox(Base=PlaneXY(-4.717435257, 3.692668414, 0), X=1, Y=1, Z=1)
slider = Slider(200, range=0..1000)  # disabled
rectangle = Rectangle(Plane=PlaneXY(0, 0, 0), XSize=Domain(-1, 1), YSize=Domain(-2, 2), Radius=0)  # -> Rectangle, Length; disabled
pop2d = Populate2D(Region=rectangle.Rectangle, Count=slider, Seed=1)  # disabled
pop3d = Populate3D(Region=box, Count=Slider(200, range=0..1000), Seed=1)
decodes = DecodesPythonScript(pts=pop3d)  # -> console, a, b; inputs pts: list
# ---------- decodes: Python ----------
bnds=Bounds(center=Point(-2,2),dim_x=10,dim_y=10,dim_z=3)

qt = QuadTree(4, bnds)
for pt in pts: qt.append(pt)


def to_gh(tree):
    if tree.has_children: 
        return [tree.bnd.to_polyline()] + [to_gh(child) for child in tree.children]
    return tree.bnd.to_polyline()

a.put(qt.bnd.to_polyline())
b.put(to_gh(qt))
# ---------- end decodes ----------
decodes_2 = DecodesPythonScript(pts=pop2d)  # -> console, a, b; inputs pts: list; disabled
# ---------- decodes_2: Python ----------
bnds=Bounds(center=Point(-2,2),dim_x=10,dim_y=10)

qt = QuadTree(4, bnds)

for pt in pts: qt.append(pt)


def to_gh(tree):
    if tree.has_children: 
        return [tree.bnd.to_polyline()] + [to_gh(child) for child in tree.children]
    return tree.bnd.to_polyline()

a.put(qt.bnd.to_polyline())
b.put(to_gh(qt))
# ---------- end decodes_2 ----------
