# Grasshopper definition rgon test.gh (Grasshopper 0.9.14)
# plug-ins: Decodes Python Interpreter

md_slider = MDSlider(slider_value=Point(1, 1, 0.5), x_domain=Domain(0, 1), y_domain=Domain(0, 1), z_domain=Domain(0, 1), SliderMode=0)  # disabled
slider = Slider(1, range=0..2)  # disabled
line = Line(Line((-22.68336319, 0.699413448, 1.437683199), (-11.73745124, 10.47811249, 0)))
slider_2 = Slider(4, range=3..10)  # disabled
pl_origin = PlaneOrigin(Base=PlaneXY(0, 0, 0), Origin=md_slider)  # disabled
slider_3 = Slider(1, range=0..4)  # disabled
slider_4 = Slider(5, range=3..10)  # disabled
slider_5 = Slider(10, range=3..10)  # disabled

# ---- group: snub square tiling
decodes = DecodesPythonScript(seed_edge=line)  # -> console, a; disabled
# ---------- decodes: Python ----------
def cluster(sedg):
    tri_a = RGon.from_edge(edge,3)
    tri_b = RGon.from_edge(edge.inverted(),3)
    sq_a = RGon.from_edge(tri_a.edges[0],4)
    sq_b = RGon.from_edge(tri_b.edges[1],4)
    tri_c = RGon.from_edge(sq_a.edges[0],3)
    tri_d = RGon.from_edge(sq_a.edges[2],3)
    return [tri_a,tri_b,sq_a,sq_b,tri_c,tri_d]

def xf_x(cluster):
    tri_a = cluster[0]
    tri_height = tri_a.edges[0].midpoint.distance(tri_a.edges[1].ept)
    vec = seed_edge.vec.cross(Vec(0,0,1))
    vec = vec.normalized(tri_height*2+seed_edge.length)
    return Xform.translation(vec)

def xf_y(cluster,is_odd):
    tri_a = cluster[0]
    tri_height = tri_a.edges[0].midpoint.distance(tri_a.edges[1].ept)
    vec = seed_edge.vec
    vec = vec.normalized( tri_height+seed_edge.length/2.0 )
    dx = tri_height+seed_edge.length/2.0
    if is_odd : dx *=-1
    vec += vec.cross(Vec(0,0,1)).normalized(dx)
    return Xform.translation(vec)

#seed_edge = Segment(Point(),Point(0,1))
# make sure seed edge is 2d
seed_edge._pt.z = 0
seed_edge._vec.z = 0

clusters = []
for v in range(4):
    row_clusters = []
    edge = Segment(seed_edge.spt,seed_edge.ept)
    for u in range(4):
        new_cluster = cluster(edge)
        row_clusters.append(new_cluster)
        edge *= xf_x(new_cluster)
        
    clusters.append(row_clusters)
    seed_edge *= xf_y(new_cluster,v%2==0)

a.put(clusters)
# ---------- end decodes ----------

# ---- group: Truncated square tiling
decodes_2 = DecodesPythonScript(u_cnt=Slider(3, range=0..10), v_cnt=Slider(5, range=0..10))  # -> console, a; inputs u_cnt: Int32, v_cnt: Int32
# ---------- decodes_2: Python ----------
import time

def node(seed,flags):
    ta = time.time()
    rgons = []
    for n in flags:
        rgons.append(RGon.from_edge(seed,n))
        seed = rgons[-1].edges[0]
    
    segs = [Segment(rgon.pts[0],Vec(rgon.pts[0],rgon.pts[1])/2.0) for rgon in rgons]
    
    return segs


seed = Segment(Point(1,1),Vec(0,1))
flags = (4,8,8) # Truncated square tiling

nodes_per_clst = 4
clst_per_row = u_cnt

sqrt2 = 2**0.5 # the width of an octogon is 1+sqrt(2)*side_length

for n in range(u_cnt*v_cnt*nodes_per_clst):
    if n>0 and n%nodes_per_clst==0:
        # translations between u-clusters
        seed._pt += Vec(1+sqrt2*seed.length+seed.length,0)
    if n>0 and n%(nodes_per_clst*clst_per_row)==0:
        # translations between v-clusters
        dy = 1+sqrt2*seed.length+seed.length
        #alternate odd and even rows
        if n%(nodes_per_clst*clst_per_row*2)==0 : dx = -dy*(clst_per_row+0.5)
        else : dx = -dy*(clst_per_row-0.5)
        seed *= Xform.translation(Vec(dx,dy/2.0))
    if n>0:
        # translations within a cluster
        seed = Segment(seed.ept,seed._vec.cross(Vec(0,0,1)))
    
    cur_node = node(seed,flags)
    a.put(cur_node)
# ---------- end decodes_2 ----------

# ----
pln = Plane(Plane(origin=(5.4608739, 6.529996777, 0), x=(0.2610691895, 0.9653200911, 0), y=(-0.5523822251, 0.1493908405, 0.8200952714)))  # disabled
slider_6 = Slider(3, range=3..10)  # disabled
pln_2 = Plane(PlaneXY(6.379368919, -19.58778263, 0))  # disabled
line_2 = Line(Line((1.552594406, -6.533477803, 0), (0, 0, 1)))  # disabled
pln_3 = Plane(PlaneXY(10.19164384, -10.30705097, 0))  # disabled
decodes_3 = DecodesPythonScript(pln=pln_2, n=slider_4, r=slider_3, cnt=slider_5)  # -> console, a, b; inputs n: Int32, cnt: Int32; disabled
# ---------- decodes_3: Python ----------
argon = RGon(n,r,pln)

for x in range(cnt):
    argon = argon.inflate()
    a.put(argon)
    
    
argon = RGon(n,r,pln)

for x in range(cnt):
    argon = argon.deflate()
    a.put(argon)
# ---------- end decodes_3 ----------
pcomp = PlaneComponents(Plane=pln)  # -> Origin, XAxis, YAxis, ZAxis; disabled
decodes_4 = DecodesPythonScript(pln=pln_3, seg=line_2, n=slider_6)  # -> console, a; inputs n: Int32
# ---------- decodes_4: Python ----------
argon = RGon.from_edge(seg,n)


a.put(argon)
#a.put(argon.circle_inscr)
#a.put(argon.circle_cirscr)
# ---------- end decodes_4 ----------
decodes_5 = DecodesPythonScript(pln=pln, n=slider_2, r=slider)  # -> console, a; inputs n: Int32; disabled
# ---------- decodes_5: Python ----------
argon = RGon(n,r,pln)


a.put(argon)
a.put(argon.circle_inscr)
a.put(argon.circle_cirscr)


argon = RGon(n,basis=pln,edge_length=r)
a.put(argon)
# ---------- end decodes_5 ----------
geo = Geometry(decodes_3.a)  # disabled
line_3 = LineSDL(Start=pcomp.Origin, Direction=pcomp.XAxis, Length=1)  # disabled

# ---- group: Truncated square tiling [IN PROGRESS]
decodes_6 = DecodesPythonScript()  # -> console, a; disabled
# ---------- decodes_6: Python ----------
def node(seed,flags):
    rgons = []
    for n in flags:
        rgons.append(RGon.from_edge(seed,n))
        seed = rgons[-1].edges[0]
        
    if sum([rgon.interior_angle for rgon in rgons]) != math.pi*2:
        raise GeometricError("Interior angles do not sum to 360deg, I can't join those polygons!")
    
    segs = [Segment(rgon.edges[0].spt,rgon.edges[0].midpoint) for rgon in rgons]
    return segs


seed = Segment(Point(1,1),Vec(0,1))

#flags = (3,12,12) # truncated hexagonal tiling
#flags = (6,6,6) # Hexagonal tiling

flags = (4,8,8) # Truncated square tiling

nodes_per_clst = 4
clst_per_row = 3

sqrt2 = 2**0.5 # the width of an octogon is 1+sqrt(2)*side_length

for n in range(36):
    if n>0 and n%nodes_per_clst==0:
        # translations between u-clusters
        #octo_a = cur_node[1][1]
        #sqre = cur_node[1][0]
        #vec = Vec(octogon.pts[-1],octogon.pts[4]) + Vec(sqre.pts[3],sqre.pts[0])
        #seed *= Xform.translation(vec)
        seed._pt += Vec(1+sqrt2*seed.length+seed.length,0)
    if n>0 and n%(nodes_per_clst*clst_per_row)==0:
        # translations between v-clusters
        #octo_a = cur_node[1][1]
        #sqre = cur_node[1][0]
        #vec = Vec(octogon.pts[-1],octogon.pts[4]) + Vec(sqre.pts[3],sqre.pts[0])
        vec = Vec(1+sqrt2*seed.length+seed.length,0)
        #alternate odd and even rows
        dx = clst_per_row-0.5
        if n%(nodes_per_clst*clst_per_row*2)==0 : 
            print n
            dx = clst_per_row+0.5
        
        vec = (vec.inverted() * dx) + vec.cross(Vec(0,0,-1))/2.0
        seed *= Xform.translation(vec)
    if n>0:
        # translations within a cluster
        seed = Segment(seed.ept,seed._vec.cross(Vec(0,0,1)))
    
    cur_node = node(seed,flags)
    a.put(cur_node)
# ---------- end decodes_6 ----------
