# Grasshopper definition rotation test.gh (Grasshopper 0.9.14)
# plug-ins: Decodes Python Interpreter

md_slider = MDSlider(
    slider_value=Point(0.7134146341, 0.9268292683, 0.5),
    x_domain=Domain(-1, 1),
    y_domain=Domain(-1, 1),
    z_domain=Domain(0, 1),
    SliderMode=0)
md_slider_2 = MDSlider(
    slider_value=Point(0.8719512195, 0.2743902439, 0.5),
    x_domain=Domain(0, 1),
    y_domain=Domain(0, 1),
    z_domain=Domain(0, 1),
    SliderMode=0)
vcomp = Decompose(Vector=md_slider)  # -> XComponent, YComponent, ZComponent
vec = VectorXYZ(XComponent=vcomp.XComponent, YComponent=vcomp.YComponent, ZComponent=vcomp.YComponent)  # -> Vector, Length
vec_2 = Vector(vec.Vector)
pt = Point(md_slider_2)
vdis = VectorDisplay(Anchor=Point(0, 0, 0), Vector=vec_2)
pi = Pi(Factor=Slider(1.68, range=0..2))
decodes = DecodesPythonScript(pt=pt, angle=pi, axis=vec_2)  # -> console, a
# ---------- decodes: Python ----------
for ang in Interval(0,angle)/100:
    xf = Xform.rotation(axis=axis,angle=ang)
    a.put(pt*xf)
# ---------- end decodes ----------
panel = Panel(decodes.console)
