# Grasshopper definition seg xf test.gh (Grasshopper 0.9.75)
# plug-ins: Decodes Python Interpreter

number_slider = Slider(15, range=0..30)
trigrid = Triangular(Plane=PlaneXY(0, 0, 0), Size=1, ExtentX=expr("x*2", number_slider), ExtentY=number_slider)  # -> Cells, Points
radgrid = Radial(Plane=PlaneXY(0, 0, 0), Size=1, ExtentR=5, ExtentP=20)  # -> Cells, Points
hexgrid = Hexagonal(Plane=PlaneXY(0, 0, 0), Size=1, ExtentX=number_slider, ExtentY=number_slider)  # -> Cells, Points
crv = Curve(trigrid.Cells)
explode = Explode(Curve=crv, Recursive=True)  # -> flatten(Segments), flatten(Vertices)
avr = Average(Input=explode.Vertices)
move = Move(Geometry=explode.Segments, Motion=expr("-x", avr))  # -> Geometry, Transform
pt = Point(Point(1.953187573, -4.007667513, 0))
decodes = DecodesPythonScript(segs=move.Geometry, attr_pt=pt, fac=Slider(0.59, range=0.02..2))  # -> console, a; inputs segs: list
# ---------- decodes: Python ----------
from math import *
"""
xf = Xform()
transformed_segs = []
ival_len = Interval.encompass([seg.length for seg in segs])
for seg in segs:
    ang = Interval.remap(seg.length,ival_len,Interval.pi())
    sint, cost = sin(ang), cos(ang)
    xf.c11, xf.c12, xf.c21, xf.c22 = cost, -sint, sint, cost
    transformed_segs.append( seg * xf )
    
a.put( transformed_segs )
"""


ival_dist = Interval.encompass([max(seg.spt.dist(attr_pt),seg.ept.dist(attr_pt)) for seg in segs])
ival_spin = Interval(0,math.pi*fac)

xf = Xform()
def spin(pt):
    ang = Interval.remap(pt.dist(attr_pt),ival_dist,ival_spin)
    sint, cost = sin(ang), cos(ang)
    xf.c11, xf.c12, xf.c21, xf.c22 = cost, -sint, sint, cost
    return pt * xf

segs = [Segment(spin(seg.spt),spin(seg.ept)) for seg in segs]
a.put(segs)
# ---------- end decodes ----------
