# Grasshopper definition shelden packing.gh (Grasshopper 0.9.14)
# plug-ins: Decodes Python Interpreter

crv = Curve(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)
decodes = DecodesPythonScript(pgon=crv, mat_w=Slider(2.7, range=0.5..10), mat_h=Slider(0.5, range=0.1..1.1))  # -> console, a
# ---------- decodes: Python ----------
mat_size = mat_w, mat_h


edge = pgon.edges[0]
off_vec = edge.vec.cross(Vec(edge.spt,pgon.centroid)).cross(edge.vec)
line = Line(edge.spt + off_vec.normalized(mat_size[0]), edge.vec)

xsec = Intersector()

p0, p1 = None, None
if xsec.of(line,pgon.edges[-1]) : p0 = xsec[0]
if xsec.of(line,pgon.edges[1]) : p1 = xsec[0]

if p0 is None or p1 is None:
    print "wtf?"
    
a.put(Segment(p0,p1))
# ---------- end decodes ----------
data = Data(decodes.a)
