# Grasshopper definition shift and match.gh (Grasshopper 0.9.76)
# plug-ins: Decodes Python Interpreter

pt = Point([Point(5.410041802, 7.595750685, 0), Point(17.63376892, 14.2822339, 0), Point(24.63368104, 9.789752989, 0), Point(42.18569947, 9.267371488, 0), Point(28.81273304, -7.762265443, 0)])
decodes = DecodesPythonScript(pts=pt, n=Slider(5, range=-10..10))  # -> console, a, b; inputs pts: list
# ---------- decodes: Python ----------
def shift(lst,n=0):
    n = int(n)%len(lst)
    return lst[n:] + lst[:n]

def match(lst,rel_idxs):
    return zip(*[shift(lst,idx) for idx in rel_idxs])


nums = [0,1,2,3,4]
print shift(nums,n)
print match(nums,[-1,1])

pts = shift(pts,n)
a.put( pts )
b.put( match(pts,[-1,1]) )
# ---------- end decodes ----------
ln = Line(StartPoint=graft(decodes.a), EndPoint=decodes.b)
points = PointList(Points=decodes.a, Size=Slider(3.3, range=0..6))
panel = Panel(decodes.b)
