# Grasshopper definition solar geom test.gh (Grasshopper 0.9.14)
# plug-ins: Decodes Python Interpreter, DYear

slider = Slider(167, range=0..364)  # disabled
slider_2 = Slider(6, range=2..23)  # disabled
dhr = DataHour([{hr="0", color_r="0", color_g="0", color_b="0", color_a="255", pos_x="0", pos_y="0", pos_z="0", is_surrogate="False", keys="et_rad_horz,et_rad_norm,global_horz_irrad,direct_norm_irrad,diffuse_horz_irrad,global_horz_illum,direct_norm_illum,diffuse_horz_illum,zenith_luminance,total_sky_cvr,opaque_sky_cvr,dry_bulb_temp,dew_point_temp,relative_humidity,pressure,wind_dir,wind_speed,horz_visibility,ceiling_height,precipt_water,aerosol_depth,snow_depth,days_since_snow,solar_altitude,solar_azimuth,sun_is_up,absolute_humidity", values="0,0,0,0,0,999900,999900,999900,99990,0,0,5.7,4.5,92,101430,40,1.9,24.1,77777,0,0,0,88,-1.309197,6.092528,0,655.0204"}, {hr="1", color_r="0", color_g="0", color_b="0", color_a="255", pos_x="0", pos_y="0", pos_z="0", is_surrogate="False", keys="et_rad_horz,et_rad_norm,global_horz_irrad,direct_norm_irrad,diffuse_horz_irrad,global_horz_illum,direct_norm_illum,diffuse_horz_illum,zenith_luminance,total_sky_cvr,opaque_sky_cvr,dry_bulb_temp,dew_point_temp,relative_humidity,pressure,wind_dir,wind_speed,horz_visibility,ceiling_height,precipt_water,aerosol_depth,snow_depth,days_since_snow,solar_altitude,solar_azimuth,sun_is_up,absolute_humidity", values="0,0,0,0,0,999900,999900,999900,99990,0,0,4.9,3.9,93,101230,30,2,24.1,77777,0,0,0,88,-1.257168,0.6658595,0,628.1306"}, {hr="2", color_r="0", color_g="0", color_b="0", color_a="255", pos_x="0", pos_y="0", pos_z="0", is_surrogate="False", keys="et_rad_horz,et_rad_norm,global_horz_irrad,direct_norm_irrad,diffuse_horz_irrad,global_horz_illum,direct_norm_illum,diffuse_horz_illum,zenith_luminance,total_sky_cvr,opaque_sky_cvr,dry_bulb_temp,dew_point_temp,relative_humidity,pressure,wind_dir,wind_speed,horz_visibility,ceiling_height,precipt_water,aerosol_depth,snow_depth,days_since_snow,solar_altitude,solar_azimuth,sun_is_up,absolute_humidity", values="0,0,0,0,0,999900,999900,999900,99990,0,0,4.4,3.6,95,101110,20,2.2,24.1,77777,0,0,0,88,-1.092806,1.136033,0,620.726"}, {hr="3", color_r="0", color_g="0", color_b="0", color_a="255", pos_x="0", pos_y="0", pos_z="0", is_surrogate="False", keys="et_rad_horz,et_rad_norm,global_horz_irrad,direct_norm_irrad,diffuse_horz_irrad,global_horz_illum,direct_norm_illum,diffuse_horz_illum,zenith_luminance,total_sky_cvr,opaque_sky_cvr,dry_bulb_temp,dew_point_temp,relative_humidity,pressure,wind_dir,wind_speed,horz_visibility,ceiling_height,precipt_water,aerosol_depth,snow_depth,days_since_snow,solar_altitude,solar_azimuth,sun_is_up,absolute_humidity", values="0,0,0,0,0,999900,999900,999900,99990,2,2,4.1,3.5,96,101060,10,2.3,24.1,77777,0,0,0,88,-0.8952814,1.392847,0,614.871"}, {hr="4", color_r="0", color_g="0", color_b="0", color_a="255", pos_x="0", pos_y="0", pos_z="0", is_surrogate="False", keys="et_rad_horz,et_rad_norm,global_horz_irrad,direct_norm_irrad,diffuse_horz_irrad,global_horz_illum,direct_norm_illum,diffuse_horz_illum,zenith_luminance,total_sky_cvr,opaque_sky_cvr,dry_bulb_temp,dew_point_temp,relative_humidity,pressure,wind_dir,wind_speed,horz_visibility,ceiling_height,precipt_water,aerosol_depth,snow_depth,days_since_snow,solar_altitude,solar_azimuth,sun_is_up,absolute_humidity", values="0,0,0,0,0,999900,999900,999900,99990,2,2,4.3,2.7,89,101090,27,2.4,24.1,77777,0,0,0,88,-0.6892139,1.57199,0,577.6714"}, {hr="5", color_r="0", color_g="0", color_b="0", color_a="255", pos_x="0", pos_y="0", pos_z="0", is_surrogate="False", keys="et_rad_horz,et_rad_norm,global_horz_irrad,direct_norm_irrad,diffuse_horz_irrad,global_horz_illum,direct_norm_illum,diffuse_horz_illum,zenith_luminance,total_sky_cvr,opaque_sky_cvr,dry_bulb_temp,dew_point_temp,relative_humidity,pressure,wind_dir,wind_speed,horz_visibility,ceiling_height,precipt_water,aerosol_depth,snow_depth,days_since_snow,solar_altitude,solar_azimuth,sun_is_up,absolute_humidity", values="0,0,0,0,0,999900,999900,999900,99990,2,2,5.1,2.7,84,101190,43,2.6,24.1,77777,0,0,0,88,-0.4829474,1.722077,0,574.8912"}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])
latlong = Panel("37.709999,-122.209999,0")
timezone = Panel("-8.0")
decodes = DecodesPythonScript(latlong=latlong, tmz=timezone, hod=slider_2, doy=slider)  # -> console, a; inputs latlong: Vector3d, tmz: Int32, hod: Int32, doy: Int32; disabled
# ---------- decodes: Python ----------
from decodes.extensions.solar_geometry import *

#sg = SolarGeom(42.35,71.05,-5)
sg = SolarGeom(latlong.x,latlong.y,tmz)
vec = sg.vec_at(doy,hod)
a.put(vec)
# ---------- end decodes ----------
getval = GetValue(ValueKey="solar_altitude", DHour=dhr)  # -> Value, Range
getval_2 = GetValue(ValueKey="solar_azimuth", DHour=dhr)  # -> Value, Range

# ---- group: from dhour plugin
pt = PointXYZ(XComponent=getval_2.Value, YComponent=getval.Value, ZComponent=0, System=PlaneXY(0, 0, 0))

# ----
vdis = VectorDisplay(Anchor=Point(0, 0, 0), Vector=decodes.a)  # disabled
slider_3 = Slider(448, range=0..8759)
slider_4 = Slider(24, range=0..48)

# ---- group: using solar geom module
decodes_2 = DecodesPythonScript(latlong=latlong, tmz=timezone)  # -> console, a; inputs latlong: Vector3d, tmz: Int32
# ---------- decodes_2: Python ----------
from decodes.extensions.solar_geometry import *

sg = SolarGeom(latlong.x,latlong.y,tmz)

for doy in range(365):
    for hod in range(24):
        alt,azm,d,o = sg.angles_at(doy,hod)
        #alt *=-1
        #azm -= math.pi
        if o > math.pi or o < 0:
            azm = math.pi*2-azm
        #if o < math.pi and o > 0:
        #    azm = math.pi*2-azm
        #if math.degrees(o) < 0:
        #    azm = math.pi*2-azm
        pt = Point(azm,alt)
        a.put(pt)
        
"""
if math.degrees(omega_rad) < 0:
    azimuth = math.degrees(azimuth_rad)
else:
    azimuth = 360-math.degrees(azimuth_rad)
"""
# ---------- end decodes_2 ----------

# ----
item = ListItem(List=decodes_2.a, Index=slider_4, Wrap=False)
item_2 = ListItem(List=pt, Index=slider_4, Wrap=False)
pt_2 = Point([item, item_2])
