# Grasshopper definition surface class test.gh (Grasshopper 0.9.14)
# plug-ins: Decodes Python Interpreter

decodes = DecodesPythonScript(res=Slider(20, range=4..20))  # -> console, a, b; inputs res: Int32
# ---------- decodes: Python ----------
def func(u,v):
    return Point(u,v,math.sin(u+v))
twopi = Interval.twopi()
surf = Surface(func,twopi,twopi)


for u in twopi/res: 
    for v in twopi/res:
        a.put(surf.deval(u,v))

b.put(surf.to_mesh())
# ---------- end decodes ----------
