# Grasshopper definition tangent circle.gh (Grasshopper 0.9.14)
# plug-ins: Decodes Python Interpreter

md_slider = MDSlider(
    slider_value=Point(0.4280488549, 0.3902439024, 0.5),
    x_domain=Domain(0, 10),
    y_domain=Domain(0, 10),
    z_domain=Domain(0, 1),
    SliderMode=0)
md_slider_2 = MDSlider(
    slider_value=Point(0, 0.4390242972, 0.5),
    x_domain=Domain(0, 10),
    y_domain=Domain(0, 10),
    z_domain=Domain(0, 1),
    SliderMode=0)
md_slider_3 = MDSlider(
    slider_value=Point(1, 0.4451219512, 0.5),
    x_domain=Domain(0, 10),
    y_domain=Domain(0, 10),
    z_domain=Domain(0, 1),
    SliderMode=0)
pi = Pi(Factor=Slider(-0.52, range=-1..1))
cir = Circle(Plane=md_slider, Radius=Slider(2.88, range=0..10))
cir_2 = Circle(Plane=md_slider_2, Radius=Slider(1.5, range=0..10))
cir_3 = Circle(Plane=md_slider_3, Radius=Slider(1.36, range=0..10))
decodes = DecodesPythonScript(cir_a=cir_2, cir_b=cir, cir_c=cir_3, tan_off=pi)  # -> console, a, b, c
# ---------- decodes: Python ----------
cir_ab, pt_ab, pt_ba = Circle.mutually_tangent(cir_a,cir_b,tan_off,True)
a.put( cir_ab )
b.put(pt_ab)
b.put(pt_ba)


cir_bc, pt_bc, pt_cb = Circle.mutually_tangent(cir_b,cir_c,tan_off,True)
a.put( cir_bc )
b.put(pt_bc)
b.put(pt_cb)


pt_a = cir_a.plane.origin + Vec(-1,1).normalized(cir_a.rad)
b.put(pt_a)

pt_c = cir_c.plane.origin + Vec(1,1).normalized(cir_c.rad)
b.put(pt_c)

arc_a = Arc.from_pts(cir_a.plane.origin,pt_a,pt_ab)
arc_ab = Arc.from_pts(cir_ab.plane.origin,pt_ab,pt_ba)
arc_b = Arc.from_pts(cir_b.plane.origin,pt_ba,pt_bc)
arc_bc = Arc.from_pts(cir_bc.plane.origin,pt_bc,pt_cb)
arc_c = Arc.from_pts(cir_c.plane.origin,pt_cb,pt_c)

c.put([arc_a,arc_ab,arc_b,arc_bc,arc_c])
# ---------- end decodes ----------
data = Data(decodes.c)
data_2 = Data(decodes.b)
pi_2 = Pi(Factor=Slider(0.27, range=0.1..0.5))
decodes_2 = DecodesPythonScript(arcs=data, rot_w=pi_2)  # -> console, a; inputs arcs: list
# ---------- decodes_2: Python ----------
from decodes.extensions.classical_surfaces import *
    
for arc in arcs:
    surf = RotationalSurface(arc,Vec(1,0),Interval(math.pi/2-rot_w,math.pi/2+rot_w))
    a.put(surf.surrogate)
# ---------- end decodes_2 ----------

# ----
# http://jwilson.coe.uga.edu/EMAT6680Su06/Swanagan/Assignment7/BSAssignment7.html
md_slider_4 = MDSlider(
    slider_value=Point(0.1512195308, 0.4170733196, 0.5),
    x_domain=Domain(0, 10),
    y_domain=Domain(0, 10),
    z_domain=Domain(0, 1),
    SliderMode=0)  # disabled
slider = Slider(0.96, range=0..10)  # disabled
md_slider_5 = MDSlider(
    slider_value=Point(0.5158536958, 0.487804785, 0.5),
    x_domain=Domain(0, 10),
    y_domain=Domain(0, 10),
    z_domain=Domain(0, 1),
    SliderMode=0)  # disabled
slider_2 = Slider(1.5, range=0..10)  # disabled
cir_4 = Circle(Plane=md_slider_4, Radius=slider)  # disabled
cir_5 = Circle(Plane=md_slider_5, Radius=slider_2)  # disabled
circle = Circle(cir_5)  # disabled
circle_2 = Circle(cir_4)  # disabled
cen = Center(Arc=circle)  # -> Center, Radius; disabled
cen_2 = Center(Arc=circle_2)  # -> Center, Radius; disabled
curvepoint = PointOnCurve(circle, parameter=0.486)  # disabled
pt = Point(curvepoint)  # disabled
cir_6 = Circle(Plane=pt, Radius=slider)  # disabled
cen_3 = Center(Arc=circle_2)  # -> Center, Radius; disabled
ln = Line(StartPoint=cen.Center, EndPoint=pt)  # disabled
clx = CurveLine(Curve=cir_6, Line=ln, LimitFirst=False)  # -> Points, Params, Count; disabled
cp = ClosestPoint(Point=cen.Center, Cloud=clx.Points)  # -> ClosestPoint, CPIndex, Distance; disabled
ln_2 = Line(StartPoint=cp.ClosestPoint, EndPoint=cen_3.Center)  # disabled
curvepoint_2 = PointOnCurve(ln_2, parameter=0.5)  # disabled
Z = UnitZ(Factor=1)  # disabled
xprod = CrossProduct(VectorA=ln_2, VectorB=Z, Unitize=False)  # -> Vector, Length; disabled
line = LineSDL(Start=curvepoint_2, Direction=xprod.Vector, Length=1)  # disabled
llx = LineLine(Line1=ln, Line2=line)  # -> ParamA, ParamB, PointA, PointB; disabled
dist = Distance(PointA=pt, PointB=llx.PointA)  # disabled
cir_7 = Circle(Plane=llx.PointA, Radius=dist)  # disabled
circle_3 = Circle(cir_7)  # disabled

# ---- group: decodes construction
slider_3 = Slider(0.17, range=-1..1)  # disabled
move = Move(Geometry=circle, Motion=Vector(0, -7.753729038, 0))  # -> Geometry, Transform; disabled
move_2 = Move(Geometry=circle_2, Motion=Vector(0, -7.753729038, 0))  # -> Geometry, Transform; disabled
pi_3 = Pi(Factor=slider_3)  # disabled
decodes_3 = DecodesPythonScript(cir_a=move.Geometry, cir_b=move_2.Geometry, tan_off=pi_3)  # -> console, a, b; disabled
# ---------- decodes_3: Python ----------
#TODO: ensure cir_a and cir_b are coplanar
z_axis = cir_a.plane.normal

vec_rad = Vec(cir_a.origin,cir_b.origin).normalized(cir_a.rad)
pt_tan = cir_a.origin + vec_rad
if tan_off != 0.0:
    cs = CS(cir_a.origin,vec_rad,vec_rad.cross(z_axis))
    pt_tan = cs.eval(cir_a.rad * math.cos(tan_off),cir_a.rad * math.sin(tan_off))
    b.put(pt_tan)

pt_ff = pt_tan + Vec(pt_tan,cir_a.origin).normalized(cir_b.rad)
ln_f = Line(pt_ff,Vec(pt_ff,pt_tan))
#b.put(ln_f)

pt_gg = Point.centroid([pt_ff,cir_b.plane.origin])
ln_g = Line(pt_gg , Vec(pt_ff,cir_b.plane.origin).cross(z_axis))
#b.put(ln_g)

xsec = Intersector()
if xsec.of(ln_g,ln_f):
    rad = xsec[0].distance(pt_tan)
    cir = Circle(Plane(xsec[0],z_axis),rad)
    a.put(cir)
    b.put(cir.plane.origin + Vec(cir.plane.origin,cir_b.plane.origin).normalized(cir.rad))
else:
    print "wtf?"
# ---------- end decodes_3 ----------

# ----
ln_3 = Line(StartPoint=cen_2.Center, EndPoint=cen.Center)  # disabled
clx_2 = CurveLine(Curve=circle, Line=ln_3, LimitFirst=False)  # -> Points, Params, Count; disabled
cp_2 = ClosestPoint(Point=cen_2.Center, Cloud=clx_2.Points)  # -> ClosestPoint, CPIndex, Distance; disabled
