# Grasshopper definition tet test.gh (Grasshopper 0.9.14)
# plug-ins: Decodes Python Interpreter

pln = Plane(Plane(origin=(0.272165527, 0, -0.1924500897), x=(0.5773502692, 0, 0.8164965809), y=(0, 1, 0)))
decodes = DecodesPythonScript(test_cs=pln, test_rad=Slider(0.781, range=0..1))  # -> console, a
# ---------- decodes: Python ----------
import math

class Tetrahedron(HasBasis):
    sqrt2 = 2**0.5
    sqrt3 = 3**0.5
    sqrt24 = 24**0.5
    sqrt3_8 = (3/8)**0.5
    base_vec_radius =  ((3/8)**0.5)*2
    angle_edge_to_face = math.atan(2**0.5)
    
    @staticmethod
    def _base_vecs(radius=1.0):
        mult = radius/Tetrahedron.base_vec_radius
        v0 = Vec(1,0,1/Tetrahedron.sqrt2)*mult
        v1 = Vec(-1,0,1/Tetrahedron.sqrt2)*mult
        v2 = Vec(0,1,-1/Tetrahedron.sqrt2)*mult
        v3 = Vec(0,-1,-1/Tetrahedron.sqrt2)*mult
        return v0,v1,v2,v3
    
    def __init__(self,cs,radius=1.0):
        self.basis = cs
        self.rad = radius
        
    @property
    def pts(self):
        return tuple(self.basis.eval(v) for v in Tetrahedron._base_vecs(self.rad) )
        
        
    @staticmethod
    def from_face_center(face_cs, face_rad):
        """
        constructs a tet from a given coordinate system and radius that describe the orientation of one face of the resulting tet
        face_cs.origin ought to lie at the centroid of the face
        face_cs.x_axis ought to point at one of the points of the face
   
        """
        edge_len = face_rad * 3 / Tetrahedron.sqrt3
        rad = edge_len * Tetrahedron.sqrt3_8
        cpt = face_cs.eval(0,0,edge_len/Tetrahedron.sqrt24)
        x_axis = face_cs.x_axis * Xform.rotation(axis=face_cs.y_axis,angle=Tetrahedron.angle_edge_to_face)
        
        cs = CS(cpt,x_axis,face_cs.y_axis)
        return Tetrahedron(cs,rad)
        
#tet = Tetrahedron(CS())
tet = Tetrahedron.from_face_center(test_cs,test_rad)
a.put( tet.pts )
# ---------- end decodes ----------
