# Grasshopper definition triangle-ray intersection test.gh (Grasshopper 0.9.14)
# plug-ins: Decodes Python Interpreter

md_slider = MDSlider(
    slider_value=Point(0.1640975926, 0.7219710001, 0.5),
    x_domain=Domain(0, 1),
    y_domain=Domain(0, 1),
    z_domain=Domain(0, 1),
    SliderMode=0)
pt = Point([Point(1, 0, 1), Point(-1, -1, 1), Point(-1, 1, 1)])
decodes = DecodesPythonScript(pts=pt, vec=md_slider)  # -> console, a, b; inputs pts: list
# ---------- decodes: Python ----------
ray = Ray(Point(),Vec(0,vec.x,vec.y))
tri = PGon.triangle(pts[0],pts[1],pts[2])

a.put(tri)
a.put(ray)

xsec = Intersector()

if xsec.of(ray,tri):
    print "found intersection at distance ", xsec.dist
    b.put(xsec[0])
else:
    print xsec.log
# ---------- end decodes ----------
panel = Panel(decodes.console)
