# Grasshopper definition vec field test.gh (Grasshopper 0.9.75)
# plug-ins: Decodes Python Interpreter

pt = Point(Point(1.750677456, 1.849204226, 0))
md_slider = MDSlider(
    slider_value=Point(0.8208541766, 0.6596456674, 0.5),
    SliderMode=0,
    x_domain=Domain(-2, 2),
    y_domain=Domain(-2, 2),
    z_domain=Domain(0, 1))  # disabled
decodes = DecodesPythonScript(res=Slider(7, range=0..10), pt=pt)  # -> console, a, b, c
# ---------- decodes: Python ----------
bnd = Bounds(ival_x=Interval(1,2),ival_y=Interval(1,2))
vf = VecField( (res,res) , bnd , Vec(0,0,1) )

for x in range(vf.px_width):
    for y in range(vf.px_height):
        vf.set(x,y,Vec(x/(y+1),0,y/(x+1))/10)
        
#a.put(vf.to_rays())
#b.put(vf.lattice_segs)

a.put(vf.cell_pgons)


def vec_near(self,a,b=None):
    return self.get(*self.address_near(a,b))

def vecs_near(self,a,b=None):
    return [self.get(*add) for add in self.addresses_near(a,b)]
    
    
b.put(Ray(vf.cpt_near(pt),vec_near(vf,pt)))

for pt,vec in zip(vf.cpts_near(pt),vecs_near(vf,pt)):
    b.put(Ray(pt,vec))
# ---------- end decodes ----------
md_slider_2 = MDSlider(
    slider_value=Point(0.7722635677, 0.665799524, 0.5),
    SliderMode=0,
    x_domain=Domain(-2, 2),
    y_domain=Domain(-2, 2),
    z_domain=Domain(0, 1))  # disabled
md_slider_3 = MDSlider(
    slider_value=Point(0.3422818792, 0.3554864867, 0.5),
    SliderMode=0,
    x_domain=Domain(0, 0.2),
    y_domain=Domain(0, 0.2),
    z_domain=Domain(0, 1))  # disabled

# ---- group: Slimmed down version
md_slider_4 = MDSlider(
    slider_value=Point(0.4192751174, 0.3042044354, 0.5),
    SliderMode=0,
    x_domain=Domain(-0.1, 0.6),
    y_domain=Domain(-0.1, 0.3),
    z_domain=Domain(0, 1))  # disabled
slider = Slider(8, range=0..10)  # disabled
slider_2 = Slider(0.5555, range=0..1)  # disabled
pt_2 = Point([md_slider_4, md_slider_3])  # disabled
decodes_2 = DecodesPythonScript(res=slider, dim=slider_2, s_pt=pt_2)  # -> console, a, b, c; inputs res: Int32; disabled
# ---------- decodes_2: Python ----------
vf = VecField(pixel_res=Interval(res,res), spatial_origin=Point(dim/2,dim/4), spatial_dim=Interval(dim,dim/2))

for x in range(vf.px_width):
    for y in range(vf.px_height):
        vf.set(x,y,Vec((y+1)/(x+70),(x+1)/(y+70)))

a.put(vf.to_rays())

def avg_vec(vec_field,sample_pt):
    x = min(1.0,max(0.0,vec_field._sp_ival_x.deval(sample_pt.x)))
    y = min(1.0,max(0.0,vec_field._sp_ival_y.deval(sample_pt.y)))
    
    x0= Interval(0,vec_field.px_width).eval(x)
    y0= Interval(0,vec_field.px_height).eval(y)
    
    #print x0, y0 
    
    x1 = int(round(x0))
    y1 = int(round(y0))
    if x1 == vec_field.px_width : x1 = vec_field.px_width-1
    if y1 == vec_field.px_height : y1 = vec_field.px_height-1
    
    if x - x1 <= 0 : x2 = int(x1-1)
    else : x2 = int(x1+1)
     
    if y - y1 <= 0 : y2 = int(y1-1)
    else : y2 = int(y1+1)
    
    #boundary conditions
    if sample_pt.x < vec_field._base_pts[0].x : x2 = x1
    if sample_pt.y < vec_field._base_pts[0].y : y2 = y1
    if sample_pt.x > vec_field._base_pts[-1].x : x2 = x1
    if sample_pt.y > vec_field._base_pts[-1].y : y2 = y1
    
    nears = []
    nears.extend([vec_field.get(x1,y1), vec_field.get(x1,y2), vec_field.get(x2,y2), vec_field.get(x2,y1)])
    
    print x0, x1, x2
    print y0, y1, y2
    
    
    nqx = (abs(x1- x0 +.5 ))
    nqy = (abs(y1 - y0 +.5 )) 
    
    print nqx, nqy
    
    xvec1 = Vec.interpolate(nears[0],nears[3],nqx)
    
    xvec2 = Vec.interpolate(nears[1],nears[2],nqx)
    
    rvec  = Vec.interpolate(xvec1, xvec2, nqy)
    """
    c.put(Ray(vec_field._base_pts[x1+y1*vec_field.px_width], nears[0]))
    c.put(Ray(vec_field._base_pts[x1+y2*vec_field.px_width], nears[1]))
    c.put(Ray(vec_field._base_pts[x2+y2*vec_field.px_width], nears[2]))
    c.put(Ray(vec_field._base_pts[x2+y1*vec_field.px_width], nears[3]))
    
    c.put(Ray(Point(sample_pt.x, vec_field._base_pts[x1+y1*vec_field.px_width].y), xvec1))
    c.put(Ray(Point(sample_pt.x, vec_field._base_pts[x2+y2*vec_field.px_width].y), xvec2))
    c.put(Ray(Point(vec_field._base_pts[x2+y2*vec_field.px_width].x,sample_pt.y), rvec))
    """
    return rvec

b.put(Ray(s_pt,avg_vec(vf, s_pt)))
# ---------- end decodes_2 ----------
geo = Geometry(decodes_2.b)  # disabled
geo_2 = Geometry(decodes_2.a)  # disabled

# ----
slider_3 = Slider(7, range=0..10)  # disabled
slider_4 = Slider(4.358, range=0..10)  # disabled
pt_3 = Point(md_slider_2)  # disabled
decodes_3 = DecodesPythonScript(res=slider_3, dim=slider_4, s_pt=pt_3)  # -> console, a, b, c; inputs res: Int32; disabled
# ---------- decodes_3: Python ----------
bnd = Bounds(ival_x=Interval(1,2),ival_y=Interval(1,2))
vf = VecField( (res,res) , bnd , Vec(0,0,1) )

for x in range(vf.px_width):
    for y in range(vf.px_height):
        vf.set(x,y,Vec(x/(y+1),y/(x+1)))

a.put(vf.to_rays())
"""
def avg_vec(vec_field,sample_pt):
    x = min(1.0,max(0.0,vec_field._sp_ival_x.deval(sample_pt.x)))
    y = min(1.0,max(0.0,vec_field._sp_ival_y.deval(sample_pt.y)))
    
    x0= Interval(0,vec_field.px_width).eval(x)
    y0= Interval(0,vec_field.px_height).eval(y)
    
    x1 = int(round(x0))
    y1 = int(round(y0))
    if x1 == vec_field.px_width : x1 = vec_field.px_width-1
    if y1 == vec_field.px_height : y1 = vec_field.px_height-1
    
    if x - x1 <= 0 : x2 = int(x1-1)
    else : x2 = int(x1+1)
     
    if y - y1 <= 0 : y2 = int(y1-1)
    else : y2 = int(y1+1)
    
    #boundary conditions
    if sample_pt.x < vec_field._base_pts[0].x : x2 = x1
    if sample_pt.y < vec_field._base_pts[0].y : y2 = y1
    if sample_pt.x > vec_field._base_pts[-1].x : x2 = x1
    if sample_pt.y > vec_field._base_pts[-1].y : y2 = y1
    
    
    nears = []
    nears.extend([vec_field.get(x1,y1), vec_field.get(x1,y2), vec_field.get(x2,y2), vec_field.get(x2,y1)])
    
    
    #weighted average by distance
    d0 = sample_pt.distance(vec_field._base_pts[x1+y1*vec_field.px_width])
    d1 = sample_pt.distance(vec_field._base_pts[x1+y2*vec_field.px_width])
    d2 = sample_pt.distance(vec_field._base_pts[x2+y2*vec_field.px_width])
    d3 = sample_pt.distance(vec_field._base_pts[x2+y1*vec_field.px_width])
    d_sum = d0 + d1 + d2 + d3
    d_prod = d0 * d1 * d2 * d3
    inv_sum = 1/d0 + 1/d1 + 1/d2 + 1/d3
    
    
    #sample_vec = (nears[0]*d3 + nears[1]*d2 + nears[2]*d1 + nears[3]*d0) / (d_sum)
    
    sample_vec = (nears[0]*(1/d0) + nears[1]*(1/d1) + nears[2]*(1/d2) + nears[3]*(1/d3)) / (inv_sum)
    
    
    print d0
    print d1
    print d2
    print d3
    
    
    avg_vec = Vec.average(nears)
    
    c.put(Ray(vec_field._base_pts[x1+y1*vec_field.px_width], nears[0]))
    c.put(Ray(vec_field._base_pts[x1+y2*vec_field.px_width], nears[1]))
    c.put(Ray(vec_field._base_pts[x2+y2*vec_field.px_width], nears[2]))
    c.put(Ray(vec_field._base_pts[x2+y1*vec_field.px_width], nears[3]))
    
    return sample_vec
    
b.put(Ray(s_pt,avg_vec(vf, s_pt)))
"""
# ---------- end decodes_3 ----------
geo_3 = Geometry(decodes_3.a)  # disabled
geo_4 = Geometry(decodes_3.b)  # disabled
geo_5 = Geometry(decodes_3.c)  # disabled
geo_6 = Geometry(decodes_2.c)  # disabled
panel = Panel(decodes_3.console)  # disabled
