# Grasshopper definition xf haspts test.gh (Grasshopper 0.9.14)
# plug-ins: Decodes Python Interpreter

md_slider = MDSlider(slider_value=Point(1, 0, 0.5), x_domain=Domain(0, 1), y_domain=Domain(0, 1), z_domain=Domain(0, 1), SliderMode=0)
md_slider_2 = MDSlider(slider_value=Point(1, 1, 0.5), x_domain=Domain(0, 1), y_domain=Domain(0, 1), z_domain=Domain(0, 1), SliderMode=0)
crv = Curve(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)
decodes = DecodesPythonScript(vec=md_slider, ang=Slider(0.395, range=0..6.283))  # -> console, a, b, c
# ---------- decodes: Python ----------
xf = Xform.rotation(axis=vec,angle=ang)

cs = CS(2,2)
pl = RGon(4,1.0,basis=cs)
pl * xf 
a.put([pl, pl.basis])
pl * xf 
a.put([pl, pl.basis])

cs2 = CS(2,2)
pl2 = RGon(4,1.0,basis=cs)
pl2.basis = pl2.basis * xf
b.put(pl2)


pl3 = RGon(4,1.0)
c.put(pl3)
pl3 * xf
c.put(pl3)
# ---------- end decodes ----------
decodes_2 = DecodesPythonScript(pl=crv, vec=md_slider_2, ang=Slider(0, range=0..6.283))  # -> console, a
# ---------- decodes_2: Python ----------
xf = Xform.rotation(axis=vec,angle=ang)
pl.basis = CS(Point(),Vec(0,1),Vec(1,0))

a.put(pl.basis)
a.put( pl * xf )
# ---------- end decodes_2 ----------
