# Grasshopper definition Explicit Pasta-Shapes.gh (Grasshopper 0.9.14)
# plug-ins: Decodes Python Interpreter

# ---- group: Gnocci
decodes = DecodesPythonScript()  # -> console, a
# ---------- decodes: Python ----------
import math as m
"""
Gnocci
Surface

"""




def surf_func (u, v):
    alpha =u/40 * m.sin(v/130*m.pi)
    beta = abs(m.cos((v+13)/26*m.pi))
    x = 0.2*m.cos(u*m.pi*1.3/40) * m.sin(v*m.pi/130) * beta + alpha * m.cos(u*1.3*m.pi/40)
    y = 0.2*m.sin(u*m.pi*1.3/40) * m.sin(v*m.pi/130) * beta + alpha * m.sin(u*1.3*m.pi/40)
    z = 1.5*m.cos(v*m.pi/130)
    return Point(x,y,z)

wavy = Surface(surf_func, dom_u = Interval(0,40), dom_v = Interval(0,130)).to_mesh(divs_u=40,divs_v=130)




a.put(wavy)
# ---------- end decodes ----------

# ---- group: Farfalle - bad def from book
decodes_2 = DecodesPythonScript()  # -> console, a
# ---------- decodes_2: Python ----------
import math as m
"""
Casarecce
Surface
if 20 <= u <= 60 :
"""




def surf_func (u, v):
    alph = m.sin((7*u+16)/40*m.pi)
    beta = 7*v/16 + 4*m.sin(u/80*m.pi) * m.sin((v-10)/120*m.pi)
    gamma = 10*m.cos((u+80)/80*m.pi) * m.sin((v+110)/100*m.pi)**9
    nu = 7*v/16 - 4*m.sin(u/80*m.pi) - alph * m.sin((10-v)/20*m.pi)
    ips = 7*v/16 + 4*m.sin(u/80*m.pi) + alph * m.sin((10-v)/20*m.pi)
    if 20 <= u <= 60 :
        x = 3/8 * u + 7 * m.sin((u+40)/40*m.pi)**3 *m.sin((v+110)*m.pi/100)**9
    else : x = 3/8 * u + gamma
    if v <= 10: y = nu 
    elif  10 <= v <= 70:y = beta - 4*m.sin(u/80*m.pi) * m.sin((70-v)/120*m.pi)
    else: y = ips
    z = 3 * m.sin((u+10)*m.pi/20) * m.sin(v/80*m.pi)**1.5
    return Point(x,y,z)

wavy = Surface(surf_func, dom_u = Interval(0,80), dom_v = Interval(0,80))


pasta = wavy.to_mesh(divs_u=80,divs_v=80)

a.put(pasta)
# ---------- end decodes_2 ----------

# ---- group: Orchiette
decodes_3 = DecodesPythonScript()  # -> console, a
# ---------- decodes_3: Python ----------
import math
"""
Orecchiette
Surface
"""


def surf_func (u, v):
    x = 2/3*v*math.cos(u*math.pi/75) + 0.3*math.cos(2/15*u*math.pi)
    y = 10*math.sin(u*math.pi/75)
    z = 0.1*math.cos(u*math.pi/3) + 5 * (math.cos(v*math.pi/30)**2) * (0.5 + 0.5*(math.cos(2*u*math.pi/75)))**4  + 1.5 * (0.5 + 0.5*math.cos(2*u*math.pi/75))**5 * math.sin(v*math.pi/30)**10
    return Point(x,y,z)

wavy = Surface(surf_func,  dom_u=Interval(0,150), dom_v=Interval(0,15)).to_mesh(do_close=True,divs_u=150,divs_v=15)


a.put(wavy)
# ---------- end decodes_3 ----------
decodes_4 = DecodesPythonScript()  # -> console, a
# ---------- decodes_4: Python ----------
import math
"""
Orecchiette
Surface

"""

u_div = Interval(0,150)/150
v_div = Interval(0,15)/15

print u_div

def surf_func (u_res, v_res):
    Pts = []
    for u in u_res :
        for v in v_res :
            x = 2*v*math.cos(u*math.pi/75)/3 + 0.3*math.cos(2*u*math.pi/15)
            y = 10*math.sin(u*math.pi/75)
            z = 0.1*math.cos(u*math.pi/3) + 5 * (math.cos(v*math.pi/30)**2) * (0.5 +0.5*(math.cos(2*u*math.pi/75)))**4  + 1.5 * (math.sin(v*math.pi/30)**10) * (0.5 +0.5*math.cos(2*u*math.pi/75))**5 
            Pts.append(Point(x,y,z))
    return Pts
    
a.put(surf_func(u_div, v_div))
# ---------- end decodes_4 ----------

# ---- group: Digati Rigati
decodes_5 = DecodesPythonScript()  # -> console, a
# ---------- decodes_5: Python ----------
import math as m
"""
Casarecce
Surface

"""




def surf_func (u, v):
    x = m.cos(u*m.pi/100) + 0.03*m.cos(7*u*m.pi/40) + 0.25*m.cos(v*m.pi/50)
    y = 1.1*m.sin(u*m.pi/100) + 0.03*m.sin(7*u*m.pi/40) + 0.25*m.sin(v*m.pi/50)
    z = v/10
    return Point(x,y,z)

wavy = Surface(surf_func, dom_u = Interval(0,200), dom_v = Interval(0,25))

wavy.tol_u = 200
wavy.tol_v = 25

pasta = wavy.to_mesh(divs_u=200,divs_v=25)

a.put(pasta)
# ---------- end decodes_5 ----------
