# Grasshopper definition curvature_lines.gh (Grasshopper 0.9.14)
# plug-ins: Decodes Python Interpreter

pts_b1 = Point([Point(-3.018592699, -2.024892261, -0.09282004814), Point(-3, -0.7757352849, 1.482849848), Point(-2.990803284, 0.002538433396, 0.07336474846)])
pts_b0 = Point([Point(-3.018592699, -2.024892261, 0.1003747255), Point(-3, -0.7757352849, 1.482849848), Point(-2.990803284, 0.002538433396, 0.07336474846)])
pts_b = Point(pts_b1)
pts_c = Point([Point(-3.430345193, -2.010302463, 0), Point(-3.445540397, -0.4191996433, -0.3879325821), Point(-3.440382422, -0.005936497756, 0)])
pts_a = Point([Point(-2.001169597, -2.020473651, 0), Point(-2.007284576, -1.025343648, -1.414240644), Point(-2.040558602, -0.03388352001, 0)])
decodes = DecodesPythonScript(pts_a=pts_a, pts_b=pts_b, pts_c=pts_c)  # -> console, a; inputs pts_a: list, pts_b: list, pts_c: list
# ---------- decodes: Python ----------
crv_a = Curve.bezier(pts_a)
crv_b = Curve.bezier(pts_b)
crv_c = Curve.bezier(pts_c)

def func(u,v):
    pts = [crv.eval(u) for crv in [crv_a,crv_b,crv_c]]
    return Curve.bezier(pts).eval(v)

surf = Surface(func)
a.put(surf)
# ---------- end decodes ----------
cluster = Cluster(pts_a=pts_a, pts_b=pts_b, pts_c=pts_c)  # -> crv_7, crv_8
md_slider = MDSlider(
    slider_value=Point(0.7442731159, 0.7198698463, 0.5),
    x_domain=Domain(0, 1),
    y_domain=Domain(0, 1),
    z_domain=Domain(0, 1),
    SliderMode=0)
for_surf_a = Panel("""0.1,0.5,0
0.25,0.5,0
0.5,0.5,0
0.75,0.75,0
.375,.5,0""")
panel = Panel("""0.25,0.25,0
0.75,0.25,0
0.5,0.5,0
0.25,0.75,0
0.75,0.75,0""")
for_surf_b = Panel("""0.1,0.25,0
0.25,0.25,0
0.75,0.25,0
0.25,0.75,0
0.75,0.75,0
0.1,0.75,0""")
for_surf_b_2 = Panel("""0.3333,0.6666,0
0.5,0.5,0
0.1866,0.3333,0
0.8433,0.1866,0
0.1866,0.6666,0""")
decodes_2 = DecodesPythonScript(bz_surf=decodes.a)  # -> console, a, b, c, d, e, f
# ---------- decodes_2: Python ----------
from decodes.extensions.classical_surfaces import *

def func(t):
    return Point(t,math.sin(t)+1.2)

crv = Curve(func,Interval(0,math.pi*2))
surf = RotationalSurface(crv,Vec(1,0))
a.put(surf)


def func(u,v): return Point(u,v,math.sin(u*v)) # sine surface
surf = Surface(func,Interval(-1.5,1.5),Interval(-1.5,1.5))
b.put(surf)

def func(u,v): return Point(u,v,(u**3-3*u*v**2)/4) # monkey saddle
surf = Surface(func,Interval(-1,1),Interval(-1,1))
c.put(surf)

def func(u,v): return Point(u,v,((1/3)*u**3+u*v**2+2*(u**2-v**2))/4 ) # handkerchief surface
surf = Surface(func,Interval(-1,1),Interval(-1,1))
d.put(surf)

def func(u,v): return Point(u*v,u,v**2) #umbrella surface
surf = Surface(func,Interval(0.01,1),Interval(-1,1))
e.put(surf)

f.put(bz_surf)
# ---------- end decodes_2 ----------
crv = Curve([cluster.crv_8, cluster.crv_7])
surface = Data(decodes_2.b)

# ---- group: surrogate
decodes_3 = DecodesPythonScript(surf=surface)  # -> console, a, b
# ---------- decodes_3: Python ----------
a.put(surf)
b.put(surf.to_mesh(divs_u=30,divs_v=20))
# ---------- end decodes_3 ----------

# ----
pt = Point()
pt_2 = Point(for_surf_b)

# ---- group: show curv cs
decodes_4 = DecodesPythonScript(surf=surface, uv=md_slider)  # -> console, a, b, c
# ---------- decodes_4: Python ----------
u,v = uv.x,uv.y
ival_step = Interval(0.01,0.2)

crv = surf.eval_curv(u,v,True)
step_size = Interval.remap( abs(crv[1] - crv[2]) , Interval(0,2) , ival_step)
crv_cs = crv[0]
a.put(crv_cs)

pt, u_vec, v_vec = surf._nudged(surf.domain_u.eval(u),surf.domain_v.eval(v),False)
u_vec = u_vec.normalized()
v_vec = v_vec.normalized()
n_vec = u_vec.cross(v_vec)
crv_vec = crv_cs.x_axis.normalized()
#crv_vec = crv.x_axis.inverted().normalized() # to switch direction of curv lines
#crv_vec = crv.y_axis.inverted().normalized()

xsec = Intersector()
pln = Plane(pt+crv_vec,v_vec.cross(n_vec))
if xsec.of(pln,u_vec.to_line(pt)):
    #c.put(xsec[0])
    du = xsec.dist
else: print "no intersection", xsec.log
pln = Plane(pt+crv_vec,u_vec.cross(n_vec))
if xsec.of(pln,v_vec.to_line(pt)):
    #c.put(xsec[0])
    dv = xsec.dist
    
else: print "no intersection", xsec.log


d_vec = Vec(du,dv).normalized(step_size)
#print du,dv,d_vec
uv = uv+d_vec
u,v = uv.x,uv.y
b.put(surf.eval(u,v))

a.put([pt,u_vec.to_ray(pt),v_vec.to_ray(pt),n_vec.to_ray(pt),crv_vec.to_ray(pt)])
#pln = surf.deval_pln(u,v)
# ---------- end decodes_4 ----------

# ----
decodes_5 = DecodesPythonScript(surf=surface, uv=[pt, md_slider], too_equal=Slider(0.001, range=-0.0001..0.01))  # -> console, a, b, c
# ---------- decodes_5: Python ----------
ival_step = Interval(0.01,0.05)
max_unequal = 2.0
target_pt = surf.eval(0.5,0.5) # used to set which direction of the pline to walk first

def to_domain_vec(u,v,surf,real_vec):
    pt, u_vec, v_vec = surf._nudged(surf.domain_u.eval(u),surf.domain_v.eval(v),False)
    u_vec = u_vec.normalized()
    v_vec = v_vec.normalized()
    n_vec = u_vec.cross(v_vec)
    
    xsec = Intersector()
    pln = Plane(pt+real_vec,v_vec.cross(n_vec))
    if xsec.of(pln,u_vec.to_line(pt)):
        #c.put(xsec[0])
        du = xsec.dist
    else: print "no intersection", xsec.log
    pln = Plane(pt+real_vec,u_vec.cross(n_vec))
    if xsec.of(pln,v_vec.to_line(pt)):
        #c.put(xsec[0])
        dv = xsec.dist
    else: print "no intersection", xsec.log
    
    return Vec(du,dv)

def walk_curvature(uv_pt,direction="max_curv",do_flip=False):
    pts = [surf.eval(uv_pt.x,uv_pt.y)]
    at_edge = False
    step_vec = Vec(pts[0],target_pt)
    if step_vec.length == 0 : step_vec = Vec(pts[0],surf.eval(0,0.5))
    
    if do_flip : step_vec = step_vec.inverted()
    for n in range(50):
        crv = surf.eval_curv(uv_pt.x,uv_pt.y,True)
        equalness = abs(crv[1] - crv[2])
        if equalness < too_equal : at_edge = True
        step_size = Interval.remap( equalness , Interval(too_equal,max_unequal) , ival_step, True)
        if not crv[0] : break
        crv_cs = crv[0]
        if direction == "max_curv" : crv_vec = crv_cs.x_axis.normalized()
        if direction == "min_curv" : crv_vec = crv_cs.y_axis.normalized()
        
        d_vec = to_domain_vec(uv_pt.x,uv_pt.y,surf,crv_vec).normalized(step_size)
        if step_vec:
            if step_vec.angle(d_vec) > math.pi/2 : d_vec = d_vec.inverted()
        step_vec = d_vec
        
        uv_pt = uv_pt+step_vec
        if not uv_pt in Bounds.unit_square():
            uv_pt = Bounds.unit_square().near_pt(uv_pt)
            at_edge = True
            
        pts.append(surf.eval(uv_pt.x,uv_pt.y))
        if at_edge: break
    return pts
    
c.put(surf.eval(uv.x,uv.y))

pts = walk_curvature(uv,"max_curv",False)
pts.reverse()
pts.extend(walk_curvature(uv,"max_curv",True))
a.put(PLine(pts))

pts = walk_curvature(uv,"min_curv",False)
pts.reverse()
pts.extend(walk_curvature(uv,"min_curv",True))
b.put(PLine(pts))
# ---------- end decodes_5 ----------
slider = Slider(20, range=3..20)
decodes_6 = DecodesPythonScript(surf=surface, res_u=slider, res_v=slider)  # -> console, a, b, c, d; inputs res_u: Int32, res_v: Int32; disabled
# ---------- decodes_6: Python ----------
#u,v = uv.x,uv.y
tol = 0.0001


cs = [] # either a pt or a cs
crv_min = []
crv_max = []
delta = []

for u in Interval(0.01,0.99).divide(res_u,True):
    for v in Interval(0.01,0.99).divide(res_v,True):
        crv = surf.eval_curv(u,v,True)
        crv_min.append(crv[1])
        crv_max.append(crv[2])
        delt = abs(crv[1] - crv[2])**0.2
        if delt < tol : delt = 0.0
        delta.append( delt )
        if delt==0.0:
            cs.append(surf.eval(u,v))
        else:
            cs.append(crv[0])
            
a.put(cs)
b.put(crv_min)
c.put(crv_max)
d.put(delta)
# ---------- end decodes_6 ----------
decodes_7 = DecodesPythonScript(
    cs=decodes_6.a,
    crv_min=decodes_6.b,
    crv_max=decodes_6.c,
    delta=decodes_6.d,
    ival_eql="0 to 1.2",
    ival_ten="0.05 to 0.25",
    pow=Slider(0.45, range=0.1..5),
    c0=ColourSwatch(SwatchColor=RGB(255, 0, 0)),
    c1=ColourSwatch(SwatchColor=RGB(178, 178, 178)))  # -> console, a, a_props; inputs cs: list, crv_min: list, crv_max: list, delta: list; disabled
# ---------- decodes_7: Python ----------
for n, thing in enumerate(cs):
    t = ival_eql.deval(delta[n])**pow
    if t > 1.0 : t = 1.0
    c = Color.interpolate(c0,c1,t)
    if delta[n] == 0 : 
        c = Color(0)
        thing.set_weight(5)
    else:
        dim = ival_ten.eval(t)
        crv_vec = thing.x_axis.normalized(dim)
        thing = crv_vec.to_line(thing.origin-crv_vec/2)
    
    thing.set_color(c)
    a.put(thing)

non_zero_delts = []
for d in delta: 
    if d > 0 : non_zero_delts.append(d)
print "max inequality = ", max(non_zero_delts)
print "min inequality = ", min(non_zero_delts)
# ---------- end decodes_7 ----------
graph = QuickGraph(decodes_6.d)

to_bake_curve_network = Geometry([decodes_5.a, decodes_5.b, decodes_5.c])
to_bake_wireframe = Geometry([pts_a, pts_b0, pts_c, crv])

to_bake_mesh = Geometry(decodes_3.b)

# ---- group: TO HARD BOIL - TENSORS
hardboil = DecodesHardBoil(Geometry=decodes_7.a, Properties=decodes_7.a_props)

# ----
panel_2 = Panel(decodes_7.console)
hardboil_2 = DecodesHardBoil(Geometry=decodes_7.a, Properties=decodes_7.a_props)

# ---- group: superseded
data = Data([Point(-1, -1, 0.8414709848), Line((-1, -1, 0.8414709848), (-1.009708398, -0.9103623482, 0.7982177956)), Point(-1, -0.9333333333, 0.8036082637), Line((-1, -0.9333333333, 0.8036082637), (-0.9846746751, -0.8523957681, 0.7469139522)), Point(-1, -0.8666666667, 0.7621752729), Line((-1, -0.8666666667, 0.7621752729), (-0.9848564551, -0.7877863148, 0.7026054555))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])
num = Number([6.83e-30, 0.480176366, 0.4302814799, 0.384507163, 0.3424731677, 0.3037233687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])
sort = SortList(Keys=num)  # -> Keys, ValuesA
graph_2 = QuickGraph(sort.Keys)

data_2 = Data([Point(-1, -1, 2), Line((-1, -1, 2), (-1.099999757, -0.9998702506, 1.99982188)), Point(-1, -0.9333333333, 1.613333333), Line((-1, -0.9333333333, 1.613333333), (-0.9007017397, -0.9285116418, 1.624131796)), Point(-1, -0.8666666667, 1.253333333), Line((-1, -0.8666666667, 1.253333333), (-0.9017050074, -0.8554708312, 1.267919207))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])
num_2 = Number([7.24e-31, 0.0598463921, 0.07926681559, 0.1075295719, 0.1499567154, 0.215359686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])
data_3 = Data([Point(-1, -1, 0.5), Line((-1, -1, 0.5), (-1.09998895, -0.9991069016, 0.4988115754)), Point(-1, -0.9333333333, 0.4033333333), Line((-1, -0.9333333333, 0.4033333333), (-0.9030095657, -0.9427721498, 0.4257780297)), Point(-1, -0.8666666667, 0.3133333333), Line((-1, -0.8666666667, 0.3133333333), (-0.9041035268, -0.874062134, 0.340704367))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])
num_3 = Number([2.41e-31, 0.4025932638, 0.4565097537, 0.5118186566, 0.5658445611, 0.6157111957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])

# ---- group: superseded / direction vis
decodes_8 = DecodesPythonScript()  # -> console, a, a_props; inputs res_u: Int32, res_v: Int32
# ---------- decodes_8: Python ----------
#u,v = uv.x,uv.y
tol = 0.0001


tensors = [] #(usually lines, sometimes just points)
deltas = []
for u in Interval()/res_u:
    for v in Interval()/res_v:
        crv = surf.eval_curv(u,v,True)
        delt = abs(crv[1] - crv[2])**0.2
        if delt < tol : delt = 0.0
        deltas.append( delt )
        if delt==0.0:
            tensors.append(surf.eval(u,v))
        else:
            crv_cs = crv[0]
            crv_vec = crv_cs.x_axis.normalized(0.1)
            tensors.append(crv_vec.to_line(crv_cs.origin-crv_vec/2))
print "max inequality = ", max(deltas)
ival_delt = Interval(tol,max(deltas))
c1 = Color(1)
c0 = Color(1,0,0)
for n, thing in enumerate(tensors):
    c = Color.interpolate(c0,c1,ival_delt.deval(deltas[n]))
    if deltas[n] == 0 : 
        c = Color(0)
        thing.set_weight(5)
    thing.set_color(c)


a.put(tensors)
# ---------- end decodes_8 ----------

# ---- group: superseded
panel_3 = Panel(decodes_8.console)

# ==== cluster Cluster
pts_b = ClusterInput()
pts_a = ClusterInput()
pts_c = ClusterInput()
pts_b_2 = Point(pts_b)
pts_a_2 = Point(pts_a)
pts_c_2 = Point(pts_c)
pt = Point(graft(pts_c_2))
pt_2 = Point(graft(pts_b_2))
pt_3 = Point(graft(pts_a_2))
pline = PolyLine(Vertices=pts_b_2, Closed=False)
pline_2 = PolyLine(Vertices=pts_c_2, Closed=False)
pline_3 = PolyLine(Vertices=pts_a_2, Closed=False)
crv = Curve(Vertices=pts_c_2, Degree=2, Periodic=False)  # -> Curve, Length, Domain
crv_2 = Curve(Vertices=pts_a_2, Degree=2, Periodic=False)  # -> Curve, Length, Domain
merge = Merge(Data1=pt_3, Data2=pt_2, Data3=pt)
bang = ExplodeTree(Data=merge)  # -> Branch0, Branch1, Branch2
crv_3 = Curve(Vertices=bang.Branch2, Degree=2, Periodic=False)  # -> Curve, Length, Domain
crv_4 = Curve(Vertices=bang.Branch0, Degree=2, Periodic=False)  # -> Curve, Length, Domain
pline_4 = PolyLine(Vertices=bang.Branch1, Closed=False)
pline_5 = PolyLine(Vertices=bang.Branch2, Closed=False)
pline_6 = PolyLine(Vertices=bang.Branch0, Closed=False)
crv_5 = Curve([pline_3, pline_5, pline, pline_4, pline_2, pline_6])
crv_6 = Curve([crv_2.Curve, crv.Curve, crv_4.Curve, crv_3.Curve])
crv_7 = ClusterOutput(crv_5)
crv_8 = ClusterOutput(crv_6)
