# Grasshopper definition gherkin.gh (Grasshopper 0.9.14)
# plug-ins: Decodes Python Interpreter

number_of_rotations = Slider(0.5, range=0..2)
radius_at_base = Slider(32, range=0..100)
radius_at_top = Slider(4, range=0..100)
total_height = Slider(150, range=0..300)
mid_hieght = Slider(90, range=5..295)
mid_radius = Slider(52, range=0..100)

# ---- group: resolution
u_res = Slider(35, range=0..100)
r_res = Slider(35, range=0..100)

# ----
decodes = DecodesPythonScript(
    h=total_height,
    rad_top=radius_at_top,
    rad_mid=mid_radius,
    rad_base=radius_at_base,
    mid_cp=mid_hieght,
    num_rot=number_of_rotations,
    u_res=u_res)  # -> console, a, b; inputs u_res: Int32
# ---------- decodes: Python ----------
import math

curve_pts = []
floor_hts = []
env_rad = []

r_ival = Interval(0, 2*math.pi*num_rot)

mid_cp

for f in range (u_res+1) : floor_hts.append(h*(f/u_res))
profile_crv = Curve.bezier([Point(rad_base,0,0),Point(rad_mid,0,mid_cp),Point(rad_top,0,h)])

for n in range (u_res+1) :
    pt = profile_crv.eval(n/u_res).origin
    print r_ival.eval(n/u_res)
    xf = Xform.rotation(center = Point(), axis = Vec(0,0,1), angle=r_ival.eval(n/u_res))
    pt *= xf
    curve_pts.append(pt)

a.put(PLine(curve_pts))
b.put(profile_crv)
# ---------- end decodes ----------
crv = Curve(decodes.b)
decodes_2 = DecodesPythonScript(h_line=decodes.a, r_res=r_res)  # -> console, a; inputs r_res: Int32
# ---------- decodes_2: Python ----------
import math

rot_ival = Interval(0, 2*math.pi)

lines = []
lines.append(h_line)

#for r in range(r_res) : print rot_ival.eval(rot_ival/(r+1))

for r in range(r_res):
    newline = []
    for pt in h_line:
        xf = Xform.rotation(center = Point(), axis = Vec(0,0,1), angle=rot_ival.eval(r/r_res))
        pt*= xf
        newline.append(pt)
    profile_incr = PLine(newline)
    lines.append(profile_incr)

a.put(lines)
# ---------- end decodes_2 ----------
mesh_linear_srf = DecodesPythonScript(srf_lns=decodes_2.a)  # -> console, a; inputs srf_lns: list of Polyline
# ---------- mesh_linear_srf: Python ----------
def msh2lns (line1, line2, mesh, row):
    for i, pt in enumerate(line1):
        mesh.append(pt)
        mesh.append(line2[i])
    total = len(line1) + len(line2)
    row *= total
    for ii in range (total-2):
        if ii%2 >0:
            mesh.add_face(row+ii,row+ii+2,row+ii+1)
        else:
            mesh.add_face(row+ii,row+ii+1,row+ii+2)
    return mesh

def msh_linear_srf (lines):
    msh = Mesh()
    length = len(lines)
    for indx, l in enumerate(lines):
        msh2lns(lines[indx-1], lines[indx], msh, indx)
        print indx
    return msh

pinecone = msh_linear_srf(srf_lns)


a.put(pinecone)
# ---------- end mesh_linear_srf ----------
mesh = Mesh(mesh_linear_srf.a)
