# Grasshopper definition quadtreeclass.gh (Grasshopper 0.9.14)
# plug-ins: Decodes Python Interpreter

slider = Slider(10, range=0..10)
slider_2 = Slider(10, range=0..10)
md_slider = MDSlider(
    slider_value=Point(0.4951220257, 0.4690246582, 0.5),
    x_domain=Domain(0, 5),
    y_domain=Domain(0, 5),
    z_domain=Domain(0, 1),
    SliderMode=0)
slider_3 = Slider(1, range=0..1)
md_slider_2 = MDSlider(
    slider_value=Point(0.4634146807, 0.3926830757, 0.5),
    x_domain=Domain(0, 5),
    y_domain=Domain(0, 5),
    z_domain=Domain(0, 1),
    SliderMode=0)  # disabled
rectangle = Rectangle(Plane=PlaneXY(0, 0, 0), XSize=slider_2, YSize=slider, Radius=0)  # -> Rectangle, Length
slider_4 = Slider(9, range=0..10)
pop2d = Populate2D(Region=rectangle.Rectangle, Count=Slider(216, range=0..500), Seed=1)
pt = Point(md_slider)
cir = Circle(Plane=pt, Radius=expr("R/2", slider_3))
pt_2 = Point(md_slider_2)
pt_3 = Point(Point(4.370143807, 4.199721879, 0))
decodes = DecodesPythonScript(pts=pop2d, w=slider_2, h=slider, npt=pt, range=slider_3)  # -> console, a, b, c; inputs pts: list
# ---------- decodes: Python ----------
def report():
    print "----"
    print qt.has_children
    print qt.pts
    if qt.has_children:
        print qt.children[0].has_children
        print qt.children[0].pts

    
rect=Bounds(Point(w/2,h/2),w+0.5,h+0.5)
a.put(rect.corners)

qt = QuadTree(4, rect)
for pt in pts:
    qt.append(pt)
    
report()


def qt_to_geom(tree):
    if tree.has_children:
        return [qt_to_geom(child) for child in tree.children]
    else:
        return PLine(tree.bnd.corners)
        
b.put(qt_to_geom(qt))


nrect = Bounds(npt,range,range)
c.put(qt.pts_in_bounds(nrect))
# ---------- end decodes ----------
decodes_2 = DecodesPythonScript(pt=pt_2)  # -> console, a; disabled
# ---------- decodes_2: Python ----------
    
rect=Bounds(Point(2.5,2.5),4,4)
a.put(rect.corners)

qt = QuadTree(4, rect)

for n in range(6):
    qt.append(pt)
    print qt.has_children, qt.pts

"""
qt.divide()
for child in qt.children:
    if child.contains(pt): a.put(child.bnd.corners)
"""
# ---------- end decodes_2 ----------
pt_4 = Point(decodes.c)
crv = Curve(decodes.b)
rect_class = DecodesPythonScript(y=pt_3, w2=slider_4, h2=slider_4)  # -> console, a, b, c; disabled
# ---------- rect_class: Python ----------
tp = y
rcent = Point(4,3,5)
rectagon = Bounds(rcent, 3, 5) 
rcent2 = y
rectagon2 = Bounds(rcent2, w2, h2)

Answer = rectagon.intersects(rectagon2)
print Answer
a.put(rectagon.corners)
b.put(rectagon2.corners)
# ---------- end rect_class ----------
pline = PolyLine(Vertices=decodes.a, Closed=True)
pline_2 = PolyLine(Vertices=decodes_2.a, Closed=True)  # disabled
