# Grasshopper definition shelden packing.gh (Grasshopper 0.9.14)
# plug-ins: Decodes Python Interpreter

hex = Geometry()
crv = Curve(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)
quad = Curve(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)
pent = Geometry(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)
tri = Geometry(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)
decodes = DecodesPythonScript(
    pgon=crv,
    mat_w=Slider(1.9, range=0.5..10),
    mat_h=Slider(0.5, range=0.1..1.1),
    edge_num=Slider(0, range=0..3),
    iterat=Slider(5, range=0..10))  # -> console, a, b; inputs edge_num: Int32, iterat: Int32
# ---------- decodes: Python ----------
mat_size = mat_w, mat_h

#b.put([pgon.pts[0],pgon.pts[1],pgon.pts[2],pgon.pts[3]])

"""
edge = pgon.edges[0]
off_vec = edge.vec.cross(Vec(edge.spt,pgon.centroid)).cross(edge.vec)
line = Line(edge.spt + off_vec.normalized(mat_size[0]), edge.vec)

xsec = Intersector()

p0, p1 = None, None
if xsec.of(line,pgon.edges[-1]) : p0 = xsec[0]
if xsec.of(line,pgon.edges[1]) :p1 = xsec[0]
if p0 is None or p1 is None:
    print "wtf?"
#a.put(Segment(p0,p1))
"""

def panel_cut (fgon, mat_size, ee):
    xsec = Intersector()
    
    if len (pgon.pts) < 4:
        edge = fgon.edges[0]
        off_vec = edge.vec.cross(Vec(edge.spt,fgon.centroid)).cross(edge.vec)
        line = Line(edge.spt + off_vec.normalized(mat_size), edge.vec)
        if xsec.of(line,fgon.edges[1]) : p0 = xsec[0]
        if xsec.of(line,fgon.edges[2]) : p1 = xsec[0]
        panelpts = [p0,p1,fgon.pts[ee-2],fgon.pts[ee]]
        ngonspts =[p0,p1,fgon.pts[ee-1]]
        #b.put(ngonspts)
        return [PGon(panelpts),PGon(ngonspts)]
    
    edge = fgon.edges[ee]
    off_vec = edge.vec.cross(Vec(edge.spt,fgon.centroid)).cross(edge.vec)
    line = Line(edge.spt + off_vec.normalized(mat_size), edge.vec)
    
    
    p0, p1, p2 = None, None, None
    if xsec.of(line,fgon.edges[ee-1]) : p0 = xsec[0]
    if xsec.of(line,fgon.edges[ee-3]) : p1 = xsec[0]
    
    if xsec.of(line,fgon.edges[ee-2]) and 0 < xsec.tb <1:
        p2 = xsec[0]
        if ee == 0 : panelpts = [p2,p1,fgon.pts[ee-3],fgon.pts[ee],fgon.pts[ee-1]]
        if ee == 1 : panelpts = [p2,fgon.pts[ee-2],fgon.pts[ee-3],fgon.pts[ee],p0]
        if ee == 2 : panelpts = [fgon.pts[ee-2],p2,p0,fgon.pts[ee],fgon.pts[ee-3]]
        if ee == 3 : panelpts = [fgon.pts[ee-3],fgon.pts[ee-2],p2,p0,fgon.pts[ee]]
        if ee == 0 : ngonspts = [p2,p1,fgon.pts[ee-2]]
        if ee == 1 : ngonspts = [p2,p0,fgon.pts[ee-1]]
        if ee == 2 : ngonspts = [p2,p0,fgon.pts[ee-1]]
        if ee == 3 : ngonspts = [p2,p0,fgon.pts[ee-1]]
        #b.put(panelpts)
        b.put(ngonspts)
    else: 
        panelpts = [fgon.pts[ee],fgon.pts[ee-3],p1,p0]
        if ee == 0 : ngonspts =[p0,p1,fgon.pts[ee-2],fgon.pts[ee-1]]
        elif ee == 1 : ngonspts =[fgon.pts[ee-2],p1,p0,fgon.pts[ee-1]]
        elif ee == 2 : ngonspts =[fgon.pts[ee-2],fgon.pts[ee-1],p0,p1]
        elif ee == 3 : ngonspts =[p1,fgon.pts[ee-2],fgon.pts[ee-1],p0]
    panel = PGon(panelpts)
    new_pgon = PGon(ngonspts)
    return [panel, new_pgon]

panels = []  
#panels = panel_cut (pgon, mat_w, 3)
for n in range (iterat):
    
    slice = panel_cut (pgon, mat_w, edge_num)
    panels.append(slice[0])
    if not slice[1] : break
    pgon = slice[1]

a.put(panels)
#b.put(panels[1])
# ---------- end decodes ----------
decodes_2 = DecodesPythonScript(p_gon=tri, mat_width=Slider(0.5, range=0.5..10), edg_num=Slider(0, range=0..4), iter=Slider(3, range=0..10))  # -> console, a, b; inputs edg_num: Int32, iter: Int32
# ---------- decodes_2: Python ----------
def panel_cut(pgon, panel_width, ei) :
    pgon.rotate(ei)
    edge = pgon.edges[0]
    lhedge = pgon.edges[1]
    rhedge = pgon.edges[-1]
    rem_edge = len(pgon.edges) -2
    
    xsec = Intersector()
    
    off_vec = edge.vec.cross(Vec(edge.spt,pgon.centroid)).cross(edge.vec)
    line = Line(edge.spt + off_vec.normalized(mat_width), edge.vec)
    lh_step = False
    rh_step = False
    
    if xsec.of(line,lhedge) and 0 <= xsec.tb <= 1 : p0 = xsec[0]
    else :
        rem_edge -= 1
        if rem_edge == 0 : return [False, False, False]
        lhedge = pgon.edges[2]
        lh_step = True
        if xsec.of(line,lhedge) and 0 <= xsec.tb <= 1 : p0 = xsec[0]
    
    if xsec.of(line,rhedge) and 0 <= xsec.tb <= 1 : p1 = xsec[0]
    else :
        rem_edge -= 1
        if rem_edge == 0 : return [False, False, False]
        rhedge = pgon.edges[-2]
        rh_step = True
        if xsec.of(line,rhedge) and 0 <= xsec.tb <= 1 : p1 = xsec[0]
    
    
    b.put(pgon.pts)
    panelpts = [p0,p1,pgon.pts[0],pgon.pts[1]]
    if lh_step and not rh_step: panelpts =  [pgon.pts[0],pgon.pts[1],pgon.pts[2],p0,p1]
    if rh_step and not lh_step: panelpts = [pgon.pts[-1],pgon.pts[0],pgon.pts[1],p0,p1]
    if lh_step and rh_step : panelpts = [pgon.pts[-1],pgon.pts[0],pgon.pts[1],pgon.pts[2],p0,p1]
    
    npgonpts = [p0,p1]
    
    #print rem_edge
    for r in range(rem_edge) : 
        r+=1
        if rh_step : r+=1
        npgonpts.append(pgon.pts[-r])
    #print panelpts
    panel = PGon(panelpts)
    npgon = PGon(npgonpts)
    npgon.rotate(-ei)
    return [panel, npgon, True]
    
panels = []
group = [True,True,True]

while group[2] == True:
#for n in range(iter) :
    group = panel_cut(p_gon, mat_width, edg_num) 
    panels.append(group[0])
    p_gon = group[1]
a.put(panels)
# ---------- end decodes_2 ----------
branch = TreeBranch(Tree=decodes_2.b, Path=Slider(1, range=0..10), MaintainPaths=True)
geo = Geometry(decodes.a)
item = ListItem(List=decodes.b, Index=Slider(2, range=0..10), Wrap=False)
item_2 = ListItem(List=branch, Index=Slider(0, range=0..10), Wrap=False)
dispatch = Dispatch(List=geo, DispatchPattern=[True, False])  # -> ListA, ListB
geo_2 = Geometry(dispatch.ListB)
geo_3 = Geometry(dispatch.ListA)
