# Grasshopper definition voxelclass.gh (Grasshopper 0.9.14)
# plug-ins: Decodes Python Interpreter

slider = Slider(20, range=0..100)  # disabled
rec_2pt = Rectangle2Pt(Plane=PlaneXY(0, 0, 0), PointA=Point(0, 0, 0), PointB=Point(10, 5, 0), Radius=0)  # -> Rectangle, Length; disabled
pt = PointXYZ(XComponent=15, YComponent=0, ZComponent=0, System=PlaneXY(0, 0, 0))  # disabled
pt_2 = PointXYZ(XComponent=25, YComponent=15, ZComponent=slider, System=PlaneXY(0, 0, 0))  # disabled
move = Move(Geometry=pt_2)  # -> Geometry, Transform; disabled
mplane = MeshPlane(Boundary=rec_2pt.Rectangle, WidthCount=10, HeightCount=10)  # -> Mesh, Area; disabled
box = Box2Pt(PointA=pt, PointB=pt_2, Plane=PlaneXY(0, 0, 0))  # disabled
mbox = MeshBox(Base=box, XCount=10, YCount=10, ZCount=10)  # disabled
box_2 = Box2Pt(PointA=pt_2, PointB=pt_2, Plane=PlaneXY(0, 0, 0))  # disabled
mbox_2 = MeshBox(Base=box_2, XCount=10, YCount=10, ZCount=10)  # disabled
mshadow = MeshShadow(Mesh=mbox, Light=Vector(-0.25, -0.12, -1), Plane=PlaneXY(0, 0, 0))  # disabled
mshadow_2 = MeshShadow(Mesh=mbox_2, Light=Vector(-0.25, -0.12, -1), Plane=PlaneXY(0, 0, 0))  # disabled
decodes = DecodesPythonScript()  # -> console, a
# ---------- decodes: Python ----------
class Voxel ():
    """
    Currently rounds down to nearest whole Voxel
    
    """
    def __init__(self, bounds3d, res_x, res_y, res_z, switch=False):
        self.x_vals = int(bounds3d.dim_x//res_x)
        self.y_vals = int(bounds3d.dim_y//res_y)
        self.z_vals = int(bounds3d.dim_z//res_z)
        if switch : self.type = True
        else :self.type = False
        
        if switch :
            self.stack = []
            for b in range(self.z_vals):
                self.stack.append(ValueField(pixel_res=Interval(self.x_vals,self.y_vals), initial_value = 0.0,include_corners=False,wrap=True))
            
        else :
            self.stack = []
            for b in range(self.z_vals):
                self.stack.append(BoolField(pixel_res=Interval(self.x_vals,self.y_vals), initial_value = 0.0,ic=False,wrap=True))
            
            
    def set (self,x,y,z,value) :
        self.stack[z].set(x,y,value)
    
    def get (self,x,y,z) :
        return self.stack[z].get(x,y)
        
    
    def surrogate(self) :
        pts = []
        if self.type :
            for g in range (self.stack) :
                for ind, b in enumerate(self.stack[g]._pixels):
                    x = ind%self.x_vals
                    y = ind//self.y_vals
                    pt = Point(x,y,g*res_z)
                    pt.set_color(Color(b))
                    pt.set_weight(2)
                    pts.append(pt)
        else :
            for ig, g in enumerate (self.stack) :
                for ind, b in enumerate(g._pixels):
                    if b :
                        x = ind%self.x_vals
                        y = ind//self.y_vals
                        pts.append(Point(x,y,ig*res_z))
        return pts
    

envelope = Bounds(ival_x = Interval(0,15) ,ival_y = Interval(0,25) ,ival_z = Interval(0,50) )

building = Voxel(envelope, 1, 1, 1, switch=False)

for s in building.stack : 
        for sp in s._pixels :
            sp = random.random

approx = building.surrogate()


a.put(approx)
# ---------- end decodes ----------
planar = PlanarSrf(Edges=mshadow)  # disabled
mesh = MeshBrep(
    Brep=planar,
    Settings={Refine=True, JaggedSeams=False, SimplePlanes=True, GridMinCount=16, GridMaxCount=0, Tolerance=0, RefineAngle=0, MinTolerance=0, RelativeTolerance=0.65, MinEdgeLength=0.0001, MaxEdgeLength=0})  # disabled
planar_2 = PlanarSrf(Edges=mshadow_2)  # disabled
mesh_2 = MeshBrep(
    Brep=planar_2,
    Settings={Refine=True, JaggedSeams=False, SimplePlanes=True, GridMinCount=16, GridMaxCount=0, Tolerance=0, RefineAngle=0, MinTolerance=0, RelativeTolerance=0.65, MinEdgeLength=0.0001, MaxEdgeLength=0})  # disabled
