# Grasshopper definition voxelclass2.gh (Grasshopper 0.9.14)
# plug-ins: Decodes Python Interpreter

slider = Slider(20, range=0..100)  # disabled
rec_2pt = Rectangle2Pt(Plane=PlaneXY(0, 0, 0), PointA=Point(0, 0, 0), PointB=Point(10, 5, 0), Radius=0)  # -> Rectangle, Length; disabled
pt = PointXYZ(XComponent=15, YComponent=0, ZComponent=0, System=PlaneXY(0, 0, 0))  # disabled
pt_2 = PointXYZ(XComponent=25, YComponent=15, ZComponent=slider, System=PlaneXY(0, 0, 0))  # disabled
move = Move(Geometry=pt_2)  # -> Geometry, Transform; disabled
mplane = MeshPlane(Boundary=rec_2pt.Rectangle, WidthCount=10, HeightCount=10)  # -> Mesh, Area; disabled
box = Box2Pt(PointA=pt, PointB=pt_2, Plane=PlaneXY(0, 0, 0))  # disabled
mbox = MeshBox(Base=box, XCount=10, YCount=10, ZCount=10)  # disabled
box_2 = Box2Pt(PointA=pt_2, PointB=pt_2, Plane=PlaneXY(0, 0, 0))  # disabled
mbox_2 = MeshBox(Base=box_2, XCount=10, YCount=10, ZCount=10)  # disabled
mshadow = MeshShadow(Mesh=mbox, Light=Vector(-0.25, -0.12, -1), Plane=PlaneXY(0, 0, 0))  # disabled
mshadow_2 = MeshShadow(Mesh=mbox_2, Light=Vector(-0.25, -0.12, -1), Plane=PlaneXY(0, 0, 0))  # disabled
decodes = DecodesPythonScript()  # -> console, a, a_props, b, b_props
# ---------- decodes: Python ----------
class Voxel ():
    """
    Currently rounds down to nearest whole Voxel
    
    """
    def __init__(self, bounds3d, res_x, res_y, res_z):
        self.x_vals = int(bounds3d.dim_x//res_x)
        self.y_vals = int(bounds3d.dim_y//res_y)
        self.z_vals = int(bounds3d.dim_z//res_z)
        self.rez_x = res_x 
        self.rez_y = res_y 
        self.rez_z = res_z 
        
        self.stack = []
        for b in range(self.z_vals):
            self.stack.append(ValueField(pixel_res=Interval(self.x_vals,self.y_vals), initial_value = 0.0,include_corners=False,wrap=True))
        
    
    
    def set (self,x,y,z,value) :
        self.stack[z]._pixels[int(self.y_vals*y+x)] = value
    
    def get (self,x,y,z) :
        return self.stack[int(z)]._pixels[int(self.y_vals*y+x)] 
    
    def pt_rows (self, stack_index) :
        rows = []
        for r in range (self.y_vals) : rows.append([])
        for ni, n in enumerate(self.stack[stack_index]._pixels): 
            x = ni%self.x_vals
            y = ni//self.x_vals
            pt = Point(x*self.rez_x, y*self.rez_y, stack_index*self.rez_z)
            rows[ni // self.x_vals].append(pt)
        return rows
    
    def to_pts(self) :
        pts = []
        for g in range (len(self.stack)) :
            for ind, b in enumerate(self.stack[g]._pixels):
                x = ind%self.x_vals
                y = ind//self.x_vals
                pt = Point(x*self.rez_x, y*self.rez_y, g*self.rez_z)
                #pt.val = b
                pts.append(pt)
        return pts
    
    def to_cpts(self) :
        pts = []
        for g in range (len(self.stack)) :
            for ind, b in enumerate(self.stack[g]._pixels):
                x = ind%self.x_vals
                y = ind//self.x_vals
                pt = Point(x*self.rez_x, y*self.rez_y, g*self.rez_z)
                pts.append(pt)
                pt.set_weight(b)
                pt.set_color(Color(b))
        return pts
    

envelope = Bounds(ival_x = Interval(0,15), ival_y = Interval(0,25), ival_z = Interval(0,50))

building = Voxel(envelope, 2.5, 2.5, 2.5)

for s in range (len(building.stack)) : 
    for sp in range(len(building.stack[s]._pixels)) :
        building.stack[s]._pixels[sp] = random.random()

print building.get(0,5,0)

fifth = building.pt_rows(5)

print fifth[4]

approx = building.to_cpts()

a.put(approx)

b.put (fifth[4])
# ---------- end decodes ----------
planar = PlanarSrf(Edges=mshadow)  # disabled
mesh = MeshBrep(
    Brep=planar,
    Settings={Refine=True, JaggedSeams=False, SimplePlanes=True, GridMinCount=16, GridMaxCount=0, Tolerance=0, RefineAngle=0, MinTolerance=0, RelativeTolerance=0.65, MinEdgeLength=0.0001, MaxEdgeLength=0})  # disabled
planar_2 = PlanarSrf(Edges=mshadow_2)  # disabled
mesh_2 = MeshBrep(
    Brep=planar_2,
    Settings={Refine=True, JaggedSeams=False, SimplePlanes=True, GridMinCount=16, GridMaxCount=0, Tolerance=0, RefineAngle=0, MinTolerance=0, RelativeTolerance=0.65, MinEdgeLength=0.0001, MaxEdgeLength=0})  # disabled
hardboil = DecodesHardBoil(Geometry=decodes.a, Properties=decodes.a_props)
hardboil_2 = DecodesHardBoil(Geometry=decodes.b, Properties=decodes.b_props)
