# Grasshopper definition 3.09.L02-L05 - Surfaces.gh (Grasshopper 0.9.14)
# plug-ins: Python Interpreter, Decodes Python Interpreter

# ---- group: Filepather v2.0
# Determines base filepath and file id for this Grasshopper definition.
# 
# Do not cluster.
press_to_refresh_after_save_as = Button()
c_script = CSharpScript(refresh=press_to_refresh_after_save_as)  # -> out, A
# ---------- c_script: C# ----------
    GH_Document gh_d = owner.OnPingDocument();

    if (gh_d.IsFilePathDefined)
    {
      Print("A path is defined.");
      A = gh_d.FilePath;
    }
    else
    {
      Print("No path defined.");
    }
# ---------- end c_script ----------
python = PythonScript(x=c_script.A, y=" - ")  # -> out, a, b
# ---------- python: Python ----------
import re
a = False
b = False
spath = x.split(y)
path = y.join(spath[:-1])

id = spath[-2].split('\\')[1]
if re.match(r'\d.\d\d.\D\d\d',id) :
    if '\\fieldguide\\' in path and '.gh' not in path: 
        a = path
        b = id
# ---------- end python ----------
base_filepath = Data(python.a)
file_id = Data(python.b)
panel = Panel(file_id)

# ----
file_description = Panel("TODO")

# ----
# 3.10.04
crvs = Curve([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])  # disabled
curve_points = Point([Point(0, 0, 0), Point(0, 0.3094975549, 0.3417666388), Point(0.1544445374, 1.746816852, -0.3675136662), Point(0, 2.046117298, 0.8879580995)])  # disabled
rail_points = Point([Point(0, 0, 0), Point(1.03400497, 1.082456826, 0.5406159429), Point(1.241072145, 0, -0.1328753718), Point(1.700161103, 0, 0.2915466293)])  # disabled
decodes = DecodesPythonScript(crv_pts=curve_points, rail_pts=rail_points)  # -> console, a; inputs crv_pts: list, rail_pts: list; disabled
# ---------- decodes: Python ----------
def func(u,v):
    rail = Curve.bezier(rail_pts)
    vec = crv_pts[0] - rail.eval(u)
    new_crv = Curve.bezier([pt - vec for pt in crv_pts])
        
    return new_crv.eval(v)

a.put(func)
# ---------- end decodes ----------
panel_2 = Panel("Translational Surface")  # disabled

# ----
# 3.10.03
md_slider = MDSlider(
    slider_value=Point(0.9804877304, 0.8158539563, 0.5),
    x_domain=Domain(0, 1),
    y_domain=Domain(0, 1),
    z_domain=Domain(0, 1),
    SliderMode=0)  # disabled
slider = Slider(0.583, range=0..1)  # disabled
slider_2 = Slider(1, range=0..1)  # disabled
cluster = Cluster(num=slider_2, V=md_slider, num_2=slider)  # disabled
slider_3 = Slider(4.16, range=0..6.28)  # disabled
slider_4 = Slider(6.28, range=0..6.28)  # disabled
dom = Domain(DomainStart=slider_3, DomainEnd=slider_4)  # disabled
pts = Point(cluster)  # disabled
crv = Curve(Vertices=pts, Degree=2, Periodic=False)  # -> Curve, Length, Domain; disabled
decodes_2 = DecodesPythonScript(pts=pts, rot_ival=dom)  # -> console, a; inputs pts: list; disabled
# ---------- decodes_2: Python ----------
import math

def func(u,v):
    #evaluates the domain of the rotated surface
    angle = rot_ival.eval(u)
    rot_axis = Vec(1,1,1)
    xf = Xform.rotation(axis=rot_axis,angle=angle,center=Point(0,0,0) )
    rot_pts = [pt*xf for pt in pts]
    
    crv = Curve.bezier(rot_pts)
    
    return crv.eval(v)
    

a.put(func)
# ---------- end decodes_2 ----------
panel_3 = Panel("Rotational Surface")  # disabled
crv_2 = Curve([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])  # disabled
surface_function = Data(decodes_2.a)  # disabled

# ----
# 3.10.05
slider_5 = Slider(60, range=0..100)  # disabled
slider_6 = Slider(95, range=-360..360)  # disabled
slider_7 = Slider(17, range=0..100)  # disabled
decodes_3 = DecodesPythonScript(u_vals=slider_5, v_vals=slider_7, twist=slider_6)  # -> console, b, a; disabled
# ---------- decodes_3: Python ----------
from math import *


base = []
top = []
lines = []
length = 4 # could be externalized
radius = 1 # could be externalized
height = sqrt(length**2 - (radius**2*radians(twist)**2))

for i in Interval(0, 2*pi).divide(int(u_vals), True):
    pt = Point(cos(i), sin(i),0)
    base.append(pt)
    top.append(pt * Xform.rotation(angle = radians(twist), axis = Vec(0,0,1) ) + Vec(0,0,height))

for i in range(len(base)):
    lines.append(Segment(base[i], top[i]))

a.put(lines)
#b.put(lines[int(u_vals)].eval(v_vals))
# ---------- end decodes_3 ----------
decodes_4 = DecodesPythonScript(lines=decodes_3.a)  # -> console, a; inputs lines: list; disabled
# ---------- decodes_4: Python ----------
def func(u,v):
    return lines[u].eval(v)

print func(1,1)

a.put(func)
# ---------- end decodes_4 ----------
series = Series(Start=0, Step=1, Count=slider_5)  # disabled
range = Range(Domain=Domain(0, 1), Steps=slider_7)  # disabled
decodes_5 = DecodesPythonScript(func=decodes_4.a, u_vals=series, v_vals=range)  # -> console, a; inputs u_vals: list, v_vals: list; disabled
# ---------- decodes_5: Python ----------
msh = Mesh()
for v in v_vals:
    for u in u_vals:
        msh.append(func(int(u),v))

count_u = len(u_vals)
count_v = len(v_vals)

for j in range(count_v):
    row = j*(count_u+1)
    for i in range(count_u):
        pi_0 = row+i
        pi_1 = row+i+1
        pi_2 = row+i+count_u+2
        pi_3 = row+i+count_u+1
        msh.add_face(pi_0,pi_1,pi_2)
        msh.add_face(pi_0, pi_2, pi_3)
a.put(msh)
# ---------- end decodes_5 ----------

# ----
# 3.10.05
slider_8 = Slider(60, range=0..100)
slider_9 = Slider(17, range=0..100)
decodes_6 = DecodesPythonScript(u_vals=slider_8, v_vals=slider_9, twist=Slider(95, range=-360..360))  # -> console, b, a; same code as decodes_3
decodes_7 = DecodesPythonScript(lines=decodes_6.a)  # -> console, a; inputs lines: list; same code as decodes_4
series_2 = Series(Start=0, Step=1, Count=slider_8)
range_2 = Range(Domain=Domain(0, 1), Steps=slider_9)
decodes_8 = DecodesPythonScript(func=decodes_7.a, u_vals=series_2, v_vals=range_2)  # -> console, a; inputs u_vals: list, v_vals: list; same code as decodes_5

python_2 = PythonScript(base_filepath=base_filepath, description=file_description)  # -> out
# ---------- python_2: Python ----------
if base_filepath:
    f = open(base_filepath+'.txt','w')
    f.write(description.replace('\r',''))
    f.close()
# ---------- end python_2 ----------
res_v = Slider(8, range=2..20)
range_3 = Range(Domain=Domain(0, 1), Steps=res_v)
decodes_9 = DecodesPythonScript()  # -> console, a
# ---------- decodes_9: Python ----------
from math import *


def func(u,v):
    base = []
    top = []
    lines = []
    for i in Interval(0, 2*pi).divide(10, True):
        pt = Point(cos(i), sin(i),0)
        base.append(pt)
        top.append(pt + Vec(0,0,1))

    for i in range(len(base)):
        lines.append(Segment(base[i], top[i]))

    
    return lines[u].eval(v)

a.put(func)
# ---------- end decodes_9 ----------
decodes_10 = DecodesPythonScript(func=decodes_9.a, v_vals=range_3)  # -> console, a; inputs u_vals: list, v_vals: list
# ---------- decodes_10: Python ----------
msh = Mesh()
for v in v_vals:
    for u in u_vals:
        msh.append(func(int(u),v))

res_u = len(u_vals)


# simple triangulation style
for v in range(len(v_vals)):
    row = v*res_u
    for u in range(len(u_vals)-1):
        pi_0 = row+u
        pi_1 = row+u+1
        pi_2 = row+u+res_u+1
        pi_3 = row+u+res_u
        msh.add_face(pi_0,pi_1,pi_2,pi_3)


a.put(msh)
# ---------- end decodes_10 ----------
mesh = Mesh(decodes_10.a)

# ---- group: mesh
# Surface expressed as a set of points func(u,v) for (u,v) determined by res_u, res_v
# Surface expressed as a mesh aligned with isocurves for u, v determined by res_u and res_v
# Surface expressed as a mesh, simple triangulation style
res_u = Slider(13, range=4..50)
res_v_2 = Slider(14, range=2..20)
decodes_11 = DecodesPythonScript(res_u=res_u, res_v=res_v_2)  # -> console, a
# ---------- decodes_11: Python ----------
#IN:   a function f(u,v) describing a parametric surface on the domain [0,1]x[0,1]
#OUT:  Surface expressed as a set of points func(u,v) for (u,v) determined by res_u, res_v

count_u = int(res_u)
count_v = int(res_v)
tol_u = 1.0/res_u
tol_v = 1.0/res_v
u_vals = [i*tol_u for i in range(count_u+1)]
v_vals = [i*tol_v for i in range(count_v+1)]

#Expressed as a set of points
pts_out = []
for v in v_vals:
    for u in u_vals:
        pts_out.append(func(u,v))
a.put(pts_out)
# ---------- end decodes_11 ----------
decodes_12 = DecodesPythonScript(res_u=res_v_2, res_v=res_u)  # -> console, a
# ---------- decodes_12: Python ----------
#IN:   a function f(u,v) describing a parametric surface on the domain [0,1]x[0,1]
#OUT:  Surface expressed as a mesh aligned with isocurves for u, v determined by res_u and res_v 


count_u = int(res_u)
count_v = int(res_v)
tol_u = 1.0/res_u
tol_v = 1.0/res_v
u_vals = [i*tol_u for i in range(count_u+1)]
v_vals = [i*tol_v for i in range(count_v+1)]

#Expressed as a mesh with faces determined by isocurves
msh = Mesh()
for v in v_vals:
    for u in u_vals:
        msh.append(func(u,v))

for j in range(count_v):
    row = j*(count_u+1)
    for i in range(count_u):
        pi_0 = row+i
        pi_1 = row+i+1
        pi_2 = row+i+count_u+2
        pi_3 = row+i+count_u+1
        msh.add_face(pi_0,pi_1,pi_2,pi_3)

a.put(msh)
# ---------- end decodes_12 ----------
decodes_13 = DecodesPythonScript(func=decodes.a, res_u=res_v_2, res_v=res_u)  # -> console, a
# ---------- decodes_13: Python ----------
#IN:   a function f(u,v) describing a parametric surface on the domain [0,1]x[0,1]
#OUT:  Surface expressed as a mesh, simple triangulation style

count_u = int(res_u)
count_v = int(res_v)
tol_u = 1.0/res_u
tol_v = 1.0/res_v
u_vals = [i*tol_u for i in range(count_u+1)]
v_vals = [i*tol_v for i in range(count_v+1)]

msh = Mesh()
for v in v_vals:
    for u in u_vals:
        msh.append(func(u,v))

for j in range(count_v):
    row = j*(count_u+1)
    for i in range(count_u):
        pi_0 = row+i
        pi_1 = row+i+1
        pi_2 = row+i+count_u+2
        pi_3 = row+i+count_u+1
        msh.add_face(pi_0,pi_1,pi_2)
        msh.add_face(pi_0, pi_2, pi_3)

a.put(msh)
# ---------- end decodes_13 ----------
crv_3 = Curve(Vertices=decodes_11.a, Degree=3, Periodic=False)  # -> Curve, Length, Domain

# ----
annotated_code = Panel("""class Walker(object):
    
    def __init__(self):
        self.pos = CylCS().eval(Point(10, random.randrange(-20,20)))
        self.rov = 1
        self.vel = Vec(self.pos,Point()).normalized()
        
    def step(self):
        self.vel = Vec.interpolate(self.vel,Vec.random(Interval(-1,1),True,True),0.003)
        self.vel = self.vel.normalized()
        self.pos += self.vel
            
    def check(self, struc):
        bnd = Bounds(self.pos,self.rov,self.rov)
        near_pts = struc.pts_in_bounds(bnd)
        if len(near_pts)==0 : return False
        else:
            # find nearest point in near points and record to self
            self.other = Point.near(self.pos,near_pts)
            return True
    
    @property
    def draw(self):
        return self.pos""")
problem_statement = Panel("""Create a walker class that when initialized, moves a step in a random direction and searches for neaby points.

in:


out:
the location of the walker (pt)""")
python_3 = PythonScript(base_filepath=base_filepath, letter="a", id=file_id, p_statement=problem_statement, annot_code=annotated_code)  # -> out
# ---------- python_3: Python ----------
if base_filepath and id:
    f = open(base_filepath+letter+'.py','w')
    f.write("'''\n"+id+""+letter+"\n")
    f.write(p_statement.replace('\r',''))
    f.write("\n'''\n\n")
    f.write(annot_code.replace('\r',''))
    f.close()
# ---------- end python_3 ----------

# ==== cluster Cluster
V = ClusterInput()
num = ClusterInput()
num_2 = ClusterInput()
vcomp = Decompose(Vector=V)  # -> XComponent, YComponent, ZComponent
num_3 = Number(num)
num_4 = Number(num_2)
pt = PointXYZ(XComponent=vcomp.XComponent, YComponent=vcomp.ZComponent, ZComponent=vcomp.YComponent, System=PlaneXY(0, 0, 0))
pt_2 = PointXYZ(XComponent=num_4, YComponent=0, ZComponent=0, System=PlaneXY(0, 0, 0))
pt_3 = PointXYZ(XComponent=num_3, YComponent=0, ZComponent=1, System=PlaneXY(0, 0, 0))
pt_4 = Point([pt_2, pt, pt_3])
pt_5 = ClusterOutput(pt_4)
