# Grasshopper definition L_system_NEW.gh (Grasshopper 0.9.14)
# plug-ins: Python Interpreter, Decodes Python Interpreter

# ----
# GLOBAL COORD
# needs implementing?: production probablilities for multiple rule interpretations:
# F(.33) -> F[+F]F[-F]F
# F(.33) -> F[+F]F
# F(.34) -> F[-F]F
# CONTROLS: F  :  STEP FORWARD
# -  :  TURN RIGHT
# +  :  TURN LEFT
# \  :  ROLL LEFT
# /  :  ROLL RIGHT
# ^  :  PITCH UP
# &  :  PITCH DOWN
# [  :  START BRANCH
# ]  :  END BRANCH
# |  :  TURN AROUND
# LOCAL COORD
# needs implementing?: in the case :
# a1 < a > ar   ->  X
# a will only produce X if
# preceded by a1 and followed by ar
needs_implementing = Panel("sticky")
step = Slider(3, range=0..10)
production = Panel("""X -> F-[[X]^X]+F[&FX]-X/
F -> F&F\\
""")
production_2 = Panel("""X -> F-[[X]^X]+F[&FX]-X
F -> F&F""")
production_3 = Panel("""X -> F-[[X]+X]+F[+FX]-X
F -> FF""")
production_4 = Panel("""X -> X+YF+
Y -> -FX-Y""")
axiom = Panel("X")
axiom_2 = Panel("FX")
l_sys = DecodesPythonScript(production=production_2, axiom=axiom_2, step=step, typeOutput=Toggle(False))  # -> console, tree, lastLine; inputs production: list, step: Int32, typeOutput: Boolean
# ---------- l_sys: Python ----------
def generate(x, rule):#RULE INTERPRETER
    for r in range(len(rule)):
       if x == rule[r][0]:
           x = rule[r][5:]
       else: x = x
    return x

def main():
    type = typeOutput
    state = axiom
    rules = production
    tree = [state]
    matrix = [] #MATRIX STEP OUTPUT
    n = 0

    while n < step:
        tmpState = ''
        tmpTree = []
        charCount = 0
        for char in state:
            charCount +=1
            tmpState += generate(char, rules)
            tmpTree.append(generate(char, rules))
        state = tmpState
        if type == True:
            tree.append(tmpTree)#OUTPUTS A TREE OF DATA
        if type == False:
            tree.append(state)
        matrix.append([n, charCount])#OUTPUTS A SET OF STRINGS
        n+=1
    print matrix
    lastLine.put(state)
    return tree
    
tree.put(main())
# ---------- end l_sys ----------
output = Panel(l_sys.lastLine)
seed = Point(<point referenced from the Rhino model>)
length = Slider(1, range=0..1)
length_scale = Slider(1, range=0.01..1.2)
angle = Slider(67, range=-90..90)
angle_scale = Slider(1, range=0..1.2)
sticky = Slider(0, range=0..1)
turtles = DecodesPythonScript(
    string=l_sys.lastLine,
    sourcePoint=seed,
    sourceLength=length,
    lengthScale=length_scale,
    sourceAngle=angle,
    angleScale=angle_scale)  # -> console, lines, points, nodes, planes
# ---------- turtles: Python ----------
from math import *

def Move(trtl, chr):
    
    angle = radians(sourceAngle)*(angleScale**trtl[2])
    length = sourceLength*(lengthScale**trtl[2])
    push = False
    pop = False

    #INTERPRET STRING DATA
    if chr == '-': #YAW RIGHT
        trtl[1][0] += angle
    if chr == '+': #YAW LEFT
        trtl[1][0] -= angle 
    if chr == '^': #PITCH UP
        trtl[1][1] -= angle
    if chr == '&': #PITCH DOWN
        trtl[1][1] += angle 
    if chr == '>': #ROLL RIGHT
        trtl[1][2] += angle
    if chr == '<': #ROLL LEFT
        trtl[1][2] -= angle
  
    #UPDATE CS PLANE
    dirVec = Vec(cos(trtl[1][1])*sin(trtl[1][0]), cos(trtl[1][1])*cos(trtl[1][0]), sin(trtl[1][1]))
    
    trtl[0].yAxis.x = trtl[0].xAxis.x*dirVec.x
    trtl[0].yAxis.y = trtl[0].yAxis.y*dirVec.y
    trtl[0].yAxis.z = trtl[0].zAxis.z*dirVec.z
    trtl[0].yAxis = trtl[0].yAxis.normalized(length)
    
    trtl[0].xAxis.x = trtl[0].yAxis.y
    trtl[0].xAxis.y = -trtl[0].yAxis.x
    trtl[0].xAxis = trtl[0].xAxis.normalized(length)
    
    trtl[0].zAxis = Vec(trtl[0].xAxis * trtl[0].yAxis).normalized(length)
    #lines.put(Segment(trtl[0].origin, trtl[0].zAxis))#SHOW NORMALS
    
    if chr == 'F': #ADD A NEW TURTLE
        lines.put(Segment(trtl[0].origin, trtl[0].yAxis.normalized(length)))
        trtl[0].origin += trtl[0].yAxis.normalized(length)
        points.put(trtl[0].origin)
        planes.put(trtl[0])

    if chr == '[': #BRANCH
        push = True
    if chr == ']': #ENDBRANCH
        pop = True
    return trtl, push, pop

def main():
    
    #SETUP TURTLES
    turtleNum = 0
    turtleMatrix = [0,0,0] #[YAW, PITCH, ROLL]
    turtleCS = CS(sourcePoint, Vec(sourceLength*lengthScale,0,0),
    Vec(0,sourceLength*lengthScale,0))
    turtle = [turtleCS, turtleMatrix, turtleNum]
    turtleStack = []

    #MOVE
    points.put(sourcePoint)
    for char in string:
        turtled = Move(turtle, char)
        if turtled[1] == True: #PUSH
            turtled[0][2] +=1
            turtleStack.append([CS(turtled[0][0].origin, turtled[0][0].xAxis, turtled[0][0].yAxis), #CS
            [turtled[0][1][0], turtled[0][1][1], turtled[0][1][2]],                                 #MATRIX
            turtled[0][2]])                                                                         #NUM
            nodes.put(turtled[0][0].origin)
        if turtled[2] == True: #POP
            turtle = turtleStack[-1]
            turtleStack.remove(turtleStack[-1])
main()
# ---------- end turtles ----------
crv = Curve(turtles.lines)
pt = Point(turtles.points)  # disabled
pt_2 = Point(turtles.nodes)  # disabled
geo = Geometry(turtles.planes)  # disabled

turtles_2 = DecodesPythonScript(
    string=l_sys.lastLine,
    sourcePoint=seed,
    sourceLength=length,
    lengthScale=length_scale,
    sourceAngle=angle,
    angleScale=angle_scale)  # -> console, lines, points, nodes, planes; disabled
# ---------- turtles_2: Python ----------
from math import *

def Move(trtl, chr):
    
    angle = radians(sourceAngle)*(angleScale**trtl[2])
    length = sourceLength*(lengthScale**trtl[2])
    push = False
    pop = False

    #INTERPRET STRING DATA
    if chr == '-': #YAW RIGHT
        trtl[1][0] += angle
    if chr == '+': #YAW LEFT
        trtl[1][0] -= angle
    if chr == '^': #PITCH UP
        trtl[1][1] -=angle
    if chr == '&': #PITCH DOWN
        trtl[1][1] +=angle
    if chr == '>': #ROLL RIGHT
        trtl[1][2] +=angle
    if chr == '<': #ROLL LEFT
        trtl[1][2] -= angle
    
    #UPDATE CS PLANE
    trtl[0].yAxis.x = length*cos(trtl[1][1])*sin(trtl[1][0])
    trtl[0].yAxis.y = length*cos(trtl[1][1])*cos(trtl[1][0])
    trtl[0].yAxis.z = length*sin(trtl[1][1])
    trtl[0].xAxis.x = trtl[0].yAxis.y
    trtl[0].xAxis.y = -trtl[0].yAxis.x
    trtl[0].zAxis = Vec(trtl[0].xAxis*trtl[0].yAxis).normalized(length)

    if chr == 'F': #ADD A NEW TURTLE
        lines.put(Segment(trtl[0].origin, trtl[0].yAxis))
        trtl[0].origin += trtl[0].yAxis
        points.put(trtl[0].origin)
        planes.put(trtl[0])
        
    if chr == '[': #BRANCH
        push = True
    if chr == ']': #ENDBRANCH
        pop = True
    return trtl, push, pop

def main():
    
    #SETUP TURTLES
    turtleNum = 0
    turtleMatrix = [0,0,0] #[YAW, PITCH, ROLL]
    turtleCS = CS(sourcePoint, Vec(sourceLength*lengthScale,0,0),
    Vec(0,sourceLength*lengthScale,0))
    turtle = [turtleCS, turtleMatrix, turtleNum]
    turtleStack = []

    #MOVE
    points.put(sourcePoint)
    for char in string:
        turtled = Move(turtle, char)
        if turtled[1] == True: #PUSH
            turtled[0][2] +=1
            turtleStack.append([CS(turtled[0][0].origin, turtled[0][0].xAxis, turtled[0][0].yAxis), #CS
            [turtled[0][1][0], turtled[0][1][1], turtled[0][1][2]],                                 #MATRIX
            turtled[0][2]])                                                                         #NUM
            nodes.put(turtled[0][0].origin)
        if turtled[2] == True: #POP
            turtle = turtleStack[-1]
            turtleStack.remove(turtleStack[-1])
main()
# ---------- end turtles_2 ----------
pt_3 = Point(turtles_2.points)  # disabled
pt_4 = Point(turtles_2.nodes)  # disabled
crv_2 = Curve(turtles_2.lines)
geo_2 = Geometry(turtles_2.planes)  # disabled

length_scale_2 = Slider(1, range=0.01..1.2)
angle_2 = Slider(18, range=-90..90)
angle_scale_2 = Slider(1, range=0..1.2)
sticky_2 = Slider(0, range=0..1)
step_2 = Slider(3, range=0..10)
length_2 = Slider(1, range=0..1)
production_5 = Panel("""X -> F-[[X]^XB]+F[&FXA]-X
F -> F&FC

A -> FX
B -> CA
C -> X""")
axiom_3 = Panel("X")
l_sys_2 = DecodesPythonScript(production=production_5, axiom=axiom_3, step=step_2)  # -> console, tree, lastLine; inputs production: list, step: Int32, typeOutput: Boolean; same code as l_sys
output_2 = Panel(l_sys_2.lastLine)
seed_2 = Point(<point referenced from the Rhino model>)
grow = DecodesPythonScript(
    string=l_sys_2.lastLine,
    sourcePoint=seed_2,
    sourceLength=length_2,
    lengthScale=length_scale_2,
    sourceAngle=angle_2,
    angleScale=angle_scale_2)  # -> console, lines, points, nodes, planes, tips
# ---------- grow: Python ----------
from math import *

def Move(trtl, chr):
    
    angle = radians(sourceAngle)*(angleScale**trtl[2])
    length = sourceLength*(lengthScale**trtl[2])
    push = False
    pop = False

    #INTERPRET STRING DATA
    if chr == '-': #YAW RIGHT
        trtl[1][0] += angle
    if chr == '+': #YAW LEFT
        trtl[1][0] -= angle
    if chr == '^': #PITCH UP
        trtl[1][1] -=angle
    if chr == '&': #PITCH DOWN
        trtl[1][1] +=angle
    if chr == '>': #ROLL RIGHT
        trtl[1][2] +=angle
    if chr == '<': #ROLL LEFT
        trtl[1][2] -= angle
    
    #UPDATE CS PLANE
    trtl[0].yAxis.x = length*cos(trtl[1][1])*sin(trtl[1][0])
    trtl[0].yAxis.y = length*cos(trtl[1][1])*cos(trtl[1][0])
    trtl[0].yAxis.z = length*sin(trtl[1][1])
    trtl[0].xAxis.x = trtl[0].yAxis.y
    trtl[0].xAxis.y = -trtl[0].yAxis.x
    trtl[0].zAxis = Vec(trtl[0].xAxis*trtl[0].yAxis).normalized(length)

    #ADD A NEW TURTLE
    if chr == 'F': 
        lines.put(Segment(trtl[0].origin, trtl[0].yAxis))
        trtl[0].origin += trtl[0].yAxis
        points.put(trtl[0].origin)
        planes.put(trtl[0])
    
    #OUTPUT NODES
    nodes.put([chr, trtl[0]])
    
    #BRANCHES    
    if chr == '[': #BRANCH
        push = True
    if chr == ']': #ENDBRANCH
        tips.put(trtl[0])
        pop = True
    return trtl, push, pop

def main():
    
    #SETUP TURTLES
    turtleNum = 0
    turtleMatrix = [0,0,0] #[YAW, PITCH, ROLL]
    turtleCS = CS(sourcePoint, Vec(sourceLength*lengthScale,0,0),
    Vec(0,sourceLength*lengthScale,0))
    turtle = [turtleCS, turtleMatrix, turtleNum]
    turtleStack = []

    #MOVE
    points.put(sourcePoint)
    for char in string:
        turtled = Move(turtle, char)
        if turtled[1] == True: #PUSH
            turtled[0][2] +=1
            turtleStack.append([CS(turtled[0][0].origin, turtled[0][0].xAxis, turtled[0][0].yAxis), #CS
            [turtled[0][1][0], turtled[0][1][1], turtled[0][1][2]],                                 #MATRIX
            turtled[0][2]])                                                                         #NUM
        if turtled[2] == True: #POP
            turtle = turtleStack[-1]
            turtleStack.remove(turtleStack[-1])
main()
# ---------- end grow ----------
sph = Sphere(Base=PlaneXY(0, 0, 0), Radius=0.5)
cone = Cone(Base=PlaneXY(0, 0, 0), Radius=0.5, Length=1)  # -> Cone, Tip
cyl = Cylinder(Base=PlaneXY(0, 0, 0), Radius=0.5, Length=1)
geo_3 = Geometry(grow.tips)
graft = PythonScript(type="A", geometry=sph)  # -> out, grafted
# ---------- graft: Python ----------
grafted = [type, geometry]
# ---------- end graft ----------
crv_3 = Curve(grow.lines)
pt_5 = Point(grow.points)
geo_4 = Geometry(grow.planes)
graft_2 = PythonScript(type="B", geometry=cyl)  # -> out, grafted; same code as graft
graft_3 = PythonScript(type="C", geometry=cone.Cone)  # -> out, grafted; same code as graft
sph_2 = Sphere(Base=geo_3, Radius=1)
box = DomainBox(Base=geo_4, X=Domain(0, 0.5), Y=Domain(-0.5, 0.5), Z=Domain(0, 0.25))
smash = PythonScript(nodes=flatten(grow.nodes), rules=[graft_2.grafted, graft.grafted, graft_3.grafted])  # -> out, a; inputs nodes: list, rules: list; disabled
# ---------- smash: Python ----------
from math import *
import rhinoscriptsyntax as rs

#SETUP TREES
params = []
locators = []
origin = [rs.AddPoint(0,0,0),rs.AddPoint(1,0,0),rs.AddPoint(0,1,0),rs.AddPoint(0,0,1)]
smashed = []

#REBUILD RULE TREE
for r in range(len(rules)):
    if r % 2 == 0:
        rule = [rules[r], rules[r+1]]
        params.append(rule)
        
#REBUILD NODE TREE
for n in range(len(nodes)):
    if n % 2 == 0:
        o = rs.AddPoint(nodes[n+1][0])
        x = rs.CopyObject(o, nodes[n+1][1])
        y = rs.CopyObject(o, nodes[n+1][2])
        z = rs.CopyObject(o, nodes[n+1][3])
        cloud = [o,x,y,z]
        locator = [nodes[n], cloud]
        locators.append(locator)

#SMASH TREES
for p in params:
    for l in locators:
        if l[0] == p[0]:
            obj = rs.CopyObject(p[1])
            rs.OrientObject(obj, origin, l[1])
            smashed.append(obj)

a = smashed
# ---------- end smash ----------
