# Grasshopper definition lsystem_example.ghx (Grasshopper 0.9.14)
# plug-ins: Decodes Python Interpreter

# # a function to define rules to be checked
#     def add_rule(self,rulething):
#         # check on structure of rulething and convert to tuple
#         rule = rulething
#         try:
#             rule.strip()# remove all white spaces from the rule
#             # then attempt to split the rule at the arrow
#             # and remove any left over white spaces
#             rule = [str.strip() for str in rulething.split("->")]
#         except:# if the rule is not in single string format
#             try:# check if it is a tuple
#                 rule = rulething[0],rulething[1]
#             except:# and if not, return an error
#                 raise TypeError("oh snap, that's not a rule")
#         # if it is a valid rule, add it to the list of rules
#         self.rules.append(rule)
# CONTROLS: F  :  STEP FORWARD
# -  :  TURN RIGHT
# +  :  TURN LEFT
# { :  ROLL LEFT
# }  :  ROLL RIGHT
# ^  :  PITCH UP
# &  :  PITCH DOWN
# [  :  START BRANCH
# ]  :  END BRANCH
# # a function that replaces a character with its appropriate rule
#     def apply_rules(self, char):
#         # check all the rules for the one to apply
#         for rule in self.rules:
#             # if the character matches the first half of the rule tuple
#             if char == rule[0]:
#                 # replace the character with the second half of the rule tuple
#                 return rule[1]
#                 break
#         # if no rule characters match, return the original character
#         return char
# 
#     # a function that applies character replacement to strings based on rules
#     def step(self):
#         nxt_gen = ""
#         # for every character in the current string
#         # check if there is a rule that applies to it and replace
#         for chr in self.cur_gen: nxt_gen += str(self.apply_rules(chr))
#         self.hist.append(nxt_gen)
# 
#     # returns the last generation of applied strings of rules
#     @property
#     def cur_gen(self): return self.hist[-1]
# 
#     # removes all rules, and applied strings of rules
#     def clear(self):
#         self.hist = [self.axiom]
#         self.rules = []
decodes = DecodesPythonScript()  # -> console, a
# ---------- decodes: Python ----------
class LEngine(object):

    def __init__(self,axiom):
        self.axiom = axiom
        self.rules = []
        self.clear()

    # a function to define rules to be checked
    def add_rule(self,rulething):
        # check on structure of rulething and convert to tuple
        rule = rulething
        try:
            rule.strip()# remove all white spaces from the rule
            # then attempt to split the rule at the arrow
            # and remove any left over white spaces
            rule = [str.strip() for str in rulething.split("->")]
        except:# if the rule is not in single string format
            try:# check if it is a tuple
                rule = rulething[0],rulething[1]
            except:# and if not, return an error
                raise TypeError("oh snap, that's not a rule")
        # if it is a valid rule, add it to the list of rules
        self.rules.append(rule)

    # a function that replaces a character with its appropriate rule
    def apply_rules(self, char):
        # check all the rules for the one to apply
        for rule in self.rules:
            # if the character matches the first half of the rule tuple
            if char == rule[0]:
                # replace the character with the second half of the rule tuple
                return rule[1]
                break
        # if no rule characters match, return the original character
        return char
    
    # a function that applies character replacement to strings based on rules
    def step(self):
        nxt_gen = ""
        # for every character in the current string
        # check if there is a rule that applies to it and replace
        for chr in self.cur_gen: nxt_gen += str(self.apply_rules(chr))
        self.hist.append(nxt_gen)

    # returns the last generation of applied strings of rules
    @property
    def cur_gen(self): return self.hist[-1]
    
    # removes all rules, and applied strings of rules
    def clear(self):
        self.hist = [self.axiom]
        self.rules = []

a.put(LEngine)
# ---------- end decodes ----------
# class LTurtle(object):
# 
#     def __init__(self,instructions):
#         self.inst = instructions # the L system string to be interpreted
#         self.pts = [Point()]
#         self.css = [CS()]
#         self.angle = math.pi/4
#         self.step_size = 1.0
# 
#     # moves the turtle based on the L System string
#     def go(self):
#         lines = []
#         # while the length of the string is not 0
#         while len(self.inst)>0:
#             chr = self.inst[0]
# 
#             # update the Coordinate Sytem based on the current string character
#             if chr == '-': #yaw right
#                 self.do_xform(self.css[-1].zAxis,self.angle)
#             elif chr == '+': #yaw left
#                 self.do_xform(self.css[-1].zAxis,-self.angle)
#             elif chr == '^': #pitch up
#                 self.do_xform(self.css[-1].xAxis,-self.angle)
#             elif chr == '&': #pitch down
#                 self.do_xform(self.css[-1].xAxis,self.angle)
#             elif chr == '}': #roll right
#                 self.do_xform(self.css[-1].yAxis,self.angle)
#             elif chr == '{': # roll left
#                 self.do_xform(self.css[-1].yAxis,-self.angle)
# 
#             # draw a new line along the y axis of the Coordinate System
#             elif chr == 'F':
#                 nxt_pt = self.pts[-1] + (self.css[-1].yAxis * self.step_size)
#                 lines.append(Segment(self.pts[-1],nxt_pt))
#                 self.pts[-1] = nxt_pt
# 
#             # save the last place to branch from to a list
#             elif chr == '[':
#                 self.push(self.pts[-1], self.css[-1])
#             # remove that branch from the list once it has been drawn
#             elif chr == ']':
#                 self.pop()
#             self.inst = self.inst[1:]
#         return lines
# 
#     # the transformation to apply to the Coordinate System
#     def do_xform(self,axis,angle):
#         xf = Xform.rotation(axis=axis,angle=angle)
#         self.css[-1] = self.css[-1] * xf
#         pass
#     # adds the current point and CS to lists
#     def push(self,pt,cs):
#         self.pts.append(pt)
#         self.css.append(cs)
#     # removes the last point and CS from lists
#     def pop(self):
#         self.pts = self.pts[:-1]
#         self.css = self.css[:-1]
decodes_2 = DecodesPythonScript()  # -> console, a
# ---------- decodes_2: Python ----------
class LTurtle(object):
    
    def __init__(self,instructions):
        self.inst = instructions # the L system string to be interpreted
        self.pts = [Point()]
        self.css = [CS()]
        self.angle = math.pi/4
        self.step_size = 1.0

    # moves the turtle based on the L System string
    def go(self):
        lines = []
        # while the length of the string is not 0
        while len(self.inst)>0:
            chr = self.inst[0]
            
            # update the Coordinate Sytem based on the current string character
            if chr == '-': #yaw right
                self.do_xform(self.css[-1].zAxis,self.angle)
            elif chr == '+': #yaw left
                self.do_xform(self.css[-1].zAxis,-self.angle)
            elif chr == '^': #pitch up
                self.do_xform(self.css[-1].xAxis,-self.angle)
            elif chr == '&': #pitch down
                self.do_xform(self.css[-1].xAxis,self.angle)
            elif chr == '}': #roll right
                self.do_xform(self.css[-1].yAxis,self.angle)
            elif chr == '{': # roll left
                self.do_xform(self.css[-1].yAxis,-self.angle)
                
            # draw a new line along the y axis of the Coordinate System
            elif chr == 'F':
                nxt_pt = self.pts[-1] + (self.css[-1].yAxis * self.step_size)
                lines.append(Segment(self.pts[-1],nxt_pt))
                self.pts[-1] = nxt_pt
  
            # save the last place to branch from to a list
            elif chr == '[': 
                self.push(self.pts[-1], self.css[-1])
            # remove that branch from the list once it has been drawn
            elif chr == ']': 
                self.pop() 
            self.inst = self.inst[1:]
        return lines

    # the transformation to apply to the Coordinate System
    def do_xform(self,axis,angle):
        xf = Xform.rotation(axis=axis,angle=angle)
        self.css[-1] = self.css[-1] * xf
        pass
    # adds the current point and CS to lists
    def push(self,pt,cs):
        self.pts.append(pt)
        self.css.append(cs)
    # removes the last point and CS from lists
    def pop(self):
        self.pts = self.pts[:-1]
        self.css = self.css[:-1]

a.put (LTurtle)
# ---------- end decodes_2 ----------
_3d_tree = Panel("""X -> F-[[X]^XB]+F[&FXA]-X}
F -> F&FC{{
A -> FX
B -> CA
C -> X""")
_2d_tree = Panel("""X -> F-[[X]+X]+F[+FX]-X
F -> FF""")
dragon_curve = Panel("""X -> X+YF+
Y -> -FX-Y""")
# # sets up an L System Generator
# # and a set of rules
# leng = LEngine("X")# axiom 'X'
# leng.add_rule(['X', 'F-[[X]^XB]+F[&FXA]-X>'])# rule as a tuple
# leng.add_rule("F -> F&FC<<")# rule as a string
# leng.add_rule("A -> FX")
# leng.add_rule("B -> CA")
# leng.add_rule("C -> X")
# for n in range(3): leng.step()# generations to compute
# 
# # sets up an L system Interpreter
# turt = LTurtle(leng.cur_gen)
# geom = turt.go()# tells the turtle to move
axiom = Panel("X")
decodes_3 = DecodesPythonScript(production=_3d_tree, axiom=axiom, LEngine=decodes.a, LTurtle=decodes_2.a)  # -> console, a; inputs production: list
# ---------- decodes_3: Python ----------
# sets up an L System Generator
# and a set of rules
leng = LEngine(axiom)

for rule in production:
    leng.add_rule(rule)
for n in range(3): leng.step()# generations to compute

# sets up an L system Interpreter
turt = LTurtle(leng.cur_gen)
geom = turt.go()# tells the turtle to move

a.put(geom)
# ---------- end decodes_3 ----------
