# Grasshopper definition surfaces.ghx (Grasshopper 0.9.14)
# plug-ins: Decodes Python Interpreter

radius = Slider(0.4, range=0..1)  # disabled
divisions = Slider(42, range=0..100)  # disabled
cir = Circle(Plane=PlaneXY(0, 0, 0), Radius=radius)  # disabled
cir_2 = Circle(Plane=PlaneXY(0, 0, 0), Radius=radius)  # disabled
Z = UnitZ(Factor=1)  # disabled
pi = Pi(Factor=Slider(4, range=0..10))
md_slider = MDSlider(
    slider_value=Point(0.8578921062, 0.8015601926, 0.5),
    x_domain=Domain(0, 1),
    y_domain=Domain(0, 1),
    z_domain=Domain(0, 1),
    SliderMode=0)  # disabled
slider = Slider(0.518, range=0..1)  # disabled
slider_2 = Slider(0.409, range=0..1)  # disabled
move = Move(Geometry=cir_2, Motion=Z)  # -> Geometry, Transform; disabled
range = Range(Domain=pi, Steps=10)
range_2 = Range(Domain=Domain(0, 1), Steps=10)
slider_3 = Slider(23, range=0..100)  # disabled
toggle = BooleanToggle(True)  # disabled
sin = Sine(Value=range)
divide = DivideCurve(Curve=cir, Count=divisions, Kinks=False)  # -> Points, Tangents, Parameters; disabled
divide_2 = DivideCurve(Curve=move.Geometry, Count=divisions, Kinks=False)  # -> Points, Tangents, Parameters; disabled
slider_4 = Slider(0, range=0..6.28)  # disabled
slider_5 = Slider(3.52, range=0..6.28)  # disabled
cluster = Cluster(num=slider_2, V=md_slider, num_2=slider)  # disabled
bnd = Bounds(Numbers=sin)
shift = ShiftList(List=divide_2.Points, Shift=slider_3, Wrap=toggle)  # disabled
height = Slider(4.735, range=1..5)
num_rot = Slider(4, range=1..6)
remap = RemapNumbers(Value=sin, Source=bnd, Target=Domain(0, 1))
res_v = Slider(20, range=2..20)  # disabled
ln = Line(StartPoint=divide.Points, EndPoint=shift)  # disabled
dom = Domain(DomainStart=slider_4, DomainEnd=slider_5)  # disabled
pts = Point(cluster)  # disabled
pt = PointXYZ(XComponent=range_2, YComponent=0, ZComponent=remap, System=PlaneXY(0, 0, 0))
pt_2 = PointXYZ(XComponent=0, YComponent=range_2, ZComponent=remap, System=PlaneXY(0, 0, 0))
# Surfaces expressed as func(u,v), always on a normalized domain [0,1]x[0,1]
panel = Panel("Cone ")
panel_2 = Panel("Torus")
panel_3 = Panel("Catenoid")
panel_4 = Panel("Helicoid")
panel_5 = Panel("Rotational Surface")  # disabled
decodes = DecodesPythonScript(pts=pts, rot_ival=dom)  # -> console, a; inputs pts: list; disabled
# ---------- decodes: Python ----------
import math

def func(u,v):
    flat_pts = [Point(p.x,0,p.z) for p in pts]# ensure points lie on same plane as rotational axis by setting y=0
    
    angle = rot_ival.eval(u)
    xf = Xform.rotation(axis=Vec(0,0,1),angle=angle)
    rot_pts = [pt*xf for pt in flat_pts]
    
    crv = Curve.bezier(rot_pts)
    
    return crv.eval(v).origin
    

a.put(func)
# ---------- end decodes ----------
decodes_2 = DecodesPythonScript(h=height)  # -> console, a
# ---------- decodes_2: Python ----------
"""
Catenoid
    x = math.cosh(v/3)*math.cos(u)
    y = math.cosh(v/3)*math.sin(u)
    z = v
    domain = [0, 2*pi]x[-h/2,h/2]
"""

import math


def func(u,v):
    u_val = 2*math.pi*u
    v_val = h*v - h/2
    pt_out = Point(math.cosh(v_val/3)*math.cos(u_val), math.cosh(v_val/3)*math.sin(u_val), v_val)
    return pt_out
    
a.put(func)
# ---------- end decodes_2 ----------
decodes_3 = DecodesPythonScript(n=num_rot)  # -> console, a
# ---------- decodes_3: Python ----------
"""
Helicoid;  domain
    #x = (v/5)*math.cos(u)
    #y = (v/5)v*math.sin(u)
    #z = u/20
    domain = [0, 2*n*pi]x[2,5]
"""

import math

def func(u,v):
    u_val = 2*n*math.pi*u
    v_val = 3*v + 2
    pt_out = Point((v_val/5)*math.cos(u_val), (v_val/5)*math.sin(u_val), u_val/20)
    return pt_out
    
a.put(func)
# ---------- end decodes_3 ----------
decodes_4 = DecodesPythonScript()  # -> console, a
# ---------- decodes_4: Python ----------
"""
Cone parametrized in cylindrical coordinates
    x = v*math.cos(u)
    y = v*math.sin(u)
    z = v
    domain = [0, 2*pi]x[0, 2]
"""


import math

def func(u,v):
    u_val = 2*math.pi*u
    v_val = 2*v
    pt_out = Point(v_val*math.cos(u_val), v_val*math.sin(u_val), v_val)
    return pt_out
    
a.put(func)
# ---------- end decodes_4 ----------
decodes_5 = DecodesPythonScript(crv_pts=pt, rail_pts=pt_2)  # -> console, a; inputs crv_pts: list, rail_pts: list
# ---------- decodes_5: Python ----------
def func(u,v):
    rail = Curve.bezier(rail_pts)
    b.put(rail)
    vec = crv_pts[0] - rail.eval(u)
    new_crv = Curve.bezier([pt - vec for pt in crv_pts])
        
    return new_crv.eval(v).origin

a.put(func)
# ---------- end decodes_5 ----------
panel_6 = Panel("Translational Surface")
# Ruled Surface - TODO
# Below currently is an example of a ruled surface -- a hyperboloid.
decodes_6 = DecodesPythonScript(lines=ln)  # -> console, a; inputs lines: list; disabled
# ---------- decodes_6: Python ----------
def func(u,v):
    return lines[u].eval(v)

print func(1,1)

a.put(func)
# ---------- end decodes_6 ----------
decodes_7 = DecodesPythonScript()  # -> console, a
# ---------- decodes_7: Python ----------
"""
Torus 
    x = 0.5*(2+math.cos(v))*math.cos(u)
    y = 0.5*(2+math.cos(v))*math.sin(u)
    z = math.sin(v)
    domain = [0, 2*pi]x[0, 2*pi]
"""

import math

def func(u,v):
    u_val = 2*math.pi*u
    v_val = 2*math.pi*v
    pt_out = Point(0.5*(2+ math.cos(v_val))*math.cos(u_val), 0.5*(2+math.cos(v_val))*math.sin(u_val), math.sin(v_val))
    return pt_out
    
print func(0,0)
a.put(func)
# ---------- end decodes_7 ----------
series = Series(Start=0, Step=1, Count=divisions)  # disabled
range_3 = Range(Domain=Domain(0, 1), Steps=res_v)  # disabled
res_u = Slider(25, range=4..50)
res_v_2 = Slider(20, range=2..20)
decodes_8 = DecodesPythonScript(func=decodes_6.a, u_vals=series, v_vals=range_3)  # -> console, a; inputs u_vals: list, v_vals: list; disabled
# ---------- decodes_8: Python ----------
msh = Mesh()
for v in v_vals:
    for u in u_vals:
        msh.append(func(int(u),v))

count_u = len(u_vals)
count_v = len(v_vals)

for j in range(count_v):
    row = j*(count_u+1)
    for i in range(count_u):
        pi_0 = row+i
        pi_1 = row+i+1
        pi_2 = row+i+count_u+2
        pi_3 = row+i+count_u+1
        msh.add_face(pi_0,pi_1,pi_2)
        msh.add_face(pi_0, pi_2, pi_3)
a.put(msh)
# ---------- end decodes_8 ----------
decodes_9 = DecodesPythonScript(res_u=res_u, res_v=res_v_2)  # -> console, a
# ---------- decodes_9: Python ----------
#IN:   a function f(u,v) describing a parametric surface on the domain [0,1]x[0,1]
#OUT:  Surface expressed as a set of points func(u,v) for (u,v) determined by res_u, res_v

count_u = int(res_u)
count_v = int(res_v)
tol_u = 1.0/res_u
tol_v = 1.0/res_v
u_vals = [i*tol_u for i in range(count_u+1)]
v_vals = [i*tol_v for i in range(count_v+1)]

#Expressed as a set of points
pts_out = []
for v in v_vals:
    for u in u_vals:
        pts_out.append(func(u,v))
a.put(pts_out)
# ---------- end decodes_9 ----------
# Surface expressed as a mesh aligned with isocurves for u, v determined by res_u and res_v
decodes_10 = DecodesPythonScript(res_u=res_v_2, res_v=res_u)  # -> console, a
# ---------- decodes_10: Python ----------
#IN:   a function f(u,v) describing a parametric surface on the domain [0,1]x[0,1]
#OUT:  Surface expressed as a mesh aligned with isocurves for u, v determined by res_u and res_v 


count_u = int(res_u)
count_v = int(res_v)
tol_u = 1.0/res_u
tol_v = 1.0/res_v
u_vals = [i*tol_u for i in range(count_u+1)]
v_vals = [i*tol_v for i in range(count_v+1)]

#Expressed as a mesh with faces determined by isocurves
msh = Mesh()
for v in v_vals:
    for u in u_vals:
        msh.append(func(u,v))

for j in range(count_v):
    row = j*(count_u+1)
    for i in range(count_u):
        pi_0 = row+i
        pi_1 = row+i+1
        pi_2 = row+i+count_u+2
        pi_3 = row+i+count_u+1
        msh.add_face(pi_0,pi_1,pi_2,pi_3)

a.put(msh)
# ---------- end decodes_10 ----------
# Surface expressed as a mesh, simple triangulation style
decodes_11 = DecodesPythonScript(res_u=res_v_2, res_v=res_u)  # -> console, a
# ---------- decodes_11: Python ----------
#IN:   a function f(u,v) describing a parametric surface on the domain [0,1]x[0,1]
#OUT:  Surface expressed as a mesh, simple triangulation style

count_u = int(res_u)
count_v = int(res_v)
tol_u = 1.0/res_u
tol_v = 1.0/res_v
u_vals = [i*tol_u for i in range(count_u+1)]
v_vals = [i*tol_v for i in range(count_v+1)]

msh = Mesh()
for v in v_vals:
    for u in u_vals:
        msh.append(func(u,v))

for j in range(count_v):
    row = j*(count_u+1)
    for i in range(count_u):
        pi_0 = row+i
        pi_1 = row+i+1
        pi_2 = row+i+count_u+2
        pi_3 = row+i+count_u+1
        msh.add_face(pi_0,pi_1,pi_2)
        msh.add_face(pi_0, pi_2, pi_3)

a.put(msh)
# ---------- end decodes_11 ----------
# Surface expressed as a set of points func(u,v) for (u,v) determined by res_u, res_v
crv = Curve(Vertices=decodes_9.a, Degree=3, Periodic=False)  # -> Curve, Length, Domain

# ==== cluster Cluster
V = ClusterInput()
num = ClusterInput()
num_2 = ClusterInput()
vcomp = Decompose(Vector=V)  # -> XComponent, YComponent, ZComponent
num_3 = Number(num)
num_4 = Number(num_2)
pt = PointXYZ(XComponent=vcomp.XComponent, YComponent=vcomp.ZComponent, ZComponent=vcomp.YComponent, System=PlaneXY(0, 0, 0))
pt_2 = PointXYZ(XComponent=num_4, YComponent=0, ZComponent=0, System=PlaneXY(0, 0, 0))
pt_3 = PointXYZ(XComponent=num_3, YComponent=0, ZComponent=1, System=PlaneXY(0, 0, 0))
pt_4 = Point([pt_2, pt, pt_3])
pt_5 = ClusterOutput(pt_4)
