# Grasshopper definition Pgon_Generator.gh (Grasshopper 0.9.14)

slider = Slider(10, range=0..10)
slider_2 = Slider(26, range=0..100)
dom = Domain(DomainStart=Slider(0, range=0..100), DomainEnd=slider)
slider_3 = Slider(10, range=0..10)
random = Random(Range=dom, Number=slider, Seed=2)
polygon = Polygon(Plane=PlaneXY(0, 0, 0), Radius=dom, Segments=random, FilletRadius=0)  # -> Polygon, Length
dom_2 = Domain(DomainStart=Slider(-10, range=-10..10), DomainEnd=slider_3)
cp = ControlPoints(Curve=polygon.Polygon)  # -> Points, Weights, Knots
lng = ListLength(List=cp.Points)
random_2 = Random(Range=dom_2, Number=slider_3, Seed=2)
division = Division(A=lng, B=2)
split = SplitList(List=cp.Points, Index=division)  # -> ListA, ListB
X = UnitX(Factor=random_2)
Y = UnitY(Factor=random_2)
move = Move(Geometry=split.ListB, Motion=X)  # -> Geometry, Transform
move_2 = Move(Geometry=split.ListA, Motion=Y)  # -> Geometry, Transform
pline = PolyLine(Vertices=[move_2.Geometry, move.Geometry], Closed=True)
item = ListItem(List=pline, Index=Slider(10, range=0..11), Wrap=False)
