# Grasshopper definition Polygon_Divider.gh (Grasshopper 0.9.65)
# plug-ins: Decodes Python Interpreter

geo = Geometry(<curve referenced from the Rhino model>)
geo_2 = Geometry(<curve referenced from the Rhino model>)
pt = Point(<point referenced from the Rhino model>)
geo_3 = Geometry(<curve referenced from the Rhino model>)
geo_4 = Geometry(<curve referenced from the Rhino model>)
geo_5 = Geometry(<curve referenced from the Rhino model>)
decodes = DecodesPythonScript(p=geo_3, pt=pt, q=geo, lin=geo_2)  # -> console, a, b, c, d, e; inputs p: Polyline, lin: Line
# ---------- decodes: Python ----------
#print type(p)

#print type(pt)

res = p.near(pt)

print res
#print p.contains_pt(pt)
#print p.overlaps(q)
#print lin
print "polygon points:",p.pts
print "segments :", p.edges


a.put(res[0])
c.put(p.pts[res[1]])

xs = Intersector()

xs.of(p,lin)

ipt = xs.results
b.put(ipt)
print "intersection points: ",ipt

res1 = p.near(ipt[0])
res2 = p.near(ipt[1])
print res1
print res2

p1 = []
p2 = []
inp1 = True

for n in range(len(p.pts)):
    if inp1:
        p1.append(p.pts[n])
    else:
        p2.append(p.pts[n])
    if n == res1[1]:
        p1.append(res1[0])
        p2.append(res1[0])
        inp1 = False
    if n == res2[1]:
        p1.append(res2[0])
        p2.append(res2[0])
        inp1 = True

print p1
print p2

d.put(PGon(p1))
e.put(PGon(p2))



print p.pts
# ---------- end decodes ----------
Y = UnitY(Factor=Slider(10, range=0..10))
Y_2 = UnitY(Factor=Slider(5, range=0..10))
Y_3 = UnitY(Factor=Slider(30, range=0..100))
Y_4 = UnitY(Factor=Slider(30, range=0..100))
decodes_2 = DecodesPythonScript(p=geo_4, q=geo_5)  # -> console, a, b, c, d, e; inputs p: Polyline
# ---------- decodes_2: Python ----------
w = (0,1,2,3,4)

#print w[:0]+w[2:]

#print p.pts
#print q.pts

new_pts = p.pts
print p.pts
#print "new points: ",new_pts

def ins_list(list, index, value):
    res = []
    for n in range(len(list)):
        res.append(list[n])
        if n == index:
            res.append(value)
    return res

xpts = []

for edge in q.edges:
    xs = Intersector()
    xs.of(p,edge)
    i_pt = xs.results
    if i_pt <> []:
        near = p.near(i_pt[0])
        new_pts = ins_list(new_pts, near[1]+len(xpts), i_pt[0])
        xpts.append(i_pt[0])
        if len(xpts) == 2:
            break

p = PGon(new_pts)
print "xpts: ", xpts
new_pts = q.pts
for pt in xpts:
    near = q.near(pt)
    new_pts = ins_list(new_pts, near[1], pt)
    q = PGon(new_pts)

print p.pts
print q.pts

a.put(p)
b.put(q)
# ---------- end decodes_2 ----------
panel = Panel(decodes.console)
move = Move(Geometry=decodes.d, Motion=Y)  # -> Geometry, Transform; disabled
move_2 = Move(Geometry=decodes.e, Motion=Y_2)  # -> Geometry, Transform; disabled
move_3 = Move(Geometry=decodes_2.a, Motion=Y_3)  # -> Geometry, Transform
move_4 = Move(Geometry=decodes_2.b, Motion=Y_4)  # -> Geometry, Transform
geo_6 = Geometry(move.Geometry)  # disabled
geo_7 = Geometry(move_2.Geometry)  # disabled
geo_8 = Geometry(move_3.Geometry)
geo_9 = Geometry(move_4.Geometry)
