# Grasshopper definition ca_experiment.ghx (Grasshopper 0.9.65)
# plug-ins: Decodes Python Interpreter

# ---- group: creates an initial condition
decodes = DecodesPythonScript(w=Slider(20, range=0..100), h=Slider(20, range=0..100))  # -> console, f_out; inputs w: Int32, h: Int32
# ---------- decodes: Python ----------
# initialize an instance of the CA object class
start_field = ValueField(Interval(w,h),include_corners = True,wrap = False)
# random.seed(0)

# for every pixel in the boolean field:
for i in range(w*h):
    start_field._pixels[i] = random.choice([True, False]) # randomly select True or False

f_out.put(start_field)
# ---------- end decodes ----------

# ----
# c
# game of life
# function
decodes_2 = DecodesPythonScript()  # -> console, func
# ---------- decodes_2: Python ----------
"""
Function to plat Conway's Game of Life
"""   

def life_rules(cur_val,nei_vals):
    # initialize counter for true values in the neighborhood
    count = 0
    
    # for each cell in the neighborhood:
    for i in nei_vals:
        # if cell is True:
        if i : 
            count += 1 # count it
            
    # if home cell is True:
    if cur_val:
        # if less than 2 or more than 3 neighbors are True:
        if (count < 2) or (count >3) :
            # this cell will be False in the next generation
            return False
        # else:
        else:
            # this cell will be True in the next generation
            return True
    # else the home cell is False:
    else:
        # if exactly 3 neighbors are True:
        if (count == 3):
            # this cell will be True in the next generation
            return True
        else:
            # else this cell will be False in the next generation
            return False

func.put(life_rules)
# ---------- end decodes_2 ----------
panel = Panel("maze_rules function")
decodes_3 = DecodesPythonScript()  # -> console, func
# ---------- decodes_3: Python ----------
"""
Function to create a maze out of an random boolean field based on algorithm 
published by Kostas Terzidis,"Algorithms for Visual Design", pp. 168-171
"""
def maze_rules(cur_val,nei_vals):
    # initialize the values
    nxt_val = cur_val
    count = 0 # counter for True cells in the neighborhood
    
    # for each cell in the neighborhood:
    for i in nei_vals:
        # if cell is True:
        if i : 
            count += 1 # count it
        
    # if there are 3 True cells in the neighborhood:
    if count == 3 : 
        # this cell will be True in the next generation
        nxt_val = True
    
    # if there are more than four True cells in the neighborhood:
    if count > 4: 
        # this cell eill be False in the next generation
        nxt_val = False
        
    # return the new value for the cell
    return nxt_val

func.put(maze_rules)
# ---------- end decodes_3 ----------

# ---- group: CA class
# a
decodes_4 = DecodesPythonScript()  # -> console, a
# ---------- decodes_4: Python ----------
# from ..core import *
# from ..core import dc_color, dc_base, dc_vec, dc_point, dc_cs, dc_line, dc_mesh, dc_pgon, dc_xform
import copy
print "cellular_automata.py loaded"
# =========================================================

'''
4.02.L02a
Create a class that implements a simple, two-state cellular automata 

members:
pixel_res (Interval) The dimensions of the rectangular boundary of the model
corners (boolean) Does the neighborhood include 4 corner cells? (true=yes)
wrap (boolean) Do the boundaries of the model wrap? (true=yes)

methods:
set_cell (None) Set a given pixel to a given value
set_cells (None) Initializes a model with a list of boolean values
get_cell (boolean) Gets value of the pixel at a given location
get_cells (BoolField) Get all the cells in the model
set_rule (None) Set the CA rule to a given function
clear (None) Initialize the boolean field and clear the history
record (None) Append the current state of the model to the history.
step (None) Creates a new generation and performs reaction-diffusion algorithm to update the model.
to_pts (points) Creates a set of points representing the state of the model at a given time
'''

"""
A type is defined that stores u and v values for each location in two value fields, records the history 
of the model as it changes, and provides methods for reading, writing and clearing values.
"""

class CA (object):

    def __init__(self,field = None, pixel_res=Interval(20,20),corners=False,wrap=False):
        if field == None:
            self.width = int(pixel_res.a)
            self.height = int(pixel_res.b)
            self.clear(corners,wrap)
        else:
            self.width = field._res[0]
            self.height = field._res[1]
            self.cells = field
            self.step_count = 0
            self.hist = []
    
    def set_cell(self,x,y,val):
        x,y = self._reframe(x,y)
        self.cells.set(x,y,val)


# sets the entire field. Expects a list of booleans
    def set_cells(self, initial_cell=False):
        for n, bool in enumerate(initial_cell):
            self.cells._pixels[n] = bool
            
# pass a function to be used for each iteration of the automata
# assumes that function takes the status of the home cell, and a list of the statuses of the neighbors
# function returns the new value for the home cell
    def set_rule(self,func=False):
        self.rule = func
            
    def get_cell(self,x,y): return self.cells.get(x,y)

    def get_cells(self) : return self.cells           


    """
    [noprint]
    """
    def _reframe(self,x,y):
        while x > self.width -1 : x = x - self.width
        while y > self.height -1: y = y - self.height
        while x < 0 : x = self.width + x
        while y < 0 : y = self.height + y
        return x,y
    """
    Initialize a boolean field and clear the history.
    """
    def clear(self,corners,wrap):
        self.cells = BoolField(Interval(self.width,self.height),wrap,corners)
        self.step_count = 0
        self.hist = []
        
    """
    Methods for recording the current state of the model and creating a new generation.
    """
    def record(self):
        self.hist.append(self.cells)

    # makes a new generation by calling the function stored in self.rule
    def step(self, t=1.0):
        nxt_cells = BoolField(Interval(self.width,self.height),self.cells.wrap,self.cells.include_corners)
        t = max(min(1.0,t),0.0)
        for x in range(0,self.width):
            for y in range(0,self.height):
                cur_cell = self.cells.get(x,y)
                neighbor_cells = self.cells.neighbors_of(x,y)
                nxt_cell = self.rule(cur_cell, neighbor_cells)
                nxt_cells.set(x,y,nxt_cell)
        self.cells = nxt_cells
        self.step_count += 1
        

    """
    Creates a set of points representing the state of the model at a given time.
    """
    def to_pts(self, g=0):        
        
        # make sure that you do not select beyond the length of the CA's history
        select = g % len(self.hist)
        
        a,b = [],[]

        # iterate through the cell field for the selected generation
        # if the value of the cell is true, put a point in a
        # otherwise, put a point in b
        for i in range(self.width):
            for j in range(self.height):
                if self.hist[select].get(i,j): 
                    a.append(Point(i,j))
                else: 
                    b.append(Point(i,j))
    
        return a,b


# ========================================================================
a.put(CA)
# ---------- end decodes_4 ----------

# ----
# b
slider = Slider(50, range=0..100)
panel_2 = Panel("generates history")
decodes_5 = DecodesPythonScript(CA=decodes_4.a, func=decodes_2.func, f_in=decodes.f_out, max_gen=slider, stepsize=Slider(1, range=1..100))  # -> console, ca_out, a, b; inputs max_gen: Int32, stepsize: Int32
# ---------- decodes_5: Python ----------
'''
4.02.L02b
Given a set of rules, the width and height of the cell field, and the number of generations, create a ca model with its time history.

in: 
func (function) A function for evaluating each cell 
w,h (integers) Width, height of boolean field 
max_gen (int) The number of generations for the algorithm to run.
stepsize (int) The number of generations to run before recording the state of the model.
select_step (int) The recorded step of the model to visualize.

out:
pts_true, pts_false (list of points) Lists representing true cells and false cells
'''

"""
Create a CA object, define an initial state, perform algorithm and visualize results.
"""

# initialize an instance of the CA object class
my_CA = CA(field = f_in)
# random.seed(0)

# define the CA's rule
my_CA.set_rule(func)

# Create a starting position
#start_field= [] # start with empty boolean field

# for every pixel in the boolean field:
#for i in range(w*h):
#    start_field.append(random.choice([0,1,2,3])) # randomly select True or False
#my_CA.set_cells(start_field) # set field to the new boolean field

# for every generation to be produced:
for n in range(max_gen):
    # if generation should be recorded:
    if n % stepsize == 0:
        # record the state of the CA model
        my_CA.record() 
    my_CA.step() # update the CA model
    
# get True and False points from the CA model for a given generation
# points = my_CA.to_pts(select_step)

# ====================================================
# a.put(points[0])
# b.put(points[1])

ca_out.put(my_CA)
# ---------- end decodes_5 ----------

select = Slider(36, range=0..100)
cell_size = Slider(3, range=0..10)
decodes_6 = DecodesPythonScript(ca_in=decodes_5.ca_out, select_step=select)  # -> console, a, b, c; inputs select_step: Int32
# ---------- decodes_6: Python ----------
# get True and False points from the CA model for a given generation
points = ca_in.to_pts(select_step)

a.put(points[0])
b.put(points[1])
c.put(ca_in.hist[select_step]._pixels)
# ---------- end decodes_6 ----------
division = Division(A=cell_size, B=2)
multiplication = Multiplication(A=decodes_6.a, B=cell_size)
box = CenterBox(Base=multiplication, X=division, Y=division, Z=division)
