# Grasshopper definition demonstration.ghx (Grasshopper 0.9.65)
# plug-ins: Decodes Python Interpreter

decodes = DecodesPythonScript(x=Slider(0.5, range=0..4), y=Slider(0.5, range=0..4))  # -> console, a, b, c
# ---------- decodes: Python ----------
"""
Define a two parametric surfaces
"""
def func_a(u,v): 
    u1 = u*x
    v1 = v*y
    return Point(u,v,(u1**3-3*u1*(v1**2))/4)
    
# eval function for a handkerchief surface
def func_b(u,v): 
    u1 = u*x
    v1 = v*y
    return Point(u,v,((1/3)*u1**3+u1*v1**2+2*(u1**2-v1**2))/4 )


# eval function for the curve
def func_c(u,v): 
    u1 = 2*math.pi*u*x
    v1 = 2*math.pi*v*y
    return Point(u,v,math.sin(u1)+math.cos(v1))

# create surface over domain -1 to 1

a.put(func_a)
b.put(func_b)
c.put(func_c)
# ---------- end decodes ----------
decodes_2 = DecodesPythonScript(func=decodes.c, u=Slider(14, range=0..20), v=Slider(17, range=0..20))  # -> console, d; inputs u: Int32, v: Int32
# ---------- decodes_2: Python ----------
from decodes.extensions.classical_surfaces import *

"""
Define a surface with an umbilic point and split it apart
"""
# eval function for a monkey saddle surface

# create surface over domain -1 to 1
surf = Surface(func,Interval(-1,1),Interval(-1,1))

meshes = surf.to_mesh(divs_u=u,divs_v=v)

d.put(meshes)
# ---------- end decodes_2 ----------
surface = Data(decodes_2.d)
