# Grasshopper definition graph_ca.ghx (Grasshopper 0.9.65)
# plug-ins: Decodes Python Interpreter

number_slider = Slider(2, range=0..10)
number_slider_2 = Slider(6, range=0..10)
recgrid = Rectangular(Plane=PlaneXY(0, 0, 0), SizeX=number_slider, SizeY=number_slider, ExtentX=number_slider_2, ExtentY=number_slider_2)  # -> Cells, Points
explode = Explode(Curve=recgrid.Cells, Recursive=True)  # -> flatten(Segments), Vertices
data = Data(flatten(explode.Vertices))
number_slider_3 = Slider(15, range=0..100)
cullpt = CullDuplicates(Points=data, Tolerance=0.1, CullMode=3)  # -> Points, Indices, Valence
geo = Geometry([<curve referenced from the Rhino model> x6])
lng = ListLength(List=cullpt.Points)
decodes = DecodesPythonScript(pts=cullpt.Points, d=Slider(9, range=0..10))  # -> console, a; inputs pts: list
# ---------- decodes: Python ----------
lines = []

for i in range(len(pts)-1):
    for j in range(i+1,len(pts)):
        v = Vec(pts[i],pts[j])
        if v.length2 < d:
            a.put(Line(pts[i], pts[j]))
# ---------- end decodes ----------
random = Random(Range=Domain(0, 1), Number=lng, Seed=Slider(0, range=0..1))
decodes_2 = DecodesPythonScript(lines=explode.Segments, n=number_slider_3)  # -> console, a, b, c; inputs lines: list of Line, n: Int32; disabled
# ---------- decodes_2: Python ----------
import math
#from decodes.extensions.graph import Graph

class Graph(object):
    """
    A simple undirected, weighted graph
    """
    def __init__(self):
        self.nodes = []
        self.edges = {}
        self.distances = {}
    
    def add_node(self, value):
        if not(value in self.nodes):
            self.nodes.append(value)

    def add_edge(self, from_node, to_node, distance = 0):
        self._add_edge(from_node, to_node, distance)
        self._add_edge(to_node, from_node, distance)
 
    def _add_edge(self, from_node, to_node, distance = 0):
        #print "in _add_edge. called with ", from_node, to_node
        self.edges.setdefault(from_node, [])
        self.edges[from_node].append(to_node)
        self.distances[(from_node, to_node)] = distance
        
    def node_to_lines(self, n):
        ret = []
        n = n % len(self.nodes)
        spt = self.nodes[n]
        for ept in self.edges[spt]:
            ret.append(Line(spt, ept))
        return ret


def graph_tolines(g):
    lines = []
    used = []
    print "g.nodes = ",g.nodes
    for spt in g.nodes:
        print "spt = ", spt
        epts = g.edges[spt]
        print " epts = ", epts
        for ept in epts:
            if ept not in used:
                lines.append(Line(spt, ept))
        used.append(spt)
    return lines

# test if pt is in graph
def in_graph(pt, g):
    ret = False
    for node in g.nodes:
        if pt == node:
            pt = node
            ret = True
    return ret, pt           


g = Graph()

# adds points to graph
pts = []

for line in lines:
    pt1 = line.spt
    pt2 = line.ept
    test, pt1 = in_graph(pt1,g)
    if not(test):
        g.add_node(pt1)
        pts.append(pt1)
    test, pt2 = in_graph(pt2,g)
    if not(test):
        g.add_node(pt2)
        pts.append(pt2)
    g.add_edge(pt1,pt2,1)

print g.nodes
print pts
#g.add_edge(pts[1],pts[0])
#g.add_edge(pts[1],pts[2])
#print g.edges[pts[1]]

print g.edges,len(g.edges)
for key in g.edges: print key, " ---- ",g.edges[key]

line_list = graph_tolines(g)
print len(line_list)
a.put(line_list)



b.put(g.node_to_lines(n))
c.put(g.nodes[n % len(g.nodes)])



"""


    


# set up graph to test

pts = []
for i in range(6):
    #print i
    pt = Point(i,i)
    pts.append(pt)
    #g.add_node(pt)

for i,pt in enumerate(pts):
    g.add_node(pt)
    g.add_edge(pts[i-1],pts[i],1)
    
    
print g.nodes
print g.edges
print " ------------------"

new_pt = Point(2,2)

# how to test if point is in graph already
in_graph = False
for node in g.nodes:
    if new_pt == node:
        in_graph = True
        new_pt = node




for i,pt in enumerate(pts):
    g.add_node(pt)
    g.add_edge(pts[i-1],pts[i],1)


print g.nodes
print g.edges
"""
# ---------- end decodes_2 ----------
larger = LargerThan(FirstNumber=random, SecondNumber=Slider(0.8, range=0..1))  # -> LargerThan, OrEqualTo
number_slider_4 = Slider(5, range=0..100)
decodes_3 = DecodesPythonScript(lines=decodes.a, pts=cullpt.Points, val=larger.LargerThan, pick=number_slider_3)  # -> console, a, b, c, d, gr; inputs lines: list of Line, pts: list, val: list, pick: Int32
# ---------- decodes_3: Python ----------
import math
#from decodes.extensions.graph import Graph

class Graph(object):
    """
    A simple undirected, weighted graph
    """
    def __init__(self):
        self.nodes = []
        self.edges = {}
        self.distances = {}
        self.values = {}
    
    def add_node(self, node, value = 0):
        if not(value in self.nodes):
            self.nodes.append(node)
            self.values.setdefault(node, [])
            self.values[node] = value
            
    def set_node(self, node, value = 0):
        self.values[node] = value

    def add_edge(self, from_node, to_node, distance = 0):
        self._add_edge(from_node, to_node, distance)
        self._add_edge(to_node, from_node, distance)
 
    def _add_edge(self, from_node, to_node, distance = 0):
        #print "in _add_edge. called with ", from_node, to_node
        self.edges.setdefault(from_node, [])
        if not(to_node in self.edges[from_node]):
            self.edges[from_node].append(to_node)
        self.distances[(from_node, to_node)] = distance
        
    def node_to_lines(self, n):
        ret = []
        n = n % len(self.nodes)
        spt = self.nodes[n]
        for ept in self.edges[spt]:
            ret.append(Line(spt, ept))
        return ret
        
    def to_lines(self):
        lines = []
        used = []
        for spt in self.nodes:
            epts = self.edges[spt]
            for ept in epts:
                if ept not in used:
                    lines.append(Line(spt, ept))
            used.append(spt)
        return lines

# test if pt is in graph
def in_graph(pt, g):
    ret = False
    for node in g.nodes:
        if pt == node:
            pt = node
            ret = True
    return ret, pt           


g = Graph()

# adds points to graph
pts = []

for line in lines:
    pt1 = line.spt
    pt2 = line.ept
    test, pt1 = in_graph(pt1,g)
    if not(test):
        g.add_node(pt1)
        pts.append(pt1)
    test, pt2 = in_graph(pt2,g)
    if not(test):
        g.add_node(pt2)
        pts.append(pt2)
    g.add_edge(pt1,pt2,1)

print g.nodes

for pt in pts:
    if pt in g.nodes:
        n = g.nodes.index(pt)
        print n
        g.set_node(pt, val[n])
    else:
        print "We have a problem."

#g.add_edge(pts[1],pts[0])
#g.add_edge(pts[1],pts[2])
#print g.edges[pts[1]]

print g.edges,len(g.edges)
for key in g.edges: print key, " ---- ",g.edges[key]


a.put(g.to_lines())

pick = pick % len(g.nodes)

b.put(g.node_to_lines(pick))
c.put(g.nodes[pick])


for n in g.nodes:
    if g.values[n]:
        d.put(n)

gr.put(g)
# ---------- end decodes_3 ----------
decodes_4 = DecodesPythonScript()  # -> console, a
# ---------- decodes_4: Python ----------
def func(home_val, nei_val):
    print "home value: ", home_val
    print "neighbor values: ", nei_val
    d = dict()
    d[True] = 0
    d[False] = 0
    for v in nei_val:
        if v not in d:
            d[v] = 1
        else:
            d[v] += 1
    print d
    return d[True] > d[False]


a.put(func)
# ---------- end decodes_4 ----------
decodes_5 = DecodesPythonScript()  # -> console, a
# ---------- decodes_5: Python ----------
def func(home_val, nei_val):
    print "home value: ", home_val
    print "neighbor values: ", nei_val
    d = dict()
    d[True] = 0
    d[False] = 0
    for v in nei_val:
        if v not in d:
            d[v] = 1
        else:
            d[v] += 1
    print d
    if home_val:
        return (d[True] == 2 or d[True] == 3)
    else:
        return (d[True] == 3)


a.put(func)
# ---------- end decodes_5 ----------
data_2 = Data(decodes_3.b)
circle = CircleCNR(Center=decodes_3.c, Normal=Vector(0, 0, 1), Radius=1)
decodes_6 = DecodesPythonScript(gr=decodes_3.gr, func=decodes_5.a, gen=Slider(50, range=0..50))  # -> console, a, b; inputs gen: Int32, x: Int32
# ---------- decodes_6: Python ----------
new_gr = copy.deepcopy(gr)
r = []
print "start:"
print gr.values
for i in range(gen):
    print "generation ", i+1
    for n in gr.nodes:
        nei_val = []
        for v in gr.edges[n]:
            nei_val.append(gr.values[v])
        new_gr.set_node(n, func(gr.values[n], nei_val))
    #print new_gr.values
    r.append(copy.deepcopy(new_gr))
    gr = new_gr
    new_gr = copy.copy(gr)
"""
for i in range(len(r)):
    print i
    print r[i].values
"""

a.put(r)
# ---------- end decodes_6 ----------
data_3 = Data(decodes_3.d)
decodes_7 = DecodesPythonScript(g=decodes_3.gr)  # -> console, d
# ---------- decodes_7: Python ----------
for n in g.nodes:
    if g.values[n]:
        d.put(n)
# ---------- end decodes_7 ----------
ln = Line(StartPoint=data_3)
decodes_8 = DecodesPythonScript(x=decodes_6.a, y=Slider(0, range=0..100))  # -> console, a, b, c, d, gr; inputs x: list, y: Int32
# ---------- decodes_8: Python ----------
print x

g = x[y % len(x)]

print g

a.put(g.to_lines())


for n in g.nodes:
    if g.values[n]:
        d.put(n)
# ---------- end decodes_8 ----------
circle_2 = CircleCNR(Center=decodes_8.d, Normal=Vector(0, 0, 1), Radius=1)
