# Grasshopper definition graph_ca_2.ghx (Grasshopper 0.9.65)
# plug-ins: Decodes Python Interpreter

number_slider = Slider(2, range=0..10)
number_slider_2 = Slider(6, range=0..10)
recgrid = Rectangular(Plane=PlaneXY(0, 0, 0), SizeX=number_slider, SizeY=number_slider, ExtentX=number_slider_2, ExtentY=number_slider_2)  # -> Cells, Points
explode = Explode(Curve=recgrid.Cells, Recursive=True)  # -> flatten(Segments), Vertices
data = Data(flatten(explode.Vertices))
cullpt = CullDuplicates(Points=data, Tolerance=0.1, CullMode=3)  # -> Points, Indices, Valence
lng = ListLength(List=cullpt.Points)
decodes = DecodesPythonScript(pts=cullpt.Points, d=Slider(9, range=0..10))  # -> console, a; inputs pts: list
# ---------- decodes: Python ----------
lines = []

for i in range(len(pts)-1):
    for j in range(i+1,len(pts)):
        v = Vec(pts[i],pts[j])
        if v.length2 < d:
            a.put(Line(pts[i], pts[j]))
# ---------- end decodes ----------
random = Random(Range=Domain(0, 1), Number=lng, Seed=Slider(0, range=0..1))
larger = LargerThan(FirstNumber=random, SecondNumber=Slider(0.8, range=0..1))  # -> LargerThan, OrEqualTo

# ---- group: graph class
decodes_2 = DecodesPythonScript(lines=decodes.a, pts=cullpt.Points, val=larger.LargerThan)  # -> console, gr; inputs lines: list of Line, pts: list, val: list
# ---------- decodes_2: Python ----------
import math
#from decodes.extensions.graph import Graph

class Graph(object):
    """
    A simple undirected, weighted graph
    """
    def __init__(self):
        self.nodes = []
        self.edges = {}
        self.distances = {}
        self.values = {}
    
    def add_node(self, node, value = 0):
        if not(value in self.nodes):
            self.nodes.append(node)
            self.values.setdefault(node, [])
            self.values[node] = value
            
    def set_node(self, node, value = 0):
        self.values[node] = value

    def add_edge(self, from_node, to_node, distance = 0):
        self._add_edge(from_node, to_node, distance)
        self._add_edge(to_node, from_node, distance)
 
    def _add_edge(self, from_node, to_node, distance = 0):
        #print "in _add_edge. called with ", from_node, to_node
        self.edges.setdefault(from_node, [])
        if not(to_node in self.edges[from_node]):
            self.edges[from_node].append(to_node)
        self.distances[(from_node, to_node)] = distance
        
    def node_to_lines(self, n):
        ret = []
        n = n % len(self.nodes)
        spt = self.nodes[n]
        for ept in self.edges[spt]:
            ret.append(Line(spt, ept))
        return ret
        
    def to_lines(self):
        lines = []
        used = []
        for spt in self.nodes:
            epts = self.edges[spt]
            for ept in epts:
                if ept not in used:
                    lines.append(Line(spt, ept))
            used.append(spt)
        return lines

# test if pt is in graph
def in_graph(pt, g):
    ret = False
    for node in g.nodes:
        if pt == node:
            pt = node
            ret = True
    return ret, pt           


g = Graph()

# adds points to graph
pts = []

for line in lines:
    pt1 = line.spt
    pt2 = line.ept
    test, pt1 = in_graph(pt1,g)
    if not(test):
        g.add_node(pt1)
        pts.append(pt1)
    test, pt2 = in_graph(pt2,g)
    if not(test):
        g.add_node(pt2)
        pts.append(pt2)
    g.add_edge(pt1,pt2,1)

print g.nodes

for pt in pts:
    if pt in g.nodes:
        n = g.nodes.index(pt)
        print n
        g.set_node(pt, val[n])
    else:
        print "We have a problem."

#a.put(g.to_lines())

gr.put(g)
# ---------- end decodes_2 ----------

# ----
decodes_3 = DecodesPythonScript()  # -> console, a
# ---------- decodes_3: Python ----------
def func(home_val, nei_val):
    print "home value: ", home_val
    print "neighbor values: ", nei_val
    d = dict()
    d[True] = 0
    d[False] = 0
    for v in nei_val:
        if v not in d:
            d[v] = 1
        else:
            d[v] += 1
    print d
    return d[True] > d[False]


a.put(func)
# ---------- end decodes_3 ----------
decodes_4 = DecodesPythonScript()  # -> console, a
# ---------- decodes_4: Python ----------
def func(home_val, nei_val):
    print "home value: ", home_val
    print "neighbor values: ", nei_val
    d = dict()
    d[True] = 0
    d[False] = 0
    for v in nei_val:
        if v not in d:
            d[v] = 1
        else:
            d[v] += 1
    print d
    if home_val:
        return (d[True] == 2 or d[True] == 3)
    else:
        return (d[True] == 3)


a.put(func)
# ---------- end decodes_4 ----------

# ---- group: engine
decodes_5 = DecodesPythonScript(gr=decodes_2.gr, func=decodes_4.a, gen=Slider(10, range=0..50), go=Button())  # -> console, a, b; inputs gen: Int32, go: Boolean
# ---------- decodes_5: Python ----------
print go
if go:
    new_gr = copy.deepcopy(gr)
    r = []
    for i in range(gen):
        for n in gr.nodes:
            nei_val = []
            for v in gr.edges[n]:
                nei_val.append(gr.values[v])
            new_gr.set_node(n, func(gr.values[n], nei_val))
        #print new_gr.values
        r.append(copy.deepcopy(new_gr))
        gr = new_gr
        new_gr = copy.copy(gr)
    
a.put(r)
# ---------- end decodes_5 ----------

# ----
decodes_6 = DecodesPythonScript(x=decodes_5.a, y=Slider(27, range=0..100))  # -> console, a, b, c, d, gr; inputs x: list, y: Int32
# ---------- decodes_6: Python ----------
print x

g = x[y % len(x)]

print g

a.put(g.to_lines())


for n in g.nodes:
    if g.values[n]:
        d.put(n)
# ---------- end decodes_6 ----------
decodes_7 = DecodesPythonScript(g=decodes_2.gr, pick=Slider(15, range=0..100))  # -> console, b, c; inputs pick: Int32
# ---------- decodes_7: Python ----------
pick = pick % len(g.nodes)

b.put(g.node_to_lines(pick))
c.put(g.nodes[pick])
# ---------- end decodes_7 ----------
box = CenterBox(Base=decodes_6.d, X=1, Y=1, Z=0)
circle = CircleCNR(Center=decodes_7.c, Normal=Vector(0, 0, 1), Radius=1)
data_2 = Data(decodes_7.b)
