# Grasshopper definition nr_shelden packing.gh (Grasshopper 0.9.14)
# plug-ins: Decodes Python Interpreter

crv = Curve(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)
width = Slider(7, range=0.5..100)
max = Slider(50, range=0..500)
obsolete = DecodesPythonScript()  # -> console, a
# ---------- obsolete: Python ----------
def sheldon_packing(shape,w, indent = ''):
    result = []
    for i in range(len(shape.edges)):
        print indent, i
        cut = offset_cut(shape, w, i)
        print indent,"cut :",cut, "..."
        if cut != False:
            result = []
            temp = sheldon_packing(cut[1],w, indent+'    ')
            print indent,"temp = ", temp
            for j in temp: 
                t = [copy.deepcopy(cut[0])]
                t.append(copy.deepcopy(j))
                print indent,"t = ",t
                result.append(t)
        else: result.append([copy.deepcopy(shape)])
    print indent, "result = ",result
    return result
# ---------- end obsolete ----------
geo = Geometry(<curve referenced from the Rhino model>)
decodes = DecodesPythonScript(pgon=crv, mat_w=Slider(10.2, range=0.5..100), mat_h=Slider(0.5, range=0.1..1.1))  # -> console, a, b; disabled
# ---------- decodes: Python ----------
mat_size = mat_w, mat_h

#b.put([pgon.pts[0],pgon.pts[1],pgon.pts[2],pgon.pts[3]])

"""
edge = pgon.edges[0]
off_vec = edge.vec.cross(Vec(edge.spt,pgon.centroid)).cross(edge.vec)
line = Line(edge.spt + off_vec.normalized(mat_size[0]), edge.vec)

xsec = Intersector()

p0, p1 = None, None
if xsec.of(line,pgon.edges[-1]) : p0 = xsec[0]
if xsec.of(line,pgon.edges[1]) :p1 = xsec[0]
if p0 is None or p1 is None:
    print "wtf?"
#a.put(Segment(p0,p1))
"""

def panel_cut (fgon, mat_size, ee):
    result = False
    edge = fgon.edges[ee]
    off_vec = edge.vec.cross(Vec(edge.spt,fgon.centroid)).cross(edge.vec)
    line = Line(edge.spt + off_vec.normalized(mat_size), edge.vec)
    
    xsec = Intersector()
    
    p0, p1 = None, None
    if xsec.of(line,fgon.edges[ee-1]) :
        print xsec.ta, xsec.tb
        if xsec.tb <= 1.0:
            p0 = xsec[0]
    if xsec.of(line,fgon.edges[ee-3]) :
        print xsec.ta, xsec.tb
        if xsec.tb <= 1.0:
            p1 = xsec[0]
    print p0, p1
    
    #div = Segment(p0,p1)
    if not(p0 is None) and not (p1 is None):
        print "got it!"
        panelpts = [p0,p1,fgon.pts[ee-3],fgon.pts[ee]]
        panel = PGon(panelpts)
        ngonspts =[p0,p1,fgon.pts[ee-2],fgon.pts[ee-1]]
        new_pgon = PGon(ngonspts)
        result = [panel, new_pgon]
    return result

panels = panel_cut (pgon, mat_w, 3)

if panels != False:
    a.put(panels[0])
    b.put(panels[1])
else:
    a.put(pgon)
    b.put(pgon)
# ---------- end decodes ----------
decodes_2 = DecodesPythonScript(pgon=crv, rev=Toggle(True))  # -> console, a, b; inputs rev: Boolean
# ---------- decodes_2: Python ----------
mat_size = mat_w, mat_h

#b.put([pgon.pts[0],pgon.pts[1],pgon.pts[2],pgon.pts[3]])

"""
edge = pgon.edges[0]
off_vec = edge.vec.cross(Vec(edge.spt,pgon.centroid)).cross(edge.vec)
line = Line(edge.spt + off_vec.normalized(mat_size[0]), edge.vec)

xsec = Intersector()

p0, p1 = None, None
if xsec.of(line,pgon.edges[-1]) : p0 = xsec[0]
if xsec.of(line,pgon.edges[1]) :p1 = xsec[0]
if p0 is None or p1 is None:
    print "wtf?"
#a.put(Segment(p0,p1))
"""

e = pgon.edges

def sort_edges(edges, rev = False):
    result = range(len(edges))
    result.sort(key=lambda s: e[s].length, reverse=rev)
    return result
    
indexes = sort_edges(e, rev)

print indexes


a.put(e)
b.put(e[indexes[0]])
# ---------- end decodes_2 ----------
geo_2 = Geometry(decodes.a)  # disabled
geo_3 = Geometry(decodes.b)  # disabled
decodes_3 = DecodesPythonScript(r=geo, w=width, m=max)  # -> console, a, b, c; inputs r: Polyline, m: Int32
# ---------- decodes_3: Python ----------
class SBin():
    
    def __init__(self, _remainder, _strips = []):
        self.strips = _strips
        self.remainder = _remainder
        
    def cut(self, width = 1.0):
        result = []
        
        for i in range(len(self.remainder)):
            new_bin = SBin(copy.copy(self.remainder),copy.copy(self.strips))
            cut = offset_cut(new_bin.remainder, width,i)
            if not(cut == False):
                new_bin.strips.append(cut[0])
                new_bin.remainder = cut[1]
                result.append(new_bin)
            else:
                return None
        
        return result

def offset_cut(r,w,v):
    
    result = False
    lin = Segment(r.pts[v-1], r.pts[v])
    depth = Segment(r.pts[v-1],r.pts[v-2])
    if depth.length > w:
        dir = depth.vec.normalized()
        
        if (v == 1) or (v == 3):
            dir = dir*(w/2.0)
            cut_point = lin.midpoint + dir
            cut_rect = PGon.rectangle(cut_point, lin.length, w)
        
            rem_point = r.centroid + dir
            rem_rect = PGon.rectangle(rem_point, lin.length, depth.length - w)
        else:
            dir = dir*(w/2.0)
            cut_point = lin.midpoint + dir
            cut_rect = PGon.rectangle(cut_point, w, lin.length)
        
            rem_point = r.centroid + dir
            rem_rect = PGon.rectangle(rem_point, depth.length - w, lin.length)
        result = [cut_rect, rem_rect]
    return result


max_options = m

bins = [SBin(r)]

cuts_remain = True
finished_bins = []

while cuts_remain:
    print len(finished_bins)," -- ",
#    print "==", bins
    cuts_remain = False
    new_bins = []
    for bin in bins:
#        print bin
        test_cut = bin.cut(w)
        if test_cut == None :
            finished_bins.extend([bin])
            if len(finished_bins) >= max_options: 
                cuts_remain = False
                break
        else:
            new_bins.extend(test_cut)
            cuts_remain = True
    bins = new_bins
    print len(finished_bins)

no_bins = len(finished_bins)


b.put(finished_bins)

c.put(no_bins)
# ---------- end decodes_3 ----------
panel = Panel(decodes_3.c)
geo_4 = Geometry(decodes_2.b)
geo_5 = Geometry(decodes_2.a)
panel_2 = Panel(decodes_2.console)
decodes_4 = DecodesPythonScript(bins=decodes_3.b, i=Slider(0, range=0..500))  # -> console, a, b; inputs bins: list, i: Int32
# ---------- decodes_4: Python ----------
no_bins = len(bins)

a.put(bins[i%no_bins].strips)

b.put(bins[i%no_bins].remainder)
# ---------- end decodes_4 ----------
geo_6 = Geometry(decodes_4.a)
geo_7 = Geometry(decodes_4.b)
