# Grasshopper definition Polygon_Divider.gh (Grasshopper 0.9.65)
# plug-ins: Decodes Python Interpreter

geo = Geometry(<curve referenced from the Rhino model>)
geo_2 = Geometry(<curve referenced from the Rhino model>)
pt = Point(<point referenced from the Rhino model>)
geo_3 = Geometry(<curve referenced from the Rhino model>)
geo_4 = Geometry(<curve referenced from the Rhino model>)
geo_5 = Geometry(<curve referenced from the Rhino model>)
decodes = DecodesPythonScript(p=geo_3, pt=pt, q=geo, lin=geo_2)  # -> console, a, b, c, d, e; inputs p: Polyline, lin: Line
# ---------- decodes: Python ----------
#print type(p)

#print type(pt)

res = p.near(pt)

print res
#print p.contains_pt(pt)
#print p.overlaps(q)
#print lin
print "polygon points:",p.pts
print "segments :", p.edges


a.put(res[0])
c.put(p.pts[res[1]])

xs = Intersector()

xs.of(p,lin)

ipt = xs.results
b.put(ipt)
print "intersection points: ",ipt

res1 = p.near(ipt[0])
res2 = p.near(ipt[1])
print res1
print res2

p1 = []
p2 = []
inp1 = True

for n in range(len(p.pts)):
    if inp1:
        p1.append(p.pts[n])
    else:
        p2.append(p.pts[n])
    if n == res1[1]:
        p1.append(res1[0])
        p2.append(res1[0])
        inp1 = False
    if n == res2[1]:
        p1.append(res2[0])
        p2.append(res2[0])
        inp1 = True

print p1
print p2

d.put(PGon(p1))
e.put(PGon(p2))



print p.pts
# ---------- end decodes ----------
Y = UnitY(Factor=Slider(10, range=0..10))
Y_2 = UnitY(Factor=Slider(5, range=0..10))
decodes_2 = DecodesPythonScript()  # -> console, a
# ---------- decodes_2: Python ----------
def shuffle(list, value):
    if value in list:
        i = list.index(value)
        return list[i:]+list[:i]
    else:
        return list
        
        
m = [0,1,2,3,4,5]

print shuffle(m,2)
# ---------- end decodes_2 ----------
Y_3 = UnitY(Factor=Slider(30, range=0..100))
Y_4 = UnitY(Factor=Slider(30, range=0..100))
Y_5 = UnitY(Factor=Slider(30, range=0..100))
decodes_3 = DecodesPythonScript(p=geo_4, q=geo_5)  # -> console, a, b, c, d, e; inputs p: Polyline
# ---------- decodes_3: Python ----------
def shuffle(list, value):
    if value in list:
        i = list.index(value)
        return list[i:]+list[:i]
    else:
        return list

w = (0,1,2,3,4)

#print w[:0]+w[2:]

#print p.pts
#print q.pts

new_pts = p.pts
print p.pts
#print "new points: ",new_pts

def ins_list(list, index, value):
    res = []
    for n in range(len(list)):
        res.append(list[n])
        if n == index:
            res.append(value)
    return res

xpts = []

for edge in q.edges:
    xs = Intersector()
    xs.of(p,edge)
    i_pt = xs.results
    count = 0
    if i_pt <> []:
        near = p.near(i_pt[0])
        print "point: ", i_pt[0]," : ", new_pts
        if not(i_pt[0] in new_pts):
            new_pts = ins_list(new_pts, near[1]+count, i_pt[0])
            count += 1
        xpts.append(i_pt[0])
        if len(xpts) == 2:
            break

p = PGon(new_pts)
print "xpts: ", xpts
new_pts = q.pts
for pt in xpts:
    near = q.near(pt)
    if not(pt in new_pts):
        new_pts = ins_list(new_pts, near[1], pt)
    q = PGon(new_pts)

print p.pts
print q.pts

p_new = []
q_new = []

print "test ",q.contains_pt(Point(10.0,5.0,0.0))

for pt in p.pts:
    #print pt
    #print q.contains_pt(pt)
    if pt in xpts or not(pt in q):
        p_new.append(pt)

for pt in q.pts:
    if pt in xpts or not(pt in p):
        q_new.append(pt)

p_new = shuffle(p_new, xpts[1])
q_new = shuffle(q_new, xpts[0])
t = p_new[1:]+q_new[1:]

a.put(PGon(p_new))
b.put(PGon(q_new))
c.put(PGon(t))
d.put(xpts)
# ---------- end decodes_3 ----------
panel = Panel(decodes.console)
move = Move(Geometry=decodes.d, Motion=Y)  # -> Geometry, Transform; disabled
move_2 = Move(Geometry=decodes.e, Motion=Y_2)  # -> Geometry, Transform; disabled
move_3 = Move(Geometry=decodes_3.a, Motion=Y_3)  # -> Geometry, Transform
move_4 = Move(Geometry=decodes_3.c, Motion=Y_4)  # -> Geometry, Transform
move_5 = Move(Geometry=decodes_3.b, Motion=Y_5)  # -> Geometry, Transform
geo_6 = Geometry(move.Geometry)  # disabled
geo_7 = Geometry(move_2.Geometry)  # disabled
geo_8 = Geometry(decodes_3.d)
geo_9 = Geometry(move_3.Geometry)
geo_10 = Geometry(move_4.Geometry)
geo_11 = Geometry(move_5.Geometry)
