# Grasshopper definition ca_example.gh (Grasshopper 0.9.14)
# plug-ins: Decodes Python Interpreter

panel = Panel("maze_rules function")
decodes = DecodesPythonScript()  # -> console, func
# ---------- decodes: Python ----------
# Function to create a maze out of an random boolean field
# based on algorithm published by Kostas Terzidis,"Algorithms for Visual Design", pp. 168-171
def maze_rules(cur_val,nei_vals):
    nxt_val = cur_val
    count = 0
    for i in nei_vals:
        if i : count += 1
    if count == 3 : nxt_val = True
    if count > 4: nxt_val = False
    return nxt_val

func.put(maze_rules)
# ---------- end decodes ----------
# game of life
# function
decodes_2 = DecodesPythonScript()  # -> console, func
# ---------- decodes_2: Python ----------
# Function to perform Conway's Game of Life
def life_rules(home,neighbors):
    count = 0
    for i in neighbors:
        if i : count += 1
    if home:
        if (count < 2) or (count >3) :
            return False
        else:
            return True
    else:
        if (count == 3):
            return True
        else:
            return False

func.put(life_rules)
# ---------- end decodes_2 ----------
decodes_3 = DecodesPythonScript(func=decodes.func, w=Slider(40, range=0..100), h=Slider(40, range=0..100), gen=Slider(50, range=0..100))  # -> console, ca_out; inputs w: Int32, h: Int32, gen: Int32
# ---------- decodes_3: Python ----------
import decodes as dc
from decodes.core import *
from decodes.extensions.cellular_automata import CA
import random

my_CA = CA(Interval(w,h),True,False)
my_CA.set_rule(func)

# Create a starting position
init = []
for i in range(w*h):
    init.append(random.choice([0,1]) == 0)
my_CA.set_cells(init)
my_CA.record()

# Run the CA
stepsize = 1

for n in range(gen):
    for m in range(stepsize): my_CA.step()
    my_CA.record()

ca_out.put(my_CA)
# ---------- end decodes_3 ----------
slider = Slider(3, range=0..10)
decodes_4 = DecodesPythonScript(ca_in=decodes_3.ca_out, select=Slider(0, range=0..100), cs=slider)  # -> console, a, b; inputs select: Int32
# ---------- decodes_4: Python ----------
w = ca_in.width
h = ca_in.height
max_gen = len(ca_in.hist)
select = select % max_gen

for i in range(w):
    for j in range(h):
        if ca_in.hist[select].get(i,j): a.put(Point(i*cs,j*cs))
        else: b.put(Point(i*cs,j*cs))

print w,h
# ---------- end decodes_4 ----------
division = Division(A=slider, B=2)
box = CenterBox(Base=decodes_4.a, X=division, Y=division, Z=division)
