# Grasshopper definition rotational surfaces_ned.ghx (Grasshopper 0.9.14)
# plug-ins: Decodes Python Interpreter

md_slider = MDSlider(
    slider_value=Point(0.9111517929, 0.8116633718, 0.5),
    x_domain=Domain(0, 1),
    y_domain=Domain(0, 1),
    z_domain=Domain(0, 1),
    SliderMode=0)
slider = Slider(6, range=1..20)
# Select a "slice" of the surface.
slider_2 = Slider(4, range=0..10)
cluster = Cluster(num=Slider(0.409, range=0..1), V=md_slider, num_2=Slider(0.518, range=0..1))
v_target = Number(slider_2)
dom = Domain(DomainStart=Slider(4.1, range=0..6.28), DomainEnd=Slider(5.4, range=0..6.28))
pts = Point(cluster)
decodes = DecodesPythonScript(pts=pts, rot_ival=dom)  # -> console, a; inputs pts: list
# ---------- decodes: Python ----------
import math

def func(u,v):
    flat_pts = [Point(p.x,0,p.z) for p in pts]# ensure points lie on same plane as rotational axis by setting y=0
    
    angle = rot_ival.eval(u)
    xf = Xform.rotation(axis=Vec(0,0,1),angle=angle)
    rot_pts = [pt*xf for pt in flat_pts]
    
    crv = Curve.bezier(rot_pts)
    
    return crv.eval(v).origin
    

a.put(func)
# ---------- end decodes ----------
decodes_2 = DecodesPythonScript(func=decodes.a, res=slider)  # -> console, a, b, c, d; inputs res: Int32
# ---------- decodes_2: Python ----------
for ival_v in Interval()//res: 
    pa = func(0.5,ival_v.a)
    pb = func(0.5,ival_v.b)
    seg = Segment(pa,pb)
    a.put(seg)
    
    cpt_0 = Point(0,0,seg.spt.z)
    cpt_1 = Point(0,0,seg.ept.z)
    circ_0 = Circle(Plane(cpt_0),cpt_0.distance(seg.spt))
    circ_1 = Circle(Plane(cpt_1),cpt_1.distance(seg.ept))
    b.put([circ_0,circ_1])
    
    apex = None
    slope = 0
    if seg.vec.x != 0: # if false, we have a cyl
        slope = seg.vec.z / seg.vec.x
        dz = slope * seg.spt.x
        apex = Point(0,0,seg.spt.z - dz)
    c.put(apex)
    
    s0,s1 = None,None
    if slope < 0: 
        s0 = Segment(apex,func(0,ival_v.a))
        s1 = Segment(apex,func(1,ival_v.a))
    if slope > 0: 
        s0 = Segment(apex,func(0,ival_v.b))
        s1 = Segment(apex,func(1,ival_v.b))
    d.put([s0,s1])
# ---------- end decodes_2 ----------
edge_lines = Line(decodes_2.d)
circle = Circle(decodes_2.b)
pt = Point(simplify(graft(decodes_2.c)))
center_line = Line(decodes_2.a)
panel = Panel("Rotational Surface")
merge = Merge(Data1=circle, Data2=pt, Data3=edge_lines)
top_and_bottom_circles_at_each_div = Panel(circle)
res_u = Slider(12, range=4..50)
res_v = Slider(16, range=2..20)
branch = TreeBranch(Tree=merge, Path=slider_2, MaintainPaths=True)
apex_points_for_each_div = Panel(pt)
decodes_3 = DecodesPythonScript(res_u=res_u, res_v=res_v)  # -> console, a
# ---------- decodes_3: Python ----------
#IN:   a function f(u,v) describing a parametric surface on the domain [0,1]x[0,1]
#OUT:  Surface expressed as a set of points func(u,v) for (u,v) determined by res_u, res_v

count_u = int(res_u)
count_v = int(res_v)
tol_u = 1.0/res_u
tol_v = 1.0/res_v
u_vals = [i*tol_u for i in range(count_u+1)]
v_vals = [i*tol_v for i in range(count_v+1)]

#Expressed as a set of points
pts_out = []
for v in v_vals:
    for u in u_vals:
        pts_out.append(func(u,v))
a.put(pts_out)
# ---------- end decodes_3 ----------
# Surface expressed as a mesh aligned with isocurves for u, v determined by res_u and res_v
decodes_4 = DecodesPythonScript(func=decodes.a, res_u=res_v, res_v=res_u)  # -> console, a
# ---------- decodes_4: Python ----------
#IN:   a function f(u,v) describing a parametric surface on the domain [0,1]x[0,1]
#OUT:  Surface expressed as a mesh aligned with isocurves for u, v determined by res_u and res_v 


count_u = int(res_u)
count_v = int(res_v)
tol_u = 1.0/res_u
tol_v = 1.0/res_v
u_vals = [i*tol_u for i in range(count_u+1)]
v_vals = [i*tol_v for i in range(count_v+1)]

#Expressed as a mesh with faces determined by isocurves
msh = Mesh()
for v in v_vals:
    for u in u_vals:
        msh.append(func(u,v))

for j in range(count_v):
    row = j*(count_u+1)
    for i in range(count_u):
        pi_0 = row+i
        pi_1 = row+i+1
        pi_2 = row+i+count_u+2
        pi_3 = row+i+count_u+1
        msh.add_face(pi_0,pi_1,pi_2,pi_3)

a.put(msh)
# ---------- end decodes_4 ----------
# Surface expressed as a mesh, simple triangulation style
decodes_5 = DecodesPythonScript(res_u=res_v, res_v=res_u)  # -> console, a
# ---------- decodes_5: Python ----------
#IN:   a function f(u,v) describing a parametric surface on the domain [0,1]x[0,1]
#OUT:  Surface expressed as a mesh, simple triangulation style

count_u = int(res_u)
count_v = int(res_v)
tol_u = 1.0/res_u
tol_v = 1.0/res_v
u_vals = [i*tol_u for i in range(count_u+1)]
v_vals = [i*tol_v for i in range(count_v+1)]

msh = Mesh()
for v in v_vals:
    for u in u_vals:
        msh.append(func(u,v))

for j in range(count_v):
    row = j*(count_u+1)
    for i in range(count_u):
        pi_0 = row+i
        pi_1 = row+i+1
        pi_2 = row+i+count_u+2
        pi_3 = row+i+count_u+1
        msh.add_face(pi_0,pi_1,pi_2)
        msh.add_face(pi_0, pi_2, pi_3)

a.put(msh)
# ---------- end decodes_5 ----------
panel_2 = Panel(branch)
item = ListItem(List=branch, Index=Slider(2, range=0..100), Wrap=False)
item_2 = ListItem(List=branch, Index=Slider(0, range=0..100), Wrap=False)
geo = Geometry(branch)
edge_lines_for_each_div = Panel(edge_lines)
# Surface expressed as a set of points func(u,v) for (u,v) determined by res_u, res_v
crv = Curve(Vertices=decodes_3.a, Degree=3, Periodic=False)  # -> Curve, Length, Domain
cen = Center(Arc=item_2)  # -> Center, Radius
v_target_2 = Number(slider_2)
ln = Line(StartPoint=cen.Center, EndPoint=item)
# Creates a "slice"  of the surface.
decodes_6 = DecodesPythonScript(func=decodes.a, res_u=res_v, res_v=slider, v_target=v_target_2)  # -> console, a; inputs v_target: Int32
# ---------- decodes_6: Python ----------
#IN:   a function f(u,v) describing a parametric surface on the domain [0,1]x[0,1]
#OUT:  Surface expressed as a mesh aligned with isocurves for u, v determined by res_u and res_v 


count_u = int(res_u)
count_v = int(res_v)

u_vals = Interval(0,1).divide(count_u,True)
v_vals = Interval(0,1).divide(count_v,True)
print v_vals


#Expressed as a mesh with faces determined by isocurves
msh = Mesh()
for v in v_vals:
    if (v == v_vals[v_target]) or (v==v_vals[v_target+1]):
        for u in u_vals:
            msh.append(func(u,v))
print msh
for j in range(count_v):
    print j, v_target
    if j == v_target:
        print 
        row = j*(count_u+1)
        for i in range(count_u):
            pi_0 = i
            pi_1 = i+1
            pi_2 = i+count_u+2
            pi_3 = i+count_u+1
            print pi_0,pi_1,pi_2,pi_3
            msh.add_face(pi_0,pi_1,pi_2,pi_3)

a.put(msh)
# ---------- end decodes_6 ----------
# Shows the cone defined by the "slice".
cone = Cone(Base=item_2, Radius=cen.Radius, Length=ln)  # -> Cone, Tip

# ==== cluster Cluster
V = ClusterInput()
num = ClusterInput()
num_2 = ClusterInput()
vcomp = Decompose(Vector=V)  # -> XComponent, YComponent, ZComponent
num_3 = Number(num)
num_4 = Number(num_2)
pt = PointXYZ(XComponent=vcomp.XComponent, YComponent=vcomp.ZComponent, ZComponent=vcomp.YComponent, System=PlaneXY(0, 0, 0))
pt_2 = PointXYZ(XComponent=num_4, YComponent=0, ZComponent=0, System=PlaneXY(0, 0, 0))
pt_3 = PointXYZ(XComponent=num_3, YComponent=0, ZComponent=1, System=PlaneXY(0, 0, 0))
pt_4 = Point([pt_2, pt, pt_3])
pt_5 = ClusterOutput(pt_4)
