# Grasshopper definition scratch.gh (Grasshopper 0.9.65)
# plug-ins: Decodes Python Interpreter

decodes = DecodesPythonScript()  # -> console, a
# ---------- decodes: Python ----------
b = [0,1,2,3,4,5,6,7,8,9,10,11,12,13,14]
c = len(b)

print "index :", b.index(15)

print c, 15%c, b[c-1]

class test():
    def __init__(self, vals):
        self.nodes = vals
        

def insert(list, index, value):
    if list == None :
        return []
    index = index % len(list)
    if index == 0:
        return [value] + list
    if index == len(list)-1:
        return list + [value]
    return list[:index] + [value] + list[index:]

def ins(list, index, value):
    ret = []
    for k in range(len(list)):
        if k == index:
            ret.append(value)
        ret.append(list[k])
    return ret
    
def del_element(list, index):
    ret = []
    for k in range(len(list)):
        if k <> index:
            ret.append(list[k])
    return ret    


c = del_element(b, 3)


print b, b[3],c

b.pop(6)

print b,c
# ---------- end decodes ----------
