# Grasshopper definition ca_demo_02a.gh (Grasshopper 0.9.65)
# plug-ins: Decodes Python Interpreter

# ----
# a
pixel_width = Panel("30")
pixel_height = Panel("30")
pixel_height_2 = Integer(pixel_height)
panel = Panel("create starting position")
pixel_width_2 = Integer(pixel_width)

pixel_height_3 = Integer(pixel_height)
pixel_width_3 = Integer(pixel_width)
cluster = Cluster(B_2=pixel_width_3, B=pixel_height_3)
image = ImageSampler(
    cluster,
    FilePath="C:\Users\Ned Reifenstein\Documents\GitHub\decodes\sandbox\_nr_sandbox\studio\image_ca_demo_02.png",
    Filter="Colour",
    Interpolate=False,
    Umax=30,
    Umin=1,
    Vmax=30,
    Vmin=1,
    Wrap=1)
pixel_height_4 = Integer(pixel_height)
pixel_width_4 = Integer(pixel_width)
decodes = DecodesPythonScript(w=pixel_width_4, h=pixel_height_4, v=image, corners=Toggle(True), wrap_edge=Toggle(False))  # -> console, f_out; inputs w: Int32, h: Int32, v: list, corners: Boolean
# ---------- decodes: Python ----------
# initialize an instance of the CA object class
start_field = ValueField(Interval(w,h),include_corners=corners, wrap=wrap_edge)
# random.seed(0)
print len(v)
print v
# for every pixel in the boolean field:
for i in range(w*h):
#    print v[i]
    start_field._pixels[i] = v[i] # randomly select True or False
"""
for j in range(h):
    for i in range(w):
        print i,j,start_field.get(i,j), ":::",start_field.neighbors_of(i,j)
"""

print start_field.neighbors_of(0,0)

f_out.put(start_field)
# ---------- end decodes ----------

decodes_2 = DecodesPythonScript()  # -> console, func
# ---------- decodes_2: Python ----------
unbuilt_clr = Color(1.0,1.0,1.0)
access_clr = Color(1.0,.9529,0.6353)
built_clr = Color(0.0,0.0,0.0)


"""
Color CA Rules
"""
def wg_rules(home_clr,neighbor_clrs):
    # set up the new color for home cell
    new_clr = home_clr

    # if home cell is unbuilt:
    if home_clr == unbuilt_clr:
        count = 0 # counter for access cells in neighborhood

        # for each cell in the neighborhood:
        for neighbor_clr in neighbor_clrs:
            if neighbor_clr == access_clr: 
                count += 1 # count it

        # if there is access in neighborhood
        if (count > 0) and (random.random() > .8) : 
            # this cell will change to either built or access
            if random.random() > .5:
                new_clr = built_clr
            else:
                new_clr = access_clr

    return new_clr

func.put(wg_rules)
# ---------- end decodes_2 ----------
decodes_3 = DecodesPythonScript()  # -> console, func
# ---------- decodes_3: Python ----------
unbuilt_clr = Color(1.0,1.0,1.0)
access_clr = Color(1.0,.9529,0.6353)
built_clr = Color(0.95,0.95,0.95)


"""
Color CA Rules
"""
def wg_rules(home_clr,neighbor_clrs):
    # set up the new color for home cell
    new_clr = home_clr

    # if home cell is unbuilt:
    if home_clr == unbuilt_clr:
        count = 0 # counter for access cells in neighborhood
        # for each cell in the neighborhood:
        for neighbor_clr in neighbor_clrs:
            if neighbor_clr == access_clr: 
                count += 1 # count it
        # if there is access in neighborhood
        if (count > 0) and (random.random() > .8) : 
            # this cell will change to either built or access
            if random.random() > .5:
                new_clr = built_clr
            else:
                new_clr = access_clr
                
    # built space : does it grow?
    if (home_clr != unbuilt_clr) and (home_clr != access_clr):
        count = 0
        for neighbor_clr in neighbor_clrs:
            if (neighbor_clr != unbuilt_clr) and (neighbor_clr != access_clr): 
                count += 1 # count it
        # if there are three or more built spaces in neighborhood
        if (count > 2): 
            if new_clr.r > 0.0:
                new_clr = Color(new_clr.r-.05, new_clr.g-.05, new_clr.b-.05)

    return new_clr

func.put(wg_rules)
# ---------- end decodes_3 ----------

# ----
# b
panel_2 = Panel("30")
panel_3 = Panel("generates history")
decodes_4 = DecodesPythonScript(func=decodes_3.func, f_in=decodes.f_out, max_gen=panel_2)  # -> console, ca_out, a, b; inputs max_gen: Int32
# ---------- decodes_4: Python ----------
import copy
print "color_cellular_automata.py loaded"

"""
A type is defined that stores u and v values for each location in two value fields, records the history 
of the model as it changes, and provides methods for reading, writing and clearing values.
"""

class CA (object):

    def __init__(self,field = None, pixel_res=Interval(20,20),corners=False,wrap=False):
        if field == None:
            self.corners = corners
            self.wrap = wrap
            self.width = int(pixel_res.a)
            self.height = int(pixel_res.b)
            self.clear(corners,wrap)
        else:
            self.corners = field.include_corners
            self.wrap = field.wrap
            self.width = field._res[0]
            self.height = field._res[1]
            self.cells = field
            self.step_count = 0
            self.hist = []
    
    def set_cell(self,x,y,val):
        x,y = self._reframe(x,y)
        self.cells.set(x,y,val)


# sets the entire field. Expects a list of booleans
    def set_cells(self, initial_cell=False):
        for n, bool in enumerate(initial_cell):
            self.cells._pixels[n] = bool
            
# pass a function to be used for each iteration of the automata
# assumes that function takes the status of the home cell, and a list of the statuses of the neighbors
# function returns the new value for the home cell
    def set_rule(self,func=False):
        self.rule = func
            
    def get_cell(self,x,y): return self.cells.get(x,y)

    def get_cells(self) : return self.cells           


    """
    [noprint]
    """
    def _reframe(self,x,y):
        while x > self.width -1 : x = x - self.width
        while y > self.height -1: y = y - self.height
        while x < 0 : x = self.width + x
        while y < 0 : y = self.height + y
        return x,y
    """
    Initialize a boolean field and clear the history.
    """
    def clear(self,corners,wrap):
        self.cells = ValueField(Interval(self.width,self.height),include_corners = corners, wrap = wrap)
        self.step_count = 0
        self.hist = []
        
    """
    Methods for recording the current state of the model and creating a new generation.
    """
    def record(self):
        self.hist.append(self.cells)

    # makes a new generation by calling the function stored in self.rule
    def step(self):
        #print "starting step: ", self.cells
        nxt_cells = ValueField(Interval(self.width,self.height),include_corners=self.cells.include_corners, wrap=self.cells.wrap)
        for x in range(0,self.width):
            for y in range(0,self.height):
                cur_cell = self.cells.get(x,y)
                neighbor_cells = self.cells.neighbors_of(x,y)
                #print "cell: ",x,y," calling rule with:", cur_cell," :: ", neighbor_cells
                nxt_cell = self.rule(cur_cell, neighbor_cells)
                #print "return value = ", nxt_cell
                nxt_cells.set(x,y,nxt_cell)
        self.cells = nxt_cells
        #print self.cells, nxt_cells
        self.step_count += 1
        

    """
    Creates a set of points representing the state of the model at a given time.
    """
    def to_pts(self, g=0, show_color = False):        
        
        # make sure that you do not select beyond the length of the CA's history
        select = g % len(self.hist)
        
        pt_list = []

        # iterate through the cell field for the selected generation
        # if the value of the cell is true, put a point in a
        # otherwise, put a point in b
        for j in range(self.height):
            for i in range(self.width):
                new_pt = Point(i,j)
                if show_color:
                    new_pt.set_color(self.hist[select].get(i,j))
                pt_list.append(new_pt)

        return pt_list



"""
Create a CA object, define an initial state, perform algorithm and visualize results.
"""

# initialize an instance of the CA object class
my_CA = CA(field = f_in)

# random.seed(0)

# define the CA's rule
my_CA.set_rule(func)


# for every generation to be produced:
for n in range(max_gen):
    my_CA.record() 
    my_CA.step() # update the CA model


ca_out.put(my_CA)
# ---------- end decodes_4 ----------

# ----
# c
select = Slider(0, range=0..200)
panel_4 = Panel("visualize results")
decodes_5 = DecodesPythonScript(ca_in=decodes_4.ca_out, select_step=select)  # -> console, a, b; inputs select_step: Int32
# ---------- decodes_5: Python ----------
select_step = select_step % len(ca_in.hist)

points = ca_in.to_pts(select_step)
a.put(points)

b.put(ca_in.hist[select_step]._pixels)
# ---------- end decodes_5 ----------
division = Division(A="1", B=2)
multiplication = Multiplication(A=decodes_5.a, B="1")

decodes_6 = DecodesPythonScript(x=decodes_5.b, y="1")  # -> console, a; inputs x: list, y: Int32
# ---------- decodes_6: Python ----------
for c in x:
    if c.r <> c.g:
        a.put(0.0)
    else:
        a.put(y*(1.0-c.r))
# ---------- end decodes_6 ----------
Z = UnitZ(Factor=decodes_6.a)
move = Move(Geometry=multiplication, Motion=Z)  # -> Geometry, Transform

box = CenterBox(Base=move.Geometry, X=division, Y=division, Z=decodes_6.a)
preview = CustomPreview(Geometry=box, Shader=decodes_5.b)

# ==== cluster Cluster
B = ClusterInput()
B_2 = ClusterInput()
dom = ConstructDomain(DomainStart=1, DomainEnd=B)
dom_2 = ConstructDomain(DomainStart=1, DomainEnd=B_2)
range = Range(Domain=dom, Steps=dom)
range_2 = Range(Domain=dom_2, Steps=dom_2)
crossref = CrossReference(ListA=range_2, ListB=range, CrossMode=1)  # -> ListA, ListB
pt = ConstructPoint(XCoordinate=crossref.ListA, YCoordinate=crossref.ListB, ZCoordinate=0)
pt_2 = ClusterOutput(pt)
