# Grasshopper definition flocking_01.ghx (Grasshopper 0.9.65)
# plug-ins: Decodes Python Interpreter

geo = Geometry([<point referenced from the Rhino model> x5])

# ---- group: flocking birds / create Bird class
decodes = DecodesPythonScript()  # -> console, a
# ---------- decodes: Python ----------
'''
4.02.L05c
Create a Bird class with flocking behavior

members:
pos (Point) The location of the Bird object
vel (Vec) The velocity vector of the Bird object
max_val (float) The maximum velocity allowed for this Bird
acl (Vec) The acceleration vector of the Bird object
max_frc (float) The maximum force that can be exerted on the Bird
rov (float) Range of vision is the range to which this bird can see other Birds
roc (float) Range of comfort is the range of comfort with nearby Birds
hist_pos (list of Point) The past positions of the Bird
hist_vel (list of Vec) The past velocities of the Bird
hist_acl (list of acl) The past acceleration vectors of the Bird

methods:
step (None) Update Bird's position, velocity and acceleration and record history
steer (Vec) Steer the Bird by changing its accelaration vectors
scan ([Birds]) Scan for Birds that are within the range of vision
in_range([Birds]) Select Birds that are within a certain distance
seek (None) Steer Bird toward a goal
flee (None) Steer Bird away from a goal
align (None) Steer Bird to align with neighboring Birds
clear_history (None) Initialize the Bird's history
record (None) Add the Bird's current status to the Bird's history
'''

"""
A simple Bird class is defined with position, velocity, acceleration vectors, and history.
"""
class Bird():
    
    def __init__(self, pos_start = None, vel_start = None):
        # if there is no starting position:
        if pos_start is None : 
            # give the Bird a random point
            pos_start = Point.random(constrain2d=True)
        # if there is no starting velocity:
        if vel_start is None : 
            # give the Bird a random initial velocity
            vel_start = Vec.random(constrain2d=True)
            vel_start.normalized()
        
        # set the Bird's position to the initial point
        self.pos = pos_start 
        # set the Bird's velocity to the initial velocity
        self.vel = vel_start 
        # set a limit to the Bird's velocity
        self.max_vel = 3.00
        # set the initial acceleration to zero
        self.acl = Vec() 
        # set a limit to the Bird's acceleration
        self.max_frc = 0.30
        # range of vision is the range to which this bird can see other birds
        self.rov = 40.0
        # range of comfort is the range of comfort with nearby birds
        self.roc = 15.00
        
        # initalize history lists 
        self.clear_history()
        # record this initial condition as a "step"
        self.record()
        
    # define property functions to return x- and y-position
    @property
    def x(self): 
        return self.pos.x
    
    @property
    def y(self): 
        return self.pos.y
        
    """
    Overload the '==' operator so that two birds will be considered equal if their x and y coordinates are equal. Needed in order for the Point.cull_duplicates method to work.
    [noprint]
    """
    def __eq__(self, other): 
        try:
            return all([self.x==other.x,self.y==other.y])
        except:
            return False

    """
    Cause the Bird object to move, using its current velocity and acceleration.
    """        
    def step(self):  
        # add the acceleration to the velocity
        self.vel += self.acl
        # limit to the maximum velocity
        self.vel = self.vel.limited(self.max_vel) 
        # move bird
        self.pos += self.vel 
        # record the step after move
        self.record()       
        # reset acceleration back to zero for next step
        self.acl = Vec() 

    """
    Steer the Bird toward, or away from, a desired vector. Implements Craig Reynolds' formular: Steer = Desired - Velocity
    """  
    def steer(self, desired = Vec(), weight = 1.0):
        # if the desired direction is not zero:
        if desired <> Vec():
            # scale the desire vector to the max velocity
            desired = desired.normalized(self.max_vel)
        # Steer = Desired - Velocity
        steer =  desired  - self.vel
        # limit the steer vector and weight it
        steer = steer.limited(self.max_frc) * weight
        # add the steer vector to acceleration
        self.acl += steer         

    """
    Basic behavior functions to allow Bird to interact with neighbors
    """   
    # scan a region of space and find birds within it 
    def scan(self, quadtree) :
        # create the boundary to scan
        b_scan = Bounds(center = self.pos, dim_x = self.rov, dim_y = self.rov)
        # get a list of birds within boundary
        close_birds = quadtree.pts_in_bounds(b_scan)
        # return close birds that are not this bird
        return [c for c in close_birds if c is not self]    
        
    # find the birds within a certain distance
    def in_range(self, others, range):
        # get the square of the range distance
        r2 = range**2
        # initialize an empty list
        near_birds = []
        # for each bird:
        for bird in others:
            # get the square of the distance to this bird
            dist2 = self.pos.distance2(bird.pos)
            # if the distance is within the range:
            if dist2 !=0 and dist2 <= r2 : 
                # add it to the list of nearby birds
                near_birds.append(bird)
        return near_birds

    """
    Mid-Level Behaviors to steer the Bird
    """
    # steers this bird towards a group of birds
    def seek(self, others, weight = 1.0):
        # if there are birds in the group:
        if len(others) > 0 : 
            # define goal point as centroid of the birds
            goal = Point.centroid([other_bird.pos for other_bird in others])
            # steer toward the goal point
            self.steer(Vec(self.pos, goal), weight)

    # steers this bird away from a group of birds    
    def flee(self, others, weight = 1.0):
        # if there are birds in the group:
        if len(others) > 0 :
            # start a list of vectors
            vecs = []
            # for every bird in the group:
            for other_bird in others:
                # make a vector from other to self
                vec = Vec(other_bird.pos,self.pos)
                # find square of the length
                dist2 = vec.length2
                # if it is not zero:
                if dist2 > 0 : 
                    # normailze and scale vector
                    vec.normalized(1/dist2)
                # add it to the list
                vecs.append(vec)
            # steer toward the average of the vectors
            self.steer(Vec.average(vecs), weight)           

    # steers this bird to align with other birds
    def align(self,others, weight = 1.0):
        # if there are birds in the group:
        if len(others) > 0 :     
            # get the average vector of nearby birds
            align_vec=Vec.average([other_bird.vel for other_bird in others])
            # steer the average alignment vector
            self.steer(align_vec, weight)

    """
    Reset the Bird to its initial position and values
    [noprint]
    """    
    def reset(self):
        """
        resets this bird back to his initialized condition.
        replaces existing history lists with single inital values
        """
        self.is_alive = True
        if len(self.hist_pos) > 0:
            self.pos = self.hist_pos[0]
            self.vel = self.hist_vel[0]
            self.acl = self.hist_acl[0]
        self.clear_history()
        self.record()
        
    """
    Functions to clear the history and record a step
    """    
    # clear the position, velocity and acceleration histories
    def clear_history(self):
        self.hist_pos = []
        self.hist_vel = []
        self.hist_acl = []

    # record this step
    def record(self):
        # add its position, velocity and accelaration to the history
        self.hist_pos.append(self.pos)
        self.hist_vel.append(self.vel)
        self.hist_acl.append(self.acl)


a.put(Bird)
# ---------- end decodes ----------

# ---- group: goal-seeking birds / create Bird class
decodes_2 = DecodesPythonScript()  # -> console, a
# ---------- decodes_2: Python ----------
'''
4.02.L05a
Create a simple Bird class with goal-seeking behavior

members:
pos (Point) The location of the Bird object
vel (Vec) The velocity vector of the Bird object
max_val (float) The maximum velocity allowed for this Bird
acl (Vec) The acceleration vector of the Bird object
max_frc (float) The maximum force that can be exerted on the Bird
hist_pos (list of Point) The past positions of the Bird
hist_vel (list of Vec) The past velocities of the Bird
hist_acl (list of acl) The past acceleration vectors of the Bird

methods:
step (None) Update Bird's position, velocity and acceleration and record history
steer (Vec) Steer the Bird by changing its accelaration vectors
clear_history (None) Initialize the Bird's history
record (None) Add the Bird's current status to the Bird's history
'''

"""
A simple Bird class is defined with position, velocity, acceleration vectors, and history.
"""
class Bird():
    
    def __init__(self, pos_start = None, vel_start = None):
        # if there is no starting position:
        if pos_start is None : 
            # give the Bird a random point
            pos_start = Point.random(constrain2d=True)
        # if there is no starting velocity:
        if vel_start is None : 
            # give the Bird a random initial velocity
            vel_start = Vec.random(constrain2d=True)
        
        # set the Bird's position to the initial point
        self.pos = pos_start 
        # set the Bird's velocity to the initial velocity
        self.vel = vel_start 
        # set a limit to the Bird's velocity
        self.max_vel = 2.00
        # set the initial acceleration to zero
        self.acl = Vec() 
        # set a limit to the Bird's acceleration
        self.max_frc = 0.35
        # initalize history lists 
        self.clear_history()
        # record this initial condition as a "step"
        self.record()
        
    """
    Cause the Bird object to move, using its current velocity and acceleration.
    """        
    def step(self):
        # add the acceleration to the velocity
        self.vel += self.acl
        # limit to the maximum velocity
        self.vel = self.vel.limited(self.max_vel) 
        # record the step (note that we record before moving)
        self.record() 
        # move bird
        self.pos += self.vel 
        # reset acceleration back to zero for next step
        self.acl = Vec() 
            
    """
    Steer the Bird by adding the given vector to the acceleration
    """    
    def steer(self, vec):
        # keep the acceleration to within the maximum
        vec = vec.limited(self.max_frc) 
        # add the accelation vector
        self.acl += vec
        
    """
    Reset the Bird to its initial position and values
    [noprint]
    """    
    def reset(self):
        """
        resets this bird back to his initialized condition.
        replaces existing history lists with single inital values
        """
        self.is_alive = True
        if len(self.hist_pos) > 0:
            self.pos = self.hist_pos[0]
            self.vel = self.hist_vel[0]
            self.acl = self.hist_acl[0]
        self.clear_history()
        self.record()
        
    """
    Functions to clear the history and record a step
    """    
    # clear the position, velocity and acceleration histories
    def clear_history(self):
        self.hist_pos = []
        self.hist_vel = []
        self.hist_acl = []
        
    # record this step 
    def record(self):
        # add its position, velocity and accelaration to the history
        self.hist_pos.append(self.pos)
        self.hist_vel.append(self.vel)
        self.hist_acl.append(self.acl)


a.put(Bird)
# ---------- end decodes_2 ----------

# ---- group: flocking birds
# c
# d
step_count = Slider(100, range=5..100)

# ---- group: flocking birds / create flock
bird_count = Slider(6, range=3..30)
max_vel = Slider(2, range=0..6)
max_frc = Slider(0.3, range=0..1)
rov = Slider(40, range=0.5..60)
roc = Slider(9, range=0.5..30)
decodes_3 = DecodesPythonScript(Bird=decodes.a, count=bird_count, start_pos=geo, max_frc=max_frc, max_vel=max_vel, rov=rov, roc=roc)  # -> console, a; inputs count: Int32, start_pos: list
# ---------- decodes_3: Python ----------
import math

random.seed(0)

count = len(start_pos)
flock = []
for n in range(count): 
    flock.append(Bird(pos_start = start_pos[n]))


for bird in flock: 
    bird.max_frc = max_frc
    bird.max_vel = max_vel
    bird.rov = rov
    bird.roc = roc

print flock[0].max_frc

a.put(flock)
# ---------- end decodes_3 ----------

# ---- group: goal-seeking birds
# a
# b
md_slider = MDSlider(
    slider_value=Point(0.8663377762, 0.9187507629, 0.5),
    SliderMode=0,
    x_domain=Domain(-30, 30),
    y_domain=Domain(-30, 30),
    z_domain=Domain(0, 1))
close_enough = Slider(1.25, range=0.1..3)
goal_pt = Point(md_slider)
step_count_2 = Slider(100, range=5..100)
slider = Slider(0, range=0..100)

# ---- group: goal-seeking birds / create flock
bird_count_2 = Slider(10, range=3..200)
max_vel_2 = Slider(2, range=0..6)
max_frc_2 = Slider(0.35, range=0..1)
decodes_4 = DecodesPythonScript(Bird=decodes_2.a, count=bird_count_2, max_frc=max_frc_2, max_vel=max_vel_2)  # -> console, a; inputs count: Int32
# ---------- decodes_4: Python ----------
import math


flock = []
for n in range(count): 
    flock.append(Bird(pos_start = Point(0,0)))


for bird in flock: 
    bird.reset()
    bird.max_frc = max_frc
    bird.max_vel = max_vel

a.put(flock)
# ---------- end decodes_4 ----------

# ----
cir = Circle(Plane=goal_pt, Radius=close_enough)

# ---- group: flocking birds / move flock
decodes_5 = DecodesPythonScript(
    flock=decodes_3.a,
    count=step_count,
    w_seek=Slider(1, range=0..3),
    w_align=Slider(1, range=0..3),
    w_flee=Slider(2, range=0..3))  # -> console, a, b, c, d; inputs flock: list, count: Int32
# ---------- decodes_5: Python ----------
'''
4.02.L05d
Move a flock of simple Birds using the Flocking algorithm

required:
flock ([Bird]) A group of Bird objects
count (int) The number of steps
w_align, w_seek, w_flee (float) The relative strength of the align, seek and flee behaviors 

result:
flock ([Bird]) A group of Birds with their history filled out
'''

"""
Move a group of Birds as a flock
"""
# for each time step:
for step in range(count):
    # establish a searchable "sky" 
    sky = QuadTree.encompass(pts = flock)
    # for each Bird in the flock:
    for bird in flock:
        # if this is the first step:
        if step == 0:
            # reset the Bird's history
            bird.reset()
        # find Birds within range of vision
        nears = bird.scan(sky)
        # steer Bird to align with nearby Birds
        bird.align(nears, w_align)
        # steer Bird toward nearby Birds
        bird.seek(nears, w_seek)
        # find Birds within the range of comfort
        too_nears = bird.in_range(nears, bird.roc)
        # steer Bird to flee
        bird.flee(too_nears, w_flee)
        # update Bird
        bird.step()

a.put(flock)
# ---------- end decodes_5 ----------

# ---- group: goal-seeking birds / move flock
decodes_6 = DecodesPythonScript(flock=decodes_4.a, goal_pt=goal_pt, close_enough=close_enough, count=step_count_2)  # -> console, a; inputs flock: list, count: Int32; disabled
# ---------- decodes_6: Python ----------
'''
4.02.L05b
Move a flock of simple Birds toward a goal.

required:
flock ([Bird]) A group of Bird objects
goal_pt (Point) The point that the flock will seek
close_enough (float) The distance from the goal that will cause Bird to stop
count (int) The number of steps 

result:
flock ([Bird]) A group of Birds with their history filled out
'''

"""
Move a flock of simple Birds toward a goal
"""
# for each time step:
for step in range(count):
    # for each Bird in the flock:
    for bird in flock:
        # if this is the first step:
        if step == 0:
            # reset the Bird's history
            bird.reset()
        # create a steering vector
        vec = Vec(bird.pos,goal_pt)
        # if Bird is not close to goal point:
        if vec.length > close_enough : 
            # steer bird toward goal and update
            bird.steer( vec - bird.vel )
            bird.step()

a.put(flock)
# ---------- end decodes_6 ----------

# ---- group: flocking birds / visualize flock / draw bird trails
decodes_7 = DecodesPythonScript(flock=decodes_5.a)  # -> console, a; inputs flock: list
# ---------- decodes_7: Python ----------
for bird in flock: a.put(PLine(bird.hist_pos))
# ---------- end decodes_7 ----------

# ----
step = Slider(0, range=0..100)

# ---- group: goal-seeking birds / visualize flock / draw bird trails
decodes_8 = DecodesPythonScript(flock=decodes_6.a)  # -> console, a; inputs flock: list; same code as decodes_7

# ---- group: flocking birds / visualize flock / draw birds at given step
decodes_9 = DecodesPythonScript(flock=decodes_5.a, step=step)  # -> console, a, b, c, d, e; inputs flock: list, step: Int32
# ---------- decodes_9: Python ----------
max_step = len(flock[0].hist_pos)
step = step%max_step

for bird in flock:
    pos = bird.hist_pos[-1]
    vel = bird.hist_vel[-1]
    acl = bird.hist_acl[-1]
    if step < len(bird.hist_pos):
        pos = bird.hist_pos[step]
        vel = bird.hist_vel[step]
        acl = bird.hist_acl[step]
    a.put(pos)
    b.put(vel)
    c.put(acl)
    d.put(Circle(Plane(pos,Vec(0,0,1)),bird.rov))
    e.put(Circle(Plane(pos,Vec(0,0,1)),bird.roc))
# ---------- end decodes_9 ----------

# ---- group: flocking birds / visualize flock
vdis = VectorDisplay(Anchor=decodes_9.a, Vector=decodes_9.c)
vdis_2 = VectorDisplay(Anchor=decodes_9.a, Vector=decodes_9.b)
runion = RegionUnion(Curves=decodes_9.d)
runion_2 = RegionUnion(Curves=decodes_9.e)

# ---- group: goal-seeking birds / visualize flock / draw birds at given step
decodes_10 = DecodesPythonScript(flock=decodes_6.a, step=slider)  # -> console, a, b, c; inputs flock: list, step: Int32
# ---------- decodes_10: Python ----------
print len(flock)
print len(flock[0].hist_pos)

max_step = len(flock[0].hist_pos)
step = step%max_step

print max_step

for bird in flock:
    pos = bird.hist_pos[-1]
    vel = bird.hist_vel[-1]
    acl = bird.hist_acl[-1]
    if step < len(bird.hist_pos):
        pos = bird.hist_pos[step]
        vel = bird.hist_vel[step]
        acl = bird.hist_acl[step]
    a.put(pos)
    b.put(vel)
    c.put(acl)
# ---------- end decodes_10 ----------

# ---- group: goal-seeking birds / visualize flock
vdis_3 = VectorDisplay(Anchor=decodes_10.a, Vector=decodes_10.c)
vdis_4 = VectorDisplay(Anchor=decodes_10.a, Vector=decodes_10.b)
