# Grasshopper definition ga_demo_01.gh (Grasshopper 0.9.65)
# plug-ins: Decodes Python Interpreter

number_slider = Slider(2, range=0..10)
number_slider_2 = Slider(8, range=0..30)

# ----
# a
pixel_width = Panel("2")
pixel_height = Panel("2")
pixel_height_2 = Integer(pixel_height)
panel = Panel("create starting position")
pixel_width_2 = Integer(pixel_width)

pixel_height_3 = Integer(pixel_height)
pixel_width_3 = Integer(pixel_width)
pixel_height_4 = Integer(pixel_height)
pixel_width_4 = Integer(pixel_width)
recgrid = Rectangular(Plane=PlaneXY(0, 0, 0), SizeX=number_slider, SizeY=number_slider, ExtentX=number_slider_2, ExtentY=number_slider_2)  # -> Cells, Points
trigrid = Triangular(Plane=PlaneXY(0, 0, 0), Size=1, ExtentX=pixel_width_3, ExtentY=pixel_height_3)  # -> flatten(Cells), Points
hexgrid = Hexagonal(Plane=PlaneXY(0, 0, 0), Size=1, ExtentX=pixel_width_4, ExtentY=pixel_height_4)  # -> flatten(Cells), Points
explode = Explode(Curve=recgrid.Cells, Recursive=True)  # -> flatten(Segments), Vertices

# ---- group: creates an initial condition
decodes = DecodesPythonScript(w=Slider(20, range=0..100), h=Slider(20, range=0..100))  # -> console, f_out; inputs w: Int32, h: Int32
# ---------- decodes: Python ----------
# initialize an instance of the CA object class
start_field = ValueField(Interval(w,h),include_corners = True,wrap = False)
# random.seed(0)

# for every pixel in the boolean field:
for i in range(w*h):
    start_field._pixels[i] = random.choice([True, False]) # randomly select True or False

f_out.put(start_field)
# ---------- end decodes ----------

# ----
panel_2 = Panel(hexgrid.Cells)
data = Data(flatten(explode.Vertices))

# ----
# c
# game of life
# function
decodes_2 = DecodesPythonScript()  # -> console, func
# ---------- decodes_2: Python ----------
"""
Function to plat Conway's Game of Life
"""   

def life_rules(cur_val,nei_vals):
    # initialize counter for true values in the neighborhood
    count = 0
    
    # for each cell in the neighborhood:
    for i in nei_vals:
        # if cell is True:
        if i : 
            count += 1 # count it
            
    # if home cell is True:
    if cur_val:
        # if less than 2 or more than 3 neighbors are True:
        if (count < 2) or (count >3) :
            # this cell will be False in the next generation
            return False
        # else:
        else:
            # this cell will be True in the next generation
            return True
    # else the home cell is False:
    else:
        # if exactly 3 neighbors are True:
        if (count == 3):
            # this cell will be True in the next generation
            return True
        else:
            # else this cell will be False in the next generation
            return False

func.put(life_rules)
# ---------- end decodes_2 ----------
panel_3 = Panel("maze_rules function")
decodes_3 = DecodesPythonScript()  # -> console, func
# ---------- decodes_3: Python ----------
"""
Function to create a maze out of an random boolean field based on algorithm 
published by Kostas Terzidis,"Algorithms for Visual Design", pp. 168-171
"""
def maze_rules(cur_val,nei_vals):
    # initialize the values
    nxt_val = cur_val
    count = 0 # counter for True cells in the neighborhood
    
    # for each cell in the neighborhood:
    for i in nei_vals:
        # if cell is True:
        if i : 
            count += 1 # count it
        
    # if there are 3 True cells in the neighborhood:
    if count == 3 : 
        # this cell will be True in the next generation
        nxt_val = True
    
    # if there are more than four True cells in the neighborhood:
    if count > 4: 
        # this cell eill be False in the next generation
        nxt_val = False
        
    # return the new value for the cell
    return nxt_val

func.put(maze_rules)
# ---------- end decodes_3 ----------

pixel_height_5 = Integer(pixel_height)
pixel_width_5 = Integer(pixel_width)
cluster = Cluster(B_2=pixel_width_5, B=pixel_height_5)
image = ImageSampler(
    cluster,
    FilePath="C:\Users\Ned Reifenstein\Documents\GitHub\decodes\sandbox\_nr_sandbox\studio\game_of_life_01_40x40.png",
    Filter="Colour",
    Interpolate=False,
    Umax=40,
    Umin=1,
    Vmax=40,
    Vmin=1,
    Wrap=1)
pixel_height_6 = Integer(pixel_height)
pixel_width_6 = Integer(pixel_width)
decodes_4 = DecodesPythonScript(w=pixel_width_6, h=pixel_height_6, v=image, corners=Toggle(True), wrap_edge=Toggle(False))  # -> console, f_out; inputs w: Int32, h: Int32, v: list, corners: Boolean
# ---------- decodes_4: Python ----------
# initialize an instance of the CA object class
start_field = ValueField(Interval(w,h),include_corners=corners, wrap=wrap_edge)
# random.seed(0)
print len(v)
print v
# for every pixel in the boolean field:
for i in range(w*h):
#    print v[i]
    start_field._pixels[i] = v[i] # randomly select True or False
"""
for j in range(h):
    for i in range(w):
        print i,j,start_field.get(i,j), ":::",start_field.neighbors_of(i,j)
"""

print start_field.neighbors_of(0,0)

f_out.put(start_field)
# ---------- end decodes_4 ----------

pixel_width_7 = Integer(pixel_width)
pixel_height_7 = Integer(pixel_height)
decodes_5 = DecodesPythonScript(w=pixel_width_7, h=pixel_height_7)  # -> console, f_out; inputs w: Int32, h: Int32
# ---------- decodes_5: Python ----------
black = Color(0.0,0.0,0.0)
white = Color(1.0,1.0,1.0)


# initialize an instance of the CA object class
start_field = ValueField(Interval(w,h),include_corners = True,wrap = False)
# random.seed(0)

# for every pixel in the boolean field:
for i in range(w*h):
    start_field._pixels[i] = random.choice([black, white]) # randomly select black or white

f_out.put(start_field)
# ---------- end decodes_5 ----------

cullpt = CullDuplicates(Points=data, Tolerance=0.1, CullMode=3)  # -> Points, Indices, Valence

# ---- group: Graph_CA class
# a
decodes_6 = DecodesPythonScript()  # -> console, a
# ---------- decodes_6: Python ----------
# from ..core import *
# from ..core import dc_color, dc_base, dc_vec, dc_point, dc_cs, dc_line, dc_mesh, dc_pgon, dc_xform
import copy
print "graph_cellular_automata.py loaded"
# =========================================================

'''
Create a class that implements a simple, two-state cellular automata 

members:
pixel_res (Interval) The dimensions of the rectangular boundary of the model
corners (boolean) Does the neighborhood include 4 corner cells? (true=yes)
wrap (boolean) Do the boundaries of the model wrap? (true=yes)

methods:
set_cell (None) Set a given pixel to a given value
set_cells (None) Initializes a model with a list of boolean values
get_cell (boolean) Gets value of the pixel at a given location
get_cells (BoolField) Get all the cells in the model
set_rule (None) Set the CA rule to a given function
clear (None) Initialize the boolean field and clear the history
record (None) Append the current state of the model to the history.
step (None) Creates a new generation and performs reaction-diffusion algorithm to update the model.
to_pts (points) Creates a set of points representing the state of the model at a given time
'''

"""
A type is defined that stores u and v values for each location in two value fields, records the history 
of the model as it changes, and provides methods for reading, writing and clearing values.
"""

class Graph_CA (object):

    def __init__(self,graph = None):
        if graph == None:
            # initialize empty graph
            self.graph = Graph()
            self.step_count = 0
            self.hist = []
        else:
            self.graph = graph
            self.cells = graph.values
            self.len = len(graph.values)
            self.step_count = 0
            self.hist = []
    
    def set_cell(self,i,val):
        i = i % self.len
        self.cells.set(i,val)


# sets the entire field. Expects a list of values
    def set_cells(self, initial_cell=False):
        for n,value in enumerate(initial_cell):
            self.cells[n] = value
            
# pass a function to be used for each iteration of the automata
# assumes that function takes the status of the home cell, and a list of the statuses of the neighbors
# function returns the new value for the home cell
    def set_rule(self,func=False):
        self.rule = func
            
    def get_cell(self,i): return self.cells[i]

    def get_cells(self) : return self.cells           


    """
    [noprint]
    """
    def _reframe(self,x,y): # Not used
        while x > self.width -1 : x = x - self.width
        while y > self.height -1: y = y - self.height
        while x < 0 : x = self.width + x
        while y < 0 : y = self.height + y
        return x,y
    """
    Initialize and clear.
    """
    def clear(self, initial_val = None):
        if initial_val != None:
            self.cells = self.graph.values
        else:
            self.cells = [initial_val] * self.len
        self.step_count = 0
        self.hist = []
        
    """
    Methods for recording the current state of the model and creating a new generation.
    """
    def record(self):
        self.hist.append(self.cells)

    # makes a new generation by calling the function stored in self.rule
    def step(self, t=1.0):
        nxt_cells = copy.copy(self.graph.values)
        t = max(min(1.0,t),0.0)
        for i in range(0,self.len):
            cur_cell = self.cells[i]
            neighbor_cells = [self.cells[v] for v in self.graph.neighbors_of(i)]
            nxt_cell = self.rule(cur_cell, neighbor_cells)
            nxt_cells[i] = nxt_cell
        self.cells = nxt_cells
        self.step_count += 1
        

    """
    Creates a set of points representing the state of the model at a given time.
    """
    def to_pts(self, g=0, show_color = False):        
        
        # make sure that you do not select beyond the length of the CA's history
        select = g % len(self.hist)
        
        pt_list = []

        # iterate through the cell field for the selected generation
        # if the value of the cell is true, put a point in a
        # otherwise, put a point in b
        for i in range(self.len):
            new_pt = self.graph.nodes[i]
            if show_color:
                new_pt.set_color(self.hist[select].cell[i])
            pt_list.append(new_pt)
        return pt_list


# ========================================================================
a.put(Graph_CA)
# ---------- end decodes_6 ----------

# ---- group: Graph class
# g
decodes_7 = DecodesPythonScript()  # -> console, a
# ---------- decodes_7: Python ----------
class Graph(object):
    """
    A simple undirected, weighted graph
    """
    def __init__(self):
        self.nodes = []
        self.edges = []
        self.values = []
    
    def add_node(self, node, value = 0):
        if not(node in self.nodes):
            self.nodes.append(node)
            self.values.append(value)
            self.edges.append([])
            
    def _index_of(self, node):
        if not(node in self.nodes):
            return -1
        else:
            return self.nodes.index(node)
            
    def neighbors_of(self, i = 0):
        return self.edges[i]

    def set_node(self, node, value = 0):
        self.values[node] = value

    def add_edge(self, from_node, to_node):
        if type(from_node) != int:
            i = self._index_of(from_node)
        else:
            i = from_node
        if type(to_node) != int:
            j = self._index_of(to_node)
        else:
            j = to_node
        if i == -1 or j == -1:
            return
        self._add_edge(i,j)
        self._add_edge(j,i)
 
    def _add_edge(self, from_node, to_node):
        #print "in _add_edge. called with ", from_node, to_node
        if not(to_node) in self.edges[from_node]:
            self.edges[from_node].append(to_node)
        if not(from_node) in self.edges[to_node]:
            self.edges[to_node].append(from_node)
        
    def node_to_lines(self, n):
        ret = []
        n = n % len(self.nodes)
        spt = self.nodes[n]
        for i in self.edges[n]:
            ret.append(Line(spt, self.nodes[i]))
        return ret
        
    def to_lines(self):
        ret = []
        for i in range(len(self.nodes)):
            spt = self.nodes[i]
            for j in self.edges[i]:
                if j > i:
                    ret.append(Line(spt, self.nodes[j]))
        return ret


a.put(Graph)
# ---------- end decodes_7 ----------

# ----
decodes_8 = DecodesPythonScript(Graph=decodes_7.a, shapes_in=trigrid.Cells)  # -> console, gr; inputs shapes_in: list of Polyline, val: list
# ---------- decodes_8: Python ----------
digits = 8
tol = .1**digits
print tol
# test if pt is in graph
def in_graph(pt, g):
    ret = False
    for node in g.nodes:
        if pt == node:
            pt = node
            ret = True
    return ret, pt           


g = Graph()

#print shapes[1].overlaps(shapes[0])

# adds points to graph
pts = []
pgons = []

for n, shape  in enumerate(shapes_in):
    #print shape.basis
    new_pts = []

    for pt in shape.pts:
        x1 = round(pt.x, digits)
        if abs(x1) < tol : x1 = 0.0
        y1 = round(pt.y, digits)
        if abs(y1) < tol : y1 = 0.0
        z1 = round(pt.z, digits)
        if abs(z1) < tol : z1 = 0.0
        new_pt = Point(x1,y1,z1)
        #print pt, new_pt, pt.x, pt.y, pt.z, new_pt.x, new_pt.y, new_pt.z
        new_pts.append(new_pt)

    #print "PLYGON ", n," NEW PTS:", new_pts, 
    new_pgon = PGon(new_pts, CS())
    #print ":::",new_pgon.pts,":::", new_pgon.basis, ":::"
    #print ":::",new_pgon.pts,":::", new_pgon.basis, ":::"        
    g.add_node(Point.centroid(new_pts))
    pgons.append(new_pgon)

shapes = []
shapes = pgons

for i in range(len(shapes)-1):
    for j in range(i+1,len(shapes)):
        print "=================i,j: ",i,j
        if i == 2 and j == 3:
            print shapes[i].pts, shapes[i].bounds.ival_x, shapes[i].bounds.ival_y
            print shapes[j].pts, shapes[j].bounds.ival_x, shapes[j].bounds.ival_y
            print shapes[i].pts[0],shapes[j].pts[2], shapes[i].pts[0] == shapes[j].pts[2]
            print shapes[i].pts[0].x,shapes[i].pts[0].x==shapes[j].pts[2].x
            print shapes[i].pts[0].y,shapes[j].pts[2].y, shapes[i].pts[0].y==shapes[j].pts[2].y
            print shapes[i].pts[0].z,shapes[i].pts[0].z==shapes[j].pts[2].z
            for pt in shapes[j].pts: 
                print pt, shapes[i].contains_pt(pt, tol)
            for pt in shapes[i].pts: 
                print pt, shapes[j].contains_pt(pt, tol)
            
        if shapes[i].overlaps(shapes[j], tolerance = tol):
            g.add_edge(i,j)

try:
    v = val[0]
except:
    val = [random.choice([Color(0.0),Color(1.0)]) for v in range(len(shapes))] 

for n in range(len(g.nodes)):
    g.set_node(n, val[n])

#a.put(g.to_lines())

gr.put(g)
print g
# ---------- end decodes_8 ----------
lng = ListLength(List=cullpt.Points)
decodes_9 = DecodesPythonScript(g_in=decodes_8.gr)  # -> console, a, b
# ---------- decodes_9: Python ----------
a.put(g_in.nodes)

b.put(g_in.to_lines())
# ---------- end decodes_9 ----------
decodes_10 = DecodesPythonScript(pts=cullpt.Points, d=Slider(9, range=0..10))  # -> console, a; inputs pts: list
# ---------- decodes_10: Python ----------
lines = []

for i in range(len(pts)-1):
    for j in range(i+1,len(pts)):
        v = Vec(pts[i],pts[j])
        if v.length2 < d:
            a.put(Line(pts[i], pts[j]))
# ---------- end decodes_10 ----------
random = Random(Range=Domain(0, 1), Number=lng, Seed=Slider(0, range=0..1))
geo = Geometry(decodes_9.b)
larger = LargerThan(FirstNumber=random, SecondNumber=Slider(0.7, range=0..1))  # -> LargerThan, OrEqualTo
decodes_11 = DecodesPythonScript(Graph=decodes_7.a, lines=decodes_10.a, pts=cullpt.Points, val=larger.LargerThan)  # -> console, gr; inputs lines: list of Line, pts: list, val: list
# ---------- decodes_11: Python ----------
# test if pt is in graph
def in_graph(pt, g):
    ret = False
    for node in g.nodes:
        if pt == node:
            pt = node
            ret = True
    return ret, pt           


g = Graph()

# adds points to graph
pts = []

for line in lines:
    pt1 = line.spt
    pt2 = line.ept
    test, pt1 = in_graph(pt1,g)
    if not(test):
        g.add_node(pt1)
        pts.append(pt1)
    test, pt2 = in_graph(pt2,g)
    if not(test):
        g.add_node(pt2)
        pts.append(pt2)
    g.add_edge(pt1,pt2)

print g.nodes, g.edges

for pt in pts:
    if pt in g.nodes:
        n = g.nodes.index(pt)
        print n
        g.set_node(n, val[n])
    else:
        print "We have a problem."

#a.put(g.to_lines())

gr.put(g)
print g
# ---------- end decodes_11 ----------

# ---- group: create a graph
decodes_12 = DecodesPythonScript(Graph=decodes_7.a, lines=decodes_10.a, pts=cullpt.Points, val=larger.LargerThan)  # -> console, gr; inputs lines: list of Line, pts: list, val: list; same code as decodes_11

# ----
life = DecodesPythonScript()  # -> console, a
# ---------- life: Python ----------
def func(home_val, nei_val):
    print "home value: ", home_val
    print "neighbor values: ", nei_val
    d = dict()
    d[True] = 0
    d[False] = 0
    for v in nei_val:
        if v not in d:
            d[v] = 1
        else:
            d[v] += 1
    print d
    if home_val:
        return (d[True] == 2 or d[True] == 3)
    else:
        return (d[True] == 3)


a.put(func)
# ---------- end life ----------
growth = DecodesPythonScript()  # -> console, a
# ---------- growth: Python ----------
def func(home_val, nei_val):
    print "home value: ", home_val
    print "neighbor values: ", nei_val
    
    n_true = 0
    for i in nei_val:
        if i:
            n_true += 1
    print "True = ", n_true
    
    if n_true > 0 :
        return True
    else:
        return False

a.put(func)
# ---------- end growth ----------

# ----
# b
panel_4 = Panel("20")
panel_5 = Panel("generates history")
decodes_13 = DecodesPythonScript()  # -> console, func
# ---------- decodes_13: Python ----------
# Colors are defined by Red, Green, Blue values between 0.0 and 1.0
# To convert from Photoshop RGB, divide values by 255.

black = Color(0.0,0.0,0.0)
white = Color(1.0,1.0,1.0)


"""
Function to play Conway's Game of Life
"""
def life_rules(cur_val,nei_vals):
    # initialize counter for black (filled) values in the neighborhood
    count = 0

    # for each cell in the neighborhood:
    for i in nei_vals:
        # if cell is black (filled):
        if i == black: 
            count += 1 # count it

    # if home cell is black (filled):
    if cur_val == black:
        # if less than 2 or more than 3 neighbors are black:
        if (count < 2) or (count > 3) :
            # this cell will be white (empty) in the next generation
            return white
        # else:
        else:
            # this cell will be black (filled) in the next generation
            return black
    # else the home cell is white (empty):
    else:
        # if exactly 3 neighbors are black (filled):
        if (count == 3):
            # this cell will be black (filled) in the next generation
            return black
        else:
            # else this cell will be white(empty) in the next generation
            return white

func.put(life_rules)
# ---------- end decodes_13 ----------
decodes_14 = DecodesPythonScript(func=decodes_13.func, f_in=decodes_4.f_out, max_gen=panel_4)  # -> console, ca_out, a, b; inputs max_gen: Int32; disabled
# ---------- decodes_14: Python ----------
import copy
print "color_cellular_automata.py loaded"

"""
A type is defined that stores u and v values for each location in two value fields, records the history 
of the model as it changes, and provides methods for reading, writing and clearing values.
"""

class CA (object):

    def __init__(self,field = None, pixel_res=Interval(20,20),corners=False,wrap=False):
        if field == None:
            self.corners = corners
            self.wrap = wrap
            self.width = int(pixel_res.a)
            self.height = int(pixel_res.b)
            self.clear(corners,wrap)
        else:
            self.corners = field.include_corners
            self.wrap = field.wrap
            self.width = field._res[0]
            self.height = field._res[1]
            self.cells = field
            self.step_count = 0
            self.hist = []
    
    def set_cell(self,x,y,val):
        x,y = self._reframe(x,y)
        self.cells.set(x,y,val)


# sets the entire field. Expects a list of booleans
    def set_cells(self, initial_cell=False):
        for n, bool in enumerate(initial_cell):
            self.cells._pixels[n] = bool
            
# pass a function to be used for each iteration of the automata
# assumes that function takes the status of the home cell, and a list of the statuses of the neighbors
# function returns the new value for the home cell
    def set_rule(self,func=False):
        self.rule = func
            
    def get_cell(self,x,y): return self.cells.get(x,y)

    def get_cells(self) : return self.cells           


    """
    [noprint]
    """
    def _reframe(self,x,y):
        while x > self.width -1 : x = x - self.width
        while y > self.height -1: y = y - self.height
        while x < 0 : x = self.width + x
        while y < 0 : y = self.height + y
        return x,y
    """
    Initialize a boolean field and clear the history.
    """
    def clear(self,corners,wrap):
        self.cells = ValueField(Interval(self.width,self.height),include_corners = corners, wrap = wrap)
        self.step_count = 0
        self.hist = []
        
    """
    Methods for recording the current state of the model and creating a new generation.
    """
    def record(self):
        self.hist.append(self.cells)

    # makes a new generation by calling the function stored in self.rule
    def step(self):
        #print "starting step: ", self.cells
        nxt_cells = ValueField(Interval(self.width,self.height),include_corners=self.cells.include_corners, wrap=self.cells.wrap)
        for x in range(0,self.width):
            for y in range(0,self.height):
                cur_cell = self.cells.get(x,y)
                neighbor_cells = self.cells.neighbors_of(x,y)
                #print "cell: ",x,y," calling rule with:", cur_cell," :: ", neighbor_cells
                nxt_cell = self.rule(cur_cell, neighbor_cells)
                #print "return value = ", nxt_cell
                nxt_cells.set(x,y,nxt_cell)
        self.cells = nxt_cells
        #print self.cells, nxt_cells
        self.step_count += 1
        

    """
    Creates a set of points representing the state of the model at a given time.
    """
    def to_pts(self, g=0, show_color = False):        
        
        # make sure that you do not select beyond the length of the CA's history
        select = g % len(self.hist)
        
        pt_list = []

        # iterate through the cell field for the selected generation
        # if the value of the cell is true, put a point in a
        # otherwise, put a point in b
        for j in range(self.height):
            for i in range(self.width):
                new_pt = Point(i,j)
                if show_color:
                    new_pt.set_color(self.hist[select].get(i,j))
                pt_list.append(new_pt)

        return pt_list



"""
Create a CA object, define an initial state, perform algorithm and visualize results.
"""

# initialize an instance of the CA object class
my_CA = CA(field = f_in)

# random.seed(0)

# define the CA's rule
my_CA.set_rule(func)


# for every generation to be produced:
for n in range(max_gen):
    my_CA.record() 
    my_CA.step() # update the CA model


ca_out.put(my_CA)
# ---------- end decodes_14 ----------

decodes_15 = DecodesPythonScript()  # -> console, func; same code as decodes_13

# ----
# b
slider = Slider(30, range=0..100)
decodes_16 = DecodesPythonScript(Graph_CA=decodes_6.a, func=decodes_15.func, g_in=decodes_12.gr, max_gen=slider, stepsize=Slider(1, range=1..100))  # -> console, ca_out, a, b; inputs max_gen: Int32, stepsize: Int32
# ---------- decodes_16: Python ----------
'''
4.02.L02b
Given a set of rules, the width and height of the cell field, and the number of generations, create a ca model with its time history.

in: 
func (function) A function for evaluating each cell 
w,h (integers) Width, height of boolean field 
max_gen (int) The number of generations for the algorithm to run.
stepsize (int) The number of generations to run before recording the state of the model.
select_step (int) The recorded step of the model to visualize.

out:
pts_true, pts_false (list of points) Lists representing true cells and false cells
'''

"""
Create a CA object, define an initial state, perform algorithm and visualize results.
"""

# initialize an instance of the CA object class
my_CA = Graph_CA(graph = g_in)
# random.seed(0)

# define the CA's rule
my_CA.set_rule(func)


# Create a starting position
#start_field= [] # start with empty boolean field

# for every pixel in the boolean field:
#for i in range(w*h):
#    start_field.append(random.choice([0,1,2,3])) # randomly select True or False
#my_CA.set_cells(start_field) # set field to the new boolean field

# for every generation to be produced:
for n in range(max_gen):
    # if generation should be recorded:
    if n % stepsize == 0:

        # record the state of the CA model
        my_CA.record() 
    my_CA.step() # update the CA model
    
# get True and False points from the CA model for a given generation
# points = my_CA.to_pts(select_step)

# ====================================================
# a.put(points[0])
# b.put(points[1])

print len(my_CA.hist)
print my_CA.hist

ca_out.put(my_CA)
# ---------- end decodes_16 ----------

growth_2 = DecodesPythonScript()  # -> console, a
# ---------- growth_2: Python ----------
# function will look at adjacent nodes, and build up based on the amount of building around it

max_floors = 10

def func(home_val, nei_val):
    print "home value: ", home_val
    print "neighbor values: ", nei_val
    
    # count up the value of all the adjacent nodes
    sum = 0
    for i in nei_val:
        sum += nei_val
        
    # determine whether we build up or not
    


a.put(func)
# ---------- end growth_2 ----------

# ----
# c
select = Slider(0, range=0..200)
panel_7 = Panel("visualize results")
decodes_17 = DecodesPythonScript(ca_in=decodes_14.ca_out, select_step=select)  # -> console, a, b; inputs select_step: Int32
# ---------- decodes_17: Python ----------
select_step = select_step % len(ca_in.hist)

points = ca_in.to_pts(select_step)
a.put(points)

b.put(ca_in.hist[select_step]._pixels)
# ---------- end decodes_17 ----------
division = Division(A="1", B=2)
multiplication = Multiplication(A=decodes_17.a, B="1")
box = CenterBox(Base=multiplication, X=division, Y=division, Z=0)
preview = CustomPreview(Geometry=box, Shader=decodes_17.b)

# ----
# c
select_2 = Slider(0, range=0..200)
decodes_18 = DecodesPythonScript(ca_in=decodes_16.ca_out, select_step=select_2)  # -> console, a, b; inputs select_step: Int32
# ---------- decodes_18: Python ----------
select_step = select_step % len(ca_in.hist)

points = ca_in.to_pts(select_step)
a.put(points)

b.put(ca_in.hist[select_step])
# ---------- end decodes_18 ----------
division_2 = Division(A="1", B=2)
multiplication_2 = Multiplication(A=decodes_18.a, B="1")
box_2 = CenterBox(Base=multiplication_2, X=division_2, Y=division_2, Z=0)
preview_2 = CustomPreview(Geometry=box_2, Shader=decodes_18.b)

# ==== cluster Cluster
B = ClusterInput()
B_2 = ClusterInput()
dom = ConstructDomain(DomainStart=1, DomainEnd=B)
dom_2 = ConstructDomain(DomainStart=1, DomainEnd=B_2)
range = Range(Domain=dom, Steps=dom)
range_2 = Range(Domain=dom_2, Steps=dom_2)
crossref = CrossReference(ListA=range_2, ListB=range, CrossMode=1)  # -> ListA, ListB
pt = ConstructPoint(XCoordinate=crossref.ListA, YCoordinate=crossref.ListB, ZCoordinate=0)
pt_2 = ClusterOutput(pt)
