# Grasshopper definition ga_demo_01a.gh (Grasshopper 0.9.65)
# plug-ins: Decodes Python Interpreter

number_slider = Slider(2, range=0..10)
number_slider_2 = Slider(8, range=0..30)
recgrid = Rectangular(Plane=PlaneXY(0, 0, 0), SizeX=number_slider, SizeY=number_slider, ExtentX=number_slider_2, ExtentY=number_slider_2)  # -> Cells, Points
explode = Explode(Curve=recgrid.Cells, Recursive=True)  # -> flatten(Segments), Vertices
data = Data(flatten(explode.Vertices))
cullpt = CullDuplicates(Points=data, Tolerance=0.1, CullMode=3)  # -> Points, Indices, Valence
lng = ListLength(List=cullpt.Points)
decodes = DecodesPythonScript(pts=cullpt.Points, d=Slider(9, range=0..10))  # -> console, a; inputs pts: list
# ---------- decodes: Python ----------
lines = []

for i in range(len(pts)-1):
    for j in range(i+1,len(pts)):
        v = Vec(pts[i],pts[j])
        if v.length2 < d:
            a.put(Line(pts[i], pts[j]))
# ---------- end decodes ----------

# ----
# a
pixel_height = Panel("10")
pixel_width = Panel("10")
panel = Panel("create starting position")

pixel_height_2 = Integer()
pixel_width_2 = Integer()
trigrid = Triangular(Plane=PlaneXY(0, 0, 0), Size=1, ExtentX=pixel_width_2, ExtentY=pixel_height_2)  # -> flatten(Cells), Points
pixel_height_3 = Integer(pixel_height)
pixel_width_3 = Integer(pixel_width)

# ---- group: creates an initial condition
decodes_2 = DecodesPythonScript(w=Slider(20, range=0..100), h=Slider(20, range=0..100))  # -> console, f_out; inputs w: Int32, h: Int32
# ---------- decodes_2: Python ----------
# initialize an instance of the CA object class
start_field = ValueField(Interval(w,h),include_corners = True,wrap = False)
# random.seed(0)

# for every pixel in the boolean field:
for i in range(w*h):
    start_field._pixels[i] = random.choice([True, False]) # randomly select True or False

f_out.put(start_field)
# ---------- end decodes_2 ----------

# ----
# c
# game of life
# function
decodes_3 = DecodesPythonScript()  # -> console, func
# ---------- decodes_3: Python ----------
"""
Function to plat Conway's Game of Life
"""   

def life_rules(cur_val,nei_vals):
    # initialize counter for true values in the neighborhood
    count = 0
    
    # for each cell in the neighborhood:
    for i in nei_vals:
        # if cell is True:
        if i : 
            count += 1 # count it
            
    # if home cell is True:
    if cur_val:
        # if less than 2 or more than 3 neighbors are True:
        if (count < 2) or (count >3) :
            # this cell will be False in the next generation
            return False
        # else:
        else:
            # this cell will be True in the next generation
            return True
    # else the home cell is False:
    else:
        # if exactly 3 neighbors are True:
        if (count == 3):
            # this cell will be True in the next generation
            return True
        else:
            # else this cell will be False in the next generation
            return False

func.put(life_rules)
# ---------- end decodes_3 ----------
panel_2 = Panel("maze_rules function")
decodes_4 = DecodesPythonScript()  # -> console, func
# ---------- decodes_4: Python ----------
"""
Function to create a maze out of an random boolean field based on algorithm 
published by Kostas Terzidis,"Algorithms for Visual Design", pp. 168-171
"""
def maze_rules(cur_val,nei_vals):
    # initialize the values
    nxt_val = cur_val
    count = 0 # counter for True cells in the neighborhood
    
    # for each cell in the neighborhood:
    for i in nei_vals:
        # if cell is True:
        if i : 
            count += 1 # count it
        
    # if there are 3 True cells in the neighborhood:
    if count == 3 : 
        # this cell will be True in the next generation
        nxt_val = True
    
    # if there are more than four True cells in the neighborhood:
    if count > 4: 
        # this cell eill be False in the next generation
        nxt_val = False
        
    # return the new value for the cell
    return nxt_val

func.put(maze_rules)
# ---------- end decodes_4 ----------

hexgrid = Hexagonal(Plane=PlaneXY(0, 0, 0), Size=1, ExtentX=pixel_width_3, ExtentY=pixel_height_3)  # -> flatten(Cells), Points
random = Random(Range=Domain(0, 1), Number=lng, Seed=Slider(0, range=0..1))

# ---- group: Graph_CA class
# a
decodes_5 = DecodesPythonScript()  # -> console, a
# ---------- decodes_5: Python ----------
# from ..core import *
# from ..core import dc_color, dc_base, dc_vec, dc_point, dc_cs, dc_line, dc_mesh, dc_pgon, dc_xform
import copy
print "graph_cellular_automata.py loaded"
# =========================================================

'''
Create a class that implements a simple, two-state cellular automata 

members:
pixel_res (Interval) The dimensions of the rectangular boundary of the model
corners (boolean) Does the neighborhood include 4 corner cells? (true=yes)
wrap (boolean) Do the boundaries of the model wrap? (true=yes)

methods:
set_cell (None) Set a given pixel to a given value
set_cells (None) Initializes a model with a list of boolean values
get_cell (boolean) Gets value of the pixel at a given location
get_cells (BoolField) Get all the cells in the model
set_rule (None) Set the CA rule to a given function
clear (None) Initialize the boolean field and clear the history
record (None) Append the current state of the model to the history.
step (None) Creates a new generation and performs reaction-diffusion algorithm to update the model.
to_pts (points) Creates a set of points representing the state of the model at a given time
'''

"""
A type is defined that stores u and v values for each location in two value fields, records the history 
of the model as it changes, and provides methods for reading, writing and clearing values.
"""

class Graph_CA (object):

    def __init__(self,graph = None):
        if graph == None:
            # initialize empty graph
            self.graph = Graph()
            self.step_count = 0
            self.hist = []
        else:
            self.graph = graph
            self.cells = graph.values
            self.len = len(graph.values)
            self.step_count = 0
            self.hist = []
    
    def set_cell(self,i,val):
        i = i % self.len
        self.cells.set(i,val)


# sets the entire field. Expects a list of values
    def set_cells(self, initial_cell=False):
        for n,value in enumerate(initial_cell):
            self.cells[n] = value
            
# pass a function to be used for each iteration of the automata
# assumes that function takes the status of the home cell, and a list of the statuses of the neighbors
# function returns the new value for the home cell
    def set_rule(self,func=False):
        self.rule = func
            
    def get_cell(self,i): return self.cells[i]

    def get_cells(self) : return self.cells           


    """
    [noprint]
    """
    def _reframe(self,x,y): # Not used
        while x > self.width -1 : x = x - self.width
        while y > self.height -1: y = y - self.height
        while x < 0 : x = self.width + x
        while y < 0 : y = self.height + y
        return x,y
    """
    Initialize and clear.
    """
    def clear(self, initial_val = None):
        if initial_val != None:
            self.cells = self.graph.values
        else:
            self.cells = [initial_val] * self.len
        self.step_count = 0
        self.hist = []
        
    """
    Methods for recording the current state of the model and creating a new generation.
    """
    def record(self):
        self.hist.append(self.cells)

    # makes a new generation by calling the function stored in self.rule
    def step(self, t=1.0):
        nxt_cells = copy.copy(self.graph.values)
        t = max(min(1.0,t),0.0)
        for i in range(0,self.len):
            cur_cell = self.cells[i]
            neighbor_cells = [self.cells[v] for v in self.graph.neighbors_of(i)]
            nxt_cell = self.rule(cur_cell, neighbor_cells)
            nxt_cells[i] = nxt_cell
        self.cells = nxt_cells
        self.step_count += 1
        

    """
    Creates a set of points representing the state of the model at a given time.
    """
    def to_pts(self, g=0, show_color = False):        
        
        # make sure that you do not select beyond the length of the CA's history
        select = g % len(self.hist)
        
        pt_list = []

        # iterate through the cell field for the selected generation
        # if the value of the cell is true, put a point in a
        # otherwise, put a point in b
        for i in range(self.len):
            new_pt = self.graph.nodes[i]
            if show_color:
                new_pt.set_color(self.hist[select].cell[i])
            pt_list.append(new_pt)
        return pt_list


# ========================================================================
a.put(Graph_CA)
# ---------- end decodes_5 ----------

# ---- group: Graph class
# g
decodes_6 = DecodesPythonScript()  # -> console, a
# ---------- decodes_6: Python ----------
class Graph(object):
    """
    A simple undirected, weighted graph
    """
    def __init__(self):
        self.nodes = []
        self.edges = []
        self.values = []
    
    def add_node(self, node, value = 0):
        if not(node in self.nodes):
            self.nodes.append(node)
            self.values.append(value)
            self.edges.append([])
            
    def _index_of(self, node):
        if not(node in self.nodes):
            return -1
        else:
            return self.nodes.index(node)
            
    def neighbors_of(self, i = 0):
        return self.edges[i]

    def set_node(self, node, value = 0):
        self.values[node] = value

    def add_edge(self, from_node, to_node):
        if type(from_node) != int:
            i = self._index_of(from_node)
        else:
            i = from_node
        if type(to_node) != int:
            j = self._index_of(to_node)
        else:
            j = to_node
        if i == -1 or j == -1:
            return
        self._add_edge(i,j)
        self._add_edge(j,i)
 
    def _add_edge(self, from_node, to_node):
        #print "in _add_edge. called with ", from_node, to_node
        if not(to_node) in self.edges[from_node]:
            self.edges[from_node].append(to_node)
        if not(from_node) in self.edges[to_node]:
            self.edges[to_node].append(from_node)
        
    def node_to_lines(self, n):
        ret = []
        n = n % len(self.nodes)
        spt = self.nodes[n]
        for i in self.edges[n]:
            ret.append(Line(spt, self.nodes[i]))
        return ret
        
    def to_lines(self):
        ret = []
        for i in range(len(self.nodes)):
            spt = self.nodes[i]
            for j in self.edges[i]:
                if j > i:
                    ret.append(Line(spt, self.nodes[j]))
        return ret


a.put(Graph)
# ---------- end decodes_6 ----------

# ----
larger = LargerThan(FirstNumber=random, SecondNumber=Slider(0.7, range=0..1))  # -> LargerThan, OrEqualTo
decodes_7 = DecodesPythonScript(Graph=decodes_6.a, lines=decodes.a, pts=cullpt.Points, val=larger.LargerThan)  # -> console, gr; inputs lines: list of Line, pts: list, val: list
# ---------- decodes_7: Python ----------
# test if pt is in graph
def in_graph(pt, g):
    ret = False
    for node in g.nodes:
        if pt == node:
            pt = node
            ret = True
    return ret, pt           


g = Graph()

# adds points to graph
pts = []

for line in lines:
    pt1 = line.spt
    pt2 = line.ept
    test, pt1 = in_graph(pt1,g)
    if not(test):
        g.add_node(pt1)
        pts.append(pt1)
    test, pt2 = in_graph(pt2,g)
    if not(test):
        g.add_node(pt2)
        pts.append(pt2)
    g.add_edge(pt1,pt2)

print g.nodes, g.edges

for pt in pts:
    if pt in g.nodes:
        n = g.nodes.index(pt)
        print n
        g.set_node(n, val[n])
    else:
        print "We have a problem."

#a.put(g.to_lines())

gr.put(g)
print g
# ---------- end decodes_7 ----------

# ---- group: create a graph
decodes_8 = DecodesPythonScript(Graph=decodes_6.a, lines=decodes.a, pts=cullpt.Points, val=larger.LargerThan)  # -> console, gr; inputs lines: list of Line, pts: list, val: list; same code as decodes_7

# ----
decodes_9 = DecodesPythonScript(shapes_in=hexgrid.Cells)  # -> console, gr; inputs shapes_in: list of Polyline, val: list
# ---------- decodes_9: Python ----------
class Graph(object):
    """
    A simple undirected, weighted graph
    """
    def __init__(self):
        self.nodes = []
        self.edges = []
        self.values = []
    
    def add_node(self, node, value = 0):
        if not(node in self.nodes):
            self.nodes.append(node)
            self.values.append(value)
            self.edges.append([])
            
    def _index_of(self, node):
        if not(node in self.nodes):
            return -1
        else:
            return self.nodes.index(node)
            
    def neighbors_of(self, i = 0):
        return self.edges[i]

    def set_node(self, node, value = 0):
        self.values[node] = value

    def add_edge(self, from_node, to_node):
        if type(from_node) != int:
            i = self._index_of(from_node)
        else:
            i = from_node
        if type(to_node) != int:
            j = self._index_of(to_node)
        else:
            j = to_node
        if i == -1 or j == -1:
            return
        self._add_edge(i,j)
        self._add_edge(j,i)
 
    def _add_edge(self, from_node, to_node):
        #print "in _add_edge. called with ", from_node, to_node
        if not(to_node) in self.edges[from_node]:
            self.edges[from_node].append(to_node)
        if not(from_node) in self.edges[to_node]:
            self.edges[to_node].append(from_node)
        
    def node_to_lines(self, n):
        ret = []
        n = n % len(self.nodes)
        spt = self.nodes[n]
        for i in self.edges[n]:
            ret.append(Line(spt, self.nodes[i]))
        return ret
        
    def to_lines(self):
        ret = []
        for i in range(len(self.nodes)):
            spt = self.nodes[i]
            for j in self.edges[i]:
                if j > i:
                    ret.append(Line(spt, self.nodes[j]))
        return ret



#===============================

digits = 8
tol = .1**digits
print tol

# test if pt is in graph
def in_graph(pt, g):
    ret = False
    for node in g.nodes:
        if pt == node:
            pt = node
            ret = True
    return ret, pt           


g = Graph()


# adds points to graph
pts = []
pgons = []

for n, shape  in enumerate(shapes_in):
    new_pts = []
    for pt in shape.pts:
        x1 = round(pt.x, digits)
        if abs(x1) < tol : x1 = 0.0
        y1 = round(pt.y, digits)
        if abs(y1) < tol : y1 = 0.0
        z1 = round(pt.z, digits)
        if abs(z1) < tol : z1 = 0.0
        new_pt = Point(x1,y1,z1)
        #print pt, new_pt, pt.x, pt.y, pt.z, new_pt.x, new_pt.y, new_pt.z
        new_pts.append(new_pt)
    new_pgon = PGon(new_pts, CS())     
    g.add_node(Point.centroid(new_pts))
    pgons.append(new_pgon)

shapes = []
shapes = pgons

for i in range(len(shapes)-1):
    for j in range(i+1,len(shapes)):
        if shapes[i].overlaps(shapes[j]):
            g.add_edge(i,j)

try:
    v = val[0]
except:
    val = [random.choice([Color(0.0),Color(1.0)]) for v in range(len(shapes))] 

for n in range(len(g.nodes)):
    g.set_node(n, val[n])

#a.put(g.to_lines())

gr.put(g)
print g
# ---------- end decodes_9 ----------
fpatch = FragmentPatch(Boundary=hexgrid.Cells)
geo = Geometry(fpatch)
decodes_10 = DecodesPythonScript(g_in=decodes_9.gr)  # -> console, a, b, c
# ---------- decodes_10: Python ----------
a.put(g_in.nodes)

b.put(g_in.to_lines())

c.put(g_in.values)
# ---------- end decodes_10 ----------
geo_2 = Geometry(decodes_10.b)

life = DecodesPythonScript()  # -> console, a
# ---------- life: Python ----------
def func(home_val, nei_val):
    print "home value: ", home_val
    print "neighbor values: ", nei_val
    d = dict()
    d[True] = 0
    d[False] = 0
    for v in nei_val:
        if v not in d:
            d[v] = 1
        else:
            d[v] += 1
    print d
    if home_val:
        return (d[True] == 2 or d[True] == 3)
    else:
        return (d[True] == 3)


a.put(func)
# ---------- end life ----------
growth = DecodesPythonScript()  # -> console, a
# ---------- growth: Python ----------
def func(home_val, nei_val):
    print "home value: ", home_val
    print "neighbor values: ", nei_val
    
    n_true = 0
    for i in nei_val:
        if i:
            n_true += 1
    print "True = ", n_true
    
    if n_true > 0 :
        return True
    else:
        return False

a.put(func)
# ---------- end growth ----------

# ----
# b
panel_3 = Panel("20")
panel_4 = Panel("generates history")
decodes_11 = DecodesPythonScript()  # -> console, func
# ---------- decodes_11: Python ----------
# Colors are defined by Red, Green, Blue values between 0.0 and 1.0
# To convert from Photoshop RGB, divide values by 255.

black = Color(0.0,0.0,0.0)
white = Color(1.0,1.0,1.0)


"""
Function to play Conway's Game of Life
"""
def life_rules(cur_val,nei_vals):
    # initialize counter for black (filled) values in the neighborhood
    count = 0

    # for each cell in the neighborhood:
    for i in nei_vals:
        # if cell is black (filled):
        if i == black: 
            count += 1 # count it

    # if home cell is black (filled):
    if cur_val == black:
        # if less than 2 or more than 3 neighbors are black:
        if (count < 2) or (count > 3) :
            # this cell will be white (empty) in the next generation
            return white
        # else:
        else:
            # this cell will be black (filled) in the next generation
            return black
    # else the home cell is white (empty):
    else:
        # if exactly 3 neighbors are black (filled):
        if (count == 3):
            # this cell will be black (filled) in the next generation
            return black
        else:
            # else this cell will be white(empty) in the next generation
            return white

func.put(life_rules)
# ---------- end decodes_11 ----------
decodes_12 = DecodesPythonScript(func=decodes_11.func, g_in=decodes_9.gr, max_gen=panel_3)  # -> console, ca_out, a, b; inputs max_gen: Int32
# ---------- decodes_12: Python ----------
"""
A type is defined that stores u and v values for each location in two value fields, records the history 
of the model as it changes, and provides methods for reading, writing and clearing values.
"""

class Graph_CA (object):

    def __init__(self,graph = None):
        if graph == None:
            # initialize empty graph
            self.graph = Graph()
            self.step_count = 0
            self.hist = []
        else:
            self.graph = graph
            self.cells = graph.values
            self.len = len(graph.values)
            self.step_count = 0
            self.hist = []
    
    def set_cell(self,i,val):
        i = i % self.len
        self.cells.set(i,val)


# sets the entire field. Expects a list of values
    def set_cells(self, initial_cell=False):
        for n,value in enumerate(initial_cell):
            self.cells[n] = value
            
# pass a function to be used for each iteration of the automata
# assumes that function takes the status of the home cell, and a list of the statuses of the neighbors
# function returns the new value for the home cell
    def set_rule(self,func=False):
        self.rule = func
            
    def get_cell(self,i): return self.cells[i]

    def get_cells(self) : return self.cells           


    """
    [noprint]
    """
    def _reframe(self,x,y): # Not used
        while x > self.width -1 : x = x - self.width
        while y > self.height -1: y = y - self.height
        while x < 0 : x = self.width + x
        while y < 0 : y = self.height + y
        return x,y
    """
    Initialize and clear.
    """
    def clear(self, initial_val = None):
        if initial_val != None:
            self.cells = self.graph.values
        else:
            self.cells = [initial_val] * self.len
        self.step_count = 0
        self.hist = []
        
    """
    Methods for recording the current state of the model and creating a new generation.
    """
    def record(self):
        self.hist.append(self.cells)

    # makes a new generation by calling the function stored in self.rule
    def step(self, t=1.0):
        nxt_cells = copy.copy(self.graph.values)
        t = max(min(1.0,t),0.0)
        for i in range(0,self.len):
            cur_cell = self.cells[i]
            neighbor_cells = [self.cells[v] for v in self.graph.neighbors_of(i)]
            nxt_cell = self.rule(cur_cell, neighbor_cells)
            nxt_cells[i] = nxt_cell
        self.cells = nxt_cells
        self.step_count += 1
        

    """
    Creates a set of points representing the state of the model at a given time.
    """
    def to_pts(self, g=0, show_color = False):        
        
        # make sure that you do not select beyond the length of the CA's history
        select = g % len(self.hist)
        
        pt_list = []

        # iterate through the cell field for the selected generation
        # if the value of the cell is true, put a point in a
        # otherwise, put a point in b
        for i in range(self.len):
            new_pt = self.graph.nodes[i]
            if show_color:
                new_pt.set_color(self.hist[select].cell[i])
            pt_list.append(new_pt)
        return pt_list


"""
Create a CA object, define an initial state, perform algorithm and visualize results.
"""

# initialize an instance of the CA object class
my_CA = Graph_CA(graph = g_in)
# random.seed(0)

# define the CA's rule
my_CA.set_rule(func)


# for every generation to be produced:
for n in range(max_gen):
    # record the state of the CA model
    my_CA.record() 
    my_CA.step() # update the CA model
    

# ====================================================


ca_out.put(my_CA)
# ---------- end decodes_12 ----------

growth_2 = DecodesPythonScript()  # -> console, a
# ---------- growth_2: Python ----------
# function will look at adjacent nodes, and build up based on the amount of building around it

max_floors = 10

def func(home_val, nei_val):
    print "home value: ", home_val
    print "neighbor values: ", nei_val
    
    # count up the value of all the adjacent nodes
    sum = 0
    for i in nei_val:
        sum += nei_val
        
    # determine whether we build up or not
    


a.put(func)
# ---------- end growth_2 ----------
decodes_13 = DecodesPythonScript()  # -> console, func; same code as decodes_11

# ----
# b
slider = Slider(30, range=0..100)
slider_2 = Slider(1, range=1..100)
decodes_14 = DecodesPythonScript(func=decodes_13.func, max_gen=slider)  # -> console, ca_out, a, b; inputs max_gen: Int32; same code as decodes_12

geo_3 = Geometry(geo)

# ----
# c
select = Slider(0, range=0..200)
panel_6 = Panel("visualize results")
decodes_15 = DecodesPythonScript(ca_in=decodes_12.ca_out, select_step=select)  # -> console, a, b; inputs select_step: Int32
# ---------- decodes_15: Python ----------
select_step = select_step % len(ca_in.hist)

points = ca_in.to_pts(select_step)
a.put(points)

b.put(ca_in.hist[select_step])
# ---------- end decodes_15 ----------
preview = CustomPreview(Geometry=geo_3, Shader=decodes_15.b)

panel_7 = Panel("1")
