# Grasshopper definition ga_demo_02_mod.gh (Grasshopper 0.9.72)
# plug-ins: Decodes Python Interpreter

box_height = Panel("50")
box_width = Panel("50")
rectangle = Rectangle(Plane=PlaneXY(0, 0, 0), XSize=box_width, YSize=box_height, Radius=0)  # -> Rectangle, Length
boxrec = BoxRectangle(Rectangle=rectangle.Rectangle, Height=box_height)
number_slider = Slider(3, range=0..10)  # disabled
geo = Geometry(rectangle.Rectangle)

# ----
# a
num_points = Panel("20")
panel = Panel("create starting position")
pop2d = Populate2D(Region=geo, Count=num_points, Seed=1)

pop3d = Populate3D(Region=boxrec, Count=num_points, Seed=1)
number_slider_2 = Slider(10, range=0..10)  # disabled
voronoi³ = Voronoi3D(Points=pop3d, Box=boxrec)  # -> Cells, Boundary
voronoi = Voronoi(Points=pop2d, Boundary=geo, BruteForceOverride=False)
recgrid = Rectangular(Plane=PlaneXY(0, 0, 0), SizeX=number_slider_2, SizeY=number_slider_2, ExtentX=number_slider, ExtentY=number_slider)  # -> Cells, flatten(Points); disabled

# ---- group: turn pts into lines
decodes = DecodesPythonScript(pts=pop3d, dist=Slider(30, range=0..100))  # -> console, a; inputs pts: list of Point3d
# ---------- decodes: Python ----------
for i in range(len(pts) - 1):
    for j in range(i+1, len(pts)):
        print i,j
        if Vec(pts[i], pts[j]).length < dist:
            a.put(Line(pts[i],pts[j]))
# ---------- end decodes ----------

# ----
decodes_2 = DecodesPythonScript(shapes_in=decodes.a)  # -> console, gr; inputs shapes_in: list of Polyline, val: list
# ---------- decodes_2: Python ----------
class Graph(object):
    """
    A simple undirected, weighted graph
    """
    def __init__(self):
        self.nodes = []
        self.edges = []
        self.values = []
    
    def add_node(self, node, value = 0):
        if not(node in self.nodes):
            self.nodes.append(node)
            self.values.append(value)
            self.edges.append([])
            
    def _index_of(self, node):
        if not(node in self.nodes):
            return -1
        else:
            return self.nodes.index(node)
            
    def neighbors_of(self, i = 0):
        return self.edges[i]

    def set_node(self, node, value = 0):
        self.values[node] = value

    def add_edge(self, from_node, to_node):
        if type(from_node) != int:
            i = self._index_of(from_node)
        else:
            i = from_node
        if type(to_node) != int:
            j = self._index_of(to_node)
        else:
            j = to_node
        if i == -1 or j == -1:
            return
        self._add_edge(i,j)
        self._add_edge(j,i)
 
    def _add_edge(self, from_node, to_node):
        #print "in _add_edge. called with ", from_node, to_node
        if not(to_node) in self.edges[from_node]:
            self.edges[from_node].append(to_node)
        if not(from_node) in self.edges[to_node]:
            self.edges[to_node].append(from_node)
        
    def node_to_lines(self, n):
        ret = []
        n = n % len(self.nodes)
        spt = self.nodes[n]
        for i in self.edges[n]:
            ret.append(Line(spt, self.nodes[i]))
        return ret
        
    def to_lines(self):
        ret = []
        for i in range(len(self.nodes)):
            spt = self.nodes[i]
            for j in self.edges[i]:
                if j > i:
                    ret.append(Line(spt, self.nodes[j]))
        return ret



#===============================

digits = 8
tol = .1**digits
print tol

# test if pt is in graph
def in_graph(pt, g):
    ret = False
    for node in g.nodes:
        if pt == node:
            pt = node
            ret = True
    return ret, pt           


g = Graph()


# adds points to graph
pts = []
pgons = []

for n, shape  in enumerate(shapes_in):
    new_pts = []
    for pt in shape.pts:
        x1 = round(pt.x, digits)
        if abs(x1) < tol : x1 = 0.0
        y1 = round(pt.y, digits)
        if abs(y1) < tol : y1 = 0.0
        z1 = round(pt.z, digits)
        if abs(z1) < tol : z1 = 0.0
        new_pt = Point(x1,y1,z1)
        #print pt, new_pt, pt.x, pt.y, pt.z, new_pt.x, new_pt.y, new_pt.z
        new_pts.append(new_pt)
    new_pgon = PGon(new_pts, CS())     
    g.add_node(Point.centroid(new_pts))
    pgons.append(new_pgon)

shapes = []
shapes = pgons

for i in range(len(shapes)-1):
    for j in range(i+1,len(shapes)):
        if shapes[i].overlaps(shapes[j]):
            g.add_edge(i,j)

try:
    v = val[0]
except:
    val = [random.choice([Color(0.0),Color(1.0)]) for v in range(len(shapes))] 

for n in range(len(g.nodes)):
    g.set_node(n, val[n])

#a.put(g.to_lines())

gr.put(g)
print g
# ---------- end decodes_2 ----------
fpatch = FragmentPatch(Boundary=voronoi)
decodes_3 = DecodesPythonScript(g_in=decodes_2.gr)  # -> console, a, b, c
# ---------- decodes_3: Python ----------
a.put(g_in.nodes)

b.put(g_in.to_lines())

c.put(g_in.values)
# ---------- end decodes_3 ----------
geo_2 = Geometry(fpatch)
geo_3 = Geometry(decodes_3.b)

# ----
# b
panel_2 = Panel("20")
panel_3 = Panel("generates history")
decodes_4 = DecodesPythonScript()  # -> console, func
# ---------- decodes_4: Python ----------
# Colors are defined by Red, Green, Blue values between 0.0 and 1.0
# To convert from Photoshop RGB, divide values by 255.

black = Color(0.0,0.0,0.0)
white = Color(1.0,1.0,1.0)


"""
Function to play Conway's Game of Life
"""
def life_rules(cur_val,nei_vals):
    # initialize counter for black (filled) values in the neighborhood
    count = 0

    # for each cell in the neighborhood:
    for i in nei_vals:
        # if cell is black (filled):
        if i == black: 
            count += 1 # count it

    # if home cell is black (filled):
    if cur_val == black:
        # if less than 2 or more than 3 neighbors are black:
        if (count < 2) or (count > 3) :
            # this cell will be white (empty) in the next generation
            return white
        # else:
        else:
            # this cell will be black (filled) in the next generation
            return black
    # else the home cell is white (empty):
    else:
        # if exactly 3 neighbors are black (filled):
        if (count == 3):
            # this cell will be black (filled) in the next generation
            return black
        else:
            # else this cell will be white(empty) in the next generation
            return white

func.put(life_rules)
# ---------- end decodes_4 ----------
decodes_5 = DecodesPythonScript(func=decodes_4.func, g_in=decodes_2.gr, max_gen=panel_2)  # -> console, ca_out, a, b; inputs max_gen: Int32
# ---------- decodes_5: Python ----------
"""
A type is defined that stores u and v values for each location in two value fields, records the history 
of the model as it changes, and provides methods for reading, writing and clearing values.
"""

class Graph_CA (object):

    def __init__(self,graph = None):
        if graph == None:
            # initialize empty graph
            self.graph = Graph()
            self.step_count = 0
            self.hist = []
        else:
            self.graph = graph
            self.cells = graph.values
            self.len = len(graph.values)
            self.step_count = 0
            self.hist = []
    
    def set_cell(self,i,val):
        i = i % self.len
        self.cells.set(i,val)


# sets the entire field. Expects a list of values
    def set_cells(self, initial_cell=False):
        for n,value in enumerate(initial_cell):
            self.cells[n] = value
            
# pass a function to be used for each iteration of the automata
# assumes that function takes the status of the home cell, and a list of the statuses of the neighbors
# function returns the new value for the home cell
    def set_rule(self,func=False):
        self.rule = func
            
    def get_cell(self,i): return self.cells[i]

    def get_cells(self) : return self.cells           


    """
    [noprint]
    """
    def _reframe(self,x,y): # Not used
        while x > self.width -1 : x = x - self.width
        while y > self.height -1: y = y - self.height
        while x < 0 : x = self.width + x
        while y < 0 : y = self.height + y
        return x,y
    """
    Initialize and clear.
    """
    def clear(self, initial_val = None):
        if initial_val != None:
            self.cells = self.graph.values
        else:
            self.cells = [initial_val] * self.len
        self.step_count = 0
        self.hist = []
        
    """
    Methods for recording the current state of the model and creating a new generation.
    """
    def record(self):
        self.hist.append(self.cells)

    # makes a new generation by calling the function stored in self.rule
    def step(self, t=1.0):
        nxt_cells = copy.copy(self.graph.values)
        t = max(min(1.0,t),0.0)
        for i in range(0,self.len):
            cur_cell = self.cells[i]
            neighbor_cells = [self.cells[v] for v in self.graph.neighbors_of(i)]
            nxt_cell = self.rule(cur_cell, neighbor_cells)
            nxt_cells[i] = nxt_cell
        self.cells = nxt_cells
        self.step_count += 1
        

    """
    Creates a set of points representing the state of the model at a given time.
    """
    def to_pts(self, g=0, show_color = False):        
        
        # make sure that you do not select beyond the length of the CA's history
        select = g % len(self.hist)
        
        pt_list = []

        # iterate through the cell field for the selected generation
        # if the value of the cell is true, put a point in a
        # otherwise, put a point in b
        for i in range(self.len):
            new_pt = self.graph.nodes[i]
            if show_color:
                new_pt.set_color(self.hist[select].cell[i])
            pt_list.append(new_pt)
        return pt_list


"""
Create a CA object, define an initial state, perform algorithm and visualize results.
"""

# initialize an instance of the CA object class
my_CA = Graph_CA(graph = g_in)
# random.seed(0)

# define the CA's rule
my_CA.set_rule(func)


# for every generation to be produced:
for n in range(max_gen):
    # record the state of the CA model
    my_CA.record() 
    my_CA.step() # update the CA model
    

# ====================================================


ca_out.put(my_CA)
# ---------- end decodes_5 ----------

geo_4 = Geometry(geo_2)

# ----
# c
select = Slider(0, range=0..200)
panel_4 = Panel("visualize results")
decodes_6 = DecodesPythonScript(ca_in=decodes_5.ca_out, select_step=select)  # -> console, a, b; inputs select_step: Int32
# ---------- decodes_6: Python ----------
select_step = select_step % len(ca_in.hist)

points = ca_in.to_pts(select_step)
a.put(points)

b.put(ca_in.hist[select_step])
# ---------- end decodes_6 ----------
preview = CustomPreview(Geometry=geo_4, Shader=decodes_6.b)
