# Grasshopper definition ga_demo_05.gh (Grasshopper 0.9.65)
# plug-ins: Decodes Python Interpreter

colour = ColourPicker(PickedColour=RGB(200, 200, 200))
colour_2 = ColourPicker(PickedColour=RGB(51, 49, 13))
colour_3 = ColourPicker(PickedColour=RGB(97, 207, 0))
decodes = DecodesPythonScript(col_in=[colour, colour_2, colour_3])  # -> console, a; inputs col_in: list of Color
# ---------- decodes: Python ----------
for n, c in enumerate(col_in):
    print n,c
    
a.put(col_in)
# ---------- end decodes ----------
colors = Data(decodes.a)

# ----
# a
geo = Geometry([<curve referenced from the Rhino model> x283])
panel = Panel("create starting position")
decodes_2 = DecodesPythonScript(lin_in=geo)  # -> console, a; inputs lin_in: list of Line
# ---------- decodes_2: Python ----------
a.put(lin_in)
# ---------- end decodes_2 ----------

panel_2 = Panel(decodes.console)
colors_2 = Data(colors)
geo_2 = Geometry(<curve referenced from the Rhino model>)
decodes_3 = DecodesPythonScript()  # -> console, func
# ---------- decodes_3: Python ----------
"""
Color CA Rules
"""

empty_clr = Color(1.0,1.0,1.0)

def blend_rules(home_clr,neighbor_clrs):
    # set up the new color for home cell
    new_clr = home_clr
    # average your non-empty neighbors
    color_list = [clr for clr in neighbor_clrs if not clr==empty_clr]

    new_clr = Color.average(color_list)

    return new_clr

func.put(blend_rules)
# ---------- end decodes_3 ----------
colors_3 = Data(colors)

decodes_4 = DecodesPythonScript(shapes_in=decodes_2.a, cols=colors_2)  # -> console, gr, sh, vt; inputs shapes_in: list, val: list, cols: list of Color
# ---------- decodes_4: Python ----------
class Graph(object):
    """
    A simple undirected, weighted graph
    """
    def __init__(self):
        self.nodes = []
        self.edges = []
        self.values = []
    
    def add_node(self, node, value = 0):
        if not(node in self.nodes):
            self.nodes.append(node)
            self.values.append(value)
            self.edges.append([])
            
    def _index_of(self, node):
        if not(node in self.nodes):
            return -1
        else:
            return self.nodes.index(node)
            
    def neighbors_of(self, i = 0):
        return self.edges[i]

    def set_node(self, node, value = 0):
        self.values[node] = value

    def add_edge(self, from_node, to_node):
        if type(from_node) != int:
            i = self._index_of(from_node)
        else:
            i = from_node
        if type(to_node) != int:
            j = self._index_of(to_node)
        else:
            j = to_node
        if i == -1 or j == -1:
            return
        self._add_edge(i,j)
        self._add_edge(j,i)
 
    def _add_edge(self, from_node, to_node):
        #print "in _add_edge. called with ", from_node, to_node
        if not(to_node) in self.edges[from_node]:
            self.edges[from_node].append(to_node)
        if not(from_node) in self.edges[to_node]:
            self.edges[to_node].append(from_node)
        
    def node_to_lines(self, n):
        ret = []
        n = n % len(self.nodes)
        spt = self.nodes[n]
        for i in self.edges[n]:
            ret.append(Line(spt, self.nodes[i]))
        return ret
        
    def to_lines(self):
        ret = []
        for i in range(len(self.nodes)):
            spt = self.nodes[i]
            for j in self.edges[i]:
                if j > i:
                    ret.append(Line(spt, self.nodes[j]))
        return ret

#===============================

digits = 8
tol = .1**digits
print tol

random.seed(0)

# test if pt is in graph
def in_graph(pt, g):
    ret = False
    for node in g.nodes:
        if pt == node:
            pt = node
            ret = True
    return ret, pt           


g = Graph()
try:
    print shapes_in[0].spt
    print "Lines!"
    for line in shapes_in:
        pt1 = line.spt
        pt2 = line.ept
        test, pt1 = in_graph(pt1,g)
        if not(test):
            g.add_node(pt1)
            pts.append(pt1)
        test, pt2 = in_graph(pt2,g)
        if not(test):
            g.add_node(pt2)
            pts.append(pt2)
        g.add_edge(pt1,pt2)
    shapes = [PGon.rectangle(pt,1.0,1.0) for pt in g.nodes]

    print "done."
    
except:
    # adds points to graph
    pts = []
    pgons = []
    
    for n, shape  in enumerate(shapes_in):
        new_pts = []
        for pt in shape.pts:
            x1 = round(pt.x, digits)
            if abs(x1) < tol : x1 = 0.0
            y1 = round(pt.y, digits)
            if abs(y1) < tol : y1 = 0.0
            z1 = round(pt.z, digits)
            if abs(z1) < tol : z1 = 0.0
            new_pt = Point(x1,y1,z1)
            #print pt, new_pt, pt.x, pt.y, pt.z, new_pt.x, new_pt.y, new_pt.z
            new_pts.append(new_pt)
        new_pgon = PGon(new_pts, CS())     
        g.add_node(Point.centroid(new_pts))
        pgons.append(new_pgon)
    
    shapes = []
    shapes = pgons
    
    for i in range(len(shapes)-1):
        for j in range(i+1,len(shapes)):
            if shapes[i].overlaps(shapes[j]):
                g.add_edge(i,j)
"""              
else:
    print "Can't create graph!"
"""
try:
    v = val[0]
except:
    val = [random.choice(cols) for v in range(len(g.nodes))] 

for n in range(len(g.nodes)):
    g.set_node(n, val[n])

#a.put(g.to_lines())

gr.put(g)

sh.put(shapes)

vt.put(g.nodes)
# ---------- end decodes_4 ----------
decodes_5 = DecodesPythonScript(g_in=decodes_4.gr)  # -> console, a, b, c
# ---------- decodes_5: Python ----------
a.put(g_in.nodes)

b.put(g_in.to_lines())

c.put(g_in.values)
# ---------- end decodes_5 ----------
geo_3 = Geometry(decodes_5.b)

cullpt = CullDuplicates(Points=decodes_4.vt, Tolerance=0.1, CullMode=3)  # -> Points, Indices, Valence
voronoi = Voronoi(Points=cullpt.Points, Boundary=geo_2, BruteForceOverride=False)
fpatch = FragmentPatch(Boundary=voronoi)

geo_4 = Geometry(fpatch)

# ----
# b
panel_3 = Panel("15")
panel_4 = Panel("generates history")
decodes_6 = DecodesPythonScript(colors=colors_3)  # -> console, func; inputs colors: list of Color
# ---------- decodes_6: Python ----------
# Colors passed to function as a list
#   color_states = [ c1 , c2 , c3 , c4 , etc ]
# Refer to each color by index


"""
A Color CA
"""
def color_rules(cur_col,nei_colors):
    # initialize counters for each color
    count = [0] * len(colors)
    for c in nei_colors:
        for n in range(len(colors)):
            if c == colors[n]: 
                count[n] += 1
    # if home cell is 0
    if count[1] > count[0]:
        cur_col = colors[1]
    elif count[0] > count[1]:
        cur_col = colors[0]
    else:
        cur_col = colors[2]
    
    return cur_col
    
func.put(color_rules)
# ---------- end decodes_6 ----------
decodes_7 = DecodesPythonScript(func=decodes_3.func, g_in=decodes_4.gr, max_gen=panel_3)  # -> console, ca_out, a, b; inputs max_gen: Int32
# ---------- decodes_7: Python ----------
"""
A type is defined that stores u and v values for each location in two value fields, records the history 
of the model as it changes, and provides methods for reading, writing and clearing values.
"""

class Graph_CA (object):

    def __init__(self,graph = None):
        if graph == None:
            # initialize empty graph
            self.graph = Graph()
            self.step_count = 0
            self.hist = []
        else:
            self.graph = graph
            self.cells = graph.values
            self.len = len(graph.values)
            self.step_count = 0
            self.hist = []
    
    def set_cell(self,i,val):
        i = i % self.len
        self.cells.set(i,val)


# sets the entire field. Expects a list of values
    def set_cells(self, initial_cell=False):
        for n,value in enumerate(initial_cell):
            self.cells[n] = value
            
# pass a function to be used for each iteration of the automata
# assumes that function takes the status of the home cell, and a list of the statuses of the neighbors
# function returns the new value for the home cell
    def set_rule(self,func=False):
        self.rule = func
            
    def get_cell(self,i): return self.cells[i]

    def get_cells(self) : return self.cells           


    """
    [noprint]
    """
    def _reframe(self,x,y): # Not used
        while x > self.width -1 : x = x - self.width
        while y > self.height -1: y = y - self.height
        while x < 0 : x = self.width + x
        while y < 0 : y = self.height + y
        return x,y
    """
    Initialize and clear.
    """
    def clear(self, initial_val = None):
        if initial_val != None:
            self.cells = self.graph.values
        else:
            self.cells = [initial_val] * self.len
        self.step_count = 0
        self.hist = []
        
    """
    Methods for recording the current state of the model and creating a new generation.
    """
    def record(self):
        self.hist.append(self.cells)

    # makes a new generation by calling the function stored in self.rule
    def step(self, t=1.0):
        nxt_cells = copy.copy(self.graph.values)
        t = max(min(1.0,t),0.0)
        for i in range(0,self.len):
            cur_cell = self.cells[i]
            neighbor_cells = [self.cells[v] for v in self.graph.neighbors_of(i)]
            nxt_cell = self.rule(cur_cell, neighbor_cells)
            nxt_cells[i] = nxt_cell
        self.cells = nxt_cells
        self.step_count += 1
        

    """
    Creates a set of points representing the state of the model at a given time.
    """
    def to_pts(self, g=0, show_color = False):        
        
        # make sure that you do not select beyond the length of the CA's history
        select = g % len(self.hist)
        
        pt_list = []

        # iterate through the cell field for the selected generation
        # if the value of the cell is true, put a point in a
        # otherwise, put a point in b
        for i in range(self.len):
            new_pt = self.graph.nodes[i]
            if show_color:
                new_pt.set_color(self.hist[select].cell[i])
            pt_list.append(new_pt)
        return pt_list


"""
Create a CA object, define an initial state, perform algorithm and visualize results.
"""

# initialize an instance of the CA object class
my_CA = Graph_CA(graph = g_in)
# random.seed(0)

# define the CA's rule
my_CA.set_rule(func)


# for every generation to be produced:
for n in range(max_gen):
    # record the state of the CA model
    my_CA.record() 
    my_CA.step() # update the CA model
    

# ====================================================


ca_out.put(my_CA)
# ---------- end decodes_7 ----------

geo_5 = Geometry(geo_4)

# ----
# c
select = Slider(0, range=0..200)
panel_5 = Panel("visualize results")
decodes_8 = DecodesPythonScript(ca_in=decodes_7.ca_out, select_step=select)  # -> console, a, b; inputs select_step: Int32
# ---------- decodes_8: Python ----------
select_step = select_step % len(ca_in.hist)

points = ca_in.to_pts(select_step)
a.put(points)

b.put(ca_in.hist[select_step])
# ---------- end decodes_8 ----------
preview = CustomPreview(Geometry=geo_5, Shader=decodes_8.b)
