# Grasshopper definition graph_ca_experiment.ghx (Grasshopper 0.9.65)
# plug-ins: Decodes Python Interpreter

number_slider = Slider(2, range=0..10)
number_slider_2 = Slider(8, range=0..30)
recgrid = Rectangular(Plane=PlaneXY(0, 0, 0), SizeX=number_slider, SizeY=number_slider, ExtentX=number_slider_2, ExtentY=number_slider_2)  # -> Cells, Points
explode = Explode(Curve=recgrid.Cells, Recursive=True)  # -> flatten(Segments), Vertices

# ---- group: creates an initial condition
decodes = DecodesPythonScript(w=Slider(20, range=0..100), h=Slider(20, range=0..100))  # -> console, f_out; inputs w: Int32, h: Int32
# ---------- decodes: Python ----------
# initialize an instance of the CA object class
start_field = ValueField(Interval(w,h),include_corners = True,wrap = False)
# random.seed(0)

# for every pixel in the boolean field:
for i in range(w*h):
    start_field._pixels[i] = random.choice([True, False]) # randomly select True or False

f_out.put(start_field)
# ---------- end decodes ----------

# ----
data = Data(flatten(explode.Vertices))

# ----
# c
# game of life
# function
decodes_2 = DecodesPythonScript()  # -> console, func
# ---------- decodes_2: Python ----------
"""
Function to plat Conway's Game of Life
"""   

def life_rules(cur_val,nei_vals):
    # initialize counter for true values in the neighborhood
    count = 0
    
    # for each cell in the neighborhood:
    for i in nei_vals:
        # if cell is True:
        if i : 
            count += 1 # count it
            
    # if home cell is True:
    if cur_val:
        # if less than 2 or more than 3 neighbors are True:
        if (count < 2) or (count >3) :
            # this cell will be False in the next generation
            return False
        # else:
        else:
            # this cell will be True in the next generation
            return True
    # else the home cell is False:
    else:
        # if exactly 3 neighbors are True:
        if (count == 3):
            # this cell will be True in the next generation
            return True
        else:
            # else this cell will be False in the next generation
            return False

func.put(life_rules)
# ---------- end decodes_2 ----------
panel = Panel("maze_rules function")
decodes_3 = DecodesPythonScript()  # -> console, func
# ---------- decodes_3: Python ----------
"""
Function to create a maze out of an random boolean field based on algorithm 
published by Kostas Terzidis,"Algorithms for Visual Design", pp. 168-171
"""
def maze_rules(cur_val,nei_vals):
    # initialize the values
    nxt_val = cur_val
    count = 0 # counter for True cells in the neighborhood
    
    # for each cell in the neighborhood:
    for i in nei_vals:
        # if cell is True:
        if i : 
            count += 1 # count it
        
    # if there are 3 True cells in the neighborhood:
    if count == 3 : 
        # this cell will be True in the next generation
        nxt_val = True
    
    # if there are more than four True cells in the neighborhood:
    if count > 4: 
        # this cell eill be False in the next generation
        nxt_val = False
        
    # return the new value for the cell
    return nxt_val

func.put(maze_rules)
# ---------- end decodes_3 ----------

cullpt = CullDuplicates(Points=data, Tolerance=0.1, CullMode=3)  # -> Points, Indices, Valence

# ---- group: Graph_CA class
# a
decodes_4 = DecodesPythonScript()  # -> console, a
# ---------- decodes_4: Python ----------
# from ..core import *
# from ..core import dc_color, dc_base, dc_vec, dc_point, dc_cs, dc_line, dc_mesh, dc_pgon, dc_xform
import copy
print "graph_cellular_automata.py loaded"
# =========================================================

'''
Create a class that implements a simple, two-state cellular automata 

members:
pixel_res (Interval) The dimensions of the rectangular boundary of the model
corners (boolean) Does the neighborhood include 4 corner cells? (true=yes)
wrap (boolean) Do the boundaries of the model wrap? (true=yes)

methods:
set_cell (None) Set a given pixel to a given value
set_cells (None) Initializes a model with a list of boolean values
get_cell (boolean) Gets value of the pixel at a given location
get_cells (BoolField) Get all the cells in the model
set_rule (None) Set the CA rule to a given function
clear (None) Initialize the boolean field and clear the history
record (None) Append the current state of the model to the history.
step (None) Creates a new generation and performs reaction-diffusion algorithm to update the model.
to_pts (points) Creates a set of points representing the state of the model at a given time
'''

"""
A type is defined that stores u and v values for each location in two value fields, records the history 
of the model as it changes, and provides methods for reading, writing and clearing values.
"""

class Graph_CA (object):

    def __init__(self,graph = None):
        if graph == None:
            # initialize empty graph
            self.graph = Graph()
            self.step_count = 0
            self.hist = []
        else:
            self.graph = graph
            self.cells = graph.values
            self.len = len(graph.values)
            self.step_count = 0
            self.hist = []
    
    def set_cell(self,i,val):
        i = i % self.len
        self.cells.set(i,val)


# sets the entire field. Expects a list of values
    def set_cells(self, initial_cell=False):
        for n,value in enumerate(initial_cell):
            self.cells[n] = value
            
# pass a function to be used for each iteration of the automata
# assumes that function takes the status of the home cell, and a list of the statuses of the neighbors
# function returns the new value for the home cell
    def set_rule(self,func=False):
        self.rule = func
            
    def get_cell(self,i): return self.cells[i]

    def get_cells(self) : return self.cells           


    """
    [noprint]
    """
    def _reframe(self,x,y): # Not used
        while x > self.width -1 : x = x - self.width
        while y > self.height -1: y = y - self.height
        while x < 0 : x = self.width + x
        while y < 0 : y = self.height + y
        return x,y
    """
    Initialize and clear.
    """
    def clear(self, initial_val = None):
        if initial_val != None:
            self.cells = self.graph.values
        else:
            self.cells = [initial_val] * self.len
        self.step_count = 0
        self.hist = []
        
    """
    Methods for recording the current state of the model and creating a new generation.
    """
    def record(self):
        self.hist.append(self.cells)

    # makes a new generation by calling the function stored in self.rule
    def step(self, t=1.0):
        nxt_cells = copy.copy(self.graph.values)
        t = max(min(1.0,t),0.0)
        for i in range(0,self.len):
            cur_cell = self.cells[i]
            neighbor_cells = [self.cells[v] for v in self.graph.neighbors_of(i)]
            nxt_cell = self.rule(cur_cell, neighbor_cells)
            nxt_cells[i] = nxt_cell
        self.cells = nxt_cells
        self.step_count += 1
        

    """
    Creates a set of points representing the state of the model at a given time.
    """
    def to_pts(self, g=0, show_color = False):        
        
        # make sure that you do not select beyond the length of the CA's history
        select = g % len(self.hist)
        
        pt_list = []

        # iterate through the cell field for the selected generation
        # if the value of the cell is true, put a point in a
        # otherwise, put a point in b
        for i in range(self.len):
            new_pt = self.graph.nodes[i]
            if show_color:
                new_pt.set_color(self.hist[select].cell[i])
            pt_list.append(new_pt)
        return pt_list


# ========================================================================
a.put(Graph_CA)
# ---------- end decodes_4 ----------

# ----
lng = ListLength(List=cullpt.Points)
decodes_5 = DecodesPythonScript()  # -> console, a
# ---------- decodes_5: Python ----------
d = [13,5,6,10,11]

print len(d)

print range(len(d))
# ---------- end decodes_5 ----------

# ---- group: Graph class
# g
decodes_6 = DecodesPythonScript()  # -> console, a
# ---------- decodes_6: Python ----------
class Graph(object):
    """
    A simple undirected, weighted graph
    """
    def __init__(self):
        self.nodes = []
        self.edges = []
        self.values = []
    
    def add_node(self, node, value = 0):
        if not(node in self.nodes):
            self.nodes.append(node)
            self.values.append(value)
            self.edges.append([])
            
    def _index_of(self, node):
        if not(node in self.nodes):
            return -1
        else:
            return self.nodes.index(node)
            
    def neighbors_of(self, i = 0):
        return self.edges[i]

    def set_node(self, node, value = 0):
        self.values[node] = value

    def add_edge(self, from_node, to_node):
        if type(from_node) != int:
            i = self._index_of(from_node)
        else:
            i = from_node
        if type(to_node) != int:
            j = self._index_of(to_node)
        else:
            j = to_node
        if i == -1 or j == -1:
            return
        self._add_edge(i,j)
        self._add_edge(j,i)
 
    def _add_edge(self, from_node, to_node):
        #print "in _add_edge. called with ", from_node, to_node
        if not(to_node) in self.edges[from_node]:
            self.edges[from_node].append(to_node)
        if not(from_node) in self.edges[to_node]:
            self.edges[to_node].append(from_node)
        
    def node_to_lines(self, n):
        ret = []
        n = n % len(self.nodes)
        spt = self.nodes[n]
        for i in self.edges[n]:
            ret.append(Line(spt, self.nodes[i]))
        return ret
        
    def to_lines(self):
        ret = []
        for i in range(len(self.nodes)):
            spt = self.nodes[i]
            for j in self.edges[i]:
                if j > i:
                    ret.append(Line(spt, self.nodes[j]))
        return ret


a.put(Graph)
# ---------- end decodes_6 ----------

# ----
decodes_7 = DecodesPythonScript(pts=cullpt.Points, d=Slider(9, range=0..10))  # -> console, a; inputs pts: list
# ---------- decodes_7: Python ----------
lines = []

for i in range(len(pts)-1):
    for j in range(i+1,len(pts)):
        v = Vec(pts[i],pts[j])
        if v.length2 < d:
            a.put(Line(pts[i], pts[j]))
# ---------- end decodes_7 ----------
random = Random(Range=Domain(0, 1), Number=lng, Seed=Slider(0, range=0..1))
larger = LargerThan(FirstNumber=random, SecondNumber=Slider(0.7, range=0..1))  # -> LargerThan, OrEqualTo

# ---- group: create a graph
decodes_8 = DecodesPythonScript(Graph=decodes_6.a, lines=decodes_7.a, pts=cullpt.Points, val=larger.LargerThan)  # -> console, gr; inputs lines: list of Line, pts: list, val: list
# ---------- decodes_8: Python ----------
# test if pt is in graph
def in_graph(pt, g):
    ret = False
    for node in g.nodes:
        if pt == node:
            pt = node
            ret = True
    return ret, pt           


g = Graph()

# adds points to graph
pts = []

for line in lines:
    pt1 = line.spt
    pt2 = line.ept
    test, pt1 = in_graph(pt1,g)
    if not(test):
        g.add_node(pt1)
        pts.append(pt1)
    test, pt2 = in_graph(pt2,g)
    if not(test):
        g.add_node(pt2)
        pts.append(pt2)
    g.add_edge(pt1,pt2)

print g.nodes, g.edges

for pt in pts:
    if pt in g.nodes:
        n = g.nodes.index(pt)
        print n
        g.set_node(n, val[n])
    else:
        print "We have a problem."

#a.put(g.to_lines())

gr.put(g)
print g
# ---------- end decodes_8 ----------

# ----
life = DecodesPythonScript()  # -> console, a
# ---------- life: Python ----------
def func(home_val, nei_val):
    print "home value: ", home_val
    print "neighbor values: ", nei_val
    d = dict()
    d[True] = 0
    d[False] = 0
    for v in nei_val:
        if v not in d:
            d[v] = 1
        else:
            d[v] += 1
    print d
    if home_val:
        return (d[True] == 2 or d[True] == 3)
    else:
        return (d[True] == 3)


a.put(func)
# ---------- end life ----------
geo = Geometry([<curve referenced from the Rhino model> x32])
geo_2 = Geometry([<curve referenced from the Rhino model> x15])
growth = DecodesPythonScript()  # -> console, a
# ---------- growth: Python ----------
def func(home_val, nei_val):
    print "home value: ", home_val
    print "neighbor values: ", nei_val
    
    n_true = 0
    for i in nei_val:
        if i:
            n_true += 1
    print "True = ", n_true
    
    if n_true > 0 :
        return True
    else:
        return False

a.put(func)
# ---------- end growth ----------
growth_2 = DecodesPythonScript()  # -> console, a
# ---------- growth_2: Python ----------
# function will look at adjacent nodes, and build up based on the amount of building around it

max_floors = 10

def func(home_val, nei_val):
    print "home value: ", home_val
    print "neighbor values: ", nei_val
    
    # count up the value of all the adjacent nodes
    sum = 0
    for i in nei_val:
        sum += nei_val
        
    # determine whether we build up or not
    


a.put(func)
# ---------- end growth_2 ----------
geo_3 = Geometry(<curve referenced from the Rhino model>)
decodes_9 = DecodesPythonScript(Graph=decodes_6.a, lines=geo, val=larger.LargerThan)  # -> console, gr; inputs lines: list of Line, val: list
# ---------- decodes_9: Python ----------
# test if pt is in graph
def in_graph(pt, g):
    ret = False
    for node in g.nodes:
        if pt == node:
            pt = node
            ret = True
    return ret, pt           


g = Graph()

# adds points to graph
pts = []

for line in lines:
    pt1 = line.spt
    pt2 = line.ept
    test, pt1 = in_graph(pt1,g)
    if not(test):
        g.add_node(pt1)
        pts.append(pt1)
    test, pt2 = in_graph(pt2,g)
    if not(test):
        g.add_node(pt2)
        pts.append(pt2)
    g.add_edge(pt1,pt2)

print g.nodes, g.edges

for n in range(len(g.nodes)):
    if val[n]:
        g.set_node(n,1)
    else:
        g.set_node(n,0)

#a.put(g.to_lines())

gr.put(g)
print g
# ---------- end decodes_9 ----------

# ----
# b
slider = Slider(30, range=0..100)
panel_2 = Panel("generates history")
decodes_10 = DecodesPythonScript(Graph_CA=decodes_4.a, func=growth.a, g_in=decodes_9.gr, max_gen=slider, stepsize=Slider(1, range=1..100))  # -> console, ca_out, a, b; inputs max_gen: Int32, stepsize: Int32
# ---------- decodes_10: Python ----------
'''
4.02.L02b
Given a set of rules, the width and height of the cell field, and the number of generations, create a ca model with its time history.

in: 
func (function) A function for evaluating each cell 
w,h (integers) Width, height of boolean field 
max_gen (int) The number of generations for the algorithm to run.
stepsize (int) The number of generations to run before recording the state of the model.
select_step (int) The recorded step of the model to visualize.

out:
pts_true, pts_false (list of points) Lists representing true cells and false cells
'''

"""
Create a CA object, define an initial state, perform algorithm and visualize results.
"""

# initialize an instance of the CA object class
my_CA = Graph_CA(graph = g_in)
# random.seed(0)

# define the CA's rule
my_CA.set_rule(func)


# Create a starting position
#start_field= [] # start with empty boolean field

# for every pixel in the boolean field:
#for i in range(w*h):
#    start_field.append(random.choice([0,1,2,3])) # randomly select True or False
#my_CA.set_cells(start_field) # set field to the new boolean field

# for every generation to be produced:
for n in range(max_gen):
    # if generation should be recorded:
    if n % stepsize == 0:

        # record the state of the CA model
        my_CA.record() 
    my_CA.step() # update the CA model
    
# get True and False points from the CA model for a given generation
# points = my_CA.to_pts(select_step)

# ====================================================
# a.put(points[0])
# b.put(points[1])

print len(my_CA.hist)
print my_CA.hist

ca_out.put(my_CA)
# ---------- end decodes_10 ----------

decodes_11 = DecodesPythonScript(Graph=decodes_6.a, shapes=geo_2, val=larger.LargerThan)  # -> console, gr; inputs shapes: list of Polyline, val: list
# ---------- decodes_11: Python ----------
# test if pt is in graph
def in_graph(pt, g):
    ret = False
    for node in g.nodes:
        if pt == node:
            pt = node
            ret = True
    return ret, pt           


g = Graph()

print shapes[1].overlaps(shapes[0])

# adds points to graph
pts = []

for shape in shapes:
    g.add_node(Point.centroid(shape.pts))

print g.nodes, g.edges

for i in range(len(shapes)-1):
    for j in range(i+1,len(shapes)):
        if shapes[i].overlaps(shapes[j]):
            g.add_edge(i,j)



print g.nodes, g.edges

for n in range(len(g.nodes)):
    g.set_node(n, val[n])

#a.put(g.to_lines())

gr.put(g)
print g
# ---------- end decodes_11 ----------
geo_4 = Geometry(<curve referenced from the Rhino model>)
decodes_12 = DecodesPythonScript(lin1=geo_3, lin2=geo_4)  # -> console, a; inputs lin1: Line, lin2: Line
# ---------- decodes_12: Python ----------
vec1 = Vec(lin1.spt,lin1.ept)

vec2 = Vec(lin2.spt,lin2.ept)

print vec1.angle_deg(vec2)
# ---------- end decodes_12 ----------
decodes_13 = DecodesPythonScript(g_in=decodes_11.gr)  # -> console, a, b
# ---------- decodes_13: Python ----------
a.put(g_in.nodes)

b.put(g_in.to_lines())
# ---------- end decodes_13 ----------
panel_3 = Panel(decodes_12.console)
decodes_14 = DecodesPythonScript(gr_in=decodes_9.gr, n=Slider(7, range=0..50))  # -> console, a, b, c, d, f; inputs n: Int32
# ---------- decodes_14: Python ----------
dir = gr_in.edges[n][0]
dir_node = gr_in.nodes[dir]
dir_vec = Vec(gr_in.nodes[n],dir_node)
print gr_in.nodes[n], dir, dir_node, dir_vec

max_ang = 0
max_node = n

for i in range(len(gr_in.edges[n])):
    if i != n:
        test_node = gr_in.edges[n][i]
        ang = dir_vec.angle(Vec(gr_in.nodes[n],gr_in.nodes[test_node]))
        if ang > max_ang:
            max_ang = ang
            max_node = test_node


print max_ang, max_node

a.put(gr_in.nodes[n])
b.put(Segment(gr_in.nodes[n], dir_node))
c.put(Segment(gr_in.nodes[n], gr_in.nodes[max_node]))

# go through list of neighbors and put them into new lists for each new node
edges_n1 = []
edges_n2 = []
half_pi = math.pi/2
max_vec = Vec(gr_in.nodes[n], gr_in.nodes[max_node])
for i in range(len(gr_in.edges[n])):
    if i != n:
        test_node = gr_in.edges[n][i]
        ang1 = dir_vec.angle(Vec(gr_in.nodes[n],gr_in.nodes[test_node]))
        if ang1 <= half_pi:
            edges_n1.append(test_node)
        ang2 = max_vec.angle(Vec(gr_in.nodes[n],gr_in.nodes[test_node]))
        if ang2 <= half_pi:
            edges_n2.append(test_node)
            
            
print edges_n1, edges_n2
for e in edges_n1:
    d.put(gr_in.nodes[e])
    
for e in edges_n2:
    f.put(gr_in.nodes[e])

# remove references to n
neighbors = gr_in.edges[n]
for nei in neighbors:
    if n in gr_in.edges[nei]:
        gr_in.edges[nei].remove(n)

home_node = Point(gr_in.nodes[n].x,gr_in.nodes[n].y, gr_in.nodes[n].z)

gr_in.nodes[n] = home_node + dir_vec/3
# ---------- end decodes_14 ----------
Z = UnitZ(Factor=Slider(6, range=0..10))

# ---- group: wild growth
decodes_15 = DecodesPythonScript()  # -> console, func
# ---------- decodes_15: Python ----------
"""
Color CA Rules
"""

unbuilt_clr = Color(1.0,1.0,1.0)
access_clr = Color(1.0,.9529,0.6353)
built_clr = Color(0.0,0.0,0.0)

def wg_rules(home_clr,neighbor_clrs):
    # set up the new color for home cell
    new_clr = home_clr

    # if home cell is unbuilt:
    if home_clr == unbuilt_clr:
        count = 0 # counter for access cells in neighborhood

        # for each cell in the neighborhood:
        for neighbor_clr in neighbor_clrs:
            if neighbor_clr == access_clr: 
                count += 1 # count it

        # if there is access in neighborhood
        if count > 0 : 
            # this cell will change to either built or access
            if random.random() > .5:
                new_clr = built_clr
            else:
                new_clr = access_clr

    return new_clr

func.put(wg_rules)
# ---------- end decodes_15 ----------
decodes_16 = DecodesPythonScript()  # -> console, func
# ---------- decodes_16: Python ----------
"""
Color CA Rules
"""

unbuilt_clr = Color(1.0,1.0,1.0)
access_clr = Color(1.0,.9529,0.6353)
built_clr = Color(0.0,0.0,0.0)

def wg_rules(home_clr,neighbor_clrs):
    # set up the new color for home cell
    new_clr = home_clr

    # if home cell is unbuilt:
    if home_clr == unbuilt_clr:
        count = 0 # counter for access cells in neighborhood

        # for each cell in the neighborhood:
        for neighbor_clr in neighbor_clrs:
            if neighbor_clr == access_clr: 
                count += 1 # count it

        # if there is access in neighborhood
        if count > 0 : 
            chance = .1 + count * .2
            if chance > 1.0:
                chance = 1.0
            # this cell will change to either built or access
            if random.random() < chance:
                new_clr = built_clr
            else:
                new_clr = access_clr

    return new_clr

func.put(wg_rules)
# ---------- end decodes_16 ----------
decodes_17 = DecodesPythonScript()  # -> console, func
# ---------- decodes_17: Python ----------
"""
Color CA Rules
"""

empty_clr = Color(1.0,1.0,1.0)
access_clr = Color(1.0,.9529,0.6353)
built_clr = Color(0.0,0.0,0.0)
openspace_clr = Color(0,1.0,0.588)


# directions
nw,n = 2,4
ne = 7
e = 6
se = 5
s = 3
sw = 0
w = 1

def wg_rules(home_clr,neighbor_clrs):
    # set up the new color for home cell
    new_clr = home_clr
    
    
    if home_clr == empty_clr:
        # if there is a building south of me:
        if neighbor_clrs[s] == built_clr:
            # make me open space
            new_clr = openspace_clr
        else:
            # if there is access in the neighborhood
            if access_clr in neighbor_clrs:
                new_clr = random.choice([access_clr, built_clr])

    return new_clr

func.put(wg_rules)
# ---------- end decodes_17 ----------

# ----
extr = Extrude(Base=[decodes_14.b, decodes_14.c], Direction=Z)
circle = CircleCNR(Center=decodes_14.a, Normal=Vector(0, 0, 1), Radius=3)
geo_5 = Geometry(decodes_14.d)
geo_6 = Geometry(decodes_14.f)

# ---- group: color mix
decodes_18 = DecodesPythonScript()  # -> console, func
# ---------- decodes_18: Python ----------
"""
Color CA Rules
"""

empty_clr = Color(1.0,1.0,1.0)
access_clr = Color(1.0,.9529,0.6353)
built_clr = Color(0.0,0.0,0.0)

def wg_rules(home_clr,neighbor_clrs):
    # set up the new color for home cell
    new_clr = home_clr
    new_clr = Color.average(neighbor_clrs)

    return new_clr

func.put(wg_rules)
# ---------- end decodes_18 ----------
decodes_19 = DecodesPythonScript()  # -> console, func
# ---------- decodes_19: Python ----------
"""
Color CA Rules
"""

empty_clr = Color(1.0,1.0,1.0)
access_clr = Color(1.0,.9529,0.6353)
built_clr = Color(0.0,0.0,0.0)

def wg_rules(home_clr,neighbor_clrs):
    # set up the new color for home cell
    new_clr = home_clr
    #color_list = [neighbor_clrs[0],neighbor_clrs[0],neighbor_clrs[1],neighbor_clrs[1],neighbor_clrs[3]]
    #color_list = [neighbor_clrs[1],neighbor_clrs[3],neighbor_clrs[4],neighbor_clrs[6]]
    #color_list = [neighbor_clrs[0],neighbor_clrs[1],neighbor_clrs[2]]
    color_list = neighbor_clrs
    color_list.extend([neighbor_clrs[3],neighbor_clrs[4]])
    new_clr = Color.average(color_list)

    return new_clr

func.put(wg_rules)
# ---------- end decodes_19 ----------
decodes_20 = DecodesPythonScript()  # -> console, func
# ---------- decodes_20: Python ----------
"""
Color CA Rules
"""

empty_clr = Color(1.0,1.0,1.0)
access_clr = Color(1.0,.9529,0.6353)
built_clr = Color(0.0,0.0,0.0)



def wg_rules(home_clr,neighbor_clrs):
    # set up the new color for home cell
    new_clr = home_clr
    # average your non-empty neighbors
    color_list = [clr for clr in neighbor_clrs if not clr==empty_clr]
    #for neighbor in neighbor_clrs:
    #    if not(neighbor == empty_clr):
    #        color_list.append(neighbor)
    new_clr = Color.average(color_list)

    return new_clr

func.put(wg_rules)
# ---------- end decodes_20 ----------

# ----
decodes_21 = DecodesPythonScript()  # -> console, a
# ---------- decodes_21: Python ----------
v = [Color(1.0),Color(0.0)]

c = Color.average(v)


print v, c

print Color(1.0) != Color(0)
# ---------- end decodes_21 ----------

select = Slider(0, range=0..100)
decodes_22 = DecodesPythonScript(ca_in=decodes_10.ca_out, select_step=select)  # -> console, a, b, c; inputs select_step: Int32
# ---------- decodes_22: Python ----------
select_step = select_step % len(ca_in.hist)

points = ca_in.to_pts(select_step)
a.put(points)

step = ca_in.hist[select_step]
print step

for s in step:
    if s:
        b.put(Color(0.0))
    else:
        b.put(Color(1.0))

#b.put(ca_in.hist[select_step])

res = [[],[]]
for n in range(len(step)):
    res[step[n]].append(points[n])
    
c.put(res)
# ---------- end decodes_22 ----------
cell_size = Slider(1, range=0..10)
division = Division(A=cell_size, B=1)
multiplication = Multiplication(A=decodes_22.a, B=cell_size)
box = CenterBox(Base=multiplication, X=division, Y=division, Z=0)

decodes_23 = DecodesPythonScript()  # -> console, func
# ---------- decodes_23: Python ----------
"""
Color CA Rules
"""

white = Color(1.0,1.0,1.0)
black = Color(0.0,0.0,0.0)

# note: assumes gray scale! r=g=b

def wg_rules(home_clr,neighbor_clrs):
    # set up the new color for home cell
    new_clr = home_clr

    num_darker = 0
    num_lighter = 0
    for neighbor in neighbor_clrs:
        if neighbor.r < home_clr.r:
            num_darker += 1
        else:
            num_lighter += 1
    
    # if more neighbors are darker:
    if num_darker > num_lighter:
        new_clr = Color.interpolate(new_clr, black)
    else:
        new_clr = Color.interpolate(new_clr, white)

    return new_clr

func.put(wg_rules)
# ---------- end decodes_23 ----------
panel_4 = Panel(decodes_22.c)
panel_5 = Panel(decodes_22.console)
bang = ExplodeTree(Data=decodes_22.c)  # -> Branch0, Branch1
voronoi = Voronoi(Points=decodes_22.a, BruteForceOverride=False)
preview = CustomPreview(Geometry=box, Shader=decodes_22.b)
panel_6 = Panel(bang.Branch0)
